# Dynamo graph 0.Авторазмер-между-сеткой витража0.2.dyn (Dynamo 1.3.2.2480)

# note: ВСЁ ОСТАЛЬНОЕ

# group: ЗАПАСНЫЕ ВАРИАНТЫ, ДОПОЛНИТЕЛЬНЫЕ ОПЦИИ
# note: ЗАПАСНЫЕ
# note: ДОПОЛНИТЕЛЬНЫЕ. Градации серово по важности, темнее - важнее

# group: ЭЛЕМЕНТЫ УПРАВЛЕНИЯ Dyno Studio
# note: Dyno Studio

# group: КЛЮЧЕВЫЕ МОМЕНТЫ РАБОТЫ 1
# note: ИТОГОВАЯ КОНСОЛИДАЦИЯ ДАННЫХ

# group: КЛЮЧЕВЫЕ МОМЕНТЫ РАБОТЫ 2
# note: ИСПОЛНИТЕЛЬНЫЕ НОДЫ
# note: НОДЫ РАБОТАЮЩИЕ С ДАННЫМИ

# group: ИСПОЛНИТЕЛЬНЫЕ НОДЫ (фильтрование, подбор, списки и т.д.)
# note: ИСПОЛНИТЕЛЬНЫЕ НОДЫ
# note: НОДЫ РАБОТАЮЩИЕ С ДАННЫМИ

# group: ЭЛЕМЕНТЫ УПРАВЛЕНИЯ 2 УРОВЕНЬ
# note: ЭЛЕМЕНТЫ УПРАВЛЕНИЯ
# note: ПЕРЕМЕННЫЕ ЗНАЧЕНИЯ

# group: ЭЛЕМЕНТЫ УПРАВЛЕНИЯ
# note: ПЕРЕМЕННЫЕ ЗНАЧЕНИЯ
# note: ЭЛЕМЕНТЫ УПРАВЛЕНИЯ

# group: ПОЛУЧАЕМ ДАННЫЕ ИЗ РЕВИТ
# note: ПОЛУЧАЕМ ДАННЫЕ ИЗ РЕВИТ

# group: ПРОВЕРОЧНЫЕ НОДЫ
# note: ПРОВЕРОЧНЫЕ НОДЫ

# group: ПЕРЕДАЁМ ИНФОРМАЦИЮ В РЕВИТ
# note: ПЕРЕДАЁМ ИНФОРМАЦИЮ В РЕВИТ

# group: ПРИМЕЧАНИЯ ПО ЦВЕТОВОЙ ГРУППИРОВКЕ
# note: GUIDELINES

forceChildrensEval = ForceChildrensEval()  # unwired: arg0
только_по_импостам_по_всей_сетке = BoolSelector(true)

# group: Выбор рамкой ревита
forceChildrensEval_2 = ForceChildrensEval()  # unwired: arg0
pys_get_revit_selection = Python(IN[0]=forceChildrensEval_2)
# ---------- pys_get_revit_selection.python (22 lines) ----------
import clr
clr.AddReference('RevitServices')
clr.AddReference('RevitAPI')
from Autodesk.Revit.DB import *
import RevitServices
from RevitServices.Persistence import DocumentManager
from Autodesk.Revit.ApplicationServices import Application

reset = IN[0]

doc = DocumentManager.Instance.CurrentDBDocument
uidoc = DocumentManager.Instance.CurrentUIApplication.ActiveUIDocument
ids = uidoc.Selection.GetElementIds()

idd = [str(i) for i in ids]

if isinstance(idd, list) == True:
	elems = [doc.GetElement(ElementId(int(i))) for i in idd]
else:
	elems = doc.GetElement(ElementId(int(idd)))

OUT = elems
# ----------------------------------------

getCategory = Element.GetCategory(pys_get_revit_selection)
string_from_object = FromObject(getCategory)
code_block = CodeBlock { "Схемы разрезки витражей"; }
contains = String.Contains(str=string_from_object, searchFor=code_block)
filterByBoolMask = List.FilterByBoolMask(list=pys_get_revit_selection, mask=contains)
fullCurve = Python(IN[0]=filterByBoolMask.in)  # "CurtainGrid.FullCurve"
# ---------- fullCurve.python (32 lines) ----------
import clr
clr.AddReference('RevitAPI')
from Autodesk.Revit.DB import *
import Autodesk

clr.AddReference("RevitNodes")
import Revit
clr.ImportExtensions(Revit.GeometryConversion)

clr.AddReference("RevitServices")
import RevitServices
from RevitServices.Persistence import DocumentManager

doc = DocumentManager.Instance.CurrentDBDocument

#The inputs to this node will be stored as a list in the IN variable.
dataEnteringNode = IN

#unwrap all elements to use with API
items = UnwrapElement(IN[0])

#apply API method to list
typelist = list()
for i in items:
	try:
		typelist.append(i.FullCurve.ToProtoType())
	except:
		typelist.append(list())


#Assign your output to the OUT variable
OUT = typelist
# ----------------------------------------
byGeometry = BoundingBox.ByGeometry(fullCurve@L1)
type = Object.Type(pys_get_revit_selection)
code_block_2 = CodeBlock { "Mullion"; }
contains_2 = String.Contains(str=type, searchFor=code_block_2)
filterByBoolMask_2 = List.FilterByBoolMask(list=pys_get_revit_selection, mask=contains_2)
locationCurve = Mullion.LocationCurve(filterByBoolMask_2.in)
byGeometry_2 = BoundingBox.ByGeometry(locationCurve@L1)
intersects = BoundingBox.Intersects(byGeometry, byGeometry_2, lacing=CrossProduct)
allFalse = AllFalse(intersects@L2)
filterByBoolMask_3 = List.FilterByBoolMask(list=filterByBoolMask.in, mask=allFalse)
if_ = Python(IN[0]=только_по_импостам_по_всей_сетке, IN[1]=filterByBoolMask_3.out, IN[2]=filterByBoolMask.in)
# ---------- if_.python (12 lines) ----------
import clr
boolean = IN[0]
true = UnwrapElement(IN[1])
false = UnwrapElement(IN[2])

if boolean:
	out = true
else:
	out = false

#Назначьте вывод переменной OUT.
OUT = out
# ----------------------------------------
размер_по_сетке_витража = Python(IN[0]=forceChildrensEval, IN[1]=if_)  # "РАЗМЕР ПО СЕТКЕ ВИТРАЖА (CurtainGridLine) цепляет невидимые линии сетки"
# ---------- размер_по_сетке_витража.python (69 lines) ----------
import clr
clr.AddReference('RevitAPI')
from Autodesk.Revit.DB import *

clr.AddReference('RevitNodes')
import Revit
clr.ImportExtensions(Revit.GeometryConversion)
clr.ImportExtensions(Revit.Elements)

clr.AddReference('RevitServices')
import RevitServices
from RevitServices.Persistence import DocumentManager
from RevitServices.Transactions import TransactionManager

clr.AddReference('ProtoGeometry')
#from Autodesk.DesignScript.Geometry import *
import Autodesk.DesignScript.Geometry as ge # ИБО КОНФЛИКТ REFERENCE !!!!!!!!

doc = DocumentManager.Instance.CurrentDBDocument 

inc = 304.8
list = UnwrapElement(IN[1])
Ref = ReferenceArray()
lengths = []

opt = Options()
opt.ComputeReferences = True
opt.IncludeNonVisibleObjects = True
opt.View = doc.ActiveView

leng = len(list)

l1 = list[0]
l2 = list[1]



# линия размера по первому и последнему элементу
curve1 = l1.FullCurve.ToProtoType()
curve2 = l2.FullCurve.ToProtoType()

pt1=curve1.PointAtParameter(0.5)
pt2=curve2.PointAtParameter(0.5)

line= ge.Line.ByStartPointEndPoint(pt1,pt2).ToRevitType()
# линия размера по первому и последнему элементу



# создаём список элементов референс, для размещения размеров
for grid in list:
	for obj in grid.get_Geometry(opt):
		if isinstance(obj, Line):
			gline = obj
			Ref.Append(gline.Reference)
# создаём список элементов референс, для размещения размеров


TransactionManager.Instance.EnsureInTransaction(doc)

newdim = doc.Create.NewDimension(doc.ActiveView, line, Ref).ToDSType(False)

TransactionManager.Instance.TransactionTaskDone()

OUT=newdim

"""
OUT=line
"""
# ----------------------------------------
