# Dynamo graph 0.Авторазмер-между-стенами-и-осями.dyn (Dynamo 1.3.2.2480)

# note: ВСЁ ОСТАЛЬНОЕ

# group: ЗАПАСНЫЕ ВАРИАНТЫ, ДОПОЛНИТЕЛЬНЫЕ ОПЦИИ
# note: ДОПОЛНИТЕЛЬНЫЕ. Градации серово по важности, темнее - важнее
# note: ЗАПАСНЫЕ

# group: КЛЮЧЕВЫЕ МОМЕНТЫ РАБОТЫ 2
# note: НОДЫ РАБОТАЮЩИЕ С ДАННЫМИ
# note: ИСПОЛНИТЕЛЬНЫЕ НОДЫ

# group: КЛЮЧЕВЫЕ МОМЕНТЫ РАБОТЫ 1
# note: ИТОГОВАЯ КОНСОЛИДАЦИЯ ДАННЫХ

# group: ИСПОЛНИТЕЛЬНЫЕ НОДЫ (фильтрование, подбор, списки и т.д.)
# note: ИСПОЛНИТЕЛЬНЫЕ НОДЫ
# note: НОДЫ РАБОТАЮЩИЕ С ДАННЫМИ

# group: ЭЛЕМЕНТЫ УПРАВЛЕНИЯ Dyno Studio
# note: Dyno Studio

# group: ЭЛЕМЕНТЫ УПРАВЛЕНИЯ 2 УРОВЕНЬ
# note: ЭЛЕМЕНТЫ УПРАВЛЕНИЯ
# note: ПЕРЕМЕННЫЕ ЗНАЧЕНИЯ

# group: ЭЛЕМЕНТЫ УПРАВЛЕНИЯ
# note: ПЕРЕМЕННЫЕ ЗНАЧЕНИЯ
# note: ЭЛЕМЕНТЫ УПРАВЛЕНИЯ

# group: ПОЛУЧАЕМ ДАННЫЕ ИЗ РЕВИТ
# note: ПОЛУЧАЕМ ДАННЫЕ ИЗ РЕВИТ

# group: ПРОВЕРОЧНЫЕ НОДЫ
# note: ПРОВЕРОЧНЫЕ НОДЫ

# group: ПЕРЕДАЁМ ИНФОРМАЦИЮ В РЕВИТ
# note: ПЕРЕДАЁМ ИНФОРМАЦИЮ В РЕВИТ

# group: ПРИМЕЧАНИЯ ПО ЦВЕТОВОЙ ГРУППИРОВКЕ
# note: GUIDELINES

select_model_elements = DSModelElementsSelection()  # 29 picked in the model
string_from_object = FromObject(select_model_elements)
code_block = CodeBlock { "Group"; }
contains = String.Contains(str=string_from_object, searchFor=code_block)
filterByBoolMask = List.FilterByBoolMask(list=select_model_elements, mask=contains)
setParameterByName = Element.SetParameterByName()  # unwired: element, parameterName, value
getParameterValueByName = Element.GetParameterValueByName()  # unwired: element, parameterName
geometry = Element.Geometry()  # unwired: arg0
boolean = BoolSelector(true)  # frozen
code_block_2 = CodeBlock { 1; 2; }
if_ = Python(IN[0]=boolean, IN[1]=code_block_2.out0, IN[2]=code_block_2.out1)
# ---------- if_.python (12 lines) ----------
import clr
boolean = IN[0]
true = UnwrapElement(IN[1])
false = UnwrapElement(IN[2])

if boolean:
	out = true
else:
	out = false

#Назначьте вывод переменной OUT.
OUT = out
# ----------------------------------------

# group: Get Revit Selection:
forceChildrensEval = ForceChildrensEval()  # frozen; unwired: arg0
pys_get_revit_selection = Python(IN[0]=forceChildrensEval)
# ---------- pys_get_revit_selection.python (22 lines) ----------
import clr
clr.AddReference('RevitServices')
clr.AddReference('RevitAPI')
from Autodesk.Revit.DB import *
import RevitServices
from RevitServices.Persistence import DocumentManager
from Autodesk.Revit.ApplicationServices import Application

reset = IN[0]

doc = DocumentManager.Instance.CurrentDBDocument
uidoc = DocumentManager.Instance.CurrentUIApplication.ActiveUIDocument
ids = uidoc.Selection.GetElementIds()

idd = [str(i) for i in ids]

if isinstance(idd, list) == True:
	elems = [doc.GetElement(ElementId(int(i))) for i in idd]
else:
	elems = doc.GetElement(ElementId(int(idd)))

OUT = elems
# ----------------------------------------

# group: Parameters name from language
parameters_name_from_language = Python()
# ---------- parameters_name_from_language.python (18 lines) ----------
import clr
clr.AddReference('RevitServices')
import RevitServices
from RevitServices.Persistence import DocumentManager

uiapp = DocumentManager.Instance.CurrentUIApplication
app = uiapp.Application
lng = app.Language
rus = ["Тип","Имя семейства","Имя типа"]
enu = ["Type","Family name","Type name"]
out = []
if str(lng) == "Russian":
	out = rus
else:
	out = enu
#English_USA
#Russian
OUT = out
# ----------------------------------------

flatten = Flatten(select_model_elements)
getCategory = Element.GetCategory(flatten)
string_from_object_2 = FromObject(getCategory)
code_block_3 = CodeBlock(x=string_from_object_2, x1=string_from_object_2) { x == "Стены"; x1 == "Оси"; }
filterByBoolMask_2 = List.FilterByBoolMask(list=flatten, mask=code_block_3.out0)
filterByBoolMask_3 = List.FilterByBoolMask(list=flatten, mask=code_block_3.out1)
create = List.Create(filterByBoolMask_2.in, filterByBoolMask_3.in)
flatten_2 = Flatten(create)
forceChildrensEval_2 = ForceChildrensEval()  # unwired: arg0
python_script = Python(IN[0]=flatten_2, IN[1]=forceChildrensEval_2)
# ---------- python_script.python (81 lines) ----------
import clr
clr.AddReference('RevitAPI')
from Autodesk.Revit.DB import *

clr.AddReference('RevitNodes')
import Revit
clr.ImportExtensions(Revit.GeometryConversion)
clr.ImportExtensions(Revit.Elements)

clr.AddReference('RevitServices')
import RevitServices
from RevitServices.Persistence import DocumentManager
from RevitServices.Transactions import TransactionManager

clr.AddReference('ProtoGeometry')
#from Autodesk.DesignScript.Geometry import *
import Autodesk.DesignScript.Geometry as ge # ИБО КОНФЛИКТ REFERENCE !!!!!!!!

doc = DocumentManager.Instance.CurrentDBDocument 

walls=[]
grids=[]
lengths=[]
inc = 304.8
for i in IN[0]:
	typename = i.GetType().Name
	if typename == "Wall":
		walls.append(i)
		lengths.append(UnwrapElement(i).Location.Curve.Length * 304.8)
	elif typename == "Grid":
		grids.append(i)
	else:
		pass

for i in walls:
	if (UnwrapElement(i).Location.Curve.Length * 304.8) == min(lengths):
		shortWall = i


curve = UnwrapElement(shortWall).Location.Curve.ToProtoType()
pt0=curve.PointAtParameter(0.5)
x0 = curve.PointAtParameter(0).X
x1 = curve.PointAtParameter(1).X
y0 = curve.PointAtParameter(0).Y
y1 = curve.PointAtParameter(1).Y
if abs(y0-y1)<10:
	pt1= ge.Point.ByCoordinates(pt0.X, pt0.Y+1000, pt0.Z)
	line= ge.Line.ByStartPointEndPoint(pt0,pt1).ToRevitType()
elif abs(x0-x1)<10:
	pt1= ge.Point.ByCoordinates(pt0.X+1000, pt0.Y, pt0.Z)
	line= ge.Line.ByStartPointEndPoint(pt0,pt1).ToRevitType()


walls = UnwrapElement(walls)
grids = UnwrapElement(grids)
Ref = ReferenceArray()
opt = Options()
opt.ComputeReferences = True
opt.IncludeNonVisibleObjects = True
opt.View = doc.ActiveView

for grid in grids:
	for obj in grid.get_Geometry(opt):
		if isinstance(obj, Line):
			gline = obj
			Ref.Append(gline.Reference)
		
for element in walls:
	a = HostObjectUtils.GetSideFaces(element, ShellLayerType.Exterior)
	for i in a:
		Ref.Append(i)
	b = HostObjectUtils.GetSideFaces(element, ShellLayerType.Interior)
	for i in b:
		Ref.Append(i)

TransactionManager.Instance.EnsureInTransaction(doc)

newdim = doc.Create.NewDimension(doc.ActiveView, line, Ref).ToDSType(False)

TransactionManager.Instance.TransactionTaskDone()
OUT=newdim
# ----------------------------------------
code_block_4 = CodeBlock(result=python_script) { result; }
минимальный_размер = IntegerSlider(1000, range=0..5000 step 100)
смещение_по_x = IntegerSlider(400, range=-5000..5000 step 100)
смещение_по_y = IntegerSlider(400, range=-5000..5000 step 100)
python_script_2 = Python(IN[0]=code_block_4, IN[1]=минимальный_размер, IN[2]=смещение_по_x, IN[3]=смещение_по_y)
# ---------- python_script_2.python (179 lines) ----------
import clr
clr.AddReference('RevitAPI')
from Autodesk.Revit.DB import *

clr.AddReference('RevitNodes')
import Revit
clr.ImportExtensions(Revit.GeometryConversion)
clr.ImportExtensions(Revit.Elements)

clr.AddReference('RevitServices')
import RevitServices
from RevitServices.Persistence import DocumentManager
from RevitServices.Transactions import TransactionManager

doc = DocumentManager.Instance.CurrentDBDocument

dims = UnwrapElement(IN[0])

min = IN[1]/304.80
xo1 = IN[2]/304.80
yo1 = IN[3]/304.80



listx = []
dimseg = []
prnt = []
prnt1 = []
dimseglist = []
dimseglist = dims.Segments
viewM = doc.ActiveView.LookupParameter("Масштаб вида").AsInteger()
k = dims.DimensionType.LookupParameter("Размер текста").AsDouble()*viewM*10


TransactionManager.Instance.EnsureInTransaction(doc) 
for dmr in dimseglist:
	dmr.ResetTextPosition() #Возвращаем текст в первоначальное положение
TransactionManager.Instance.TransactionTaskDone()

xt0 = dimseglist[0].TextPosition.X
xt1 = dimseglist[1].TextPosition.X
yt0 = dimseglist[0].TextPosition.Y
yt1 = dimseglist[1].TextPosition.Y
testxy = [xt0,xt1,yt0,yt1]

for x,dim in enumerate(dimseglist):
	dimseg.append(dim)
	listx.append(x)
	#dim.ResetTextPosition
#prnt1 = [int(yt0), int(yt1)]	
prnt1 = ["значение сегмента=", dimseglist[1].Value, "минимум в дюймах=", min, "минимум на коф. в дюймах=", min*k, "количество размеров в цепи=", len(dimseg), "значение координат первых двух элементов", testxy]
prnt.append(prnt1)#, dimseg, listx


TransactionManager.Instance.EnsureInTransaction(doc)
#для горизонтальных размеров

if int(yt0) == int(yt1) and int(xt0) >= int(xt1):
	for x,dim in enumerate(dimseg):
		x1=dim.TextPosition.X
		y1=dim.TextPosition.Y
		if dim.Value <= min and x == 0: #Обработка первого сегмента
			dim.TextPosition = XYZ(x1+xo1,y1,0) #Обработка первого сегмента
			continue
		elif dim.Value <= min:
			if x != len(dimseg)-1:
				if dimseg[x+1].Value > k:
					dim.TextPosition = XYZ(x1-xo1,y1,0)
					continue
				elif x != 0:	
					if dimseg[x-1].Value > k:
						dim.TextPosition = XYZ(x1+xo1,y1,0)
						continue
					elif x != len(dimseg)-2:
						if dimseg[x+2].Value <= min:
							dim.TextPosition = XYZ(x1-xo1,y1+yo1,0)
						else:
							dim.TextPosition = XYZ(x1+xo1,y1+yo1,0)
					else:
						dim.TextPosition = XYZ(x1+xo1,y1,0)
				else:
					dim.TextPosition = XYZ(x1+xo1,y1+yo1,0)
			else: 
				dim.TextPosition = XYZ(x1-xo1,y1,0) #Обработка последнего сегмента
		else:
			pass	
elif int(yt0) == int(yt1) and int(xt0) <= int(xt1):
	for x,dim in enumerate(dimseg):
		x1=dim.TextPosition.X
		y1=dim.TextPosition.Y
		if dim.Value <= min and x == 0: #Обработка первого сегмента
			dim.TextPosition = XYZ(x1-xo1,y1,0) #Обработка первого сегмента
			continue
		elif dim.Value <= min:
			if x != len(dimseg)-1:
				if dimseg[x+1].Value > k:
					dim.TextPosition = XYZ(x1+xo1,y1,0)
					continue
				elif x != 0:	
					if dimseg[x-1].Value > k:
						dim.TextPosition = XYZ(x1-xo1,y1,0)
						continue
					elif x != len(dimseg)-2:
						if dimseg[x+2].Value <= min:
							dim.TextPosition = XYZ(x1+xo1,y1+yo1,0)
						else:
							dim.TextPosition = XYZ(x1-xo1,y1+yo1,0)
					else:
						dim.TextPosition = XYZ(x1-xo1,y1,0)
				else:
					dim.TextPosition = XYZ(x1-xo1,y1+yo1,0)
			else: 
				dim.TextPosition = XYZ(x1+xo1,y1,0) #Обработка последнего сегмента
		else:
			pass				
#для вертикальных размеров
elif int(yt0) >= int(yt1):
	for x,dim in enumerate(dimseg):
		x1=dim.TextPosition.X
		y1=dim.TextPosition.Y
		if dim.Value <= min and x == 0: #Обработка первого сегмента
			dim.TextPosition = XYZ(x1,y1+yo1,0) #Обработка первого сегмента
			continue
		elif dim.Value <= min:
			if x != len(dimseg)-1:
				if dimseg[x+1].Value > k:
					dim.TextPosition = XYZ(x1,y1-yo1,0)
					continue
				elif x != 0:	
					if dimseg[x-1].Value > k:
						dim.TextPosition = XYZ(x1,y1+yo1,0)
						continue
					elif x != len(dimseg)-2:
						if dimseg[x+2].Value <= min:
							dim.TextPosition = XYZ(x1-xo1,y1-yo1,0)
						else:
							dim.TextPosition = XYZ(x1-xo1,y1+yo1,0)
					else:
						dim.TextPosition = XYZ(x1,y1+yo1,0)
				else:
					dim.TextPosition = XYZ(x1-xo1,y1+yo1,0)
			else: 
				dim.TextPosition = XYZ(x1,y1-yo1,0) #Обработка последнего сегмента
		else:
			pass	
else:
	for x,dim in enumerate(dimseg):
		x1=dim.TextPosition.X
		y1=dim.TextPosition.Y
		if dim.Value <= min and x == 0: #Обработка первого сегмента
			dim.TextPosition = XYZ(x1,y1-yo1,0) #Обработка первого сегмента
			continue
		elif dim.Value <= min:
			if x != len(dimseg)-1:
				if dimseg[x+1].Value > k:
					dim.TextPosition = XYZ(x1,y1+yo1,0)
					continue
				elif x != 0:	
					if dimseg[x-1].Value > k:
						dim.TextPosition = XYZ(x1,y1-yo1,0)
						continue
					elif x != len(dimseg)-2:
						if dimseg[x+2].Value <= min:
							dim.TextPosition = XYZ(x1-xo1,y1+yo1,0)
						else:
							dim.TextPosition = XYZ(x1-xo1,y1-yo1,0)
					else:
						dim.TextPosition = XYZ(x1,y1-yo1,0)
				else:
					dim.TextPosition = XYZ(x1-xo1,y1-yo1,0)
			else: 
				dim.TextPosition = XYZ(x1,y1+yo1,0) #Обработка последнего сегмента
		else:
			pass				
	
TransactionManager.Instance.TransactionTaskDone()


OUT = prnt
# ----------------------------------------
watch = Watch(python_script_2)
