# Dynamo graph 00.Корректировка размерных выносок.dyn (Dynamo 1.3.0.875)

# note: ВСЁ ОСТАЛЬНОЕ

# group: ПОЛУЧАЕМ ДАННЫЕ ИЗ РЕВИТ
# note: ПОЛУЧАЕМ ДАННЫЕ ИЗ РЕВИТ

# group: ЭЛЕМЕНТЫ УПРАВЛЕНИЯ
# note: ЭЛЕМЕНТЫ УПРАВЛЕНИЯ
# note: ПЕРЕМЕННЫЕ ЗНАЧЕНИЯ

# group: ПРОВЕРОЧНЫЕ НОДЫ
# note: ПРОВЕРОЧНЫЕ НОДЫ

# group: КЛЮЧЕВЫЕ МОМЕНТЫ РАБОТЫ
# note: ИТОГОВАЯ КОНСОЛИДАЦИЯ ДАННЫХ

# group: ИСПОЛНИТЕЛЬНЫЕ НОДЫ (фильтрование, подбор, списки и т.д.)
# note: ИСПОЛНИТЕЛЬНЫЕ НОДЫ
# note: НОДЫ РАБОТАЮЩИЕ С ДАННЫМИ

# group: ЗАПАСНЫЕ ВАРИАНТЫ, ДОПОЛНИТЕЛЬНЫЕ ОПЦИИ
# note: ЗАПАСНЫЕ
# note: ДОПОЛНИТЕЛЬНЫЕ. Градации серово по важности, темнее - важнее

# group: ПРИМЕЧАНИЯ ПО ЦВЕТОВОЙ ГРУППИРОВКЕ
# note: GUIDELINES

# group: ПЕРЕДАЁМ ИНФОРМАЦИЮ В РЕВИТ
# note: ПЕРЕДАЁМ ИНФОРМАЦИЮ В РЕВИТ

forceChildrensEval = ForceChildrensEval()  # frozen; unwired: arg0
pys_get_revit_selection = Python(IN[0]=forceChildrensEval)
# ---------- pys_get_revit_selection.python (22 lines) ----------
import clr
clr.AddReference('RevitServices')
clr.AddReference('RevitAPI')
from Autodesk.Revit.DB import *
import RevitServices
from RevitServices.Persistence import DocumentManager
from Autodesk.Revit.ApplicationServices import Application

reset = IN[0]

doc = DocumentManager.Instance.CurrentDBDocument
uidoc = DocumentManager.Instance.CurrentUIApplication.ActiveUIDocument
ids = uidoc.Selection.GetElementIds()

idd = [str(i) for i in ids]

if isinstance(idd, list) == True:
	elems = [doc.GetElement(ElementId(int(i))) for i in idd]
else:
	elems = doc.GetElement(ElementId(int(idd)))

OUT = elems
# ----------------------------------------
code_block = CodeBlock()
# ---------- code_block.designscript (15 lines) ----------
def oldif(test,iftrue:var[]..[],
iffalse:var[]..[])
{
return = [Imperative]
{
if (test)
{
return = iftrue;
}
else
{
return = iffalse;
}
}
};
# ----------------------------------------
выбрать_элементы = DSModelElementsSelection()  # 21 picked in the model
code_block_2 = CodeBlock { "False"; }
clean = List.Clean(list=выбрать_элементы, preserveIndices=code_block_2)
code_block_3 = CodeBlock { "Размеры"; }
getCategory = Element.GetCategory(clean)
string_from_object = FromObject(getCategory)
eq = code_block_3 == string_from_object
filterByBoolMask = List.FilterByBoolMask(list=clean, mask=eq)
code_block_4 = CodeBlock(input=filterByBoolMask.in) { input; }
count = List.Count(code_block_4)
code_block_5 = CodeBlock(input=count) { input>1; }
firstItem = List.FirstItem(code_block_4)
create = List.Create(firstItem)
code_block_6 = CodeBlock(test=code_block_5, iftrue=code_block_4, iffalse=create) { oldif(test,iftrue,iffalse); }
code_block_7 = CodeBlock(result=code_block_6) { result; }
минимальный_размер = IntegerSlider(700, range=0..5000 step 100)
смещение_по_x = IntegerSlider(900, range=-5000..5000 step 100)
смещение_по_y = IntegerSlider(900, range=-5000..5000 step 100)
python_script = Python(IN[0]=code_block_7, IN[1]=минимальный_размер, IN[2]=смещение_по_x, IN[3]=смещение_по_y)
# ---------- python_script.python (179 lines) ----------
import clr
clr.AddReference('RevitAPI')
from Autodesk.Revit.DB import *

clr.AddReference('RevitNodes')
import Revit
clr.ImportExtensions(Revit.GeometryConversion)
clr.ImportExtensions(Revit.Elements)

clr.AddReference('RevitServices')
import RevitServices
from RevitServices.Persistence import DocumentManager
from RevitServices.Transactions import TransactionManager

doc = DocumentManager.Instance.CurrentDBDocument

dimslist = UnwrapElement(IN[0])

min = IN[1]/304.80
xo1 = IN[2]/304.80
yo1 = IN[3]/304.80


for dims in dimslist:
	listx = []
	dimseg = []
	prnt = []
	prnt1 = []
	dimseglist = []
	dimseglist = dims.Segments
	viewM = doc.ActiveView.LookupParameter("Масштаб вида").AsInteger()
	k = dims.DimensionType.LookupParameter("Размер текста").AsDouble()*viewM*10


	TransactionManager.Instance.EnsureInTransaction(doc) 
	for dmr in dimseglist:
		dmr.ResetTextPosition() #Возвращаем текст в первоначальное положение
	TransactionManager.Instance.TransactionTaskDone()

	xt0 = dimseglist[0].TextPosition.X
	xt1 = dimseglist[1].TextPosition.X
	yt0 = dimseglist[0].TextPosition.Y
	yt1 = dimseglist[1].TextPosition.Y
	testxy = [xt0,xt1,yt0,yt1]
	
	for x,dim in enumerate(dimseglist):
		dimseg.append(dim)
		listx.append(x)
		#dim.ResetTextPosition
	#prnt1 = [int(yt0), int(yt1)]	
	prnt1 = ["значение сегмента=", dimseglist[1].Value, "минимум в дюймах=", min, "минимум на коф. в дюймах=", min*k, "количество размеров в цепи=", len(dimseg), "значение координат первых двух элементов", testxy]
	prnt.append(prnt1)#, dimseg, listx
	
	
	TransactionManager.Instance.EnsureInTransaction(doc)
	#для горизонтальных размеров
	
	if int(yt0) == int(yt1) and int(xt0) >= int(xt1):
		for x,dim in enumerate(dimseg):
			x1=dim.TextPosition.X
			y1=dim.TextPosition.Y
			if dim.Value <= min and x == 0: #Обработка первого сегмента
				dim.TextPosition = XYZ(x1+xo1,y1,0) #Обработка первого сегмента
				continue
			elif dim.Value <= min:
				if x != len(dimseg)-1:
					if dimseg[x+1].Value > k:
						dim.TextPosition = XYZ(x1-xo1,y1,0)
						continue
					elif x != 0:	
						if dimseg[x-1].Value > k:
							dim.TextPosition = XYZ(x1+xo1,y1,0)
							continue
						elif x != len(dimseg)-2:
							if dimseg[x+2].Value <= min:
								dim.TextPosition = XYZ(x1-xo1,y1+yo1,0)
							else:
								dim.TextPosition = XYZ(x1+xo1,y1+yo1,0)
						else:
							dim.TextPosition = XYZ(x1+xo1,y1,0)
					else:
						dim.TextPosition = XYZ(x1+xo1,y1+yo1,0)
				else: 
					dim.TextPosition = XYZ(x1-xo1,y1,0) #Обработка последнего сегмента
			else:
				pass	
	elif int(yt0) == int(yt1) and int(xt0) <= int(xt1):
		for x,dim in enumerate(dimseg):
			x1=dim.TextPosition.X
			y1=dim.TextPosition.Y
			if dim.Value <= min and x == 0: #Обработка первого сегмента
				dim.TextPosition = XYZ(x1-xo1,y1,0) #Обработка первого сегмента
				continue
			elif dim.Value <= min:
				if x != len(dimseg)-1:
					if dimseg[x+1].Value > k:
						dim.TextPosition = XYZ(x1+xo1,y1,0)
						continue
					elif x != 0:	
						if dimseg[x-1].Value > k:
							dim.TextPosition = XYZ(x1-xo1,y1,0)
							continue
						elif x != len(dimseg)-2:
							if dimseg[x+2].Value <= min:
								dim.TextPosition = XYZ(x1+xo1,y1+yo1,0)
							else:
								dim.TextPosition = XYZ(x1-xo1,y1+yo1,0)
						else:
							dim.TextPosition = XYZ(x1-xo1,y1,0)
					else:
						dim.TextPosition = XYZ(x1-xo1,y1+yo1,0)
				else: 
					dim.TextPosition = XYZ(x1+xo1,y1,0) #Обработка последнего сегмента
			else:
				pass				
	#для вертикальных размеров
	elif int(yt0) >= int(yt1):
		for x,dim in enumerate(dimseg):
			x1=dim.TextPosition.X
			y1=dim.TextPosition.Y
			if dim.Value <= min and x == 0: #Обработка первого сегмента
				dim.TextPosition = XYZ(x1,y1+yo1,0) #Обработка первого сегмента
				continue
			elif dim.Value <= min:
				if x != len(dimseg)-1:
					if dimseg[x+1].Value > k:
						dim.TextPosition = XYZ(x1,y1-yo1,0)
						continue
					elif x != 0:	
						if dimseg[x-1].Value > k:
							dim.TextPosition = XYZ(x1,y1+yo1,0)
							continue
						elif x != len(dimseg)-2:
							if dimseg[x+2].Value <= min:
								dim.TextPosition = XYZ(x1-xo1,y1-yo1,0)
							else:
								dim.TextPosition = XYZ(x1-xo1,y1+yo1,0)
						else:
							dim.TextPosition = XYZ(x1,y1+yo1,0)
					else:
						dim.TextPosition = XYZ(x1-xo1,y1+yo1,0)
				else: 
					dim.TextPosition = XYZ(x1,y1-yo1,0) #Обработка последнего сегмента
			else:
				pass	
	else:
		for x,dim in enumerate(dimseg):
			x1=dim.TextPosition.X
			y1=dim.TextPosition.Y
			if dim.Value <= min and x == 0: #Обработка первого сегмента
				dim.TextPosition = XYZ(x1,y1-yo1,0) #Обработка первого сегмента
				continue
			elif dim.Value <= min:
				if x != len(dimseg)-1:
					if dimseg[x+1].Value > k:
						dim.TextPosition = XYZ(x1,y1+yo1,0)
						continue
					elif x != 0:	
						if dimseg[x-1].Value > k:
							dim.TextPosition = XYZ(x1,y1-yo1,0)
							continue
						elif x != len(dimseg)-2:
							if dimseg[x+2].Value <= min:
								dim.TextPosition = XYZ(x1-xo1,y1+yo1,0)
							else:
								dim.TextPosition = XYZ(x1-xo1,y1-yo1,0)
						else:
							dim.TextPosition = XYZ(x1,y1-yo1,0)
					else:
						dim.TextPosition = XYZ(x1-xo1,y1-yo1,0)
				else: 
					dim.TextPosition = XYZ(x1,y1+yo1,0) #Обработка последнего сегмента
			else:
				pass				
	
	TransactionManager.Instance.TransactionTaskDone()


OUT = prnt
# ----------------------------------------
watch = Watch(python_script)
