# Dynamo graph 00.Размеры между осями (выбрать нужные оси, проставляются в начале оси).dyn (Dynamo 1.3.3.4111)

# group: Код программы на Python
code_block = CodeBlock()
# ---------- code_block.designscript (42 lines) ----------
"
import clr
clr.AddReference('RevitAPI')
from Autodesk.Revit.DB import *

clr.AddReference('RevitNodes')
import Revit
clr.ImportExtensions(Revit.GeometryConversion)
clr.ImportExtensions(Revit.Elements)

clr.AddReference('RevitServices')
import RevitServices
from RevitServices.Persistence import DocumentManager
from RevitServices.Transactions import TransactionManager

doc = DocumentManager.Instance.CurrentDBDocument

#Converting input from Dynamo to Revit
line = IN[0].ToRevitType()
grids = UnwrapElement(IN[1])

#Getting refrences from grid
gridRef = ReferenceArray()
opt = Options()
opt.ComputeReferences = True
opt.IncludeNonVisibleObjects = True
opt.View = doc.ActiveView
for grid in grids:
 for obj in grid.get_Geometry(opt):
  if isinstance(obj, Line):
   gline = obj
   gridRef.Append(gline.Reference)

#Create the dimension in a transaction
TransactionManager.Instance.EnsureInTransaction(doc)

dim = doc.Create.NewDimension(doc.ActiveView, line, gridRef).ToDSType(True)

TransactionManager.Instance.TransactionTaskDone()

OUT = dim
";
# ----------------------------------------

select_model_elements = DSModelElementsSelection()
code_block_2 = CodeBlock { "Оси"; }
getCategory = Element.GetCategory(select_model_elements)
string_from_object = FromObject(getCategory)
eq = code_block_2 == string_from_object
filterByBoolMask = List.FilterByBoolMask(list=select_model_elements, mask=eq)
curve = Grid.Curve(filterByBoolMask.in)
firstItem = List.FirstItem(curve)
code_block_3 = CodeBlock { 0.1; }
pointAtParameter = Curve.PointAtParameter(curve=firstItem, param=code_block_3)
lastItem = List.LastItem(curve)
pointAtParameter_2 = Curve.PointAtParameter(curve=lastItem, param=code_block_3)
byStartPointEndPoint = Line.ByStartPointEndPoint(startPoint=pointAtParameter, endPoint=pointAtParameter_2)

# group: IN[0] = Line IN[1] = Grids
python_script_from_string = PythonStringNode(script=code_block, IN[0]=byStartPointEndPoint, IN[1]=filterByBoolMask.in)

forceChildrensEval = ForceChildrensEval()  # unwired: arg0
pys_get_revit_selection = Python(IN[0]=forceChildrensEval)
# ---------- pys_get_revit_selection.python (22 lines) ----------
import clr
clr.AddReference('RevitServices')
clr.AddReference('RevitAPI')
from Autodesk.Revit.DB import *
import RevitServices
from RevitServices.Persistence import DocumentManager
from Autodesk.Revit.ApplicationServices import Application

reset = IN[0]

doc = DocumentManager.Instance.CurrentDBDocument
uidoc = DocumentManager.Instance.CurrentUIApplication.ActiveUIDocument
ids = uidoc.Selection.GetElementIds()

idd = [str(i) for i in ids]

if isinstance(idd, list) == True:
	elems = [doc.GetElement(ElementId(int(i))) for i in idd]
else:
	elems = doc.GetElement(ElementId(int(idd)))

OUT = elems
# ----------------------------------------
