# Dynamo graph 00.Размеры между стенами.dyn (Dynamo 1.3.0.875)

# group: Выбор рамкой ревита
forceChildrensEval = ForceChildrensEval()  # frozen; unwired: arg0
pys_get_revit_selection = Python(IN[0]=forceChildrensEval)
# ---------- pys_get_revit_selection.python (22 lines) ----------
import clr
clr.AddReference('RevitServices')
clr.AddReference('RevitAPI')
from Autodesk.Revit.DB import *
import RevitServices
from RevitServices.Persistence import DocumentManager
from Autodesk.Revit.ApplicationServices import Application

reset = IN[0]

doc = DocumentManager.Instance.CurrentDBDocument
uidoc = DocumentManager.Instance.CurrentUIApplication.ActiveUIDocument
ids = uidoc.Selection.GetElementIds()

idd = [str(i) for i in ids]

if isinstance(idd, list) == True:
	elems = [doc.GetElement(ElementId(int(i))) for i in idd]
else:
	elems = doc.GetElement(ElementId(int(idd)))

OUT = elems
# ----------------------------------------

размеры_по_плоскостям_стен = CodeBlock()
# ---------- размеры_по_плоскостям_стен.designscript (45 lines) ----------
"
import clr
clr.AddReference('RevitAPI')
from Autodesk.Revit.DB import *

clr.AddReference('RevitNodes')
import Revit
clr.ImportExtensions(Revit.GeometryConversion)
clr.ImportExtensions(Revit.Elements)

clr.AddReference('RevitServices')
import RevitServices
from RevitServices.Persistence import DocumentManager
from RevitServices.Transactions import TransactionManager

doc = DocumentManager.Instance.CurrentDBDocument

#Converting input from Dynamo to Revit
elements = UnwrapElement(IN[0])
line = IN[1].ToRevitType()

#Getting refrences from wall
elementsRef = ReferenceArray()
opt = Options()
opt.ComputeReferences = True
opt.IncludeNonVisibleObjects = True
opt.View = doc.ActiveView

for element in elements:
 a = HostObjectUtils.GetSideFaces(element, ShellLayerType.Exterior)
 for i in a:
  elementsRef.Append(i)
 b = HostObjectUtils.GetSideFaces(element, ShellLayerType.Interior)
 for i in b:
  elementsRef.Append(i)

#Create the dimension in a transaction
TransactionManager.Instance.EnsureInTransaction(doc)

dim = doc.Create.NewDimension(doc.ActiveView, line, elementsRef).ToDSType(True)

TransactionManager.Instance.TransactionTaskDone()

OUT = dim
";
# ----------------------------------------
выберите_объекты = DSModelElementsSelection()  # 72 picked in the model
code_block = CodeBlock(e5=выберите_объекты) { category1 = e5.GetCategory; e1 = "Стены"; e2 = "Длинна"; e3 = 0.5; e4 = 1000; }
string_from_object = FromObject(code_block.category1)
getParameterValueByName = Element.GetParameterValueByName(parameterName=code_block.e2)  # unwired: element
code_block_2 = CodeBlock(t3=string_from_object, t4=code_block.e1, t5=выберите_объекты, t10=getParameterValueByName, t11=code_block.e3, t12=code_block.e4)
# ---------- code_block_2.designscript (10 lines) ----------
t2 = Equals(t3, t4);
t6 = List.FilterByBoolMask(t5, t2);
t7 = __TryGetValueFromNestedDictionaries(t6, "in");
t8 = __TryGetValueFromNestedDictionaries(t6, "out");
t9 = SortByFunction(t7, t10);
a = t9;
geometry1 = a[0].GetLocation();
point1 = geometry1.PointAtParameter(t11);
vector1 = geometry1.NormalAtParameter(t11);
line1 = Line.ByStartPointDirectionLength(point1, vector1, t12);
# ----------------------------------------
python_script_from_string = PythonStringNode(script=размеры_по_плоскостям_стен, IN[0]=code_block_2.t7, IN[1]=code_block_2.line1)  # frozen
python_script = Python(IN[0]=code_block_2.t7, IN[1]=code_block_2.line1)
# ---------- python_script.python (83 lines) ----------
import clr
clr.AddReference('RevitAPI')
from Autodesk.Revit.DB import *
"""
from Autodesk.Revit.DB import ReferenceArray
from Autodesk.Revit.DB import Options
from Autodesk.Revit.DB import HostObjectUtils
from Autodesk.Revit.DB import ShellLayerType
from Autodesk.Revit.DB import GeometryElement
"""

clr.AddReference('RevitNodes')
import Revit
from Revit import *
clr.ImportExtensions(Revit.GeometryConversion)
clr.ImportExtensions(Revit.Elements)

clr.AddReference('RevitServices')
import RevitServices
from RevitServices.Persistence import DocumentManager
from RevitServices.Transactions import TransactionManager

doc = DocumentManager.Instance.CurrentDBDocument

#Converting input from Dynamo to Revit
walls = UnwrapElement(IN[0])
line = IN[1].ToRevitType()

#Getting refrences from wall
elementsRef = ReferenceArray()
opt = Options()
opt.ComputeReferences = True
opt.IncludeNonVisibleObjects = True
opt.View = doc.ActiveView
orient = []
vec = []
yy = 0
xx = 0
v = []
y_wall = []
x_wall = []
	
for wall in walls:
	orient.append(wall.Orientation)
	y = abs(int(wall.Orientation.Y))
	x = abs(int(wall.Orientation.X))
	if y > x:
		y_wall.append(wall)
	elif y < x:
		x_wall.append(wall)
	else:
		pass
		
if len(y_wall) > len(x_wall):
	for element in y_wall:
		a = HostObjectUtils.GetSideFaces(element, ShellLayerType.Exterior)
		for i in a:
			elementsRef.Append(i)
		b = HostObjectUtils.GetSideFaces(element, ShellLayerType.Interior)
		for i in b:
			elementsRef.Append(i)

elif len(y_wall) < len(x_wall):
	for element in x_wall:
		a = HostObjectUtils.GetSideFaces(element, ShellLayerType.Exterior)
		for i in a:
			elementsRef.Append(i)
		b = HostObjectUtils.GetSideFaces(element, ShellLayerType.Interior)
		for i in b:
			elementsRef.Append(i)
else:
	pass

#Create the dimension in a transaction
TransactionManager.Instance.EnsureInTransaction(doc)

dim = doc.Create.NewDimension(doc.ActiveView, line, elementsRef).ToDSType(True)

TransactionManager.Instance.TransactionTaskDone()

OUT = dim

#OUT = orient, yy, xx, y_wall, x_wall
# ----------------------------------------
