# Dynamo graph 00.Парковочные места, нумерация.dyn (Dynamo 1.3.1.1736)

# note: ВСЁ ОСТАЛЬНОЕ

# group: ПЕРЕМЕННЫЕ ЗНАЧЕНИЯ
# note: ПЕРЕМЕННЫЕ ЗНАЧЕНИЯ

# group: ПОЛУЧАЕМ ДАННЫЕ ИЗ РЕВИТ
# note: ПОЛУЧАЕМ ДАННЫЕ ИЗ РЕВИТ

# group: ПРОВЕРОЧНЫЕ НОДЫ
# note: ПРОВЕРОЧНЫЕ НОДЫ

# group: ИСПОЛНИТЕЛЬНЫЕ НОДЫ (фильтрование, подбор, списки и т.д.)
# note: ИСПОЛНИТЕЛЬНЫЕ НОДЫ
# note: НОДЫ РАБОТАЮЩИЕ С ДАННЫМИ

# group: КЛЮЧЕВЫЕ МОМЕНТЫ РАБОТЫ
# note: ИТОГОВАЯ КОНСОЛИДАЦИЯ ДАННЫХ

# group: ПЕРЕДАЁМ ИНФОРМАЦИЮ В РЕВИТ
# note: ПЕРЕДАЁМ ИНФОРМАЦИЮ В РЕВИТ

# group: ЗАПАСНЫЕ ВАРИАНТЫ, ДОПОЛНИТЕЛЬНЫЕ ОПЦИИ
# note: ЗАПАСНЫЕ
# note: ДОПОЛНИТЕЛЬНЫЕ. Градации серово по важности, темнее - важнее

# group: ПРИМЕЧАНИЯ ПО ЦВЕТОВОЙ ГРУППИРОВКЕ
# note: GUIDELINES

forceChildrensEval = ForceChildrensEval()  # unwired: arg0
pys_get_revit_selection = Python(IN[0]=forceChildrensEval)
# ---------- pys_get_revit_selection.python (22 lines) ----------
import clr
clr.AddReference('RevitServices')
clr.AddReference('RevitAPI')
from Autodesk.Revit.DB import *
import RevitServices
from RevitServices.Persistence import DocumentManager
from Autodesk.Revit.ApplicationServices import Application

reset = IN[0]

doc = DocumentManager.Instance.CurrentDBDocument
uidoc = DocumentManager.Instance.CurrentUIApplication.ActiveUIDocument
ids = uidoc.Selection.GetElementIds()

idd = [str(i) for i in ids]

if isinstance(idd, list) == True:
	elems = [doc.GetElement(ElementId(int(i))) for i in idd]
else:
	elems = doc.GetElement(ElementId(int(idd)))

OUT = elems
# ----------------------------------------
# note: С права на лево/С лево на право
сверху_в_низ_справа_на_лево = BoolSelector(false)  # "Сверху в низ (Справа на лево) // Снизу в верх (Слева на право)"
select_model_elements = DSModelElementsSelection()
code_block = CodeBlock { "Уровень"; "Имя"; "Номер м/м"; "Тип"; "Категория"; "Парковка"; }
getParameterValueByName = Element.GetParameterValueByName(element=select_model_elements, parameterName=code_block.out4)
string_from_object = FromObject(getParameterValueByName)
eq = string_from_object == code_block.out5
filterByBoolMask = List.FilterByBoolMask(list=select_model_elements, mask=eq)
вертикальная_нумерацяи = BoolSelector(true)  # "Вертикальная нумерацяи / (Горизонтальная нумерация)"
boundingBox = Element.BoundingBox(filterByBoolMask.in)
toCuboid = BoundingBox.ToCuboid(boundingBox)
explode = Geometry.Explode(toCuboid)
flatten = Flatten(explode)
code_block_2 = CodeBlock { 0.5; }
pointAtParameter = Surface.PointAtParameter(surface=flatten, u=code_block_2, v=code_block_2)
Y = Point.Y(pointAtParameter)
X = Point.X(pointAtParameter)
if_ = Python(IN[0]=вертикальная_нумерацяи, IN[1]=Y, IN[2]=X)
# ---------- if_.python (12 lines) ----------
import clr
boolean = IN[0]
true = UnwrapElement(IN[1])
false = UnwrapElement(IN[2])

if boolean:
	out = true
else:
	out = false

#Назначьте вывод переменной OUT.
OUT = out
# ----------------------------------------
code_block_3 = CodeBlock(x=if_) { x/100; 5; }
round = Math.Round(code_block_3.out0)
code_block_4 = CodeBlock(dbl=round) { dbl; }
code_block_5 = CodeBlock(precision=code_block_3.out1) { precision; }
code_block_6 = CodeBlock(a=code_block_4, b=code_block_5) { Math.Round(a/b)*b; }
code_block_7 = CodeBlock(dbl=code_block_6) { dbl; }
sortByKey = List.SortByKey(list=filterByBoolMask.in, keys=code_block_7)
reverse = List.Reverse(sortByKey.sorted_list)
if_2 = Python(IN[0]=сверху_в_низ_справа_на_лево, IN[1]=reverse, IN[2]=sortByKey.sorted_list)  # same code as if_
code_block_8 = CodeBlock(M_Number=code_block.out2) { M_Number; }
нумеруем_с_номера = IntegerSlider(1, range=0..1000 step 1)
count = Count(sortByKey.sorted_list)
code_block_9 = CodeBlock(y=нумеруем_с_номера, x=count) { y..x+y-1; }
setParameterByName = Element.SetParameterByName(element=if_2, parameterName=code_block_8, value=code_block_9)
