# Dynamo graph 00.Переименование уровней.dyn (Dynamo 1.2.1.3083)

# group: 2
параметры = CodeBlock { "Имя"; "Корпус 8"; "К"; "К8 "; }

# group: 1
categories = Categories("Levels")
# note: Собираем и записываем
all_elements_of_category = ElementsOfCategory(categories)

parameters = Element.Parameters(all_elements_of_category)
# note: Фильтруем и собираем параметры
getParameterValueByName = Element.GetParameterValueByName(element=all_elements_of_category, parameterName=параметры.out0)
contains = String.Contains(str=getParameterValueByName, searchFor=параметры.out1)

# group (continued): 1
filterByBoolMask = List.FilterByBoolMask(list=all_elements_of_category, mask=contains)

filterByBoolMask_2 = List.FilterByBoolMask(list=getParameterValueByName, mask=contains)
split = String.Split(filterByBoolMask_2.in, параметры.out2)
transpose = List.Transpose(split)
code_block = CodeBlock(K=параметры.out3, lvl=transpose) { K+lvl[0]; }

# group (continued): 1
setParameterByName = Element.SetParameterByName(element=filterByBoolMask.in, parameterName=параметры.out0, value=code_block)
