# Dynamo graph 3.(Select&Push) Оси.перевод выбраных в 2D.dyn (Dynamo 1.2.1.3083)

# group: Get Revit Selection:
forceChildrensEval = ForceChildrensEval()  # unwired: arg0
pys_get_revit_selection = Python(IN[0]=forceChildrensEval)
# ---------- pys_get_revit_selection.python (22 lines) ----------
import clr
clr.AddReference('RevitServices')
clr.AddReference('RevitAPI')
from Autodesk.Revit.DB import *
import RevitServices
from RevitServices.Persistence import DocumentManager
from Autodesk.Revit.ApplicationServices import Application

reset = IN[0]

doc = DocumentManager.Instance.CurrentDBDocument
uidoc = DocumentManager.Instance.CurrentUIApplication.ActiveUIDocument
ids = uidoc.Selection.GetElementIds()

idd = [str(i) for i in ids]

if isinstance(idd, list) == True:
	elems = [doc.GetElement(ElementId(int(i))) for i in idd]
else:
	elems = doc.GetElement(ElementId(int(idd)))

OUT = elems
# ----------------------------------------

python_script = Python(IN[0]=forceChildrensEval, IN[1]=pys_get_revit_selection)
# ---------- python_script.python (27 lines) ----------
import clr
clr.AddReference('ProtoGeometry')
from Autodesk.DesignScript.Geometry import *
clr.AddReference("RevitServices")
import RevitServices
from RevitServices.Persistence import DocumentManager
from RevitServices.Transactions import TransactionManager
clr.AddReference("RevitAPI")
import Autodesk
from Autodesk.Revit.DB import *
doc = DocumentManager.Instance.CurrentDBDocument
from System.Collections.Generic import *
clr.AddReference("RevitNodes")
import Revit
clr.ImportExtensions(Revit.Elements)

reset = IN[0]
grids = UnwrapElement(IN[1])

TransactionManager.Instance.EnsureInTransaction(doc)
view = doc.ActiveView
for grid in grids:
	grid.SetDatumExtentType(DatumEnds.End1,view,DatumExtentType.ViewSpecific)
	grid.SetDatumExtentType(DatumEnds.End0,view,DatumExtentType.ViewSpecific)
TransactionManager.Instance.TransactionTaskDone()

OUT = view
# ----------------------------------------
