# Dynamo graph 3.(Select&Push) Оси.переименование осей (просто запустить, по ГОСТ).dyn (Dynamo 1.2.1.3083)

categories = Categories("Grids")
all_elements_of_category = ElementsOfCategory(categories)
divideByOrientation = Prorubim.GridsRenumbering.Grids.DivideByOrientation(all_elements_of_category)
count = Count(divideByOrientation.out1)
code_block = CodeBlock(x=count) { {"А","Б","В","Г","Д","Е","Ж","К","Л","М","Н","П","Р","С","Т","У","Ф","Ш","Ю","Я"}; {1..x}; }
renumber = Prorubim.GridsRenumbering.Grids.Renumber(divideByOrientation.out0, code_block.out0)
renumber_2 = Prorubim.GridsRenumbering.Grids.Renumber(divideByOrientation.out1, code_block.out1)
index = StringInput("index")
