# Dynamo graph 3.Оси.переименование осей (запускать из динамо, для сложной структуры).dyn (Dynamo 1.2.1.3083)

# group: Выбираем оси внутри ревита
forceChildrensEval = ForceChildrensEval()  # unwired: arg0
pys_get_revit_selection = Python(IN[0]=forceChildrensEval)
# ---------- pys_get_revit_selection.python (22 lines) ----------
import clr
clr.AddReference('RevitServices')
clr.AddReference('RevitAPI')
from Autodesk.Revit.DB import *
import RevitServices
from RevitServices.Persistence import DocumentManager
from Autodesk.Revit.ApplicationServices import Application

reset = IN[0]

doc = DocumentManager.Instance.CurrentDBDocument
uidoc = DocumentManager.Instance.CurrentUIApplication.ActiveUIDocument
ids = uidoc.Selection.GetElementIds()

idd = [str(i) for i in ids]

if isinstance(idd, list) == True:
	elems = [doc.GetElement(ElementId(int(i))) for i in idd]
else:
	elems = doc.GetElement(ElementId(int(idd)))

OUT = elems
# ----------------------------------------

code_block = CodeBlock(elmnts=pys_get_revit_selection) { elmnts; }
# note: Выстраиваем список осей по порядку (порядок может быть перепутан в элементах полученых из ревит)
curve = Grid.Curve(code_block)
boundingBox = Geometry.BoundingBox(curve)
string_from_object = FromObject(boundingBox)
code_block_2 = CodeBlock { "="; ","; }
split = String.Split(string_from_object, code_block_2.out0, code_block_2.out1)
transpose = List.Transpose(split)
number_or_symbol = BoolSelector(true)
code_block_3 = CodeBlock { 2; }
code_block_4 = CodeBlock { 4; }
if_ = If(test=number_or_symbol, true=code_block_3, false=code_block_4)
getItemAtIndex = List.GetItemAtIndex(list=transpose, index=if_)
toNumber = String.ToNumber(getItemAtIndex)
create = List.Create(code_block, toNumber)
transpose_2 = List.Transpose(create)
code_block_5 = CodeBlock { 1; }
getItemAtIndex_2 = List.GetItemAtIndex(index=code_block_5)  # unwired: list
sortByFunction = SortByFunction(transpose_2, getItemAtIndex_2)
code_block_6 = CodeBlock { 0; }
getItemAtIndex_3 = List.GetItemAtIndex(list=sortByFunction, index=code_block_6, lacing=Longest)
rus_eng = BoolSelector(true)
code_block_7 = CodeBlock { "Имя"; }
code_block_8 = CodeBlock { "Name"; }
if_2 = If(test=rus_eng, true=code_block_7, false=code_block_8)

# group: Прификс
наличие_доп_символа = BoolSelector(true)
доп_символ_до_после = BoolSelector(true)
доп_символ = StringInput("В/")

code_block_9 = CodeBlock(s_prifiksom_da_net=наличие_доп_символа) { s_prifiksom_da_net; }
code_block_10 = CodeBlock(s_prifiksom_da_net=code_block_9) { s_prifiksom_da_net; }
code_block_11 = CodeBlock(prifiks_left_right=доп_символ_до_после) { prifiks_left_right; }
code_block_12 = CodeBlock(prifiks_left_right=code_block_11) { prifiks_left_right; }
code_block_13 = CodeBlock(prifiks=доп_символ) { prifiks; }
code_block_14 = CodeBlock(prifiks=code_block_13) { prifiks; }
n1_100 = BoolSelector(true)  # "1/100"
start_at = DoubleInput(1)
start_at_2 = DoubleInput(100)
if_3 = If(test=n1_100, true=start_at, false=start_at_2)
count = Count(code_block)
number = DoubleInput(1)
sequence = Sequence(start=if_3, amount=count, step=number, lacing=Longest)
string_from_object_2 = FromObject(sequence)
начать_с_буквы = StringInput("А")
code_block_15 = CodeBlock(separater=начать_с_буквы) { separater; }
code_block_16 = CodeBlock { "А"; }
eq = code_block_15 == code_block_16
code_block_17 = CodeBlock { "А,Б,В,Г,Д,Е,Ж,И,К,Л,М,Н,П,Р,С,Т,У,Ф,Ш,Ю,Я"; }
split_2 = String.Split(code_block_17, code_block_15)
code_block_18 = CodeBlock(a=split_2) { a[1]; }
code_block_19 = CodeBlock { 0; }
insert = String.Insert(str=code_block_18, index=code_block_19, toInsert=code_block_15)
if_4 = If(test=eq, true=code_block_17, false=insert)
code_block_20 = CodeBlock { ","; }
split_3 = String.Split(if_4, code_block_20)
if_5 = If(test=number_or_symbol, true=string_from_object_2, false=split_3)
code_block_21 = CodeBlock(a=code_block_14, b=if_5) { a+b; }
code_block_22 = CodeBlock(a=if_5, b=code_block_14) { a+b; }
if_6 = If(test=code_block_12, true=code_block_21, false=code_block_22)
if_7 = If(test=code_block_10, true=if_6, false=if_5)
setParameterByName = Element.SetParameterByName(element=getItemAtIndex_3, parameterName=if_2, value=if_7)
code_block_23 = CodeBlock()
# ---------- code_block_23.designscript (3 lines) ----------
Выбираем цыфры, или буквы. Если цифры,
то вначале сбрасываем номера осей на нумерацию с 100,
потом возвращаем на правильную с 1.;
# ----------------------------------------
