# Dynamo graph Отметка отверстия.dyn (Dynamo 0.9.1.4062)

categories = Categories("AdaptivePoints")
boolean = BoolSelector(true)
activeView = Custom[Springs.Doc.ActiveView](refresh=boolean)  # Selects the current document's active view. Supports more view types than the built-in option. Will be depreciated once the bult in node works with all plan types.
byCategoryAndView = Archilab.Grimshaw.Selection.Select.ByCategoryAndView(categories, activeView)
string = StringInput("GKS_Отв_Отметка")
string_2 = StringInput("CP_Отв_Абс_Отметка")
getLocation = Element.GetLocation(byCategoryAndView)
Z = Point.Z(getLocation)
levels = Levels("К8 01 Этаж (0.000)")
elevation = Level.Elevation(levels)
watch = Watch(elevation)
code_block = CodeBlock(Z, watch) { (a-b-c)/1000; c=0; }
watch_2 = Watch(code_block.out0)
code_block_2 = CodeBlock { 142.10; }
code_block_3 = CodeBlock(a=watch_2, b=code_block_2) { a+b; }
setparameterbyname_with_catch = Python(IN[0]=byCategoryAndView, IN[1]=string, IN[2]=string_2, IN[3]=watch_2, IN[4]=code_block_3)  # "SetParameterByName with catch exception"
# ---------- setparameterbyname_with_catch.python (24 lines) ----------
import clr
clr.AddReference('ProtoGeometry')
from Autodesk.DesignScript.Geometry import *
import clr
clr.AddReference('RevitNodes')
import Revit
#Введенные в этом узле данные сохраняется в виде списка в переменных IN.
elements = IN[0]
paramName1 = IN[1]
paramName2 = IN[2]
paramVal1 = IN[3]
paramVal2 = IN[4]

for i in range(len(elements)):
	try:
		elements[i].SetParameterByName(paramName1,paramVal1[i])
		elements[i].SetParameterByName(paramName2,paramVal2[i])
	except:
		paramName1 = paramName1
	


#Назначьте вывод переменной OUT.
OUT = elements
# ----------------------------------------
watch_3 = Watch(setparameterbyname_with_catch)
