# Dynamo graph Переключение обозначения (уровни, оси).dyn (Dynamo 1.3.0.875)

end1_end0 = BoolSelector(false)

# group: Get Revit Selection:
forceChildrensEval = ForceChildrensEval()  # unwired: arg0
pys_get_revit_selection = Python(IN[0]=forceChildrensEval)
# ---------- pys_get_revit_selection.python (22 lines) ----------
import clr
clr.AddReference('RevitServices')
clr.AddReference('RevitAPI')
from Autodesk.Revit.DB import *
import RevitServices
from RevitServices.Persistence import DocumentManager
from Autodesk.Revit.ApplicationServices import Application

reset = IN[0]

doc = DocumentManager.Instance.CurrentDBDocument
uidoc = DocumentManager.Instance.CurrentUIApplication.ActiveUIDocument
ids = uidoc.Selection.GetElementIds()

idd = [str(i) for i in ids]

if isinstance(idd, list) == True:
	elems = [doc.GetElement(ElementId(int(i))) for i in idd]
else:
	elems = doc.GetElement(ElementId(int(idd)))

OUT = elems
# ----------------------------------------

python_script = Python(IN[0]=end1_end0, IN[1]=pys_get_revit_selection, IN[2]=forceChildrensEval)
# ---------- python_script.python (35 lines) ----------
if IN[0]:
	import clr
	clr.AddReference('ProtoGeometry')
	from Autodesk.DesignScript.Geometry import *
	clr.AddReference("RevitServices")
	import RevitServices
	from RevitServices.Persistence import DocumentManager
	from RevitServices.Transactions import TransactionManager
	clr.AddReference("RevitAPI")
	import Autodesk
	from Autodesk.Revit.DB import *
	doc = DocumentManager.Instance.CurrentDBDocument
	from System.Collections.Generic import *
	clr.AddReference("RevitNodes")
	import Revit
	clr.ImportExtensions(Revit.Elements)
	
	reset = IN[2]
	grids = UnwrapElement(IN[1])
	view = doc.ActiveView
	
	TransactionManager.Instance.EnsureInTransaction(doc)
	
	for grid in grids:
	
		if grid.IsBubbleVisibleInView(DatumEnds.End1,view):
			grid.HideBubbleInView(DatumEnds.End1,view)
		else:
			grid.ShowBubbleInView(DatumEnds.End1,view)
			
	TransactionManager.Instance.TransactionTaskDone()
	
	OUT = grid
else:
	pass
# ----------------------------------------
python_script_2 = Python(IN[0]=end1_end0, IN[1]=pys_get_revit_selection, IN[2]=forceChildrensEval)
# ---------- python_script_2.python (35 lines) ----------
if not IN[0]:
	import clr
	clr.AddReference('ProtoGeometry')
	from Autodesk.DesignScript.Geometry import *
	clr.AddReference("RevitServices")
	import RevitServices
	from RevitServices.Persistence import DocumentManager
	from RevitServices.Transactions import TransactionManager
	clr.AddReference("RevitAPI")
	import Autodesk
	from Autodesk.Revit.DB import *
	doc = DocumentManager.Instance.CurrentDBDocument
	from System.Collections.Generic import *
	clr.AddReference("RevitNodes")
	import Revit
	clr.ImportExtensions(Revit.Elements)
	
	reset = IN[2]
	grids = UnwrapElement(IN[1])
	view = doc.ActiveView
	
	TransactionManager.Instance.EnsureInTransaction(doc)
	
	for grid in grids:
	
		if grid.IsBubbleVisibleInView(DatumEnds.End0,view):
			grid.HideBubbleInView(DatumEnds.End0,view)
		else:
			grid.ShowBubbleInView(DatumEnds.End0,view)
			
	TransactionManager.Instance.TransactionTaskDone()
	
	OUT = grid
else:
	pass
# ----------------------------------------
