# Dynamo graph 0.Включить-Выключить подписи в штампе ГП.dyn (Dynamo 1.3.0.875)

categories = Categories("TitleBlocks")
all_elements_of_category = ElementsOfCategory(categories)
code_block = CodeBlock { "Имя семейства"; "Семейство и типоразмер"; }
getParameterValueByName = Element.GetParameterValueByName(element=all_elements_of_category, parameterName=code_block.out1)
string_from_object = FromObject(getParameterValueByName)
code_block_2 = CodeBlock { "ГП"; }
contains = String.Contains(str=string_from_object, searchFor=code_block_2)
filterByBoolMask = List.FilterByBoolMask(list=all_elements_of_category, mask=contains)
flatten = Flatten(filterByBoolMask.in)
code_block_3 = CodeBlock { "Подписи"; }
включить_выключить = BoolSelector(false)
setParameterByName = Element.SetParameterByName(element=flatten, parameterName=code_block_3, value=включить_выключить)
parameters = Element.Parameters(all_elements_of_category)
