# Dynamo graph 0.Переключение параметров в основной надписи.dyn (Dynamo 1.3.0.875)

code_block = CodeBlock { "Разработал"; }
categories = Categories("TitleBlocks")
all_elements_of_category = ElementsOfCategory(categories)
code_block_2 = CodeBlock { "L-Номер листа"; "Лист"; }
getParameterValueByName = Element.GetParameterValueByName(element=all_elements_of_category, parameterName=code_block_2.out0)
code_block_3 = CodeBlock { "ОДИ"; }
contains = String.Contains(str=getParameterValueByName, searchFor=code_block_3)  # frozen
filterByBoolMask = List.FilterByBoolMask(list=all_elements_of_category, mask=contains)
code_block_4 = CodeBlock { "Подпись Лысенко"; "Подпись Перебатов"; }
code_block_5 = CodeBlock { 1; 0; }
setParameterByName = Element.SetParameterByName(element=filterByBoolMask.in, parameterName=code_block_4.out0, value=code_block_5.out0)
setParameterByName_2 = Element.SetParameterByName(element=setParameterByName, parameterName=code_block_4.out1, value=code_block_5.out1)
create = List.Create(categories)
boolean = BoolSelector(true)
python_script = Python(IN[0]=create, IN[1]=boolean)
# ---------- python_script.python (21 lines) ----------
import System
import clr
clr.AddReference('RevitAPI')
from Autodesk.Revit.DB import *

clr.AddReference("RevitServices")
import RevitServices
from RevitServices.Persistence import DocumentManager

doc = DocumentManager.Instance.CurrentDBDocument
cats = IN[0]

elementlist = list()
# This could be more elegant if only I knew how to implement a Multicategory filter in Python....
for item in cats:
	collector = FilteredElementCollector(doc)
	collector.OfClass(FamilySymbol)
	bic = System.Enum.ToObject(BuiltInCategory, item.Id)
	collector.OfCategory(bic)
	elementlist.append(collector.ToElements())
OUT = elementlist
# ----------------------------------------
parameters = Element.Parameters(all_elements_of_category)
code_block_6 = CodeBlock { "Имя семейства"; "Семейство и типоразмер"; }
getParameterValueByName_2 = Element.GetParameterValueByName(element=all_elements_of_category, parameterName=code_block_6.out1)
string_from_object = FromObject(getParameterValueByName_2)
code_block_7 = CodeBlock { "ГП"; }
contains_2 = String.Contains(str=string_from_object, searchFor=code_block_7)
filterByBoolMask_2 = List.FilterByBoolMask(list=all_elements_of_category, mask=contains_2)
flatten = Flatten(filterByBoolMask_2.in)
code_block_8 = CodeBlock { "Подписи"; }
code_block_9 = CodeBlock { 0; }
setParameterByName_3 = Element.SetParameterByName(element=flatten, parameterName=code_block_8, value=code_block_9)
setParameterByName_4 = Element.SetParameterByName(element=all_elements_of_category, parameterName=code_block_2.out1, value=getParameterValueByName)  # frozen
