# Dynamo graph 00.Все виды форматов в проекте.dyn (Dynamo 1.3.1.1736)

# note: ВСЁ ОСТАЛЬНОЕ

# group: ЭЛЕМЕНТЫ УПРАВЛЕНИЯ
# note: ПЕРЕМЕННЫЕ ЗНАЧЕНИЯ
# note: ЭЛЕМЕНТЫ УПРАВЛЕНИЯ

# group: ПОЛУЧАЕМ ДАННЫЕ ИЗ РЕВИТ
# note: ПОЛУЧАЕМ ДАННЫЕ ИЗ РЕВИТ

# group: ПРОВЕРОЧНЫЕ НОДЫ
# note: ПРОВЕРОЧНЫЕ НОДЫ

# group: КЛЮЧЕВЫЕ МОМЕНТЫ РАБОТЫ
# note: ИТОГОВАЯ КОНСОЛИДАЦИЯ ДАННЫХ

# group: ИСПОЛНИТЕЛЬНЫЕ НОДЫ (фильтрование, подбор, списки и т.д.)
# note: ИСПОЛНИТЕЛЬНЫЕ НОДЫ
# note: НОДЫ РАБОТАЮЩИЕ С ДАННЫМИ

# group: ЗАПАСНЫЕ ВАРИАНТЫ, ДОПОЛНИТЕЛЬНЫЕ ОПЦИИ
# note: ЗАПАСНЫЕ
# note: ДОПОЛНИТЕЛЬНЫЕ. Градации серово по важности, темнее - важнее

# group: ПЕРЕДАЁМ ИНФОРМАЦИЮ В РЕВИТ
# note: ПЕРЕДАЁМ ИНФОРМАЦИЮ В РЕВИТ

# group: ПРИМЕЧАНИЯ ПО ЦВЕТОВОЙ ГРУППИРОВКЕ
# note: GUIDELINES

# group: [PRORUBIM]
forceChildrensEval = ForceChildrensEval()  # unwired: arg0

# group: Все названия Наборов листов
# note: Все названия Наборов листов
get_all_views_set_name = Python(IN[0]=forceChildrensEval)
# ---------- get_all_views_set_name.python (33 lines) ----------
#Copyright(c) 2015, Konrad Sobon
# @arch_laboratory, http://archi-lab.net

import clr
clr.AddReference('ProtoGeometry')
from Autodesk.DesignScript.Geometry import *

# Import DocumentManager and TransactionManager
clr.AddReference("RevitServices")
import RevitServices
from RevitServices.Persistence import DocumentManager
from RevitServices.Transactions import TransactionManager

doc = DocumentManager.Instance.CurrentDBDocument

# Import Element wrapper extension methods
clr.AddReference("RevitNodes")
import Revit
clr.ImportExtensions(Revit.Elements)

# Import RevitAPI
clr.AddReference("RevitAPI")
import Autodesk
from Autodesk.Revit.DB import *

viewSets = FilteredElementCollector(doc).OfClass(ViewSheetSet)
viewSetsName = []

for i in viewSets:
	viewSetsName.append(i.Name)

#Assign your output to the OUT variable
OUT = (viewSetsName, viewSets)
# ----------------------------------------

code_block = CodeBlock(x=get_all_views_set_name) { x[1]; }
code_block_2 = CodeBlock(ViewSetName=code_block) { ViewSetName[0]; }
get_views_from_view_set_grimshaw = Python(IN[0]=code_block_2)
# ---------- get_views_from_view_set_grimshaw.python (37 lines) ----------
#Copyright(c) 2015, Konrad Sobon
# @arch_laboratory, http://archi-lab.net

import clr
clr.AddReference('ProtoGeometry')
from Autodesk.DesignScript.Geometry import *

# Import DocumentManager and TransactionManager
clr.AddReference("RevitServices")
import RevitServices
from RevitServices.Persistence import DocumentManager
from RevitServices.Transactions import TransactionManager

doc = DocumentManager.Instance.CurrentDBDocument

# Import Element wrapper extension methods
clr.AddReference("RevitNodes")
import Revit
clr.ImportExtensions(Revit.Elements)

# Import RevitAPI
clr.AddReference("RevitAPI")
import Autodesk
from Autodesk.Revit.DB import *

viewSet = UnwrapElement(IN[0])

viewSets = FilteredElementCollector(doc).OfClass(ViewSheetSet)

for i in viewSets:
	if i.Name == viewSet.Name:
		vs = i
	else:
		continue

#Assign your output to the OUT variable
OUT = [i.ToDSType(True) for i in vs.Views]
# ----------------------------------------
фильтр_по_категории_основные = Python(IN[0]=get_views_from_view_set_grimshaw, IN[1]=forceChildrensEval)  # "Фильтр по категории: "Основные надписи""
# ---------- фильтр_по_категории_основные.python (33 lines) ----------
#Copyright(c) 2016, Dimitar Venkov
# @5devene, dimitar.ven@gmail.com

import clr

clr.AddReference("RevitServices")
import RevitServices
from RevitServices.Persistence import DocumentManager
doc = DocumentManager.Instance.CurrentDBDocument

clr.AddReference("RevitAPI")
import Autodesk
from Autodesk.Revit.DB import FilteredElementCollector

clr.AddReference("RevitNodes")
import Revit
clr.ImportExtensions(Revit.Elements)

def tolist(obj1):
	if hasattr(obj1,"__iter__"): return obj1
	else: return [obj1]
def output1(l1):
	if len(l1) == 1: return l1[0]
	else: return l1

views = UnwrapElement(tolist(IN[0]))
elements = []
elemId = Autodesk.Revit.DB.ElementId(-2000280)

for i in views:
	fec = FilteredElementCollector(doc, i.Id).OfCategoryId(elemId).ToElements()
	elements.append(fec)
OUT = output1(elements)
# ----------------------------------------
flatten = Flatten(фильтр_по_категории_основные)
string_from_object = FromObject(flatten)
uniqueItems = List.UniqueItems(string_from_object)
categories = Categories("Sheets")
all_elements_of_category = ElementsOfCategory(categories)
