# Dynamo graph 00.Добавляем нули к номерам.dyn (Dynamo 1.3.1.1736)

# group: ЭЛЕМЕНТЫ УПРАВЛЕНИЯ
# note: ПЕРЕМЕННЫЕ ЗНАЧЕНИЯ
# note: ЭЛЕМЕНТЫ УПРАВЛЕНИЯ

# group: ПОЛУЧАЕМ ДАННЫЕ ИЗ РЕВИТ
# note: ПОЛУЧАЕМ ДАННЫЕ ИЗ РЕВИТ

# group: ПРОВЕРОЧНЫЕ НОДЫ
# note: ПРОВЕРОЧНЫЕ НОДЫ

# group: ИСПОЛНИТЕЛЬНЫЕ НОДЫ (фильтрование, подбор, списки и т.д.)
# note: ИСПОЛНИТЕЛЬНЫЕ НОДЫ
# note: НОДЫ РАБОТАЮЩИЕ С ДАННЫМИ

# group: КЛЮЧЕВЫЕ МОМЕНТЫ РАБОТЫ
# note: ИТОГОВАЯ КОНСОЛИДАЦИЯ ДАННЫХ

# group: ПЕРЕДАЁМ ИНФОРМАЦИЮ В РЕВИТ
# note: ПЕРЕДАЁМ ИНФОРМАЦИЮ В РЕВИТ

# group: ПРИМЕЧАНИЯ ПО ЦВЕТОВОЙ ГРУППИРОВКЕ
# note: GUIDELINES

# group: ЗАПАСНЫЕ ВАРИАНТЫ, ДОПОЛНИТЕЛЬНЫЕ ОПЦИИ
# note: ЗАПАСНЫЕ
# note: ДОПОЛНИТЕЛЬНЫЕ. Градации серово по важности, темнее - важнее

# group: ВСЁ ОСТАЛЬНОЕ
# note: ВСЁ ОСТАЛЬНОЕ

# group: Get Revit Selection:
forceChildrensEval = ForceChildrensEval()  # unwired: arg0
pys_get_revit_selection = Python(IN[0]=forceChildrensEval)
# ---------- pys_get_revit_selection.python (22 lines) ----------
import clr
clr.AddReference('RevitServices')
clr.AddReference('RevitAPI')
from Autodesk.Revit.DB import *
import RevitServices
from RevitServices.Persistence import DocumentManager
from Autodesk.Revit.ApplicationServices import Application

reset = IN[0]

doc = DocumentManager.Instance.CurrentDBDocument
uidoc = DocumentManager.Instance.CurrentUIApplication.ActiveUIDocument
ids = uidoc.Selection.GetElementIds()

idd = [str(i) for i in ids]

if isinstance(idd, list) == True:
	elems = [doc.GetElement(ElementId(int(i))) for i in idd]
else:
	elems = doc.GetElement(ElementId(int(idd)))

OUT = elems
# ----------------------------------------

categories = Categories("Sheets")
all_elements_of_category = ElementsOfCategory(categories)
code_block = CodeBlock { "Раздел проекта"; }  # frozen
getParameterValueByName = Element.GetParameterValueByName(parameterName=code_block)  # unwired: element
sortByFunction = SortByFunction(all_elements_of_category, getParameterValueByName)
parameters = Element.Parameters(all_elements_of_category)
groupByFunction = GroupByFunction(arg1=getParameterValueByName)  # unwired: arg0

# group: Новый параметр для листа
string = StringInput("Лист")

code_block_2 = CodeBlock { "Лист"; }
getParameterValueByName_2 = Element.GetParameterValueByName(element=all_elements_of_category, parameterName=code_block_2)
# note: ТРАВИМ ТАРА.. ЮНИКОД
python_script = Python(IN[0]=getParameterValueByName_2)
# ---------- python_script.python (46 lines) ----------
#Created by DPS Design, dpsdesign.org
import clr
clr.AddReference('ProtoGeometry')
from Autodesk.DesignScript.Geometry import *

# Import ToDSType(bool) extension method
clr.AddReference("RevitNodes")
import Revit
clr.ImportExtensions(Revit.Elements)

# Import DocumentManager and TransactionManager
clr.AddReference("RevitServices")
import RevitServices
from RevitServices.Persistence import DocumentManager
from RevitServices.Transactions import TransactionManager

from System.Collections.Generic import *

# Import RevitAPI
clr.AddReference("RevitAPI")
import Autodesk

doc = DocumentManager.Instance.CurrentDBDocument
uiapp = DocumentManager.Instance.CurrentUIApplication
app = uiapp.Application

#The inputs to this node will be stored as a list in the IN variable.
dataEnteringNode = IN

#unwrap all elements to use with API
items = UnwrapElement(IN[0])
TransactionManager.Instance.EnsureInTransaction(doc)
#apply lineweight override to elements in an input list
typelist = list()
for i in items:
	try:
		typelist.append(i.decode('unicode_escape').encode('ascii','ignore'))
	except:
		typelist.append(i)


# "End" the transaction
TransactionManager.Instance.TransactionTaskDone()

#Assign your output to the OUT variable
OUT = typelist
# ----------------------------------------
python_script_2 = Python(IN[0]=python_script)
# ---------- python_script_2.python (56 lines) ----------
#Created by DPS Design, dpsdesign.org
import clr
clr.AddReference('ProtoGeometry')
from Autodesk.DesignScript.Geometry import *

# Import ToDSType(bool) extension method
clr.AddReference("RevitNodes")
import Revit
clr.ImportExtensions(Revit.Elements)

# Import DocumentManager and TransactionManager
clr.AddReference("RevitServices")
import RevitServices
from RevitServices.Persistence import DocumentManager
from RevitServices.Transactions import TransactionManager

from System.Collections.Generic import *

# Import RevitAPI
clr.AddReference("RevitAPI")
import Autodesk

doc = DocumentManager.Instance.CurrentDBDocument
uiapp = DocumentManager.Instance.CurrentUIApplication
app = uiapp.Application

whitespace = ' \t\n\r\v\f'
lowercase = 'abcdefghijklmnopqrstuvwxyz'
uppercase = 'ABCDEFGHIJKLMNOPQRSTUVWXYZ'
letters = lowercase + uppercase
ascii_lowercase = lowercase
ascii_uppercase = uppercase
ascii_letters = ascii_lowercase + ascii_uppercase
digits = '0123456789'
hexdigits = digits + 'abcdef' + 'ABCDEF'
octdigits = '01234567'
punctuation = '!"#$%&()*+,-./:;<=>?@[\]^_`{|}~'
printable = digits + letters + punctuation + whitespace



#unwrap all elements to use with API
items = UnwrapElement(IN[0])
TransactionManager.Instance.EnsureInTransaction(doc)
#apply lineweight override to elements in an input list
typelist = list()
for i in items:
	cl = filter(lambda x: x in printable, i)
	typelist.append(cl)


# "End" the transaction
TransactionManager.Instance.TransactionTaskDone()

#Assign your output to the OUT variable
OUT = typelist
# ----------------------------------------
length = String.Length(python_script_2)  # frozen
code_block_3 = CodeBlock { 1; true; }
eq = length == code_block_3.out0
allIndicesOf = List.AllIndicesOf(list=eq, item=code_block_3.out1)
filterByBoolMask = List.FilterByBoolMask(list=python_script_2, mask=eq)
code_block_4 = CodeBlock(i=filterByBoolMask.in) { "0"+i; }
replaceItemAtIndex = List.List.ReplaceItemAtIndex(python_script_2, allIndicesOf, code_block_4)
setParameterByName = Element.SetParameterByName(element=all_elements_of_category, parameterName=string, value=replaceItemAtIndex)  # frozen
isUnicode = Custom[String.IsUnicode](string=python_script_2)  # Determines if input string is a unicode character.
uniqueItems = List.UniqueItems(isUnicode)
code_block_5 = CodeBlock { "Альбом"; "Корпус"; 1; 0; ""; "Раздел проекта"; "Лист"; "Номер листа"; }  # frozen
getParameterValueByName_3 = Element.GetParameterValueByName(element=all_elements_of_category, parameterName=code_block_5.out0)
code_block_6 = CodeBlock { "."; "0"; }
split = String.Split(getParameterValueByName_3, code_block_6.out0)
transpose = List.Transpose(split)
code_block_7 = CodeBlock(a=transpose) { a[0]; }
getParameterValueByName_4 = Element.GetParameterValueByName(element=all_elements_of_category, parameterName=code_block_5.out1)
string_from_object = FromObject(getParameterValueByName_4)
substring = String.Substring(str=string_from_object, startIndex=code_block_5.out3, length=code_block_5.out2)
replaceNulls = Lists.Manage.ReplaceNulls(substring, code_block_5.out3)
getParameterValueByName_5 = Element.GetParameterValueByName(element=all_elements_of_category, parameterName=code_block_5.out5)
getParameterValueByName_6 = Element.GetParameterValueByName(element=all_elements_of_category, parameterName=code_block_5.out6)
code_block_8 = CodeBlock(a=code_block_7, l=replaceNulls, s=getParameterValueByName_5, n=getParameterValueByName_6) { a+"."+l+"."+s+"."+n; }
setParameterByName_2 = Element.SetParameterByName(element=all_elements_of_category, parameterName=code_block_5.out7, value=code_block_8)
