# Dynamo graph 00.Из номера листа в Лист1.1.dyn (Dynamo 1.3.1.1736)

# group: ЭЛЕМЕНТЫ УПРАВЛЕНИЯ
# note: ПЕРЕМЕННЫЕ ЗНАЧЕНИЯ
# note: ЭЛЕМЕНТЫ УПРАВЛЕНИЯ

# group: ПОЛУЧАЕМ ДАННЫЕ ИЗ РЕВИТ
# note: ПОЛУЧАЕМ ДАННЫЕ ИЗ РЕВИТ

# group: ПРОВЕРОЧНЫЕ НОДЫ
# note: ПРОВЕРОЧНЫЕ НОДЫ

# group: ИСПОЛНИТЕЛЬНЫЕ НОДЫ (фильтрование, подбор, списки и т.д.)
# note: ИСПОЛНИТЕЛЬНЫЕ НОДЫ
# note: НОДЫ РАБОТАЮЩИЕ С ДАННЫМИ

# group: КЛЮЧЕВЫЕ МОМЕНТЫ РАБОТЫ
# note: ИТОГОВАЯ КОНСОЛИДАЦИЯ ДАННЫХ

# group: ПЕРЕДАЁМ ИНФОРМАЦИЮ В РЕВИТ
# note: ПЕРЕДАЁМ ИНФОРМАЦИЮ В РЕВИТ

# group: ПРИМЕЧАНИЯ ПО ЦВЕТОВОЙ ГРУППИРОВКЕ
# note: GUIDELINES

# group: ЗАПАСНЫЕ ВАРИАНТЫ, ДОПОЛНИТЕЛЬНЫЕ ОПЦИИ
# note: ЗАПАСНЫЕ
# note: ДОПОЛНИТЕЛЬНЫЕ. Градации серово по важности, темнее - важнее

# group: ВСЁ ОСТАЛЬНОЕ
# note: ВСЁ ОСТАЛЬНОЕ

# group: Get Revit Selection:
forceChildrensEval = ForceChildrensEval()  # unwired: arg0
pys_get_revit_selection = Python(IN[0]=forceChildrensEval)
# ---------- pys_get_revit_selection.python (22 lines) ----------
import clr
clr.AddReference('RevitServices')
clr.AddReference('RevitAPI')
from Autodesk.Revit.DB import *
import RevitServices
from RevitServices.Persistence import DocumentManager
from Autodesk.Revit.ApplicationServices import Application

reset = IN[0]

doc = DocumentManager.Instance.CurrentDBDocument
uidoc = DocumentManager.Instance.CurrentUIApplication.ActiveUIDocument
ids = uidoc.Selection.GetElementIds()

idd = [str(i) for i in ids]

if isinstance(idd, list) == True:
	elems = [doc.GetElement(ElementId(int(i))) for i in idd]
else:
	elems = doc.GetElement(ElementId(int(idd)))

OUT = elems
# ----------------------------------------

categories = Categories("Sheets")
all_elements_of_category = ElementsOfCategory(categories)
code_block = CodeBlock { "Раздел проекта"; }  # frozen
getParameterValueByName = Element.GetParameterValueByName(parameterName=code_block)  # unwired: element
sortByFunction = SortByFunction(all_elements_of_category, getParameterValueByName)
number_slider = DoubleSlider(100, range=0..100 step 1)
count = Count(all_elements_of_category)
code_block_2 = CodeBlock(x1=number_slider, x=count) { x1..(x1+x); }
string_from_object = FromObject(code_block_2)
parameters = Element.Parameters(all_elements_of_category)
code_block_3 = CodeBlock { "SHEET_NUMBER"; }
code_block_4 = CodeBlock(ParameterName=code_block_3) { ParameterName; }
code_block_5 = CodeBlock { Elemnts; }  # unwired: Elemnts
code_block_6 = CodeBlock { x1[0]+"-"+x; }  # frozen; unwired: x1, x
flatten = Flatten(code_block_6)
string_from_object_2 = FromObject(flatten)
code_block_7 = CodeBlock(ParameterValues=string_from_object_2) { ParameterValues; }
python_script = Python(IN[0]=code_block_4, IN[1]=code_block_5, IN[2]=code_block_7)  # frozen
# ---------- python_script.python (78 lines) ----------
#Copyright(c) 2015, Konrad K Sobon
# @arch_laboratory, http://archi-lab.net

import clr
import sys
clr.AddReference('ProtoGeometry')
from Autodesk.DesignScript.Geometry import *

pyt_path = r'C:\Program Files (x86)\IronPython 2.7\Lib'
sys.path.append(pyt_path)

# Import Element wrapper extension methods
clr.AddReference("RevitNodes")
import Revit
clr.ImportExtensions(Revit.Elements)

# Import DocumentManager and TransactionManager
clr.AddReference("RevitServices")
import RevitServices
from RevitServices.Persistence import DocumentManager
from RevitServices.Transactions import TransactionManager

doc = DocumentManager.Instance.CurrentDBDocument
uiapp = DocumentManager.Instance.CurrentUIApplication
app = uiapp.Application

# Import RevitAPI
clr.AddReference("RevitAPI")
import Autodesk
from Autodesk.Revit.DB import *
import System

#The inputs to this node will be stored as a list in the IN variable.
dataEnteringNode = IN

paramName = IN[0]
paramValues = IN[2]

if isinstance(IN[1], list):
	elements = []
	for i in IN[1]:
		elements.append(UnwrapElement(i))
else:
	elements = IN[1]

def GetBuiltInParam(paramName):
	builtInParams = System.Enum.GetValues(BuiltInParameter)
	test = []
	for i in builtInParams:
		if i.ToString() == paramName:
			test.append(i)
			break
		else:
			continue
	return test[0]

try:
	errorReport = None
	# "Start" the transaction
	TransactionManager.Instance.EnsureInTransaction(doc)
	
	bipName = GetBuiltInParam(paramName)
	for i, j in zip(elements, paramValues):
		param = i.get_Parameter(bipName)
		param.Set(j)
	
	# "End" the transaction
	TransactionManager.Instance.TransactionTaskDone()
except:
	# if error accurs anywhere in the process catch it
	import traceback
	errorReport = traceback.format_exc()

#Assign your output to the OUT variable
if errorReport == None:
	OUT = 0
else:
	OUT = errorReport
# ----------------------------------------
groupByFunction = GroupByFunction(arg1=getParameterValueByName)  # unwired: arg0

# group: Новый параметр для листа
string = StringInput("Лист")

code_block_8 = CodeBlock { "Номер листа"; }
getParameterValueByName_2 = Element.GetParameterValueByName(element=all_elements_of_category, parameterName=code_block_8)
code_block_9 = CodeBlock { "."; }
split = String.Split(getParameterValueByName_2, code_block_9)
flatten_2 = Flatten(split@L2)
transpose = List.Transpose(flatten_2)
code_block_10 = CodeBlock(a=transpose) { Flatten(a); }
# note: ТРАВИМ ТАРА.. ЮНИКОД
python_script_2 = Python(IN[0]=code_block_10)
# ---------- python_script_2.python (46 lines) ----------
#Created by DPS Design, dpsdesign.org
import clr
clr.AddReference('ProtoGeometry')
from Autodesk.DesignScript.Geometry import *

# Import ToDSType(bool) extension method
clr.AddReference("RevitNodes")
import Revit
clr.ImportExtensions(Revit.Elements)

# Import DocumentManager and TransactionManager
clr.AddReference("RevitServices")
import RevitServices
from RevitServices.Persistence import DocumentManager
from RevitServices.Transactions import TransactionManager

from System.Collections.Generic import *

# Import RevitAPI
clr.AddReference("RevitAPI")
import Autodesk

doc = DocumentManager.Instance.CurrentDBDocument
uiapp = DocumentManager.Instance.CurrentUIApplication
app = uiapp.Application

#The inputs to this node will be stored as a list in the IN variable.
dataEnteringNode = IN

#unwrap all elements to use with API
items = UnwrapElement(IN[0])
TransactionManager.Instance.EnsureInTransaction(doc)
#apply lineweight override to elements in an input list
typelist = list()
for i in items:
	try:
		typelist.append(i.decode('unicode_escape').encode('ascii','ignore'))
	except:
		typelist.append(i)


# "End" the transaction
TransactionManager.Instance.TransactionTaskDone()

#Assign your output to the OUT variable
OUT = typelist
# ----------------------------------------
python_script_3 = Python(IN[0]=python_script_2)
# ---------- python_script_3.python (56 lines) ----------
#Created by DPS Design, dpsdesign.org
import clr
clr.AddReference('ProtoGeometry')
from Autodesk.DesignScript.Geometry import *

# Import ToDSType(bool) extension method
clr.AddReference("RevitNodes")
import Revit
clr.ImportExtensions(Revit.Elements)

# Import DocumentManager and TransactionManager
clr.AddReference("RevitServices")
import RevitServices
from RevitServices.Persistence import DocumentManager
from RevitServices.Transactions import TransactionManager

from System.Collections.Generic import *

# Import RevitAPI
clr.AddReference("RevitAPI")
import Autodesk

doc = DocumentManager.Instance.CurrentDBDocument
uiapp = DocumentManager.Instance.CurrentUIApplication
app = uiapp.Application

whitespace = ' \t\n\r\v\f'
lowercase = 'abcdefghijklmnopqrstuvwxyz'
uppercase = 'ABCDEFGHIJKLMNOPQRSTUVWXYZ'
letters = lowercase + uppercase
ascii_lowercase = lowercase
ascii_uppercase = uppercase
ascii_letters = ascii_lowercase + ascii_uppercase
digits = '0123456789'
hexdigits = digits + 'abcdef' + 'ABCDEF'
octdigits = '01234567'
punctuation = '!"#$%&()*+,-./:;<=>?@[\]^_`{|}~'
printable = digits + letters + punctuation + whitespace



#unwrap all elements to use with API
items = UnwrapElement(IN[0])
TransactionManager.Instance.EnsureInTransaction(doc)
#apply lineweight override to elements in an input list
typelist = list()
for i in items:
	cl = filter(lambda x: x in printable, i)
	typelist.append(cl)


# "End" the transaction
TransactionManager.Instance.TransactionTaskDone()

#Assign your output to the OUT variable
OUT = typelist
# ----------------------------------------
setParameterByName = Element.SetParameterByName(element=all_elements_of_category, parameterName=string, value=python_script_3)  # frozen
code_block_11 = CodeBlock { "---"; }
count_2 = Count(code_block_10)  # frozen
ofRepeatedItem = List.OfRepeatedItem(item=code_block_11, amount=count_2)
isUnicode = Custom[String.IsUnicode](string=python_script_3)  # Determines if input string is a unicode character.
uniqueItems = List.UniqueItems(isUnicode)
length = String.Length(python_script_3)  # frozen
code_block_12 = CodeBlock { 1; true; }
eq = length == code_block_12.out0
allIndicesOf = List.AllIndicesOf(list=eq, item=code_block_12.out1)
filterByBoolMask = List.FilterByBoolMask(list=python_script_3, mask=eq)
code_block_13 = CodeBlock(i=filterByBoolMask.in) { "0"+i; }
replaceItemAtIndex = List.List.ReplaceItemAtIndex(python_script_3, allIndicesOf, code_block_13)
