# Dynamo graph 00.Копирование листа и его содержимого 1.5.dyn (Dynamo 1.3.2.2480)

# note: ВСЁ ОСТАЛЬНОЕ

# group: КЛЮЧЕВЫЕ МОМЕНТЫ РАБОТЫ
# note: ИТОГОВАЯ КОНСОЛИДАЦИЯ ДАННЫХ

# group: ИСПОЛНИТЕЛЬНЫЕ НОДЫ (фильтрование, подбор, списки и т.д.)
# note: НОДЫ РАБОТАЮЩИЕ С ДАННЫМИ
# note: ИСПОЛНИТЕЛЬНЫЕ НОДЫ

# group: ЗАПАСНЫЕ ВАРИАНТЫ, ДОПОЛНИТЕЛЬНЫЕ ОПЦИИ
# note: ДОПОЛНИТЕЛЬНЫЕ. Градации серово по важности, темнее - важнее
# note: ЗАПАСНЫЕ

# group: ПРОВЕРОЧНЫЕ НОДЫ
# note: ПРОВЕРОЧНЫЕ НОДЫ

# group: ПЕРЕДАЁМ ИНФОРМАЦИЮ В РЕВИТ
# note: ПЕРЕДАЁМ ИНФОРМАЦИЮ В РЕВИТ

# group: ЭЛЕМЕНТЫ УПРАВЛЕНИЯ
# note: ПЕРЕМЕННЫЕ ЗНАЧЕНИЯ
# note: ЭЛЕМЕНТЫ УПРАВЛЕНИЯ

# group: ПРИМЕЧАНИЯ ПО ЦВЕТОВОЙ ГРУППИРОВКЕ
# note: GUIDELINES

# group: ПОЛУЧАЕМ ДАННЫЕ ИЗ РЕВИТ
# note: ПОЛУЧАЕМ ДАННЫЕ ИЗ РЕВИТ

forceChildrensEval = ForceChildrensEval()  # unwired: arg0
pys_get_revit_selection = Python(IN[0]=forceChildrensEval)
# ---------- pys_get_revit_selection.python (22 lines) ----------
import clr
clr.AddReference('RevitServices')
clr.AddReference('RevitAPI')
from Autodesk.Revit.DB import *
import RevitServices
from RevitServices.Persistence import DocumentManager
from Autodesk.Revit.ApplicationServices import Application

reset = IN[0]

doc = DocumentManager.Instance.CurrentDBDocument
uidoc = DocumentManager.Instance.CurrentUIApplication.ActiveUIDocument
ids = uidoc.Selection.GetElementIds()

idd = [str(i) for i in ids]

if isinstance(idd, list) == True:
	elems = [doc.GetElement(ElementId(int(i))) for i in idd]
else:
	elems = doc.GetElement(ElementId(int(idd)))

OUT = elems
# ----------------------------------------
code_block = CodeBlock(elements_on_sheet=pys_get_revit_selection) { elements_on_sheet; }
code_block_2 = CodeBlock(S_E=code_block) { S_E; }
getCategory = Element.GetCategory(code_block)
string_from_object = FromObject(getCategory)
code_block_3 = CodeBlock { "Видовые экраны"; "Типовые аннотации"; "Основные надписи"; "Графика спецификации"; "Листы"; }
eq = string_from_object == code_block_3.out1
filterByBoolMask = List.FilterByBoolMask(list=code_block_2, mask=eq)
типовые_аннотации = Watch(filterByBoolMask.in)
eq_2 = string_from_object == code_block_3.out3
filterByBoolMask_2 = List.FilterByBoolMask(list=code_block_2, mask=eq_2)
спецификации = Watch(filterByBoolMask_2.in)

# group: Дублировать спецификации?
дублировать_спецификации = BoolSelector(true)
code_block_4 = CodeBlock { ""; }
create = List.Create(спецификации, code_block_4)
create_2 = List.Create(code_block_4, спецификации)
if_ = Python(IN[0]=дублировать_спецификации, IN[1]=create, IN[2]=create_2)
# ---------- if_.python (14 lines) ----------
import clr

det = IN[0]
true = UnwrapElement(IN[1])
false = UnwrapElement(IN[2])
list = []

if det:
	out = true
else:
	out = false

#Назначьте вывод переменной OUT.
OUT = out
# ----------------------------------------

code_block_5 = CodeBlock(dubl=if_, copy=if_) { dubl[0]; copy[1]; }
code_block_6 = CodeBlock(спецификации=code_block_5.out1) { спецификации; }
provide_your_elements_from_the = List.Create(типовые_аннотации, code_block_6)  # "provide your elements from the source view"
code_block_7 = CodeBlock(item=provide_your_elements_from_the) { Flatten({item}); }
elements_id = Python(IN[0]=code_block_7)
# ---------- elements_id.python (17 lines) ----------
import clr
clr.AddReference('RevitAPI')
from Autodesk.Revit.DB import *

clr.AddReference("RevitNodes")
import Revit
clr.ImportExtensions(Revit.Elements)

items = UnwrapElement(IN[0])
elementlist = list()
booleans = list()
for item in items:
	try:
		elementlist.append(item.Id)
	except:
		pass
OUT = elementlist
# ----------------------------------------
текущий_активный_вид = Python(IN[0]=forceChildrensEval)
# ---------- текущий_активный_вид.python (14 lines) ----------
#Copyright(c) 2016, Dimitar Venkov
# @5devene, dimitar.ven@gmail.com

import clr

clr.AddReference("RevitServices")
import RevitServices
from RevitServices.Persistence import DocumentManager
doc = DocumentManager.Instance.CurrentDBDocument
clr.AddReference("RevitNodes")
import Revit
clr.ImportExtensions(Revit.Elements)

OUT = doc.ActiveView.ToDSType(True)
# ----------------------------------------
getCategory_2 = Element.GetCategory(текущий_активный_вид)
string_from_object_2 = FromObject(getCategory_2)
eq_3 = string_from_object_2 == code_block_3.out4
filterByBoolMask_3 = List.FilterByBoolMask(list=текущий_активный_вид, mask=eq_3)
листы = Watch(filterByBoolMask_3.in)
code_block_8 = CodeBlock(sourceView=листы) { sourceView[0]; }

# group: НАЗВАНИЕ ВИДОВ
поиск_и_замена_в_названии_вида = BoolSelector(false)
искать = StringInput("КЖ-03")
заменить = StringInput("КМ-07")

eq_4 = string_from_object == code_block_3.out2
filterByBoolMask_4 = List.FilterByBoolMask(list=code_block_2, mask=eq_4)
основные_надписи = Watch(filterByBoolMask_4.in)
type = Elements.Element.Type(основные_надписи)
code_block_9 = CodeBlock { "_"; }

# group: Название параметров в листе
code_block_10 = CodeBlock { "Имя листа"; "Номер листа"; }

getParameterValueByName = Element.GetParameterValueByName(element=листы, parameterName=code_block_10.out0)
getParameterValueByName_2 = Element.GetParameterValueByName(element=листы, parameterName=code_block_10.out1)
code_block_11 = CodeBlock(test=code_block_9, name=getParameterValueByName, number=getParameterValueByName_2) { test+name; test+number; }
create_3 = List.Create(type, code_block_11.out0, code_block_11.out1)
flatten = Flatten(create_3)
code_block_12 = CodeBlock(a=flatten) { a[0]; a[1]; a[2]; }
code_block_13 = CodeBlock(Формат=code_block_12.out0, Имя=code_block_12.out1, Номер=code_block_12.out2) { Формат; Имя; Номер; }
forceChildrensEval_2 = ForceChildrensEval()  # unwired: arg0
создание_листа = Python(IN[0]=code_block_13.Формат, IN[1]=code_block_13.Имя, IN[2]=code_block_13.Номер, IN[3]=forceChildrensEval_2)
# ---------- создание_листа.python (26 lines) ----------
import clr
clr.AddReference('RevitAPI')
from Autodesk.Revit.DB import *

clr.AddReference("RevitNodes")
import Revit
clr.ImportExtensions(Revit.Elements)

clr.AddReference("RevitServices")
import RevitServices
from RevitServices.Persistence import DocumentManager
from RevitServices.Transactions import TransactionManager

doc = DocumentManager.Instance.CurrentDBDocument
elementlist = []

elt = UnwrapElement(IN[0])

TransactionManager.Instance.EnsureInTransaction(doc)


newsheet = ViewSheet.Create(doc, elt.Id);
newsheet.SheetNumber = IN[2]
newsheet.Name = IN[1]
elementlist.append(newsheet.ToDSType(False))
OUT = elementlist
# ----------------------------------------
end = Revit.Transaction.Transaction.End(создание_листа)
code_block_14 = CodeBlock { "Номер листа уже существует"; }
eq_5 = end == code_block_14
filterByBoolMask_5 = List.FilterByBoolMask(list=end, mask=eq_5)
code_block_15 = CodeBlock(Sheet_List=filterByBoolMask_5.out) { Sheet_List[0]; }
eq_6 = string_from_object == code_block_3.out0
filterByBoolMask_6 = List.FilterByBoolMask(list=code_block_2, mask=eq_6)
видовые_экраны = Watch(filterByBoolMask_6.in)
фильтр_легенд = Python(IN[0]=видовые_экраны)
# ---------- фильтр_легенд.python (21 lines) ----------
import clr
clr.AddReference('RevitAPI')
from Autodesk.Revit.DB import *

clr.AddReference("RevitServices")
import RevitServices
from RevitServices.Persistence import DocumentManager

doc = DocumentManager.Instance.CurrentDBDocument
faminsts = UnwrapElement(IN[0])
viewlist = []
legendlist = []
for item in faminsts:
	viewNamne = item.get_Parameter(BuiltInParameter.VIEW_FAMILY).AsString()
	if "Легенды" in viewNamne:
		viewid = item.ViewId
		lg = doc.GetElement(viewid)
		legendlist.append(item)
	else:
		viewlist.append(item)
OUT = ([viewlist, legendlist])
# ----------------------------------------

# group: Дублировать легенды?
дублировать_легенды = BoolSelector(true)
code_block_16 = CodeBlock { ""; }
create_4 = List.Create(видовые_экраны, code_block_16)
if_2 = Python(IN[0]=дублировать_легенды, IN[1]=create_4, IN[2]=фильтр_легенд)  # same code as if_

code_block_17 = CodeBlock(view=if_2, legend=if_2) { view[0]; legend[1]; }
viewPortBoxCenter = Python(IN[0]=code_block_17.out0)  # "View.ViewPortBoxCenter"
# ---------- viewPortBoxCenter.python (42 lines) ----------
#python nodes in dynamo 1.0
#proposed by Julien Benoit @jbenoit44 
#http://aecuandme.wordpress.com/
import clr
clr.AddReference('ProtoGeometry')
from Autodesk.DesignScript.Geometry import *
# Import ToDSType(bool) extension method
clr.AddReference("RevitNodes")
import Revit
clr.ImportExtensions(Revit.Elements)
# Import geometry conversion extension methods
clr.ImportExtensions(Revit.GeometryConversion)
# Import DocumentManager and TransactionManager
clr.AddReference("RevitServices")
import RevitServices
from RevitServices.Persistence import DocumentManager
from RevitServices.Transactions import TransactionManager
from System.Collections.Generic import *
# Import RevitAPI
clr.AddReference("RevitAPI")
import Autodesk
from Autodesk.Revit.DB import *

doc = DocumentManager.Instance.CurrentDBDocument
uiapp = DocumentManager.Instance.CurrentUIApplication
app = uiapp.Application
uidoc=DocumentManager.Instance.CurrentUIApplication.ActiveUIDocument

elt = []
for i in IN[0]:
	elt.append(UnwrapElement(i))

# Start Transaction
TransactionManager.Instance.EnsureInTransaction(doc)
loc=[]
for v in elt:
	loc.append(v.GetBoxCenter().ToPoint())

# End Transaction
TransactionManager.Instance.TransactionTaskDone()

OUT=loc
# ----------------------------------------
viewPortBoxCenter_2 = Python(IN[0]=code_block_17.out1)  # "View.ViewPortBoxCenter"; same code as viewPortBoxCenter

# group: .
виды = Watch(code_block_17.out0)
code_block_18 = CodeBlock(view=viewPortBoxCenter, legend=viewPortBoxCenter_2) { view; legend; }
python_script = Python(IN[0]=code_block_17.out0)
# ---------- python_script.python (10 lines) ----------
import clr
clr.AddReference('RevitAPI')
from Autodesk.Revit.DB import *

faminsts = UnwrapElement(IN[0])
elementlist = list()
for item in faminsts:
	n = item.get_Parameter(BuiltInParameter.VIEW_FAMILY).AsString()
	elementlist.append(n)
OUT = elementlist
# ----------------------------------------

flatten_2 = Flatten(виды)
code_block_19 = CodeBlock(Views_List=flatten_2) { Views_List; }
flatten_3 = Flatten(code_block_18.view)
code_block_20 = CodeBlock(Points_List=flatten_3) { Points_List; }
code_block_21 = CodeBlock(legend=code_block_17.out1) { legend; }
code_block_22 = CodeBlock(le_points=code_block_18.legend) { le_points; }
code_block_23 = CodeBlock(schedule=code_block_5.out0) { schedule; }
viewPortBoxCenter_3 = Python(IN[0]=code_block_5.out0)  # "View.ViewPortBoxCenter"
# ---------- viewPortBoxCenter_3.python (43 lines) ----------
#python nodes in dynamo 1.0
#proposed by Julien Benoit @jbenoit44 
#http://aecuandme.wordpress.com/
import clr
clr.AddReference('ProtoGeometry')
from Autodesk.DesignScript.Geometry import *
# Import ToDSType(bool) extension method
clr.AddReference("RevitNodes")
import Revit
clr.ImportExtensions(Revit.Elements)
# Import geometry conversion extension methods
clr.ImportExtensions(Revit.GeometryConversion)
# Import DocumentManager and TransactionManager
clr.AddReference("RevitServices")
import RevitServices
from RevitServices.Persistence import DocumentManager
from RevitServices.Transactions import TransactionManager
from System.Collections.Generic import *
# Import RevitAPI
clr.AddReference("RevitAPI")
import Autodesk
from Autodesk.Revit.DB import *

doc = DocumentManager.Instance.CurrentDBDocument
uiapp = DocumentManager.Instance.CurrentUIApplication
app = uiapp.Application
uidoc=DocumentManager.Instance.CurrentUIApplication.ActiveUIDocument

elt = []
for i in IN[0]:
	elt.append(UnwrapElement(i))

# Start Transaction
TransactionManager.Instance.EnsureInTransaction(doc)
loc=[]
for v in elt:
	pt = v.Point.ToPoint()
	loc.append(pt)
	
# End Transaction
TransactionManager.Instance.TransactionTaskDone()

OUT= loc
# ----------------------------------------
code_block_24 = CodeBlock(sch_points=viewPortBoxCenter_3) { sch_points; }
дублирование_видов_и_размещение = Python(IN[0]=поиск_и_замена_в_названии_вида, IN[1]=искать, IN[2]=заменить, IN[3]=code_block_15, IN[4]=code_block_19, IN[5]=code_block_20, IN[6]=дублировать_легенды, IN[7]=code_block_21, IN[8]=code_block_22, IN[9]=дублировать_спецификации, IN[10]=code_block_23, IN[11]=code_block_24)  # "Дублирование видов и размещение их на листе"
# ---------- дублирование_видов_и_размещение.python (115 lines) ----------
#python nodes in dynamo 1.2
#proposed by Julien Benoit @jbenoit44 
#http://aecuandme.wordpress.com/
import clr
clr.AddReference('ProtoGeometry')
from Autodesk.DesignScript.Geometry import *
# Import ToDSType(bool) extension method
clr.AddReference("RevitNodes")
import Revit
clr.ImportExtensions(Revit.Elements)
# Import geometry conversion extension methods
clr.ImportExtensions(Revit.GeometryConversion)
# Import DocumentManager and TransactionManager
clr.AddReference("RevitServices")
import RevitServices
from RevitServices.Persistence import DocumentManager
from RevitServices.Transactions import TransactionManager
from System.Collections.Generic import *
# Import RevitAPI
clr.AddReference("RevitAPI")
import Autodesk
from Autodesk.Revit.DB import *

doc = DocumentManager.Instance.CurrentDBDocument
uiapp = DocumentManager.Instance.CurrentUIApplication
app = uiapp.Application
uidoc=DocumentManager.Instance.CurrentUIApplication.ActiveUIDocument
zm_true = IN[0] #bool заменяем ли мы какой-то текст в имени вида
zm_find = IN[1]
zm_replace = IN[2]
report = "OK"
le_true = IN[6] #bool дублируем ли мы легенды
b = "легенды дублированы"
sh_true = IN[9] #bool дублируем ли мы спецификации


dupopt = Autodesk.Revit.DB.ViewDuplicateOption.WithDetailing
	
sch_dupopt = Autodesk.Revit.DB.ViewDuplicateOption.Duplicate

sheet = UnwrapElement(IN[3])

# Списки элементов и их координаты на листе
views=[]	
for i in IN[4]:
	views.append(UnwrapElement(i))
points=[]	
for i in IN[5]:
	points.append(UnwrapElement(i).ToXyz())
legends=[]	
for i in IN[7]:
	legends.append(UnwrapElement(i))	
le_points=[]	
for i in IN[8]:
	le_points.append(UnwrapElement(i).ToXyz())		
schedule=[]	
for i in IN[10]:
	schedule.append(UnwrapElement(i))	
sh_points=[]	
for i in IN[11]:
	sh_points.append(UnwrapElement(i).ToXyz())			
	

# Start Transaction
TransactionManager.Instance.EnsureInTransaction(doc)
viewp=[]

for v,p in zip(views,points):
	viewid = v.ViewId
	view = doc.GetElement(viewid)
	newview = view.Duplicate(dupopt)
	nv = doc.GetElement(newview)
	
	if zm_true:
		try:
			rnm = view.Name
			nv.Name = rnm.replace(zm_find, zm_replace)
		except:
			report = "В имени вида не найдено"
	
	a=Viewport.Create(doc, sheet.Id, nv.Id, p)
	viewp.append(a)
	
if le_true:
	pass
else:
	b = "легенды копированы"
	for le,p in zip(legends,le_points):
		lid = le.ViewId
		l = doc.GetElement(lid)
		a=Viewport.Create(doc, sheet.Id, l.Id, p)
		viewp.append(a)
		
if sh_true:
	for s,p in zip(schedule,sh_points):
		scheid = s.ScheduleId
		sche = doc.GetElement(scheid)
		newsche = sche.Duplicate(sch_dupopt)
		nsh = doc.GetElement(newsche)
		if zm_true:
			try:
				rnm = sche.Name
				nsh.Name = rnm.replace(zm_find, zm_replace)
			except:
				report = "В имени спецификации не найдено"	
		else:
			pass
			
		a=ScheduleSheetInstance.Create(doc, sheet.Id, nsh.Id, p)
		viewp.append(a)
		
# End Transaction
TransactionManager.Instance.TransactionTaskDone()

OUT = ([sheet, viewp, report, b])
# ----------------------------------------
передаём_лист_дальше = CodeBlock(list=дублирование_видов_и_размещение, report=дублирование_видов_и_размещение, legend=дублирование_видов_и_размещение) { list[0]; report[2]; legend[3]; }
code_block_25 = CodeBlock(destinationView=передаём_лист_дальше.out0) { destinationView; }
isEmpty = List.IsEmpty(elements_id)
создаём_на_листе_аннотационные = Python(IN[0]=elements_id, IN[1]=code_block_8, IN[2]=code_block_25, IN[3]=isEmpty)  # "Создаём на листе аннотационные семейства"
# ---------- создаём_на_листе_аннотационные.python (40 lines) ----------
#Based on a node originally from Dimitar Venkov
import clr

clr.AddReference("RevitServices")
import RevitServices
from RevitServices.Persistence import DocumentManager
from RevitServices.Transactions import TransactionManager
doc = DocumentManager.Instance.CurrentDBDocument
doc1 = DocumentManager.Instance.CurrentDBDocument

clr.AddReference("RevitNodes")
import Revit
clr.ImportExtensions(Revit.Elements)
clr.ImportExtensions(Revit.GeometryConversion)

clr.AddReference("RevitAPI")
from Autodesk.Revit.DB import *

from System.Collections.Generic import*

empty = IN[3]
ele = List[ElementId](IN[0])
sourceView = UnwrapElement(IN[1])
destView = UnwrapElement(IN[2])
res1 = 0

if empty:
	OUT = ([destView, res1])
else:
	try:	
		newId = ElementTransformUtils.CopyElements(sourceView, ele, destView, None, CopyPasteOptions() )
	
		res1 = [doc.GetElement(newId[i]).ToDSType(False) for i in xrange(len(newId) )]
	except: 	
		TransactionManager.Instance.EnsureInTransaction(doc)
		newId = ElementTransformUtils.CopyElements(sourceView, ele, destView, None, CopyPasteOptions() )
	
		res1 = [doc.GetElement(newId[i]).ToDSType(False) for i in xrange(len(newId) )]

OUT = ([destView, res1])
# ----------------------------------------
передаём_лист_дальше_2 = CodeBlock(list=создаём_на_листе_аннотационные) { list[0]; }

# group: СОБИРАЕМ ВСЕ ПАРАМЕТРЫ ЛИСТА, кроме выбранных и тех запись, в которые невозможна
parameters = Element.Parameters(листы)
isReadOnly = Parameter.IsReadOnly(parameters)
filterByBoolMask_7 = List.FilterByBoolMask(list=parameters, mask=isReadOnly)
name = Element.Name(filterByBoolMask_7.out)
eq_7 = name == code_block_10.out0
filterByBoolMask_8 = List.FilterByBoolMask(list=name, mask=eq_7)
eq_8 = filterByBoolMask_8.out == code_block_10.out1
filterByBoolMask_9 = List.FilterByBoolMask(list=filterByBoolMask_8.out, mask=eq_8)
getParameterValueByName_3 = Element.GetParameterValueByName(element=листы, parameterName=filterByBoolMask_9.out)

# group: Запись всех возможных параметров проекта
setParameterByName = Element.SetParameterByName(element=передаём_лист_дальше_2, parameterName=filterByBoolMask_9.out, value=getParameterValueByName_3)

есть_ли_дублирование_имени_листа = Watch(filterByBoolMask_5.in)
имя_вида = Watch(передаём_лист_дальше.out1)
watch = Watch(передаём_лист_дальше.out2)
создание_листа_2 = Python(IN[0]=code_block_13.Формат, IN[1]=code_block_13.Имя, IN[2]=code_block_13.Номер, IN[3]=forceChildrensEval_2)  # frozen
# ---------- создание_листа_2.python (28 lines) ----------
import clr
clr.AddReference('RevitAPI')
from Autodesk.Revit.DB import *

clr.AddReference("RevitNodes")
import Revit
clr.ImportExtensions(Revit.Elements)

clr.AddReference("RevitServices")
import RevitServices
from RevitServices.Persistence import DocumentManager
from RevitServices.Transactions import TransactionManager

doc = DocumentManager.Instance.CurrentDBDocument
elementlist = []

elt = UnwrapElement(IN[0])

TransactionManager.Instance.EnsureInTransaction(doc)

try:
	newsheet = ViewSheet.Create(doc, elt.Id);
	newsheet.SheetNumber = IN[2]
	newsheet.Name = IN[1]
	elementlist.append(newsheet.ToDSType(False))
	OUT = elementlist
except:
	OUT = "Номер листа уже существует"
# ----------------------------------------
