# Dynamo graph 00.Пакетная печать1.4.dyn (Dynamo 1.3.3.4111)

# group: ЗАПАСНЫЕ ВАРИАНТЫ, ДОПОЛНИТЕЛЬНЫЕ ОПЦИИ
# note: ДОПОЛНИТЕЛЬНЫЕ. Градации серово по важности, темнее - важнее
# note: ЗАПАСНЫЕ

# group: КЛЮЧЕВЫЕ МОМЕНТЫ РАБОТЫ 1
# note: КОНСОЛИДАЦИЯ И СЛОЖНЫЕ ОБРАБОТКИ

# group: КЛЮЧЕВЫЕ МОМЕНТЫ РАБОТЫ 2
# note: УСЛОЖНЕННЫЕ КОНСТРУКЦИИ
# note: УСЛОЖНЕНЫЕ КОНСТРУКЦИИ

# group: ИСПОЛНИТЕЛЬНЫЕ НОДЫ (фильтрование, подбор, списки и т.д.)
# note: ИСПОЛНИТЕЛЬНЫЕ НОДЫ

# group: Python ноды
# note: Python

# group: ЭЛЕМЕНТЫ УПРАВЛЕНИЯ 2 УРОВЕНЬ
# note: ЭЛЕМЕНТЫ УПРАВЛЕНИЯ
# note: ПЕРЕМЕННЫЕ ЗНАЧЕНИЯ

# group: Запуск питона из внешнего файла
# note: Py - files

# group: ЭЛЕМЕНТЫ УПРАВЛЕНИЯ
# note: ПЕРЕМЕННЫЕ ЗНАЧЕНИЯ
# note: ЭЛЕМЕНТЫ УПРАВЛЕНИЯ

# group: ПОЛУЧАЕМ ДАННЫЕ
# note: ПОЛУЧАЕМ ДАННЫЕ ИЗ РЕВИТ и других источников

# group: ПРОВЕРОЧНЫЕ НОДЫ
# note: ПРОВЕРОЧНЫЕ НОДЫ

# group: ПЕРЕДАЁМ ИНФОРМАЦИЮ
# note: ПЕРЕДАЁМ ИНФОРМАЦИЮ В РЕВИТ
# note: ПЕРЕДАЁМ ИНФОРМАЦИЮ ЕЩЁ КУДА-ТО

# group: ПРИМЕЧАНИЯ ПО ЦВЕТОВОЙ ГРУППИРОВКЕ
# note: GUIDELINES

# group: [PRORUBIM]
forceChildrensEval = ForceChildrensEval()  # unwired: arg0

# group: Все названия Наборов листов
# note: Все названия Наборов листов
get_all_views_set_name = Python(IN[0]=forceChildrensEval)
# ---------- get_all_views_set_name.python (33 lines) ----------
#Copyright(c) 2015, Konrad Sobon
# @arch_laboratory, http://archi-lab.net

import clr
clr.AddReference('ProtoGeometry')
from Autodesk.DesignScript.Geometry import *

# Import DocumentManager and TransactionManager
clr.AddReference("RevitServices")
import RevitServices
from RevitServices.Persistence import DocumentManager
from RevitServices.Transactions import TransactionManager

doc = DocumentManager.Instance.CurrentDBDocument

# Import Element wrapper extension methods
clr.AddReference("RevitNodes")
import Revit
clr.ImportExtensions(Revit.Elements)

# Import RevitAPI
clr.AddReference("RevitAPI")
import Autodesk
from Autodesk.Revit.DB import *

viewSets = FilteredElementCollector(doc).OfClass(ViewSheetSet)
viewSetsName = []

for i in viewSets:
	viewSetsName.append(i.Name)

#Assign your output to the OUT variable
OUT = (viewSetsName, viewSets)
# ----------------------------------------

# group: Элементы управления в интерфейсе
code_block = CodeBlock { InputName : string = ""; }
code_block_2 = CodeBlock(Names=get_all_views_set_name, Sets=get_all_views_set_name) { Names[0]; Sets[1]; }
code_block_3 = CodeBlock(Keys=code_block_2.out0) { Keys; }
code_block_4 = CodeBlock(Values=code_block_2.out1) { Values; }
ui_dropdown_data_data_shape = Python(IN[0]=code_block, IN[1]=code_block_3, IN[2]=code_block_4)
# ---------- ui_dropdown_data_data_shape.python (46 lines) ----------
#Copyright (c) mostafa el ayoubi ,  2016
#Data-Shapes www.data-shapes.net , elayoubi.mostafa@gmail.com

class dropdown():

    def __init__(self,inputname):
        self.inputname = inputname

    def __setitem__(self, key, item):
        self.__dict__[key] = item

    def __getitem__(self, key):
        return self.__dict__[key]

    def __iter__(self):
        return iter(self.__dict__)

    def values(self):
        return self.__dict__.values()

    def keys(self):
        return self.__dict__.keys()

    def __repr__(self):
        return 'UI.DropDown input'
        
x = dropdown(IN[0])

if isinstance(IN[1],list):
	in1 = IN[1]
else:
	in1 = [IN[1]]
if isinstance(IN[2],list):
	in2 = IN[2]
else:
	in2 = [IN[2]]
	

for k,v in zip(in1,in2):
	try:
		x[str(k)] = v
	except:
		x[k.encode('utf-8').decode('utf-8')] = v


OUT = x
# ----------------------------------------
code_block_5 = CodeBlock { InputName : string = ""; }
directory_path = Directory("C:\test")
code_block_6 = CodeBlock(DefaultPath=directory_path) { DefaultPath; }
ui_directorypath_data_data_shape = Python(IN[0]=code_block_5, IN[1]=code_block_6)
# ---------- ui_directorypath_data_data_shape.python (16 lines) ----------
#Copyright (c) mostafa el ayoubi ,  2016
#Data-Shapes www.data-shapes.net , elayoubi.mostafa@gmail.com

class uidirectorypath():

    def __init__(self,inputname,defaultvalue):
        self.inputname = inputname
        self.defaultvalue = defaultvalue
        
    def __repr__(self):
        return 'UI.DirectoryPath input'
        
x = uidirectorypath(IN[0],IN[1])


OUT = x
# ----------------------------------------
create = List.Create(ui_dropdown_data_data_shape, ui_directorypath_data_data_shape)

# group: Интерфейс - окно
code_block_7 = CodeBlock(Inputs=create) { Inputs; }
code_block_8 = CodeBlock { ButtonText_optional : string = "Печать"; }
code_block_9 = CodeBlock { Description_optional : string = "Выберите набор листов:"; }
code_block_10 = CodeBlock { Logo_optional : var = false; }
ui_multipleinputform_data_shape = Python(IN[0]=code_block_7, IN[1]=code_block_8, IN[3]=code_block_9, IN[4]=code_block_10)  # unwired: IN[2]
# ---------- ui_multipleinputform_data_shape.python (489 lines) ----------
#Copyright (c) mostafa el ayoubi ,  2016
#Data-Shapes www.data-shapes.net , elayoubi.mostafa@gmail.com
	
import clr
try:
	clr.AddReference('System.Windows.Forms')
	clr.AddReference('System.Drawing')
	
	from System.Drawing import Point , Size , Graphics, Bitmap, Image, Font, FontStyle, Icon, Color, Region , Rectangle
	from System.Windows.Forms import Application, DockStyle, Button, Form, Label, TrackBar , ToolTip, ColumnHeader, TextBox, CheckBox, FolderBrowserDialog, OpenFileDialog, DialogResult, ComboBox, FormBorderStyle, FormStartPosition, ListView, ListViewItem , SortOrder, Panel, ImageLayout, GroupBox, RadioButton, BorderStyle, PictureBox, PictureBoxSizeMode
	from System.Collections.Generic import *
	from System.Windows.Forms import View as vi
	clr.AddReference('System')
	from System import IntPtr
	from System.ComponentModel import Container
	
	
	import sys
	pyt_path = r'C:\Program Files (x86)\IronPython 2.7\Lib'
	sys.path.append(pyt_path)
	import os
	
	clr.AddReference('RevitAPIUI')
	from  Autodesk.Revit.UI import Selection
	from  Autodesk.Revit.UI.Selection import ISelectionFilter
	
	importcolorselection = 0
	try:
		from  Autodesk.Revit.UI import ColorSelectionDialog
	except:
		importcolorselection = 1
	
	clr.AddReference('RevitNodes')
	import Revit
	clr.ImportExtensions(Revit.Elements)
	clr.ImportExtensions(Revit.GeometryConversion)
	
	clr.AddReference('RevitServices')
	from RevitServices.Persistence import DocumentManager
	doc = DocumentManager.Instance.CurrentDBDocument
	uidoc = DocumentManager.Instance.CurrentUIApplication.ActiveUIDocument

	class selectionfilter(ISelectionFilter):
		def __init__(self,category):
			self.category = category
		def AllowElement(self,element):
			if element.Category.Name in [c.Name for c in self.category]:
				return True
			else:
				return False
		def AllowReference(reference,point):
			return False
		
	class MultiTextBoxForm(Form):
	
	
	    def __init__(self):
	        self.Text = 'Пакетная печать'
	        self.output = []
	        self.values = []
	
	    def setclose(self, sender, event):
	    	cbindexread = 0
	    	for f in self.output:
	    		if f.GetType() == TextBox:
	    			self.values.append(f.Text)
	    		if f.GetType() == CheckBox:
	    			self.values.append(f.Checked)
	    		if f.GetType() == Button:
	    			if f.Tag == None :
	    				self.values.append(f.Text)
	    			else:
	    				self.values.append(f.Tag)
	    		if f.GetType() == ComboBox:
	    			key = f.Text
	    			self.values.append(f.Tag[key])
	    		if f.GetType() == mylistview:
	    			self.values.append([f.Values[i.Text] for i in f.CheckedItems])
	    		if f.GetType() == mytrackbar:
	    			self.values.append(f.startval+f.Value*f.step)
	    		if f.GetType() == mygroupbox:
	    			key = [j.Text for j in f.Controls if j.Checked == True][0]
	    			self.values.append(f.Tag[key])
	    	self.Close()
	
	    def reset(self, sender, event):
			pass
	
	    def openfile(self, sender, event):
			ofd = OpenFileDialog()
			dr = ofd.ShowDialog()
			if dr == DialogResult.OK:
				sender.Text = ofd.FileName
	
	    def opendirectory(self, sender, event):
			fbd = FolderBrowserDialog()
			dr = fbd.ShowDialog()
			if dr == DialogResult.OK:
				sender.Text = fbd.SelectedPath
	
	    def pickobjects(self, sender, event):
			sel = uidoc.Selection.PickObjects(Selection.ObjectType.Element,'')
			selelem = [doc.GetElement(s.ElementId) for s in sel]
			sender.Tag = (selelem)

	    def pickobject(self, sender, event):
			sel = uidoc.Selection.PickObject(Selection.ObjectType.Element,'')
			selelem = doc.GetElement(sel.ElementId) 
			sender.Tag = (selelem)
			
	    def pickobjectsofcat(self, sender, event):
			if isinstance(sender.Tag,list):	    
				category = UnwrapElement(sender.Tag)
			else:
				category = [UnwrapElement(sender.Tag)]
			selfilt = selectionfilter(category)
			sel = uidoc.Selection.PickObjects(Selection.ObjectType.Element,selfilt,'Select %s' %(', '.join([c.Name for c in category])))
			selelem = [doc.GetElement(s.ElementId) for s in sel]
			sender.Tag = (selelem)

	    def pickobjectofcat(self, sender, event):
			if isinstance(sender.Tag,list):	    
				category = UnwrapElement(sender.Tag)
			else:
				category = [UnwrapElement(sender.Tag)]
			selfilt = selectionfilter(category)
			sel = uidoc.Selection.PickObject(Selection.ObjectType.Element,selfilt,'Select %s' %(', '.join([c.Name for c in category])))
			selelem = doc.GetElement(sel.ElementId) 
			sender.Tag = (selelem)
			
	    def pickfaces(self, sender, event):
			selface = uidoc.Selection.PickObjects(Selection.ObjectType.Face,'')
			faces = [uidoc.Document.GetElement(s).GetGeometryObjectFromReference(s).ToProtoType(True) for s in selface]
			sender.Tag = [i for f in faces for i in f]
	
	    def pickedges(self, sender, event):
			seledge = uidoc.Selection.PickObjects(Selection.ObjectType.Edge,'')
			edges = [uidoc.Document.GetElement(s).GetGeometryObjectFromReference(s).AsCurve().ToProtoType(True) for s in seledge]
			sender.Tag = edges

	    def colorpicker(self, sender, event):
			dialog = ColorSelectionDialog()
			selection = ColorSelectionDialog.Show(dialog)
			selected = dialog.SelectedColor
			sender.Tag = selected
			sender.BackColor = Color.FromArgb(selected.Red,selected.Green,selected.Blue)
			sender.ForeColor = Color.FromArgb(selected.Red,selected.Green,selected.Blue)
	
	    def topmost(self):
			self.TopMost = True
	
	    def lvadd(self, sender, event):
			sender.Tag = [i for i in sender.CheckedItems]
			
	    def scroll(self, sender, event):
			parent = sender.Parent
			child = parent.GetChildAtPoint(Point(0,5))
			child.Text = str(sender.startval+sender.Value*sender.step)

	
	class mylistview(ListView):
	
		def __init__(self):
			self.Values = []

	class mytrackbar(TrackBar):
	
		def __init__(self,startval,step):
			self.startval = startval
			self.step = step
			
	class mygroupbox(GroupBox):
	
		def __init__(self):
			self.Values = []
	
	#Form initialization
	
	form = MultiTextBoxForm()
	form.topmost()
	
	
	xlabel = 25
	xinput = 20
	y = 20
	fields = []
	error = 0
	
	#Description 
	
	if IN[3] != "":
		des = Label()
		des.Font = Font("Arial", 15,FontStyle.Bold)
		des.Location = Point(xlabel,y)
		des.AutoSize = True
		des.MaximumSize = Size(300,0)
		des.Text = IN[3]
		form.Controls.Add(des)
		y = des.Bottom + 15
	
	#Input form
	
	
	if isinstance(IN[0],list):
		inputtypes = IN[0]
	else:
		inputtypes = [IN[0]]
	
	for j in inputtypes:

		label = Label()
		label.Location = Point(xlabel,y+4)
		label.AutoSize = True
		label.MaximumSize = Size(120,0)
		label.Text = j.inputname
		form.Controls.Add(label)

		if j.__class__.__name__ == 'dropdown':
			cb = ComboBox()
			cb.Location = Point(xinput,y)
			cb.Width = 160
			[cb.Items.Add(i) for i in j.keys() if not (i == 'inputname' or i == 'height')]
			cb.Tag = j
			form.Controls.Add(cb)
			form.output.append(cb)
			y = label.Bottom + 25
		elif j.__class__.__name__ == 'listview':
			lv = mylistview()
			lv.Values = j
			lv.CheckBoxes = True
			lv.View = vi.List
			lv.Sorting = SortOrder.Ascending
			[lv.Items.Add(i) for i in j.keys() if not (i == 'inputname' or i == 'height')]
			lv.Location = Point(xinput,y+50)
			lv.Width = 495
			lv.Height = j.height
			lv.Scrollable = True
			form.Controls.Add(lv)
			form.output.append(lv)
			y = lv.Bottom + 25
		elif j.__class__.__name__ == 'uitext':
			tb = TextBox()
			tb.Text = j.defaultvalue
			tb.Width = 160
			tb.Location = Point(xinput,y)
			form.Controls.Add(tb)
			form.Controls.Add(label)
			form.output.append(tb)
			y = label.Bottom + 25
		elif j.__class__.__name__ == 'uitextnote':
			gb = GroupBox()
			gb.Text = j.title
			gb.Parent = form
			gb.SendToBack()
			gb.BackColor = Color.Transparent
			gb.Location = Point(xlabel, y)
			tn = Label()
			tn.Location = Point(xlabel,18)
			tn.AutoSize = True
			tn.MaximumSize = Size(260,0)
			tn.Text = j.textnote
			tn.BringToFront()
			gb.Controls.Add(tn)
			gb.Size = Size(285, tn.Bottom-tn.Top+25)
			y = gb.Bottom + 25
		elif j.__class__.__name__ == 'uibool':
			yn = CheckBox()
			yn.Width = 150
			yn.Location = Point(xinput,y)
			yn.Text = j.booltext
			yn.Checked = j.defaultvalue
			form.Controls.Add(yn)
			form.output.append(yn)
			y = label.Bottom + 25
		elif j.__class__.__name__ == 'uiradio':
			yrb = 20
			rbs = []
			rbgroup = mygroupbox()
			rbgroup.Width = 160
			rbgroup.Location = Point(xinput,y)
			rbgroup.Tag = j
			for key in j.keys():
				if key != 'inputname':
					rb = RadioButton()
					rb.Text = key 
					rb.Width = 130
					rb.Location = Point(20,yrb)
					rbgroup.Controls.Add(rb)
					ybot = rb.Bottom
					yrb = ybot + 5					
				else:
					pass
			rbgroup.Height = ybot +20
			[rbgroup.Controls.Add(rb) for rb in rbs]
			form.Controls.Add(rbgroup)
			form.output.append(rbgroup)
			y = rbgroup.Bottom + 25
		elif j.__class__.__name__  == 'uifilepath':
			fp = Button()
			fp.Width = 160
			fp.Text = j.defaultvalue
			fp.Location = Point(xinput,y)
			form.Controls.Add(fp)
			fp.Click += form.openfile
			form.output.append(fp)
			y = label.Bottom + 25
		elif j.__class__.__name__ == 'uidirectorypath':
			dp = Button()
			dp.Width = 160
			dp.Text = j.defaultvalue
			dp.Location = Point(xinput,y)
			form.Controls.Add(dp)
			dp.Click += form.opendirectory
			form.output.append(dp)
			y = label.Bottom + 30
		elif j.__class__.__name__ == 'uiselectelements':
			se = Button()
			se.Width = 160
			se.Text = j.buttontext
			se.Location = Point(xinput,y)
			form.Controls.Add(se)
			if j.multi == False:
				se.Click += form.pickobjects
			else:
				se.Click  += form.pickobject
			form.output.append(se)
			y = label.Bottom + 25
		elif j.__class__.__name__ == 'uiselectelementsofcat':
			sec = Button()
			sec.Width = 160
			sec.Text = j.buttontext
			sec.Tag = j.category
			sec.Location = Point(xinput,y)
			form.Controls.Add(sec)
			if j.multi == False:
				sec.Click += form.pickobjectsofcat
			else:
				sec.Click += form.pickobjectofcat
			form.output.append(sec)
			y = label.Bottom + 25
		elif j.__class__.__name__ == 'uiselectfaces':
			sf = Button()
			sf.Width = 160
			sf.Text = j.buttontext
			sf.Location = Point(xinput,y)
			form.Controls.Add(sf)
			sf.Click += form.pickfaces
			form.output.append(sf)
			y = label.Bottom + 25
		elif j.__class__.__name__ == 'uiselectedges':
			sed = Button()
			sed.Width = 160
			sed.Text = j.buttontext
			sed.Location = Point(xinput,y)
			form.Controls.Add(sed)
			sed.Click += form.pickedges
			form.output.append(sed)
			y = label.Bottom + 25
			
		elif j.__class__.__name__ == 'uislider':
			gb = Panel()
			if j.defaultvalue == '':
				defval = j.minimum
			else:
				defval = j.defaultvalue
			sl = mytrackbar(j.minimum,j.step)
			gb.Width = 160 
			gb.Height = 40
			sl.Minimum = 0
			sl.Maximum = (j.maximum-j.minimum)/j.step
			sl.Value = (defval - j.minimum) / j.step
			sl.TickFrequency = (j.maximum-j.minimum)/j.step/10
			gb.Location = Point(xinput,y)
			sl.Location = Point(40,0)
			sl.Width = 125
			sl.Orientation = Vertical
			gb.Controls.Add(sl)
			form.output.append(sl)
			displabel = Label()
			displabel.Width = 50
			displabel.Location = Point(0,5)
			displabel.Text = str(defval)
			displabel.BringToFront()
			gb.Controls.Add(displabel)	
			form.Controls.Add(gb)			
			sl.Scroll += form.scroll
			y = label.Bottom + 25
		elif j.__class__.__name__ == 'uiimage':
			pic = Image.FromFile(j.image)
			im = PictureBox()
			im.BorderStyle = BorderStyle.Fixed3D
			ratio = (pic.Height)/(pic.Width)
			h = float(pic.Height)
			w = float(pic.Width)
			ratio = h/w
			im.Size = Size(285,285*ratio)
			scaledimage = Bitmap(285,285*ratio)
			gr = Graphics.FromImage(scaledimage)
			gr.DrawImage(pic,0,0,285,285*ratio)
			im.Image = pic
			im.SizeMode = PictureBoxSizeMode.Zoom
			form.Controls.Add(im)
			im.Location = Point(25,y+25)
			y = im.Bottom + 25;
	
		elif j.__class__.__name__ == 'uicolorpick' and importcolorselection == 0:
			cp = Button()
			cp.Width = 160
			cp.Text = j.buttontext
			cp.Location = Point(xinput,y)
			form.Controls.Add(cp)
			cp.Click += form.colorpicker
			form.output.append(cp)
			y = label.Bottom + 25			
		elif j.__class__.__name__ == 'uicolorpick' and importcolorselection == 1:
			importcolorselection = 2
			
	
	#Adding validation button
	
	button = Button()
	button.Text = IN[1]
	button.Width = 160
	button.Location = Point (150,y+60)
	button.Click += form.setclose
	form.Controls.Add(button)
	form.MaximizeBox = False
	form.MinimizeBox = False
	form.FormBorderStyle = FormBorderStyle.FixedSingle
	
	#Adding Logo 
	#default logo in case no input
	
	try:
	#There won't be a default logo if your package folder is not the default one
		deflogopath = os.getenv('APPDATA')+"\\Dynamo\Dynamo Revit\\1.2\packages\Data-Shapes\extra\\a.png"
		if IN[4] == '':
			ima = Image.FromFile(deflogopath)
		else :
			ima = IN[4]
		
		logo = Panel()
		logo.Size = Size(100,100)
		ratio = (ima.Height)/(ima.Width)
		h = float(ima.Height)
		w = float(ima.Width)
		ratio = h/w
		scaledimage = Bitmap(100,100*ratio)
		gr = Graphics.FromImage(scaledimage)
		gr.DrawImage(ima,0,0,100,100*ratio)
		logo.BackgroundImage = scaledimage
		logo.BackgroundImageLayout = ImageLayout.Center
		form.Controls.Add(logo)
		logo.Location = Point(20,y+20)
		
		#Setting icon 
		if IN[4] == '':
			bmp = Bitmap.FromFile(deflogopath)
		else:
			bmp = Bitmap(IN[4])
		thumb = bmp.GetThumbnailImage(64, 64, bmp.GetThumbnailImageAbort,IntPtr.Zero)
		thumb.MakeTransparent();
		icon = Icon.FromHandle(thumb.GetHicon())
		form.Icon = icon
	except:
		form.ShowIcon = False
		

	
	form.Height = y + 180
	form.Width = 350
		
	uiviews = uidoc.GetOpenUIViews()
	activeviewid = doc.ActiveView.Id
	activeUIView = [v for v in uiviews if v.ViewId == activeviewid][0]
	rect = activeUIView.GetWindowRectangle()
	form.StartPosition = FormStartPosition.Manual
	form.Location = Point(rect.Left-7,rect.Top)
	
	if importcolorselection != 2:
		Application.Run(form)
		result = form.values
		OUT = result,True
	else:
		OUT = ['ColorSelection input is only available With Revit 2017'] , False
		
except:
	import traceback
	OUT = traceback.format_exc() , "error"
# ----------------------------------------
code_block_11 = CodeBlock(OUT=ui_multipleinputform_data_shape) { OUT[0]; OUT[1]; }
flatten_sheets = Flatten(code_block_11.out0)

code_block_12 = CodeBlock(ViewSetName=flatten_sheets) { ViewSetName[0]; }
get_views_from_view_set_grimshaw = Python(IN[0]=code_block_12)
# ---------- get_views_from_view_set_grimshaw.python (37 lines) ----------
#Copyright(c) 2015, Konrad Sobon
# @arch_laboratory, http://archi-lab.net

import clr
clr.AddReference('ProtoGeometry')
from Autodesk.DesignScript.Geometry import *

# Import DocumentManager and TransactionManager
clr.AddReference("RevitServices")
import RevitServices
from RevitServices.Persistence import DocumentManager
from RevitServices.Transactions import TransactionManager

doc = DocumentManager.Instance.CurrentDBDocument

# Import Element wrapper extension methods
clr.AddReference("RevitNodes")
import Revit
clr.ImportExtensions(Revit.Elements)

# Import RevitAPI
clr.AddReference("RevitAPI")
import Autodesk
from Autodesk.Revit.DB import *

viewSet = UnwrapElement(IN[0])

viewSets = FilteredElementCollector(doc).OfClass(ViewSheetSet)

for i in viewSets:
	if i.Name == viewSet.Name:
		vs = i
	else:
		continue

#Assign your output to the OUT variable
OUT = [i.ToDSType(True) for i in vs.Views]
# ----------------------------------------
code_block_13 = CodeBlock(sheets=get_views_from_view_set_grimshaw) { sheets; }
фильтр_по_категории_основные = Python(IN[0]=get_views_from_view_set_grimshaw, IN[1]=forceChildrensEval)  # "Фильтр по категории: "Основные надписи""
# ---------- фильтр_по_категории_основные.python (33 lines) ----------
#Copyright(c) 2016, Dimitar Venkov
# @5devene, dimitar.ven@gmail.com

import clr

clr.AddReference("RevitServices")
import RevitServices
from RevitServices.Persistence import DocumentManager
doc = DocumentManager.Instance.CurrentDBDocument

clr.AddReference("RevitAPI")
import Autodesk
from Autodesk.Revit.DB import FilteredElementCollector

clr.AddReference("RevitNodes")
import Revit
clr.ImportExtensions(Revit.Elements)

def tolist(obj1):
	if hasattr(obj1,"__iter__"): return obj1
	else: return [obj1]
def output1(l1):
	if len(l1) == 1: return l1[0]
	else: return l1

views = UnwrapElement(tolist(IN[0]))
elements = []
elemId = Autodesk.Revit.DB.ElementId(-2000280)

for i in views:
	fec = FilteredElementCollector(doc, i.Id).OfCategoryId(elemId).ToElements()
	elements.append(fec)
OUT = output1(elements)
# ----------------------------------------
flatten = Flatten(фильтр_по_категории_основные)
string_from_object = FromObject(flatten)

# group: Подбираем вариант настроек печати, по имени Типа семейства "Основной надписи"
подбираем_вариант_настроек = Python(IN[0]=forceChildrensEval, IN[1]=string_from_object)  # "Подбираем вариант настроек печати"
# ---------- подбираем_вариант_настроек.python (43 lines) ----------
#Copyright(c) 2015, Konrad Sobon
# @arch_laboratory, http://archi-lab.net

import clr
clr.AddReference('ProtoGeometry')
from Autodesk.DesignScript.Geometry import *

# Import ToDSType(bool) extension method
clr.AddReference('RevitNodes')
import Revit
clr.ImportExtensions(Revit.Elements)

# Import DocumentManager and TransactionManager
clr.AddReference('RevitServices')
import RevitServices
from RevitServices.Persistence import DocumentManager
from RevitServices.Transactions import TransactionManager

# Import RevitAPI
clr.AddReference('RevitAPI')
import Autodesk
from Autodesk.Revit.DB import *

doc = DocumentManager.Instance.CurrentDBDocument

#The inputs to this node will be stored as a list in the IN variable.

namelist = IN[1]

setid = []
setid = doc.GetPrintSettingIds()
set = []
setlist = []

for j in setid:
	set.append(doc.GetElement(j))
	
for name in namelist:
	for s in set:
		if name in s.Name:
			setlist.append(s)

OUT = setlist
# ----------------------------------------

code_block_14 = CodeBlock(PrintSettings=подбираем_вариант_настроек) { PrintSettings; }
code_block_15 = CodeBlock(File_Path=flatten_sheets) { File_Path[1]+"\\test.pdf"; }
code_block_16 = CodeBlock { "Bullzip PDF Printer"; "PDFCreator"; "Microsoft Print to PDF"; "\\\\sh35ps1\\FollowMe"; }
code_block_17 = CodeBlock(PrinterName=code_block_16.out3) { PrinterName; }
запуск = BoolSelector(true)
code_block_18 = CodeBlock(RunIt=запуск) { RunIt; }
print_pdf_archi_lab_grimshaw = Python(IN[0]=code_block_13, IN[1]=code_block_14, IN[2]=code_block_15, IN[3]=code_block_17, IN[4]=code_block_18)
# ---------- print_pdf_archi_lab_grimshaw.python (125 lines) ----------
#Copyright(c) 2015, Konrad K Sobon
# @arch_laboratory, http://archi-lab.net

import clr
clr.AddReference('ProtoGeometry')
from Autodesk.DesignScript.Geometry import *

# Import Element wrapper extension methods
clr.AddReference("RevitNodes")
import Revit
clr.ImportExtensions(Revit.Elements)

# Import geometry conversion extension methods
clr.ImportExtensions(Revit.GeometryConversion)

# Import DocumentManager and TransactionManager
clr.AddReference("RevitServices")
import RevitServices
from RevitServices.Persistence import DocumentManager
from RevitServices.Transactions import TransactionManager

doc = DocumentManager.Instance.CurrentDBDocument
uiapp = DocumentManager.Instance.CurrentUIApplication
app = uiapp.Application

# Import RevitAPI
clr.AddReference("RevitAPI")
import Autodesk
from Autodesk.Revit.DB import *

import sys
pyt_path = r'C:\Program Files (x86)\IronPython 2.7\Lib'
sys.path.append(pyt_path)
import System

#The inputs to this node will be stored as a list in the IN variable.
dataEnteringNode = IN

sheets = IN[0]
printSetting = UnwrapElement(IN[1])
filePath = IN[2]
printerName = IN[3]

pRange = Autodesk.Revit.DB.PrintRange.Select
combined = False
runIt = IN[4]

if isinstance(sheets, list):
	viewSheets = []
	for i in sheets:
		viewSheets.append(UnwrapElement(i))
else:
	viewSheets = UnwrapElement(sheets)

def PrintView(doc, sheet, pRange, printerName, combined, filePath, printSetting):
	# create view set 
	viewSet = ViewSet()
	viewSet.Insert(sheet)
	# determine print range
	printManager = doc.PrintManager
	printManager.PrintRange = pRange
	printManager.Apply()
	# make new view set current
	viewSheetSetting = printManager.ViewSheetSetting
	viewSheetSetting.CurrentViewSheetSet.Views = viewSet
	# set printer
	printManager.SelectNewPrintDriver(printerName)
	printManager.Apply()
	# set combined and print to file
	if printManager.IsVirtual:
		printManager.CombinedFile = combined
		printManager.Apply()
		printManager.PrintToFile = True
		printManager.Apply()
	else:
		#printManager.CombinedFile = combined
		printManager.Apply()
		printManager.PrintToFile = False
		printManager.Apply()
	# set file path
	printManager.PrintToFileName = filePath
	printManager.Apply()
	# apply print setting

	printSetup = printManager.PrintSetup
	printSetup.CurrentPrintSetting = printSetting
	printManager.Apply()

	# save settings and submit print
	TransactionManager.Instance.EnsureInTransaction(doc)
	viewSheetSetting.SaveAs("tempSetName")
	printManager.Apply()
	printManager.SubmitPrint()
	viewSheetSetting.Delete()
	TransactionManager.Instance.TransactionTaskDone()
	
	return True

try:
	viewSets = FilteredElementCollector(doc).OfClass(ViewSheetSet)
	for i in viewSets:
		if i.Name == "tempSetName":
			TransactionManager.Instance.EnsureInTransaction(doc)
			doc.Delete(i.Id)
			TransactionManager.Instance.ForceCloseTransaction()
		else:
			continue
		
	errorReport = None
	message = "Success"
	if runIt:
		for i, j in zip(viewSheets, printSetting):
			PrintView(doc, i, pRange, printerName, combined, filePath, j)
	else:
		message = "Set RunIt to True"
except:
	# if error accurs anywhere in the process catch it
	import traceback
	errorReport = traceback.format_exc()
	
#Assign your output to the OUT variable
if errorReport == None:
	OUT = message
else:
	OUT = errorReport
# ----------------------------------------
uniqueItems = List.UniqueItems(string_from_object)
setParameterByName = Element.SetParameterByName()  # unwired: element, parameterName, value
# note: ВСЁ ОСТАЛЬНОЕ
getParameterValueByName = Element.GetParameterValueByName()  # unwired: element, parameterName
parameters = Element.Parameters()  # unwired: arg0
geometry = Element.Geometry()  # unwired: arg0
boolean = BoolSelector(true)  # frozen
code_block_19 = CodeBlock { 1; 2; }
if_ = Python(IN[0]=boolean, IN[1]=code_block_19.out0, IN[2]=code_block_19.out1)
# ---------- if_.python (12 lines) ----------
import clr
boolean = IN[0]
true = UnwrapElement(IN[1])
false = UnwrapElement(IN[2])

if boolean:
	out = true
else:
	out = false

#Назначьте вывод переменной OUT.
OUT = out
# ----------------------------------------
filteredElementCollector = Python()  # frozen; unwired: IN[0]
# ---------- filteredElementCollector.python (29 lines) ----------
if IN[1]:
	import clr
	
	# Import DocumentManager and TransactionManager
	clr.AddReference("RevitServices")
	import RevitServices
	from RevitServices.Persistence import DocumentManager
	
	
	# Import RevitAPI
	clr.AddReference("RevitAPI")
	import Autodesk
	from Autodesk.Revit.DB import *
	
	doc = DocumentManager.Instance.CurrentDBDocument
	uiapp = DocumentManager.Instance.CurrentUIApplication
	app = uiapp.Application
	
	from System.Collections.Generic import *
	
	
	#The inputs to this node will be stored as a list in the IN variable.
	dataEnteringNode = IN
	collector = FilteredElementCollector(doc)
	elements = collector.OfCategory(BuiltInCategory.OST_Views).ToElements()
	
	OUT = sheetInstances
else:
	OUT = "скрипт не выполнен"
# ----------------------------------------
regenerate = Python()  # frozen; unwired: IN[0]
# ---------- regenerate.python (26 lines) ----------
import clr

# Import DocumentManager and TransactionManager
clr.AddReference("RevitServices")
import RevitServices
from RevitServices.Persistence import DocumentManager


# Import RevitAPI
clr.AddReference("RevitAPI")
import Autodesk
from Autodesk.Revit.DB import *

doc = DocumentManager.Instance.CurrentDBDocument


#The inputs to this node will be stored as a list in the IN variable.
list = IN[0]


if list:
	doc.Regenerate()
	out = "Regeneration complete"
else:
	out = "fail"
OUT = out
# ----------------------------------------
shablon_python_shablon = Python()  # frozen; unwired: IN[0]
# ---------- shablon_python_shablon.python (69 lines) ----------
# -*- coding: utf-8 -*- 
#-----------------------Импоорт библиотек----------------------
import clr
clr.AddReference('RevitAPI')
import Autodesk
from Autodesk.Revit.DB import *

clr.AddReference("RevitNodes") 
import Revit
from Revit.Elements import *

clr.ImportExtensions(Revit.Elements) #ToDSType не работает без
clr.ImportExtensions(Revit.GeometryConversion)

clr.AddReference("RevitServices")
import RevitServices
from RevitServices.Persistence import DocumentManager
from RevitServices.Transactions import TransactionManager

clr.AddReference('ProtoGeometry')
from Autodesk.DesignScript.Geometry import *

#-----------------------ИМПОРТ БИБЛИОТЕК----------------------
"""-"""
#-----------------------ФУНКЦИИ----------------------

def __x__(x):
	x="x"
	return x
	
#-----------------------ФУНКЦИИ----------------------
"""-"""
#-----------------------АПИ ПАРАМЕТРЫ----------------------

doc = DocumentManager.Instance.CurrentDBDocument
#link_doc = UnwrapElement(IN[1])
#uiapp = DocumentManager.Instance.CurrentUIApplication
#app = uiapp.Application
#version = app.VersionNumber
#options = Autodesk.Revit.DB.SpatialElementBoundaryOptions()
calculator = SpatialElementGeometryCalculator(doc)

#-----------------------АПИ ПАРАМЕТРЫ----------------------
"""-"""
#-----------------------РАБОЧИЕ ПАРАМЕТРЫ----------------------

rooms = UnwrapElement(IN[0])

#-----------------------РАБОЧИЕ ПАРАМЕТРЫ----------------------	
"""-"""
#-----------------------ТЕСТОВЫЕ ПАРАМЕТРЫ----------------------

test = []

#-----------------------ТЕСТОВЫЕ ПАРАМЕТРЫ----------------------
"""-"""
#-----------------------НАЧАЛО СКРИПТА----------------------

x = 0
if rooms == None:
	rooms = [0,0]

for room in rooms:
	x=__x__(x)+__x__(x)
#TransactionManager.Instance.EnsureInTransaction(doc)
#TransactionManager.Instance.TransactionTaskDone()
#-----------------------КОНЕЦ СКРИПТА----------------------

OUT = x
# ----------------------------------------
members = Python()  # "Object.Members"; frozen; unwired: IN[0]
# ---------- members.python (14 lines) ----------
import clr

items = IN[0]
elementlist = list()

try:
	clr.AddReference('RevitAPI')
	from Autodesk.Revit.DB import *
	for item in items:
		elementlist.append(dir(UnwrapElement(item)))
except:
	for item in items:
		elementlist.append(dir(item))
OUT = elementlist
# ----------------------------------------

# group: Get Revit Selection:
forceChildrensEval_2 = ForceChildrensEval()  # frozen; unwired: arg0
pys_get_revit_selection = Python(IN[0]=forceChildrensEval_2)
# ---------- pys_get_revit_selection.python (22 lines) ----------
import clr
clr.AddReference('RevitServices')
clr.AddReference('RevitAPI')
from Autodesk.Revit.DB import *
import RevitServices
from RevitServices.Persistence import DocumentManager
from Autodesk.Revit.ApplicationServices import Application

reset = IN[0]

doc = DocumentManager.Instance.CurrentDBDocument
uidoc = DocumentManager.Instance.CurrentUIApplication.ActiveUIDocument
ids = uidoc.Selection.GetElementIds()

idd = [str(i) for i in ids]

if isinstance(idd, list) == True:
	elems = [doc.GetElement(ElementId(int(i))) for i in idd]
else:
	elems = doc.GetElement(ElementId(int(idd)))

OUT = elems
# ----------------------------------------

# group: Parameters name from language
parameters_name_from_language = Python()  # frozen
# ---------- parameters_name_from_language.python (18 lines) ----------
import clr
clr.AddReference('RevitServices')
import RevitServices
from RevitServices.Persistence import DocumentManager

uiapp = DocumentManager.Instance.CurrentUIApplication
app = uiapp.Application
lng = app.Language
rus = ["Тип","Имя семейства","Имя типа"]
enu = ["Type","Family name","Type name"]
out = []
if str(lng) == "Russian":
	out = rus
else:
	out = enu
#English_USA
#Russian
OUT = out
# ----------------------------------------

путь_к_файлу_python = Filename(".\N.Отделка помещений_сбор элементов вокруг_1.7.py")  # frozen
forceChildrensEval_3 = ForceChildrensEval()  # unwired: arg0
не_читает_кирилицу = Python(IN[0]=путь_к_файлу_python, IN[1]=forceChildrensEval_3)
# ---------- не_читает_кирилицу.python (9 lines) ----------
try:
	filePath = IN[0]

	with open(filePath, 'rb') as inf:
	    lines = inf.readlines()

	OUT = ''.join(lines)
except Exception, e:
	OUT = "No file"
# ----------------------------------------
python_script_from_string = PythonStringNode(script=не_читает_кирилицу)  # unwired: IN[0]
categories = Categories()  # frozen
all_elements_of_category = ElementsOfCategory(categories)

# group: элементы внутри групп
members_2 = Python()  # "Group.Members"; frozen; unwired: IN[0]
# ---------- members_2.python (19 lines) ----------
import clr
clr.AddReference('RevitAPI')
from Autodesk.Revit.DB import *

clr.AddReference("RevitNodes")
import Revit
clr.ImportExtensions(Revit.Elements)

groups = UnwrapElement(IN[0])
elementlist = list()
for item in groups:
	try:
		memberlist = list()
		for member in item.GetMemberIds():
			memberlist.append(item.Document.GetElement(member))
		elementlist.append(memberlist)
	except:
		elementlist.append(list())
OUT = elementlist
# ----------------------------------------

путь_к_файлу_python_2 = Filename("..\..\Z.Тест\00.Пакетная печать1.py")  # frozen
forceChildrensEval_4 = ForceChildrensEval()  # unwired: arg0
не_читает_кирилицу_2 = Python(IN[0]=путь_к_файлу_python_2, IN[1]=forceChildrensEval_4)  # same code as не_читает_кирилицу
python_script_from_string_2 = PythonStringNode(script=не_читает_кирилицу_2, IN[0]=code_block_13, IN[1]=code_block_14, IN[2]=code_block_15, IN[3]=code_block_17, IN[5]=запуск)  # frozen; unwired: IN[4]
