# Dynamo graph 00.Тиражирование вида на листы.dyn (Dynamo 1.3.1.1736)

# note: ВСЁ ОСТАЛЬНОЕ

# group: КЛЮЧЕВЫЕ МОМЕНТЫ РАБОТЫ
# note: ИТОГОВАЯ КОНСОЛИДАЦИЯ ДАННЫХ

# group: ИСПОЛНИТЕЛЬНЫЕ НОДЫ (фильтрование, подбор, списки и т.д.)
# note: НОДЫ РАБОТАЮЩИЕ С ДАННЫМИ
# note: ИСПОЛНИТЕЛЬНЫЕ НОДЫ

# group: ЗАПАСНЫЕ ВАРИАНТЫ, ДОПОЛНИТЕЛЬНЫЕ ОПЦИИ
# note: ДОПОЛНИТЕЛЬНЫЕ. Градации серово по важности, темнее - важнее
# note: ЗАПАСНЫЕ

# group: ПРОВЕРОЧНЫЕ НОДЫ
# note: ПРОВЕРОЧНЫЕ НОДЫ

# group: ПЕРЕДАЁМ ИНФОРМАЦИЮ В РЕВИТ
# note: ПЕРЕДАЁМ ИНФОРМАЦИЮ В РЕВИТ

# group: ЭЛЕМЕНТЫ УПРАВЛЕНИЯ
# note: ПЕРЕМЕННЫЕ ЗНАЧЕНИЯ
# note: ЭЛЕМЕНТЫ УПРАВЛЕНИЯ

# group: ПРИМЕЧАНИЯ ПО ЦВЕТОВОЙ ГРУППИРОВКЕ
# note: GUIDELINES

# group: ПОЛУЧАЕМ ДАННЫЕ ИЗ РЕВИТ
# note: ПОЛУЧАЕМ ДАННЫЕ ИЗ РЕВИТ

categories = Categories("Sheets")
all_elements_of_category = ElementsOfCategory(categories)

# group: Листы
code_block = CodeBlock { "Номер листа"; "Имя листа"; }
getParameterValueByName = Element.GetParameterValueByName(parameterName=code_block.out0)  # unwired: element
sortByFunction = SortByFunction(all_elements_of_category, getParameterValueByName)
getParameterValueByName_2 = Element.GetParameterValueByName(element=sortByFunction, parameterName=code_block.out0)
getParameterValueByName_3 = Element.GetParameterValueByName(element=sortByFunction, parameterName=code_block.out1)
code_block_2 = CodeBlock(N=getParameterValueByName_2, name=getParameterValueByName_3) { N+" - "+name; }

# group: UI
code_block_3 = CodeBlock { InputName : string = "Выбрать листы:"; }
code_block_4 = CodeBlock(Keys=code_block_2) { Keys; }
code_block_5 = CodeBlock(Values=sortByFunction) { Values; }
code_block_6 = CodeBlock { Height : int = 400; }
ui_listview_data_data_shape = Python(IN[0]=code_block_3, IN[1]=code_block_4, IN[2]=code_block_5, IN[3]=code_block_6)
# ---------- ui_listview_data_data_shape.python (47 lines) ----------
#Copyright (c) mostafa el ayoubi ,  2016
#Data-Shapes www.data-shapes.net , elayoubi.mostafa@gmail.com

class listview():

    def __init__(self,inputname,height):
        self.inputname = inputname
        self.height = height

    def __setitem__(self, key, item):
        self.__dict__[key] = item

    def __getitem__(self, key):
        return self.__dict__[key]

    def __iter__(self):
        return iter(self.__dict__)

    def values(self):
        return self.__dict__.values()

    def keys(self):
        return self.__dict__.keys()

    def __repr__(self):
        return 'UI.ListView input'
        
x = listview(IN[0],IN[3])

if isinstance(IN[1],list):
	in1 = IN[1]
else:
	in1 = [IN[1]]

if isinstance(IN[2],list):
	in2 = IN[2]
else:
	in2 = [IN[2]]

for k,v in zip(in1,in2):
	try:
		x[str(k)] = v
	except:
		x[k.encode('utf-8').decode('utf-8')] = v


OUT = x
# ----------------------------------------

# group: UI.Boolean input
code_block_7 = CodeBlock { InputName : string = "Зависимый вид?"; }
code_block_8 = CodeBlock { DefaultValue : bool = true; }
code_block_9 = CodeBlock { SideText : string = "Да/Нет"; }
ui_boolean_input = Python(IN[0]=code_block_7, IN[1]=code_block_8, IN[2]=code_block_9)
# ---------- ui_boolean_input.python (17 lines) ----------
#Copyright (c) mostafa el ayoubi ,  2016
#Data-Shapes www.data-shapes.net , elayoubi.mostafa@gmail.com

class uibool():

    def __init__(self,inputname,defaultvalue,booltext):
        self.inputname = inputname
        self.defaultvalue = defaultvalue
        self.booltext = booltext
    def __repr__(self):
        return 'UI.Boolean input'
        
      
x = uibool(IN[0],IN[1],IN[2])


OUT = x
# ----------------------------------------
code_block_10 = CodeBlock(Boolean_input=ui_boolean_input) { Boolean_input; }

create = List.Create(ui_listview_data_data_shape, code_block_10)
forceChildrensEval = ForceChildrensEval()  # unwired: arg0

# group: UI FORM
code_block_11 = CodeBlock(Inputs=create) { Inputs; }
code_block_12 = CodeBlock { ButtonText_optional : string = "Копировать"; }
code_block_13 = CodeBlock { Description_optional : string = "Выберите на текущем листе легенду, которую хотите скопировать. "; }
code_block_14 = CodeBlock { Logo_optional : var = false; }
ui_multipleinputform_data_shape = Python(IN[0]=code_block_11, IN[1]=code_block_12, IN[2]=forceChildrensEval, IN[3]=code_block_13, IN[4]=code_block_14)
# ---------- ui_multipleinputform_data_shape.python (489 lines) ----------
#Copyright (c) mostafa el ayoubi ,  2016
#Data-Shapes www.data-shapes.net , elayoubi.mostafa@gmail.com
	
import clr
try:
	clr.AddReference('System.Windows.Forms')
	clr.AddReference('System.Drawing')
	
	from System.Drawing import Point , Size , Graphics, Bitmap, Image, Font, FontStyle, Icon, Color, Region , Rectangle
	from System.Windows.Forms import Application, DockStyle, Button, Form, Label, TrackBar , ToolTip, ColumnHeader, TextBox, CheckBox, FolderBrowserDialog, OpenFileDialog, DialogResult, ComboBox, FormBorderStyle, FormStartPosition, ListView, ListViewItem , SortOrder, Panel, ImageLayout, GroupBox, RadioButton, BorderStyle, PictureBox, PictureBoxSizeMode
	from System.Collections.Generic import *
	from System.Windows.Forms import View as vi
	clr.AddReference('System')
	from System import IntPtr
	from System.ComponentModel import Container
	
	
	import sys
	pyt_path = r'C:\Program Files (x86)\IronPython 2.7\Lib'
	sys.path.append(pyt_path)
	import os
	
	clr.AddReference('RevitAPIUI')
	from  Autodesk.Revit.UI import Selection
	from  Autodesk.Revit.UI.Selection import ISelectionFilter
	
	importcolorselection = 0
	try:
		from  Autodesk.Revit.UI import ColorSelectionDialog
	except:
		importcolorselection = 1
	
	clr.AddReference('RevitNodes')
	import Revit
	clr.ImportExtensions(Revit.Elements)
	clr.ImportExtensions(Revit.GeometryConversion)
	
	clr.AddReference('RevitServices')
	from RevitServices.Persistence import DocumentManager
	doc = DocumentManager.Instance.CurrentDBDocument
	uidoc = DocumentManager.Instance.CurrentUIApplication.ActiveUIDocument

	class selectionfilter(ISelectionFilter):
		def __init__(self,category):
			self.category = category
		def AllowElement(self,element):
			if element.Category.Name in [c.Name for c in self.category]:
				return True
			else:
				return False
		def AllowReference(reference,point):
			return False
		
	class MultiTextBoxForm(Form):
	
	
	    def __init__(self):
	        self.Text = 'Копирование легенд между листами'
	        self.output = []
	        self.values = []
	
	    def setclose(self, sender, event):
	    	cbindexread = 0
	    	for f in self.output:
	    		if f.GetType() == TextBox:
	    			self.values.append(f.Text)
	    		if f.GetType() == CheckBox:
	    			self.values.append(f.Checked)
	    		if f.GetType() == Button:
	    			if f.Tag == None :
	    				self.values.append(f.Text)
	    			else:
	    				self.values.append(f.Tag)
	    		if f.GetType() == ComboBox:
	    			key = f.Text
	    			self.values.append(f.Tag[key])
	    		if f.GetType() == mylistview:
	    			self.values.append([f.Values[i.Text] for i in f.CheckedItems])
	    		if f.GetType() == mytrackbar:
	    			self.values.append(f.startval+f.Value*f.step)
	    		if f.GetType() == mygroupbox:
	    			key = [j.Text for j in f.Controls if j.Checked == True][0]
	    			self.values.append(f.Tag[key])
	    	self.Close()
	
	    def reset(self, sender, event):
			pass
	
	    def openfile(self, sender, event):
			ofd = OpenFileDialog()
			dr = ofd.ShowDialog()
			if dr == DialogResult.OK:
				sender.Text = ofd.FileName
	
	    def opendirectory(self, sender, event):
			fbd = FolderBrowserDialog()
			dr = fbd.ShowDialog()
			if dr == DialogResult.OK:
				sender.Text = fbd.SelectedPath
	
	    def pickobjects(self, sender, event):
			sel = uidoc.Selection.PickObjects(Selection.ObjectType.Element,'')
			selelem = [doc.GetElement(s.ElementId) for s in sel]
			sender.Tag = (selelem)

	    def pickobject(self, sender, event):
			sel = uidoc.Selection.PickObject(Selection.ObjectType.Element,'')
			selelem = doc.GetElement(sel.ElementId) 
			sender.Tag = (selelem)
			
	    def pickobjectsofcat(self, sender, event):
			if isinstance(sender.Tag,list):	    
				category = UnwrapElement(sender.Tag)
			else:
				category = [UnwrapElement(sender.Tag)]
			selfilt = selectionfilter(category)
			sel = uidoc.Selection.PickObjects(Selection.ObjectType.Element,selfilt,'Select %s' %(', '.join([c.Name for c in category])))
			selelem = [doc.GetElement(s.ElementId) for s in sel]
			sender.Tag = (selelem)

	    def pickobjectofcat(self, sender, event):
			if isinstance(sender.Tag,list):	    
				category = UnwrapElement(sender.Tag)
			else:
				category = [UnwrapElement(sender.Tag)]
			selfilt = selectionfilter(category)
			sel = uidoc.Selection.PickObject(Selection.ObjectType.Element,selfilt,'Select %s' %(', '.join([c.Name for c in category])))
			selelem = doc.GetElement(sel.ElementId) 
			sender.Tag = (selelem)
			
	    def pickfaces(self, sender, event):
			selface = uidoc.Selection.PickObjects(Selection.ObjectType.Face,'')
			faces = [uidoc.Document.GetElement(s).GetGeometryObjectFromReference(s).ToProtoType(True) for s in selface]
			sender.Tag = [i for f in faces for i in f]
	
	    def pickedges(self, sender, event):
			seledge = uidoc.Selection.PickObjects(Selection.ObjectType.Edge,'')
			edges = [uidoc.Document.GetElement(s).GetGeometryObjectFromReference(s).AsCurve().ToProtoType(True) for s in seledge]
			sender.Tag = edges

	    def colorpicker(self, sender, event):
			dialog = ColorSelectionDialog()
			selection = ColorSelectionDialog.Show(dialog)
			selected = dialog.SelectedColor
			sender.Tag = selected
			sender.BackColor = Color.FromArgb(selected.Red,selected.Green,selected.Blue)
			sender.ForeColor = Color.FromArgb(selected.Red,selected.Green,selected.Blue)
	
	    def topmost(self):
			self.TopMost = True
	
	    def lvadd(self, sender, event):
			sender.Tag = [i for i in sender.CheckedItems]
			
	    def scroll(self, sender, event):
			parent = sender.Parent
			child = parent.GetChildAtPoint(Point(0,5))
			child.Text = str(sender.startval+sender.Value*sender.step)

	
	class mylistview(ListView):
	
		def __init__(self):
			self.Values = []

	class mytrackbar(TrackBar):
	
		def __init__(self,startval,step):
			self.startval = startval
			self.step = step
			
	class mygroupbox(GroupBox):
	
		def __init__(self):
			self.Values = []
	
	#Form initialization
	
	form = MultiTextBoxForm()
	form.topmost()
	
	
	xlabel = 25
	xinput = 20
	y = 20
	fields = []
	error = 0
	
	#Description 
	
	if IN[3] != "":
		des = Label()
		des.Font = Font("Arial", 15,FontStyle.Bold)
		des.Location = Point(xlabel,y)
		des.AutoSize = True
		des.MaximumSize = Size(300,0)
		des.Text = IN[3]
		form.Controls.Add(des)
		y = des.Bottom + 15
	
	#Input form
	
	
	if isinstance(IN[0],list):
		inputtypes = IN[0]
	else:
		inputtypes = [IN[0]]
	
	for j in inputtypes:

		label = Label()
		label.Location = Point(xlabel,y+4)
		label.AutoSize = True
		label.MaximumSize = Size(120,0)
		label.Text = j.inputname
		form.Controls.Add(label)

		if j.__class__.__name__ == 'dropdown':
			cb = ComboBox()
			cb.Location = Point(xinput,y)
			cb.Width = 160
			[cb.Items.Add(i) for i in j.keys() if not (i == 'inputname' or i == 'height')]
			cb.Tag = j
			form.Controls.Add(cb)
			form.output.append(cb)
			y = label.Bottom + 25
		elif j.__class__.__name__ == 'listview':
			lv = mylistview()
			lv.Values = j
			lv.CheckBoxes = True
			lv.View = vi.List
			lv.Sorting = SortOrder.Ascending
			[lv.Items.Add(i) for i in j.keys() if not (i == 'inputname' or i == 'height')]
			lv.Location = Point(xinput,y+50)
			lv.Width = 450
			lv.Height = j.height
			lv.Scrollable = True
			form.Controls.Add(lv)
			form.output.append(lv)
			y = lv.Bottom + 25
		elif j.__class__.__name__ == 'uitext':
			tb = TextBox()
			tb.Text = j.defaultvalue
			tb.Width = 160
			tb.Location = Point(xinput,y)
			form.Controls.Add(tb)
			form.Controls.Add(label)
			form.output.append(tb)
			y = label.Bottom + 25
		elif j.__class__.__name__ == 'uitextnote':
			gb = GroupBox()
			gb.Text = j.title
			gb.Parent = form
			gb.SendToBack()
			gb.BackColor = Color.Transparent
			gb.Location = Point(xlabel, y)
			tn = Label()
			tn.Location = Point(xlabel,18)
			tn.AutoSize = True
			tn.MaximumSize = Size(260,0)
			tn.Text = j.textnote
			tn.BringToFront()
			gb.Controls.Add(tn)
			gb.Size = Size(285, tn.Bottom-tn.Top+25)
			y = gb.Bottom + 25
		elif j.__class__.__name__ == 'uibool':
			yn = CheckBox()
			yn.Width = 250
			yn.Location = Point(xinput,y+25)
			yn.Text = j.booltext
			yn.Checked = j.defaultvalue
			form.Controls.Add(yn)
			form.output.append(yn)
			y = label.Bottom + 50
		elif j.__class__.__name__ == 'uiradio':
			yrb = 20
			rbs = []
			rbgroup = mygroupbox()
			rbgroup.Width = 160
			rbgroup.Location = Point(xinput,y)
			rbgroup.Tag = j
			for key in j.keys():
				if key != 'inputname':
					rb = RadioButton()
					rb.Text = key 
					rb.Width = 130
					rb.Location = Point(20,yrb)
					rbgroup.Controls.Add(rb)
					ybot = rb.Bottom
					yrb = ybot + 5					
				else:
					pass
			rbgroup.Height = ybot +20
			[rbgroup.Controls.Add(rb) for rb in rbs]
			form.Controls.Add(rbgroup)
			form.output.append(rbgroup)
			y = rbgroup.Bottom + 25
		elif j.__class__.__name__  == 'uifilepath':
			fp = Button()
			fp.Width = 160
			fp.Text = j.defaultvalue
			fp.Location = Point(xinput,y)
			form.Controls.Add(fp)
			fp.Click += form.openfile
			form.output.append(fp)
			y = label.Bottom + 25
		elif j.__class__.__name__ == 'uidirectorypath':
			dp = Button()
			dp.Width = 160
			dp.Text = j.defaultvalue
			dp.Location = Point(xinput,y)
			form.Controls.Add(dp)
			dp.Click += form.opendirectory
			form.output.append(dp)
			y = label.Bottom + 30
		elif j.__class__.__name__ == 'uiselectelements':
			se = Button()
			se.Width = 160
			se.Text = j.buttontext
			se.Location = Point(xinput,y)
			form.Controls.Add(se)
			if j.multi == False:
				se.Click += form.pickobjects
			else:
				se.Click  += form.pickobject
			form.output.append(se)
			y = label.Bottom + 25
		elif j.__class__.__name__ == 'uiselectelementsofcat':
			sec = Button()
			sec.Width = 160
			sec.Text = j.buttontext
			sec.Tag = j.category
			sec.Location = Point(xinput,y)
			form.Controls.Add(sec)
			if j.multi == False:
				sec.Click += form.pickobjectsofcat
			else:
				sec.Click += form.pickobjectofcat
			form.output.append(sec)
			y = label.Bottom + 25
		elif j.__class__.__name__ == 'uiselectfaces':
			sf = Button()
			sf.Width = 160
			sf.Text = j.buttontext
			sf.Location = Point(xinput,y)
			form.Controls.Add(sf)
			sf.Click += form.pickfaces
			form.output.append(sf)
			y = label.Bottom + 25
		elif j.__class__.__name__ == 'uiselectedges':
			sed = Button()
			sed.Width = 160
			sed.Text = j.buttontext
			sed.Location = Point(xinput,y)
			form.Controls.Add(sed)
			sed.Click += form.pickedges
			form.output.append(sed)
			y = label.Bottom + 25
			
		elif j.__class__.__name__ == 'uislider':
			gb = Panel()
			if j.defaultvalue == '':
				defval = j.minimum
			else:
				defval = j.defaultvalue
			sl = mytrackbar(j.minimum,j.step)
			gb.Width = 160 
			gb.Height = 40
			sl.Minimum = 0
			sl.Maximum = (j.maximum-j.minimum)/j.step
			sl.Value = (defval - j.minimum) / j.step
			sl.TickFrequency = (j.maximum-j.minimum)/j.step/10
			gb.Location = Point(xinput,y)
			sl.Location = Point(40,0)
			sl.Width = 125
			sl.Orientation = Vertical
			gb.Controls.Add(sl)
			form.output.append(sl)
			displabel = Label()
			displabel.Width = 50
			displabel.Location = Point(0,5)
			displabel.Text = str(defval)
			displabel.BringToFront()
			gb.Controls.Add(displabel)	
			form.Controls.Add(gb)			
			sl.Scroll += form.scroll
			y = label.Bottom + 25
		elif j.__class__.__name__ == 'uiimage':
			pic = Image.FromFile(j.image)
			im = PictureBox()
			im.BorderStyle = BorderStyle.Fixed3D
			ratio = (pic.Height)/(pic.Width)
			h = float(pic.Height)
			w = float(pic.Width)
			ratio = h/w
			im.Size = Size(285,285*ratio)
			scaledimage = Bitmap(285,285*ratio)
			gr = Graphics.FromImage(scaledimage)
			gr.DrawImage(pic,0,0,285,285*ratio)
			im.Image = pic
			im.SizeMode = PictureBoxSizeMode.Zoom
			form.Controls.Add(im)
			im.Location = Point(25,y+25)
			y = im.Bottom + 25;
	
		elif j.__class__.__name__ == 'uicolorpick' and importcolorselection == 0:
			cp = Button()
			cp.Width = 160
			cp.Text = j.buttontext
			cp.Location = Point(xinput,y)
			form.Controls.Add(cp)
			cp.Click += form.colorpicker
			form.output.append(cp)
			y = label.Bottom + 25			
		elif j.__class__.__name__ == 'uicolorpick' and importcolorselection == 1:
			importcolorselection = 2
			
	
	#Adding validation button
	
	button = Button()
	button.Text = IN[1]
	button.Width = 160
	button.Location = Point (150,y+60)
	button.Click += form.setclose
	form.Controls.Add(button)
	form.MaximizeBox = False
	form.MinimizeBox = False
	form.FormBorderStyle = FormBorderStyle.FixedSingle
	
	#Adding Logo 
	#default logo in case no input
	
	try:
	#There won't be a default logo if your package folder is not the default one
		deflogopath = os.getenv('APPDATA')+"\\Dynamo\Dynamo Revit\\1.2\packages\Data-Shapes\extra\\a.png"
		if IN[4] == '':
			ima = Image.FromFile(deflogopath)
		else :
			ima = IN[4]
		
		logo = Panel()
		logo.Size = Size(100,100)
		ratio = (ima.Height)/(ima.Width)
		h = float(ima.Height)
		w = float(ima.Width)
		ratio = h/w
		scaledimage = Bitmap(100,100*ratio)
		gr = Graphics.FromImage(scaledimage)
		gr.DrawImage(ima,0,0,100,100*ratio)
		logo.BackgroundImage = scaledimage
		logo.BackgroundImageLayout = ImageLayout.Center
		form.Controls.Add(logo)
		logo.Location = Point(20,y+20)
		
		#Setting icon 
		if IN[4] == '':
			bmp = Bitmap.FromFile(deflogopath)
		else:
			bmp = Bitmap(IN[4])
		thumb = bmp.GetThumbnailImage(64, 64, bmp.GetThumbnailImageAbort,IntPtr.Zero)
		thumb.MakeTransparent();
		icon = Icon.FromHandle(thumb.GetHicon())
		form.Icon = icon
	except:
		form.ShowIcon = False
		

	
	form.Height = y + 180
	form.Width = 500
		
	uiviews = uidoc.GetOpenUIViews()
	activeviewid = doc.ActiveView.Id
	activeUIView = [v for v in uiviews if v.ViewId == activeviewid][0]
	rect = activeUIView.GetWindowRectangle()
	form.StartPosition = FormStartPosition.Manual
	form.Location = Point(rect.Left-7,rect.Top)
	
	if importcolorselection != 2:
		Application.Run(form)
		result = form.values
		OUT = result
	else:
		OUT = ['ColorSelection input is only available With Revit 2017'] , False
		
except:
	import traceback
	OUT = traceback.format_exc() , "error"
# ----------------------------------------
code_block_15 = CodeBlock(OUT=ui_multipleinputform_data_shape) { OUT[0]; OUT[1]; }
flatten_sheets = Flatten(code_block_15.out0)

end = Revit.Transaction.Transaction.End(flatten_sheets)
passthrough_clockwork = CodeBlock(passthrough=forceChildrensEval, waitfor=end) { {passthrough,waitfor}[0]; }
pys_get_revit_selection = Python(IN[0]=passthrough_clockwork)
# ---------- pys_get_revit_selection.python (22 lines) ----------
import clr
clr.AddReference('RevitServices')
clr.AddReference('RevitAPI')
from Autodesk.Revit.DB import *
import RevitServices
from RevitServices.Persistence import DocumentManager
from Autodesk.Revit.ApplicationServices import Application

reset = IN[0]

doc = DocumentManager.Instance.CurrentDBDocument
uidoc = DocumentManager.Instance.CurrentUIApplication.ActiveUIDocument
ids = uidoc.Selection.GetElementIds()

idd = [str(i) for i in ids]

if isinstance(idd, list) == True:
	elems = [doc.GetElement(ElementId(int(i))) for i in idd]
else:
	elems = doc.GetElement(ElementId(int(idd)))

OUT = elems
# ----------------------------------------
view_viewportboxcenter_steam = Python(IN[0]=pys_get_revit_selection)  # "View.ViewPortBoxCenter [STEAM NODES]"
# ---------- view_viewportboxcenter_steam.python (42 lines) ----------
#python nodes in dynamo 1.0
#proposed by Julien Benoit @jbenoit44 
#http://aecuandme.wordpress.com/
import clr
clr.AddReference('ProtoGeometry')
from Autodesk.DesignScript.Geometry import *
# Import ToDSType(bool) extension method
clr.AddReference("RevitNodes")
import Revit
clr.ImportExtensions(Revit.Elements)
# Import geometry conversion extension methods
clr.ImportExtensions(Revit.GeometryConversion)
# Import DocumentManager and TransactionManager
clr.AddReference("RevitServices")
import RevitServices
from RevitServices.Persistence import DocumentManager
from RevitServices.Transactions import TransactionManager
from System.Collections.Generic import *
# Import RevitAPI
clr.AddReference("RevitAPI")
import Autodesk
from Autodesk.Revit.DB import *

doc = DocumentManager.Instance.CurrentDBDocument
uiapp = DocumentManager.Instance.CurrentUIApplication
app = uiapp.Application
uidoc=DocumentManager.Instance.CurrentUIApplication.ActiveUIDocument

elt = []
for i in IN[0]:
	elt.append(UnwrapElement(i))

# Start Transaction
TransactionManager.Instance.EnsureInTransaction(doc)
loc=[]
for v in elt:
	loc.append(v.GetBoxCenter().ToPoint())

# End Transaction
TransactionManager.Instance.TransactionTaskDone()

OUT=loc
# ----------------------------------------
tool_placeviewsonsheets_steam = Python(IN[0]=flatten_sheets, IN[1]=pys_get_revit_selection, IN[2]=view_viewportboxcenter_steam, IN[3]=forceChildrensEval, IN[4]=code_block_15.out1)  # "Tool.PlaceViewsOnSheets [STEAM NODES]"
# ---------- tool_placeviewsonsheets_steam.python (60 lines) ----------
#python nodes in dynamo 1.2
#proposed by Julien Benoit @jbenoit44 
#http://aecuandme.wordpress.com/
import clr
clr.AddReference('ProtoGeometry')
from Autodesk.DesignScript.Geometry import *
# Import ToDSType(bool) extension method
clr.AddReference("RevitNodes")
import Revit
clr.ImportExtensions(Revit.Elements)
# Import geometry conversion extension methods
clr.ImportExtensions(Revit.GeometryConversion)
# Import DocumentManager and TransactionManager
clr.AddReference("RevitServices")
import RevitServices
from RevitServices.Persistence import DocumentManager
from RevitServices.Transactions import TransactionManager
from System.Collections.Generic import *
# Import RevitAPI
clr.AddReference("RevitAPI")
import Autodesk
from Autodesk.Revit.DB import *

doc = DocumentManager.Instance.CurrentDBDocument
uiapp = DocumentManager.Instance.CurrentUIApplication
app = uiapp.Application
uidoc=DocumentManager.Instance.CurrentUIApplication.ActiveUIDocument

if IN[4]:
	dupopt = Autodesk.Revit.DB.ViewDuplicateOption.AsDependent
else:
	dupopt = Autodesk.Revit.DB.ViewDuplicateOption.WithDetailing

sheets = []
for i in IN[0]:
	sheets.append(UnwrapElement(i))
views=[]	
for i in IN[1]:
	views.append(UnwrapElement(i))
points=[]	
for i in IN[2]:
	points.append(UnwrapElement(i).ToXyz())

# Start Transaction
TransactionManager.Instance.EnsureInTransaction(doc)
viewp=[]
for s in sheets:
	for v,p in zip(views,points):
		viewid = v.ViewId
		view = doc.GetElement(viewid)
		newview = view.Duplicate(dupopt)
		nv = doc.GetElement(newview)	
		a=Viewport.Create(doc, s.Id, nv.Id, p)
		viewp.append(a)
	

# End Transaction
TransactionManager.Instance.TransactionTaskDone()

OUT=viewp
# ----------------------------------------
code_block_16 = CodeBlock(Viewports=tool_placeviewsonsheets_steam) { Viewports; }
code_block_17 = CodeBlock { "Раздел"; }
раздел_проекта = StringInput("ИГ-1702Р-9-АР2.1")

# group: Запись раздела проекта
setParameterByName = Element.SetParameterByName(parameterName=code_block_17, value=раздел_проекта)  # frozen; unwired: element

# group: Запись всех возможных параметров проекта
setParameterByName_2 = Element.SetParameterByName(element=setParameterByName)  # unwired: parameterName, value
