# Dynamo graph 000.Получение листа, на котором расположен вид.dyn (Dynamo 1.2.1.3083)

current = Document.Current()
activeView = Document.ActiveView(current)
parameters = Element.Parameters(activeView)
string_from_object = FromObject(parameters)
code_block = CodeBlock { "ист"; }
contains = String.Contains(str=string_from_object, searchFor=code_block)
filterByBoolMask = List.FilterByBoolMask(list=string_from_object, mask=contains)
watch = Watch(filterByBoolMask.in)
