# Dynamo graph 000.Создаём листы по списку из ексель (lite).dyn (Dynamo 1.3.0.875)

# group: ЭЛЕМЕНТЫ УПРАВЛЕНИЯ
# note: ПЕРЕМЕННЫЕ ЗНАЧЕНИЯ
# note: ЭЛЕМЕНТЫ УПРАВЛЕНИЯ

# group: ПОЛУЧАЕМ ДАННЫЕ ИЗ РЕВИТ
# note: ПОЛУЧАЕМ ДАННЫЕ ИЗ РЕВИТ

# group: ПРОВЕРОЧНЫЕ НОДЫ
# note: ПРОВЕРОЧНЫЕ НОДЫ

# group: ИСПОЛНИТЕЛЬНЫЕ НОДЫ (фильтрование, подбор, списки и т.д.)
# note: ИСПОЛНИТЕЛЬНЫЕ НОДЫ
# note: НОДЫ РАБОТАЮЩИЕ С ДАННЫМИ

# group: КЛЮЧЕВЫЕ МОМЕНТЫ РАБОТЫ
# note: ИТОГОВАЯ КОНСОЛИДАЦИЯ ДАННЫХ

# group: ПЕРЕДАЁМ ИНФОРМАЦИЮ В РЕВИТ
# note: ПЕРЕДАЁМ ИНФОРМАЦИЮ В РЕВИТ

# group: ПРИМЕЧАНИЯ ПО ЦВЕТОВОЙ ГРУППИРОВКЕ
# note: GUIDELINES

# group: ЗАПАСНЫЕ ВАРИАНТЫ, ДОПОЛНИТЕЛЬНЫЕ ОПЦИИ
# note: ЗАПАСНЫЕ
# note: ДОПОЛНИТЕЛЬНЫЕ. Градации серово по важности, темнее - важнее

имя_семейства_формата = StringInput("А2А")
byName = FamilyType.ByName(имя_семейства_формата)
выберите_файл_эксель = Filename("..\..\Пакетное создание листов.xlsx")
fromPath = FileObject(выберите_файл_эксель)  # "File.FromPath"
имя_листа_c_данными_в_эксель = StringInput("Лист1")
code_block = CodeBlock { "True"; }
readFromFile = Excel.ReadFromFile(fromPath, имя_листа_c_данными_в_эксель, code_block)
transpose = List.Transpose(readFromFile)
isNull = Object.IsNull(transpose)
filterByBoolMask = List.FilterByBoolMask(list=transpose, mask=isNull)
code_block_2 = CodeBlock(Имя=filterByBoolMask.out, Номер=filterByBoolMask.out) { Имя[1]; Номер[0]; }
forceChildrensEval = ForceChildrensEval()  # unwired: arg0
создание_листа = Python(IN[0]=byName, IN[1]=code_block_2.out0, IN[2]=code_block_2.out1, IN[3]=forceChildrensEval)  # frozen
# ---------- создание_листа.python (31 lines) ----------
import clr
clr.AddReference('RevitAPI')
from Autodesk.Revit.DB import *

clr.AddReference("RevitNodes")
import Revit
clr.ImportExtensions(Revit.Elements)

clr.AddReference("RevitServices")
import RevitServices
from RevitServices.Persistence import DocumentManager
from RevitServices.Transactions import TransactionManager

doc = DocumentManager.Instance.CurrentDBDocument

elementlist = []
elt = UnwrapElement(IN[0])
Name = IN[1]
Number = IN[2]

TransactionManager.Instance.EnsureInTransaction(doc)

for na, nu in zip(Name, Number):	
	newsheet = ViewSheet.Create(doc, elt.Id)
	newsheet.Name = na
	newsheet.SheetNumber = nu
	elementlist.append(newsheet.ToDSType(False))

TransactionManager.Instance.TransactionTaskDone()
		
OUT = elementlist
# ----------------------------------------
code_block_3 = CodeBlock { {null}; }
byNameNumberTitleBlockAndViews = Sheet.ByNameNumberTitleBlockAndViews(code_block_2.out0, code_block_2.out1, byName, code_block_3)  # frozen
# note: ВСЁ ОСТАЛЬНОЕ
пояснения = StringInput("Номер листа в первом столбце, имя листа во втором столбце.")
createEmptySheet = Custom[Tool.CreateEmptySheet]()  # Add the amount of sheets from titleblock type. numbers and names are set from lists; unwired: Type_TitleBlock, List, List_2, Refresh
code_block_4 = CodeBlock(TitleBlock=byName) { TitleBlock; }
code_block_5 = CodeBlock(SheetNames=code_block_2.out0) { SheetNames; }
count = Count(code_block_5)
прификс_номера_листа = StringInput("1.1.")
code_block_6 = CodeBlock(p=прификс_номера_листа, SheetNumbers=code_block_2.out1) { p+SheetNumbers; }
count_2 = Count(code_block_6)
eq = count == count_2
max = Math.Max(value1=count, value2=count_2)
if_ = If(test=eq, true=count, false=max)
ofRepeatedItem = List.OfRepeatedItem(item=code_block_4, amount=if_)
code_block_7 = CodeBlock(item=ofRepeatedItem) { Flatten({item}); }
python_script = Python(IN[0]=code_block_7, IN[1]=code_block_5, IN[2]=code_block_6, IN[3]=forceChildrensEval)
# ---------- python_script.python (74 lines) ----------
#python nodes in dynamo 1.0
#proposed by Julien Benoit @jbenoit44 
#http://aecuandme.wordpress.com/

#Credits for Traceback:
# Copyright(c) 2015, Konrad K Sobon
# @arch_laboratory, http://archi-lab.net

import clr
clr.AddReference('ProtoGeometry')
from Autodesk.DesignScript.Geometry import *
# Import ToDSType(bool) extension method
clr.AddReference("RevitNodes")
import Revit
clr.ImportExtensions(Revit.Elements)
# Import geometry conversion extension methods
clr.ImportExtensions(Revit.GeometryConversion)
# Import DocumentManager and TransactionManager
clr.AddReference("RevitServices")
import RevitServices
from RevitServices.Persistence import DocumentManager
from RevitServices.Transactions import TransactionManager
from System.Collections.Generic import *
# Import RevitAPI
clr.AddReference("RevitAPI")
import Autodesk
from Autodesk.Revit.DB import *

import sys
pyt_path = r'C:\Program Files (x86)\IronPython 2.7\Lib'
sys.path.append(pyt_path)

doc = DocumentManager.Instance.CurrentDBDocument
uiapp = DocumentManager.Instance.CurrentUIApplication
app = uiapp.Application
uidoc=DocumentManager.Instance.CurrentUIApplication.ActiveUIDocument

elt = []
names=[]
numbers=[]
sheets=[]
for i in IN[0]:
	elt.append(UnwrapElement(i).Id)
for i in IN[1]:
	names.append(UnwrapElement(i))
for i in IN[2]:
	numbers.append(UnwrapElement(i))

# Start Transaction
TransactionManager.Instance.EnsureInTransaction(doc)
for i,n,u in zip(elt,names,numbers):
	try:
		errorReport = None
		a=ViewSheet.Create(doc,i)
		a.ViewName=n
		a.SheetNumber=u
		sheets.append(a.ToDSType(False))
	except:
		# if error accurs anywhere in the process catch it
		import traceback
		errorReport = traceback.format_exc()

# End Transaction
TransactionManager.Instance.TransactionTaskDone()

OUT = sheets

#Assign your output to the OUT variable
"""
if errorReport == None:
	OUT = sheets
else:
	OUT = errorReport,sheets
"""
# ----------------------------------------
code_block_8 = CodeBlock { "Лист"; }
setParameterByName = Element.SetParameterByName(element=python_script, parameterName=code_block_8, value=code_block_2.out1)
параметр_для_заполнения = StringInput("Раздел проекта")
значение_параметр = StringInput("ОДИ-1")
count_3 = Count(setParameterByName)
ofRepeatedItem_2 = List.OfRepeatedItem(item=значение_параметр, amount=count_3)
setParameterByName_2 = Element.SetParameterByName(element=setParameterByName, parameterName=параметр_для_заполнения, value=ofRepeatedItem_2)
code_block_9 = CodeBlock { "Стадия проекта"; "П"; }
setParameterByName_3 = Element.SetParameterByName(element=setParameterByName_2, parameterName=code_block_9.out0, value=code_block_9.out1)
