# Dynamo graph 00.Сохранение площади помещения в параметр.dyn (Dynamo 1.3.1.1736)

categories = Categories("Rooms")
all_elements_of_category = ElementsOfCategory(categories)
точное_имя_параметра_для = StringInput("Проверочная площадь на 2017.10.05")  # "Точное имя параметра, для фиксирования площади"
code_block = CodeBlock { "Площадь"; }
getParameterValueByName = Element.GetParameterValueByName(element=all_elements_of_category, parameterName=code_block)
code_block_2 = CodeBlock(x=getParameterValueByName) { x+0; }
setParameterByName = Element.SetParameterByName(element=all_elements_of_category, parameterName=точное_имя_параметра_для, value=code_block_2)
code_block_3 = CodeBlock { "Проверочная площадь на 2017.10.05"; }
