# Dynamo graph 1.(Select&Push) Помещения.перевод простых линий в разделитель помещений.dyn (Dynamo 1.3.0.875)

# group: Get Revit Selection:
forceChildrensEval = ForceChildrensEval()  # unwired: arg0
pys_get_revit_selection = Python(IN[0]=forceChildrensEval)
# ---------- pys_get_revit_selection.python (22 lines) ----------
import clr
clr.AddReference('RevitServices')
clr.AddReference('RevitAPI')
from Autodesk.Revit.DB import *
import RevitServices
from RevitServices.Persistence import DocumentManager
from Autodesk.Revit.ApplicationServices import Application

reset = IN[0]

doc = DocumentManager.Instance.CurrentDBDocument
uidoc = DocumentManager.Instance.CurrentUIApplication.ActiveUIDocument
ids = uidoc.Selection.GetElementIds()

idd = [str(i) for i in ids]

if isinstance(idd, list) == True:
	elems = [doc.GetElement(ElementId(int(i))) for i in idd]
else:
	elems = doc.GetElement(ElementId(int(idd)))

OUT = elems
# ----------------------------------------

geometry = Element.Geometry(pys_get_revit_selection)
explode = Geometry.Explode(geometry)
flatten = Flatten(explode)
code_block = CodeBlock { refresh:bool = true; }
python_script = Python(IN[0]=code_block)
# ---------- python_script.python (14 lines) ----------
#Copyright(c) 2016, Dimitar Venkov
# @5devene, dimitar.ven@gmail.com

import clr

clr.AddReference("RevitServices")
import RevitServices
from RevitServices.Persistence import DocumentManager
doc = DocumentManager.Instance.CurrentDBDocument
clr.AddReference("RevitNodes")
import Revit
clr.ImportExtensions(Revit.Elements)

OUT = doc.ActiveView.ToDSType(True)
# ----------------------------------------
create = List.Create(python_script)
python_script_2 = Python(IN[0]=create)
# ---------- python_script_2.python (25 lines) ----------
import clr
clr.AddReference('RevitAPI')
from Autodesk.Revit.DB import *

clr.AddReference("RevitNodes")
import Revit
clr.ImportExtensions(Revit.Elements)

faminsts = UnwrapElement(IN[0])
elementlist = list()
for item in faminsts:
	try:	
		elementlist.append(item.Document.GetElement(item.LevelId).ToDSType(True))
	except:
		try:
			elementlist.append(item.Level.ToDSType(True))
		except:
			try:
				elementlist.append(item.GenLevel.ToDSType(True))
			except:
				try:
					elementlist.append(item.Document.GetElement(item.get_Parameter(BuiltInParameter.INSTANCE_REFERENCE_LEVEL_PARAM).AsElementId()).ToDSType(True))
				except:
					elementlist.append(list())
OUT = elementlist
# ----------------------------------------
code_block_2 = CodeBlock(l=python_script_2) { o = Autodesk.Point.ByCoordinates(0,0,l.Elevation); pl = Plane.ByOriginNormal(o,Vector.ZAxis()); }
byPlane = SketchPlane.ByPlane(code_block_2.pl)
fromCurve = Python(IN[0]=flatten, IN[1]=byPlane, IN[2]=python_script)  # "RoomSeparator.FromCurve"
# ---------- fromCurve.python (30 lines) ----------
import clr
clr.AddReference('RevitAPI')
from Autodesk.Revit.DB import *

clr.AddReference("RevitNodes")
import Revit
clr.ImportExtensions(Revit.GeometryConversion)

clr.AddReference("RevitServices")
import RevitServices
from RevitServices.Persistence import DocumentManager
from RevitServices.Transactions import TransactionManager

doc = DocumentManager.Instance.CurrentDBDocument
curves = UnwrapElement(IN[0])
sketchplane = UnwrapElement(IN[1])
view = UnwrapElement(IN[2])

TransactionManager.Instance.EnsureInTransaction(doc)
curvearray = CurveArray()
for curve in curves:
	curvearray.Append(curve.ToRevitType())
doccreation = doc.Create
separatorarray = doccreation.NewRoomBoundaryLines(sketchplane[0], curvearray, view)
TransactionManager.Instance.TransactionTaskDone()

elementlist = list()
for item in separatorarray:
	elementlist.append(item)
OUT = elementlist
# ----------------------------------------
watch = Watch(fromCurve)
