# Dynamo graph 1.(in Dynamo) Нумерация помещений по функциям.dyn (Dynamo 1.3.0.875)

# note: Собираем помещения, фильтр по помещениям, запись в параметр помещения
# note: ВСЁ ОСТАЛЬНОЕ

# group: ПЕРЕМЕННЫЕ ЗНАЧЕНИЯ
# note: ПЕРЕМЕННЫЕ ЗНАЧЕНИЯ

# group: ПРОВЕРОЧНЫЕ НОДЫ
# note: ПРОВЕРОЧНЫЕ НОДЫ

# group: ПОЛУЧАЕМ ДАННЫЕ ИЗ РЕВИТ
# note: ПОЛУЧАЕМ ДАННЫЕ ИЗ РЕВИТ

# group: ИСПОЛНИТЕЛЬНЫЕ НОДЫ (фильтрование, подбор, списки и т.д.)
# note: ИСПОЛНИТЕЛЬНЫЕ НОДЫ
# note: НОДЫ РАБОТАЮЩИЕ С ДАННЫМИ

# group: ПЕРЕДАЁМ ИНФОРМАЦИЮ В РЕВИТ
# note: ПЕРЕДАЁМ ИНФОРМАЦИЮ В РЕВИТ

# group: ПРИМЕЧАНИЯ ПО ЦВЕТОВОЙ ГРУППИРОВКЕ
# note: GUIDELINES

# group: КЛЮЧЕВЫЕ МОМЕНТЫ РАБОТЫ
# note: ИТОГОВАЯ КОНСОЛИДАЦИЯ ДАННЫХ

# group: ЗАПАСНЫЕ ВАРИАНТЫ, ДОПОЛНИТЕЛЬНЫЕ ОПЦИИ
# note: ЗАПАСНЫЕ
# note: ДОПОЛНИТЕЛЬНЫЕ. Градации серово по важности, темнее - важнее

исключить_функцию_да_нет = BoolSelector(true)
фильтр_по_этажу_да_нет = BoolSelector(true)
categories = Categories("Rooms")
all_elements_of_category = ElementsOfCategory(categories)
code_block = CodeBlock { "Площадь"; }
getParameterValueByName = Element.GetParameterValueByName(element=all_elements_of_category, parameterName=code_block)
code_block_2 = CodeBlock { 0; }
gt = getParameterValueByName > code_block_2
isNull = Object.IsNull(gt)
filterByBoolMask = List.FilterByBoolMask(list=all_elements_of_category, mask=isNull)
code_block_3 = CodeBlock(elm=filterByBoolMask.out) { elm; }
параметр_этажа = StringInput("Номер этажа")
getParameterValueByName_2 = Element.GetParameterValueByName(element=code_block_3, parameterName=параметр_этажа)
номер_параметра_этажа = StringInput("-1")
eq = getParameterValueByName_2 == номер_параметра_этажа
filterByBoolMask_2 = List.FilterByBoolMask(list=code_block_3, mask=eq)
if_ = If(test=фильтр_по_этажу_да_нет, true=filterByBoolMask_2.in, false=code_block_3)
code_block_4 = CodeBlock(elm=if_) { elm; }
code_block_5 = CodeBlock { "Номер помещения"; }
getParameterValueByName_3 = Element.GetParameterValueByName(element=code_block_4, parameterName=code_block_5)
sortByKey = List.SortByKey(list=code_block_4, keys=getParameterValueByName_3)
code_block_6 = CodeBlock(elm=sortByKey.sorted_list) { elm; }
code_block_7 = CodeBlock { "Номер функции"; "АС"; }
getParameterValueByName_4 = Element.GetParameterValueByName(element=code_block_6, parameterName=code_block_7.out0)
eq_2 = getParameterValueByName_4 == code_block_7.out1
filterByBoolMask_3 = List.FilterByBoolMask(list=code_block_6, mask=eq_2)
if_2 = If(test=исключить_функцию_да_нет, true=filterByBoolMask_3.out, false=code_block_6)
code_block_8 = CodeBlock(elm=if_2) { elm; }
location = Room.Location(code_block_8)
deconstructPoint = Geometry.Points.DeconstructPoint(location)
code_block_9 = CodeBlock(y=deconstructPoint) { y/1; }
round = Math.Round(code_block_9)
sortByKey_2 = List.SortByKey(list=code_block_8, keys=round)
code_block_10 = CodeBlock { "Номер функции"; }
getParameterValueByName_5 = Element.GetParameterValueByName(parameterName=code_block_10)  # unwired: element
groupByFunction = GroupByFunction(sortByKey_2.sorted_list, getParameterValueByName_5)
code_block_11 = CodeBlock { "Номер помещения"; }
count = Count(groupByFunction@L2)
code_block_12 = CodeBlock(x=count) { 1..x; }
string_from_object = FromObject(code_block_12)
length = String.Length(string_from_object)
code_block_13 = CodeBlock { 1; }
eq_3 = length == code_block_13
code_block_14 = CodeBlock(x=code_block_12) { "0"+x; }
if_3 = If(test=eq_3, true=code_block_14, false=code_block_12)
string_from_object_2 = FromObject(if_3)
setParameterByName = Element.SetParameterByName(element=groupByFunction, parameterName=code_block_11, value=string_from_object_2)  # frozen
code_block_15 = CodeBlock()
# ---------- code_block_15.designscript (17 lines) ----------
"Номер помещения";
"01";
"Площадь по мос.проекту (текст)";
"";
",";
".";
"=";
"Площадь по мос.проекту";
"Уровень";
"Имя";
"Номер помещения";
"-";
"Номер этажа";
"-1";
"01";
"Номер функции";
"АС";
# ----------------------------------------
parameters = Element.Parameters(all_elements_of_category)
id = Element.Id(all_elements_of_category)
sort = List.Sort(id)
eq_4 = id == sort
uniqueItems = List.UniqueItems(eq_4)
watch = Watch(sortByKey.sorted_keys)
code_block_16 = CodeBlock { "Номер помещения"; "01"; }
getParameterValueByName_6 = Element.GetParameterValueByName(element=sortByKey.sorted_list, parameterName=code_block_16.out0)
eq_5 = getParameterValueByName_6 == code_block_16.out1
filterByBoolMask_4 = List.FilterByBoolMask(list=sortByKey.sorted_list, mask=eq_5)
getParameterValueByName_7 = Element.GetParameterValueByName(element=filterByBoolMask_4.out, parameterName=code_block_16.out0)
code_block_17 = CodeBlock { "Номер этажа"; "-1"; }
фильтр_по_корпусу_да_нет = BoolSelector(true)
code_block_18 = CodeBlock(elm=if_) { elm; }
code_block_19 = CodeBlock { "Номер корпуса"; "8"; }
getParameterValueByName_8 = Element.GetParameterValueByName(element=code_block_18, parameterName=code_block_19.out0)
eq_6 = getParameterValueByName_8 == code_block_19.out1
filterByBoolMask_5 = List.FilterByBoolMask(list=code_block_18, mask=eq_6)
if_4 = If(test=фильтр_по_корпусу_да_нет, true=filterByBoolMask_5.in, false=code_block_18)
groupByKey = List.GroupByKey()  # frozen; unwired: list, keys
location_2 = Room.Location(groupByKey.groups)
deconstructPoint_2 = Geometry.Points.DeconstructPoint(location_2)
create = List.Create(groupByKey.groups, deconstructPoint_2)
transpose = List.Transpose(create)
sort_2 = List.Sort(transpose@L2)
flatten = Flatten(sortByKey_2.sorted_list)  # frozen
type = Object.Type(flatten)
code_block_20 = CodeBlock { "Revit.Elements.Room"; }
eq_7 = type == code_block_20
filterByBoolMask_6 = List.FilterByBoolMask(list=flatten, mask=eq_7)
code_block_21 = CodeBlock { "Номер функции"; "АС"; }
взять_только_функцию_да_нет = BoolSelector(false)
code_block_22 = CodeBlock(elm=sortByKey.sorted_list) { elm; }
параметр_функции = StringInput("Номер функции")
getParameterValueByName_9 = Element.GetParameterValueByName(element=code_block_22, parameterName=параметр_функции)
номер_параметра_этажа_2 = StringInput("АС")
eq_8 = getParameterValueByName_9 == номер_параметра_этажа_2
filterByBoolMask_7 = List.FilterByBoolMask(list=code_block_22, mask=eq_8)
if_5 = If(test=взять_только_функцию_да_нет, true=filterByBoolMask_7.in, false=code_block_22)
lastItem = List.LastItem(if_3@L2)
lastItem_2 = List.LastItem(groupByFunction@L2)
code_block_23 = CodeBlock { "Номер помещения"; "Номер функции"; }
getParameterValueByName_10 = Element.GetParameterValueByName(element=lastItem_2, parameterName=code_block_23.out0)
getParameterValueByName_11 = Element.GetParameterValueByName(element=lastItem_2, parameterName=code_block_23.out1)
взять_только_функцию_да_нет_2 = BoolSelector(true)
фильтр_по_этажу_да_нет_2 = BoolSelector(true)

# group: Включить для продолжения нумерации на следующем этаже
categories_2 = Categories("Rooms")  # frozen
all_elements_of_category_2 = ElementsOfCategory(categories_2)

code_block_24 = CodeBlock { "Площадь"; }
getParameterValueByName_12 = Element.GetParameterValueByName(element=all_elements_of_category_2, parameterName=code_block_24)
code_block_25 = CodeBlock { 0; }
gt_2 = getParameterValueByName_12 > code_block_25
isNull_2 = Object.IsNull(gt_2)
filterByBoolMask_8 = List.FilterByBoolMask(list=all_elements_of_category_2, mask=isNull_2)
code_block_26 = CodeBlock(elm=filterByBoolMask_8.out) { elm; }
code_block_27 = CodeBlock { "Номер этажа"; "Антресоль"; }
getParameterValueByName_13 = Element.GetParameterValueByName(element=code_block_26, parameterName=code_block_27.out0)
eq_9 = getParameterValueByName_13 == code_block_27.out1
filterByBoolMask_9 = List.FilterByBoolMask(list=code_block_26, mask=eq_9)
if_6 = If(test=фильтр_по_этажу_да_нет_2, true=filterByBoolMask_9.in, false=code_block_26)
code_block_28 = CodeBlock(elm=if_6) { elm; }
code_block_29 = CodeBlock { "Номер функции"; "ПЭ"; }
getParameterValueByName_14 = Element.GetParameterValueByName(element=code_block_28, parameterName=code_block_29.out0)
eq_10 = getParameterValueByName_14 == code_block_29.out1
filterByBoolMask_10 = List.FilterByBoolMask(list=code_block_28, mask=eq_10)
if_7 = If(test=взять_только_функцию_да_нет_2, true=filterByBoolMask_10.in, false=code_block_28)
code_block_30 = CodeBlock(elm=if_7) { elm; }
location_3 = Room.Location(code_block_30)
deconstructPoint_3 = Geometry.Points.DeconstructPoint(location_3)
code_block_31 = CodeBlock(y=deconstructPoint_3) { y/1; }
round_2 = Math.Round(code_block_31)
sortByKey_3 = List.SortByKey(list=code_block_30, keys=round_2)
code_block_32 = CodeBlock { "Номер функции"; }
getParameterValueByName_15 = Element.GetParameterValueByName(parameterName=code_block_32)  # unwired: element
groupByFunction_2 = GroupByFunction(sortByKey_3.sorted_list, getParameterValueByName_15)
code_block_33 = CodeBlock { "Номер помещения"; }
code_block_34 = CodeBlock { 9; }
count_2 = Count(groupByFunction_2@L2)
code_block_35 = CodeBlock(y=code_block_34, x=count_2) { y..y+x-1; }
string_from_object_3 = FromObject(code_block_35)
length_2 = String.Length(string_from_object_3)
code_block_36 = CodeBlock { 1; }
eq_11 = length_2 == code_block_36
code_block_37 = CodeBlock(x=code_block_35) { "0"+x; }
if_8 = If(test=eq_11, true=code_block_37, false=code_block_35)
string_from_object_4 = FromObject(if_8)
setParameterByName_2 = Element.SetParameterByName(element=groupByFunction_2, parameterName=code_block_33, value=string_from_object_4)
lastItem_3 = List.LastItem(groupByFunction_2@L2)
code_block_38 = CodeBlock { "Номер помещения"; "Номер функции"; }
getParameterValueByName_16 = Element.GetParameterValueByName(element=lastItem_3, parameterName=code_block_38.out1)
