# Dynamo graph 1.(in Dynamo) Работа с параметром помещения и перенос в другой параметр.dyn (Dynamo 1.2.1.3083)

# note: Параметры для работы

categories = Categories("Rooms")
all_elements_of_category = ElementsOfCategory(categories)
code_block = CodeBlock { "Номер корпуса"; "9"; "Площадь по мос.проекту (текст)"; ""; ","; "."; "="; "Площадь по мос.проекту"; }
getParameterValueByName = Element.GetParameterValueByName(element=all_elements_of_category, parameterName=code_block.out0)
# note: Фильтрация по заданным параметрам
eq = getParameterValueByName == code_block.out1
filterByBoolMask = List.FilterByBoolMask(list=all_elements_of_category, mask=eq)
getParameterValueByName_2 = Element.GetParameterValueByName(element=filterByBoolMask.in, parameterName=code_block.out2)
# note: Собираем помещения, фильтр по помещениям, запись в параметр помещения
eq_2 = getParameterValueByName_2 == code_block.out3
filterByBoolMask_2 = List.FilterByBoolMask(list=filterByBoolMask.in, mask=eq_2)
getParameterValueByName_3 = Element.GetParameterValueByName(element=filterByBoolMask_2.out, parameterName=code_block.out2)
code_block_2 = CodeBlock(найти1=code_block.out4, поменять1=code_block.out5, найти2=code_block.out6) { найти1; поменять1; найти2; "-1"; "0"; 0; }
replace = String.Replace(str=getParameterValueByName_3, searchFor=code_block_2.найти1, replaceWith=code_block_2.поменять1)
lastIndexOf = String.LastIndexOf(replace, code_block_2.найти2)
# note: Работа с значением параметра
code_block_3 = CodeBlock(x=lastIndexOf) { x+1; }
remove = String.Remove(str=replace, startIndex=code_block_2.out5, count=code_block_3)
toNumber = String.ToNumber(remove)
setParameterByName = Element.SetParameterByName(element=filterByBoolMask_2.out, parameterName=code_block.out7, value=toNumber)
parameters = Element.Parameters(all_elements_of_category)
id = Element.Id(all_elements_of_category)
sort = List.Sort(id)
eq_3 = id == sort
uniqueItems = List.UniqueItems(eq_3)
string_from_object = FromObject(lastIndexOf)
replace_2 = String.Replace(str=string_from_object, searchFor=code_block_2.out3, replaceWith=code_block_2.out4)
toNumber_2 = String.ToNumber(replace_2)
