# Dynamo graph 1.(in Dynamo) Создание помещений по тексту (квартиры) и Сортиривка текста по координатам (добавляем имя и старую площадь)2.dyn (Dynamo 1.2.1.3083)

# note: Номера квартир должны быть те что выбраны
# note: ВСЁ ОСТАЛЬНОЕ

# group: ПРИМЕЧАНИЯ ПО ЦВЕТОВОЙ ГРУППИРОВКЕ
# note: GUIDELINES

# group: ПЕРЕМЕННЫЕ ЗНАЧЕНИЯ
# note: ПЕРЕМЕННЫЕ ЗНАЧЕНИЯ

# group: ПРОВЕРОЧНЫЕ НОДЫ
# note: ПРОВЕРОЧНЫЕ НОДЫ

# group: ПЕРЕДАЁМ ИНФОРМАЦИЮ В РЕВИТ
# note: ПЕРЕДАЁМ ИНФОРМАЦИЮ В РЕВИТ

# group: ИСПОЛНИТЕЛЬНЫЕ НОДЫ (фильтрование, подбор, списки и т.д.)
# note: НОДЫ РАБОТАЮЩИЕ С ДАННЫМИ
# note: ИСПОЛНИТЕЛЬНЫЕ НОДЫ

# group: ЗАПАСНЫЕ ВАРИАНТЫ, ДОПОЛНИТЕЛЬНЫЕ ОПЦИИ
# note: ЗАПАСНЫЕ
# note: ДОПОЛНИТЕЛЬНЫЕ. Градации серово по важности, темнее - важнее

# group: КЛЮЧЕВЫЕ МОМЕНТЫ РАБОТЫ
# note: ИТОГОВАЯ КОНСОЛИДАЦИЯ ДАННЫХ

# group: ПОЛУЧАЕМ ДАННЫЕ ИЗ РЕВИТ
# note: ПОЛУЧАЕМ ДАННЫЕ ИЗ РЕВИТ

# group: Get Revit Selection:
forceChildrensEval = ForceChildrensEval()  # unwired: arg0
pys_get_revit_selection = Python(IN[0]=forceChildrensEval)
# ---------- pys_get_revit_selection.python (22 lines) ----------
import clr
clr.AddReference('RevitServices')
clr.AddReference('RevitAPI')
from Autodesk.Revit.DB import *
import RevitServices
from RevitServices.Persistence import DocumentManager
from Autodesk.Revit.ApplicationServices import Application

reset = IN[0]

doc = DocumentManager.Instance.CurrentDBDocument
uidoc = DocumentManager.Instance.CurrentUIApplication.ActiveUIDocument
ids = uidoc.Selection.GetElementIds()

idd = [str(i) for i in ids]

if isinstance(idd, list) == True:
	elems = [doc.GetElement(ElementId(int(i))) for i in idd]
else:
	elems = doc.GetElement(ElementId(int(idd)))

OUT = elems
# ----------------------------------------

parameters = Element.Parameters(pys_get_revit_selection)
# note: ПЕРЕМЕННЫЕ ЗНАЧЕНИЯ
уровень_создания = Levels("К8 04 Этаж")
ветка_переноса_текста_в_имя = CodeBlock(text_for_name=pys_get_revit_selection) { text_for_name; }  # "Ветка переноса текста в имя помещения"
получаем_положение_точки_текста = Python(IN[0]=ветка_переноса_текста_в_имя)
# ---------- получаем_положение_точки_текста.python (24 lines) ----------
import clr
import math
clr.AddReference('RevitAPI')
from Autodesk.Revit.DB import *

clr.AddReference("RevitNodes")
import Revit
clr.ImportExtensions(Revit.GeometryConversion)

items = UnwrapElement(IN[0])
pointlist = list()


for item in items:
	try:
		# points and text notes
		pointlist.append(item.Coord.ToPoint())
	except:
		loc = item.Location
		if loc.ToString() == 'Autodesk.Revit.DB.LocationPoint':
			# point-based elements
			pointlist.append(loc.Point.ToPoint())

OUT = pointlist
# ----------------------------------------
получаем_boundingbox_вокруг = Python(IN[0]=ветка_переноса_текста_в_имя)  # "Получаем BoundingBox вокруг текста"
# ---------- получаем_boundingbox_вокруг.python (23 lines) ----------
import clr
import math
clr.AddReference('RevitAPI')
from Autodesk.Revit.DB import *

clr.AddReference("RevitNodes")
import Revit
clr.ImportExtensions(Revit.GeometryConversion)

clr.AddReference("RevitServices")
import RevitServices
from RevitServices.Persistence import DocumentManager

doc = DocumentManager.Instance.CurrentDBDocument

items = UnwrapElement(IN[0])
view = doc.ActiveView
bb = []

for item in items:
	bb.append(item.get_BoundingBox(view).ToProtoType())

OUT = bb
# ----------------------------------------
minPoint = BoundingBox.MinPoint(получаем_boundingbox_вокруг)
deconstructPoint = Geometry.Points.DeconstructPoint(minPoint)
code_block = CodeBlock(x=deconstructPoint) { x/1000; ","; false; 1; 5; }
string_from_object = FromObject(code_block.out0)
removeAfterGivenCharacter = Custom[String.RemoveAfterGivenCharacter](str=string_from_object, Character=code_block.out1)  # This will move all characters at and after the given character.
toNumber = String.ToNumber(removeAfterGivenCharacter)
round = Math.Round(toNumber)
code_block_2 = CodeBlock(dbl=round) { dbl; }
code_block_3 = CodeBlock(precision=code_block.out4) { precision; }
code_block_4 = CodeBlock(a=code_block_2, b=code_block_3) { Math.Round(a/b)*b; }
# note: Количество цифр должно соответствовать количеству подоваемых столбцов данных
code_block_5 = CodeBlock(dbl=code_block_4) { dbl; }
uniqueItems = List.UniqueItems(code_block_5)
file_path = Filename("E:\Dyno\name.xlsx")
code_block_6 = CodeBlock { 1; 0; }
string_from_object_2 = FromObject(code_block_6.out0)
sortByKey = List.SortByKey(list=ветка_переноса_текста_в_имя, keys=code_block_5)
groupByKey = List.GroupByKey(list=sortByKey.sorted_list, keys=sortByKey.sorted_keys)
code_block_7 = CodeBlock(list=groupByKey.groups) { list[2]; list[1]; list[0]; list[3]; }
code_block_8 = CodeBlock(название=code_block_7.out0, номер=code_block_7.out1, секция=code_block_7.out2, площадь=code_block_7.out3) { название; номер; секция; площадь; }
text = TextNote.Text(code_block_8.секция)
квартиры_и_секции = String.TrimWhitespace(text)
code_block_9 = CodeBlock { "("; }
split = String.Split(квартиры_и_секции, code_block_9)
transpose = List.Transpose(split)
code_block_10 = CodeBlock { "("; ")"; " "; }
replace = String.Replace(str=transpose, searchFor=code_block_10.out1, replaceWith=code_block_10.out2)
trimWhitespace = String.TrimWhitespace(replace)
trimWhitespace_2 = String.TrimWhitespace(trimWhitespace)
code_block_11 = CodeBlock(str=trimWhitespace_2) { str[0]; str[1]; }
code_block_12 = CodeBlock(секция=code_block_11.out0, функция=code_block_11.out1) { секция; функция; }
code_block_13 = CodeBlock(item=code_block_8.номер) { Flatten({item}); }
python_script = Python(IN[0]=code_block_13)  # same code as получаем_положение_точки_текста
deconstructPoint_2 = Geometry.Points.DeconstructPoint(python_script)
sortByKey_2 = List.SortByKey(list=code_block_8.номер, keys=deconstructPoint_2.out1)
reverse = List.Reverse(sortByKey_2.sorted_list)
text_2 = TextNote.Text(reverse)
номера_помещений = String.TrimWhitespace(text_2)
count = Count(номера_помещений)
cycle = List.Cycle(list=code_block_12.секция, amount=count)
code_block_14 = CodeBlock(item=code_block_8.название) { Flatten({item}); }
python_script_2 = Python(IN[0]=code_block_14)  # same code as получаем_положение_точки_текста
deconstructPoint_3 = Geometry.Points.DeconstructPoint(python_script_2)
sortByKey_3 = List.SortByKey(list=code_block_8.название, keys=deconstructPoint_3.out1)
reverse_2 = List.Reverse(sortByKey_3.sorted_list)
text_3 = TextNote.Text(reverse_2)
# note: Смотрим для проверки получаймых данных.
# Последовательность данных должна быть такая же, как в выбраных элементах. Не должно быть смешения данных между списками
названия_помещений = String.TrimWhitespace(text_3)
cycle_2 = List.Cycle(list=code_block_12.функция, amount=count)
code_block_15 = CodeBlock(секция=cycle, номер=номера_помещений, название=названия_помещений, функция=cycle_2) { секция; номер; название; функция; }
create = List.Create(code_block_15.секция, code_block_15.номер, code_block_15.название, code_block_15.функция)
transpose_2 = List.Transpose(create)
boolean = BoolSelector(true)
writeToFile = Excel.WriteToFile(filePath=file_path, sheetName=string_from_object_2, startRow=code_block_6.out1, startCol=code_block_6.out1, data=transpose_2, overWrite=boolean)  # frozen
categories = Categories("Rooms")
all_elements_of_category = ElementsOfCategory(categories)
# note: ФИЛЬТРУЕМ ПОМЕЩЕНИЯ для записи в них параметров
code_block_16 = CodeBlock { "Номер помещения"; "Номер секции"; "Номер этажа"; "Номер функции"; "Name"; "Level"; "ОЗ"; }
getParameterValueByName = Element.GetParameterValueByName(element=all_elements_of_category, parameterName=code_block_16.out5)
выбрать_уровень_с_которым = Levels("К9 02 Этаж")  # "ВЫБРАТЬ Уровень с которым работаеш"
getParameterValueByName_2 = Element.GetParameterValueByName(element=выбрать_уровень_с_которым, parameterName=code_block_16.out4)
eq = getParameterValueByName == getParameterValueByName_2  # lacing=Longest
filterByBoolMask = List.FilterByBoolMask(list=all_elements_of_category, mask=eq)
getParameterValueByName_3 = Element.GetParameterValueByName(element=filterByBoolMask.in, parameterName=code_block_16.out1)
code_block_17 = CodeBlock(секция=code_block_11.out0, функция=code_block_11.out1) { секция; функция; }
eq_2 = getParameterValueByName_3 == code_block_17.секция  # lacing=Longest
filterByBoolMask_2 = List.FilterByBoolMask(list=filterByBoolMask.in, mask=eq_2)
getParameterValueByName_4 = Element.GetParameterValueByName(element=filterByBoolMask_2.in, parameterName=code_block_16.out3)
sort = List.Sort(code_block_17.функция)
allIndicesOf = List.AllIndicesOf(list=getParameterValueByName_4, item=sort)
getItemAtIndex = List.GetItemAtIndex(list=filterByBoolMask_2.in, index=allIndicesOf)
getParameterValueByName_5 = Element.GetParameterValueByName(element=getItemAtIndex, parameterName=code_block_16.out0)
sortByKey_4 = List.SortByKey(list=getItemAtIndex@L2, keys=getParameterValueByName_5@L2)
code_block_18 = CodeBlock { "Площадь по мос.проекту"; "Площадь по мос.проекту (текст)"; "Name"; }
# note: Групируем значения по помещениям
code_block_19 = CodeBlock { "01"; 1; }
allIndicesOf_2 = List.AllIndicesOf(list=номера_помещений, item=code_block_19.out0)
deconstruct = List.Deconstruct(list=allIndicesOf_2)
count_2 = List.Count(номера_помещений)
join = List.Join(deconstruct.rest, count_2)
slice = List.Slice(номера_помещений, allIndicesOf_2, join)
slice_2 = List.Slice(названия_помещений, allIndicesOf_2, join)
code_block_20 = CodeBlock(item=code_block_8.площадь) { Flatten({item}); }
python_script_3 = Python(IN[0]=code_block_20)  # same code as получаем_положение_точки_текста
deconstructPoint_4 = Geometry.Points.DeconstructPoint(python_script_3)
sortByKey_5 = List.SortByKey(list=code_block_8.площадь, keys=deconstructPoint_4.out1)
reverse_3 = List.Reverse(sortByKey_5.sorted_list)
text_4 = TextNote.Text(reverse_3)
площадь_помещений = String.TrimWhitespace(text_4)
slice_3 = List.Slice(площадь_помещений, allIndicesOf_2, join)
# note: Записываем данные в ревит. Для теста лучше запускать замороженными.
code_block_21 = CodeBlock(номера=slice, названия=slice_2, площадь=slice_3) { номера; названия; площадь; }
записываем_площади = Element.SetParameterByName(element=sortByKey_4.sorted_list, parameterName=code_block_18.out1, value=code_block_21.площадь)  # frozen
byLocation = Room.ByLocation()  # frozen; unwired: arg0, arg1
code_block_22 = CodeBlock(rooms=byLocation) { rooms; }
code_block_23 = CodeBlock { "Номер секции"; "Номер помещения"; "Name"; "Номер функции"; "Upper Limit"; "Limit Offset"; 0; }
номер_секции = CodeBlock { "C"; }
ветка_создания_помещений_из = CodeBlock(text_for_room=pys_get_revit_selection) { text_for_room; }  # "Ветка создания помещений из текста (присваиваем номер и функцию)"; frozen
text_5 = TextNote.Text(ветка_создания_помещений_из)
trimWhitespace_3 = String.TrimWhitespace(text_5)
code_block_24 = CodeBlock { "Кв"; }
contains = String.Contains(str=trimWhitespace_3, searchFor=code_block_24)
filterByBoolMask_3 = List.FilterByBoolMask(list=ветка_создания_помещений_из, mask=contains)
code_block_25 = CodeBlock(item=filterByBoolMask_3.out) { Flatten({item}); }
python_script_4 = Python(IN[0]=code_block_25)  # same code as получаем_положение_точки_текста
code_block_26 = CodeBlock(марка=filterByBoolMask_3.in, номер=filterByBoolMask_3.out, координаты=python_script_4) { марка; номер; координаты; }
text_6 = TextNote.Text(code_block_26.марка)
trimWhitespace_4 = String.TrimWhitespace(text_6)
code_block_27 = CodeBlock { "_"; }
text_7 = TextNote.Text(code_block_26.номер)
trimWhitespace_5 = String.TrimWhitespace(text_7)
code_block_28 = CodeBlock(x=trimWhitespace_4, z=code_block_27, y=trimWhitespace_5) { x+z+y; }
count_3 = Count(code_block_28)
cycle_3 = List.Cycle(list=номер_секции, amount=count_3)
code_block_29 = CodeBlock { ")"; " "; }
cycle_4 = List.Cycle(list=code_block_29.out1, amount=count_3)
code_block_30 = CodeBlock { "("; }
split_2 = String.Split(trimWhitespace_4, code_block_30)
transpose_3 = List.Transpose(split_2)
replace_2 = String.Replace(str=transpose_3, searchFor=code_block_29.out0, replaceWith=code_block_29.out1)
trimWhitespace_6 = String.TrimWhitespace(replace_2)
flatten = Flatten(trimWhitespace_6)
code_block_31 = CodeBlock(секция=cycle_3, номер=trimWhitespace_5, название=cycle_4, функция=flatten) { секция; номер; название; функция; }
setParameterByName = Element.SetParameterByName(element=code_block_22, parameterName=code_block_23.out0, value=code_block_31.секция)
setParameterByName_2 = Element.SetParameterByName(element=code_block_22, parameterName=code_block_23.out1, value=code_block_31.номер)
replace_3 = String.Replace(str=replace, searchFor=code_block_10.out1, replaceWith=code_block_9)
setParameterByName_3 = Element.SetParameterByName(element=code_block_22, parameterName=code_block_23.out2, value=code_block_31.название)
setParameterByName_4 = Element.SetParameterByName(element=code_block_22, parameterName=code_block_23.out3, value=code_block_31.функция)
верхний_уровень = Levels("К8 05 Этаж")
setParameterByName_5 = Element.SetParameterByName(element=code_block_22, parameterName=code_block_23.out4, value=верхний_уровень)
setParameterByName_6 = Element.SetParameterByName(element=code_block_22, parameterName=code_block_23.out5, value=code_block_23.out6)
lunchbox_create_room_by_name_and = Custom[LunchBox Create Room by Name and Number]()  # Creates an unplaced room element using a name and number.; unwired: Toggle, Number, Name
code_block_32 = CodeBlock { Toggle; }  # unwired: Toggle
code_block_33 = CodeBlock { Number; }  # unwired: Number
code_block_34 = CodeBlock { Name; }  # unwired: Name
python_script_5 = Python(IN[0]=code_block_32, IN[1]=code_block_33, IN[2]=code_block_34)
# ---------- python_script_5.python (76 lines) ----------
import clr
clr.AddReference('ProtoGeometry')
from Autodesk.DesignScript.Geometry import *

# Import RevitAPI
clr.AddReference("RevitAPI")
import Autodesk
from Autodesk.Revit.DB import *

# Import DocumentManager and TransactionManager
clr.AddReference("RevitServices")
import RevitServices
from RevitServices.Persistence import DocumentManager
from RevitServices.Transactions import TransactionManager

# Import ToDSType(bool) extension method
clr.AddReference("RevitNodes")
import Revit
clr.ImportExtensions(Revit.Elements)
clr.ImportExtensions(Revit.GeometryConversion)

#The inputs to this node will be stored as a list in the IN variable.
doc =  DocumentManager.Instance.CurrentDBDocument
app =  DocumentManager.Instance.CurrentUIApplication.Application

bool = IN[0]
rmnumbers = IN[1]
rmnames = IN[2]

rooms = []

existrooms = []
existnames = []
existnumbers = []
collector = FilteredElementCollector(doc)
collector.OfCategory(BuiltInCategory.OST_Rooms)
for roomexist in collector:
	existrooms.append(roomexist)

if bool == True:
	
	# "Start" the transaction
	TransactionManager.Instance.EnsureInTransaction(doc)
	for i in range(0,len(rmnumbers)):
		name = rmnames[i]
		number = rmnumbers[i]

		v = doc.ActiveView
		p = v.get_Parameter(BuiltInParameter.VIEW_PHASE).AsElementId()
		phase = doc.GetElement(p)
		
		#search for matching rooms
		match = False
		for j in range(0, len(existrooms)):
			existrm = existrooms[j]
			existnm = ''
			for p in existrm.Parameters:
				if p.Definition.Name == 'Name':		
					existnm = p.AsString()
			existnum = existrm.Number
			if existnm == name and existnum == number:
				rooms.append(existrm)
				match = True
				break

		if match == False:
			room = doc.Create.NewRoom(phase)
			room.Name = name
			room.Number = str(number)
			rooms.append(room)
	
# "End" the transaction
TransactionManager.Instance.TransactionTaskDone()

#Assign your output to the OUT variable
OUT = rooms
# ----------------------------------------
code_block_35 = CodeBlock(Rom=python_script_5) { Rom; }
boolean_2 = BoolSelector(true)
atPointInPhase = Custom[Room.AtPointInPhase]()  # Tries to retrieve a room element at the given location for the given phase.; unwired: point, phase
code_block_36 = CodeBlock(xyz=code_block_26.координаты, name=code_block_28) { xyz; name; }
getParameterValueByName_6 = Element.GetParameterValueByName(element=all_elements_of_category, parameterName=code_block_16.out3)  # frozen
code_block_37 = CodeBlock { "."; " "; }
replace_4 = String.Replace(str=getParameterValueByName_6, searchFor=code_block_37.out0, replaceWith=code_block_37.out1)
setParameterByName_7 = Element.SetParameterByName(element=all_elements_of_category, parameterName=code_block_16.out3, value=replace_4)
code_block_38 = CodeBlock { " "; }
split_3 = String.Split(code_block_17.функция, code_block_38)
transpose_4 = List.Transpose(split_3)
code_block_39 = CodeBlock(K=transpose_4) { K[1]; }
sortByKey_6 = List.SortByKey(list=code_block_17.функция, keys=code_block_39)
sortByKey_7 = List.SortByKey(list=filterByBoolMask_2.in, keys=getParameterValueByName_4)
groupByKey_2 = List.GroupByKey(list=sortByKey_7.sorted_list, keys=sortByKey_7.sorted_keys)
code_block_40 = CodeBlock { "Номер секции"; "Номер помещения"; "Name"; "Номер функции"; }
getParameterValueByName_7 = Element.GetParameterValueByName(element=sortByKey_4.sorted_list, parameterName=code_block_40.out3)
getParameterValueByName_8 = Element.GetParameterValueByName(element=sortByKey_4.sorted_list, parameterName=code_block_40.out1)
записываем_названия = Element.SetParameterByName(element=sortByKey_4.sorted_list, parameterName=code_block_18.out2, value=code_block_21.названия)  # frozen
code_block_41 = CodeBlock(a=code_block_11.out0) { a; }
# note: Номера помещений в списках должны совпадать
code_block_42 = CodeBlock(номера=slice) { номера; }
code_block_43 = CodeBlock(площадь=slice_3) { площадь; }
maxPoint = BoundingBox.MaxPoint(получаем_boundingbox_вокруг)
uniqueItems_2 = List.UniqueItems(removeAfterGivenCharacter)
byStartPointEndPoint = Line.ByStartPointEndPoint()  # frozen; unwired: startPoint, endPoint
