# Dynamo graph 1.Заполняем таблицу для эксель.dyn (Dynamo 1.3.2.2480)

# group: Get Revit Selection:
forceChildrensEval = ForceChildrensEval()  # frozen; unwired: arg0
pys_get_revit_selection = Python(IN[0]=forceChildrensEval)
# ---------- pys_get_revit_selection.python (22 lines) ----------
import clr
clr.AddReference('RevitServices')
clr.AddReference('RevitAPI')
from Autodesk.Revit.DB import *
import RevitServices
from RevitServices.Persistence import DocumentManager
from Autodesk.Revit.ApplicationServices import Application

reset = IN[0]

doc = DocumentManager.Instance.CurrentDBDocument
uidoc = DocumentManager.Instance.CurrentUIApplication.ActiveUIDocument
ids = uidoc.Selection.GetElementIds()

idd = [str(i) for i in ids]

if isinstance(idd, list) == True:
	elems = [doc.GetElement(ElementId(int(i))) for i in idd]
else:
	elems = doc.GetElement(ElementId(int(idd)))

OUT = elems
# ----------------------------------------

shedules = Python()  # "get.all.Shedules"; frozen
# ---------- shedules.python (95 lines) ----------
#Copyright(c) 2015, Konrad Sobon
# @arch_laboratory, http://archi-lab.net

import clr
clr.AddReference('ProtoGeometry')
from Autodesk.DesignScript.Geometry import *

# Import DocumentManager and TransactionManager
clr.AddReference("RevitServices")
import RevitServices
from RevitServices.Persistence import DocumentManager
from RevitServices.Transactions import TransactionManager

# Import RevitAPI
clr.AddReference("RevitAPI")
import Autodesk
from Autodesk.Revit.DB import *

doc = DocumentManager.Instance.CurrentDBDocument
uiapp = DocumentManager.Instance.CurrentUIApplication
app = uiapp.Application

from System.Collections.Generic import *

# Import ToDSType(bool) extension method
clr.AddReference("RevitNodes")
import Revit
clr.ImportExtensions(Revit.Elements)

#The inputs to this node will be stored as a list in the IN variable.
dataEnteringNode = IN

#collect all views in the model
collector = FilteredElementCollector(doc)
views = collector.OfClass(View).ToElements()

#sort views into separate lists based on view type
areaPlans, ceilingPlans, columnSchedules = [], [], []
costReport, details, draftingViews = [], [], []
drawingSheets, elevations, engineetingPlans = [], [], []
floorPlans, internal, legends, loadReports = [], [], [], []
panelSchedules, pressureLossReports, renderings = [], [], []
reports, schedules, sections, threeD = [], [], [], []
undefined, walkthrough = [], []
for i in views:
	if not i.IsTemplate:
		if i.ViewType == ViewType.AreaPlan:
			areaPlans.append(i.ToDSType(True))
		elif i.ViewType == ViewType.CeilingPlan:
			ceilingPlans.append(i.ToDSType(True))
		elif i.ViewType == ViewType.ColumnSchedule:
			columnSchedules.append(i.ToDSType(True))
		elif i.ViewType == ViewType.CostReport:
			costReport.append(i.ToDSType(True))
		elif i.ViewType == ViewType.Detail:
			details.append(i.ToDSType(True))
		elif i.ViewType == ViewType.DraftingView:
			draftingViews.append(i.ToDSType(True))
		elif i.ViewType == ViewType.DrawingSheet:
			drawingSheets.append(i.ToDSType(True))
		elif i.ViewType == ViewType.Elevation:
			elevations.append(i.ToDSType(True))
		elif i.ViewType == ViewType.EngineeringPlan:
			engineetingPlans.append(i.ToDSType(True))
		elif i.ViewType == ViewType.FloorPlan:
			floorPlans.append(i.ToDSType(True))
		elif i.ViewType == ViewType.Internal:
			internal.append(i.ToDSType(True))
		elif i.ViewType == ViewType.Legend:
			legends.append(i.ToDSType(True))
		elif i.ViewType == ViewType.LoadsReport:
			loadReports.append(i.ToDSType(True))
		elif i.ViewType == ViewType.PanelSchedule:
			panelSchedules.append(i.ToDSType(True))
		elif i.ViewType == ViewType.PresureLossReport:
			pressureLossReports.append(i.ToDSType(True))
		elif i.ViewType == ViewType.Rendering:
			renderings.append(i.ToDSType(True))
		elif i.ViewType == ViewType.Report:
			reports.append(i.ToDSType(True))
		elif i.ViewType == ViewType.Schedule:
			schedules.append(i.ToDSType(True))
		elif i.ViewType == ViewType.Section:
			sections.append(i.ToDSType(True))
		elif i.ViewType == ViewType.ThreeD:
			threeD.append(i.ToDSType(True))
		elif i.ViewType == ViewType.Undefined:
			undefined.append(i.ToDSType(True))
		elif i.ViewType == ViewType.Walkthrough:
			walkthrough.append(i.ToDSType(True))
		else:
			continue

#Assign your output to the OUT variable
OUT = schedules
# ----------------------------------------
code_block = CodeBlock { "Имя вида"; }
getParameterValueByName = Element.GetParameterValueByName(element=shedules, parameterName=code_block)
code_block_2 = CodeBlock(x=getParameterValueByName) { x=="% Экспликация помещений. Помещения жилого дома, все квартиры."; }
filterByBoolMask = List.FilterByBoolMask(list=shedules, mask=code_block_2)
code_block_3 = CodeBlock { "Skf03"; }
getCalculatedValues = Python(IN[0]=filterByBoolMask.in, IN[1]=code_block_3)  # "Schedule.GetCalculatedValues"
# ---------- getCalculatedValues.python (74 lines) ----------
#python nodes in dynamo 1.0
#proposed by Julien Benoit @jbenoit44 
#http://aecuandme.wordpress.com/
import clr
clr.AddReference('ProtoGeometry')
from Autodesk.DesignScript.Geometry import *
# Import ToDSType(bool) extension method
clr.AddReference("RevitNodes")
import Revit
clr.ImportExtensions(Revit.Elements)
# Import geometry conversion extension methods
clr.ImportExtensions(Revit.GeometryConversion)
# Import DocumentManager and TransactionManager
clr.AddReference("RevitServices")
import RevitServices
from RevitServices.Persistence import DocumentManager
from RevitServices.Transactions import TransactionManager
from System.Collections.Generic import *
# Import RevitAPI
clr.AddReference("RevitAPI")
import Autodesk
from Autodesk.Revit.DB import *

doc = DocumentManager.Instance.CurrentDBDocument
uiapp = DocumentManager.Instance.CurrentUIApplication
app = uiapp.Application
uidoc=DocumentManager.Instance.CurrentUIApplication.ActiveUIDocument


views = UnwrapElement(IN[0])

values=[]
name=IN[1]

# Start Transaction
TransactionManager.Instance.EnsureInTransaction(doc)
"""

for v in views:
	value=[]
	for i in range(100):
		try:
			b=SectionType.Body
			a=v.GetCellText(b,0,i)
			value.append(str(a))
		except:
			pass
			
	values.append(value)

"""
for v in views:
	value=[]
	for i in range(100):
		try:
			b=SectionType.Body
			a=v.GetCellText(b,0,i)
		except:
			pass
		if a == IN[1]:
			try:
				for n in range(2000):
					c=SectionType.Body
					d=v.GetCellText(b,n,i)
					value.append(d)
			except:
				pass	
	values.append(value)


# End Transaction
TransactionManager.Instance.TransactionTaskDone()

OUT=values
# ----------------------------------------
code_block_4 = CodeBlock { "Помещения"; }
byName = Category.ByName(code_block_4)
all_elements_of_category = ElementsOfCategory(byName)
code_block_5 = CodeBlock { "Вариант конструкции"; }
getParameterValueByName_2 = Element.GetParameterValueByName(element=all_elements_of_category, parameterName=code_block_5)
code_block_6 = CodeBlock(x=getParameterValueByName_2) { x == "-1"; }
filterByBoolMask_2 = List.FilterByBoolMask(list=all_elements_of_category, mask=code_block_6)
filterByBoolMask_3 = List.FilterByBoolMask(list=getParameterValueByName_2, mask=code_block_6)
code_block_7 = CodeBlock { "Имя"; }
getParameterValueByName_3 = Element.GetParameterValueByName(element=filterByBoolMask_3.out, parameterName=code_block_7)
code_block_8 = CodeBlock(x=getParameterValueByName_3) { x == "Без перегородок"; }
filterByBoolMask_4 = List.FilterByBoolMask(list=filterByBoolMask_2.out, mask=code_block_8)
create = List.Create(filterByBoolMask_2.in, filterByBoolMask_4.in)
flatten = Flatten(create)
code_block_9 = CodeBlock { "Номер секции"; }
getParameterValueByName_4 = Element.GetParameterValueByName(element=flatten, parameterName=code_block_9)
code_block_10 = CodeBlock(x=getParameterValueByName_4) { x == "1.3"; }
filterByBoolMask_5 = List.FilterByBoolMask(list=flatten, mask=code_block_10)
code_block_11 = CodeBlock { "Комментарии"; }
getParameterValueByName_5 = Element.GetParameterValueByName(element=filterByBoolMask_5.in, parameterName=code_block_11)
code_block_12 = CodeBlock(x=getParameterValueByName_5) { x != "МОП"; }
filterByBoolMask_6 = List.FilterByBoolMask(list=filterByBoolMask_5.in, mask=code_block_12)
code_block_13 = CodeBlock { "Уровень"; }
getParameterValueByName_6 = Element.GetParameterValueByName(element=filterByBoolMask_6.in, parameterName=code_block_13)
forceChildrensEval_2 = ForceChildrensEval()  # unwired: arg0
string_tonumber_clean = Python(IN[0]=getParameterValueByName_6, IN[1]=forceChildrensEval_2)
# ---------- string_tonumber_clean.python (9 lines) ----------
list = IN[0]
newlist = []

for l in list:
	try:
		newlist.append(int(l))	
	except:
		newlist.append(0)		
OUT = newlist
# ----------------------------------------
code_block_14 = CodeBlock(x=string_tonumber_clean) { x >= 2; }
filterByBoolMask_7 = List.FilterByBoolMask(list=filterByBoolMask_6.in, mask=code_block_14)
code_block_15 = CodeBlock { "Уровень"; }
getParameterValueByName_7 = Element.GetParameterValueByName(parameterName=code_block_15)  # unwired: element
sortByFunction = SortByFunction(filterByBoolMask_7.in, getParameterValueByName_7)
groupByFunction = GroupByFunction(sortByFunction, getParameterValueByName_7)
code_block_16 = CodeBlock { "Наименование функции"; }
getParameterValueByName_8 = Element.GetParameterValueByName(parameterName=code_block_16)  # unwired: element
groupByFunction_2 = GroupByFunction(groupByFunction@L2, getParameterValueByName_8)
parameters = Element.Parameters(groupByFunction_2)
getData = Revit.Schedule.GetData(filterByBoolMask.in)
code_block_17 = CodeBlock { "Уровень"; }
getParameterValueByName_9 = Element.GetParameterValueByName(element=groupByFunction_2, parameterName=code_block_17)
code_block_18 = CodeBlock { "Имя"; }
getParameterValueByName_10 = Element.GetParameterValueByName(element=groupByFunction_2, parameterName=code_block_18)
code_block_19 = CodeBlock(x=getParameterValueByName_10) { x == "Комната"; }
filterByBoolMask_8 = List.FilterByBoolMask(list=groupByFunction_2, mask=code_block_19)
flatten_2 = Flatten(filterByBoolMask_8.in)
code_block_20 = CodeBlock { "№ помещения"; }
getParameterValueByName_11 = Element.GetParameterValueByName(element=flatten_2, parameterName=code_block_20)
code_block_21 = CodeBlock(x=getParameterValueByName_11) { x=="1"; }
filterByBoolMask_9 = List.FilterByBoolMask(list=flatten_2, mask=code_block_21)
code_block_22 = CodeBlock()
# ---------- code_block_22.designscript (8 lines) ----------
"_э_Условный номер";
"_э_Назначение";
"_э_Этаж расположения";
"_э_Номер подъезда (номер секции)";
"_э_Общая площадь, м2";
"_э_Количество комнат";
"_э_Площадь, м2 (комнаты)";
"_э_Площадь, м2 (помещений)";
# ----------------------------------------
code_block_23 = CodeBlock { "Наименование функции"; " "; }
getParameterValueByName_12 = Element.GetParameterValueByName(element=filterByBoolMask_9.in, parameterName=code_block_23.out0)
split = String.Split(getParameterValueByName_12, code_block_23.out1)
transpose = List.Transpose(split)
code_block_24 = CodeBlock(x=transpose) { x[1]; }
setParameterByName = Element.SetParameterByName(element=filterByBoolMask_9.in, parameterName=code_block_22.out0, value=code_block_24)
code_block_25 = CodeBlock { "квартира"; }
setParameterByName_2 = Element.SetParameterByName(element=setParameterByName, parameterName=code_block_22.out1, value=code_block_25)
code_block_26 = CodeBlock { "Уровень"; }
getParameterValueByName_13 = Element.GetParameterValueByName(element=setParameterByName_2, parameterName=code_block_26)
setParameterByName_3 = Element.SetParameterByName(element=setParameterByName_2, parameterName=code_block_22.out2, value=getParameterValueByName_13)
code_block_27 = CodeBlock { "Здание №1, Корпус№1"; }
setParameterByName_4 = Element.SetParameterByName(element=setParameterByName_3, parameterName=code_block_22.out3, value=code_block_27)
code_block_28 = CodeBlock { "Площадь"; "Коэффициент"; }
getParameterValueByName_14 = Element.GetParameterValueByName(element=groupByFunction_2, parameterName=code_block_28.out0)
getParameterValueByName_15 = Element.GetParameterValueByName(element=groupByFunction_2, parameterName=code_block_28.out1)
code_block_29 = CodeBlock(x=getParameterValueByName_14, y=getParameterValueByName_15) { x*y; }
code_block_30 = CodeBlock { 1; }
round = Math.Round(number=code_block_29, digits=code_block_30)
sum = Math.Sum(round@L2)
string_from_object = FromObject(sum)
python_script = Python(IN[0]=string_from_object)
# ---------- python_script.python (6 lines) ----------
fail = IN[0]
clear = []
for f in fail:
	clear.append(f[:-5])

OUT = clear
# ----------------------------------------
setParameterByName_5 = Element.SetParameterByName(element=setParameterByName_4, parameterName=code_block_22.out4, value=python_script)
count = List.Count(filterByBoolMask_8.in@L2)
string_from_object_2 = FromObject(count)
setParameterByName_6 = Element.SetParameterByName(element=setParameterByName_5, parameterName=code_block_22.out5, value=string_from_object_2)
code_block_31 = CodeBlock { "Площадь"; "Коэффициент"; }
getParameterValueByName_16 = Element.GetParameterValueByName(element=flatten_2, parameterName=code_block_31.out0)
getParameterValueByName_17 = Element.GetParameterValueByName(element=flatten_2, parameterName=code_block_31.out1)
code_block_32 = CodeBlock(x=getParameterValueByName_16, y=getParameterValueByName_17) { x*y; }
code_block_33 = CodeBlock { 1; }
round_2 = Math.Round(number=code_block_32, digits=code_block_33)
string_from_object_3 = FromObject(round_2)
python_script_2 = Python(IN[0]=string_from_object_3)  # same code as python_script
setParameterByName_7 = Element.SetParameterByName(element=flatten_2, parameterName=code_block_22.out6, value=python_script_2)
flatten_3 = Flatten(filterByBoolMask_8.out)
code_block_34 = CodeBlock { "Площадь"; "Коэффициент"; }
getParameterValueByName_18 = Element.GetParameterValueByName(element=flatten_3, parameterName=code_block_34.out0)
getParameterValueByName_19 = Element.GetParameterValueByName(element=flatten_3, parameterName=code_block_34.out1)
code_block_35 = CodeBlock(x=getParameterValueByName_18, y=getParameterValueByName_19) { x*y; }
code_block_36 = CodeBlock { 1; }
round_3 = Math.Round(number=code_block_35, digits=code_block_36)
string_from_object_4 = FromObject(round_3)
python_script_3 = Python(IN[0]=string_from_object_4)  # same code as python_script
setParameterByName_8 = Element.SetParameterByName(element=flatten_3, parameterName=code_block_22.out7, value=python_script_3)
code_block_37 = CodeBlock { "Имя"; }
getParameterValueByName_20 = Element.GetParameterValueByName(parameterName=code_block_37)  # unwired: element
sortByFunction_2 = SortByFunction(groupByFunction_2@L2, getParameterValueByName_20)  # frozen
flatten_4 = Flatten(sortByFunction_2)
code_block_38 = CodeBlock { "№ помещения"; }
getParameterValueByName_21 = Element.GetParameterValueByName(element=sortByFunction_2, parameterName=code_block_37)
count_2 = List.Count(getParameterValueByName_21@L2)
code_block_39 = CodeBlock(x=count_2) { 1..x; }
flatten_5 = Flatten(code_block_39)
string_from_object_5 = FromObject(flatten_5)
setParameterByName_9 = Element.SetParameterByName(element=flatten_4, parameterName=code_block_38, value=string_from_object_5)
code_block_40 = CodeBlock { 1; }  # frozen
flatten_6 = List.Flatten(list=filterByBoolMask_8.in, amt=code_block_40)
transpose_2 = List.Transpose(flatten_6)
code_block_41 = CodeBlock(x=transpose_2) { x[0]; }
