# Dynamo graph 1.Нумерация помещений по функциям по выбору.dyn (Dynamo 1.3.2.2480)

# group: Get Revit Selection:
forceChildrensEval = ForceChildrensEval()  # unwired: arg0
pys_get_revit_selection = Python(IN[0]=forceChildrensEval)
# ---------- pys_get_revit_selection.python (22 lines) ----------
import clr
clr.AddReference('RevitServices')
clr.AddReference('RevitAPI')
from Autodesk.Revit.DB import *
import RevitServices
from RevitServices.Persistence import DocumentManager
from Autodesk.Revit.ApplicationServices import Application

reset = IN[0]

doc = DocumentManager.Instance.CurrentDBDocument
uidoc = DocumentManager.Instance.CurrentUIApplication.ActiveUIDocument
ids = uidoc.Selection.GetElementIds()

idd = [str(i) for i in ids]

if isinstance(idd, list) == True:
	elems = [doc.GetElement(ElementId(int(i))) for i in idd]
else:
	elems = doc.GetElement(ElementId(int(idd)))

OUT = elems
# ----------------------------------------

code_block = CodeBlock { "Номер помещения"; }
getParameterValueByName = Element.GetParameterValueByName(parameterName=code_block)  # unwired: element
groupByFunction = GroupByFunction(pys_get_revit_selection, getParameterValueByName)
code_block_2 = CodeBlock { "№ помещения"; }
count = Count(groupByFunction@L2)
code_block_3 = CodeBlock(x=count) { 1..x; }
string_from_object = FromObject(code_block_3)
setParameterByName = Element.SetParameterByName(element=groupByFunction, parameterName=code_block_2, value=string_from_object)
code_block_4 = CodeBlock { "Номер"; "№ помещения"; }
code_block_5 = CodeBlock { "Номер помещения"; "№ группы помещений"; }
getParameterValueByName_2 = Element.GetParameterValueByName(element=pys_get_revit_selection, parameterName=code_block_5.out0)
setParameterByName_2 = Element.SetParameterByName(element=pys_get_revit_selection, parameterName=code_block_5.out1, value=getParameterValueByName_2)
code_block_6 = CodeBlock { "Помещения"; }
byName = Category.ByName(code_block_6)
all_elements_of_category = ElementsOfCategory(byName)
code_block_7 = CodeBlock { "Номер секции"; }
getParameterValueByName_3 = Element.GetParameterValueByName(element=all_elements_of_category, parameterName=code_block_7)
code_block_8 = CodeBlock(x=getParameterValueByName_3) { x == "2"; }
filterByBoolMask = List.FilterByBoolMask(list=all_elements_of_category, mask=code_block_8)
code_block_9 = CodeBlock { "Комментарии"; }
getParameterValueByName_4 = Element.GetParameterValueByName(element=filterByBoolMask.in, parameterName=code_block_9)
code_block_10 = CodeBlock(x=getParameterValueByName_4) { x == "МОП"; }
filterByBoolMask_2 = List.FilterByBoolMask(list=filterByBoolMask.in, mask=code_block_10)
code_block_11 = CodeBlock { "Уровень"; }
getParameterValueByName_5 = Element.GetParameterValueByName(element=filterByBoolMask_2.in, parameterName=code_block_11)
toNumber = String.ToNumber(getParameterValueByName_5)
code_block_12 = CodeBlock(x=toNumber) { x >= 2; }
filterByBoolMask_3 = List.FilterByBoolMask(list=filterByBoolMask_2.in, mask=code_block_12)
