# Dynamo graph 1.Подсчет комнат в помещениях.dyn (Dynamo 1.3.0.875)

categories = Categories("Rooms")
all_elements_of_category = ElementsOfCategory(categories)
levels = Levels("К9 02 Этаж")
string = StringInput("Имя")
getParameterValueByName = Element.GetParameterValueByName(element=levels, parameterName=string)
string_2 = StringInput("Уровень")
getParameterValueByName_2 = Element.GetParameterValueByName(element=all_elements_of_category, parameterName=string_2)
equals = Equals(getParameterValueByName, getParameterValueByName_2)
filterByBoolMask = List.FilterByBoolMask(list=all_elements_of_category, mask=equals)
string_3 = StringInput("Назначение")
getParameterValueByName_3 = Element.GetParameterValueByName(element=filterByBoolMask.in, parameterName=string_3)
string_4 = StringInput("Квартира")
equals_2 = Equals(getParameterValueByName_3, string_4)
filterByBoolMask_2 = List.FilterByBoolMask(list=filterByBoolMask.in, mask=equals_2)
string_5 = StringInput("Номер функции")
getParameterValueByName_4 = Element.GetParameterValueByName(parameterName=string_5)  # unwired: element
groupByFunction = GroupByFunction(filterByBoolMask_2.in, getParameterValueByName_4)
string_6 = StringInput("Имя")
getParameterValueByName_5 = Element.GetParameterValueByName(element=groupByFunction, parameterName=string_6)

# group: 0
string_7 = StringInput("Комната")

equals_3 = Equals(getParameterValueByName_5, string_7)
filterByBoolMask_3 = List.FilterByBoolMask(list=groupByFunction, mask=equals_3)
string_8 = StringInput("Имя")
getParameterValueByName_6 = Element.GetParameterValueByName(element=filterByBoolMask_3.in, parameterName=string_8)
сгруппированные_помещения = CodeBlock(GroupRoom=groupByFunction) { GroupRoom; }
string_9 = StringInput("Наименование функции")
count = Count()  # unwired: arg0
map = List.Map(list=filterByBoolMask_3.in, f_x=count)
count_2 = Count()  # unwired: arg0
map_2 = List.Map(list=groupByFunction, f_x=count_2)
ofRepeatedItem = List.OfRepeatedItem(item=map, amount=map_2, lacing=Longest)
string_10 = StringInput("-комнатная квартира")
code_block = CodeBlock(x=ofRepeatedItem, y=string_10) { x+y; }
string_from_object = FromObject(code_block)
setParameterByName = Element.SetParameterByName(element=сгруппированные_помещения, parameterName=string_9, value=string_from_object)  # frozen
string_11 = StringInput("Уровень")
getParameterValueByName_7 = Element.GetParameterValueByName(parameterName=string_11)  # unwired: element
groupByFunction_2 = GroupByFunction(filterByBoolMask_2.in, getParameterValueByName_7)
string_12 = StringInput("1-комнатная квартира")
string_13 = StringInput("Номер функции")
getParameterValueByName_8 = Element.GetParameterValueByName(element=groupByFunction, parameterName=string_13)
countOccurences = Custom[List.CountOccurences](seq=map)  # Counts the number of occurences of each unique element in a given list
categories_2 = Categories("Rooms")  # frozen
all_elements_of_category_2 = ElementsOfCategory(categories_2)
levels_2 = Levels("К8 11 Этаж")
string_14 = StringInput("Имя")
getParameterValueByName_9 = Element.GetParameterValueByName(element=levels_2, parameterName=string_14)
string_15 = StringInput("Уровень")
getParameterValueByName_10 = Element.GetParameterValueByName(element=all_elements_of_category_2, parameterName=string_15)
equals_4 = Equals(getParameterValueByName_9, getParameterValueByName_10)
filterByBoolMask_4 = List.FilterByBoolMask(list=all_elements_of_category_2, mask=equals_4)
string_16 = StringInput("Назначение")
getParameterValueByName_11 = Element.GetParameterValueByName(element=filterByBoolMask_4.in, parameterName=string_16)
string_17 = StringInput("Квартира")
equals_5 = Equals(getParameterValueByName_11, string_17)
filterByBoolMask_5 = List.FilterByBoolMask(list=filterByBoolMask_4.in, mask=equals_5)
string_18 = StringInput("Уровень")
getParameterValueByName_12 = Element.GetParameterValueByName(element=filterByBoolMask_5.in, parameterName=string_18)
groupByKey = List.GroupByKey(list=filterByBoolMask_5.in, keys=getParameterValueByName_12)
string_19 = StringInput("Номер функции")
getParameterValueByName_13 = Element.GetParameterValueByName(parameterName=string_19)  # unwired: element
groupByFunction_3 = GroupByFunction(groupByKey.groups@L2, getParameterValueByName_13)
string_20 = StringInput("Наименование функции")
getParameterValueByName_14 = Element.GetParameterValueByName(element=groupByFunction_3, parameterName=string_20)
firstItem = List.FirstItem(getParameterValueByName_14@L2)
groupByKey_2 = List.GroupByKey(list=firstItem, keys=firstItem)
count_3 = Count(groupByKey_2.groups@L2)
