# Dynamo graph 1.Ренумерация выбранных помещений с разбивкой на два списка.dyn (Dynamo 1.3.3.4111)

# note: ВСЁ ОСТАЛЬНОЕ

# group: КЛЮЧЕВЫЕ МОМЕНТЫ РАБОТЫ 1
# note: ИТОГОВАЯ КОНСОЛИДАЦИЯ ДАННЫХ

# group: ЗАПАСНЫЕ ВАРИАНТЫ, ДОПОЛНИТЕЛЬНЫЕ ОПЦИИ
# note: ДОПОЛНИТЕЛЬНЫЕ. Градации серово по важности, темнее - важнее
# note: ЗАПАСНЫЕ

# group: КЛЮЧЕВЫЕ МОМЕНТЫ РАБОТЫ 2
# note: НОДЫ РАБОТАЮЩИЕ С ДАННЫМИ
# note: ИСПОЛНИТЕЛЬНЫЕ НОДЫ

# group: ИСПОЛНИТЕЛЬНЫЕ НОДЫ (фильтрование, подбор, списки и т.д.)
# note: ИСПОЛНИТЕЛЬНЫЕ НОДЫ
# note: НОДЫ РАБОТАЮЩИЕ С ДАННЫМИ

# group: ЭЛЕМЕНТЫ УПРАВЛЕНИЯ
# note: ЭЛЕМЕНТЫ УПРАВЛЕНИЯ
# note: ПЕРЕМЕННЫЕ ЗНАЧЕНИЯ

# group: ПРОВЕРОЧНЫЕ НОДЫ
# note: ПРОВЕРОЧНЫЕ НОДЫ

# group: ПЕРЕДАЁМ ИНФОРМАЦИЮ В РЕВИТ
# note: ПЕРЕДАЁМ ИНФОРМАЦИЮ В РЕВИТ

# group: ЭЛЕМЕНТЫ УПРАВЛЕНИЯ Dyno Studio
# note: Dyno Studio

# group: ЭЛЕМЕНТЫ УПРАВЛЕНИЯ 2 УРОВЕНЬ
# note: ЭЛЕМЕНТЫ УПРАВЛЕНИЯ
# note: ПЕРЕМЕННЫЕ ЗНАЧЕНИЯ

# group: ПОЛУЧАЕМ ДАННЫЕ ИЗ РЕВИТ
# note: ПОЛУЧАЕМ ДАННЫЕ ИЗ РЕВИТ

# group: ПРИМЕЧАНИЯ ПО ЦВЕТОВОЙ ГРУППИРОВКЕ
# note: GUIDELINES

запуск = BoolSelector(true)
нужен_ли_параметр_для_фильтрации = BoolSelector(true)
выбрать_помещения_можно_с = DSModelElementsSelection()  # "Выбрать помещения (можно с захватом других элементов)"; 603 picked in the model
code_block = CodeBlock { "Категория"; "Помещения"; }
getParameterValueByName = Element.GetParameterValueByName(element=выбрать_помещения_можно_с, parameterName=code_block.out0)
string_from_object = FromObject(getParameterValueByName)
equals = Equals(string_from_object, code_block.out1)
filterByBoolMask = List.FilterByBoolMask(list=выбрать_помещения_можно_с, mask=equals)
название_параметра_для_фильтра = StringInput("Назначение")
getParameterValueByName_2 = Element.GetParameterValueByName(element=filterByBoolMask.in, parameterName=название_параметра_для_фильтра)
значение_параметра_для_фильтра = StringInput("Квартира")
equals_2 = Equals(getParameterValueByName_2, значение_параметра_для_фильтра)
filterByBoolMask_2 = List.FilterByBoolMask(list=filterByBoolMask.in, mask=equals_2)
watch = Watch(filterByBoolMask_2.in)
if_ = Python(IN[0]=нужен_ли_параметр_для_фильтрации, IN[1]=watch, IN[2]=filterByBoolMask.in)
# ---------- if_.python (12 lines) ----------
import clr
boolean = IN[0]
true = UnwrapElement(IN[1])
false = UnwrapElement(IN[2])

if boolean:
	out = true
else:
	out = false

#Назначьте вывод переменной OUT.
OUT = out
# ----------------------------------------
code_block_2 = CodeBlock { "Площадь"; 0; "null"; "false"; }
getParameterValueByName_3 = Element.GetParameterValueByName(element=if_, parameterName=code_block_2.out0)
gt = getParameterValueByName_3 > code_block_2.out1
isNull = Object.IsNull(gt)
filterByBoolMask_3 = List.FilterByBoolMask(list=if_, mask=isNull)
параметр_номера_помещения = StringInput("ADSK_Номер квартиры")

# group: Сортировка по возврастанрию 1,2,3..100
flatten = Flatten(filterByBoolMask_3.out)
getParameterValueByName_4 = Element.GetParameterValueByName(element=flatten, parameterName=параметр_номера_помещения)

groupByKey = List.GroupByKey(list=getParameterValueByName_4, keys=getParameterValueByName_4)
watch_2 = Watch(groupByKey.groups)
uniqueItems = List.UniqueItems(watch_2@L2)
flatten_2 = Flatten(uniqueItems)
делим_на_два_списка___количество = DoubleInput(5)  # "__Делим на два списка__ Количество элементов в первом списке:"
code_block_3 = CodeBlock(x=делим_на_два_списка___количество) { 0..x; x+1; }
sublists = List.Sublists(list=flatten_2, ranges=code_block_3.out0, offset=code_block_3.out1)
lastItem = List.LastItem(sublists@L2)
count = Count(sublists@L2)
count_2 = Count(watch_2@L2)
create = List.Create(lastItem, count, count_2, flatten)
end = Revit.Transaction.Transaction.End(create)
start = Revit.Transaction.Transaction.Start(end)
code_block_4 = CodeBlock { 0; 1; 2; 3; }
getItemAtIndex = List.GetItemAtIndex(list=start, index=code_block_4.out3)
code_block_5 = CodeBlock { null; }
if_2 = Python(IN[0]=запуск, IN[1]=getItemAtIndex, IN[2]=code_block_5)  # same code as if_
getItemAtIndex_2 = List.GetItemAtIndex(list=start, index=code_block_4.out0)
code_block_6 = CodeBlock(x=getItemAtIndex_2) { String.ToNumber(x)+1; }
getItemAtIndex_3 = List.GetItemAtIndex(list=start, index=code_block_4.out1)
code_block_7 = CodeBlock(x=code_block_6, y=getItemAtIndex_3) { x..(x+y-1); }
getItemAtIndex_4 = List.GetItemAtIndex(list=start, index=code_block_4.out2)
ofRepeatedItem = List.OfRepeatedItem(item=code_block_7@L1, amount=getItemAtIndex_4@L1)
flatten_3 = Flatten(ofRepeatedItem)
string_from_object_2 = FromObject(flatten_3)
setParameterByName = Element.SetParameterByName(element=if_2, parameterName=параметр_номера_помещения, value=string_from_object_2)
forceChildrensEval = ForceChildrensEval()  # unwired: arg0

# group: Get Revit Selection:
pys_get_revit_selection = Python(IN[0]=forceChildrensEval)
# ---------- pys_get_revit_selection.python (22 lines) ----------
import clr
clr.AddReference('RevitServices')
clr.AddReference('RevitAPI')
from Autodesk.Revit.DB import *
import RevitServices
from RevitServices.Persistence import DocumentManager
from Autodesk.Revit.ApplicationServices import Application

reset = IN[0]

doc = DocumentManager.Instance.CurrentDBDocument
uidoc = DocumentManager.Instance.CurrentUIApplication.ActiveUIDocument
ids = uidoc.Selection.GetElementIds()

idd = [str(i) for i in ids]

if isinstance(idd, list) == True:
	elems = [doc.GetElement(ElementId(int(i))) for i in idd]
else:
	elems = doc.GetElement(ElementId(int(idd)))

OUT = elems
# ----------------------------------------

setParameterByName_2 = Element.SetParameterByName()  # unwired: element, parameterName, value
getParameterValueByName_5 = Element.GetParameterValueByName()  # unwired: element, parameterName
путь_к_файлу_python = Filename(".\1.Из Excel в параметры помещений, по номерам квартир.py")  # frozen
forceChildrensEval_2 = ForceChildrensEval()  # unwired: arg0
find_file_and_import_it = Python(IN[0]=путь_к_файлу_python, IN[1]=forceChildrensEval_2)
# ---------- find_file_and_import_it.python (9 lines) ----------
try:
	filePath = IN[0]

	with open(filePath, 'rb') as inf:
	    lines = inf.readlines()

	OUT = ''.join(lines)
except Exception, e:
	OUT = "No file"
# ----------------------------------------
parameters = Element.Parameters()  # unwired: arg0
geometry = Element.Geometry()  # unwired: arg0
boolean = BoolSelector(true)  # frozen
code_block_8 = CodeBlock { 1; 2; }
if_3 = Python(IN[0]=boolean, IN[1]=code_block_8.out0, IN[2]=code_block_8.out1)  # same code as if_

# group: элементы внутри групп
members = Python()  # "Group.Members"; frozen; unwired: IN[0]
# ---------- members.python (19 lines) ----------
import clr
clr.AddReference('RevitAPI')
from Autodesk.Revit.DB import *

clr.AddReference("RevitNodes")
import Revit
clr.ImportExtensions(Revit.Elements)

groups = UnwrapElement(IN[0])
elementlist = list()
for item in groups:
	try:
		memberlist = list()
		for member in item.GetMemberIds():
			memberlist.append(item.Document.GetElement(member))
		elementlist.append(memberlist)
	except:
		elementlist.append(list())
OUT = elementlist
# ----------------------------------------

# group: Get Revit Selection:
forceChildrensEval_3 = ForceChildrensEval()  # frozen; unwired: arg0
pys_get_revit_selection_2 = Python(IN[0]=forceChildrensEval_3)  # same code as pys_get_revit_selection

# group: Parameters name from language
parameters_name_from_language = Python()  # frozen
# ---------- parameters_name_from_language.python (18 lines) ----------
import clr
clr.AddReference('RevitServices')
import RevitServices
from RevitServices.Persistence import DocumentManager

uiapp = DocumentManager.Instance.CurrentUIApplication
app = uiapp.Application
lng = app.Language
rus = ["Тип","Имя семейства","Имя типа"]
enu = ["Type","Family name","Type name"]
out = []
if str(lng) == "Russian":
	out = rus
else:
	out = enu
#English_USA
#Russian
OUT = out
# ----------------------------------------

code_block_9 = CodeBlock { 0..38; 39; }
