# Dynamo graph 1.Ренумерация выбранных помещений.dyn (Dynamo 1.3.3.4111)

# note: ВСЁ ОСТАЛЬНОЕ

# group: КЛЮЧЕВЫЕ МОМЕНТЫ РАБОТЫ 1
# note: ИТОГОВАЯ КОНСОЛИДАЦИЯ ДАННЫХ

# group: ЗАПАСНЫЕ ВАРИАНТЫ, ДОПОЛНИТЕЛЬНЫЕ ОПЦИИ
# note: ДОПОЛНИТЕЛЬНЫЕ. Градации серово по важности, темнее - важнее
# note: ЗАПАСНЫЕ

# group: КЛЮЧЕВЫЕ МОМЕНТЫ РАБОТЫ 2
# note: НОДЫ РАБОТАЮЩИЕ С ДАННЫМИ
# note: ИСПОЛНИТЕЛЬНЫЕ НОДЫ

# group: ИСПОЛНИТЕЛЬНЫЕ НОДЫ (фильтрование, подбор, списки и т.д.)
# note: ИСПОЛНИТЕЛЬНЫЕ НОДЫ
# note: НОДЫ РАБОТАЮЩИЕ С ДАННЫМИ

# group: ЭЛЕМЕНТЫ УПРАВЛЕНИЯ
# note: ЭЛЕМЕНТЫ УПРАВЛЕНИЯ
# note: ПЕРЕМЕННЫЕ ЗНАЧЕНИЯ

# group: ПРОВЕРОЧНЫЕ НОДЫ
# note: ПРОВЕРОЧНЫЕ НОДЫ

# group: ПЕРЕДАЁМ ИНФОРМАЦИЮ В РЕВИТ
# note: ПЕРЕДАЁМ ИНФОРМАЦИЮ В РЕВИТ

# group: ЭЛЕМЕНТЫ УПРАВЛЕНИЯ Dyno Studio
# note: Dyno Studio

# group: ЭЛЕМЕНТЫ УПРАВЛЕНИЯ 2 УРОВЕНЬ
# note: ЭЛЕМЕНТЫ УПРАВЛЕНИЯ
# note: ПЕРЕМЕННЫЕ ЗНАЧЕНИЯ

# group: ПОЛУЧАЕМ ДАННЫЕ ИЗ РЕВИТ
# note: ПОЛУЧАЕМ ДАННЫЕ ИЗ РЕВИТ

# group: ПРИМЕЧАНИЯ ПО ЦВЕТОВОЙ ГРУППИРОВКЕ
# note: GUIDELINES

запуск = BoolSelector(false)
нужен_ли_параметр_для_фильтрации = BoolSelector(false)
выбрать_помещения_можно_с = DSModelElementsSelection()  # "Выбрать помещения (можно с захватом других элементов)"
code_block = CodeBlock { "Категория"; "Помещения"; }
getParameterValueByName = Element.GetParameterValueByName(element=выбрать_помещения_можно_с, parameterName=code_block.out0)
string_from_object = FromObject(getParameterValueByName)
equals = Equals(string_from_object, code_block.out1)
filterByBoolMask = List.FilterByBoolMask(list=выбрать_помещения_можно_с, mask=equals)
название_параметра_для_фильтра = StringInput("Комментарии")
getParameterValueByName_2 = Element.GetParameterValueByName(element=filterByBoolMask.in, parameterName=название_параметра_для_фильтра)
значение_параметра_для_фильтра = StringInput("Место хранения")
equals_2 = Equals(getParameterValueByName_2, значение_параметра_для_фильтра)
filterByBoolMask_2 = List.FilterByBoolMask(list=filterByBoolMask.in, mask=equals_2)
watch = Watch(filterByBoolMask_2.in)
if_ = Python(IN[0]=нужен_ли_параметр_для_фильтрации, IN[1]=watch, IN[2]=filterByBoolMask.in)
# ---------- if_.python (12 lines) ----------
import clr
boolean = IN[0]
true = UnwrapElement(IN[1])
false = UnwrapElement(IN[2])

if boolean:
	out = true
else:
	out = false

#Назначьте вывод переменной OUT.
OUT = out
# ----------------------------------------
code_block_2 = CodeBlock { "Площадь"; 0; "null"; "false"; }
getParameterValueByName_3 = Element.GetParameterValueByName(element=if_, parameterName=code_block_2.out0)
gt = getParameterValueByName_3 > code_block_2.out1
isNull = Object.IsNull(gt)
filterByBoolMask_3 = List.FilterByBoolMask(list=if_, mask=isNull)
параметр_номера_помещения = StringInput("Номер")

# group: Сортировка по возврастанрию 1,2,3..100
flatten = Flatten(filterByBoolMask_3.out)
getParameterValueByName_4 = Element.GetParameterValueByName(element=flatten, parameterName=параметр_номера_помещения)

code_block_3 = CodeBlock { "."; }
split = String.Split(getParameterValueByName_4, code_block_3)
transpose = List.Transpose(split)
code_block_4 = CodeBlock(x=transpose) { x[3]; }

# group (continued): Сортировка по возврастанрию 1,2,3..100
toNumber = String.ToNumber(code_block_4)
sortByKey = List.SortByKey(list=flatten, keys=toNumber)

code_block_5 = CodeBlock { null; }
if_2 = Python(IN[0]=запуск, IN[1]=sortByKey.sorted_list, IN[2]=code_block_5)  # same code as if_
getParameterValueByName_5 = Element.GetParameterValueByName(element=sortByKey.sorted_list, parameterName=параметр_номера_помещения)
watch_2 = Watch(getParameterValueByName_5)
code_block_6 = CodeBlock { "."; }
split_2 = String.Split(watch_2, code_block_6)
transpose_2 = List.Transpose(split_2)
code_block_7 = CodeBlock(x1=transpose_2, x2=transpose_2, x3=transpose_2) { x1[0]+"."+x2[1]+"."+x3[2]; }
номер_с_которого_начинаем = IntegerSlider(2, range=1..100 step 1)  # "Номер с которого начинаем ренумерацию"
count = Count(sortByKey.sorted_list)
code_block_8 = CodeBlock(x=номер_с_которого_начинаем, x2=count) { x..(x+x2-1); }
string_from_object_2 = FromObject(code_block_8)
code_block_9 = CodeBlock(y1=code_block_7, y2=string_from_object_2) { y1+"."+y2; }
setParameterByName = Element.SetParameterByName(element=if_2, parameterName=параметр_номера_помещения, value=code_block_9)
parameters = Element.Parameters(if_)
forceChildrensEval = ForceChildrensEval()  # unwired: arg0

# group: Get Revit Selection:
pys_get_revit_selection = Python(IN[0]=forceChildrensEval)
# ---------- pys_get_revit_selection.python (22 lines) ----------
import clr
clr.AddReference('RevitServices')
clr.AddReference('RevitAPI')
from Autodesk.Revit.DB import *
import RevitServices
from RevitServices.Persistence import DocumentManager
from Autodesk.Revit.ApplicationServices import Application

reset = IN[0]

doc = DocumentManager.Instance.CurrentDBDocument
uidoc = DocumentManager.Instance.CurrentUIApplication.ActiveUIDocument
ids = uidoc.Selection.GetElementIds()

idd = [str(i) for i in ids]

if isinstance(idd, list) == True:
	elems = [doc.GetElement(ElementId(int(i))) for i in idd]
else:
	elems = doc.GetElement(ElementId(int(idd)))

OUT = elems
# ----------------------------------------

parameters_2 = Element.Parameters(выбрать_помещения_можно_с)
setParameterByName_2 = Element.SetParameterByName()  # unwired: element, parameterName, value
getParameterValueByName_6 = Element.GetParameterValueByName()  # unwired: element, parameterName
путь_к_файлу_python = Filename(".\1.Из Excel в параметры помещений, по номерам квартир.py")  # frozen
forceChildrensEval_2 = ForceChildrensEval()  # unwired: arg0
find_file_and_import_it = Python(IN[0]=путь_к_файлу_python, IN[1]=forceChildrensEval_2)
# ---------- find_file_and_import_it.python (9 lines) ----------
try:
	filePath = IN[0]

	with open(filePath, 'rb') as inf:
	    lines = inf.readlines()

	OUT = ''.join(lines)
except Exception, e:
	OUT = "No file"
# ----------------------------------------
parameters_3 = Element.Parameters()  # unwired: arg0
geometry = Element.Geometry()  # unwired: arg0
boolean = BoolSelector(true)  # frozen
code_block_10 = CodeBlock { 1; 2; }
if_3 = Python(IN[0]=boolean, IN[1]=code_block_10.out0, IN[2]=code_block_10.out1)  # same code as if_

# group: элементы внутри групп
members = Python()  # "Group.Members"; frozen; unwired: IN[0]
# ---------- members.python (19 lines) ----------
import clr
clr.AddReference('RevitAPI')
from Autodesk.Revit.DB import *

clr.AddReference("RevitNodes")
import Revit
clr.ImportExtensions(Revit.Elements)

groups = UnwrapElement(IN[0])
elementlist = list()
for item in groups:
	try:
		memberlist = list()
		for member in item.GetMemberIds():
			memberlist.append(item.Document.GetElement(member))
		elementlist.append(memberlist)
	except:
		elementlist.append(list())
OUT = elementlist
# ----------------------------------------

# group: Get Revit Selection:
forceChildrensEval_3 = ForceChildrensEval()  # frozen; unwired: arg0
pys_get_revit_selection_2 = Python(IN[0]=forceChildrensEval_3)  # same code as pys_get_revit_selection

# group: Parameters name from language
parameters_name_from_language = Python()  # frozen
# ---------- parameters_name_from_language.python (18 lines) ----------
import clr
clr.AddReference('RevitServices')
import RevitServices
from RevitServices.Persistence import DocumentManager

uiapp = DocumentManager.Instance.CurrentUIApplication
app = uiapp.Application
lng = app.Language
rus = ["Тип","Имя семейства","Имя типа"]
enu = ["Type","Family name","Type name"]
out = []
if str(lng) == "Russian":
	out = rus
else:
	out = enu
#English_USA
#Russian
OUT = out
# ----------------------------------------
