# Dynamo graph 1.Сканируем текст и Записываем по координатам в помещение V 1.dyn (Dynamo 1.3.2.2480)

# note: ВСЁ ОСТАЛЬНОЕ

# group: ЭЛЕМЕНТЫ УПРАВЛЕНИЯ
# note: ПЕРЕМЕННЫЕ ЗНАЧЕНИЯ
# note: ЭЛЕМЕНТЫ УПРАВЛЕНИЯ

# group: ПОЛУЧАЕМ ДАННЫЕ ИЗ РЕВИТ
# note: ПОЛУЧАЕМ ДАННЫЕ ИЗ РЕВИТ

# group: ЭЛЕМЕНТЫ УПРАВЛЕНИЯ 2 УРОВЕНЬ
# note: ЭЛЕМЕНТЫ УПРАВЛЕНИЯ
# note: ПЕРЕМЕННЫЕ ЗНАЧЕНИЯ

# group: ПРОВЕРОЧНЫЕ НОДЫ
# note: ПРОВЕРОЧНЫЕ НОДЫ

# group: ЭЛЕМЕНТЫ УПРАВЛЕНИЯ Dyno Studio
# note: Dyno Studio

# group: КЛЮЧЕВЫЕ МОМЕНТЫ РАБОТЫ 1
# note: ИТОГОВАЯ КОНСОЛИДАЦИЯ ДАННЫХ

# group: ИСПОЛНИТЕЛЬНЫЕ НОДЫ (фильтрование, подбор, списки и т.д.)
# note: ИСПОЛНИТЕЛЬНЫЕ НОДЫ
# note: НОДЫ РАБОТАЮЩИЕ С ДАННЫМИ

# group: ЗАПАСНЫЕ ВАРИАНТЫ, ДОПОЛНИТЕЛЬНЫЕ ОПЦИИ
# note: ЗАПАСНЫЕ
# note: ДОПОЛНИТЕЛЬНЫЕ. Градации серово по важности, темнее - важнее

# group: КЛЮЧЕВЫЕ МОМЕНТЫ РАБОТЫ 2
# note: ИСПОЛНИТЕЛЬНЫЕ НОДЫ
# note: НОДЫ РАБОТАЮЩИЕ С ДАННЫМИ

# group: ПЕРЕДАЁМ ИНФОРМАЦИЮ В РЕВИТ
# note: ПЕРЕДАЁМ ИНФОРМАЦИЮ В РЕВИТ

# group: ПРИМЕЧАНИЯ ПО ЦВЕТОВОЙ ГРУППИРОВКЕ
# note: GUIDELINES

boolean = BoolSelector(true)  # frozen
code_block = CodeBlock { 1; 2; }
if_ = Python(IN[0]=boolean, IN[1]=code_block.out0, IN[2]=code_block.out1)
# ---------- if_.python (12 lines) ----------
import clr
boolean = IN[0]
true = UnwrapElement(IN[1])
false = UnwrapElement(IN[2])

if boolean:
	out = true
else:
	out = false

#Назначьте вывод переменной OUT.
OUT = out
# ----------------------------------------
parameters = Element.Parameters()  # unwired: arg0
geometry = Element.Geometry()  # unwired: arg0
getParameterValueByName = Element.GetParameterValueByName()  # unwired: element, parameterName

# group: Parameters name from language
parameters_name_from_language = Python()  # frozen
# ---------- parameters_name_from_language.python (18 lines) ----------
import clr
clr.AddReference('RevitServices')
import RevitServices
from RevitServices.Persistence import DocumentManager

uiapp = DocumentManager.Instance.CurrentUIApplication
app = uiapp.Application
lng = app.Language
rus = ["Тип","Имя семейства","Имя типа"]
enu = ["Type","Family name","Type name"]
out = []
if str(lng) == "Russian":
	out = rus
else:
	out = enu
#English_USA
#Russian
OUT = out
# ----------------------------------------

setParameterByName = Element.SetParameterByName()  # unwired: element, parameterName, value

# group: элементы внутри групп
members = Python()  # "Group.Members"; frozen; unwired: IN[0]
# ---------- members.python (19 lines) ----------
import clr
clr.AddReference('RevitAPI')
from Autodesk.Revit.DB import *

clr.AddReference("RevitNodes")
import Revit
clr.ImportExtensions(Revit.Elements)

groups = UnwrapElement(IN[0])
elementlist = list()
for item in groups:
	try:
		memberlist = list()
		for member in item.GetMemberIds():
			memberlist.append(item.Document.GetElement(member))
		elementlist.append(memberlist)
	except:
		elementlist.append(list())
OUT = elementlist
# ----------------------------------------

byName = Family.ByName()  # unwired: arg0

# group: Get Revit Selection:
выбрать_элементы_в_модели = DSModelElementsSelection()
forceChildrensEval = ForceChildrensEval()  # unwired: arg0
pys_get_revit_selection = Python(IN[0]=forceChildrensEval)
# ---------- pys_get_revit_selection.python (22 lines) ----------
import clr
clr.AddReference('RevitServices')
clr.AddReference('RevitAPI')
from Autodesk.Revit.DB import *
import RevitServices
from RevitServices.Persistence import DocumentManager
from Autodesk.Revit.ApplicationServices import Application

reset = IN[0]

doc = DocumentManager.Instance.CurrentDBDocument
uidoc = DocumentManager.Instance.CurrentUIApplication.ActiveUIDocument
ids = uidoc.Selection.GetElementIds()

idd = [str(i) for i in ids]

if isinstance(idd, list) == True:
	elems = [doc.GetElement(ElementId(int(i))) for i in idd]
else:
	elems = doc.GetElement(ElementId(int(idd)))

OUT = elems
# ----------------------------------------
if_2 = Python(IN[0]=выбрать_элементы_в_модели, IN[1]=pys_get_revit_selection)
# ---------- if_2.python (12 lines) ----------
import clr

true = UnwrapElement(IN[0])
false = UnwrapElement(IN[1])

if true == None:
	out = false
else:
	out = true

#Назначьте вывод переменной OUT.
OUT = out
# ----------------------------------------

type = Object.Type(if_2)
groupByKey = List.GroupByKey(list=if_2, keys=type)
code_block_2 = CodeBlock(room=groupByKey.groups, text=groupByKey.groups) { room[0]; text[1]; }
flatten = Flatten(code_block_2.out0)
получаем_boundingbox_вокруг = Python(IN[0]=code_block_2.out1)  # "Получаем BoundingBox вокруг текста"
# ---------- получаем_boundingbox_вокруг.python (23 lines) ----------
import clr
import math
clr.AddReference('RevitAPI')
from Autodesk.Revit.DB import *

clr.AddReference("RevitNodes")
import Revit
clr.ImportExtensions(Revit.GeometryConversion)

clr.AddReference("RevitServices")
import RevitServices
from RevitServices.Persistence import DocumentManager

doc = DocumentManager.Instance.CurrentDBDocument

items = UnwrapElement(IN[0])
view = doc.ActiveView
bb = []

for item in items:
	bb.append(item.get_BoundingBox(view).ToProtoType())

OUT = bb
# ----------------------------------------
maxPoint = BoundingBox.MaxPoint(получаем_boundingbox_вокруг)
minPoint = BoundingBox.MinPoint(получаем_boundingbox_вокруг)
byStartPointEndPoint = Line.ByStartPointEndPoint(startPoint=maxPoint, endPoint=minPoint)
code_block_3 = CodeBlock { 0.5; }
pointAtParameter = Curve.PointAtParameter(curve=byStartPointEndPoint, param=code_block_3)
isInsideRoom = Room.IsInsideRoom(flatten, pointAtParameter, lacing=CrossProduct)
transpose = List.Transpose(isInsideRoom)
запись_в_параметры = BoolSelector(true)
code_block_4 = CodeBlock { null; }
if_3 = Python(IN[0]=запись_в_параметры, IN[1]=code_block_2.out0, IN[2]=code_block_4)  # same code as if_
имя_параметра_для_записи = StringInput("***№ по РД")
filterByBoolMask = List.FilterByBoolMask(list=code_block_2.out1, mask=isInsideRoom@L2)
code_block_5 = CodeBlock(n=filterByBoolMask.in) { n; }
text = TextNote.Text(code_block_5)
чистка = String.TrimWhitespace(text)

# group: Замена пустых списков
isEmpty = List.IsEmpty(чистка@L2)
allFalse = AllFalse(isEmpty)
code_block_6 = CodeBlock { true; }
indexOf = IndexOf(isEmpty, code_block_6)
code_block_7 = CodeBlock { "Нет"; }
create = List.Create(code_block_7)
replaceItemAtIndex = List.ReplaceItemAtIndex(list=чистка, index=indexOf, item=create)
if_4 = Python(IN[0]=allFalse, IN[1]=чистка, IN[2]=replaceItemAtIndex)  # same code as if_

string_from_array = FromArray(if_4)
code_block_8 = CodeBlock { "{{"; ""; "}}"; ""; }
replace = String.Replace(str=string_from_array, searchFor=code_block_8.out0, replaceWith=code_block_8.out1)
replace_2 = String.Replace(str=replace, searchFor=code_block_8.out2, replaceWith=code_block_8.out3)
code_block_9 = CodeBlock { "},{"; ","; ", "; }
split = String.Split(replace_2, code_block_9.out0)
replace_3 = String.Replace(str=split, searchFor=code_block_9.out1, replaceWith=code_block_9.out2)
записываем_названия = Element.SetParameterByName(element=if_3, parameterName=имя_параметра_для_записи, value=replace_3)
ZAxis = Vector.ZAxis()
code_block_10 = CodeBlock { 1000; }
translate = Geometry.Translate(geometry=pointAtParameter, direction=ZAxis, distance=code_block_10)
