# Dynamo graph 1.Сканируем текст и Создаём помещений по тексту 2.4.dyn (Dynamo 1.3.3.4111)

# note: ВСЁ ОСТАЛЬНОЕ

# group: ЭЛЕМЕНТЫ УПРАВЛЕНИЯ
# note: ПЕРЕМЕННЫЕ ЗНАЧЕНИЯ
# note: ЭЛЕМЕНТЫ УПРАВЛЕНИЯ

# group: ПОЛУЧАЕМ ДАННЫЕ ИЗ РЕВИТ
# note: ПОЛУЧАЕМ ДАННЫЕ ИЗ РЕВИТ

# group: ЭЛЕМЕНТЫ УПРАВЛЕНИЯ 2 УРОВЕНЬ
# note: ЭЛЕМЕНТЫ УПРАВЛЕНИЯ
# note: ПЕРЕМЕННЫЕ ЗНАЧЕНИЯ

# group: ПРОВЕРОЧНЫЕ НОДЫ
# note: ПРОВЕРОЧНЫЕ НОДЫ

# group: ЭЛЕМЕНТЫ УПРАВЛЕНИЯ Dyno Studio
# note: Dyno Studio

# group: КЛЮЧЕВЫЕ МОМЕНТЫ РАБОТЫ 1
# note: ИТОГОВАЯ КОНСОЛИДАЦИЯ ДАННЫХ

# group: ИСПОЛНИТЕЛЬНЫЕ НОДЫ (фильтрование, подбор, списки и т.д.)
# note: ИСПОЛНИТЕЛЬНЫЕ НОДЫ
# note: НОДЫ РАБОТАЮЩИЕ С ДАННЫМИ

# group: ЗАПАСНЫЕ ВАРИАНТЫ, ДОПОЛНИТЕЛЬНЫЕ ОПЦИИ
# note: ЗАПАСНЫЕ
# note: ДОПОЛНИТЕЛЬНЫЕ. Градации серово по важности, темнее - важнее

# group: КЛЮЧЕВЫЕ МОМЕНТЫ РАБОТЫ 2
# note: ИСПОЛНИТЕЛЬНЫЕ НОДЫ
# note: НОДЫ РАБОТАЮЩИЕ С ДАННЫМИ

# group: ПЕРЕДАЁМ ИНФОРМАЦИЮ В РЕВИТ
# note: ПЕРЕДАЁМ ИНФОРМАЦИЮ В РЕВИТ

# group: ПРИМЕЧАНИЯ ПО ЦВЕТОВОЙ ГРУППИРОВКЕ
# note: GUIDELINES

code_block = CodeBlock { "_"; }
создать_помещение = BoolSelector(true)

# group: Get Revit Selection:
выбрать_элементы_в_модели = DSModelElementsSelection()
forceChildrensEval = ForceChildrensEval()  # unwired: arg0
pys_get_revit_selection = Python(IN[0]=forceChildrensEval)
# ---------- pys_get_revit_selection.python (22 lines) ----------
import clr
clr.AddReference('RevitServices')
clr.AddReference('RevitAPI')
from Autodesk.Revit.DB import *
import RevitServices
from RevitServices.Persistence import DocumentManager
from Autodesk.Revit.ApplicationServices import Application

reset = IN[0]

doc = DocumentManager.Instance.CurrentDBDocument
uidoc = DocumentManager.Instance.CurrentUIApplication.ActiveUIDocument
ids = uidoc.Selection.GetElementIds()

idd = [str(i) for i in ids]

if isinstance(idd, list) == True:
	elems = [doc.GetElement(ElementId(int(i))) for i in idd]
else:
	elems = doc.GetElement(ElementId(int(idd)))

OUT = elems
# ----------------------------------------
if_ = Python(IN[0]=выбрать_элементы_в_модели, IN[1]=pys_get_revit_selection)
# ---------- if_.python (12 lines) ----------
import clr

true = UnwrapElement(IN[0])
false = UnwrapElement(IN[1])

if true == None:
	out = false
else:
	out = true

#Назначьте вывод переменной OUT.
OUT = out
# ----------------------------------------

ветка_создания_помещений_из = CodeBlock(text_for_room=if_) { text_for_room; }  # "Ветка создания помещений из текста (присваиваем номер и функцию)"
text = TextNote.Text(ветка_создания_помещений_из)
trimWhitespace = String.TrimWhitespace(text)
code_block_2 = CodeBlock { " м"; }
contains = String.Contains(str=trimWhitespace, searchFor=code_block_2)
filterByBoolMask = List.FilterByBoolMask(list=ветка_создания_помещений_из, mask=contains)
code_block_3 = CodeBlock(item=filterByBoolMask.out) { Flatten({item}); }
text_2 = TextNote.Text(code_block_3)
trimWhitespace_2 = String.TrimWhitespace(text_2)
python_script = Python(IN[0]=code_block_3)
# ---------- python_script.python (24 lines) ----------
import clr
import math
clr.AddReference('RevitAPI')
from Autodesk.Revit.DB import *

clr.AddReference("RevitNodes")
import Revit
clr.ImportExtensions(Revit.GeometryConversion)

items = UnwrapElement(IN[0])
pointlist = list()

for item in items:
	try:
		# points and text notes
		pointlist.append(item.Coord.ToPoint())
		y=BoundingBoxUV(item)
	except:
		loc = item.Location
		if loc.ToString() == 'Autodesk.Revit.DB.LocationPoint':
			# point-based elements
			pointlist.append(loc.Point.ToPoint())

OUT = pointlist
# ----------------------------------------

# group: Пытаемся центрировать текст
YAxis = Vector.YAxis()
python_script_2 = Python(IN[0]=code_block_3)
# ---------- python_script_2.python (17 lines) ----------
import clr
import math
clr.AddReference('RevitAPI')
from Autodesk.Revit.DB import *

clr.AddReference("RevitNodes")
import Revit
clr.ImportExtensions(Revit.GeometryConversion)

items = UnwrapElement(IN[0])
pointlist = list()
x,y = [],[]

for item in items:
	y.append(len(item.Text))

OUT = y
# ----------------------------------------
code_block_4 = CodeBlock(y=python_script_2, x=python_script_2) { y*30; x*70; }
translate = Geometry.Translate(geometry=python_script, direction=YAxis, distance=code_block_4.out0)
XAxis = Vector.XAxis()
translate_2 = Geometry.Translate(geometry=translate, direction=XAxis, distance=code_block_4.out1)

create = List.Create(trimWhitespace_2, translate_2)
code_block_5 = CodeBlock { null; }
if_2 = Python(IN[0]=создать_помещение, IN[1]=create, IN[2]=code_block_5)
# ---------- if_2.python (12 lines) ----------
import clr
boolean = IN[0]
true = UnwrapElement(IN[1])
false = UnwrapElement(IN[2])

if boolean:
	out = true
else:
	out = false

#Назначьте вывод переменной OUT.
OUT = out
# ----------------------------------------
code_block_6 = CodeBlock(номер=if_2, координаты=if_2) { номер[0]; координаты[1]; }
code_block_7 = CodeBlock(x=code_block, z=code_block_6.out0, y=code_block) { x+z+y; }
count = Count(code_block_7)  # frozen
# note: ПЕРЕМЕННЫЕ ЗНАЧЕНИЯ
уровень_создания = Levels("Этаж -1")
code_block_8 = CodeBlock(xyz=code_block_6.out1, name=code_block_7) { xyz; name; }
byLocation = Room.ByLocation(уровень_создания, code_block_8.xyz, code_block_8.name, code_block_6.out0)
# note: Записываем данные в ревит. Для теста лучше запускать замороженными.
code_block_9 = CodeBlock(rooms=byLocation) { rooms; }  # frozen
code_block_10 = CodeBlock { "Номер секции"; "Номер помещения"; "Name"; "Номер функции"; "Upper Limit"; "Limit Offset"; 0; "Площадь по SPEECH-РД"; }
code_block_11 = CodeBlock { секция; номер; название; функция; }  # unwired: секция, номер, название, функция
setParameterByName = Element.SetParameterByName(element=code_block_9, parameterName=code_block_10.out0, value=code_block_11.секция)
setParameterByName_2 = Element.SetParameterByName(element=code_block_9, parameterName=code_block_10.out1, value=code_block_11.номер)
setParameterByName_3 = Element.SetParameterByName(element=code_block_9, parameterName=code_block_10.out2, value=code_block_11.название)
setParameterByName_4 = Element.SetParameterByName(element=code_block_9, parameterName=code_block_10.out3, value=code_block_11.функция)
верхний_уровень = Levels("Этаж -2")
setParameterByName_5 = Element.SetParameterByName(element=byLocation, parameterName=code_block_10.out4, value=верхний_уровень)
setParameterByName_6 = Element.SetParameterByName(element=setParameterByName_5, parameterName=code_block_10.out5, value=code_block_10.out6)
номер_секции = CodeBlock { "C"; }
boolean = BoolSelector(true)  # frozen
code_block_12 = CodeBlock { 1; 2; }
if_3 = Python(IN[0]=boolean, IN[1]=code_block_12.out0, IN[2]=code_block_12.out1)  # same code as if_2
parameters = Element.Parameters()  # unwired: arg0
geometry = Element.Geometry()  # unwired: arg0
getParameterValueByName = Element.GetParameterValueByName()  # unwired: element, parameterName

# group: Parameters name from language
parameters_name_from_language = Python()  # frozen
# ---------- parameters_name_from_language.python (18 lines) ----------
import clr
clr.AddReference('RevitServices')
import RevitServices
from RevitServices.Persistence import DocumentManager

uiapp = DocumentManager.Instance.CurrentUIApplication
app = uiapp.Application
lng = app.Language
rus = ["Тип","Имя семейства","Имя типа"]
enu = ["Type","Family name","Type name"]
out = []
if str(lng) == "Russian":
	out = rus
else:
	out = enu
#English_USA
#Russian
OUT = out
# ----------------------------------------

setParameterByName_7 = Element.SetParameterByName()  # unwired: element, parameterName, value

# group: элементы внутри групп
members = Python()  # "Group.Members"; frozen; unwired: IN[0]
# ---------- members.python (19 lines) ----------
import clr
clr.AddReference('RevitAPI')
from Autodesk.Revit.DB import *

clr.AddReference("RevitNodes")
import Revit
clr.ImportExtensions(Revit.Elements)

groups = UnwrapElement(IN[0])
elementlist = list()
for item in groups:
	try:
		memberlist = list()
		for member in item.GetMemberIds():
			memberlist.append(item.Document.GetElement(member))
		elementlist.append(memberlist)
	except:
		elementlist.append(list())
OUT = elementlist
# ----------------------------------------

byName = Family.ByName()  # unwired: arg0
удалить = BoolSelector(false)
code_block_13 = CodeBlock { "˛"; }  # frozen
contains_2 = String.Contains(str=trimWhitespace, searchFor=code_block_13)
filterByBoolMask_2 = List.FilterByBoolMask(list=ветка_создания_помещений_из, mask=contains_2)
eraser = Python(IN[0]=удалить, IN[1]=filterByBoolMask_2.in)  # "Tool.Eraser"
# ---------- eraser.python (47 lines) ----------
if IN[0] == True:
	import clr
	clr.AddReference('ProtoGeometry')
	from Autodesk.DesignScript.Geometry import *
	# Import ToDSType(bool) extension method
	clr.AddReference("RevitNodes")
	import Revit
	clr.ImportExtensions(Revit.Elements)
	# Import geometry conversion extension methods
	clr.ImportExtensions(Revit.GeometryConversion)
	# Import DocumentManager and TransactionManager
	clr.AddReference("RevitServices")
	import RevitServices
	from RevitServices.Persistence import DocumentManager
	from RevitServices.Transactions import TransactionManager
	from System.Collections.Generic import *
	# Import RevitAPI
	clr.AddReference("RevitAPI")
	import Autodesk
	from Autodesk.Revit.DB import *
	
	doc = DocumentManager.Instance.CurrentDBDocument
	uiapp = DocumentManager.Instance.CurrentUIApplication
	app = uiapp.Application
	
	elt = []
	for i in IN[1]:
		elt.append(UnwrapElement(i).Id)
	
	# Start Transaction
	TransactionManager.Instance.EnsureInTransaction(doc)
	
	
	cantdelete=[]
	for item in elt:
		try:
			doc.Delete(item)
		except:
			cantdelete.append(item)
			
	
	# End Transaction
	TransactionManager.Instance.TransactionTaskDone()
	doc.Regenerate()
	OUT=cantdelete
else:
	OUT="не запущен"
# ----------------------------------------
text_3 = TextNote.Text(filterByBoolMask.in)
trimWhitespace_3 = String.TrimWhitespace(text_3)
split = String.Split(trimWhitespace_3, code_block_2)
flatten = Flatten(split)
toNumber = String.ToNumber(flatten)
setParameterByName_8 = Element.SetParameterByName(element=byLocation, parameterName=code_block_10.out7, value=toNumber)
count_2 = List.Count(trimWhitespace_2)
количество_номеров = Watch(count_2)
count_3 = List.Count(flatten)
количество_площадей = Watch(count_3)
watch = Watch(filterByBoolMask_2.in)
