# Dynamo graph 1.Сканируем текст спецификации и присваеваем параметрам помещений_V 1.dyn (Dynamo 1.3.2.2480)

# note: Номера квартир должны быть те что выбраны
# note: ВСЁ ОСТАЛЬНОЕ

# group: ЭЛЕМЕНТЫ УПРАВЛЕНИЯ
# note: ПЕРЕМЕННЫЕ ЗНАЧЕНИЯ
# note: ЭЛЕМЕНТЫ УПРАВЛЕНИЯ

# group: ПОЛУЧАЕМ ДАННЫЕ ИЗ РЕВИТ
# note: ПОЛУЧАЕМ ДАННЫЕ ИЗ РЕВИТ

# group: ЭЛЕМЕНТЫ УПРАВЛЕНИЯ 2 УРОВЕНЬ
# note: ЭЛЕМЕНТЫ УПРАВЛЕНИЯ
# note: ПЕРЕМЕННЫЕ ЗНАЧЕНИЯ

# group: ПРОВЕРОЧНЫЕ НОДЫ
# note: ПРОВЕРОЧНЫЕ НОДЫ

# group: ЭЛЕМЕНТЫ УПРАВЛЕНИЯ Dyno Studio
# note: Dyno Studio

# group: КЛЮЧЕВЫЕ МОМЕНТЫ РАБОТЫ 1
# note: ИТОГОВАЯ КОНСОЛИДАЦИЯ ДАННЫХ

# group: ИСПОЛНИТЕЛЬНЫЕ НОДЫ (фильтрование, подбор, списки и т.д.)
# note: ИСПОЛНИТЕЛЬНЫЕ НОДЫ
# note: НОДЫ РАБОТАЮЩИЕ С ДАННЫМИ

# group: ЗАПАСНЫЕ ВАРИАНТЫ, ДОПОЛНИТЕЛЬНЫЕ ОПЦИИ
# note: ЗАПАСНЫЕ
# note: ДОПОЛНИТЕЛЬНЫЕ. Градации серово по важности, темнее - важнее

# group: КЛЮЧЕВЫЕ МОМЕНТЫ РАБОТЫ 2
# note: ИСПОЛНИТЕЛЬНЫЕ НОДЫ
# note: НОДЫ РАБОТАЮЩИЕ С ДАННЫМИ

# group: ПЕРЕДАЁМ ИНФОРМАЦИЮ В РЕВИТ
# note: ПЕРЕДАЁМ ИНФОРМАЦИЮ В РЕВИТ

# group: ПРИМЕЧАНИЯ ПО ЦВЕТОВОЙ ГРУППИРОВКЕ
# note: GUIDELINES

# group: Get Revit Selection:
выбрать_элементы_в_модели = DSModelElementsSelection()
forceChildrensEval = ForceChildrensEval()  # unwired: arg0
pys_get_revit_selection = Python(IN[0]=forceChildrensEval)
# ---------- pys_get_revit_selection.python (22 lines) ----------
import clr
clr.AddReference('RevitServices')
clr.AddReference('RevitAPI')
from Autodesk.Revit.DB import *
import RevitServices
from RevitServices.Persistence import DocumentManager
from Autodesk.Revit.ApplicationServices import Application

reset = IN[0]

doc = DocumentManager.Instance.CurrentDBDocument
uidoc = DocumentManager.Instance.CurrentUIApplication.ActiveUIDocument
ids = uidoc.Selection.GetElementIds()

idd = [str(i) for i in ids]

if isinstance(idd, list) == True:
	elems = [doc.GetElement(ElementId(int(i))) for i in idd]
else:
	elems = doc.GetElement(ElementId(int(idd)))

OUT = elems
# ----------------------------------------
if_ = Python(IN[0]=выбрать_элементы_в_модели, IN[1]=pys_get_revit_selection)
# ---------- if_.python (12 lines) ----------
import clr

true = UnwrapElement(IN[0])
false = UnwrapElement(IN[1])

if true == None:
	out = false
else:
	out = true

#Назначьте вывод переменной OUT.
OUT = out
# ----------------------------------------

end = Revit.Transaction.Transaction.End(if_)
start = Revit.Transaction.Transaction.Start(end)
parameters = Element.Parameters(start)
ветка_переноса_текста_в_имя = CodeBlock(text_for_name=start) { text_for_name; }  # "Ветка переноса текста в имя помещения"
получаем_положение_точки_текста = Python(IN[0]=ветка_переноса_текста_в_имя)
# ---------- получаем_положение_точки_текста.python (24 lines) ----------
import clr
import math
clr.AddReference('RevitAPI')
from Autodesk.Revit.DB import *

clr.AddReference("RevitNodes")
import Revit
clr.ImportExtensions(Revit.GeometryConversion)

items = UnwrapElement(IN[0])
pointlist = list()


for item in items:
	try:
		# points and text notes
		pointlist.append(item.Coord.ToPoint())
	except:
		loc = item.Location
		if loc.ToString() == 'Autodesk.Revit.DB.LocationPoint':
			# point-based elements
			pointlist.append(loc.Point.ToPoint())

OUT = pointlist
# ----------------------------------------
получаем_boundingbox_вокруг = Python(IN[0]=ветка_переноса_текста_в_имя)  # "Получаем BoundingBox вокруг текста"
# ---------- получаем_boundingbox_вокруг.python (23 lines) ----------
import clr
import math
clr.AddReference('RevitAPI')
from Autodesk.Revit.DB import *

clr.AddReference("RevitNodes")
import Revit
clr.ImportExtensions(Revit.GeometryConversion)

clr.AddReference("RevitServices")
import RevitServices
from RevitServices.Persistence import DocumentManager

doc = DocumentManager.Instance.CurrentDBDocument

items = UnwrapElement(IN[0])
view = doc.ActiveView
bb = []

for item in items:
	bb.append(item.get_BoundingBox(view).ToProtoType())

OUT = bb
# ----------------------------------------
minPoint = BoundingBox.MinPoint(получаем_boundingbox_вокруг)
deconstructPoint = Geometry.Points.DeconstructPoint(minPoint)
code_block = CodeBlock(x=deconstructPoint) { x/100; ","; false; 1; 5; }
string_from_object = FromObject(code_block.out0)
removeAfterGivenCharacter = Custom[String.RemoveAfterGivenCharacter](str=string_from_object, Character=code_block.out1)  # This will move all characters at and after the given character.
toNumber = String.ToNumber(removeAfterGivenCharacter)
round = Math.Round(toNumber)
code_block_2 = CodeBlock(dbl=round) { dbl; }
code_block_3 = CodeBlock(precision=code_block.out4) { precision; }
code_block_4 = CodeBlock(a=code_block_2, b=code_block_3) { Math.Round(a/b)*b; }
uniqueItems = List.UniqueItems(code_block_4)
categories = Categories("Rooms")
all_elements_of_category = ElementsOfCategory(categories)
code_block_5 = CodeBlock { "Number"; "Name"; "Level"; }
# note: ФИЛЬТРУЕМ ПОМЕЩЕНИЯ для записи в них параметров
getParameterValueByName = Element.GetParameterValueByName(element=all_elements_of_category, parameterName=code_block_5.out2)
# note: ПЕРЕМЕННЫЕ ЗНАЧЕНИЯ
выбрать_уровень_с_которым = Levels("Этаж 01")  # "ВЫБРАТЬ Уровень с которым работаеш"
getParameterValueByName_2 = Element.GetParameterValueByName(element=выбрать_уровень_с_которым, parameterName=code_block_5.out1)
eq = getParameterValueByName == getParameterValueByName_2  # lacing=Longest
filterByBoolMask = List.FilterByBoolMask(list=all_elements_of_category, mask=eq)
getParameterValueByName_3 = Element.GetParameterValueByName(element=filterByBoolMask.in, parameterName=code_block_5.out0)
sortByKey = List.SortByKey(list=ветка_переноса_текста_в_имя, keys=code_block_4)
groupByKey = List.GroupByKey(list=sortByKey.sorted_list, keys=sortByKey.sorted_keys)
code_block_6 = CodeBlock(list=groupByKey.groups) { list[2]; list[0]; list[1]; list[3]; }
code_block_7 = CodeBlock { 3; }
dropItems = List.DropItems(list=groupByKey.groups@L3, amount=code_block_7)
flatten = Flatten(dropItems)
code_block_8 = CodeBlock(название=code_block_6.out0, номер1=code_block_6.out1, номер2=code_block_6.out2, площадь=flatten) { название; номер1; номер2; площадь; }
code_block_9 = CodeBlock(item=code_block_8.номер1) { Flatten({item}); }
python_script = Python(IN[0]=code_block_9)  # same code as получаем_положение_точки_текста
deconstructPoint_2 = Geometry.Points.DeconstructPoint(python_script)
sortByKey_2 = List.SortByKey(list=code_block_9, keys=deconstructPoint_2.out1)
reverse = List.Reverse(sortByKey_2.sorted_list)
text = TextNote.Text(reverse)
номера_помещений = String.TrimWhitespace(text)
code_block_10 = CodeBlock { "."; }
split = String.Split(номера_помещений, code_block_10)
flatten_2 = Flatten(split)
uniqueItems_2 = List.UniqueItems(flatten_2)
code_block_11 = CodeBlock(index=uniqueItems_2) { index[1]; }
contains = String.Contains(str=getParameterValueByName_3, searchFor=code_block_11)
filterByBoolMask_2 = List.FilterByBoolMask(list=filterByBoolMask.in, mask=contains)
getParameterValueByName_4 = Element.GetParameterValueByName(element=filterByBoolMask_2.in, parameterName=code_block_5.out0)
code_block_12 = CodeBlock { "."; }
split_2 = String.Split(getParameterValueByName_4, code_block_12)
transpose = List.Transpose(split_2)
code_block_13 = CodeBlock(index=transpose) { index[2]; }
toNumber_2 = String.ToNumber(code_block_13)
sortByKey_3 = List.SortByKey(list=filterByBoolMask_2.in, keys=toNumber_2)
code_block_14 = CodeBlock { "Name"; "***Площадь - РД2"; }
запись_в_параметры = BoolSelector(true)
code_block_15 = CodeBlock(item=code_block_8.название) { Flatten({item}); }
python_script_2 = Python(IN[0]=code_block_15)  # same code as получаем_положение_точки_текста
deconstructPoint_3 = Geometry.Points.DeconstructPoint(python_script_2)
sortByKey_4 = List.SortByKey(list=code_block_15, keys=deconstructPoint_3.out1)
reverse_2 = List.Reverse(sortByKey_4.sorted_list)
text_2 = TextNote.Text(reverse_2)
# note: Смотрим для проверки получаймых данных.
# Последовательность данных должна быть такая же, как в выбраных элементах. Не должно быть смешения данных между списками
названия_помещений = String.TrimWhitespace(text_2)
code_block_16 = CodeBlock(item=code_block_8.площадь) { Flatten({item}); }
python_script_3 = Python(IN[0]=code_block_16)  # same code as получаем_положение_точки_текста
deconstructPoint_4 = Geometry.Points.DeconstructPoint(python_script_3)
sortByKey_5 = List.SortByKey(list=code_block_16, keys=deconstructPoint_4.out1)
reverse_3 = List.Reverse(sortByKey_5.sorted_list)
text_3 = TextNote.Text(reverse_3)
площадь_помещений = String.TrimWhitespace(text_3)
create = List.Create(названия_помещений, площадь_помещений)
code_block_17 = CodeBlock { null; }
if_2 = Python(IN[0]=запись_в_параметры, IN[1]=create, IN[2]=code_block_17)
# ---------- if_2.python (12 lines) ----------
import clr
boolean = IN[0]
true = UnwrapElement(IN[1])
false = UnwrapElement(IN[2])

if boolean:
	out = true
else:
	out = false

#Назначьте вывод переменной OUT.
OUT = out
# ----------------------------------------
# note: Записываем данные в ревит. Для теста лучше запускать замороженными.
code_block_18 = CodeBlock(названия=if_2, площадь=if_2) { названия[0]; площадь[1]; }
toNumber_3 = String.ToNumber(code_block_18.out1)
записываем_площади = Element.SetParameterByName(element=sortByKey_3.sorted_list, parameterName=code_block_14.out1, value=toNumber_3)
записываем_названия = Element.SetParameterByName(element=sortByKey_3.sorted_list, parameterName=code_block_14.out0, value=code_block_18.out0)  # frozen
code_block_19 = CodeBlock { a; }  # unwired: a
maxPoint = BoundingBox.MaxPoint(получаем_boundingbox_вокруг)
uniqueItems_3 = List.UniqueItems(removeAfterGivenCharacter)
byStartPointEndPoint = Line.ByStartPointEndPoint()  # frozen; unwired: startPoint, endPoint
getParameterValueByName_5 = Element.GetParameterValueByName(element=sortByKey_3.sorted_list, parameterName=code_block_5.out0)
boolean = BoolSelector(true)  # frozen
code_block_20 = CodeBlock { 1; 2; }
if_3 = Python(IN[0]=boolean, IN[1]=code_block_20.out0, IN[2]=code_block_20.out1)  # same code as if_2
parameters_2 = Element.Parameters()  # unwired: arg0
geometry = Element.Geometry()  # unwired: arg0
getParameterValueByName_6 = Element.GetParameterValueByName()  # unwired: element, parameterName

# group: Parameters name from language
parameters_name_from_language = Python()  # frozen
# ---------- parameters_name_from_language.python (18 lines) ----------
import clr
clr.AddReference('RevitServices')
import RevitServices
from RevitServices.Persistence import DocumentManager

uiapp = DocumentManager.Instance.CurrentUIApplication
app = uiapp.Application
lng = app.Language
rus = ["Тип","Имя семейства","Имя типа"]
enu = ["Type","Family name","Type name"]
out = []
if str(lng) == "Russian":
	out = rus
else:
	out = enu
#English_USA
#Russian
OUT = out
# ----------------------------------------

setParameterByName = Element.SetParameterByName()  # unwired: element, parameterName, value

# group: элементы внутри групп
members = Python()  # "Group.Members"; frozen; unwired: IN[0]
# ---------- members.python (19 lines) ----------
import clr
clr.AddReference('RevitAPI')
from Autodesk.Revit.DB import *

clr.AddReference("RevitNodes")
import Revit
clr.ImportExtensions(Revit.Elements)

groups = UnwrapElement(IN[0])
elementlist = list()
for item in groups:
	try:
		memberlist = list()
		for member in item.GetMemberIds():
			memberlist.append(item.Document.GetElement(member))
		elementlist.append(memberlist)
	except:
		elementlist.append(list())
OUT = elementlist
# ----------------------------------------

byName = Family.ByName()  # unwired: arg0
code_block_21 = CodeBlock(item=code_block_8.номер2) { Flatten({item}); }
python_script_4 = Python(IN[0]=code_block_21)  # same code as получаем_положение_точки_текста
deconstructPoint_5 = Geometry.Points.DeconstructPoint(python_script_4)
sortByKey_6 = List.SortByKey(list=code_block_21, keys=deconstructPoint_5.out1)
reverse_4 = List.Reverse(sortByKey_6.sorted_list)
text_4 = TextNote.Text(reverse_4)
номера_помещений_2 = String.TrimWhitespace(text_4)
code_block_22 = CodeBlock(n1=номера_помещений, n2=номера_помещений_2) { n1+n2; }
code_block_23 = CodeBlock(номера=code_block_22) { номера; }
номера_помещений_из_текста = Watch(code_block_23)
code_block_24 = CodeBlock { "Номер секции"; "Number"; "Name"; "Номер функции"; }
# note: Номера помещений в списках должны совпадать
getParameterValueByName_7 = Element.GetParameterValueByName(element=sortByKey_3.sorted_list, parameterName=code_block_24.out1)
номера_помещений_из_модели = Watch(getParameterValueByName_7)
flatten_3 = Flatten(code_block_4)
# note: Количество цифр должно соответствовать количеству подоваемых столбцов данных
toNumber_4 = String.ToNumber(flatten_3)
count = List.Count(groupByKey.groups@L3)
