# Dynamo graph 1.Сортиривка имени помещения по координатам.dyn (Dynamo 1.2.1.3083)

# group: Get Revit Selection:
pys_get_revit_selection = Python()  # unwired: IN[0]
# ---------- pys_get_revit_selection.python (22 lines) ----------
import clr
clr.AddReference('RevitServices')
clr.AddReference('RevitAPI')
from Autodesk.Revit.DB import *
import RevitServices
from RevitServices.Persistence import DocumentManager
from Autodesk.Revit.ApplicationServices import Application

reset = IN[0]

doc = DocumentManager.Instance.CurrentDBDocument
uidoc = DocumentManager.Instance.CurrentUIApplication.ActiveUIDocument
ids = uidoc.Selection.GetElementIds()

idd = [str(i) for i in ids]

if isinstance(idd, list) == True:
	elems = [doc.GetElement(ElementId(int(i))) for i in idd]
else:
	elems = doc.GetElement(ElementId(int(idd)))

OUT = elems
# ----------------------------------------
forceChildrensEval = ForceChildrensEval()  # unwired: arg0

parameters = Element.Parameters(pys_get_revit_selection)
levels = Levels("Этаж 1")
code_block = CodeBlock { text_for_room; }  # frozen; unwired: text_for_room
text = TextNote.Text(code_block)
trimWhitespace = String.TrimWhitespace(text)
length = String.Length(trimWhitespace)
code_block_2 = CodeBlock { 6; }
eq = length == code_block_2
filterByBoolMask = List.FilterByBoolMask(list=code_block, mask=eq)
code_block_3 = CodeBlock(item=filterByBoolMask.in) { Flatten({item}); }
python_script = Python(IN[0]=code_block_3)
# ---------- python_script.python (24 lines) ----------
import clr
import math
clr.AddReference('RevitAPI')
from Autodesk.Revit.DB import *

clr.AddReference("RevitNodes")
import Revit
clr.ImportExtensions(Revit.GeometryConversion)

items = UnwrapElement(IN[0])
pointlist = list()


for item in items:
	try:
		# points and text notes
		pointlist.append(item.Coord.ToPoint())
	except:
		loc = item.Location
		if loc.ToString() == 'Autodesk.Revit.DB.LocationPoint':
			# point-based elements
			pointlist.append(loc.Point.ToPoint())

OUT = pointlist
# ----------------------------------------
code_block_4 = CodeBlock(марка=filterByBoolMask.in, номер=filterByBoolMask.out, координаты=python_script) { марка; номер; координаты; }
text_2 = TextNote.Text(code_block_4.марка)
trimWhitespace_2 = String.TrimWhitespace(text_2)
code_block_5 = CodeBlock { "_"; }
text_3 = TextNote.Text(code_block_4.номер)
trimWhitespace_3 = String.TrimWhitespace(text_3)
code_block_6 = CodeBlock(x=trimWhitespace_2, z=code_block_5, y=trimWhitespace_3) { x+z+y; }
count = Count(code_block_6)
code_block_7 = CodeBlock(x=count) { 1..x; }
string_from_object = FromObject(code_block_7)
byLocation = Room.ByLocation(levels, code_block_4.координаты, code_block_6, string_from_object)
code_block_8 = CodeBlock(text_for_name=pys_get_revit_selection) { text_for_name; }
python_script_2 = Python(IN[0]=code_block_8)  # same code as python_script
deconstructPoint = Geometry.Points.DeconstructPoint(python_script_2)
code_block_9 = CodeBlock(x=deconstructPoint) { x/1000; }
round = Math.Round(code_block_9)
groupByKey = List.GroupByKey(list=code_block_8, keys=round)
code_block_10 = CodeBlock(list=groupByKey.groups) { list[2]; list[1]; list[0]; }
code_block_11 = CodeBlock(название=code_block_10.out0, номер=code_block_10.out1, секция=code_block_10.out2) { название; номер; секция; }
text_4 = TextNote.Text(code_block_11.название)
trimWhitespace_4 = String.TrimWhitespace(text_4)
uniqueItems = List.UniqueItems(round)
count_2 = Count()  # unwired: arg0
code_block_12 = CodeBlock(x=count_2) { 0..x-1; }
text_5 = TextNote.Text(code_block_11.секция)
trimWhitespace_5 = String.TrimWhitespace(text_5)
code_block_13 = CodeBlock(item=code_block_11.номер) { Flatten({item}); }
python_script_3 = Python(IN[0]=code_block_13)  # same code as python_script
deconstructPoint_2 = Geometry.Points.DeconstructPoint(python_script_3)
sortByKey = List.SortByKey(list=code_block_11.номер, keys=deconstructPoint_2.out1)
reverse = List.Reverse(sortByKey.sorted_list)
text_6 = TextNote.Text(reverse)
trimWhitespace_6 = String.TrimWhitespace(text_6)
count_3 = Count(trimWhitespace_6)
cycle = List.Cycle(list=trimWhitespace_5, amount=count_3)
code_block_14 = CodeBlock { "_"; }
code_block_15 = CodeBlock(item=code_block_11.название) { Flatten({item}); }
python_script_4 = Python(IN[0]=code_block_15)  # same code as python_script
deconstructPoint_3 = Geometry.Points.DeconstructPoint(python_script_4)
sortByKey_2 = List.SortByKey(list=code_block_11.название, keys=deconstructPoint_3.out1)
reverse_2 = List.Reverse(sortByKey_2.sorted_list)
text_7 = TextNote.Text(reverse_2)
trimWhitespace_7 = String.TrimWhitespace(text_7)
code_block_16 = CodeBlock(a=cycle, z=code_block_14, x=trimWhitespace_6, y=trimWhitespace_7) { a+z+x+z+y; }
select_model_elements = DSModelElementsSelection()  # 40 picked in the model
code_block_17 = CodeBlock(watch=select_model_elements) { watch; }
file_path = Filename("E:\Dyno\name.xlsx")
code_block_18 = CodeBlock { 1; 0; }
string_from_object_2 = FromObject(code_block_18.out0)
create = List.Create(cycle, trimWhitespace_6, trimWhitespace_7)
transpose = List.Transpose(create)
boolean = BoolSelector(true)
writeToFile = Excel.WriteToFile(filePath=file_path, sheetName=string_from_object_2, startRow=code_block_18.out1, startCol=code_block_18.out1, data=transpose, overWrite=boolean)
boolean_2 = BoolSelector(true)
