# Dynamo graph MinMax плошадь групп помещений.dyn (Dynamo 1.3.3.4111)

# group: КЛЮЧЕВЫЕ МОМЕНТЫ РАБОТЫ 1
# note: КОНСОЛИДАЦИЯ И СЛОЖНЫЕ ОБРАБОТКИ

# group: ИСПОЛНИТЕЛЬНЫЕ НОДЫ (фильтрование, подбор, списки и т.д.)
# note: ИСПОЛНИТЕЛЬНЫЕ НОДЫ

# group: ЗАПАСНЫЕ ВАРИАНТЫ, ДОПОЛНИТЕЛЬНЫЕ ОПЦИИ
# note: ЗАПАСНЫЕ
# note: ДОПОЛНИТЕЛЬНЫЕ. Градации серово по важности, темнее - важнее

# group: КЛЮЧЕВЫЕ МОМЕНТЫ РАБОТЫ 2
# note: УСЛОЖНЕННЫЕ КОНСТРУКЦИИ
# note: УСЛОЖНЕНЫЕ КОНСТРУКЦИИ

# group: Python ноды
# note: Python

# group: ЭЛЕМЕНТЫ УПРАВЛЕНИЯ 2 УРОВЕНЬ
# note: ЭЛЕМЕНТЫ УПРАВЛЕНИЯ
# note: ПЕРЕМЕННЫЕ ЗНАЧЕНИЯ

# group: Запуск питона из внешнего файла
# note: Py - files

# group: ЭЛЕМЕНТЫ УПРАВЛЕНИЯ
# note: ПЕРЕМЕННЫЕ ЗНАЧЕНИЯ
# note: ЭЛЕМЕНТЫ УПРАВЛЕНИЯ

# group: ПОЛУЧАЕМ ДАННЫЕ
# note: ПОЛУЧАЕМ ДАННЫЕ ИЗ РЕВИТ и других источников

# group: ПРОВЕРОЧНЫЕ НОДЫ
# note: ПРОВЕРОЧНЫЕ НОДЫ

# group: ПЕРЕДАЁМ ИНФОРМАЦИЮ
# note: ПЕРЕДАЁМ ИНФОРМАЦИЮ В РЕВИТ
# note: ПЕРЕДАЁМ ИНФОРМАЦИЮ ЕЩЁ КУДА-ТО

# group: ПРИМЕЧАНИЯ ПО ЦВЕТОВОЙ ГРУППИРОВКЕ
# note: GUIDELINES

запуск = BoolSelector(false)
нужен_ли_параметр_для_фильтрации = BoolSelector(true)
categories = Categories("Rooms")
all_elements_of_category = ElementsOfCategory(categories)
название_параметра_для_фильтра = StringInput("Назначение")
getParameterValueByName = Element.GetParameterValueByName(element=all_elements_of_category, parameterName=название_параметра_для_фильтра)
значение_параметра_для_фильтра = StringInput("Кухня")
equals = Equals(getParameterValueByName, значение_параметра_для_фильтра)
filterByBoolMask = List.FilterByBoolMask(list=all_elements_of_category, mask=equals)
watch = Watch(filterByBoolMask.in)
if_ = Python(IN[0]=нужен_ли_параметр_для_фильтрации, IN[1]=watch, IN[2]=all_elements_of_category)
# ---------- if_.python (12 lines) ----------
import clr
boolean = IN[0]
true = UnwrapElement(IN[1])
false = UnwrapElement(IN[2])

if boolean:
	out = true
else:
	out = false

#Назначьте вывод переменной OUT.
OUT = out
# ----------------------------------------
code_block = CodeBlock { "Площадь"; 0; "null"; "false"; }
getParameterValueByName_2 = Element.GetParameterValueByName(element=if_, parameterName=code_block.out0)
gt = getParameterValueByName_2 > code_block.out1
isNull = Object.IsNull(gt)
filterByBoolMask_2 = List.FilterByBoolMask(list=if_, mask=isNull)
параметр_номера_помещения = StringInput("BS_Тип квартиры")

# group: Сортировка по возврастанрию 1,2,3..100
flatten = Flatten(filterByBoolMask_2.out)
getParameterValueByName_3 = Element.GetParameterValueByName(element=flatten, parameterName=параметр_номера_помещения)

groupByKey = List.GroupByKey(list=getParameterValueByName_3, keys=getParameterValueByName_3)
watch_2 = Watch(groupByKey.groups)
uniqueItems = List.UniqueItems(watch_2@L2)
flatten_2 = Flatten(uniqueItems)
делим_на_два_списка___количество = DoubleInput(5)  # "__Делим на два списка__ Количество элементов в первом списке:"
code_block_2 = CodeBlock(x=делим_на_два_списка___количество) { 0..x; x+1; }
sublists = List.Sublists(list=flatten_2, ranges=code_block_2.out0, offset=code_block_2.out1)
lastItem = List.LastItem(sublists@L2)
count = Count(sublists@L2)
count_2 = Count(watch_2@L2)
create = List.Create(lastItem, count, count_2, flatten)
end = Revit.Transaction.Transaction.End(create)  # frozen
start = Revit.Transaction.Transaction.Start(end)
code_block_3 = CodeBlock { 0; 1; 2; 3; }
getItemAtIndex = List.GetItemAtIndex(list=start, index=code_block_3.out3)
code_block_4 = CodeBlock { null; }
if_2 = Python(IN[0]=запуск, IN[1]=getItemAtIndex, IN[2]=code_block_4)  # same code as if_
параметр_номера_помещения_2 = StringInput("АБН_мин-макс")
getItemAtIndex_2 = List.GetItemAtIndex(list=start, index=code_block_3.out0)
code_block_5 = CodeBlock(x=getItemAtIndex_2) { String.ToNumber(x)+1; }
getItemAtIndex_3 = List.GetItemAtIndex(list=start, index=code_block_3.out1)
code_block_6 = CodeBlock(x=code_block_5, y=getItemAtIndex_3) { x..(x+y-1); }
getItemAtIndex_4 = List.GetItemAtIndex(list=start, index=code_block_3.out2)
ofRepeatedItem = List.OfRepeatedItem(item=code_block_6@L1, amount=getItemAtIndex_4@L1)
flatten_3 = Flatten(ofRepeatedItem)
string_from_object = FromObject(flatten_3)
setParameterByName = Element.SetParameterByName(element=if_2, parameterName=параметр_номера_помещения_2, value=string_from_object)
forceChildrensEval = ForceChildrensEval()  # unwired: arg0

# group: Get Revit Selection:
pys_get_revit_selection = Python(IN[0]=forceChildrensEval)
# ---------- pys_get_revit_selection.python (22 lines) ----------
import clr
clr.AddReference('RevitServices')
clr.AddReference('RevitAPI')
from Autodesk.Revit.DB import *
import RevitServices
from RevitServices.Persistence import DocumentManager
from Autodesk.Revit.ApplicationServices import Application

reset = IN[0]

doc = DocumentManager.Instance.CurrentDBDocument
uidoc = DocumentManager.Instance.CurrentUIApplication.ActiveUIDocument
ids = uidoc.Selection.GetElementIds()

idd = [str(i) for i in ids]

if isinstance(idd, list) == True:
	elems = [doc.GetElement(ElementId(int(i))) for i in idd]
else:
	elems = doc.GetElement(ElementId(int(idd)))

OUT = elems
# ----------------------------------------

выбрать_помещения_можно_с = DSModelElementsSelection()  # "Выбрать помещения (можно с захватом других элементов)"
code_block_7 = CodeBlock { "Категория"; "Помещения"; }
getParameterValueByName_4 = Element.GetParameterValueByName(element=выбрать_помещения_можно_с, parameterName=code_block_7.out0)
string_from_object_2 = FromObject(getParameterValueByName_4)
equals_2 = Equals(string_from_object_2, code_block_7.out1)
filterByBoolMask_3 = List.FilterByBoolMask(list=выбрать_помещения_можно_с, mask=equals_2)
code_block_8 = CodeBlock { 0..38; 39; }
setParameterByName_2 = Element.SetParameterByName()  # unwired: element, parameterName, value
parameters = Element.Parameters()  # unwired: arg0
geometry = Element.Geometry()  # unwired: arg0
# note: ВСЁ ОСТАЛЬНОЕ
getParameterValueByName_5 = Element.GetParameterValueByName()  # unwired: element, parameterName

# group: Get Revit Selection:
forceChildrensEval_2 = ForceChildrensEval()  # frozen; unwired: arg0
pys_get_revit_selection_2 = Python(IN[0]=forceChildrensEval_2)  # same code as pys_get_revit_selection

boolean = BoolSelector(true)  # frozen
code_block_9 = CodeBlock { 1; 2; }
if_3 = Python(IN[0]=boolean, IN[1]=code_block_9.out0, IN[2]=code_block_9.out1)  # same code as if_

# group: Parameters name from language
parameters_name_from_language = Python()  # frozen
# ---------- parameters_name_from_language.python (18 lines) ----------
import clr
clr.AddReference('RevitServices')
import RevitServices
from RevitServices.Persistence import DocumentManager

uiapp = DocumentManager.Instance.CurrentUIApplication
app = uiapp.Application
lng = app.Language
rus = ["Тип","Имя семейства","Имя типа"]
enu = ["Type","Family name","Type name"]
out = []
if str(lng) == "Russian":
	out = rus
else:
	out = enu
#English_USA
#Russian
OUT = out
# ----------------------------------------

# group: элементы внутри групп
members = Python()  # "Group.Members"; frozen; unwired: IN[0]
# ---------- members.python (19 lines) ----------
import clr
clr.AddReference('RevitAPI')
from Autodesk.Revit.DB import *

clr.AddReference("RevitNodes")
import Revit
clr.ImportExtensions(Revit.Elements)

groups = UnwrapElement(IN[0])
elementlist = list()
for item in groups:
	try:
		memberlist = list()
		for member in item.GetMemberIds():
			memberlist.append(item.Document.GetElement(member))
		elementlist.append(memberlist)
	except:
		elementlist.append(list())
OUT = elementlist
# ----------------------------------------

путь_к_файлу_python = Filename(".\N.Отделка помещений_сбор элементов вокруг_1.7.py")  # frozen
forceChildrensEval_3 = ForceChildrensEval()  # unwired: arg0
find_file_and_import_it = Python(IN[0]=путь_к_файлу_python, IN[1]=forceChildrensEval_3)
# ---------- find_file_and_import_it.python (11 lines) ----------
import sys
sys.path.append('C:\Program Files (x86)\IronPython 2.7\Lib')
import codecs

try:
	filePath = IN[0]
	with codecs.open(filePath, 'rb', "utf-8") as inf:
		lines = inf.readlines()
	OUT = ''.join(lines)
except:
	OUT = "No file"
# ----------------------------------------
python_script_from_string = PythonStringNode(script=find_file_and_import_it)  # unwired: IN[0]
categories_2 = Categories()  # frozen
all_elements_of_category_2 = ElementsOfCategory(categories_2)
regenerate = Python()  # frozen; unwired: IN[0]
# ---------- regenerate.python (26 lines) ----------
import clr

# Import DocumentManager and TransactionManager
clr.AddReference("RevitServices")
import RevitServices
from RevitServices.Persistence import DocumentManager


# Import RevitAPI
clr.AddReference("RevitAPI")
import Autodesk
from Autodesk.Revit.DB import *

doc = DocumentManager.Instance.CurrentDBDocument


#The inputs to this node will be stored as a list in the IN variable.
list = IN[0]


if list:
	doc.Regenerate()
	out = "Regeneration complete"
else:
	out = "fail"
OUT = out
# ----------------------------------------
members_2 = Python()  # "Object.Members"; frozen; unwired: IN[0]
# ---------- members_2.python (14 lines) ----------
import clr

items = IN[0]
elementlist = list()

try:
	clr.AddReference('RevitAPI')
	from Autodesk.Revit.DB import *
	for item in items:
		elementlist.append(dir(UnwrapElement(item)))
except:
	for item in items:
		elementlist.append(dir(item))
OUT = elementlist
# ----------------------------------------
filteredElementCollector = Python()  # frozen; unwired: IN[0]
# ---------- filteredElementCollector.python (29 lines) ----------
if IN[1]:
	import clr
	
	# Import DocumentManager and TransactionManager
	clr.AddReference("RevitServices")
	import RevitServices
	from RevitServices.Persistence import DocumentManager
	
	
	# Import RevitAPI
	clr.AddReference("RevitAPI")
	import Autodesk
	from Autodesk.Revit.DB import *
	
	doc = DocumentManager.Instance.CurrentDBDocument
	uiapp = DocumentManager.Instance.CurrentUIApplication
	app = uiapp.Application
	
	from System.Collections.Generic import *
	
	
	#The inputs to this node will be stored as a list in the IN variable.
	dataEnteringNode = IN
	collector = FilteredElementCollector(doc)
	elements = collector.OfCategory(BuiltInCategory.OST_Views).ToElements()
	
	OUT = sheetInstances
else:
	OUT = "скрипт не выполнен"
# ----------------------------------------
shablon_python_shablon = Python()  # frozen; unwired: IN[0]
# ---------- shablon_python_shablon.python (76 lines) ----------
# -*- coding: utf-8 -*- 
#-----------------------Импоорт библиотек----------------------
import clr
clr.AddReference('RevitAPI')
import Autodesk
from Autodesk.Revit.DB import *

clr.AddReference("RevitNodes") 
import Revit
from Revit.Elements import *

clr.ImportExtensions(Revit.Elements) #ToDSType не работает без
clr.ImportExtensions(Revit.GeometryConversion) #ToXyz не работает без

clr.AddReference("RevitServices")
import RevitServices
from RevitServices.Persistence import DocumentManager
from RevitServices.Transactions import TransactionManager

clr.AddReference('ProtoGeometry')
from Autodesk.DesignScript.Geometry import *

#-----------------------ИМПОРТ БИБЛИОТЕК----------------------
"""-"""
#-----------------------ФУНКЦИИ----------------------

def __x__(x):
	x="x"
	return x
	
#-----------------------ФУНКЦИИ----------------------
"""-"""
#-----------------------АПИ ПАРАМЕТРЫ----------------------

doc = DocumentManager.Instance.CurrentDBDocument
#link_doc = UnwrapElement(IN[1])
#uiapp = DocumentManager.Instance.CurrentUIApplication
#app = uiapp.Application
#version = app.VersionNumber
#options = Autodesk.Revit.DB.SpatialElementBoundaryOptions()
calculator = SpatialElementGeometryCalculator(doc)

g_id_list = []
g_id_list.append(ElementId(group))

bxList = List[ElementId](g_id_list) #АЙ ЛИСТ КОЛЕКТИОН
move = Transform.CreateTranslation(-wall.Orientation*2) #смещение
cl.CreateTransformed(move)

#-----------------------АПИ ПАРАМЕТРЫ----------------------
"""-"""
#-----------------------РАБОЧИЕ ПАРАМЕТРЫ----------------------

rooms = UnwrapElement(IN[0])

#-----------------------РАБОЧИЕ ПАРАМЕТРЫ----------------------	
"""-"""
#-----------------------ТЕСТОВЫЕ ПАРАМЕТРЫ----------------------

test = []

#-----------------------ТЕСТОВЫЕ ПАРАМЕТРЫ----------------------
"""-"""
#-----------------------НАЧАЛО СКРИПТА----------------------

x = 0
if rooms == None:
	rooms = [0,0]

for room in rooms:
	x=__x__(x)+__x__(x)
#TransactionManager.Instance.EnsureInTransaction(doc)
#TransactionManager.Instance.TransactionTaskDone()
#-----------------------КОНЕЦ СКРИПТА----------------------

OUT = x
# ----------------------------------------
