# Dynamo graph N.Отделка помещений_1,971_(без углов и скруглений).dyn (Dynamo 1.3.3.4111)

# note: ВСЁ ОСТАЛЬНОЕ

# group: ПОЛУЧАЕМ ДАННЫЕ
# note: ПОЛУЧАЕМ ДАННЫЕ ИЗ РЕВИТ и других источников

# group: ЭЛЕМЕНТЫ УПРАВЛЕНИЯ
# note: ЭЛЕМЕНТЫ УПРАВЛЕНИЯ
# note: ПЕРЕМЕННЫЕ ЗНАЧЕНИЯ

# group: ПРОВЕРОЧНЫЕ НОДЫ
# note: ПРОВЕРОЧНЫЕ НОДЫ

# group: ЭЛЕМЕНТЫ УПРАВЛЕНИЯ 2 УРОВЕНЬ
# note: ЭЛЕМЕНТЫ УПРАВЛЕНИЯ
# note: ПЕРЕМЕННЫЕ ЗНАЧЕНИЯ

# group: Python
# note: Dyno Studio
# note: Python node

# group: КЛЮЧЕВЫЕ МОМЕНТЫ РАБОТЫ 1
# note: КОНСОЛИДАЦИЯ И СЛОЖНЫЕ ОБРАБОТКИ

# group: ИСПОЛНИТЕЛЬНЫЕ НОДЫ (фильтрование, подбор, списки и т.д.)
# note: ИСПОЛНИТЕЛЬНЫЕ НОДЫ

# group: КЛЮЧЕВЫЕ МОМЕНТЫ РАБОТЫ 2
# note: УСЛОЖНЕННЫЕ КОНСТРУКЦИИ
# note: УСЛОЖНЕНЫЕ КОНСТРУКЦИИ

# group: Запуск питона из внешнего файла
# note: Py - files

# group: ПЕРЕДАЁМ ИНФОРМАЦИЮ
# note: ПЕРЕДАЁМ ИНФОРМАЦИЮ В РЕВИТ
# note: ПЕРЕДАЁМ ИНФОРМАЦИЮ ЕЩЁ КУДА-ТО

# group: ПРИМЕЧАНИЯ ПО ЦВЕТОВОЙ ГРУППИРОВКЕ
# note: GUIDELINES

# group: ЗАПАСНЫЕ ВАРИАНТЫ, ДОПОЛНИТЕЛЬНЫЕ ОПЦИИ
# note: ЗАПАСНЫЕ
# note: ДОПОЛНИТЕЛЬНЫЕ. Градации серово по важности, темнее - важнее

фильтры = BoolSelector(true)
categories = Categories("Rooms")
all_elements_of_category = ElementsOfCategory(categories)
string = StringInput("Наименование функции")
getParameterValueByName = Element.GetParameterValueByName(element=all_elements_of_category, parameterName=string)
string_2 = StringInput("МОП")
equals = Equals(getParameterValueByName, string_2)
filterByBoolMask = List.FilterByBoolMask(list=all_elements_of_category, mask=equals)
code_block = CodeBlock(rom=filterByBoolMask.in) { rom; }
string_3 = StringInput("Уровень")
getParameterValueByName_2 = Element.GetParameterValueByName(element=code_block, parameterName=string_3)
string_from_object = FromObject(getParameterValueByName_2)
номер_функции = StringInput("3")
equals_2 = Equals(string_from_object, номер_функции)
filterByBoolMask_2 = List.FilterByBoolMask(list=code_block, mask=equals_2)
if_ = Python(IN[0]=фильтры, IN[1]=filterByBoolMask_2.in, IN[2]=all_elements_of_category)
# ---------- if_.python (12 lines) ----------
import clr
boolean = IN[0]
true = UnwrapElement(IN[1])
false = UnwrapElement(IN[2])

if boolean:
	out = true
else:
	out = false

#Назначьте вывод переменной OUT.
OUT = out
# ----------------------------------------
watch = Watch(if_)
string_4 = StringInput("Площадь")
getParameterValueByName_3 = Element.GetParameterValueByName(element=watch, parameterName=string_4)
string_from_object_2 = FromObject(getParameterValueByName_3)
length = String.Length(string_from_object_2)
code_block_2 = CodeBlock { 0; }
gt = length > code_block_2
filterByBoolMask_3 = List.FilterByBoolMask(list=watch, mask=gt)
code_block_3 = CodeBlock(rom=filterByBoolMask_3.in) { Flatten(rom); }
параметр_отделки_стен = StringInput("Отделка стен2")
join = List.Join()  # unwired: arg0, arg1, arg2
code_block_4 = CodeBlock { "<Разделитель помещений>"; "Стены"; }
n_отделка_помещений_сбор = Python(IN[0]=code_block_3, IN[1]=code_block_4.out0, IN[2]=code_block_4.out1)  # "N.Отделка помещений_сбор элементов вокруг_1.8.py"
# ---------- n_отделка_помещений_сбор.python (67 lines) ----------
# -*- coding: utf-8 -*- 

import clr
clr.AddReference('RevitAPI')
from Autodesk.Revit.DB import * 
import Autodesk

clr.AddReference("RevitNodes")
import Revit
clr.ImportExtensions(Revit.GeometryConversion)

clr.AddReference("RevitServices")
import RevitServices
from RevitServices.Persistence import DocumentManager

doc = DocumentManager.Instance.CurrentDBDocument
uiapp = DocumentManager.Instance.CurrentUIApplication
app = uiapp.Application
version = app.VersionNumber
options = Autodesk.Revit.DB.SpatialElementBoundaryOptions()

incopenings,incshadows,incwalls,incshared = True,True,True,True

items = UnwrapElement(IN[0])
p_roomseparator = IN[1]
p_wall = IN[2]
elementlist = []
curvelist_wall = []
curtain_list=[]
insertslist = []
curvelist_others = []

for item in items:
	blist = []
	clist = []
	colist = []
	for boundarylist in item.GetBoundarySegments(options):
		for boundary in boundarylist:
			b_element1=doc.GetElement(boundary.ElementId)
			if b_element1 == None:
				colist.append(boundary.GetCurve().ToProtoType())
			elif b_element1.Category.Name == p_roomseparator:
				pass
			elif b_element1.Category.Name == p_wall and "Autodesk.Revit.DB.CurtainGrid" in str(b_element1.CurtainGrid):
				curtain_list.append(b_element1)
			elif b_element1.Category.Name == p_wall:
				blist.append(b_element1)
				if version > 2016:
					clist.append(boundary.GetCurve().ToProtoType())
				else:
					clist.append(boundary.Curve.ToProtoType())
			else:
				colist.append(boundary.GetCurve().ToProtoType())
	inserts2 = []
	
	for bl in blist:
		inserts1 = []
		test = bl.FindInserts(incopenings,incshadows,incwalls,incshared)
		for insert in test:
			inserts1.append(doc.GetElement(insert))
		inserts2.append(inserts1)
	insertslist.append(inserts2)
	elementlist.append(blist)
	curvelist_wall.append(clist)
	curvelist_others.append(colist)

OUT = elementlist,curvelist_wall,insertslist,curvelist_others,curtain_list
# ----------------------------------------
code_block_5 = CodeBlock { 1; }
getItemAtIndex = List.GetItemAtIndex(list=n_отделка_помещений_сбор, index=code_block_5)
ZAxis = Vector.ZAxis()
code_block_6 = CodeBlock { "Полная высота"; "Смещение снизу"; }
getParameterValueByName_4 = Element.GetParameterValueByName(element=code_block_3, parameterName=code_block_6.out1)
count = List.Count(getItemAtIndex@L2)
ofRepeatedItem = List.OfRepeatedItem(item=getParameterValueByName_4@L1, amount=count@L1)
translate = Geometry.Translate(geometry=getItemAtIndex, direction=ZAxis, distance=ofRepeatedItem)
getParameterValueByName_5 = Element.GetParameterValueByName(element=code_block_3, parameterName=code_block_6.out0)
ofRepeatedItem_2 = List.OfRepeatedItem(item=getParameterValueByName_5@L1, amount=count@L1)
extrude = Curve.Extrude(curve=translate, direction=ZAxis, distance=ofRepeatedItem_2)

# group: Элементы внутри стен
code_block_7 = CodeBlock { 2; }
getItemAtIndex_2 = List.GetItemAtIndex(list=n_отделка_помещений_сбор, index=code_block_7)
isEmpty = List.IsEmpty(getItemAtIndex_2@@L2)

filterByBoolMask_4 = List.FilterByBoolMask(list=extrude, mask=isEmpty)
code_block_8 = CodeBlock(surface_full=filterByBoolMask_4.in) { surface_full; }
вычитаем_проемы_из_стен = BoolSelector(false)
code_block_9 = CodeBlock(surface_to_cut_list=filterByBoolMask_4.out) { surface_to_cut_list; }
code_block_10 = CodeBlock { null; }
if_2 = Python(IN[0]=вычитаем_проемы_из_стен, IN[1]=code_block_9, IN[2]=code_block_10)  # same code as if_
filterByBoolMask_5 = List.FilterByBoolMask(list=getItemAtIndex_2, mask=isEmpty)
boundingBox = Element.BoundingBox(filterByBoolMask_5.out)
toCuboid = BoundingBox.ToCuboid(boundingBox)
if_3 = Python(IN[0]=вычитаем_проемы_из_стен, IN[1]=toCuboid, IN[2]=code_block_10)  # same code as if_
n_отделка_помещений_surf_cut_py = Python(IN[0]=if_2, IN[1]=if_3)
# ---------- n_отделка_помещений_surf_cut_py.python (23 lines) ----------
import clr
clr.AddReference('ProtoGeometry')
from Autodesk.DesignScript.Geometry import Surface

surfase_list = IN[0]
solid_list = IN[1]
list = []
x=0
y=0
newSurfaceList = []

for surf_sub_list, solid_sub_list in zip(surfase_list, solid_list):
	newSurfRoomList = []
	for surf, solid_sub2_list in zip(surf_sub_list, solid_sub_list):
		newsurf1 = surf
		for solid in solid_sub2_list:
			newsurf2 = Surface.SubtractFrom(newsurf1,solid)
			newsurf1 = newsurf2[0]
		newSurfRoomList.append(newsurf1)
	newSurfaceList.append(newSurfRoomList)
#w = Surface.SubtractFrom(one,two)

OUT = newSurfaceList
# ----------------------------------------

# group: Границы помещения не из стен (торцы стен)
code_block_11 = CodeBlock { 3; }
getItemAtIndex_3 = List.GetItemAtIndex(list=n_отделка_помещений_сбор, index=code_block_11)

# group: Границы помещения не из стен (торцы стен)
isEmpty_2 = List.IsEmpty(getItemAtIndex_3@@L2)
code_block_12 = CodeBlock { "Полная высота"; "Смещение снизу"; }
getParameterValueByName_6 = Element.GetParameterValueByName(element=code_block_3, parameterName=code_block_12.out1)
getParameterValueByName_7 = Element.GetParameterValueByName(element=code_block_3, parameterName=code_block_12.out0)
code_block_13 = CodeBlock(h=getParameterValueByName_7, sn=getParameterValueByName_6) { h-sn; }

filterByBoolMask_6 = List.FilterByBoolMask(list=getItemAtIndex_3, mask=isEmpty_2)

# group (continued): Границы помещения не из стен (торцы стен)
count_2 = List.Count(filterByBoolMask_6.out@L2)
ofRepeatedItem_3 = List.OfRepeatedItem(item=getParameterValueByName_6@L1, amount=count_2@L1)
translate_2 = Geometry.Translate(geometry=filterByBoolMask_6.out, direction=ZAxis, distance=ofRepeatedItem_3)
ofRepeatedItem_4 = List.OfRepeatedItem(item=getParameterValueByName_7@L1, amount=count_2@L1)
extrude_2 = Curve.Extrude(curve=translate_2, direction=ZAxis, distance=ofRepeatedItem_4)

# group: Возвращаем пустые списки для правильной комбинации плоскостей стен по помещениям
empty = List.Empty()
python_script = Python(IN[0]=isEmpty_2, IN[1]=empty, IN[2]=extrude_2)
# ---------- python_script.python (25 lines) ----------
import clr

Null_list = IN[1]
lst_2 = IN[2]
pattern = IN[0]
result = []
x=0

"""
for i, j, p in zip(lst_1, lst_2, pattern):
	if p == False:
		result.append(i)
	else:
		result.append(j)
	x=x+1
"""
for p in pattern:
	if p == True:
		result.append(Null_list)
	else:
		result.append(lst_2[x])
		x=x+1

#Assign your output to the OUT variable
OUT = result
# ----------------------------------------

combine = List.Combine(join, code_block_8, n_отделка_помещений_surf_cut_py, python_script)
area = Surface.Area(combine)
sum = Math.Sum(area@L2)
convert_between_units = DynamoConvert(sum, conversionMetric=Area, conversionFrom=SquareMillimeter, conversionTo=SquareMeter)
setParameterByName = Element.SetParameterByName(element=code_block_3, parameterName=параметр_отделки_стен, value=convert_between_units)
geometry = Element.Geometry()  # unwired: arg0
boolean = BoolSelector(true)  # frozen
code_block_14 = CodeBlock { 1; 2; }
if_4 = Python(IN[0]=boolean, IN[1]=code_block_14.out0, IN[2]=code_block_14.out1)  # same code as if_

# group: Parameters name from language
parameters_name_from_language = Python()  # frozen
# ---------- parameters_name_from_language.python (18 lines) ----------
import clr
clr.AddReference('RevitServices')
import RevitServices
from RevitServices.Persistence import DocumentManager

uiapp = DocumentManager.Instance.CurrentUIApplication
app = uiapp.Application
lng = app.Language
rus = ["Тип","Имя семейства","Имя типа"]
enu = ["Type","Family name","Type name"]
out = []
if str(lng) == "Russian":
	out = rus
else:
	out = enu
#English_USA
#Russian
OUT = out
# ----------------------------------------

# group: элементы внутри групп
members = Python()  # "Group.Members"; frozen; unwired: IN[0]
# ---------- members.python (19 lines) ----------
import clr
clr.AddReference('RevitAPI')
from Autodesk.Revit.DB import *

clr.AddReference("RevitNodes")
import Revit
clr.ImportExtensions(Revit.Elements)

groups = UnwrapElement(IN[0])
elementlist = list()
for item in groups:
	try:
		memberlist = list()
		for member in item.GetMemberIds():
			memberlist.append(item.Document.GetElement(member))
		elementlist.append(memberlist)
	except:
		elementlist.append(list())
OUT = elementlist
# ----------------------------------------

code_block_15 = CodeBlock(h=getParameterValueByName_5, sn=getParameterValueByName_4) { h-sn; }  # frozen
flatten = Flatten(combine)
путь_к_файлу_sat = Filename("..\..\..\..\test\1.txt")
exportToSAT = ExportWithUnits(flatten, путь_к_файлу_sat, exportedUnit=Millimeters)

# group: Обновляем связь (Revit 2018 and higher)
forceChildrensEval = ForceChildrensEval()  # unwired: arg0
end = Revit.Transaction.Transaction.End(exportToSAT)
start = Revit.Transaction.Transaction.Start(end)
python_script_2 = Python(IN[0]=forceChildrensEval, IN[1]=start)
# ---------- python_script_2.python (52 lines) ----------
import clr

clr.AddReference("RevitServices")
import RevitServices
from RevitServices.Persistence import DocumentManager
from RevitServices.Transactions import TransactionManager

# Import RevitAPI
clr.AddReference("RevitAPI")
from Autodesk.Revit.DB import *
import Autodesk

doc = DocumentManager.Instance.CurrentDBDocument
uiapp = DocumentManager.Instance.CurrentUIApplication
app = uiapp.Application
uidoc=DocumentManager.Instance.CurrentUIApplication.ActiveUIDocument
collector = Autodesk.Revit.DB.FilteredElementCollector(doc)
linkInstances = collector.OfClass(ImportInstance).WhereElementIsNotElementType()
view = doc.ActiveView.Id
#opt = Autodesk.Revit.DB.CADLinkOptions(True,view)

reset = IN[0]
file = IN[1]
reloadedlinks = []
reloadednames = []
linkedlist = []
importlist = []
count = 0
testnames = []

for item in linkInstances:
	if item.IsLinked:
		linkedlist.append(item)
	else:
		importlist.append(item)
		
		
for i in linkedlist:
	if i.LookupParameter("Имя").AsString() in file:
		CADLink_Type = doc.GetElement(i.GetTypeId())
		TransactionManager.Instance.EnsureInTransaction(doc)
		try:
			CADLink_Type.Reload()
			count = count+1
		except:
			pass
		TransactionManager.Instance.TransactionTaskDone()
	else:
		pass


OUT= "Обновлено ссылок="+str(count)
# ----------------------------------------

# group: Элементы окруужающие помещение
путь_к_файлу_python = Filename("..\..\Z.Тест\N.Отделка помещений_сбор элементов вокруг_1.9.py")  # frozen
forceChildrensEval_2 = ForceChildrensEval()  # unwired: arg0
find_file_and_import_it = Python(IN[0]=путь_к_файлу_python, IN[1]=forceChildrensEval_2)
# ---------- find_file_and_import_it.python (7 lines) ----------
try:
	filePath = IN[0]
	with open(filePath, 'rb') as inf:
		lines = inf.readlines()
	OUT = ''.join(lines)
except:
	OUT = "No file"
# ----------------------------------------
python_script_from_string = PythonStringNode(script=find_file_and_import_it, IN[0]=code_block_3, IN[1]=code_block_4.out0, IN[2]=code_block_4.out1)

code_block_16 = CodeBlock { 1; 2; }
