# Dynamo graph N.Отделка помещений___SpElGeoCalc___ShapeBuilder___.dyn (Dynamo 1.3.3.4111)

# group: ЭЛЕМЕНТЫ УПРАВЛЕНИЯ
# note: ПЕРЕМЕННЫЕ ЗНАЧЕНИЯ
# note: ЭЛЕМЕНТЫ УПРАВЛЕНИЯ

# group: ПОЛУЧАЕМ ДАННЫЕ
# note: ПОЛУЧАЕМ ДАННЫЕ ИЗ РЕВИТ и других источников

# group: ПРОВЕРОЧНЫЕ НОДЫ
# note: ПРОВЕРОЧНЫЕ НОДЫ

# group: КЛЮЧЕВЫЕ МОМЕНТЫ РАБОТЫ 1
# note: КОНСОЛИДАЦИЯ И СЛОЖНЫЕ ОБРАБОТКИ

# group: ИСПОЛНИТЕЛЬНЫЕ НОДЫ (фильтрование, подбор, списки и т.д.)
# note: ИСПОЛНИТЕЛЬНЫЕ НОДЫ

# group: ПЕРЕДАЁМ ИНФОРМАЦИЮ
# note: ПЕРЕДАЁМ ИНФОРМАЦИЮ В РЕВИТ
# note: ПЕРЕДАЁМ ИНФОРМАЦИЮ ЕЩЁ КУДА-ТО

# group: ЗАПАСНЫЕ ВАРИАНТЫ, ДОПОЛНИТЕЛЬНЫЕ ОПЦИИ
# note: ЗАПАСНЫЕ
# note: ДОПОЛНИТЕЛЬНЫЕ. Градации серово по важности, темнее - важнее

# group: ПРИМЕЧАНИЯ ПО ЦВЕТОВОЙ ГРУППИРОВКЕ
# note: GUIDELINES

# group: КЛЮЧЕВЫЕ МОМЕНТЫ РАБОТЫ 2
# note: УСЛОЖНЕННЫЕ КОНСТРУКЦИИ
# note: УСЛОЖНЕНЫЕ КОНСТРУКЦИИ

# group: Python ноды
# note: Python

# group: ЭЛЕМЕНТЫ УПРАВЛЕНИЯ 2 УРОВЕНЬ
# note: ЭЛЕМЕНТЫ УПРАВЛЕНИЯ
# note: ПЕРЕМЕННЫЕ ЗНАЧЕНИЯ

# group: Запуск питона из внешнего файла
# note: Py - files

string = StringInput("МОП")
номер_функции = StringInput("План подземного паркинга (Для отделки)")
categories = Categories("Rooms")
all_elements_of_category = ElementsOfCategory(categories)
string_2 = StringInput("ROM_Номер")
getParameterValueByName = Element.GetParameterValueByName(element=all_elements_of_category, parameterName=string_2)
code_block = CodeBlock { {"Технические помещения"}; }
equals = Equals(getParameterValueByName, code_block@L1)
transpose = List.Transpose(equals)
allFalse = AllFalse(transpose@L2)
filterByBoolMask = List.FilterByBoolMask(list=all_elements_of_category, mask=allFalse)
code_block_2 = CodeBlock(rom=filterByBoolMask.out) { rom; }
string_3 = StringInput("Уровень")
getParameterValueByName_2 = Element.GetParameterValueByName(element=code_block_2, parameterName=string_3)
string_from_object = FromObject(getParameterValueByName_2)
номер_функции_2 = StringInput("300-B01_План подземного паркинга")
equals_2 = Equals(string_from_object, номер_функции_2)
filterByBoolMask_2 = List.FilterByBoolMask(list=code_block_2, mask=equals_2)
watch = Watch(filterByBoolMask_2.in)
string_4 = StringInput("Площадь")
getParameterValueByName_3 = Element.GetParameterValueByName(element=watch, parameterName=string_4)
string_from_object_2 = FromObject(getParameterValueByName_3)
length = String.Length(string_from_object_2)
code_block_3 = CodeBlock { 0; }
gt = length > code_block_3
filterByBoolMask_3 = List.FilterByBoolMask(list=watch, mask=gt)
flatten = Flatten(filterByBoolMask_3.in)
параметр_отделки_стен = StringInput("АБН_Отделка стен общая")
путь_к_файлу_python = Filename(".\N.Отделка помещений___SpElGeoCalc___Material type.py")
forceChildrensEval = ForceChildrensEval()  # unwired: arg0
get_documents = Python(IN[0]=forceChildrensEval)
# ---------- get_documents.python (50 lines) ----------
#Copyright(c) 2015, Konrad K Sobon
# @arch_laboratory, http://archi-lab.net

# Huge thanks to Andreas Dieckmann for 
# adding link path functionality

import clr
clr.AddReference('ProtoGeometry')
from Autodesk.DesignScript.Geometry import *

# Import DocumentManager and TransactionManager
clr.AddReference("RevitServices")
import RevitServices
from RevitServices.Persistence import DocumentManager
from RevitServices.Transactions import TransactionManager

from System.Collections.Generic import *

# Import RevitAPI
clr.AddReference("RevitAPI")
import Autodesk
from Autodesk.Revit.DB import *
from Autodesk.Revit.DB.Analysis import *

doc = DocumentManager.Instance.CurrentDBDocument
uiapp = DocumentManager.Instance.CurrentUIApplication
app = uiapp.Application

# Import ToDSType(bool) extension method
clr.AddReference("RevitNodes")
import Revit
clr.ImportExtensions(Revit.Elements)

#The inputs to this node will be stored as a list in the IN variable.
dataEnteringNode = IN

collector = Autodesk.Revit.DB.FilteredElementCollector(doc)
linkInstances = collector.OfClass(Autodesk.Revit.DB.RevitLinkInstance)

linkDoc, linkName, linkPath = [], [], []
for i in linkInstances:
	linkDoc.append(i.GetLinkDocument())
	linkName.append(i.Name)
	try:
		linkPath.append(i.GetLinkDocument().PathName)
	except:
		linkPath.append(None)
		pass

OUT = linkDoc, linkName, linkInstances, linkPath
# ----------------------------------------
выбрать_индекс_связанного_файла = CodeBlock(l=get_documents) { l[0][1]; }
а_высота_по_стенам_помещениям_б = BoolSelector(false)  # "А) Высота по стенам/помещениям Б) Высота задана"
code_block_4 = CodeBlock { 3350.0; }
смещение_по_z = BoolSelector(false)
code_block_5 = CodeBlock { -1000; }

# group: Элементы окруужающие помещение
forceChildrensEval_2 = ForceChildrensEval(путь_к_файлу_python)
find_file_and_import_it = Python(IN[0]=forceChildrensEval_2)
# ---------- find_file_and_import_it.python (11 lines) ----------
import sys
sys.path.append('C:\Program Files (x86)\IronPython 2.7\Lib')
import codecs

try:
	filePath = IN[0]
	with codecs.open(filePath, 'rb', "utf-8") as inf:
		lines = inf.readlines()
	OUT = ''.join(lines)
except:
	OUT = "No file"
# ----------------------------------------
python_script_from_string = PythonStringNode(script=find_file_and_import_it, IN[0]=flatten, IN[1]=выбрать_индекс_связанного_файла, IN[2]=а_высота_по_стенам_помещениям_б, IN[3]=code_block_4, IN[4]=смещение_по_z, IN[5]=code_block_5)
code_block_6 = CodeBlock(surface=python_script_from_string, mat_type_name=python_script_from_string, level=python_script_from_string) { surface[0]; mat_type_name[1]; level[2]; }
путь_к_файлу_python_2 = Filename(".\N.Отделка помещений__SpatialElementGeometryCalculator.py")

area = Surface.Area(code_block_6.out0)
sum = Math.Sum(area@L2)
convert_between_units = DynamoConvert(sum, conversionMetric=Area, conversionFrom=SquareMillimeter, conversionTo=SquareMeter)
setParameterByName = Element.SetParameterByName(element=flatten, parameterName=параметр_отделки_стен, value=convert_between_units)
boolean = BoolSelector(true)  # frozen
code_block_7 = CodeBlock { 1; 2; }
if_ = Python(IN[0]=boolean, IN[1]=code_block_7.out0, IN[2]=code_block_7.out1)
# ---------- if_.python (12 lines) ----------
import clr
boolean = IN[0]
true = UnwrapElement(IN[1])
false = UnwrapElement(IN[2])

if boolean:
	out = true
else:
	out = false

#Назначьте вывод переменной OUT.
OUT = out
# ----------------------------------------
parameters = Element.Parameters()  # unwired: arg0
geometry = Element.Geometry()  # unwired: arg0
setParameterByName_2 = Element.SetParameterByName()  # unwired: element, parameterName, value
# note: ВСЁ ОСТАЛЬНОЕ
getParameterValueByName_4 = Element.GetParameterValueByName()  # unwired: element, parameterName

# group: Parameters name from language
parameters_name_from_language = Python()  # frozen
# ---------- parameters_name_from_language.python (18 lines) ----------
import clr
clr.AddReference('RevitServices')
import RevitServices
from RevitServices.Persistence import DocumentManager

uiapp = DocumentManager.Instance.CurrentUIApplication
app = uiapp.Application
lng = app.Language
rus = ["Тип","Имя семейства","Имя типа"]
enu = ["Type","Family name","Type name"]
out = []
if str(lng) == "Russian":
	out = rus
else:
	out = enu
#English_USA
#Russian
OUT = out
# ----------------------------------------

# group: элементы внутри групп
members = Python()  # "Group.Members"; frozen; unwired: IN[0]
# ---------- members.python (19 lines) ----------
import clr
clr.AddReference('RevitAPI')
from Autodesk.Revit.DB import *

clr.AddReference("RevitNodes")
import Revit
clr.ImportExtensions(Revit.Elements)

groups = UnwrapElement(IN[0])
elementlist = list()
for item in groups:
	try:
		memberlist = list()
		for member in item.GetMemberIds():
			memberlist.append(item.Document.GetElement(member))
		elementlist.append(memberlist)
	except:
		elementlist.append(list())
OUT = elementlist
# ----------------------------------------

путь_к_файлу_python_3 = Filename(".\N.Отделка помещений_сбор элементов вокруг_1.7.py")  # frozen
forceChildrensEval_3 = ForceChildrensEval()  # unwired: arg0
не_читает_кирилицу = Python(IN[0]=путь_к_файлу_python_3, IN[1]=forceChildrensEval_3)
# ---------- не_читает_кирилицу.python (9 lines) ----------
try:
	filePath = IN[0]

	with open(filePath, 'rb') as inf:
	    lines = inf.readlines()

	OUT = ''.join(lines)
except Exception, e:
	OUT = "No file"
# ----------------------------------------
python_script_from_string_2 = PythonStringNode(script=не_читает_кирилицу)  # unwired: IN[0]
categories_2 = Categories()  # frozen
all_elements_of_category_2 = ElementsOfCategory(categories_2)
regenerate = Python()  # frozen; unwired: IN[0]
# ---------- regenerate.python (26 lines) ----------
import clr

# Import DocumentManager and TransactionManager
clr.AddReference("RevitServices")
import RevitServices
from RevitServices.Persistence import DocumentManager


# Import RevitAPI
clr.AddReference("RevitAPI")
import Autodesk
from Autodesk.Revit.DB import *

doc = DocumentManager.Instance.CurrentDBDocument


#The inputs to this node will be stored as a list in the IN variable.
list = IN[0]


if list:
	doc.Regenerate()
	out = "Regeneration complete"
else:
	out = "fail"
OUT = out
# ----------------------------------------
shablon_python_shablon = Python()  # frozen; unwired: IN[0]
# ---------- shablon_python_shablon.python (81 lines) ----------
# -*- coding: utf-8 -*- 
#-----------------------Импоорт библиотек----------------------
import sys
sys.path.append('C:\Program Files (x86)\IronPython 2.7\Lib')

import clr
clr.AddReference('RevitAPI')
import Autodesk
from Autodesk.Revit.DB import *

clr.AddReference("RevitNodes") 
import Revit
from Revit.Elements import *

clr.ImportExtensions(Revit.Elements) #ToDSType не работает без
clr.ImportExtensions(Revit.GeometryConversion)

clr.AddReference("RevitServices")
import RevitServices
from RevitServices.Persistence import DocumentManager
from RevitServices.Transactions import TransactionManager

clr.AddReference('ProtoGeometry')
from Autodesk.DesignScript.Geometry import *

clr.AddReference('System')
from System.Collections.Generic import List

#-----------------------ИМПОРТ БИБЛИОТЕК----------------------
"""-"""
#-----------------------ФУНКЦИИ----------------------

def __x__(x):
	x="x"
	return x
	
#-----------------------ФУНКЦИИ----------------------
"""-"""
#-----------------------АПИ ПАРАМЕТРЫ----------------------

doc = DocumentManager.Instance.CurrentDBDocument
#link_doc = UnwrapElement(IN[1])
#uiapp = DocumentManager.Instance.CurrentUIApplication
#app = uiapp.Application
#version = app.VersionNumber
#options = Autodesk.Revit.DB.SpatialElementBoundaryOptions()
#options.StoreFreeBoundaryFaces = True --------- ЗАПИСЬ В PROPERTIS !!!!!!!!!!!!!!!
#options.SpatialElementBoundaryLocation = SpatialElementBoundaryLocation.Center --------- ЗАПИСЬ В Enumeration !!!!!!!!!!!!!!!
calculator = SpatialElementGeometryCalculator(doc)

g_id_list = []

bxList = List[ElementId](g_id_list)

#-----------------------АПИ ПАРАМЕТРЫ----------------------
"""-"""
#-----------------------РАБОЧИЕ ПАРАМЕТРЫ----------------------

rooms = UnwrapElement(IN[0])

#-----------------------РАБОЧИЕ ПАРАМЕТРЫ----------------------	
"""-"""
#-----------------------ТЕСТОВЫЕ ПАРАМЕТРЫ----------------------

test = []

#-----------------------ТЕСТОВЫЕ ПАРАМЕТРЫ----------------------
"""-"""
#-----------------------НАЧАЛО СКРИПТА----------------------

x = 0
if rooms == None:
	rooms = [0,0]

for room in rooms:
	x=__x__(x)+__x__(x)
#TransactionManager.Instance.EnsureInTransaction(doc)
#TransactionManager.Instance.TransactionTaskDone()
#-----------------------КОНЕЦ СКРИПТА----------------------

OUT = x
# ----------------------------------------
members_2 = Python()  # "Object.Members"; frozen; unwired: IN[0]
# ---------- members_2.python (14 lines) ----------
import clr

items = IN[0]
elementlist = list()

try:
	clr.AddReference('RevitAPI')
	from Autodesk.Revit.DB import *
	for item in items:
		elementlist.append(dir(UnwrapElement(item)))
except:
	for item in items:
		elementlist.append(dir(item))
OUT = elementlist
# ----------------------------------------
filteredElementCollector = Python()  # frozen; unwired: IN[0]
# ---------- filteredElementCollector.python (29 lines) ----------
if IN[1]:
	import clr
	
	# Import DocumentManager and TransactionManager
	clr.AddReference("RevitServices")
	import RevitServices
	from RevitServices.Persistence import DocumentManager
	
	
	# Import RevitAPI
	clr.AddReference("RevitAPI")
	import Autodesk
	from Autodesk.Revit.DB import *
	
	doc = DocumentManager.Instance.CurrentDBDocument
	uiapp = DocumentManager.Instance.CurrentUIApplication
	app = uiapp.Application
	
	from System.Collections.Generic import *
	
	
	#The inputs to this node will be stored as a list in the IN variable.
	dataEnteringNode = IN
	collector = FilteredElementCollector(doc)
	elements = collector.OfCategory(BuiltInCategory.OST_Views).ToElements()
	
	OUT = sheetInstances
else:
	OUT = "скрипт не выполнен"
# ----------------------------------------
code_block_8 = CodeBlock { "Назначение"; "Вместимость"; "Номер"; "ROM_Номер"; }
getParameterValueByName_5 = Element.GetParameterValueByName(element=flatten, parameterName=code_block_8.out1)
путь_к_файлу_python_4 = Filename("..\..\Z.Тест\N.Отделка помещений___SpElGeoCalc___GetBoundarySegments___Material type.py")
select_model_elements = DSModelElementsSelection()
select_model_elements_2 = DSModelElementsSelection()
select_model_elements_3 = DSModelElementsSelection()

# group: Get Revit Selection:
forceChildrensEval_4 = ForceChildrensEval()  # frozen; unwired: arg0
pys_get_revit_selection = Python(IN[0]=forceChildrensEval_4)
# ---------- pys_get_revit_selection.python (22 lines) ----------
import clr
clr.AddReference('RevitServices')
clr.AddReference('RevitAPI')
from Autodesk.Revit.DB import *
import RevitServices
from RevitServices.Persistence import DocumentManager
from Autodesk.Revit.ApplicationServices import Application

reset = IN[0]

doc = DocumentManager.Instance.CurrentDBDocument
uidoc = DocumentManager.Instance.CurrentUIApplication.ActiveUIDocument
ids = uidoc.Selection.GetElementIds()

idd = [str(i) for i in ids]

if isinstance(idd, list) == True:
	elems = [doc.GetElement(ElementId(int(i))) for i in idd]
else:
	elems = doc.GetElement(ElementId(int(idd)))

OUT = elems
# ----------------------------------------

shablon_python_shablon_2 = Python(IN[0]=select_model_elements_3, IN[1]=forceChildrensEval_4)
# ---------- shablon_python_shablon_2.python (99 lines) ----------
# -*- coding: utf-8 -*- 
#-----------------------Импоорт библиотек----------------------
import sys
sys.path.append('C:\Program Files (x86)\IronPython 2.7\Lib')

import clr
clr.AddReference('RevitAPI')
import Autodesk
from Autodesk.Revit.DB import *
clr.AddReference('RevitAPIIFC')
from Autodesk.Revit.DB.IFC import *

clr.AddReference("RevitNodes") 
import Revit
from Revit.Elements import *

clr.ImportExtensions(Revit.Elements) #ToDSType не работает без
clr.ImportExtensions(Revit.GeometryConversion)

clr.AddReference("RevitServices")
import RevitServices
from RevitServices.Persistence import DocumentManager
from RevitServices.Transactions import TransactionManager

clr.AddReference('ProtoGeometry')
from Autodesk.DesignScript.Geometry import *

#-----------------------ИМПОРТ БИБЛИОТЕК----------------------
"""-"""
#-----------------------ФУНКЦИИ----------------------

def __x__(x):
	x="x"
	return x
	
def IsInRoom(room,f):
	id = room.Id
	if f.Room != None and f.Room.Id == id:
		return True
	elif f.ToRoom != None and f.ToRoom.Id == id:
		return True
	elif f.FromRoom != None and f.FromRoom.Id == id:
		return True
	return False
	
#-----------------------ФУНКЦИИ----------------------
"""-"""
#-----------------------АПИ ПАРАМЕТРЫ----------------------

doc = DocumentManager.Instance.CurrentDBDocument
#link_doc = UnwrapElement(IN[1])
#uiapp = DocumentManager.Instance.CurrentUIApplication
#app = uiapp.Application
#version = app.VersionNumber
#options = Autodesk.Revit.DB.SpatialElementBoundaryOptions()
#options.StoreFreeBoundaryFaces = True --------- ЗАПИСЬ В PROPERTIS !!!!!!!!!!!!!!!
#options.SpatialElementBoundaryLocation = SpatialElementBoundaryLocation.Center --------- ЗАПИСЬ В Enumeration !!!!!!!!!!!!!!!
calculator = SpatialElementGeometryCalculator(doc)
opt = Options()
opt.ComputeReferences = False
opt.DetailLevel = ViewDetailLevel.Coarse
opt.IncludeNonVisibleObjects = True



#-----------------------АПИ ПАРАМЕТРЫ----------------------
"""-"""
#-----------------------РАБОЧИЕ ПАРАМЕТРЫ----------------------

wall = UnwrapElement(IN[0])
#fi = UnwrapElement(IN[1])

#-----------------------РАБОЧИЕ ПАРАМЕТРЫ----------------------	
"""-"""
#-----------------------ТЕСТОВЫЕ ПАРАМЕТРЫ----------------------
test = []
#test.append(fi.HasSpatialElementCalculationPoint)
#test.append(fi.ToRoom)
#test.append(fi.FromRoom)
#w_vector = wall.Orientation
#f_vector = fi.FacingOrientation
#test = rooms.Id
for w in wall:
	geoms = w.GetOriginalGeometry(opt)
	#for g in geoms:
	#	test.append(g.GetType().Name)
	family_doc = doc.EditFamily(w.Symbol.Family)
	#test.append(family.FamilyCategory.name)
	fam_elem = FilteredElementCollector(family_doc).OfCategory(BuiltInCategory.OST_IOSOpening)
	test.append(fam_elem)
#-----------------------ТЕСТОВЫЕ ПАРАМЕТРЫ----------------------
"""-"""
#-----------------------НАЧАЛО СКРИПТА----------------------

#TransactionManager.Instance.EnsureInTransaction(doc)
#TransactionManager.Instance.TransactionTaskDone()
#-----------------------КОНЕЦ СКРИПТА----------------------

OUT = test#w_vector.IsAlmostEqualTo(f_vector)#IsInRoom(rooms,fi) #dir(Autodesk.Revit.DB.IFC)
# ----------------------------------------
select_model_elements_4 = DSModelElementsSelection()
параметр_отделки_стен_2 = StringInput("АБН_Площадь проёмов")
type = Object.Type(pys_get_revit_selection)
code_block_9 = CodeBlock(type_string=type) { type_string == "Revit.Elements.Room"; }
filterByBoolMask_4 = List.FilterByBoolMask(list=pys_get_revit_selection, mask=code_block_9)
byMesh = DirectShape.ByMesh()  # unwired: arg0, arg1
fromRevitGeometry = Custom[DirectShape.FromRevitGeometry]()  # Creates a DirectShape from native Revit geometry objects; unwired: revitGeometry, category, name

# group: Наименования параметров
площадь_проемов = StringInput("ADSK_Площадь проемов")

retry = BoolSelector(false)

# group: Параметры ширины и высоты окон и дверей
параметр_ширины_параметр_высоты = CodeBlock { {"Примерная ширина","Примерная высота","Э"}; }  # "Параметр ширины, Параметр высоты, Э/Т (Экземпляр/Типоразмер)"
параметр_ширины_параметр_высоты_2 = CodeBlock { {"Ширина","Высота","Э"}; }  # "Параметр ширины, Параметр высоты, Э/Т (Экземпляр/Типоразмер)"
параметр_ширины_параметр_высоты_3 = CodeBlock { {"Примерная ширина","Примерная высота","Т"}; }  # "Параметр ширины, Параметр высоты, Э/Т (Экземпляр/Типоразмер)"
параметр_ширины_параметр_высоты_4 = CodeBlock { {"Ширина","Высота","Т"}; }  # "Параметр ширины, Параметр высоты, Э/Т (Экземпляр/Типоразмер)"
create = List.Create(параметр_ширины_параметр_высоты, параметр_ширины_параметр_высоты_2, параметр_ширины_параметр_высоты_3, параметр_ширины_параметр_высоты_4)

# group: Расчет
python_script = Python(IN[0]=площадь_проемов, IN[1]=retry, IN[2]=create)  # frozen
# ---------- python_script.python (101 lines) ----------
import clr
clr.AddReference('ProtoGeometry')
from Autodesk.DesignScript.Geometry import *
clr.AddReference('RevitAPI')
from Autodesk.Revit.DB import *
clr.AddReference("RevitServices")
import RevitServices
from RevitServices.Persistence import DocumentManager
from RevitServices.Transactions import TransactionManager
doc = DocumentManager.Instance.CurrentDBDocument
opt = SpatialElementBoundaryOptions()
doors = FilteredElementCollector(doc).OfCategory(BuiltInCategory.OST_Doors).WhereElementIsNotElementType().ToElements()
windows = FilteredElementCollector(doc).OfCategory(BuiltInCategory.OST_Windows).WhereElementIsNotElementType().ToElements()
pS = IN[0]
pars=IN[2]

def get_selected_elements():
	ids = uidoc.Selection.GetElementIds()
	if isinstance(ids, list) == True:
		ids=[ids]
	els = []
	for id in ids:
		el = doc.GetElement(id)
		els.append(el)
	return els
	
rooms = FilteredElementCollector(doc).OfCategory(BuiltInCategory.OST_Rooms).WhereElementIsNotElementType().ToElements()
#rooms = UnwrapElement(IN[3])
#rooms = get_selected_elements()

def get_S(window):
	h=None
	list=[]
	type = doc.GetElement(window.get_Parameter(BuiltInParameter.ELEM_TYPE_PARAM).AsElementId())
	for par in pars:
		if par[2]=="Т":
			el = type
		else:
			el = window
		w = el.LookupParameter(par[0])
		h = el.LookupParameter(par[1])
		list.append([w,h])
		if w is not None and h is not None:
			S = w.AsDouble()*h.AsDouble()
			break
	return S
def get_id(d1):
	id=0
	try:
		id= d1.Id
	except:
		id=0
	return id		
def to_dict(id,window):
	if id!=0:
		S=get_S(window)
		if id not in dict:
			dict[id]=S
		else:
			dict[id]+=S
	return dict	
def add_S(windows):
	for window in windows:
		phase = doc.GetElement(window.get_Parameter(BuiltInParameter.PHASE_CREATED).AsElementId())
		d1 = window.FromRoom[phase]
		d2 = window.ToRoom[phase]	
		id1 = str(get_id(d1))
		to_dict(id1,window)	
		id2 = str(get_id(d2))
		to_dict(id2,window)
	return dict			
#
dict={}
list=[]
add_S(windows)
add_S(doors)
TransactionManager.Instance.EnsureInTransaction(doc)
for room in rooms:
	if room.Area>0:
		id = room.Id
		if str(id) in dict:
			S = dict[str(id)]
		else:
			S=0		
		bounds = room.GetBoundarySegments(opt)
		for contour in bounds:
			for bound in contour:
				el = doc.GetElement(bound.ElementId)
				if el is not None:					
					type = el.GetType().Name
					if type == 'ModelLine':
						S = S + room.UnboundedHeight*bound.GetCurve().Length
					try:	
						if el.CurtainGrid is not None:
							S = S+room.UnboundedHeight*bound.GetCurve().Length
					except:
						0				
			room.LookupParameter(pS).Set(S)				
TransactionManager.Instance.TransactionTaskDone()		
#Назначьте вывод переменной OUT"""	
OUT = rooms
# ----------------------------------------

запуск_построения_геометрии = BoolSelector(true)
code_block_10 = CodeBlock { null; }
if_2 = Python(IN[0]=запуск_построения_геометрии, IN[1]=code_block_6.out0, IN[2]=code_block_10)  # same code as if_
categories_3 = Categories("Parts")
byName = Material.ByName(code_block_6.out1)
getParameterValueByName_6 = Element.GetParameterValueByName(element=flatten, parameterName=code_block_8.out3)
getParameterValueByName_7 = Element.GetParameterValueByName(element=flatten, parameterName=code_block_8.out0)
getParameterValueByName_8 = Element.GetParameterValueByName(element=flatten, parameterName=code_block_8.out2)
code_block_11 = CodeBlock(func=getParameterValueByName_6, nomer_func=getParameterValueByName_7, imja=getParameterValueByName_8) { func+" ("+nomer_func+")"+" - "+imja; }
byGeometry = DirectShape.ByGeometry(geometry=if_2, category=categories_3, material=byName, name=code_block_11)
параметр_отделки_элемента = StringInput("АБН_Площадь отделки (элементы)")
convert_between_units_2 = DynamoConvert(area, conversionMetric=Area, conversionFrom=SquareMillimeter, conversionTo=SquareMeter)
setParameterByName_3 = Element.SetParameterByName(element=byGeometry, parameterName=параметр_отделки_элемента, value=convert_between_units_2)
параметр_отделки_элемента_2 = StringInput("АБН_Уровень")
name = Level.Name(code_block_6.out2)
setParameterByName_4 = Element.SetParameterByName(element=setParameterByName_3, parameterName=параметр_отделки_элемента_2, value=name)
string_5 = StringInput("Служба эксплуатации")
string_6 = StringInput("Технические помещения")
code_block_12 = CodeBlock { {"Автостоянка","МХМТС"}; }
code_block_13 = CodeBlock(x=python_script_from_string) { x[1]; }
flatten_2 = Flatten(code_block_13)
uniqueItems = List.UniqueItems(flatten_2)
code_block_14 = CodeBlock { {"Автостоянка для отделки"}; }
