# Dynamo graph Квартирография ADSK Remastered_2.15_без округления после коэффицента.dyn (Dynamo 1.3.4.6666)

categories = Categories("Rooms")
all_elements_of_category = ElementsOfCategory(categories)
watch = Watch(all_elements_of_category)
# note: Сбор параметров из Revit: Площадь помещения, ADSK_Тип помещения, ADSK_Номер квартиры
# Расчет в динамо:
# "ADSK_Площадь квартиры";
# "ADSK_Площадь квартиры общая";
# "ADSK_Площадь квартиры жилая";
# "ADSK_Число комнат";
# "ADSK_Коэффициент площади";
# "ADSK_Площадь с коэффициентом"
# "ADSK_Индекс помещения" (служебный)
code_block = CodeBlock { "ADSK_Номер квартиры"; "ADSK_Тип помещения"; }
округлить_до___знаков = CodeBlock { 2; }
boolean = BoolSelector(false)
python_script = Python(IN[0]=watch, IN[1]=code_block.out0, IN[2]=code_block.out1, IN[3]=округлить_до___знаков, IN[4]=boolean)
# ---------- python_script.python (173 lines) ----------
import clr
import math

clr.AddReference('RevitAPI')
from Autodesk.Revit.DB import UnitUtils, DisplayUnitType
clr.AddReference('System')
from System import Math, MidpointRounding, Decimal, Convert

# На выходе 8 списков
# l[0] - Объект Помещения
# l[1] - Индекс помещения
# l[2] - Количество комнат
# l[3] - Общая площадь квартиры - площадь квартиры с балконами, лоджиями, террасами (с коэффициентом)
# балкон, терраса – 0,3 (коэф) (тип - 4)
# лоджия – 0,5 (коэф) (тип - 3)
# l[4] - Жилая площадь квартиры -  только жилые комнаты – спальни, гостиные
# l[5] - Площадь квартиры – площадь квартиры (без балконов, лоджий, террас)
# l[6] - Коэффициент площади комнаты
# l[7] - Площадь комнаты, умноженная на коэффициент


class RoomInfo():
	appartament_number = None
	appartament_info = None
	room = None
	room_type = None
	room_indeks = None
	room_koef = None
	room_area_by_round = None
	room_area_by_koef = None
	room_area_by_koef_not_round = None


class AppartamentInfo():
	appartament_number = None
	appartament_full_area = 0
	appartament_living_area = 0
	appartament_area = 0
	appartament_komnat = 0
	room_info_list = []

	def pack_room_info(self, room_info):
		self.room_info_list.append(room_info)
		self.appartament_number = room_info.appartament_number
		if room_info.room_type == 5:
			pass
		elif room_info.room_type == 1:
			self.appartament_full_area += room_info.room_area_by_round
			self.appartament_living_area += room_info.room_area_by_round
			self.appartament_area += room_info.room_area_by_round
			self.appartament_komnat += 1
		elif room_info.room_type == 2:
			self.appartament_full_area += room_info.room_area_by_round
			self.appartament_area += room_info.room_area_by_round
		elif room_info.room_type == 3 or room_info.room_type == 4:
			self.appartament_full_area += room_info.room_area_by_koef


test = []

rooms = UnwrapElement(IN[0])
appartament_number_parameter_name = IN[1]  # № КВАРТИРЫ
appartament_type_parameter_name = IN[2]  # Это Тип помещения
round_count = IN[3]  # Это Округление площади
# i = 0

rooms_by_appart_number_dict = {}  # Ключь словаря номер квартиры, значения список всех помещений в квартире
no_appart = "нет номмера квартиры"

for room in rooms:
	if room.LookupParameter(appartament_number_parameter_name):
		appartament_number = room.LookupParameter(appartament_number_parameter_name).AsString()
		if appartament_number:
			if appartament_number not in rooms_by_appart_number_dict.keys():
				rooms_by_appart_number_dict[appartament_number] = []
				rooms_by_appart_number_dict[appartament_number].append(room)
			else:
				rooms_by_appart_number_dict[appartament_number].append(room)
	# else:
		# if no_appart not in rooms_by_appart_number_dict.keys():
		# 	rooms_by_appart_number_dict[no_appart] = []
		# 	rooms_by_appart_number_dict[no_appart].append(room)
		# else:
		# 	rooms_by_appart_number_dict[no_appart].append(room)


# room_info_list = []


def room_koef_by_type(room_type):
	koeff = 1
	if room_type == 5:
		koeff = 0
	elif room_type == 3:
		koeff = 0.5
	elif room_type == 4:
		koeff = 0.3
	return koeff

test_list = []
rooms_info_all = []

def round_to_count(number_to_round, round_count):
	return Convert.ToDouble(Math.Round(Convert.ToDecimal(number_to_round), round_count, MidpointRounding.AwayFromZero))
	
def slice_number(number_to_slice, round_count):
	split_str_number = str(number_to_slice).split(".") # [1][0:2:]
	sliced_number = float(split_str_number[0] + "." + split_str_number[1][0:round_count:])
	return sliced_number

for appartament_number, rooms in rooms_by_appart_number_dict.items():
	appart_info = AppartamentInfo()
	appart_info.appartament_number = appartament_number
	rooms_info_by_appartament = []
	for room in rooms:
		room_info = RoomInfo()
		room_info.room = room
		if room.LookupParameter(appartament_type_parameter_name):
			room_info.room_type = room.LookupParameter(appartament_type_parameter_name).AsInteger()
			room_info.room_indeks = "{}_{}".format(appartament_number, room_info.room_type)
			room_info.room_koef = room_koef_by_type(room_info.room_type)
			# revit (round(100 * Площадь / (1000 мм * 1000 мм)) * 1000 мм * 1000 мм) / 100
			# (round(100 * ((round(1000 * Площадь / (1000 мм * 1000 мм)) * 1000 мм * 1000 мм) / 1000) / (1000 мм * 1000 мм)) * 1000 мм * 1000 мм) / 100
			# (round(100 * ((1000 * round(Площадь / 1 м²) * 1 м²) / 1000) / 1 м²) * 1 м²) / 100
			# round(round(Площадь / 1 м² * 1000) / 10) * 1 м² / 100
			
			# version 2.13 number_to_round = Convert.ToDouble(Math.Round(Convert.ToDecimal(UnitUtils.ConvertFromInternalUnits(room.Area, DisplayUnitType.DUT_SQUARE_METERS)), round_count+1, MidpointRounding.AwayFromZero))
			number_converted_from_internal = UnitUtils.ConvertFromInternalUnits(room.Area, DisplayUnitType.DUT_SQUARE_METERS)
			
			number_to_round = round_to_count(number_converted_from_internal, round_count+1)
			
			#test_list.append(test)
			#test_list.append(Math.Round(Convert.ToDecimal(test), round_count, MidpointRounding.AwayFromZero))
			
			room_info.room_area_by_round = round_to_count(number_to_round, round_count) # Convert.ToDouble(Math.Round(Convert.ToDecimal(test), round_count, MidpointRounding.AwayFromZero))
			
			# room_info.room_area_by_round = Math.Round(Math.Round(UnitUtils.ConvertFromInternalUnits(room.Area, DisplayUnitType.DUT_SQUARE_METERS), round_count + 1, MidpointRounding.AwayFromZero), round_count, MidpointRounding.AwayFromZero)
			
			# room_info.room_area_by_round = Math.Round(UnitUtils.ConvertFromInternalUnits(Math.Round(Math.Round(room.Area, round_count + 1, MidpointRounding.AwayFromZero), round_count, MidpointRounding.AwayFromZero), DisplayUnitType.DUT_SQUARE_MILLIMETERS), round_count, MidpointRounding.AwayFromZero)
			
			# в версии 2.13 умножение на коэффицент было внутри, до второго округления, теперь умножение на коэффицент после всех веток округления
			room_info.room_area_by_koef = round_to_count(round_to_count(number_to_round, round_count) * room_info.room_koef, round_count)
			room_info.room_area_by_koef_not_round = room_info.room_area_by_round * room_info.room_koef
			room_info.room_area_by_koef_sliced = slice_number(room_info.room_area_by_round * room_info.room_koef, round_count)

	
			appart_info.pack_room_info(room_info)
			rooms_info_by_appartament.append(room_info)
	for room_info in rooms_info_by_appartament:
		room_info.appartament_info = appart_info
	rooms_info_all.extend(rooms_info_by_appartament)


list_of_rooms_info_data = []
for room_info in rooms_info_all:
	list_of_rooms_info_data.append(
		(
			room_info.room,  # l[0] - Объект Помещения
			room_info.room_indeks,  # l[1] - Индекс помещения
			room_info.appartament_info.appartament_komnat,  # l[2] - Тип помещения
			room_info.appartament_info.appartament_full_area,  # l[3] - Общая площадь квартиры
			room_info.appartament_info.appartament_living_area,  # l[4] - Жилая площадь квартиры
			room_info.appartament_info.appartament_area,  # l[5] - Площадь квартиры
			room_info.room_koef,  # l[6] - Коэффициент площади комнаты
			room_info.room_area_by_koef,  # l[7] - Площадь комнаты, умноженная на коэффициент
			room_info.room_area_by_round,  # l[8] - Площадь комнаты, округлённая
			room_info.room_area_by_koef_not_round, # l[9] - Площадь комнаты, умноженная на коэффициент, без округления
			room_info.room_area_by_koef_sliced # l[10] - Площадь комнаты, умноженная на коэффициент, с отсечение знаков после заданного числа, вместо округления
		)
	)

OUT = list_of_rooms_info_data
#OUT = test_list
# ----------------------------------------
transpose = List.Transpose(python_script)
watch_2 = Watch(transpose)
# note: # На выходе 8 списков:
# # l[0] - Объект Помещения
# # l[1] - Индекс помещения
# # l[2] - Количество комнат
# # l[3] - Общая площадь квартиры - площадь квартиры с балконами, лоджиями, террасами (с коэффициентом)
# балкон, терраса – 0,3 (коэф) (тип - 4)
# лоджия – 0,5 (коэф) (тип - 3)
# # l[4] - Жилая площадь квартиры -  только жилые комнаты – спальни, гостиные
# # l[5] - Площадь квартиры – площадь квартиры (без балконов, лоджий, террас)
# # l[6] - Коэффициент площади комнаты
# # l[7] - Площадь комнаты, умноженная на коэффициент
# # l[8] - Площадь комнаты, округлённая
# # l[9] - Площадь комнаты, умноженная на коэффициент, без округления
# # l[10] - Площадь комнаты, умноженная на коэффициент, с отсечение знаков после заданного числа, вместо округления
code_block_2 = CodeBlock(l=watch_2) { l[0]; l[1]; l[2]; l[3]; l[4]; l[5]; l[6]; l[7]; }
code_block_3 = CodeBlock()
# ---------- code_block_3.designscript (8 lines) ----------
"ADSK_Номер квартиры";
"ADSK_Площадь квартиры общая";
"ADSK_Площадь квартиры жилая";
"ADSK_Количество комнат";
"ADSK_Индекс помещения";
"ADSK_Коэффициент площади";
"ADSK_Площадь с коэффициентом";
"ADSK_Площадь квартиры";
# ----------------------------------------
# note: Назначить - Общая площадь
setParameterByName = Element.SetParameterByName(element=code_block_2.out0, parameterName=code_block_3.out2, value=code_block_2.out4)
# note: Назначить - Число комнат
setParameterByName_2 = Element.SetParameterByName(element=code_block_2.out0, parameterName=code_block_3.out1, value=code_block_2.out3)
setParameterByName_3 = Element.SetParameterByName(element=code_block_2.out0, parameterName=code_block_3.out3, value=code_block_2.out2)
setParameterByName_4 = Element.SetParameterByName(element=code_block_2.out0, parameterName=code_block_3.out4, value=code_block_2.out1)
# note: Назначить - Индекс помещения
# note: Назначить - Коэффициент площади
setParameterByName_5 = Element.SetParameterByName(element=code_block_2.out0, parameterName=code_block_3.out5, value=code_block_2.out6)
# note: Назначить -Площадь с коэффициентом
setParameterByName_6 = Element.SetParameterByName(element=code_block_2.out0, parameterName=code_block_3.out6, value=code_block_2.out7)
# note: Назначить - Жилая площадь
# note: Назначить - Площадь квартиры
setParameterByName_7 = Element.SetParameterByName(element=code_block_2.out0, parameterName=code_block_3.out7, value=code_block_2.out5)
getParameterValueByName = Element.GetParameterValueByName(element=watch, parameterName=code_block.out0)
getParameterValueByName_2 = Element.GetParameterValueByName(element=watch, parameterName=code_block.out1)
