# Dynamo graph МИН-МАКС_open_doc_change_synh_close.dyn (Dynamo 1.3.3.4111)

# group: ЗАПАСНЫЕ ВАРИАНТЫ, ДОПОЛНИТЕЛЬНЫЕ ОПЦИИ
# note: ДОПОЛНИТЕЛЬНЫЕ. Градации серово по важности, темнее - важнее
# note: ЗАПАСНЫЕ

# group: КЛЮЧЕВЫЕ МОМЕНТЫ РАБОТЫ 1
# note: КОНСОЛИДАЦИЯ И СЛОЖНЫЕ ОБРАБОТКИ

# group: КЛЮЧЕВЫЕ МОМЕНТЫ РАБОТЫ 2
# note: УСЛОЖНЕННЫЕ КОНСТРУКЦИИ
# note: УСЛОЖНЕНЫЕ КОНСТРУКЦИИ

# group: Python ноды
# note: Python

# group: Запуск питона из внешнего файла
# note: Py - files

# group: ПОЛУЧАЕМ ДАННЫЕ
# note: ПОЛУЧАЕМ ДАННЫЕ ИЗ РЕВИТ и других источников

# group: ИСПОЛНИТЕЛЬНЫЕ НОДЫ (фильтрование, подбор, списки и т.д.)
# note: ИСПОЛНИТЕЛЬНЫЕ НОДЫ

# group: ЭЛЕМЕНТЫ УПРАВЛЕНИЯ 2 УРОВЕНЬ
# note: ЭЛЕМЕНТЫ УПРАВЛЕНИЯ
# note: ПЕРЕМЕННЫЕ ЗНАЧЕНИЯ

# group: ЭЛЕМЕНТЫ УПРАВЛЕНИЯ
# note: ПЕРЕМЕННЫЕ ЗНАЧЕНИЯ
# note: ЭЛЕМЕНТЫ УПРАВЛЕНИЯ

# group: ПРОВЕРОЧНЫЕ НОДЫ
# note: ПРОВЕРОЧНЫЕ НОДЫ

# group: ПЕРЕДАЁМ ИНФОРМАЦИЮ
# note: ПЕРЕДАЁМ ИНФОРМАЦИЮ В РЕВИТ
# note: ПЕРЕДАЁМ ИНФОРМАЦИЮ ЕЩЁ КУДА-ТО

# group: ПРИМЕЧАНИЯ ПО ЦВЕТОВОЙ ГРУППИРОВКЕ
# note: GUIDELINES

code_block = CodeBlock()
# ---------- code_block.designscript (43 lines) ----------
"
out = 'test'
if IN[0]:
 import clr

 import System

 clr.AddReference('RevitNodes')
 import Revit

 clr.AddReference('RevitServices')
 import RevitServices
 from RevitServices.Persistence import DocumentManager
 from RevitServices.Transactions import TransactionManager

 clr.AddReference('RevitAPI')
 import Autodesk
 from Autodesk.Revit.DB import TransactWithCentralOptions, SynchronizeWithCentralOptions, RelinquishOptions

 uiapp = DocumentManager.Instance.CurrentUIApplication
 app = uiapp.Application

 i = IN[1]
 doc = app.OpenDocumentFile(i)

 transOpts = TransactWithCentralOptions()
 syncOpts = SynchronizeWithCentralOptions()
 relinquishOpts = RelinquishOptions(False)
 syncOpts.SetRelinquishOptions(relinquishOpts)
 syncOpts.SaveLocalAfter = False

 #TransactionManager.Instance.EnsureInTransaction(doc)

 #!!!replace_code_here!!!

 #TransactionManager.Instance.ForceCloseTransaction()

 doc.SynchronizeWithCentral(transOpts, syncOpts)
 doc.Close()
else:
 pass
OUT = out
";
# ----------------------------------------
code_block_2 = CodeBlock()
# ---------- code_block_2.designscript (50 lines) ----------
"
# -*- coding: utf-8 -*-
if IN[0]:
 import clr

 import System
 import System.Reflection

 clr.AddReference('RevitNodes')
 import Revit

 clr.AddReference('RevitServices')
 import RevitServices
 from RevitServices.Persistence import DocumentManager
 from RevitServices.Transactions import TransactionManager

 clr.AddReference('RevitAPI')
 import Autodesk
 from Autodesk.Revit.DB import TransactWithCentralOptions, SynchronizeWithCentralOptions, RelinquishOptions
 from Autodesk.Revit.DB import *

 uiapp = DocumentManager.Instance.CurrentUIApplication
 app = uiapp.Application
 test = []

 file_list = IN[1]
 x=0
 for f in file_list:
  mpath = ModelPathUtils.ConvertUserVisiblePathToModelPath(f)
  doc = app.OpenDocumentFile(mpath,OpenOptions())
  test.append(f)
  transOpts = TransactWithCentralOptions()
  syncOpts = SynchronizeWithCentralOptions()
  relinquishOpts = RelinquishOptions(False)
  syncOpts.SetRelinquishOptions(relinquishOpts)
  syncOpts.SaveLocalAfter = False

  TransactionManager.Instance.EnsureInTransaction(doc)

#!!!replace_code_here!!!

  TransactionManager.Instance.ForceCloseTransaction()

  doc.SynchronizeWithCentral(transOpts, syncOpts)
  doc.Close()

 OUT = test
else:
 OUT = 'not run'
";
# ----------------------------------------
code_block_3 = CodeBlock { "#!!!replace_code_here!!!"; }
file_path = Filename("..\РАБОЧИЕ СКРИПТЫ\Python\min-max by room in not opened file.py")
forceChildrensEval = ForceChildrensEval()  # unwired: arg0
find_file_and_import_it = Python(IN[0]=file_path, IN[1]=forceChildrensEval)
# ---------- find_file_and_import_it.python (11 lines) ----------
import sys
sys.path.append('C:\Program Files (x86)\IronPython 2.7\Lib')
import codecs

try:
	filePath = IN[0]
	with codecs.open(filePath, 'rb', "utf-8") as inf:
		lines = inf.readlines()
	OUT = ''.join(lines)
except:
	OUT = "No file"
# ----------------------------------------
replace = String.Replace(str=code_block_2, searchFor=code_block_3, replaceWith=find_file_and_import_it)
выполнить = BoolSelector(true)
code_block_4 = CodeBlock { {"17_06-05-01-AR_R17.rvt","17_06-05-02-AR_R17.rvt"}; }
code_block_5 = CodeBlock(x=code_block_4) { "rsn:///"+x; }
python_script_from_string = PythonStringNode(script=replace, IN[0]=выполнить, IN[1]=code_block_5, IN[2]=forceChildrensEval)
code_block_6 = CodeBlock { {"17_06-05-00-AR_R17.rvt"}; }
code_block_7 = CodeBlock { {"C:\\test\\roms_test_s.rvt"}; }
parameters = Element.Parameters()  # unwired: arg0
geometry = Element.Geometry()  # unwired: arg0
setParameterByName = Element.SetParameterByName()  # unwired: element, parameterName, value
# note: ВСЁ ОСТАЛЬНОЕ
getParameterValueByName = Element.GetParameterValueByName()  # unwired: element, parameterName
boolean = BoolSelector(true)  # frozen
code_block_8 = CodeBlock { 1; 2; }
if_ = Python(IN[0]=boolean, IN[1]=code_block_8.out0, IN[2]=code_block_8.out1)
# ---------- if_.python (12 lines) ----------
import clr
boolean = IN[0]
true = UnwrapElement(IN[1])
false = UnwrapElement(IN[2])

if boolean:
	out = true
else:
	out = false

#Назначьте вывод переменной OUT.
OUT = out
# ----------------------------------------
members = Python()  # "Object.Members"; frozen; unwired: IN[0]
# ---------- members.python (14 lines) ----------
import clr

items = IN[0]
elementlist = list()

try:
	clr.AddReference('RevitAPI')
	from Autodesk.Revit.DB import *
	for item in items:
		elementlist.append(dir(UnwrapElement(item)))
except:
	for item in items:
		elementlist.append(dir(item))
OUT = elementlist
# ----------------------------------------
filteredElementCollector = Python()  # frozen; unwired: IN[0]
# ---------- filteredElementCollector.python (29 lines) ----------
if IN[1]:
	import clr
	
	# Import DocumentManager and TransactionManager
	clr.AddReference("RevitServices")
	import RevitServices
	from RevitServices.Persistence import DocumentManager
	
	
	# Import RevitAPI
	clr.AddReference("RevitAPI")
	import Autodesk
	from Autodesk.Revit.DB import *
	
	doc = DocumentManager.Instance.CurrentDBDocument
	uiapp = DocumentManager.Instance.CurrentUIApplication
	app = uiapp.Application
	
	from System.Collections.Generic import *
	
	
	#The inputs to this node will be stored as a list in the IN variable.
	dataEnteringNode = IN
	collector = FilteredElementCollector(doc)
	elements = collector.OfCategory(BuiltInCategory.OST_Views).ToElements()
	
	OUT = sheetInstances
else:
	OUT = "скрипт не выполнен"
# ----------------------------------------
shablon_python_shablon = Python()  # frozen; unwired: IN[0]
# ---------- shablon_python_shablon.python (76 lines) ----------
# -*- coding: utf-8 -*- 
#-----------------------Импоорт библиотек----------------------
import clr
clr.AddReference('RevitAPI')
import Autodesk
from Autodesk.Revit.DB import *

clr.AddReference("RevitNodes") 
import Revit
from Revit.Elements import *

clr.ImportExtensions(Revit.Elements) #ToDSType не работает без
clr.ImportExtensions(Revit.GeometryConversion) #ToXyz не работает без

clr.AddReference("RevitServices")
import RevitServices
from RevitServices.Persistence import DocumentManager
from RevitServices.Transactions import TransactionManager

clr.AddReference('ProtoGeometry')
from Autodesk.DesignScript.Geometry import *

#-----------------------ИМПОРТ БИБЛИОТЕК----------------------
"""-"""
#-----------------------ФУНКЦИИ----------------------

def __x__(x):
	x="x"
	return x
	
#-----------------------ФУНКЦИИ----------------------
"""-"""
#-----------------------АПИ ПАРАМЕТРЫ----------------------

doc = DocumentManager.Instance.CurrentDBDocument
#link_doc = UnwrapElement(IN[1])
#uiapp = DocumentManager.Instance.CurrentUIApplication
#app = uiapp.Application
#version = app.VersionNumber
#options = Autodesk.Revit.DB.SpatialElementBoundaryOptions()
calculator = SpatialElementGeometryCalculator(doc)

g_id_list = []
g_id_list.append(ElementId(group))

bxList = List[ElementId](g_id_list) #АЙ ЛИСТ КОЛЕКТИОН
move = Transform.CreateTranslation(-wall.Orientation*2) #смещение
cl.CreateTransformed(move)

#-----------------------АПИ ПАРАМЕТРЫ----------------------
"""-"""
#-----------------------РАБОЧИЕ ПАРАМЕТРЫ----------------------

rooms = UnwrapElement(IN[0])

#-----------------------РАБОЧИЕ ПАРАМЕТРЫ----------------------	
"""-"""
#-----------------------ТЕСТОВЫЕ ПАРАМЕТРЫ----------------------

test = []

#-----------------------ТЕСТОВЫЕ ПАРАМЕТРЫ----------------------
"""-"""
#-----------------------НАЧАЛО СКРИПТА----------------------

x = 0
if rooms == None:
	rooms = [0,0]

for room in rooms:
	x=__x__(x)+__x__(x)
#TransactionManager.Instance.EnsureInTransaction(doc)
#TransactionManager.Instance.TransactionTaskDone()
#-----------------------КОНЕЦ СКРИПТА----------------------

OUT = x
# ----------------------------------------

# group: Get Revit Selection:
forceChildrensEval_2 = ForceChildrensEval()  # frozen; unwired: arg0
pys_get_revit_selection = Python(IN[0]=forceChildrensEval_2)
# ---------- pys_get_revit_selection.python (22 lines) ----------
import clr
clr.AddReference('RevitServices')
clr.AddReference('RevitAPI')
from Autodesk.Revit.DB import *
import RevitServices
from RevitServices.Persistence import DocumentManager
from Autodesk.Revit.ApplicationServices import Application

reset = IN[0]

doc = DocumentManager.Instance.CurrentDBDocument
uidoc = DocumentManager.Instance.CurrentUIApplication.ActiveUIDocument
ids = uidoc.Selection.GetElementIds()

idd = [str(i) for i in ids]

if isinstance(idd, list) == True:
	elems = [doc.GetElement(ElementId(int(i))) for i in idd]
else:
	elems = doc.GetElement(ElementId(int(idd)))

OUT = elems
# ----------------------------------------

# group: Parameters name from language
parameters_name_from_language = Python()  # frozen
# ---------- parameters_name_from_language.python (18 lines) ----------
import clr
clr.AddReference('RevitServices')
import RevitServices
from RevitServices.Persistence import DocumentManager

uiapp = DocumentManager.Instance.CurrentUIApplication
app = uiapp.Application
lng = app.Language
rus = ["Тип","Имя семейства","Имя типа"]
enu = ["Type","Family name","Type name"]
out = []
if str(lng) == "Russian":
	out = rus
else:
	out = enu
#English_USA
#Russian
OUT = out
# ----------------------------------------

# group: элементы внутри групп
members_2 = Python()  # "Group.Members"; frozen; unwired: IN[0]
# ---------- members_2.python (19 lines) ----------
import clr
clr.AddReference('RevitAPI')
from Autodesk.Revit.DB import *

clr.AddReference("RevitNodes")
import Revit
clr.ImportExtensions(Revit.Elements)

groups = UnwrapElement(IN[0])
elementlist = list()
for item in groups:
	try:
		memberlist = list()
		for member in item.GetMemberIds():
			memberlist.append(item.Document.GetElement(member))
		elementlist.append(memberlist)
	except:
		elementlist.append(list())
OUT = elementlist
# ----------------------------------------

путь_к_файлу_python = Filename(".\N.Отделка помещений_сбор элементов вокруг_1.7.py")  # frozen
forceChildrensEval_3 = ForceChildrensEval()  # unwired: arg0
find_file_and_import_it_2 = Python(IN[0]=путь_к_файлу_python, IN[1]=forceChildrensEval_3)  # same code as find_file_and_import_it
python_script_from_string_2 = PythonStringNode(script=find_file_and_import_it_2)  # unwired: IN[0]
categories = Categories()  # frozen
all_elements_of_category = ElementsOfCategory(categories)
regenerate = Python()  # frozen; unwired: IN[0]
# ---------- regenerate.python (26 lines) ----------
import clr

# Import DocumentManager and TransactionManager
clr.AddReference("RevitServices")
import RevitServices
from RevitServices.Persistence import DocumentManager


# Import RevitAPI
clr.AddReference("RevitAPI")
import Autodesk
from Autodesk.Revit.DB import *

doc = DocumentManager.Instance.CurrentDBDocument


#The inputs to this node will be stored as a list in the IN variable.
list = IN[0]


if list:
	doc.Regenerate()
	out = "Regeneration complete"
else:
	out = "fail"
OUT = out
# ----------------------------------------
code_block_9 = CodeBlock { {"17_06-05-01-AR_R17.rvt"}; }
