# Dynamo graph ПРОСТРАНСТВА. Создание пространств по помещениям.dyn (Dynamo 1.3.0.875)

# group: Get Documents
empty = List.Empty()
python_script = Python(IN[0]=empty)
# ---------- python_script.python (50 lines) ----------
#Copyright(c) 2015, Konrad K Sobon
# @arch_laboratory, http://archi-lab.net

# Huge thanks to Andreas Dieckmann for 
# adding link path functionality

import clr
clr.AddReference('ProtoGeometry')
from Autodesk.DesignScript.Geometry import *

# Import DocumentManager and TransactionManager
clr.AddReference("RevitServices")
import RevitServices
from RevitServices.Persistence import DocumentManager
from RevitServices.Transactions import TransactionManager

from System.Collections.Generic import *

# Import RevitAPI
clr.AddReference("RevitAPI")
import Autodesk
from Autodesk.Revit.DB import *
from Autodesk.Revit.DB.Analysis import *

doc = DocumentManager.Instance.CurrentDBDocument
uiapp = DocumentManager.Instance.CurrentUIApplication
app = uiapp.Application

# Import ToDSType(bool) extension method
clr.AddReference("RevitNodes")
import Revit
clr.ImportExtensions(Revit.Elements)

#The inputs to this node will be stored as a list in the IN variable.
dataEnteringNode = IN

collector = Autodesk.Revit.DB.FilteredElementCollector(doc)
linkInstances = collector.OfClass(Autodesk.Revit.DB.RevitLinkInstance)

linkDoc, linkName, linkPath = [], [], []
for i in linkInstances:
	linkDoc.append(i.GetLinkDocument())
	linkName.append(i.Name)
	try:
		linkPath.append(i.GetLinkDocument().PathName)
	except:
		linkPath.append(None)
		pass

OUT = linkDoc, linkName, linkInstances, linkPath
# ----------------------------------------
code_block = CodeBlock { 0; 1; 2; 3; }
getItemAtIndex = List.GetItemAtIndex(list=python_script, index=code_block.out0)
code_block_2 = CodeBlock(Link_Doc=getItemAtIndex) { Link_Doc; }
getItemAtIndex_2 = List.GetItemAtIndex(list=python_script, index=code_block.out2)
code_block_3 = CodeBlock(Link_Instance=getItemAtIndex_2) { Link_Instance; }
getItemAtIndex_3 = List.GetItemAtIndex(list=python_script, index=code_block.out1)
code_block_4 = CodeBlock(Link_Name=getItemAtIndex_3) { Link_Name; }
getItemAtIndex_4 = List.GetItemAtIndex(list=python_script, index=code_block.out3)
code_block_5 = CodeBlock(Link_Path=getItemAtIndex_4) { Link_Path; }

# group: Retrieve Linked Rooms
integer_slider = IntegerSlider(1, range=0..100 step 1)
getItemAtIndex_5 = List.GetItemAtIndex(list=code_block_2, index=integer_slider)
categories = Categories("Rooms")
getItemAtIndex_6 = List.GetItemAtIndex(list=code_block_3, index=integer_slider)
get_documents = Custom[Get Documents]()  # frozen; Queries all linked Revit files and retrieves their Name, LinkInstance and Document properties.
getFromLinkedFile = Custom[Element.GetFromLinkedFile]()  # frozen; Get elements from link document instance based on category; unwired: Link_Instance, Link_Document, Category

# group: Element.GetFromLinkedFile
code_block_6 = CodeBlock(Link_Document=getItemAtIndex_5) { Link_Document; }
firstItem = List.FirstItem(code_block_6)
code_block_7 = CodeBlock(Category_=categories) { Category_; }
code_block_8 = CodeBlock(Link_Instance=getItemAtIndex_6) { Link_Instance; }
python_script_2 = Python(IN[0]=firstItem, IN[1]=code_block_7, IN[2]=code_block_8)
# ---------- python_script_2.python (46 lines) ----------
#python nodes in dynamo 1.0
#proposed by Julien Benoit @jbenoit44 
#http://aecuandme.wordpress.com/
import System
import clr
clr.AddReference('ProtoGeometry')
from Autodesk.DesignScript.Geometry import *
# Import ToDSType(bool) extension method
clr.AddReference("RevitNodes")
import Revit
clr.ImportExtensions(Revit.Elements)
# Import geometry conversion extension methods
clr.ImportExtensions(Revit.GeometryConversion)
# Import DocumentManager and TransactionManager
clr.AddReference("RevitServices")
import RevitServices
from RevitServices.Persistence import DocumentManager
from RevitServices.Transactions import TransactionManager
from System.Collections.Generic import *
# Import RevitAPI
clr.AddReference("RevitAPI")
import Autodesk
from Autodesk.Revit.DB import *

doc = DocumentManager.Instance.CurrentDBDocument
uiapp = DocumentManager.Instance.CurrentUIApplication
app = uiapp.Application
uidoc=DocumentManager.Instance.CurrentUIApplication.ActiveUIDocument

LinkDoc=IN[0]
cat = IN[1]
LinkInst = IN[2]

BuiltIn = System.Enum.ToObject(BuiltInCategory, cat.Id)

elementlist = []
typelist=[]
T = []


collector = FilteredElementCollector(LinkDoc)
filter = ElementCategoryFilter(BuiltIn)
list=collector.WherePasses(filter).WhereElementIsNotElementType().ToElements()


OUT = list
# ----------------------------------------

# group: Create Spaces
fromElement = CustomRoom.FromElement(python_script_2)
locationPoint = CustomRoom.LocationPoint(fromElement)
byPoint = Space.ByPoint(locationPoint)

# group: Get Spaces Properties
locationPoint_2 = Space.LocationPoint(byPoint)
level = Space.Level(byPoint)
boundaryElements = Space.BoundaryElements(byPoint)

categories_2 = Categories("Rooms")
all_elements_of_category = ElementsOfCategory(categories_2)
code_block_9 = CodeBlock(element=python_script_2) { element; }
python_script_3 = Python(IN[0]=code_block_9)
# ---------- python_script_3.python (68 lines) ----------
import clr
import math
clr.AddReference('RevitAPI')
from Autodesk.Revit.DB import *

clr.AddReference("RevitNodes")
import Revit
clr.ImportExtensions(Revit.GeometryConversion)

items = UnwrapElement(IN[0])
pointlist = list()
curvepointlist = list()
ispoint = list()
iscurve = list()
curves = list()
haslocation = list()
angles, hasrotation = [], []

for item in items:
	try:
		# points and text notes
		pointlist.append(item.Coord.ToPoint())
		ispoint.append(True)
		iscurve.append(False)
		haslocation.append(True)
		hasrotation.append(False)
	except:
		try:
			loc = item.Location
			if loc.ToString() == 'Autodesk.Revit.DB.LocationCurve':
				# line-based elements (e.g. walls)
				curvepoints = (loc.Curve.GetEndPoint(0).ToPoint(),loc.Curve.GetEndPoint(1).ToPoint())
				curvepointlist.append(curvepoints)
				curves.append(loc.Curve.ToProtoType())
				ispoint.append(False)
				iscurve.append(True)
				haslocation.append(True)
				hasrotation.append(False)
			elif loc.ToString() == 'Autodesk.Revit.DB.LocationPoint':
				# point-based elements
				pointlist.append(loc.Point.ToPoint())
				angles.append(math.degrees(loc.Rotation) )
				ispoint.append(True)
				iscurve.append(False)
				angles.append
				haslocation.append(True)
				hasrotation.append(True)
			else:
				ispoint.append(False)
				iscurve.append(False)
				haslocation.append(False)
				hasrotation.append(False)
		except:
			try:
				# curves
				curvepoints = (item.GetEndPoint(0).ToPoint(),item.GetEndPoint(1).ToPoint())
				curvepointlist.append(curvepoints)
				curves.append(item.ToProtoType())
				ispoint.append(False)
				iscurve.append(True)
				haslocation.append(True)
				hasrotation.append(False)
			except:
				ispoint.append(False)
				iscurve.append(False)
				haslocation.append(False)
				hasrotation.append(False)
OUT = (pointlist,curvepointlist,curves,ispoint,iscurve,haslocation,angles, hasrotation)
# ----------------------------------------
code_block_10 = CodeBlock(seq=python_script_3) { seq[0]; seq[1]; seq[2]; seq[3]; seq[4]; seq[5]; seq[6]; seq[7]; }
code_block_11 = CodeBlock(points=code_block_10.out0) { points; }
code_block_12 = CodeBlock(curveEndpoints=code_block_10.out1) { curveEndpoints; }
code_block_13 = CodeBlock(curves=code_block_10.out2) { curves; }
code_block_14 = CodeBlock(isPoint=code_block_10.out3) { isPoint; }
code_block_15 = CodeBlock(isCurve=code_block_10.out4) { isCurve; }
code_block_16 = CodeBlock(hasLocation=code_block_10.out5) { hasLocation; }
code_block_17 = CodeBlock(angle=code_block_10.out6) { angle; }
code_block_18 = CodeBlock(hasRotation=code_block_10.out7) { hasRotation; }
location = Room.Location(python_script_2)
