# Dynamo graph 0.(Select&Push) Стены.Соединение стен (выделите стены и запустите).dyn (Dynamo 1.3.4.6666)

forceChildrensEval = ForceChildrensEval()  # unwired: arg0
python_script = Python(IN[0]=forceChildrensEval)
# ---------- python_script.python (25 lines) ----------
import clr
clr.AddReference('ProtoGeometry')
from Autodesk.DesignScript.Geometry import *
clr.AddReference('RevitAPI')
from Autodesk.Revit.DB import *
import Autodesk
clr.AddReference("RevitServices")
import RevitServices
from RevitServices.Persistence import DocumentManager
from RevitServices.Transactions import TransactionManager
doc = DocumentManager.Instance.CurrentDBDocument
uidoc = DocumentManager.Instance.CurrentUIApplication.ActiveUIDocument
ids = uidoc.Selection.GetElementIds()
idd = [str(i) for i in ids]

if isinstance(idd, list) == True:
	elems = [doc.GetElement(ElementId(int(i))) for i in idd]
else:
	elems = doc.GetElement(ElementId(int(idd)))
TransactionManager.Instance.EnsureInTransaction(doc)
for e in elems:
	Autodesk.Revit.DB.WallUtils.AllowWallJoinAtEnd(e, 0)
	Autodesk.Revit.DB.WallUtils.AllowWallJoinAtEnd(e, 1)
TransactionManager.Instance.TransactionTaskDone()
OUT = elems
# ----------------------------------------
