# Dynamo graph 0.Пакетное объединение массива_с выбором категорий_оптимизация_0.9.dyn (Dynamo 1.3.4.6666)

# note: ВСЁ ОСТАЛЬНОЕ

# group: ЗАПАСНЫЕ ВАРИАНТЫ, ДОПОЛНИТЕЛЬНЫЕ ОПЦИИ
# note: ДОПОЛНИТЕЛЬНЫЕ. Градации серово по важности, темнее - важнее
# note: ЗАПАСНЫЕ

# group: КЛЮЧЕВЫЕ МОМЕНТЫ РАБОТЫ 2
# note: НОДЫ РАБОТАЮЩИЕ С ДАННЫМИ
# note: ИСПОЛНИТЕЛЬНЫЕ НОДЫ

# group: КЛЮЧЕВЫЕ МОМЕНТЫ РАБОТЫ 1
# note: ИТОГОВАЯ КОНСОЛИДАЦИЯ ДАННЫХ

# group: ИСПОЛНИТЕЛЬНЫЕ НОДЫ (фильтрование, подбор, списки и т.д.)
# note: ИСПОЛНИТЕЛЬНЫЕ НОДЫ
# note: НОДЫ РАБОТАЮЩИЕ С ДАННЫМИ

# group: ЭЛЕМЕНТЫ УПРАВЛЕНИЯ 2 УРОВЕНЬ
# note: ПЕРЕМЕННЫЕ ЗНАЧЕНИЯ
# note: ЭЛЕМЕНТЫ УПРАВЛЕНИЯ

# group: ПЕРЕДАЁМ ИНФОРМАЦИЮ В РЕВИТ
# note: ПЕРЕДАЁМ ИНФОРМАЦИЮ В РЕВИТ

# group: ЭЛЕМЕНТЫ УПРАВЛЕНИЯ Dyno Studio
# note: Dyno Studio

# group: ЭЛЕМЕНТЫ УПРАВЛЕНИЯ
# note: ПЕРЕМЕННЫЕ ЗНАЧЕНИЯ
# note: ЭЛЕМЕНТЫ УПРАВЛЕНИЯ

# group: ПОЛУЧАЕМ ДАННЫЕ ИЗ РЕВИТ
# note: ПОЛУЧАЕМ ДАННЫЕ ИЗ РЕВИТ

# group: ПРОВЕРОЧНЫЕ НОДЫ
# note: ПРОВЕРОЧНЫЕ НОДЫ

# group: ПРИМЕЧАНИЯ ПО ЦВЕТОВОЙ ГРУППИРОВКЕ
# note: GUIDELINES

setParameterByName = Element.SetParameterByName()  # unwired: element, parameterName, value
boolean = BoolSelector(true)  # frozen
code_block = CodeBlock { 1; 2; }
if_ = Python(IN[0]=boolean, IN[1]=code_block.out0, IN[2]=code_block.out1)
# ---------- if_.python (12 lines) ----------
import clr
boolean = IN[0]
true = UnwrapElement(IN[1])
false = UnwrapElement(IN[2])

if boolean:
	out = true
else:
	out = false

#Назначьте вывод переменной OUT.
OUT = out
# ----------------------------------------
parameters = Element.Parameters()  # unwired: arg0
geometry = Element.Geometry()  # unwired: arg0
getParameterValueByName = Element.GetParameterValueByName()  # unwired: element, parameterName

# group: элементы внутри групп
members = Python()  # "Group.Members"; frozen; unwired: IN[0]
# ---------- members.python (19 lines) ----------
import clr
clr.AddReference('RevitAPI')
from Autodesk.Revit.DB import *

clr.AddReference("RevitNodes")
import Revit
clr.ImportExtensions(Revit.Elements)

groups = UnwrapElement(IN[0])
elementlist = list()
for item in groups:
	try:
		memberlist = list()
		for member in item.GetMemberIds():
			memberlist.append(item.Document.GetElement(member))
		elementlist.append(memberlist)
	except:
		elementlist.append(list())
OUT = elementlist
# ----------------------------------------

# group: Get Revit Selection:
forceChildrensEval = ForceChildrensEval()  # frozen; unwired: arg0
pys_get_revit_selection = Python(IN[0]=forceChildrensEval)
# ---------- pys_get_revit_selection.python (22 lines) ----------
import clr
clr.AddReference('RevitServices')
clr.AddReference('RevitAPI')
from Autodesk.Revit.DB import *
import RevitServices
from RevitServices.Persistence import DocumentManager
from Autodesk.Revit.ApplicationServices import Application

reset = IN[0]

doc = DocumentManager.Instance.CurrentDBDocument
uidoc = DocumentManager.Instance.CurrentUIApplication.ActiveUIDocument
ids = uidoc.Selection.GetElementIds()

idd = [str(i) for i in ids]

if isinstance(idd, list) == True:
	elems = [doc.GetElement(ElementId(int(i))) for i in idd]
else:
	elems = doc.GetElement(ElementId(int(idd)))

OUT = elems
# ----------------------------------------

# group: Parameters name from language
parameters_name_from_language = Python()  # frozen
# ---------- parameters_name_from_language.python (18 lines) ----------
import clr
clr.AddReference('RevitServices')
import RevitServices
from RevitServices.Persistence import DocumentManager

uiapp = DocumentManager.Instance.CurrentUIApplication
app = uiapp.Application
lng = app.Language
rus = ["Тип","Имя семейства","Имя типа"]
enu = ["Type","Family name","Type name"]
out = []
if str(lng) == "Russian":
	out = rus
else:
	out = enu
#English_USA
#Russian
OUT = out
# ----------------------------------------

forceChildrensEval_2 = ForceChildrensEval()  # unwired: arg0
forceChildrensEval_3 = ForceChildrensEval()  # unwired: arg0
pys_get_revit_selection_2 = Python(IN[0]=forceChildrensEval_3)  # same code as pys_get_revit_selection
выбрать_элементы_select_m_elms = DSModelElementsSelection()  # "Выбрать элементы (Select M. Elms.) или выбрать прямо в ревите."
create = List.Create(pys_get_revit_selection_2, выбрать_элементы_select_m_elms)
flatten = Flatten(create)

# group: Собрать элементы из Групп
python_script = Python(IN[0]=flatten)
# ---------- python_script.python (23 lines) ----------
import clr
clr.AddReference('RevitAPI')
from Autodesk.Revit.DB import *

clr.AddReference("RevitNodes")
import Revit
clr.ImportExtensions(Revit.Elements)

groups = UnwrapElement(IN[0])
elementlist = list()
for item in groups:
	if item.Category.Name == "Группы модели":
		try:
			memberlist = list()
			for member in item.GetMemberIds():
				memberlist.append(item.Document.GetElement(member))
			elementlist.append(memberlist)
		except:
			elementlist.append(list())
	else:
		elementlist.append(item)
		
OUT = elementlist
# ----------------------------------------
flatten_2 = Flatten(python_script)

clean = List.Clean(list=flatten_2)
getCategory = Element.GetCategory(clean)
string_from_object = FromObject(getCategory)
список_категорий = StringInput("Стены")
code_block_2 = CodeBlock { ", "; }
split = String.Split(список_категорий, code_block_2)
containsItem = List.ContainsItem(list=string_from_object, item=split, lacing=CrossProduct)
allFalse = AllFalse(containsItem@L2)
filterByBoolMask = List.FilterByBoolMask(list=clean, mask=allFalse)
code_block_3 = CodeBlock(Flor=filterByBoolMask.out) { Flor; }
объединить_геометрию_filter = BoolSelector(true)
python_script_2 = Python()
# ---------- python_script_2.python (15 lines) ----------
import clr
import System
clr.AddReference('RevitAPI')
from Autodesk.Revit.DB import *
clr.AddReference("RevitNodes")
import Revit

bics = System.Enum.GetValues(BuiltInCategory)
cdata = []
for bic in bics:
	try:
		cdata.append((bic,ElementId(bic),Revit.Elements.Category.ById(ElementId(bic).IntegerValue)))
	except:
		pass
OUT = cdata
# ----------------------------------------
transpose = List.Transpose(python_script_2)
code_block_4 = CodeBlock(seq=transpose) { seq[0]; seq[2]; }
code_block_5 = CodeBlock(BuiltInCategories=code_block_4.out0) { BuiltInCategories; }
code_block_6 = CodeBlock(Categories=code_block_4.out1) { Categories; }
string_from_object_2 = FromObject(code_block_6)
containsItem_2 = List.ContainsItem(list=string_from_object_2, item=split, lacing=CrossProduct)
allFalse_2 = AllFalse(containsItem_2@L2)
filterByBoolMask_2 = List.FilterByBoolMask(list=code_block_5, mask=allFalse_2)
watch = Watch(filterByBoolMask_2.out)
filter_colector_by_list_0_8 = Python(IN[0]=forceChildrensEval_2, IN[1]=code_block_3, IN[2]=объединить_геометрию_filter, IN[3]=watch)
# ---------- filter_colector_by_list_0_8.python (81 lines) ----------
results = 0
from time import time
tic = time() # время для начала отсчета http://dynamobim.ru/forums/topic/раздутый-файл-dyn-callsitetracedata/#post-8050

if IN[2] == True:
	import clr
	
	clr.AddReference('RevitAPI')
	import Autodesk
	from Autodesk.Revit.DB import *
	
	clr.AddReference('RevitServices')
	import RevitServices
	from RevitServices.Persistence import DocumentManager
	from RevitServices.Transactions import TransactionManager
	
	clr.AddReference('System')
	from System.Collections.Generic import List
	
	def flatten_List(a, res=None):
		if res is None:
			res = []
		for i in a:
			if isinstance(a, list):
				flatten_List(i, res)
			else:
				res.append(i)
		return res
	
	opt = Options()
	doc = DocumentManager.Instance.CurrentDBDocument
	
	reset = IN[0]
	items1 = UnwrapElement(IN[1])
	buildinlist = UnwrapElement(IN[3])
	ids = []
	inter = []
	aliter = []
	alliter = []
	
	for i in items1:
		ids.append(i.Id)
		
	iids = List[ElementId](ids)

	for i1 in items1:	
		geomElem = i1.get_Geometry(opt)
		for geomObj in geomElem:
			ids.append(geomObj.ToString())
			if geomObj.ToString() == "Autodesk.Revit.DB.GeometryInstance":
				gsd = geomObj.GetInstanceGeometry()
				for g in gsd:
					if g != None: 
						geomSolid = g
					else:
						pass
				results = results + 1
			else:
				geomSolid = geomObj
		iter = []

		for ost in buildinlist:
			iter = []
			items = FilteredElementCollector(doc,iids).OfCategory(ost).WhereElementIsNotElementType()
			iter.append(items.WherePasses(ElementIntersectsSolidFilter(geomSolid)).ToElements())
			inter = flatten_List(iter)
			for int in inter:
				if int.Id.ToString() == i1.Id.ToString():
					pass
				else:
					TransactionManager.Instance.EnsureInTransaction(doc)
					if Autodesk.Revit.DB.JoinGeometryUtils.AreElementsJoined(doc,int,i1):
						pass
					else:
						Autodesk.Revit.DB.JoinGeometryUtils.JoinGeometry(doc,int,i1)
						results = results + 1
					TransactionManager.Instance.TransactionTaskDone()
					
toc = time() # время в конце
time = toc-tic
OUT = "Join elements = "+str(results), "Time in seconds = "+str(time)
# ----------------------------------------
forceChildrensEval_4 = ForceChildrensEval()  # unwired: arg0
code_block_7 = CodeBlock(Flor=filterByBoolMask.out) { Flor; }
объединить_геометрию_brute_force = BoolSelector(false)
brute_force_join = Python(IN[0]=forceChildrensEval_4, IN[1]=code_block_7, IN[2]=code_block_7, IN[3]=объединить_геометрию_brute_force)
# ---------- brute_force_join.python (44 lines) ----------
from time import time
tic = time() # время для начала отсчета
results = 0

if IN[3] == True:
	import clr

	clr.AddReference('ProtoGeometry')
	from Autodesk.DesignScript.Geometry import *
	
	clr.AddReference('RevitAPI')
	import Autodesk
	
	clr.AddReference('RevitServices')
	import RevitServices
	from RevitServices.Persistence import DocumentManager
	from RevitServices.Transactions import TransactionManager
	
	clr.AddReference("RevitNodes")
	import Revit
	clr.ImportExtensions(Revit.Elements)
	
	dataEnteringNode = IN
	
	reset = IN[0]
	items1 = UnwrapElement(IN[1])
	items2 = UnwrapElement(IN[2])
	
	doc = DocumentManager.Instance.CurrentDBDocument
	
	
	TransactionManager.Instance.EnsureInTransaction(doc)
	for item1 in items1:
		for item2 in items2:
			try:
				result = Autodesk.Revit.DB.JoinGeometryUtils.JoinGeometry(doc,item1,item2)
				results = results + 1
			except:
				pass
	TransactionManager.Instance.TransactionTaskDone()
	
toc = time() # время в конце
time = toc-tic
OUT = "Join elements = "+str(results), "Time = "+str(time)
# ----------------------------------------
create_2 = List.Create(filter_colector_by_list_0_8, brute_force_join)
flatten_3 = Flatten(create_2)
количество_объединённых = Watch(flatten_3)  # "Количество объединённых элементов"
