# Dynamo graph 0.Пакетное объединение массива_с выбором категорий_оптимизация_1.0.dyn (Dynamo 1.3.4.6666)

# note: ВСЁ ОСТАЛЬНОЕ

# group: ЗАПАСНЫЕ ВАРИАНТЫ, ДОПОЛНИТЕЛЬНЫЕ ОПЦИИ
# note: ДОПОЛНИТЕЛЬНЫЕ. Градации серово по важности, темнее - важнее
# note: ЗАПАСНЫЕ

# group: КЛЮЧЕВЫЕ МОМЕНТЫ РАБОТЫ 2
# note: НОДЫ РАБОТАЮЩИЕ С ДАННЫМИ
# note: ИСПОЛНИТЕЛЬНЫЕ НОДЫ

# group: КЛЮЧЕВЫЕ МОМЕНТЫ РАБОТЫ 1
# note: ИТОГОВАЯ КОНСОЛИДАЦИЯ ДАННЫХ

# group: ИСПОЛНИТЕЛЬНЫЕ НОДЫ (фильтрование, подбор, списки и т.д.)
# note: ИСПОЛНИТЕЛЬНЫЕ НОДЫ
# note: НОДЫ РАБОТАЮЩИЕ С ДАННЫМИ

# group: ЭЛЕМЕНТЫ УПРАВЛЕНИЯ 2 УРОВЕНЬ
# note: ПЕРЕМЕННЫЕ ЗНАЧЕНИЯ
# note: ЭЛЕМЕНТЫ УПРАВЛЕНИЯ

# group: ПЕРЕДАЁМ ИНФОРМАЦИЮ В РЕВИТ
# note: ПЕРЕДАЁМ ИНФОРМАЦИЮ В РЕВИТ

# group: ЭЛЕМЕНТЫ УПРАВЛЕНИЯ Dyno Studio
# note: Dyno Studio

# group: ЭЛЕМЕНТЫ УПРАВЛЕНИЯ
# note: ПЕРЕМЕННЫЕ ЗНАЧЕНИЯ
# note: ЭЛЕМЕНТЫ УПРАВЛЕНИЯ

# group: ПОЛУЧАЕМ ДАННЫЕ ИЗ РЕВИТ
# note: ПОЛУЧАЕМ ДАННЫЕ ИЗ РЕВИТ

# group: ПРОВЕРОЧНЫЕ НОДЫ
# note: ПРОВЕРОЧНЫЕ НОДЫ

# group: ПРИМЕЧАНИЯ ПО ЦВЕТОВОЙ ГРУППИРОВКЕ
# note: GUIDELINES

forceChildrensEval = ForceChildrensEval()  # unwired: arg0
pys_get_revit_selection = Python(IN[0]=forceChildrensEval)
# ---------- pys_get_revit_selection.python (22 lines) ----------
import clr
clr.AddReference('RevitServices')
clr.AddReference('RevitAPI')
from Autodesk.Revit.DB import *
import RevitServices
from RevitServices.Persistence import DocumentManager
from Autodesk.Revit.ApplicationServices import Application

reset = IN[0]

doc = DocumentManager.Instance.CurrentDBDocument
uidoc = DocumentManager.Instance.CurrentUIApplication.ActiveUIDocument
ids = uidoc.Selection.GetElementIds()

idd = [str(i) for i in ids]

if isinstance(idd, list) == True:
	elems = [doc.GetElement(ElementId(int(i))) for i in idd]
else:
	elems = doc.GetElement(ElementId(int(idd)))

OUT = elems
# ----------------------------------------
выбрать_элементы_select_m_elms = DSModelElementsSelection()  # "Выбрать элементы (Select M. Elms.) или выбрать прямо в ревите."
create = List.Create(pys_get_revit_selection, выбрать_элементы_select_m_elms)
flatten = Flatten(create)
clean = List.Clean(list=flatten)

# group: Собрать элементы из Групп и Сборок
не_учитывает_под_группы_в = Python(IN[0]=clean)  # "Не учитывает под. группы в группах"
# ---------- не_учитывает_под_группы_в.python (33 lines) ----------
import clr
clr.AddReference('RevitAPI')
from Autodesk.Revit.DB import ElementId, BuiltInCategory, Document
clr.AddReference("RevitServices")
from RevitServices.Persistence import DocumentManager

#clr.AddReference("RevitNodes")
#import Revit
#clr.ImportExtensions(Revit.Elements)

doc = DocumentManager.Instance.CurrentDBDocument

groups = UnwrapElement(IN[0])
#elementlist = list()

#elementlist = [item.Category.Id for item in groups]
elementlist = [[doc.GetElement(member) for member in item.GetMemberIds()] if item.Category.Id == ElementId(-2000095) or item.Category.Id == ElementId(-2000267) else item for item in groups ]
"""
for item in groups:
	if item != None:
		if item.Category.Name == BuiltInCategory.OST_IOSModelGroups or item.Category.Name == BuiltInCategory.OST_Assemblies:
			try:
				memberlist = list()
				for member in item.GetMemberIds():
					memberlist.append(item.Document.GetElement(member))
				elementlist.append(memberlist)
			except:
				elementlist.append(list())
		else:
			elementlist.append(item)
"""

OUT = elementlist
# ----------------------------------------
flatten_2 = Flatten(не_учитывает_под_группы_в)

clean_2 = List.Clean(list=flatten_2)
getCategory = Element.GetCategory(clean_2)
string_from_object = FromObject(getCategory)
список_категорий = StringInput("Стены")
code_block = CodeBlock { ", "; }
split = String.Split(список_категорий, code_block)
containsItem = List.ContainsItem(list=string_from_object, item=split, lacing=CrossProduct)
allFalse = AllFalse(containsItem@L2)
filterByBoolMask = List.FilterByBoolMask(list=clean_2, mask=allFalse)
setParameterByName = Element.SetParameterByName()  # unwired: element, parameterName, value
boolean = BoolSelector(true)  # frozen
code_block_2 = CodeBlock { 1; 2; }
if_ = Python(IN[0]=boolean, IN[1]=code_block_2.out0, IN[2]=code_block_2.out1)
# ---------- if_.python (12 lines) ----------
import clr
boolean = IN[0]
true = UnwrapElement(IN[1])
false = UnwrapElement(IN[2])

if boolean:
	out = true
else:
	out = false

#Назначьте вывод переменной OUT.
OUT = out
# ----------------------------------------
parameters = Element.Parameters()  # unwired: arg0
geometry = Element.Geometry()  # unwired: arg0
getParameterValueByName = Element.GetParameterValueByName()  # unwired: element, parameterName

# group: элементы внутри групп
members = Python()  # "Group.Members"; frozen; unwired: IN[0]
# ---------- members.python (19 lines) ----------
import clr
clr.AddReference('RevitAPI')
from Autodesk.Revit.DB import *

clr.AddReference("RevitNodes")
import Revit
clr.ImportExtensions(Revit.Elements)

groups = UnwrapElement(IN[0])
elementlist = list()
for item in groups:
	try:
		memberlist = list()
		for member in item.GetMemberIds():
			memberlist.append(item.Document.GetElement(member))
		elementlist.append(memberlist)
	except:
		elementlist.append(list())
OUT = elementlist
# ----------------------------------------

# group: Get Revit Selection:
forceChildrensEval_2 = ForceChildrensEval()  # frozen; unwired: arg0
pys_get_revit_selection_2 = Python(IN[0]=forceChildrensEval_2)  # same code as pys_get_revit_selection

# group: Parameters name from language
parameters_name_from_language = Python()  # frozen
# ---------- parameters_name_from_language.python (18 lines) ----------
import clr
clr.AddReference('RevitServices')
import RevitServices
from RevitServices.Persistence import DocumentManager

uiapp = DocumentManager.Instance.CurrentUIApplication
app = uiapp.Application
lng = app.Language
rus = ["Тип","Имя семейства","Имя типа"]
enu = ["Type","Family name","Type name"]
out = []
if str(lng) == "Russian":
	out = rus
else:
	out = enu
#English_USA
#Russian
OUT = out
# ----------------------------------------

forceChildrensEval_3 = ForceChildrensEval()  # unwired: arg0
список_категорий_2 = StringInput("Стены, Колонны")
python_script_фильтруем_элементы = Python(IN[0]=clean_2, IN[1]=список_категорий_2)  # "Python Script - Фильтруем элементы по именам категорий"
# ---------- python_script_фильтруем_элементы.python (12 lines) ----------
import clr
clr.AddReference('RevitAPI')
from Autodesk.Revit.DB import BuiltInParameter

elements = UnwrapElement(IN[0])
cats = UnwrapElement(IN[1])

filtred_elements = [e for e in elements if e.get_Parameter(BuiltInParameter.ELEM_CATEGORY_PARAM).AsValueString() in cats]
filtred_cats = [fe.get_Parameter(BuiltInParameter.ELEM_CATEGORY_PARAM).AsValueString() if not fe.get_Parameter(BuiltInParameter.DPART_ORIGINAL_CATEGORY) else fe.get_Parameter(BuiltInParameter.DPART_ORIGINAL_CATEGORY).AsString() for fe in filtred_elements ]

#OUT = [e for e in elements if e.get_Parameter(BuiltInParameter.ELEM_CATEGORY_PARAM).AsValueString() in cats]
OUT = (filtred_elements,filtred_cats)
# ----------------------------------------
code_block_3 = CodeBlock(Flor=python_script_фильтруем_элементы) { Flor[0]; }
объединить_геометрию_filter = BoolSelector(false)
python_script = Python()
# ---------- python_script.python (15 lines) ----------
import clr
import System
clr.AddReference('RevitAPI')
from Autodesk.Revit.DB import *
clr.AddReference("RevitNodes")
import Revit

bics = System.Enum.GetValues(BuiltInCategory)
cdata = []
for bic in bics:
	try:
		cdata.append((bic,ElementId(bic),Revit.Elements.Category.ById(ElementId(bic).IntegerValue)))
	except:
		pass
OUT = cdata
# ----------------------------------------
transpose = List.Transpose(python_script)
code_block_4 = CodeBlock(seq=transpose) { seq[0]; seq[2]; }
code_block_5 = CodeBlock(BuiltInCategories=code_block_4.out0) { BuiltInCategories; }
code_block_6 = CodeBlock(Categories=code_block_4.out1) { Categories; }
string_from_object_2 = FromObject(code_block_6)
containsItem_2 = List.ContainsItem(list=string_from_object_2, item=split, lacing=CrossProduct)
allFalse_2 = AllFalse(containsItem_2@L2)
filterByBoolMask_2 = List.FilterByBoolMask(list=code_block_5, mask=allFalse_2)
watch = Watch(filterByBoolMask_2.out)
filter_colector_by_list_0_8 = Python(IN[0]=forceChildrensEval_3, IN[1]=code_block_3, IN[2]=объединить_геометрию_filter, IN[3]=watch)
# ---------- filter_colector_by_list_0_8.python (81 lines) ----------
results = 0
from time import time
tic = time() # время для начала отсчета http://dynamobim.ru/forums/topic/раздутый-файл-dyn-callsitetracedata/#post-8050

if IN[2] == True:
	import clr
	
	clr.AddReference('RevitAPI')
	import Autodesk
	from Autodesk.Revit.DB import *
	
	clr.AddReference('RevitServices')
	import RevitServices
	from RevitServices.Persistence import DocumentManager
	from RevitServices.Transactions import TransactionManager
	
	clr.AddReference('System')
	from System.Collections.Generic import List
	
	def flatten_List(a, res=None):
		if res is None:
			res = []
		for i in a:
			if isinstance(a, list):
				flatten_List(i, res)
			else:
				res.append(i)
		return res
	
	opt = Options()
	doc = DocumentManager.Instance.CurrentDBDocument
	
	reset = IN[0]
	items1 = UnwrapElement(IN[1])
	buildinlist = UnwrapElement(IN[3])
	ids = []
	inter = []
	aliter = []
	alliter = []
	
	for i in items1:
		ids.append(i.Id)
		
	iids = List[ElementId](ids)

	for i1 in items1:	
		geomElem = i1.get_Geometry(opt)
		for geomObj in geomElem:
			ids.append(geomObj.ToString())
			if geomObj.ToString() == "Autodesk.Revit.DB.GeometryInstance":
				gsd = geomObj.GetInstanceGeometry()
				for g in gsd:
					if g != None: 
						geomSolid = g
					else:
						pass
				results = results + 1
			else:
				geomSolid = geomObj
		iter = []

		for ost in buildinlist:
			iter = []
			items = FilteredElementCollector(doc,iids).OfCategory(ost).WhereElementIsNotElementType()
			iter.append(items.WherePasses(ElementIntersectsSolidFilter(geomSolid)).ToElements())
			inter = flatten_List(iter)
			for int in inter:
				if int.Id.ToString() == i1.Id.ToString():
					pass
				else:
					TransactionManager.Instance.EnsureInTransaction(doc)
					if Autodesk.Revit.DB.JoinGeometryUtils.AreElementsJoined(doc,int,i1):
						pass
					else:
						Autodesk.Revit.DB.JoinGeometryUtils.JoinGeometry(doc,int,i1)
						results = results + 1
					TransactionManager.Instance.TransactionTaskDone()
					
toc = time() # время в конце
time = toc-tic
OUT = "Join elements = "+str(results), "Time in seconds = "+str(time)
# ----------------------------------------
forceChildrensEval_4 = ForceChildrensEval()  # unwired: arg0
объединить_геометрию_brute_force = BoolSelector(true)
brute_force_join = Python(IN[0]=forceChildrensEval_4, IN[1]=code_block_3, IN[2]=code_block_3, IN[3]=объединить_геометрию_brute_force)
# ---------- brute_force_join.python (44 lines) ----------
from time import time
tic = time() # время для начала отсчета
results = 0

if IN[3] == True:
	import clr

	clr.AddReference('ProtoGeometry')
	from Autodesk.DesignScript.Geometry import *
	
	clr.AddReference('RevitAPI')
	import Autodesk
	
	clr.AddReference('RevitServices')
	import RevitServices
	from RevitServices.Persistence import DocumentManager
	from RevitServices.Transactions import TransactionManager
	
	clr.AddReference("RevitNodes")
	import Revit
	clr.ImportExtensions(Revit.Elements)
	
	dataEnteringNode = IN
	
	reset = IN[0]
	items1 = UnwrapElement(IN[1])
	items2 = UnwrapElement(IN[2])
	
	doc = DocumentManager.Instance.CurrentDBDocument
	
	
	TransactionManager.Instance.EnsureInTransaction(doc)
	for item1 in items1:
		for item2 in items2:
			try:
				result = Autodesk.Revit.DB.JoinGeometryUtils.JoinGeometry(doc,item1,item2)
				results = results + 1
			except:
				pass
	TransactionManager.Instance.TransactionTaskDone()
	
toc = time() # время в конце
time = toc-tic
OUT = "Join elements = "+str(results), "Time = "+str(time)
# ----------------------------------------
create_2 = List.Create(filter_colector_by_list_0_8, brute_force_join)
flatten_3 = Flatten(create_2)
количество_объединённых = Watch(flatten_3)  # "Количество объединённых элементов"
список_категорий_3 = StringInput("Части, Окна, Панели витража, Несущие колонны, Ограждение")
