# Dynamo graph 00.М_Ungroup-Union-New-group.dyn (Dynamo 1.3.2.2480)

# note: ВСЁ ОСТАЛЬНОЕ

# group: КЛЮЧЕВЫЕ МОМЕНТЫ РАБОТЫ
# note: ИТОГОВАЯ КОНСОЛИДАЦИЯ ДАННЫХ

# group: ИСПОЛНИТЕЛЬНЫЕ НОДЫ (фильтрование, подбор, списки и т.д.)
# note: НОДЫ РАБОТАЮЩИЕ С ДАННЫМИ
# note: ИСПОЛНИТЕЛЬНЫЕ НОДЫ

# group: ЗАПАСНЫЕ ВАРИАНТЫ, ДОПОЛНИТЕЛЬНЫЕ ОПЦИИ
# note: ДОПОЛНИТЕЛЬНЫЕ. Градации серово по важности, темнее - важнее
# note: ЗАПАСНЫЕ

# group: ПРОВЕРОЧНЫЕ НОДЫ
# note: ПРОВЕРОЧНЫЕ НОДЫ

# group: ПЕРЕДАЁМ ИНФОРМАЦИЮ В РЕВИТ
# note: ПЕРЕДАЁМ ИНФОРМАЦИЮ В РЕВИТ

# group: ЭЛЕМЕНТЫ УПРАВЛЕНИЯ
# note: ПЕРЕМЕННЫЕ ЗНАЧЕНИЯ
# note: ЭЛЕМЕНТЫ УПРАВЛЕНИЯ

# group: ПОЛУЧАЕМ ДАННЫЕ ИЗ РЕВИТ
# note: ПОЛУЧАЕМ ДАННЫЕ ИЗ РЕВИТ

# group: ПРИМЕЧАНИЯ ПО ЦВЕТОВОЙ ГРУППИРОВКЕ
# note: GUIDELINES

forceChildrensEval = ForceChildrensEval()  # unwired: arg0

# group: Для элементов вне групп
forceChildrensEval_2 = ForceChildrensEval()  # unwired: arg0
pys_get_revit_selection = Python(IN[0]=forceChildrensEval_2)
# ---------- pys_get_revit_selection.python (22 lines) ----------
import clr
clr.AddReference('RevitServices')
clr.AddReference('RevitAPI')
from Autodesk.Revit.DB import *
import RevitServices
from RevitServices.Persistence import DocumentManager
from Autodesk.Revit.ApplicationServices import Application

reset = IN[0]

doc = DocumentManager.Instance.CurrentDBDocument
uidoc = DocumentManager.Instance.CurrentUIApplication.ActiveUIDocument
ids = uidoc.Selection.GetElementIds()

idd = [str(i) for i in ids]

if isinstance(idd, list) == True:
	elems = [doc.GetElement(ElementId(int(i))) for i in idd]
else:
	elems = doc.GetElement(ElementId(int(idd)))

OUT = elems
# ----------------------------------------

# group: Thanks to Andreas for this script Download clockwork for more
ungroupElements = Python(IN[0]=pys_get_revit_selection)  # "Group.UngroupElements"
# ---------- ungroupElements.python (34 lines) ----------
import clr
clr.AddReference('RevitAPI')
from Autodesk.Revit.DB import *

clr.AddReference("RevitNodes")
import Revit
clr.ImportExtensions(Revit.Elements)

clr.AddReference("RevitServices")
import RevitServices
from RevitServices.Persistence import DocumentManager
from RevitServices.Transactions import TransactionManager

doc = DocumentManager.Instance.CurrentDBDocument
groups = UnwrapElement(IN[0])
elementlist = []
for item in groups:
	try:
		memberlist = []
		for member in item.GetMemberIds():
			memberlist.append(doc.GetElement(member))
		elementlist.append(memberlist)
	except:
		elementlist.append(list())
		
TransactionManager.Instance.EnsureInTransaction(doc)
for group in groups:
	try:
		group.UngroupMembers()
	except:
		pass
TransactionManager.Instance.TransactionTaskDone()
		
OUT = elementlist
# ----------------------------------------

code_block = CodeBlock(elements=ungroupElements) { elements; }
getCategory = Element.GetCategory(code_block)
string_from_object = FromObject(getCategory)
code_block_2 = CodeBlock { "Стены"; }
eq = string_from_object == code_block_2
filterByBoolMask = List.FilterByBoolMask(list=code_block, mask=eq)
end = Revit.Transaction.Transaction.End(filterByBoolMask.in)
flatten = Flatten(end)
объединить_геометрию = BoolSelector(true)
python_script = Python(IN[0]=forceChildrensEval, IN[1]=flatten, IN[2]=flatten, IN[3]=объединить_геометрию)
# ---------- python_script.python (41 lines) ----------
if IN[3] == True:
	import clr

	clr.AddReference('ProtoGeometry')
	from Autodesk.DesignScript.Geometry import *
	
	clr.AddReference('RevitAPI')
	import Autodesk
	
	clr.AddReference('RevitServices')
	import RevitServices
	from RevitServices.Persistence import DocumentManager
	from RevitServices.Transactions import TransactionManager
	
	clr.AddReference("RevitNodes")
	import Revit
	clr.ImportExtensions(Revit.Elements)
	
	dataEnteringNode = IN
	
	reset = IN[0]
	items1 = UnwrapElement(IN[1])
	items2 = UnwrapElement(IN[2])
	newlist = []
	
	doc = DocumentManager.Instance.CurrentDBDocument
	
	results = 0
	
	TransactionManager.Instance.EnsureInTransaction(doc)
	for item1 in items1:
		for item2 in items2:
			try:
				result = Autodesk.Revit.DB.JoinGeometryUtils.JoinGeometry(doc,item1,item2)
				results = results + 1
			except:
				pass
		newlist.append(item1)
	TransactionManager.Instance.TransactionTaskDone()

OUT = newlist
# ----------------------------------------
start = Revit.Transaction.Transaction.Start(python_script)
flatten_2 = Flatten(start)
code_block_3 = CodeBlock(t4=pys_get_revit_selection) { t3 = t4.GetParameterValueByName("Тип"); t5 = t3.GetParameterValueByName("Имя типа"); }
string_from_object_2 = FromObject(code_block_3.t5)
прификс_к_имени_группы = StringInput(" (исп)")
code_block_4 = CodeBlock(name=string_from_object_2, x=прификс_к_имени_группы) { name+x; }
passthrough_clockwork = CodeBlock(passthrough=code_block_4, waitfor=flatten_2) { {passthrough,waitfor}[0]; }

# group: Пакет Prorubim
forceChildrensEval_3 = ForceChildrensEval()  # unwired: arg0

fromElements = Python(IN[0]=flatten_2, IN[1]=passthrough_clockwork, IN[2]=forceChildrensEval_3)  # "Group.FromElements"
# ---------- fromElements.python (28 lines) ----------
import clr
clr.AddReference('RevitAPI')
from Autodesk.Revit.DB import *
from System.Collections.Generic import *

clr.AddReference("RevitServices")
import RevitServices
from RevitServices.Persistence import DocumentManager
from RevitServices.Transactions import TransactionManager

doc = DocumentManager.Instance.CurrentDBDocument
items = UnwrapElement(IN[0])
newname = IN[1]
ids = list()
rejects = list()
for item in items:
	ids.append(item.Id)

items = List[ElementId](ids)

TransactionManager.Instance.EnsureInTransaction(doc)

group = doc.Create.NewGroup(items)
group.GroupType.Name = newname[0]

TransactionManager.Instance.TransactionTaskDone()

OUT = (group,newname)
# ----------------------------------------

# group: Get Revit Selection:
forceChildrensEval_4 = ForceChildrensEval()  # unwired: arg0
pys_get_revit_selection_2 = Python(IN[0]=forceChildrensEval_4)  # same code as pys_get_revit_selection
