# Dynamo graph 00.М_Изменение материалов и функций в типах стен (fix).dyn (Dynamo 1.2.1.3083)

# group: Get Revit Selection:
принудительный_перезапуск_python = ForceChildrensEval()  # unwired: arg0
элементы_выбранные_в_ревит = Python(IN[0]=принудительный_перезапуск_python)
# ---------- элементы_выбранные_в_ревит.python (22 lines) ----------
import clr
clr.AddReference('RevitServices')
clr.AddReference('RevitAPI')
from Autodesk.Revit.DB import *
import RevitServices
from RevitServices.Persistence import DocumentManager
from Autodesk.Revit.ApplicationServices import Application

reset = IN[0]

doc = DocumentManager.Instance.CurrentDBDocument
uidoc = DocumentManager.Instance.CurrentUIApplication.ActiveUIDocument
ids = uidoc.Selection.GetElementIds()

idd = [str(i) for i in ids]

if isinstance(idd, list) == True:
	elems = [doc.GetElement(ElementId(int(i))) for i in idd]
else:
	elems = doc.GetElement(ElementId(int(idd)))

OUT = elems
# ----------------------------------------

parameters = Element.Parameters(элементы_выбранные_в_ревит)
python_script_из_familytype = Python()  # "Python Script из "FamilyType.CompoundStructureLayers""; frozen; unwired: IN[0]
# ---------- python_script_из_familytype.python (56 lines) ----------
import clr
clr.AddReference('RevitAPI')
from Autodesk.Revit.DB import *

clr.AddReference("RevitNodes")
import Revit
clr.ImportExtensions(Revit.Elements)

items = UnwrapElement(IN[0])
elemlayers = list()
elemmat = list()
elemfunc = list()
elemwidth = list()
elemcore = list()
elemwraps = list()
elemvar = list()
elemdeck = list()

for item in items:
	try:
		counter = 0
		layers = list()
		layermat = list()
		layerfunc = list()
		layerwidth = list()
		layercore = list()
		layerwraps = list()
		layervar = list()
		layerdeck = list()
		compstruc = item.GetCompoundStructure()
		num = compstruc.LayerCount
		vertcomp = compstruc.IsVerticallyCompound
		varlayer = compstruc.VariableLayerIndex
		while counter < num:
			layers.append(compstruc.GetLayers()[counter])
			layermat.append(item.Document.GetElement(compstruc.GetMaterialId(counter)))
			layerfunc.append(compstruc.GetLayerFunction(counter))
			layerwidth.append(compstruc.GetLayerWidth(counter))
			layercore.append(compstruc.IsCoreLayer(counter))
			if compstruc.IsCoreLayer(counter): layerwraps.append(False)
			else: layerwraps.append(compstruc.ParticipatesInWrapping(counter))
			if varlayer == counter: layervar.append(True)
			else: layervar.append(False)
			layerdeck.append(compstruc.IsStructuralDeck(counter))
			counter += 1
	except:
		pass
	elemlayers.append(layers)
	elemmat.append(layermat)
	elemfunc.append(layerfunc)
	elemwidth.append(layerwidth)
	elemcore.append(layercore)
	elemwraps.append(layerwraps)
	elemvar.append(layervar)
	elemdeck.append(layerdeck)
OUT = (elemlayers, elemmat, elemfunc, elemwidth, elemcore, elemwraps, elemvar, elemdeck)
# ----------------------------------------
# note: 0 = Finish1
# 1 = Finish2
# 2 = Insulation
# 3 = Substrate
# 4 = Structure
функция_которую_надо_заменить = IntegerSlider(4, range=0..4 step 1)
новая_функция = IntegerSlider(3, range=0..4 step 1)
поиск_и_замена_выбранной_функции = Python(IN[0]=принудительный_перезапуск_python, IN[1]=элементы_выбранные_в_ревит, IN[2]=функция_которую_надо_заменить, IN[3]=новая_функция)  # "Поиск и замена выбранной функции на новую"; frozen
# ---------- поиск_и_замена_выбранной_функции.python (45 lines) ----------
import clr

clr.AddReference('RevitServices')
from RevitServices.Persistence import DocumentManager
from RevitServices.Transactions import TransactionManager
doc = DocumentManager.Instance.CurrentDBDocument

clr.AddReference('RevitNodes')
import Revit
clr.ImportExtensions(Revit.Elements)

clr.AddReference('RevitAPI')
from Autodesk.Revit.DB import *

memb = MaterialFunctionAssignment.Membrane
fin1 = MaterialFunctionAssignment.Finish1
fin2 = MaterialFunctionAssignment.Finish2
ins = MaterialFunctionAssignment.Insulation
sub = MaterialFunctionAssignment.Substrate
str = MaterialFunctionAssignment.Structure

reset = IN[0]
types = UnwrapElement(IN[1])
fnd = IN[2]
apl = IN[3]
strlist = [fin1, fin2, ins, sub, str]
fndfunc = strlist[fnd]
aplfunc = strlist[apl]
outs = []

TransactionManager.Instance.EnsureInTransaction(doc)

for t in types:
	cs = t.GetCompoundStructure()
	num = cs.LayerCount
	for i in range(num):
		cur_fn = cs.GetLayerFunction(i)
		if cur_fn == fndfunc:
			outs.append(aplfunc)
			cs.SetLayerFunction(i, aplfunc)
			t.SetCompoundStructure(cs)

TransactionManager.Instance.TransactionTaskDone()

OUT = outs;
# ----------------------------------------
количество_замен = CodeBlock(out=поиск_и_замена_выбранной_функции) { out; }
имена_функций_в_списке = Python(IN[0]=принудительный_перезапуск_python, IN[1]=новая_функция)  # frozen
# ---------- имена_функций_в_списке.python (27 lines) ----------
import clr

clr.AddReference('RevitServices')
from RevitServices.Persistence import DocumentManager
from RevitServices.Transactions import TransactionManager
doc = DocumentManager.Instance.CurrentDBDocument

clr.AddReference('RevitNodes')
import Revit
clr.ImportExtensions(Revit.Elements)

clr.AddReference('RevitAPI')
from Autodesk.Revit.DB import *

memb = MaterialFunctionAssignment.Membrane
fin1 = MaterialFunctionAssignment.Finish1
fin2 = MaterialFunctionAssignment.Finish2
ins = MaterialFunctionAssignment.Insulation
sub = MaterialFunctionAssignment.Substrate
str = MaterialFunctionAssignment.Structure

reset = IN[0]
int = IN[1]
strlist = [fin1, fin2, ins, sub, str]
outs = strlist[int]

OUT = outs;
# ----------------------------------------
# note: НОДЫ УПРАВЛЕНИЯ
номер_слоя_нумерация_dynamo = IntegerSlider(1, range=0..10 step 1)  # "Номер слоя (Нумерация DYNAMO, Revit+1)"
число_или_список = CodeBlock(x=номер_слоя_нумерация_dynamo) { {x}; {0,6}; }
новая_функция_2 = IntegerSlider(0, range=0..4 step 1)
установка_функции_слоя_по_его = Python(IN[0]=принудительный_перезапуск_python, IN[1]=элементы_выбранные_в_ревит, IN[2]=число_или_список.out0, IN[3]=новая_функция_2)  # "Установка функции слоя по его порядковому номеру, или списку номеров"; frozen
# ---------- установка_функции_слоя_по_его.python (40 lines) ----------
import clr

clr.AddReference('RevitServices')
from RevitServices.Persistence import DocumentManager
from RevitServices.Transactions import TransactionManager
doc = DocumentManager.Instance.CurrentDBDocument

clr.AddReference('RevitNodes')
import Revit
clr.ImportExtensions(Revit.Elements)

clr.AddReference('RevitAPI')
from Autodesk.Revit.DB import *

memb = MaterialFunctionAssignment.Membrane
fin1 = MaterialFunctionAssignment.Finish1
fin2 = MaterialFunctionAssignment.Finish2
ins = MaterialFunctionAssignment.Insulation
sub = MaterialFunctionAssignment.Substrate
str = MaterialFunctionAssignment.Structure

types = UnwrapElement(IN[1])
ilist = UnwrapElement(IN[2])
apl = IN[3]
strlist = [fin1, fin2, ins, sub, str]
aplfunc = strlist[apl]
outs = []

TransactionManager.Instance.EnsureInTransaction(doc)

for i in ilist:
	for t in types:
	    cs = t.GetCompoundStructure()
	    cs.SetLayerFunction(i, aplfunc)
	    t.SetCompoundStructure(cs)
	    outs.append(aplfunc)

TransactionManager.Instance.TransactionTaskDone()

OUT = outs;
# ----------------------------------------
количество_замен_2 = CodeBlock(out=установка_функции_слоя_по_его) { out; }
# note: ВЫПОЛНЯЮЩИЕ НОДЫ (замена функции)
установка_функции_слоя_по_его_2 = Python(IN[0]=принудительный_перезапуск_python, IN[1]=элементы_выбранные_в_ревит, IN[2]=номер_слоя_нумерация_dynamo, IN[3]=новая_функция_2)  # "Установка функции слоя по его порядковому номеру"; frozen
# ---------- установка_функции_слоя_по_его_2.python (38 lines) ----------
import clr

clr.AddReference('RevitServices')
from RevitServices.Persistence import DocumentManager
from RevitServices.Transactions import TransactionManager
doc = DocumentManager.Instance.CurrentDBDocument

clr.AddReference('RevitNodes')
import Revit
clr.ImportExtensions(Revit.Elements)

clr.AddReference('RevitAPI')
from Autodesk.Revit.DB import *

memb = MaterialFunctionAssignment.Membrane
fin1 = MaterialFunctionAssignment.Finish1
fin2 = MaterialFunctionAssignment.Finish2
ins = MaterialFunctionAssignment.Insulation
sub = MaterialFunctionAssignment.Substrate
str = MaterialFunctionAssignment.Structure

types = UnwrapElement(IN[1])
i = IN[2]
apl = IN[3]
strlist = [fin1, fin2, ins, sub, str]
aplfunc = strlist[apl]
outs = []

TransactionManager.Instance.EnsureInTransaction(doc)

for t in types:
    cs = t.GetCompoundStructure()
    cs.SetLayerFunction(i, aplfunc)
    t.SetCompoundStructure(cs)
    outs.append(aplfunc)

TransactionManager.Instance.TransactionTaskDone()
OUT = outs;
# ----------------------------------------
# note: НОДЫ ПРОВЕРКИ
compoundStructureLayers = Custom[FamilyType.CompoundStructureLayers](elementType=элементы_выбранные_в_ревит)  # Retrieves the compound layers of any layered family type (wall types, roof types, floor types etc.)
code_block = CodeBlock(core=compoundStructureLayers.isCore) { core; }
code_block_2 = CodeBlock(func=compoundStructureLayers.functions) { func; }
code_block_3 = CodeBlock(mat=compoundStructureLayers.materials) { mat; }
name = Material.Name(code_block_3)
