# Dynamo graph 1.Запись в параметр стены, информации из помещения1.3.dyn (Dynamo 1.3.0.875)

all_elements_in_active_view = ElementsInView()
getCategory = Element.GetCategory(all_elements_in_active_view)
string_from_object = FromObject(getCategory)
code_block = CodeBlock { "Помещения"; "Стены"; }
eq = string_from_object == code_block.out0
filterByBoolMask = List.FilterByBoolMask(list=all_elements_in_active_view, mask=eq)
code_block_2 = CodeBlock { "Имя"; "Автостоянка"; }
getParameterValueByName = Element.GetParameterValueByName(element=filterByBoolMask.in, parameterName=code_block_2.out0)
eq_2 = getParameterValueByName == code_block_2.out1
filterByBoolMask_2 = List.FilterByBoolMask(list=filterByBoolMask.in, mask=eq_2)
code_block_3 = CodeBlock(rom=filterByBoolMask_2.out) { rom; }
watch = Watch(code_block_3)
string = StringInput("Площадь")
getParameterValueByName_2 = Element.GetParameterValueByName(element=watch, parameterName=string)
сумма_по_полу = Math.Sum(getParameterValueByName_2)
eq_3 = string_from_object == code_block.out1
filterByBoolMask_3 = List.FilterByBoolMask(list=all_elements_in_active_view, mask=eq_3)
code_block_4 = CodeBlock(walls_on_view=filterByBoolMask_3.in) { walls_on_view; }
code_block_5 = CodeBlock { "Тип"; "отделка"; true; }
getParameterValueByName_3 = Element.GetParameterValueByName(element=code_block_4, parameterName=code_block_5.out0)
string_from_object_2 = FromObject(getParameterValueByName_3)
contains = String.Contains(str=string_from_object_2, searchFor=code_block_5.out1, ignoreCase=code_block_5.out2)
filterByBoolMask_4 = List.FilterByBoolMask(list=code_block_4, mask=contains)
code_block_6 = CodeBlock { 0; }

# group: Tool.GetSurroundingElements
code_block_7 = CodeBlock(Eleent=watch) { Eleent; }
code_block_8 = CodeBlock(ElementCheck=filterByBoolMask_4.in) { ElementCheck; }
code_block_9 = CodeBlock(item=code_block_8) { Flatten({item}); }
code_block_10 = CodeBlock(Tolerance=code_block_6) { Tolerance; }
flatten = Flatten()  # unwired: arg0
count = List.Count()  # unwired: arg0
code_block_11 = CodeBlock { 1; }
code_block_12 = CodeBlock { Flatten({item}); }  # unwired: item

flatten_2 = Flatten(code_block_7)

# group (continued): Tool.GetSurroundingElements
python_script = Python(IN[0]=flatten_2, IN[1]=code_block_9, IN[2]=code_block_10)
# ---------- python_script.python (62 lines) ----------
#python nodes in dynamo 1.0
#proposed by Julien Benoit @jbenoit44 
#http://aecuandme.wordpress.com/
import clr
clr.AddReference('ProtoGeometry')
from Autodesk.DesignScript.Geometry import *
# Import ToDSType(bool) extension method
clr.AddReference("RevitNodes")
import Revit
clr.ImportExtensions(Revit.Elements)
# Import geometry conversion extension methods
clr.ImportExtensions(Revit.GeometryConversion)
# Import DocumentManager and TransactionManager
clr.AddReference("RevitServices")
import RevitServices
from RevitServices.Persistence import DocumentManager
from RevitServices.Transactions import TransactionManager
from System.Collections.Generic import *
# Import RevitAPI
clr.AddReference("RevitAPI")
import Autodesk
from Autodesk.Revit.DB import *
import itertools
import operator

doc = DocumentManager.Instance.CurrentDBDocument
uiapp = DocumentManager.Instance.CurrentUIApplication
app = uiapp.Application
uidoc=DocumentManager.Instance.CurrentUIApplication.ActiveUIDocument
activeV=doc.ActiveView

host = []
finst=[]
finstID=[]
for i in IN[0]:
	host.append(UnwrapElement(i))
for i in IN[1]:
	finst.append(UnwrapElement(i))
for i in IN[1]:
	finstID.append(UnwrapElement(i).Id)	


superset=[]
hloop=[]


for h in host:
	collection = List[ElementId](finstID)
	collector=FilteredElementCollector(doc,collection)
	a=h.BoundingBox[activeV]
	c=Outline (a.Min,a.Max)
	d=BoundingBoxIntersectsFilter(c,float(IN[2]))
	e=collector.WherePasses(d).ToElements()
	setlist=[]
	hostlist=[]
	hostlist.append(h)
	setlist.append(e)
	all_lists = [hostlist,setlist]
	c=reduce(operator.add, all_lists)
	superset.append(c)
		
OUT=superset
# ----------------------------------------
map = List.Map(list=python_script, f_x=flatten)
map_2 = List.Map(list=map, f_x=count)
gt = map_2 > code_block_11
filterByBoolMask_5 = List.FilterByBoolMask(list=map, mask=gt)

deconstruct = List.Deconstruct(list=filterByBoolMask_5.in@L2)
geometry = Element.Geometry(deconstruct.rest)
code_block_13 = CodeBlock { 1; }
gt_2 = getParameterValueByName_2 > code_block_13
filterByBoolMask_6 = List.FilterByBoolMask(list=watch, mask=gt_2)
geometry_2 = Element.Geometry(filterByBoolMask_6.in)
code_block_14 = CodeBlock(walls=deconstruct.rest) { walls; }
code_block_15 = CodeBlock { "Номер помещения"; "Номер функции"; "Имя"; "Наименование помещения"; }
getParameterValueByName_4 = Element.GetParameterValueByName(element=deconstruct.first, parameterName=code_block_15.out0)
count_2 = Count(deconstruct.rest@L2)
ofRepeatedItem = List.OfRepeatedItem(item=getParameterValueByName_4@L1, amount=count_2@L1)
setParameterByName = Element.SetParameterByName(element=code_block_14, parameterName=code_block_15.out0, value=ofRepeatedItem, lacing=Longest)
getParameterValueByName_5 = Element.GetParameterValueByName(element=deconstruct.first, parameterName=code_block_15.out1)
ofRepeatedItem_2 = List.OfRepeatedItem(item=getParameterValueByName_5@L1, amount=count_2@L1)
setParameterByName_2 = Element.SetParameterByName(element=setParameterByName, parameterName=code_block_15.out1, value=ofRepeatedItem_2, lacing=Longest)
getParameterValueByName_6 = Element.GetParameterValueByName(element=deconstruct.first, parameterName=code_block_15.out2)
setParameterByName_3 = Element.SetParameterByName(element=setParameterByName_2, parameterName=code_block_15.out3, value=getParameterValueByName_6, lacing=Longest)
