# Dynamo graph 2.Суммарная длинна стен.dyn (Dynamo 1.3.2.2480)

# group: КЛЮЧЕВЫЕ МОМЕНТЫ РАБОТЫ
# note: ИТОГОВАЯ КОНСОЛИДАЦИЯ ДАННЫХ

# group: ЗАПАСНЫЕ ВАРИАНТЫ, ДОПОЛНИТЕЛЬНЫЕ ОПЦИИ
# note: ДОПОЛНИТЕЛЬНЫЕ. Градации серово по важности, темнее - важнее
# note: ЗАПАСНЫЕ

# group: ИСПОЛНИТЕЛЬНЫЕ НОДЫ (фильтрование, подбор, списки и т.д.)
# note: НОДЫ РАБОТАЮЩИЕ С ДАННЫМИ
# note: ИСПОЛНИТЕЛЬНЫЕ НОДЫ

# group: ЭЛЕМЕНТЫ УПРАВЛЕНИЯ
# note: ПЕРЕМЕННЫЕ ЗНАЧЕНИЯ
# note: ЭЛЕМЕНТЫ УПРАВЛЕНИЯ

# group: ПОЛУЧАЕМ ДАННЫЕ ИЗ РЕВИТ
# note: ПОЛУЧАЕМ ДАННЫЕ ИЗ РЕВИТ

# group: ПРОВЕРОЧНЫЕ НОДЫ
# note: ПРОВЕРОЧНЫЕ НОДЫ

# group: ПЕРЕДАЁМ ИНФОРМАЦИЮ В РЕВИТ
# note: ПЕРЕДАЁМ ИНФОРМАЦИЮ В РЕВИТ

# group: ПРИМЕЧАНИЯ ПО ЦВЕТОВОЙ ГРУППИРОВКЕ
# note: GUIDELINES

# group: Get Revit Selection:
# note: ВСЁ ОСТАЛЬНОЕ
forceChildrensEval = ForceChildrensEval()  # unwired: arg0
pys_get_revit_selection = Python(IN[0]=forceChildrensEval)
# ---------- pys_get_revit_selection.python (22 lines) ----------
import clr
clr.AddReference('RevitServices')
clr.AddReference('RevitAPI')
from Autodesk.Revit.DB import *
import RevitServices
from RevitServices.Persistence import DocumentManager
from Autodesk.Revit.ApplicationServices import Application

reset = IN[0]

doc = DocumentManager.Instance.CurrentDBDocument
uidoc = DocumentManager.Instance.CurrentUIApplication.ActiveUIDocument
ids = uidoc.Selection.GetElementIds()

idd = [str(i) for i in ids]

if isinstance(idd, list) == True:
	elems = [doc.GetElement(ElementId(int(i))) for i in idd]
else:
	elems = doc.GetElement(ElementId(int(idd)))

OUT = elems
# ----------------------------------------

wall_location_line = Python(IN[0]=pys_get_revit_selection)
# ---------- wall_location_line.python (16 lines) ----------
import clr
import math
clr.AddReference('RevitAPI')
from Autodesk.Revit.DB import *

clr.AddReference("RevitNodes")
import Revit
clr.ImportExtensions(Revit.GeometryConversion)

items = UnwrapElement(IN[0])
curves = list()

for item in items:
	loc = item.Location
	curves.append(loc.Curve.ToProtoType())
OUT = curves
# ----------------------------------------
flatten = Flatten(wall_location_line)
group_curves_archi_lab = Python(IN[0]=flatten)
# ---------- group_curves_archi_lab.python (35 lines) ----------
#Copyright(c) 2015, Konrad Sobon
# @arch_laboratory, http://archi-lab.net

import clr
clr.AddReference('ProtoGeometry')
from Autodesk.DesignScript.Geometry import *

#The inputs to this node will be stored as a list in the IN variable.
dataEnteringNode = IN

inputCurves = IN[0]

#join/group curves function
def groupCurves(Line_List): 
	ignore_distance = 0.1 # Assume points this close or closer to each other are touching 
	Grouped_Lines = [] 
	Queue = set() 
	while Line_List: 
		Shape = [] 
		Queue.add(Line_List.pop()) # Move a line from the Line_List to our queue 
		while Queue: 
			Current_Line = Queue.pop() 
			Shape.append(Current_Line) 
			for Potential_Match in Line_List: 
				Points = (Potential_Match.StartPoint, Potential_Match.EndPoint)
				for P1 in Points: 
					for P2 in (Current_Line.StartPoint, Current_Line.EndPoint): 
						distance = P1.DistanceTo(P2) 
						if distance <= ignore_distance: 
							Queue.add(Potential_Match) 
			Line_List = [item for item in Line_List if item not in Queue]
		Grouped_Lines.append(Shape) 
	return Grouped_Lines

OUT = groupCurves(inputCurves)
# ----------------------------------------
byJoinedCurves = PolyCurve.ByJoinedCurves(group_curves_archi_lab)
length = Curve.Length(byJoinedCurves)
code_block = CodeBlock(l=length) { Math.Round((l/1000),4); }
сумма_по_группам_в_м_п = Watch(code_block)
sum = Math.Sum(сумма_по_группам_в_м_п)
суммарная_длинна_в_м_п = Watch(sum)
