# Dynamo graph 3.Создание отделочных стен по помещениям1.0.dyn (Dynamo 1.3.4.6666)

# group: ЭЛЕМЕНТЫ УПРАВЛЕНИЯ
# note: ПЕРЕМЕННЫЕ ЗНАЧЕНИЯ
# note: ЭЛЕМЕНТЫ УПРАВЛЕНИЯ

# group: ПОЛУЧАЕМ ДАННЫЕ
# note: ПОЛУЧАЕМ ДАННЫЕ ИЗ РЕВИТ и других источников

# group: ЭЛЕМЕНТЫ УПРАВЛЕНИЯ 2 УРОВЕНЬ
# note: ЭЛЕМЕНТЫ УПРАВЛЕНИЯ
# note: ПЕРЕМЕННЫЕ ЗНАЧЕНИЯ

# group: ПРОВЕРОЧНЫЕ НОДЫ
# note: ПРОВЕРОЧНЫЕ НОДЫ

# group: Python ноды
# note: Python

# group: КЛЮЧЕВЫЕ МОМЕНТЫ РАБОТЫ 1
# note: КОНСОЛИДАЦИЯ И СЛОЖНЫЕ ОБРАБОТКИ

# group: ИСПОЛНИТЕЛЬНЫЕ НОДЫ (фильтрование, подбор, списки и т.д.)
# note: ИСПОЛНИТЕЛЬНЫЕ НОДЫ

# group: ПЕРЕДАЁМ ИНФОРМАЦИЮ
# note: ПЕРЕДАЁМ ИНФОРМАЦИЮ В РЕВИТ
# note: ПЕРЕДАЁМ ИНФОРМАЦИЮ ЕЩЁ КУДА-ТО

# group: ЗАПАСНЫЕ ВАРИАНТЫ, ДОПОЛНИТЕЛЬНЫЕ ОПЦИИ
# note: ЗАПАСНЫЕ
# note: ДОПОЛНИТЕЛЬНЫЕ. Градации серово по важности, темнее - важнее

# group: КЛЮЧЕВЫЕ МОМЕНТЫ РАБОТЫ 2
# note: УСЛОЖНЕНЫЕ КОНСТРУКЦИИ
# note: УСЛОЖНЕННЫЕ КОНСТРУКЦИИ

# group: Запуск питона из внешнего файла
# note: Py - files

# group: ПРИМЕЧАНИЯ ПО ЦВЕТОВОЙ ГРУППИРОВКЕ
# note: GUIDELINES

с_фильтрацией_10 = BoolSelector(true)

# group: Get Revit Selection:
forceChildrensEval = ForceChildrensEval()  # unwired: arg0
pys_get_revit_selection = Python(IN[0]=forceChildrensEval)
# ---------- pys_get_revit_selection.python (22 lines) ----------
import clr
clr.AddReference('RevitServices')
clr.AddReference('RevitAPI')
from Autodesk.Revit.DB import *
import RevitServices
from RevitServices.Persistence import DocumentManager
from Autodesk.Revit.ApplicationServices import Application

reset = IN[0]

doc = DocumentManager.Instance.CurrentDBDocument
uidoc = DocumentManager.Instance.CurrentUIApplication.ActiveUIDocument
ids = uidoc.Selection.GetElementIds()

idd = [str(i) for i in ids]

if isinstance(idd, list) == True:
	elems = [doc.GetElement(ElementId(int(i))) for i in idd]
else:
	elems = doc.GetElement(ElementId(int(idd)))

OUT = elems
# ----------------------------------------

getCategory = Element.GetCategory(pys_get_revit_selection)
string_from_object = FromObject(getCategory)
code_block = CodeBlock { "Помещения"; }
equals = Equals(string_from_object, code_block)
filterByBoolMask = List.FilterByBoolMask(list=pys_get_revit_selection, mask=equals)
code_block_2 = CodeBlock { "Отделка стен"; "Полная высота"; }
getParameterValueByName = Element.GetParameterValueByName(element=filterByBoolMask.in, parameterName=code_block_2.out0)
code_block_3 = CodeBlock { ""; }
equals_2 = Equals(getParameterValueByName, code_block_3)
filterByBoolMask_2 = List.FilterByBoolMask(list=filterByBoolMask.in, mask=equals_2)
forceChildrensEval_2 = ForceChildrensEval()  # unwired: arg0
python_script = Python(IN[0]=filterByBoolMask_2.out, IN[1]=code_block_2.out0, IN[2]=code_block_2.out1, IN[3]=forceChildrensEval_2)  # frozen
# ---------- python_script.python (194 lines) ----------
# This node has been made by Modelical
# www.modelical.com

import clr
clr.AddReference('ProtoGeometry')
from Autodesk.DesignScript.Geometry import *

#Load Dynamo wrappers
clr.AddReference("RevitNodes")
import Revit
from Revit.Elements import *
clr.ImportExtensions(Revit.GeometryConversion)
clr.ImportExtensions(Revit.Elements)

#Load Revit API
clr.AddReference('RevitAPI')
from Autodesk.Revit.DB import *
import Autodesk

#Load document reference
clr.AddReference("RevitServices")
import RevitServices
from RevitServices.Persistence import DocumentManager
from RevitServices.Transactions import TransactionManager

doc = DocumentManager.Instance.CurrentDBDocument
uiapp = DocumentManager.Instance.CurrentUIApplication
app = uiapp.Application

def toList(input):
	if isinstance(input,list) == False:
		return [input]
	else:
		return input

def flatten(x):
    result = []
    for el in x:
        if hasattr(el, "__iter__") and not isinstance(el, basestring):
            result.extend(flatten(el))
        else:
            result.append(el)
    return result

rooms = flatten(toList(IN[0]))
wfParam = IN[1]
whParam = IN[2]

#Get room boundaries, elements and disjoined curves
roomElems = []
disjoinedCurves = []
options = Autodesk.Revit.DB.SpatialElementBoundaryOptions()
roomBounds = []
wHeights = []

for r in rooms:
	roomBounds.append(UnwrapElement(r).GetBoundarySegments(options))

for rb in roomBounds:
	tempCrvList = []
	for closedCrv in rb:
		tempCCCrvList = []
		for elem in closedCrv:
			if doc.GetElement(elem.ElementId) is None:
				roomElems.append(None)
				tempCCCrvList.append(elem.GetCurve().ToProtoType())
			else:
				roomElems.append(doc.GetElement(elem.ElementId))
				rwall = doc.GetElement(elem.ElementId)
				tempCCCrvList.append(elem.GetCurve().ToProtoType())
				if rwall is not None and rwall.Category.Name.ToString() == "Стены" and rwall.WallType.Kind != WallKind.Curtain:
					wHeights.append(UnwrapElement(rwall).GetParameterValueByName(whParam))
		tempCrvList.append(tempCCCrvList)
	disjoinedCurves.append(tempCrvList)

#Join curves in polycurves
joinedCurves = []
for d in disjoinedCurves:
	tempList = []
	for item in d:
		tempList.append(PolyCurve.ByJoinedCurves(item))
	joinedCurves.append(tempList)

#Check the sense of the polycurve
for j in joinedCurves:
	for crv in j:
		if crv.BasePlane().Normal.Z > 0:
			crv = crv
		else:
			crv = crv.Reverse()

repeatedRooms = []
count = 0
for j in joinedCurves:
	tempList = []
	for crv in j:
		tempList.append(rooms[count])
	repeatedRooms.append(tempList)
	count += 1

joinedCurves = flatten(joinedCurves)
repeatedRooms = flatten(repeatedRooms)


#Retrieve wallTypes and heights
wTypes = []

allWallTypes = FilteredElementCollector(doc).OfClass(WallType)
for r in repeatedRooms:
	for wt in allWallTypes:
		if Element.Name.__get__(wt) == r.GetParameterValueByName(wfParam):
			wTypes.append(wt.ToDSType(True))

#Retrieve the level of each room
levels = []
for r in repeatedRooms:
	levels.append(UnwrapElement(r).Level)

#Create an offseted curve to place finishes. Wall by curve are modeled by Wall Centerline
offsetedCurves = []
count = 0
for j in joinedCurves:
	if UnwrapElement(repeatedRooms[count]).IsPointInRoom(j.Offset(wTypes[count].GetParameterValueByName("Ширина")*0.5,False).StartPoint.ToXyz()) == True:
		offsetedCurves.append(j.Offset(wTypes[count].GetParameterValueByName("Ширина")*0.5,False))
	else:
		offsetedCurves.append(j.Offset(wTypes[count].GetParameterValueByName("Ширина")*-0.5,False))
	count +=1

explodedCurves = []
for oc in offsetedCurves:
	explodedCurves.append(oc.Explode())

#Create walls on top of the curves with fixed height
wHeightsList = [] #List of height for each wall
distances = [] #distance to move a probe point to check the paralel wall
walls = []

TransactionManager.Instance.EnsureInTransaction(doc)
count = 0
for group in explodedCurves:
	for crv in group:
		if crv.Length > 10:
			w = Wall.Create(doc, crv.ToRevitType(), UnwrapElement(wTypes[count]).Id, UnwrapElement(levels[count]).Id, 5, 0, True, False)
			wHeightsList.append(wHeights[count])
			walls.append(w.ToDSType(False))
	count +=1
TransactionManager.Instance.TransactionTaskDone()

#Change the height of the walls to meet requirements, change Location line to Finish Face Exterior and turn off Room Bounding
count = 0
for w in walls:
	w.SetParameterByName("Неприсоединенная высота", wHeightsList[count])
	w.SetParameterByName("Линия привязки", 2)
	w.SetParameterByName("Граница помещения", 1)
	#Here is the best location to add any room parameter to the walls p.e. Room Number
	#w.SetParameterByName("RoomNumber", UnwrapElement(repeatedRooms[count]).GetParameterValueByName(Number))
	count +=1

#If the suport wall has inserts, this will join it to the finish wall.
#If the suport wall is a curtain wall, this will delete the finish associated to it.
newwalls = []
oldwalls = []
newwallH = []

TransactionManager.Instance.EnsureInTransaction(doc)
count = 0
"""
for r in roomElems:
	if r is not None and r.Category.Name.ToString() == "Стены" and r.WallType.Kind == WallKind.Curtain:
		doc.Delete(walls[count].Id)
	if r is not None and r.Category.Name.ToString() == "<Разделитель помещений>":
		doc.Delete(UnwrapElement(walls[count]).Id)
	if r is not None and r.Category.Name.ToString() == "Стены" and len(r.FindInserts(True, True, True, True)) != 0:
		JoinGeometryUtils.JoinGeometry(doc, UnwrapElement(walls[count]), UnwrapElement(r))
	count +=1
"""

for w in walls:
	if roomElems[count] is not None and roomElems[count].Category.Name.ToString() == "Стены" and roomElems[count].WallType.Kind == WallKind.Curtain:
		doc.Delete(UnwrapElement(w).Id)
	if roomElems[count] is not None and roomElems[count].Category.Name.ToString() == "<Разделитель помещений>":
		doc.Delete(UnwrapElement(w).Id)
	if roomElems[count] is not None and roomElems[count].Category.Name.ToString() == "Стены" and len(roomElems[count].FindInserts(True, True, True, True)) != 0:
		JoinGeometryUtils.JoinGeometry(doc, UnwrapElement(w), UnwrapElement(roomElems[count]))
	count +=1


TransactionManager.Instance.TransactionTaskDone()

#OUT = walls, offsetedCurves, explodedCurves, roomElems

#OUT = newwalls, oldwalls

OUT = roomElems, walls
# ----------------------------------------
python_script_2 = Python()  # frozen; unwired: IN[0], IN[1], IN[2], IN[3], IN[4]
# ---------- python_script_2.python (192 lines) ----------
# This node has been made by Modelical
# www.modelical.com

import clr
clr.AddReference('ProtoGeometry')
from Autodesk.DesignScript.Geometry import *

#Load Dynamo wrappers
clr.AddReference("RevitNodes")
import Revit
from Revit.Elements import *
clr.ImportExtensions(Revit.GeometryConversion)
clr.ImportExtensions(Revit.Elements)

#Load Revit API
clr.AddReference('RevitAPI')
from Autodesk.Revit.DB import *
import Autodesk

#Load document reference
clr.AddReference("RevitServices")
import RevitServices
from RevitServices.Persistence import DocumentManager
from RevitServices.Transactions import TransactionManager

doc = DocumentManager.Instance.CurrentDBDocument
uiapp = DocumentManager.Instance.CurrentUIApplication
app = uiapp.Application

def toList(input):
	if isinstance(input,list) == False:
		return [input]
	else:
		return input

def flatten(x):
    result = []
    for el in x:
        if hasattr(el, "__iter__") and not isinstance(el, basestring):
            result.extend(flatten(el))
        else:
            result.append(el)
    return result

rooms = flatten(toList(IN[0]))
wfParam = IN[1]
whParam = IN[2]
whight = IN[4]

#Get room boundaries, elements and disjoined curves
roomElems = []
disjoinedCurves = []
options = Autodesk.Revit.DB.SpatialElementBoundaryOptions()
roomBounds = []
for r in rooms:
	roomBounds.append(UnwrapElement(r).GetBoundarySegments(options))

for rb in roomBounds:
	tempCrvList = []
	for closedCrv in rb:
		tempCCCrvList = []
		for elem in closedCrv:
			if doc.GetElement(elem.ElementId) is None:
				roomElems.append(None)
				tempCCCrvList.append(elem.GetCurve().ToProtoType())
			else:
				roomElems.append(doc.GetElement(elem.ElementId))
				tempCCCrvList.append(elem.GetCurve().ToProtoType())
		tempCrvList.append(tempCCCrvList)
	disjoinedCurves.append(tempCrvList)

#Join curves in polycurves
joinedCurves = []
for d in disjoinedCurves:
	tempList = []
	for item in d:
		tempList.append(PolyCurve.ByJoinedCurves(item))
	joinedCurves.append(tempList)

#Check the sense of the polycurve
for j in joinedCurves:
	for crv in j:
		if crv.BasePlane().Normal.Z > 0:
			crv = crv
		else:
			crv = crv.Reverse()

repeatedRooms = []
count = 0
for j in joinedCurves:
	tempList = []
	for crv in j:
		tempList.append(rooms[count])
	repeatedRooms.append(tempList)
	count += 1

joinedCurves = flatten(joinedCurves)
repeatedRooms = flatten(repeatedRooms)


#Retrieve wallTypes and heights
wTypes = []
wHeights = []

allWallTypes = FilteredElementCollector(doc).OfClass(WallType)
for r in repeatedRooms:
	wHeights.append(r.GetParameterValueByName(whParam))
	for wt in allWallTypes:
		if Element.Name.__get__(wt) == r.GetParameterValueByName(wfParam):
			wTypes.append(wt.ToDSType(True))

#Retrieve the level of each room
levels = []
for r in repeatedRooms:
	levels.append(UnwrapElement(r).Level)

#Create an offseted curve to place finishes. Wall by curve are modeled by Wall Centerline
offsetedCurves = []
count = 0
for j in joinedCurves:
	if UnwrapElement(repeatedRooms[count]).IsPointInRoom(j.Offset(wTypes[count].GetParameterValueByName("Ширина")*0.5,False).StartPoint.ToXyz()) == True:
		offsetedCurves.append(j.Offset(wTypes[count].GetParameterValueByName("Ширина")*0.5,False))
	else:
		offsetedCurves.append(j.Offset(wTypes[count].GetParameterValueByName("Ширина")*-0.5,False))
	count +=1

explodedCurves = []
for oc in offsetedCurves:
	explodedCurves.append(oc.Explode())

#Create walls on top of the curves with fixed height
wHeightsList = [] #List of height for each wall
distances = [] #distance to move a probe point to check the paralel wall
walls = []

TransactionManager.Instance.EnsureInTransaction(doc)
count = 0
for group in explodedCurves:
	for crv in group:
		if crv.Length > 10:
			w = Wall.Create(doc, crv.ToRevitType(), UnwrapElement(wTypes[count]).Id, UnwrapElement(levels[count]).Id, 5, 0, True, False)
			wHeightsList.append(wHeights[count])
			walls.append(w.ToDSType(False))
	count +=1
TransactionManager.Instance.TransactionTaskDone()

#Change the height of the walls to meet requirements, change Location line to Finish Face Exterior and turn off Room Bounding
count = 0
for w in walls:
	w.SetParameterByName("Неприсоединенная высота", whight)
	w.SetParameterByName("Линия привязки", 2)
	w.SetParameterByName("Граница помещения", 1)
	#Here is the best location to add any room parameter to the walls p.e. Room Number
	#w.SetParameterByName("RoomNumber", UnwrapElement(repeatedRooms[count]).GetParameterValueByName(Number))
	count +=1

#If the suport wall has inserts, this will join it to the finish wall.
#If the suport wall is a curtain wall, this will delete the finish associated to it.
newwalls = []
oldwalls = []
newwallH = []

TransactionManager.Instance.EnsureInTransaction(doc)
count = 0
"""
for r in roomElems:
	if r is not None and r.Category.Name.ToString() == "Стены" and r.WallType.Kind == WallKind.Curtain:
		doc.Delete(walls[count].Id)
	if r is not None and r.Category.Name.ToString() == "<Разделитель помещений>":
		doc.Delete(UnwrapElement(walls[count]).Id)
	if r is not None and r.Category.Name.ToString() == "Стены" and len(r.FindInserts(True, True, True, True)) != 0:
		JoinGeometryUtils.JoinGeometry(doc, UnwrapElement(walls[count]), UnwrapElement(r))
	count +=1
"""

for w in walls:
	if roomElems[count] is not None and roomElems[count].Category.Name.ToString() == "Стены" and roomElems[count].WallType.Kind == WallKind.Curtain:
		doc.Delete(UnwrapElement(w).Id)
	if roomElems[count] is not None and roomElems[count].Category.Name.ToString() == "<Разделитель помещений>":
		doc.Delete(UnwrapElement(w).Id)
	if roomElems[count] is not None and roomElems[count].Category.Name.ToString() == "Стены" and len(roomElems[count].FindInserts(True, True, True, True)) != 0:
		JoinGeometryUtils.JoinGeometry(doc, UnwrapElement(w), UnwrapElement(roomElems[count]))
	count +=1


TransactionManager.Instance.TransactionTaskDone()

#OUT = walls, offsetedCurves, explodedCurves, roomElems

#OUT = newwalls, oldwalls

OUT = roomElems, walls
# ----------------------------------------
if_ = Python(IN[0]=с_фильтрацией_10, IN[1]=python_script, IN[2]=python_script_2)
# ---------- if_.python (12 lines) ----------
import clr
boolean = IN[0]
true = UnwrapElement(IN[1])
false = UnwrapElement(IN[2])

if boolean:
	out = true
else:
	out = false

#Назначьте вывод переменной OUT.
OUT = out
# ----------------------------------------
python_script_3 = Python(IN[0]=filterByBoolMask_2.out, IN[1]=code_block_2.out0, IN[2]=code_block_2.out1, IN[3]=forceChildrensEval_2)  # frozen
# ---------- python_script_3.python (190 lines) ----------
# This node has been made by Modelical
# www.modelical.com

import clr
clr.AddReference('ProtoGeometry')
from Autodesk.DesignScript.Geometry import *

#Load Dynamo wrappers
clr.AddReference("RevitNodes")
import Revit
from Revit.Elements import *
clr.ImportExtensions(Revit.GeometryConversion)
clr.ImportExtensions(Revit.Elements)

#Load Revit API
clr.AddReference('RevitAPI')
from Autodesk.Revit.DB import *
import Autodesk

#Load document reference
clr.AddReference("RevitServices")
import RevitServices
from RevitServices.Persistence import DocumentManager
from RevitServices.Transactions import TransactionManager

doc = DocumentManager.Instance.CurrentDBDocument
uiapp = DocumentManager.Instance.CurrentUIApplication
app = uiapp.Application

def toList(input):
	if isinstance(input,list) == False:
		return [input]
	else:
		return input

def flatten(x):
    result = []
    for el in x:
        if hasattr(el, "__iter__") and not isinstance(el, basestring):
            result.extend(flatten(el))
        else:
            result.append(el)
    return result

rooms = flatten(toList(IN[0]))
wfParam = IN[1]
whParam = IN[2]

#Get room boundaries, elements and disjoined curves
roomElems = []
disjoinedCurves = []
options = Autodesk.Revit.DB.SpatialElementBoundaryOptions()
roomBounds = []
for r in rooms:
	roomBounds.append(UnwrapElement(r).GetBoundarySegments(options))

for rb in roomBounds:
	tempCrvList = []
	for closedCrv in rb:
		tempCCCrvList = []
		for elem in closedCrv:
			if doc.GetElement(elem.ElementId) is None:
				roomElems.append(None)
				tempCCCrvList.append(elem.GetCurve().ToProtoType())
			else:
				roomElems.append(doc.GetElement(elem.ElementId))
				tempCCCrvList.append(elem.GetCurve().ToProtoType())
		tempCrvList.append(tempCCCrvList)
	disjoinedCurves.append(tempCrvList)

#Join curves in polycurves
joinedCurves = []
for d in disjoinedCurves:
	tempList = []
	for item in d:
		tempList.append(PolyCurve.ByJoinedCurves(item))
	joinedCurves.append(tempList)

#Check the sense of the polycurve
for j in joinedCurves:
	for crv in j:
		if crv.BasePlane().Normal.Z > 0:
			crv = crv
		else:
			crv = crv.Reverse()

repeatedRooms = []
count = 0
for j in joinedCurves:
	tempList = []
	for crv in j:
		tempList.append(rooms[count])
	repeatedRooms.append(tempList)
	count += 1

joinedCurves = flatten(joinedCurves)
repeatedRooms = flatten(repeatedRooms)


#Retrieve wallTypes and heights
wTypes = []
wHeights = []

allWallTypes = FilteredElementCollector(doc).OfClass(WallType)
for r in repeatedRooms:
	wHeights.append(r.GetParameterValueByName(whParam))
	for wt in allWallTypes:
		if Element.Name.__get__(wt) == r.GetParameterValueByName(wfParam):
			wTypes.append(wt.ToDSType(True))

#Retrieve the level of each room
levels = []
for r in repeatedRooms:
	levels.append(UnwrapElement(r).Level)

#Create an offseted curve to place finishes. Wall by curve are modeled by Wall Centerline
offsetedCurves = []
count = 0
for j in joinedCurves:
	if UnwrapElement(repeatedRooms[count]).IsPointInRoom(j.Offset(wTypes[count].GetParameterValueByName("Ширина")*0.5,False).StartPoint.ToXyz()) == True:
		offsetedCurves.append(j.Offset(wTypes[count].GetParameterValueByName("Ширина")*0.5,False))
	else:
		offsetedCurves.append(j.Offset(wTypes[count].GetParameterValueByName("Ширина")*-0.5,False))
	count +=1

explodedCurves = []
for oc in offsetedCurves:
	explodedCurves.append(oc.Explode())

#Create walls on top of the curves with fixed height
wHeightsList = [] #List of height for each wall
distances = [] #distance to move a probe point to check the paralel wall
walls = []

TransactionManager.Instance.EnsureInTransaction(doc)
count = 0
for group in explodedCurves:
	for crv in group:
		w = Wall.Create(doc, crv.ToRevitType(), UnwrapElement(wTypes[count]).Id, UnwrapElement(levels[count]).Id, 5, 0, True, False)
		wHeightsList.append(wHeights[count])
		walls.append(w.ToDSType(False))
	count +=1
TransactionManager.Instance.TransactionTaskDone()

#Change the height of the walls to meet requirements, change Location line to Finish Face Exterior and turn off Room Bounding
count = 0
for w in walls:
	w.SetParameterByName("Неприсоединенная высота", wHeightsList[count])
	w.SetParameterByName("Линия привязки", 2)
	w.SetParameterByName("Граница помещения", 1)
	#Here is the best location to add any room parameter to the walls p.e. Room Number
	#w.SetParameterByName("RoomNumber", UnwrapElement(repeatedRooms[count]).GetParameterValueByName(Number))
	count +=1

#If the suport wall has inserts, this will join it to the finish wall.
#If the suport wall is a curtain wall, this will delete the finish associated to it.
newwalls = []
oldwalls = []
newwallH = []

TransactionManager.Instance.EnsureInTransaction(doc)
count = 0
"""
for r in roomElems:
	if r is not None and r.Category.Name.ToString() == "Стены" and r.WallType.Kind == WallKind.Curtain:
		doc.Delete(walls[count].Id)
	if r is not None and r.Category.Name.ToString() == "<Разделитель помещений>":
		doc.Delete(UnwrapElement(walls[count]).Id)
	if r is not None and r.Category.Name.ToString() == "Стены" and len(r.FindInserts(True, True, True, True)) != 0:
		JoinGeometryUtils.JoinGeometry(doc, UnwrapElement(walls[count]), UnwrapElement(r))
	count +=1
"""

for w in walls:
	if roomElems[count] is not None and roomElems[count].Category.Name.ToString() == "Стены" and roomElems[count].WallType.Kind == WallKind.Curtain:
		doc.Delete(UnwrapElement(w).Id)
	if roomElems[count] is not None and roomElems[count].Category.Name.ToString() == "<Разделитель помещений>":
		doc.Delete(UnwrapElement(w).Id)
	if roomElems[count] is not None and roomElems[count].Category.Name.ToString() == "Стены" and len(roomElems[count].FindInserts(True, True, True, True)) != 0:
		JoinGeometryUtils.JoinGeometry(doc, UnwrapElement(w), UnwrapElement(roomElems[count]))
	count +=1


TransactionManager.Instance.TransactionTaskDone()

#OUT = walls, offsetedCurves, explodedCurves, roomElems

#OUT = newwalls, oldwalls

OUT = roomElems, walls
# ----------------------------------------

# group: Get Revit Selection:
forceChildrensEval_3 = ForceChildrensEval()  # frozen; unwired: arg0
pys_get_revit_selection_2 = Python(IN[0]=forceChildrensEval_3)  # same code as pys_get_revit_selection

parameters = Element.Parameters()  # unwired: arg0
# note: ВСЁ ОСТАЛЬНОЕ
getParameterValueByName_2 = Element.GetParameterValueByName()  # unwired: element, parameterName
categories = Categories()  # frozen
all_elements_of_category = ElementsOfCategory(categories)
boolean = BoolSelector(true)  # frozen
code_block_4 = CodeBlock { 1; 2; }
if_2 = Python(IN[0]=boolean, IN[1]=code_block_4.out0, IN[2]=code_block_4.out1)  # same code as if_
geometry = Element.Geometry()  # unwired: arg0
setParameterByName = Element.SetParameterByName()  # unwired: element, parameterName, value

# group: Parameters name from language
parameters_name_from_language = Python()  # frozen
# ---------- parameters_name_from_language.python (18 lines) ----------
import clr
clr.AddReference('RevitServices')
import RevitServices
from RevitServices.Persistence import DocumentManager

uiapp = DocumentManager.Instance.CurrentUIApplication
app = uiapp.Application
lng = app.Language
rus = ["Тип","Имя семейства","Имя типа"]
enu = ["Type","Family name","Type name"]
out = []
if str(lng) == "Russian":
	out = rus
else:
	out = enu
#English_USA
#Russian
OUT = out
# ----------------------------------------

# group: элементы внутри групп
members = Python()  # "Group.Members"; frozen; unwired: IN[0]
# ---------- members.python (19 lines) ----------
import clr
clr.AddReference('RevitAPI')
from Autodesk.Revit.DB import *

clr.AddReference("RevitNodes")
import Revit
clr.ImportExtensions(Revit.Elements)

groups = UnwrapElement(IN[0])
elementlist = list()
for item in groups:
	try:
		memberlist = list()
		for member in item.GetMemberIds():
			memberlist.append(item.Document.GetElement(member))
		elementlist.append(memberlist)
	except:
		elementlist.append(list())
OUT = elementlist
# ----------------------------------------

members_2 = Python()  # "Object.Members"; frozen; unwired: IN[0]
# ---------- members_2.python (14 lines) ----------
import clr

items = IN[0]
elementlist = list()

try:
	clr.AddReference('RevitAPI')
	from Autodesk.Revit.DB import *
	for item in items:
		elementlist.append(dir(UnwrapElement(item)))
except:
	for item in items:
		elementlist.append(dir(item))
OUT = elementlist
# ----------------------------------------
путь_к_файлу_python = Filename(".\N.Отделка помещений_сбор элементов вокруг_1.7.py")  # frozen
forceChildrensEval_4 = ForceChildrensEval(путь_к_файлу_python)
forceChildrensEval_5 = ForceChildrensEval(путь_к_файлу_python)
find_file_and_import_it = Python(IN[0]=forceChildrensEval_5)
# ---------- find_file_and_import_it.python (11 lines) ----------
import sys
sys.path.append('C:\Program Files (x86)\IronPython 2.7\Lib')
import codecs

try:
	filePath = IN[0]
	with codecs.open(filePath, 'rb', "utf-8") as inf:
		lines = inf.readlines()
	OUT = ''.join(lines)
except:
	OUT = "No file"
# ----------------------------------------
python_script_from_string = PythonStringNode(script=find_file_and_import_it)  # unwired: IN[0]
regenerate = Python()  # frozen; unwired: IN[0]
# ---------- regenerate.python (26 lines) ----------
import clr

# Import DocumentManager and TransactionManager
clr.AddReference("RevitServices")
import RevitServices
from RevitServices.Persistence import DocumentManager


# Import RevitAPI
clr.AddReference("RevitAPI")
import Autodesk
from Autodesk.Revit.DB import *

doc = DocumentManager.Instance.CurrentDBDocument


#The inputs to this node will be stored as a list in the IN variable.
list = IN[0]


if list:
	doc.Regenerate()
	out = "Regeneration complete"
else:
	out = "fail"
OUT = out
# ----------------------------------------
filteredElementCollector = Python()  # frozen; unwired: IN[0]
# ---------- filteredElementCollector.python (29 lines) ----------
if IN[1]:
	import clr
	
	# Import DocumentManager and TransactionManager
	clr.AddReference("RevitServices")
	import RevitServices
	from RevitServices.Persistence import DocumentManager
	
	
	# Import RevitAPI
	clr.AddReference("RevitAPI")
	import Autodesk
	from Autodesk.Revit.DB import *
	
	doc = DocumentManager.Instance.CurrentDBDocument
	uiapp = DocumentManager.Instance.CurrentUIApplication
	app = uiapp.Application
	
	from System.Collections.Generic import *
	
	
	#The inputs to this node will be stored as a list in the IN variable.
	dataEnteringNode = IN
	collector = FilteredElementCollector(doc)
	elements = collector.OfCategory(BuiltInCategory.OST_Views).ToElements()
	
	OUT = sheetInstances
else:
	OUT = "скрипт не выполнен"
# ----------------------------------------
shablon_python_shablon = Python()  # frozen; unwired: IN[0]
# ---------- shablon_python_shablon.python (77 lines) ----------
# -*- coding: utf-8 -*- 
#-----------------------Импоорт библиотек----------------------
import clr
clr.AddReference('RevitAPI')
import Autodesk
from Autodesk.Revit.DB import *

clr.AddReference("RevitNodes") 
import Revit
from Revit.Elements import *

clr.ImportExtensions(Revit.Elements) #ToDSType не работает без
clr.ImportExtensions(Revit.GeometryConversion) #ToXyz не работает без

clr.AddReference("RevitServices")
import RevitServices
from RevitServices.Persistence import DocumentManager
from RevitServices.Transactions import TransactionManager

clr.AddReference('ProtoGeometry')
from Autodesk.DesignScript.Geometry import *

#-----------------------ИМПОРТ БИБЛИОТЕК----------------------
"""-"""
#-----------------------ФУНКЦИИ----------------------

def __x__(x):
	x="x"
	return x
	
#-----------------------ФУНКЦИИ----------------------
"""-"""
#-----------------------АПИ ПАРАМЕТРЫ----------------------

doc = DocumentManager.Instance.CurrentDBDocument
#link_doc = UnwrapElement(IN[1])
#uiapp = DocumentManager.Instance.CurrentUIApplication
#app = uiapp.Application
#version = app.VersionNumber
#options = Autodesk.Revit.DB.SpatialElementBoundaryOptions()
calculator = SpatialElementGeometryCalculator(doc)

g_id_list = []
g_id_list.append(ElementId(group))

bxList = List[ElementId](g_id_list) #АЙ ЛИСТ КОЛЕКТИОН
move = Transform.CreateTranslation(-wall.Orientation*2) #смещение
cl.CreateTransformed(move)

#-----------------------АПИ ПАРАМЕТРЫ----------------------
"""-"""
#-----------------------РАБОЧИЕ ПАРАМЕТРЫ----------------------

rooms = UnwrapElement(IN[0])

#-----------------------РАБОЧИЕ ПАРАМЕТРЫ----------------------	
"""-"""
#-----------------------ТЕСТОВЫЕ ПАРАМЕТРЫ----------------------

test = []

#-----------------------ТЕСТОВЫЕ ПАРАМЕТРЫ----------------------
"""-"""
#-----------------------НАЧАЛО СКРИПТА----------------------

x = 0
if rooms == None:
	rooms = [0,0]

for room in rooms:
	x=__x__(x)+__x__(x)
#TransactionManager.Instance.EnsureInTransaction(doc)
#TransactionManager.Instance.TransactionTaskDone()
#TransactionManager.Instance.ForceCloseTransaction()
#-----------------------КОНЕЦ СКРИПТА----------------------

OUT = x
# ----------------------------------------
select_model_elements = DSModelElementsSelection()
id = Element.Id(select_model_elements)
forceChildrensEval_6 = ForceChildrensEval(id)
warningSwallower = Python(IN[0]=forceChildrensEval_6)  # frozen
# ---------- warningSwallower.python (138 lines) ----------
# -*- coding: utf-8 -*- 
#-----------------------Импоорт библиотек----------------------
import clr
clr.AddReference('RevitAPI')
import Autodesk
from Autodesk.Revit.DB import *
from Autodesk.Revit.DB.Analysis import *
from Autodesk.Revit.DB.Events import *
from Autodesk.Revit.Creation import *


clr.AddReference("RevitNodes") 
import Revit
from Revit.Elements import *

clr.ImportExtensions(Revit.Elements) #ToDSType не работает без
clr.ImportExtensions(Revit.GeometryConversion) #ToXyz не работает без

clr.AddReference("RevitServices")
import RevitServices
from RevitServices.Persistence import DocumentManager
from RevitServices.Transactions import TransactionManager

clr.AddReference('ProtoGeometry')
from Autodesk.DesignScript.Geometry import *

import System
from System import Type,Byte,DateTime,Text,IO
clr.AddReference('System')
from System.Collections.Generic import List



class WarningSwallower(IFailuresPreprocessor):
	def PreprocessFailures(self, failuresAccessor):
		fail_list = List[FailureMessageAccessor]()
		fail_acc_list = failuresAccessor.GetFailureMessages().GetEnumerator()
		fail_id_list = failuresAccessor.GetFailureMessages().GetFailingElementIds()
		for failure in fail_acc_list:
			failuresAccessor.ResolveFailure(failure)
			failuresAccessor.DeleteWarning(failure)
			test = 1
		return FailureProcessingResult.Continue	
		

class WarningSwallower2(IFailuresProcessor):
	def ProcessFailures(self, failuresAccessor):
		resolutionTypeList = List[FailureResolutionType]()
		#fail_list = List[FailureMessageAccessor]()
		fail_list = failuresAccessor.GetFailureMessages()
		errorString = ""
		hasFailures = False
		for failure in fail_list:
			resolutionTypeList = failuresAccessor.GetAttemptedResolutionTypes(failure)
			if resolutionTypeList.Count >= 3:
				TaskDialog.Show("Error", "Cannot resolve failures - transaction will be rolled back.")
				return FailureProcessingResult.ProceedWithRollBack
			errorString += "IDs "
			for id in failure.GetFailingElementIds():
				errorString += id.ToString() + ", "
				hasFailures = True
			errorString += "\nWill be deleted because: " + failure.GetDescriptionText() + "\n"
			failuresAccessor.DeleteElements(failure.GetFailingElementIds())
		
		if hasFailures:
			TaskDialog.Show("Error", errorString)
			return FailureProcessingResult.ProceedWithCommit
		return FailureProcessingResult.Continue
	def Dismiss(self, doc):
	
		"""
		fail_list = List[FailureMessageAccessor]()
		fail_acc_list = failuresAccessor.GetFailureMessages().GetEnumerator()
		fail_id_list = failuresAccessor.GetFailureMessages().GetFailingElementIds()
		for failure in fail_acc_list:
			failuresAccessor.ResolveFailure(failure)
			failuresAccessor.DeleteWarning(failure)
			test = 1
		return FailureProcessingResult.ProceedWithCommit#Continue	
		"""
#-----------------------ИМПОРТ БИБЛИОТЕК----------------------
"""-"""
#-----------------------ФУНКЦИИ----------------------

def __x__(x):
	x="x"
	return x
	
#-----------------------ФУНКЦИИ----------------------
"""-"""
#-----------------------АПИ ПАРАМЕТРЫ----------------------

current_doc = DocumentManager.Instance.CurrentDBDocument
#link_doc = UnwrapElement(IN[1])
#uiapp = DocumentManager.Instance.CurrentUIApplication
#app = uiapp.Application
#version = app.VersionNumber
#options = Autodesk.Revit.DB.SpatialElementBoundaryOptions()
#calculator = SpatialElementGeometryCalculator(doc)


#-----------------------АПИ ПАРАМЕТРЫ----------------------
"""-"""
#-----------------------РАБОЧИЕ ПАРАМЕТРЫ----------------------

ids = UnwrapElement(IN[0])
ids_ilist = List[ElementId]()

for i in ids:
	ids_ilist.Add(ElementId(i))
	
trf = Transform.Identity
test = []
#-----------------------НАЧАЛО СКРИПТА----------------------
#ElementTransformUtils.CopyElements(current_doc,ids_ilist,current_doc,trf,CopyPasteOptions())


TransactionManager.Instance.ForceCloseTransaction()
tx = Transaction(current_doc, "working")
tx.Start()
options = tx.GetFailureHandlingOptions()
options.SetFailuresPreprocessor(WarningSwallower2())
tx.SetFailureHandlingOptions(options)
ElementTransformUtils.CopyElements(current_doc,ids_ilist,current_doc,trf,CopyPasteOptions())
tx.Commit()
"""
fail_acces = FailuresProcessingEventArgs.GetFailuresAccessor()
options = FailuresAccessor.GetFailureHandlingOptions(fail_acces)
options.SetFailuresPreprocessor(WarningSwallower())
FailuresAccessor.SetFailureHandlingOptions(options)

TransactionManager.Instance.EnsureInTransaction(current_doc)
ElementTransformUtils.CopyElements(current_doc,ids_ilist,current_doc,trf,CopyPasteOptions())
TransactionManager.Instance.TransactionTaskDone()
"""
#-----------------------КОНЕЦ СКРИПТА----------------------

OUT = test
# ----------------------------------------
forceChildrensEval_7 = ForceChildrensEval(select_model_elements)
warningSwallower_2 = Python(IN[0]=forceChildrensEval_7)
# ---------- warningSwallower_2.python (50 lines) ----------
# -*- coding: utf-8 -*- 
#-----------------------Импоорт библиотек----------------------
import clr
clr.AddReference('RevitAPI')
import Autodesk
from Autodesk.Revit.DB import *
from Autodesk.Revit.DB.Analysis import *
from Autodesk.Revit.DB.Events import *
from Autodesk.Revit.Creation import *


clr.AddReference("RevitServices")
import RevitServices
from RevitServices.Persistence import DocumentManager
from RevitServices.Transactions import TransactionManager

import System
from System import Type,Byte,DateTime,Text,IO
clr.AddReference('System')
from System.Collections.Generic import List

def parametersnapshot2(x):
	parameters = x.Parameters
	paramnames = [p.Definition.Name for p in parameters]
	sortedindex = sorted(range(len(paramnames)), key = lambda k : paramnames[k])
	sortedparameters = [paramnames[i] for i in sortedindex]
	paramvalues = [p.AsString() if p.AsString() != None else p.AsValueString() for p in parameters]	
	sortedvalues = [paramvalues[i] for i in sortedindex]
	return ', '.join(['%s : %s' % (param,value) for param,value in zip(sortedparameters,sortedvalues)])	

def p1(x):
	parameters = x.Parameters
	return [p.Definition.Name for p in parameters]	

def p2(x):
	parameters = x.Parameters
	return [[p.AsValueString(),p.Definition.Name,p.Definition.ParameterGroup] for p in parameters]	

date_and_time = DateTime.Now.ToString()

elems = UnwrapElement(IN[0])
test = []

for e in elems:
	#test.append(p1(e))
	test.append(p2(e))

date_and_time2 = DateTime.Now.ToString()

OUT = date_and_time,date_and_time2,test
# ----------------------------------------
путь_к_файлу_python_2 = Filename("..\..\Z.Тест\Отделка помещения стенами.py")
forceChildrensEval_8 = ForceChildrensEval(путь_к_файлу_python_2)
find_file_and_import_it_2 = Python(IN[0]=forceChildrensEval_8)  # same code as find_file_and_import_it
number = DoubleInput(3200)
python_script_from_string_2 = PythonStringNode(script=find_file_and_import_it_2, IN[0]=filterByBoolMask_2.out, IN[1]=code_block_2.out0, IN[2]=code_block_2.out1, IN[3]=forceChildrensEval_2, IN[4]=number)
