# Dynamo graph 3.Создание стен по линиям V0.4 (только вертикальные и горизонтальные лини, использовать Flip для правильной ориентации).dyn (Dynamo 1.3.2.2480)

# note: ВСЁ ОСТАЛЬНОЕ

# group: ЭЛЕМЕНТЫ УПРАВЛЕНИЯ
# note: ПЕРЕМЕННЫЕ ЗНАЧЕНИЯ
# note: ЭЛЕМЕНТЫ УПРАВЛЕНИЯ

# group: ПОЛУЧАЕМ ДАННЫЕ ИЗ РЕВИТ
# note: ПОЛУЧАЕМ ДАННЫЕ ИЗ РЕВИТ

# group: ПРОВЕРОЧНЫЕ НОДЫ
# note: ПРОВЕРОЧНЫЕ НОДЫ

# group: КЛЮЧЕВЫЕ МОМЕНТЫ РАБОТЫ 1
# note: ИТОГОВАЯ КОНСОЛИДАЦИЯ ДАННЫХ

# group: ИСПОЛНИТЕЛЬНЫЕ НОДЫ (фильтрование, подбор, списки и т.д.)
# note: ИСПОЛНИТЕЛЬНЫЕ НОДЫ
# note: НОДЫ РАБОТАЮЩИЕ С ДАННЫМИ

# group: ПЕРЕДАЁМ ИНФОРМАЦИЮ В РЕВИТ
# note: ПЕРЕДАЁМ ИНФОРМАЦИЮ В РЕВИТ

# group: ЗАПАСНЫЕ ВАРИАНТЫ, ДОПОЛНИТЕЛЬНЫЕ ОПЦИИ
# note: ЗАПАСНЫЕ
# note: ДОПОЛНИТЕЛЬНЫЕ. Градации серово по важности, темнее - важнее

# group: ПРИМЕЧАНИЯ ПО ЦВЕТОВОЙ ГРУППИРОВКЕ
# note: GUIDELINES

# group: КЛЮЧЕВЫЕ МОМЕНТЫ РАБОТЫ 2
# note: НОДЫ РАБОТАЮЩИЕ С ДАННЫМИ
# note: ИСПОЛНИТЕЛЬНЫЕ НОДЫ

# group: ЭЛЕМЕНТЫ УПРАВЛЕНИЯ Dyno Studio
# note: Dyno Studio

# group: ЭЛЕМЕНТЫ УПРАВЛЕНИЯ 2 УРОВЕНЬ
# note: ЭЛЕМЕНТЫ УПРАВЛЕНИЯ
# note: ПЕРЕМЕННЫЕ ЗНАЧЕНИЯ

boolean = BoolSelector(true)  # frozen
code_block = CodeBlock { 1; 2; }
if_ = Python(IN[0]=boolean, IN[1]=code_block.out0, IN[2]=code_block.out1)
# ---------- if_.python (12 lines) ----------
import clr
boolean = IN[0]
true = UnwrapElement(IN[1])
false = UnwrapElement(IN[2])

if boolean:
	out = true
else:
	out = false

#Назначьте вывод переменной OUT.
OUT = out
# ----------------------------------------
geometry = Element.Geometry()  # unwired: arg0
setParameterByName = Element.SetParameterByName()  # unwired: element, parameterName, value
getParameterValueByName = Element.GetParameterValueByName()  # unwired: element, parameterName

# group: Parameters name from language
parameters_name_from_language = Python()  # frozen
# ---------- parameters_name_from_language.python (18 lines) ----------
import clr
clr.AddReference('RevitServices')
import RevitServices
from RevitServices.Persistence import DocumentManager

uiapp = DocumentManager.Instance.CurrentUIApplication
app = uiapp.Application
lng = app.Language
rus = ["Тип","Имя семейства","Имя типа"]
enu = ["Type","Family name","Type name"]
out = []
if str(lng) == "Russian":
	out = rus
else:
	out = enu
#English_USA
#Russian
OUT = out
# ----------------------------------------

# group: элементы внутри групп
members = Python()  # "Group.Members"; frozen; unwired: IN[0]
# ---------- members.python (19 lines) ----------
import clr
clr.AddReference('RevitAPI')
from Autodesk.Revit.DB import *

clr.AddReference("RevitNodes")
import Revit
clr.ImportExtensions(Revit.Elements)

groups = UnwrapElement(IN[0])
elementlist = list()
for item in groups:
	try:
		memberlist = list()
		for member in item.GetMemberIds():
			memberlist.append(item.Document.GetElement(member))
		elementlist.append(memberlist)
	except:
		elementlist.append(list())
OUT = elementlist
# ----------------------------------------

создать_разделители_помещений = BoolSelector(true)

# group: Get Revit Selection:
выбрать_элементы_в_модели = DSModelElementsSelection()
forceChildrensEval = ForceChildrensEval()  # unwired: arg0
pys_get_revit_selection = Python(IN[0]=forceChildrensEval)
# ---------- pys_get_revit_selection.python (22 lines) ----------
import clr
clr.AddReference('RevitServices')
clr.AddReference('RevitAPI')
from Autodesk.Revit.DB import *
import RevitServices
from RevitServices.Persistence import DocumentManager
from Autodesk.Revit.ApplicationServices import Application

reset = IN[0]

doc = DocumentManager.Instance.CurrentDBDocument
uidoc = DocumentManager.Instance.CurrentUIApplication.ActiveUIDocument
ids = uidoc.Selection.GetElementIds()

idd = [str(i) for i in ids]

if isinstance(idd, list) == True:
	elems = [doc.GetElement(ElementId(int(i))) for i in idd]
else:
	elems = doc.GetElement(ElementId(int(idd)))

OUT = elems
# ----------------------------------------
if_2 = Python(IN[0]=выбрать_элементы_в_модели, IN[1]=pys_get_revit_selection)
# ---------- if_2.python (12 lines) ----------
import clr

true = UnwrapElement(IN[0])
false = UnwrapElement(IN[1])

if true == None:
	out = false
else:
	out = true

#Назначьте вывод переменной OUT.
OUT = out
# ----------------------------------------

type = Object.Type(if_2)
code_block_2 = CodeBlock { "DetailCurve"; }
contains = String.Contains(str=type, searchFor=code_block_2)
filterByBoolMask = List.FilterByBoolMask(list=if_2, mask=contains)
curves = Element.Curves(filterByBoolMask.in)
flatten = Flatten(curves)
code_block_3 = CodeBlock { null; }
if_3 = Python(IN[0]=создать_разделители_помещений, IN[1]=flatten, IN[2]=code_block_3)  # same code as if_
forceChildrensEval_2 = ForceChildrensEval()  # unwired: arg0
python_script = Python(IN[0]=forceChildrensEval_2)
# ---------- python_script.python (14 lines) ----------
#Copyright(c) 2016, Dimitar Venkov
# @5devene, dimitar.ven@gmail.com

import clr

clr.AddReference("RevitServices")
import RevitServices
from RevitServices.Persistence import DocumentManager
doc = DocumentManager.Instance.CurrentDBDocument
clr.AddReference("RevitNodes")
import Revit
clr.ImportExtensions(Revit.Elements)

OUT = doc.ActiveView.ToDSType(True)
# ----------------------------------------
create = List.Create(python_script)
python_script_2 = Python(IN[0]=create)
# ---------- python_script_2.python (25 lines) ----------
import clr
clr.AddReference('RevitAPI')
from Autodesk.Revit.DB import *

clr.AddReference("RevitNodes")
import Revit
clr.ImportExtensions(Revit.Elements)

faminsts = UnwrapElement(IN[0])
elementlist = list()
for item in faminsts:
	try:	
		elementlist.append(item.Document.GetElement(item.LevelId).ToDSType(True))
	except:
		try:
			elementlist.append(item.Level.ToDSType(True))
		except:
			try:
				elementlist.append(item.GenLevel.ToDSType(True))
			except:
				try:
					elementlist.append(item.Document.GetElement(item.get_Parameter(BuiltInParameter.INSTANCE_REFERENCE_LEVEL_PARAM).AsElementId()).ToDSType(True))
				except:
					elementlist.append(list())
OUT = elementlist
# ----------------------------------------
code_block_4 = CodeBlock(l=python_script_2) { o = Autodesk.Point.ByCoordinates(0,0,l.Elevation); pl = Plane.ByOriginNormal(o,Vector.ZAxis()); }
byPlane = SketchPlane.ByPlane(code_block_4.pl)
fromCurve = Python(IN[0]=if_3, IN[1]=byPlane, IN[2]=python_script)  # "RoomSeparator.FromCurve"
# ---------- fromCurve.python (30 lines) ----------
import clr
clr.AddReference('RevitAPI')
from Autodesk.Revit.DB import *

clr.AddReference("RevitNodes")
import Revit
clr.ImportExtensions(Revit.GeometryConversion)

clr.AddReference("RevitServices")
import RevitServices
from RevitServices.Persistence import DocumentManager
from RevitServices.Transactions import TransactionManager

doc = DocumentManager.Instance.CurrentDBDocument
curves = UnwrapElement(IN[0])
sketchplane = UnwrapElement(IN[1])
view = UnwrapElement(IN[2])

TransactionManager.Instance.EnsureInTransaction(doc)
curvearray = CurveArray()
for curve in curves:
	curvearray.Append(curve.ToRevitType())
doccreation = doc.Create
separatorarray = doccreation.NewRoomBoundaryLines(sketchplane[0], curvearray, view)
TransactionManager.Instance.TransactionTaskDone()

elementlist = list()
for item in separatorarray:
	elementlist.append(item)
OUT = elementlist
# ----------------------------------------
включить_зависимость_сверху = BoolSelector(true)
flip = BoolSelector(true)
direction = Line.Direction(flatten)
normalized = Vector.Normalized(direction)
X = Vector.X(normalized)
отступ_от_линии_вручную = BoolSelector(true)
отступ_от_линиистен = StringInput("50.000")
toNumber = String.ToNumber(отступ_от_линиистен)
выбрать_тип_стен = WallTypes("ADSK_Витраж_Без разрезки_Импосты 50х160")
code_block_5 = CodeBlock { "Ширина"; }
getParameterValueByName_2 = Element.GetParameterValueByName(element=выбрать_тип_стен, parameterName=code_block_5)
if_4 = Python(IN[0]=отступ_от_линии_вручную, IN[1]=toNumber, IN[2]=getParameterValueByName_2)  # same code as if_
code_block_6 = CodeBlock(x=if_4) { -(x/2); x/2; }
list_replace = Python(IN[0]=flip, IN[1]=X, IN[2]=code_block_6.out0, IN[3]=code_block_6.out1)
# ---------- list_replace.python (22 lines) ----------
import clr
flip = IN[0]
booleans = IN[1]
true = UnwrapElement(IN[2])
false = UnwrapElement(IN[3])
newlist = []

if flip:
	for boolean in booleans:
		if boolean:
			newlist.append(true)
		else:
			newlist.append(false)
else:
	for boolean in booleans:
		if boolean:
			newlist.append(false)
		else:
			newlist.append(true)

#Назначьте вывод переменной OUT.
OUT = newlist
# ----------------------------------------
offset = Curve.Offset(curve=flatten, distance=list_replace)
высота_стен = StringInput("50.000")
toNumber_2 = String.ToNumber(высота_стен)
уровень_размещения = Levels("Этаж 01")
byCurveAndHeight = Wall.ByCurveAndHeight(curve=offset, height=toNumber_2, level=уровень_размещения, wallType=выбрать_тип_стен)
code_block_7 = CodeBlock { "Линия привязки"; 4; "Зависимость сверху"; "Смещение сверху"; "Смещение снизу"; }
setParameterByName_2 = Element.SetParameterByName(element=byCurveAndHeight, parameterName=code_block_7.out0, value=code_block_7.out1)
смещение_снизу = StringInput("-450")
toNumber_3 = String.ToNumber(смещение_снизу)
setParameterByName_3 = Element.SetParameterByName(element=setParameterByName_2, parameterName=code_block_7.out4, value=toNumber_3)
code_block_8 = CodeBlock { null; }
if_5 = Python(IN[0]=включить_зависимость_сверху, IN[1]=setParameterByName_3, IN[2]=code_block_8)  # same code as if_
зависимость_сверху = Levels("Этаж 01")
setParameterByName_4 = Element.SetParameterByName(element=if_5, parameterName=code_block_7.out2, value=зависимость_сверху)
смещение_сверху = StringInput("-450")
toNumber_4 = String.ToNumber(смещение_сверху)
setParameterByName_5 = Element.SetParameterByName(element=setParameterByName_4, parameterName=code_block_7.out3, value=toNumber_4)
