# Dynamo graph 4.Коректировка высоты проёма.dyn (Dynamo 1.2.1.3083)

categories = Categories("Windows")
all_elements_of_category = ElementsOfCategory(categories)
type = Archilab.Grimshaw.Elements.Element.Type(all_elements_of_category)
code_block = CodeBlock { "Имя типа"; "Проём прямоугольный"; "Высота нижнего бруса"; "Ширина проёма"; 500; }
getParameterValueByName = Element.GetParameterValueByName(element=type, parameterName=code_block.out0)
eq = getParameterValueByName == code_block.out1
filterByBoolMask = List.FilterByBoolMask(list=all_elements_of_category, mask=eq)
getParameterValueByName_2 = Element.GetParameterValueByName(element=filterByBoolMask.in, parameterName=code_block.out2)
round = Math.Round(getParameterValueByName_2)
setParameterByName = Element.SetParameterByName(element=filterByBoolMask.in, parameterName=code_block.out2, value=round)  # frozen
getParameterValueByName_3 = Element.GetParameterValueByName(element=filterByBoolMask.in, parameterName=code_block.out3)
ge = getParameterValueByName_3 >= code_block.out4
filterByBoolMask_2 = List.FilterByBoolMask(list=filterByBoolMask.in, mask=ge)
getParameterValueByName_4 = Element.GetParameterValueByName(element=filterByBoolMask_2.in, parameterName=code_block.out3)
