# Dynamo graph 4.Формирование отверстий по связанному файлу (с выбором стен) new.dyn (Dynamo 1.3.0.875)

forceChildrensEval = ForceChildrensEval()  # unwired: arg0
code_block = CodeBlock { "WallOpening"; }
byName = Family.ByName(code_block)
types = Family.Types(byName)
code_block_2 = CodeBlock { "Имя типа"; }
getParameterValueByName = Element.GetParameterValueByName(element=types, parameterName=code_block_2)

# group: Работа со связанными файлами
часть_имени_связанного_файла = StringInput("ОВ")
сети_в_связанном_файле = BoolSelector(true)

eq = getParameterValueByName == часть_имени_связанного_файла
filterByBoolMask = List.FilterByBoolMask(list=types, mask=eq)
code_block_3 = CodeBlock(a=filterByBoolMask.in) { a[0]; }
монтажный_зазор = IntegerSlider(75, range=75..100 step 500)

# group: Условия формирования круглого, а не прямоугольного, отверстия
максимальное_отношение_сторон = CodeBlock { 3; }
максимально_допустимый_диаметр = CodeBlock { 400; }  # "Максимально допустимый диаметр, мм"

# group: Get Revit Selection:
pys_get_revit_selection = Python(IN[0]=forceChildrensEval)
# ---------- pys_get_revit_selection.python (22 lines) ----------
import clr
clr.AddReference('RevitServices')
clr.AddReference('RevitAPI')
from Autodesk.Revit.DB import *
import RevitServices
from RevitServices.Persistence import DocumentManager
from Autodesk.Revit.ApplicationServices import Application

reset = IN[0]

doc = DocumentManager.Instance.CurrentDBDocument
uidoc = DocumentManager.Instance.CurrentUIApplication.ActiveUIDocument
ids = uidoc.Selection.GetElementIds()

idd = [str(i) for i in ids]

if isinstance(idd, list) == True:
	elems = [doc.GetElement(ElementId(int(i))) for i in idd]
else:
	elems = doc.GetElement(ElementId(int(idd)))

OUT = elems
# ----------------------------------------

getCategory = Element.GetCategory(pys_get_revit_selection)
string_from_object = FromObject(getCategory)
code_block_4 = CodeBlock { "Стены"; }
eq_2 = string_from_object == code_block_4
filterByBoolMask_2 = List.FilterByBoolMask(list=pys_get_revit_selection, mask=eq_2)
изначальный_скрипт_fix_отладка = Python(IN[0]=forceChildrensEval, IN[1]=code_block_3, IN[2]=code_block_3, IN[3]=монтажный_зазор, IN[4]=монтажный_зазор, IN[5]=максимальное_отношение_сторон, IN[6]=максимально_допустимый_диаметр, IN[7]=сети_в_связанном_файле, IN[8]=часть_имени_связанного_файла, IN[9]=filterByBoolMask_2.in)  # "Изначальный скрипт (fix) отладка ЭС"
# ---------- изначальный_скрипт_fix_отладка.python (221 lines) ----------
# Подгрузка библиотек
import clr
clr.AddReference('ProtoGeometry')
from Autodesk.DesignScript.Geometry import *

clr.AddReference('RevitAPI')
import Autodesk
from Autodesk.Revit.DB import *

clr.AddReference('RevitServices')
import RevitServices
from RevitServices.Persistence import DocumentManager
from RevitServices.Transactions import TransactionManager

import math

# Получение текущего проекта
doc = DocumentManager.Instance.CurrentDBDocument

# Получение списка связанных файлов
linkInstances = FilteredElementCollector(doc).OfClass(RevitLinkInstance)

# Опции для работы функций
opt = Options() # Для получения геометрии
optS = SolidCurveIntersectionOptions() # Для нахождения пересечения объёмного тела с кривой
nonStr = Autodesk.Revit.DB.Structure.StructuralType.NonStructural # Для вставки семейства в основу

# Входные данные
rezet = IN[0]
rectnOpen = UnwrapElement(IN[1]) # Тип прямоугольного проёма
roundOpen = UnwrapElement(IN[2]) # Тип круглого проёма
rectnReserv = IN[3] / 304.8 # Запас для прямоугольного проёма в мм
roundReserv = IN[4] / 304.8 # Запас для круглого проёма в мм
koef = IN[5] # Максимальное отношение сторон для круглого отверстия
maxDiam = IN[6] / 304.8 # Максимальный диаметр для круглого отверстия
isLink = IN[7] # Определение того, в связанном ли файле находятся сети
nameLink = IN[8] # Часть имени файла с сетями для корректного определения
walls = UnwrapElement(IN[9])
catparam = 0

# Фильтрация связанных файлов
if isLink:
	a = 0
	for inst in linkInstances:
		if nameLink in inst.Name:
			linkDoc = inst.GetLinkDocument()
			a = 1
	if a == 0:
		linkDoc = doc
else:
	linkDoc = doc

# Функция расчёта и создания проёма
def creation(communication):
	# Получение имени категории коммуникации
	categName = communication.Category.Name
	# Определение параметров ширины и высоты для труб
	if categName == 'Трубы':
		# Получение внешнего диаметра трубы
		commDiam = communication.get_Parameter(BuiltInParameter.RBS_PIPE_OUTER_DIAMETER).AsDouble()
		commWidth = commDiam
		commHeight = commDiam
		catparam = "ВК"
	# Определение параметров ширины и высоты для воздуховодов	
	elif categName == 'Воздуховоды':
		# Определение формы сечения воздуховода
		sect = communication.get_Parameter(BuiltInParameter.ELEM_FAMILY_PARAM).AsValueString()
		if sect == 'Воздуховод круглого сечения':
			commDiam = communication.get_Parameter(BuiltInParameter.RBS_CURVE_DIAMETER_PARAM).AsDouble()
			commWidth = commDiam
			commHeight = commDiam
		elif sect == 'Воздуховод овального сечения' or sect == 'Воздуховод прямоугольного сечения':
			commWidth = communication.get_Parameter(BuiltInParameter.RBS_CURVE_WIDTH_PARAM).AsDouble()
			commHeight = communication.get_Parameter(BuiltInParameter.RBS_CURVE_HEIGHT_PARAM).AsDouble()
		catparam = "ОВ"
	elif categName == 'Кабельные лотки':
		commWidth = communication.get_Parameter(BuiltInParameter.RBS_CABLETRAY_WIDTH_PARAM).AsDouble()
		commHeight = communication.get_Parameter(BuiltInParameter.RBS_CABLETRAY_HEIGHT_PARAM).AsDouble()
		catparam = "ЭС"
	
	# Получение коэффициентов уравнения прямой (аналогично стене)
	pipeCurve = communication.Location.Curve # Получение кривой эскиза трубы
	line0 = geomSolid.IntersectWithCurve(pipeCurve, optS) # Получение геометрии (списка кривых) возможно наличие нулевых списков
	lineCount = line0.SegmentCount
	if lineCount >= 1: # Отфильтровываем нулевые списки
		line = line0.GetCurveSegment(0)
		end0 = line.GetEndPoint(0)
		end1 = line.GetEndPoint(1)
		x0_ = end0.X; y0_ = end0.Y;	x1_ = end1.X; y1_ = end1.Y; z0_ = end0.Z; z1_ = end1.Z
		A2 = y0_-y1_; B2 = x1_-x0_; C2 = z1_-z0_
		
		# Получение центра пересечения стены и трубы
		
		#center = XYZ((end0.X + end1.X) / 2, (end0.Y + end1.Y) / 2, (end0.Z + end1.Z) / 2) # Получение центра пересечения стены и трубы
	
		# Получение угла пересечения кривой стены и кривой трубы в плане (для определения минимальной ширины проёма)
		cosin = (A1*A2 + B1*B2) / ((A1**2 + B1**2)**0.5 * (A2**2 + B2**2)**0.5) # Вычисление косинуса между прямыми трубы и стены
		angleHor = math.degrees(math.acos(cosin)) # Вычисление горизонтального угла (в градусах)
		if angleHor > 90:
			angleHor = 180 - angleHor # Определение острого угла при пересечении
		newAngleHor = math.radians(angleHor) # Перевод острого угла в радианы
		# Определение минимальной ширины проёма
		minWidth = width/math.tan(newAngleHor) + commWidth/math.sin(newAngleHor)
		# Определение ширины проёма с учётом допуска
		openWidth = minWidth + rectnReserv * 2
		
		# Получение угла пересечения кривой стены и кривой трубы по вертикали (для определения минимальной высоты проёма, аналогично предыдущему)
		cosin = C2 / ((A2**2 + B2**2+C2**2)**0.5) # Вычисление косинуса между трубой и горизонтальной плоскостью
		angleVert = math.degrees(math.acos(cosin)) # Вычисление вертикального угла (в градусах)
		if angleVert > 90:
			angleVert = 180 - angleVert
		newAngleVert = math.radians(angleVert)
		# Определение минимальной высоты проёма
		minHeight = width/math.tan(newAngleVert) + commHeight/math.sin(newAngleVert)
		# Определение высоты проёма с учётом допуска
		openHeight = minHeight + rectnReserv * 2
		
		# Округление размеров до сантиметров
		openWidth = round(openWidth * 304.8, -1) / 304.8
		openHeight = round(openHeight * 304.8, -1) / 304.8
		
		center = XYZ((end0.X + end1.X) / 2, (end0.Y + end1.Y) / 2, ((end0.Z + end1.Z) / 2) - openHeight / 2) # Получение центра пересечения стены и трубы
	
		# Проверка того, нужен ли круглый проём, и создание проёма
		if openHeight > openWidth: # Случай, если высота больше ширины
			if openHeight/openWidth <= koef and openHeight <= maxDiam: # Проверка на допустимые значения
				# Создание круглого проёма и задание его диаметра
				cutNew = doc.Create.NewFamilyInstance(center, roundOpen, wall, doc.GetElement(wall.LevelId), nonStr)
				cutNew.LookupParameter('Примерная ширина').Set(openWidth)
				cutNew.LookupParameter('Примерная высота').Set(openHeight)
			else:
				# Создание прямоугольного проёма и задание его ширины и высоты
				cutNew = doc.Create.NewFamilyInstance(center, rectnOpen, wall, doc.GetElement(wall.LevelId), nonStr)
				cutNew.LookupParameter('Примерная ширина').Set(openWidth)
				cutNew.LookupParameter('Примерная высота').Set(openHeight)
		else: # Случай, если ширина больше высоты (аналогично)
			if openWidth/openHeight <= koef and openWidth <= maxDiam:
				cutNew = doc.Create.NewFamilyInstance(center, roundOpen, wall, doc.GetElement(wall.LevelId), nonStr)
				cutNew.LookupParameter('Примерная ширина').Set(openWidth)
				cutNew.LookupParameter('Примерная высота').Set(openHeight)
			else:
				cutNew = doc.Create.NewFamilyInstance(center, rectnOpen, wall, doc.GetElement(wall.LevelId), nonStr)
				cutNew.LookupParameter('Примерная ширина').Set(openWidth)
				cutNew.LookupParameter('Примерная высота').Set(openHeight)
				
		#catparam = cutNew.LookupParameter('Тип отверстия').AsString()
		cutNew.LookupParameter('*Отступ от уровня').Set(cutNew.LookupParameter('Смещение по высоте').AsDouble())
		cutNew.LookupParameter('Смещение по высоте').Set(0)
	else:
		pass
	
	return cutNew

# Формирование пустого выходного списка
lst = []

# Открытие транзакции
TransactionManager.Instance.EnsureInTransaction(doc)

# Аквтивация загруженных семейств проёмов (если ещё не были использованы)
rectnOpen.Activate()
roundOpen.Activate()

# Обработка списка экземпляров стен
for wall in walls:
	# Получение ширины
	width = wall.Width
	
	# Получение коэффициентов уравнения прямой
	wallCurve = wall.Location.Curve # Получение кривой эскиза стены
	endWall0 = wallCurve.GetEndPoint(0) # Получение начальной точки кривой
	endWall1 = wallCurve.GetEndPoint(1) # Получение конечной точки кривой
	x0 = endWall0.X; y0 = endWall0.Y; x1 = endWall1.X; y1 = endWall1.Y # Получение отдельных координат точек
	A1 = y0-y1;	B1 = x1-x0 # Получение коэффициентов уравнения прямой
	
	# Получение геометрии стены
	geomElem = wall.get_Geometry(opt)
	for geomObj in geomElem:
		geomSolid = geomObj
		
	# Получение коллекции всех экземпляров труб в проекте (необходимо каждый раз брать заново)
	pipes = FilteredElementCollector(linkDoc).OfCategory(BuiltInCategory.OST_PipeCurves).WhereElementIsNotElementType()
	# Извлечение только тех из них, которые пересекаются с объёмом данной стены
	pipeInters = pipes.WherePasses(ElementIntersectsSolidFilter(geomSolid)).ToElements()
	
	# Получение коллекции всех экземпляров труб в проекте (необходимо каждый раз брать заново)
	ducts = FilteredElementCollector(linkDoc).OfCategory(BuiltInCategory.OST_DuctCurves).WhereElementIsNotElementType()
	# Извлечение только тех из них, которые пересекаются с объёмом данной стены
	ductInters = ducts.WherePasses(ElementIntersectsSolidFilter(geomSolid)).ToElements()

	# Получение коллекции всех экземпляров лотков в проекте (необходимо каждый раз брать заново)
	cabels = FilteredElementCollector(linkDoc).OfCategory(BuiltInCategory.OST_CableTray).WhereElementIsNotElementType()
		
	# Извлечение только тех из них, которые пересекаются с объёмом данной стены

	cabelInters = cabels.WherePasses(ElementIntersectsSolidFilter(geomSolid)).ToElements()

	
	# Формирование пустого промежуточного списка
	_lst = []

	# Обработка труб, пересекающихся с данной стеной
	for pipe in pipeInters:
		result = creation(pipe)	
		_lst.append(result)
	
	# Обработка воздуховодов, пересекающихся с данной стеной	
	for duct in ductInters:
		result = creation(duct)	
		_lst.append(result)
		
	for cabel in cabelInters:
		result = creation(cabel)	
		_lst.append(result)	
	
	lst.append(_lst)

# Закрытие транзакции
TransactionManager.Instance.TransactionTaskDone()

OUT = lst
# ----------------------------------------
flatten = Flatten(изначальный_скрипт_fix_отладка)

# group: Выберите типы проёмов
тип_прямоугольного_проёма = FamilyTypes("WallOpening:ОВ")  # frozen
