# Dynamo graph D2 3.Создание стен по Цветовым облостям V0.7 (полученым из DWG, заливка стен).dyn (Dynamo 2.3.0.5885)
# packages: Prorubim Core Kit 2.x 0.5.0

# note: ВСЁ ОСТАЛЬНОЕ

# group: ЭЛЕМЕНТЫ УПРАВЛЕНИЯ
# note: ПЕРЕМЕННЫЕ ЗНАЧЕНИЯ
# note: ЭЛЕМЕНТЫ УПРАВЛЕНИЯ

# group: ПОЛУЧАЕМ ДАННЫЕ ИЗ РЕВИТ
# note: ПОЛУЧАЕМ ДАННЫЕ ИЗ РЕВИТ

# group: ПРОВЕРОЧНЫЕ НОДЫ
# note: ПРОВЕРОЧНЫЕ НОДЫ

# group: КЛЮЧЕВЫЕ МОМЕНТЫ РАБОТЫ 1
# note: ИТОГОВАЯ КОНСОЛИДАЦИЯ ДАННЫХ

# group: ИСПОЛНИТЕЛЬНЫЕ НОДЫ (фильтрование, подбор, списки и т.д.)
# note: ИСПОЛНИТЕЛЬНЫЕ НОДЫ
# note: НОДЫ РАБОТАЮЩИЕ С ДАННЫМИ

# group: ПЕРЕДАЁМ ИНФОРМАЦИЮ В РЕВИТ
# note: ПЕРЕДАЁМ ИНФОРМАЦИЮ В РЕВИТ

# group: ЗАПАСНЫЕ ВАРИАНТЫ, ДОПОЛНИТЕЛЬНЫЕ ОПЦИИ
# note: ЗАПАСНЫЕ
# note: ДОПОЛНИТЕЛЬНЫЕ. Градации серово по важности, темнее - важнее

# group: ПРИМЕЧАНИЯ ПО ЦВЕТОВОЙ ГРУППИРОВКЕ
# note: GUIDELINES

# group: КЛЮЧЕВЫЕ МОМЕНТЫ РАБОТЫ 2
# note: НОДЫ РАБОТАЮЩИЕ С ДАННЫМИ
# note: ИСПОЛНИТЕЛЬНЫЕ НОДЫ

# group: ЭЛЕМЕНТЫ УПРАВЛЕНИЯ Dyno Studio
# note: Dyno Studio

# group: ЭЛЕМЕНТЫ УПРАВЛЕНИЯ 2 УРОВЕНЬ
# note: ЭЛЕМЕНТЫ УПРАВЛЕНИЯ
# note: ПЕРЕМЕННЫЕ ЗНАЧЕНИЯ

boolean = BoolSelector(true)  # frozen
code_block = CodeBlock { 1; 2; }
if_ = Python(IN[0]=boolean, IN[1]=code_block.out0, IN[2]=code_block.out1)
# ---------- if_.python (12 lines) ----------
import clr
boolean = IN[0]
true = UnwrapElement(IN[1])
false = UnwrapElement(IN[2])

if boolean:
	out = true
else:
	out = false

#Назначьте вывод переменной OUT.
OUT = out
# ----------------------------------------
geometry = Element.Geometry()  # unwired: element
setParameterByName = Element.SetParameterByName()  # unwired: element, parameterName, value
getParameterValueByName = Element.GetParameterValueByName()  # unwired: element, parameterName

# group: Parameters name from language
parameters_name_from_language = Python()  # graph input; frozen
# ---------- parameters_name_from_language.python (18 lines) ----------
import clr
clr.AddReference('RevitServices')
import RevitServices
from RevitServices.Persistence import DocumentManager

uiapp = DocumentManager.Instance.CurrentUIApplication
app = uiapp.Application
lng = app.Language
rus = ["Тип","Имя семейства","Имя типа"]
enu = ["Type","Family name","Type name"]
out = []
if str(lng) == "Russian":
	out = rus
else:
	out = enu
#English_USA
#Russian
OUT = out
# ----------------------------------------

# group: элементы внутри групп
members = Python()  # "Group.Members"; frozen; unwired: IN[0]
# ---------- members.python (19 lines) ----------
import clr
clr.AddReference('RevitAPI')
from Autodesk.Revit.DB import *

clr.AddReference("RevitNodes")
import Revit
clr.ImportExtensions(Revit.Elements)

groups = UnwrapElement(IN[0])
elementlist = list()
for item in groups:
	try:
		memberlist = list()
		for member in item.GetMemberIds():
			memberlist.append(item.Document.GetElement(member))
		elementlist.append(memberlist)
	except:
		elementlist.append(list())
OUT = elementlist
# ----------------------------------------

поиск_в_имени_типа = StringInput("ADSK_Внутренняя_Газобетон_")  # graph input
выбрать_элементы_в_модели = DSModelElementsSelection()  # nothing selected; graph input
forceChildsEval = ForceChildsEval()  # unwired: passObject

# group: Get Revit Selection:
pys_get_revit_selection = Python(IN[0]=forceChildsEval)
# ---------- pys_get_revit_selection.python (22 lines) ----------
import clr
clr.AddReference('RevitServices')
clr.AddReference('RevitAPI')
from Autodesk.Revit.DB import *
import RevitServices
from RevitServices.Persistence import DocumentManager
from Autodesk.Revit.ApplicationServices import Application

reset = IN[0]

doc = DocumentManager.Instance.CurrentDBDocument
uidoc = DocumentManager.Instance.CurrentUIApplication.ActiveUIDocument
ids = uidoc.Selection.GetElementIds()

idd = [str(i) for i in ids]

if isinstance(idd, list) == True:
	elems = [doc.GetElement(ElementId(int(i))) for i in idd]
else:
	elems = doc.GetElement(ElementId(int(idd)))

OUT = elems
# ----------------------------------------

if_2 = Python(IN[0]=выбрать_элементы_в_модели, IN[1]=pys_get_revit_selection)
# ---------- if_2.python (12 lines) ----------
import clr

true = UnwrapElement(IN[0])
false = UnwrapElement(IN[1])

if true == None:
	out = false
else:
	out = true

#Назначьте вывод переменной OUT.
OUT = out
# ----------------------------------------
type = Object.Type(obj=if_2)
code_block_2 = CodeBlock { "FilledRegion"; }
contains = String.Contains(str=type, searchFor=code_block_2)
filterByBoolMask = List.FilterByBoolMask(list=if_2, mask=contains)
faces = Element.Faces(element=filterByBoolMask.in)
flatten = List.Flatten(list=faces)
perimeterCurves = Surface.PerimeterCurves(surface=flatten)
count = List.Count(list=perimeterCurves@L2)
code_block_3 = CodeBlock(l=count) { l!=4; }
filterByBoolMask_2 = List.FilterByBoolMask(list=filterByBoolMask.in, mask=code_block_3)
поиск_в_имени_типа_2 = StringInput("ADSK_Внутренняя_Кирпич_")  # graph input
boundingBox = Element.BoundingBox(element=filterByBoolMask.in)
toCuboid = BoundingBox.ToCuboid(boundingBox=boundingBox)
explode = Geometry.Explode(geometry=toCuboid)
flatten_2 = List.Flatten(list=explode)
code_block_4 = CodeBlock { 0.5; 1; }
getIsoline = Surface.GetIsoline(surface=flatten_2, parameter=code_block_4.out0)
getIsoline_2 = Surface.GetIsoline(surface=flatten_2, isoDirection=code_block_4.out1, parameter=code_block_4.out0)
create = List.Create(item0=getIsoline, item1=getIsoline_2)
transpose = List.Transpose(lists=create)
length = Curve.Length(curve=transpose)
round = Math.Round(number=length)
sortByKey = List.SortByKey(list=transpose@L2, keys=round@L2)
code_block_5 = CodeBlock { 1; 0; }
getItemAtIndex = List.GetItemAtIndex(list=sortByKey.sorted_keys@L2, index=code_block_5.out1)
getItemAtIndex_2 = List.GetItemAtIndex(list=sortByKey.sorted_list@L2, index=code_block_5.out0)
length_2 = Curve.Length(curve=getItemAtIndex_2)
не_создавать_стены_меньше = DoubleSlider(100, range=0..100 step 0.1)  # graph input
lt = length_2 < не_создавать_стены_меньше
filterByBoolMask_3 = List.FilterByBoolMask(list=getItemAtIndex, mask=lt)
code_block_6 = CodeBlock(t4=filterByBoolMask_3.out) { t3 = Math.Round(t4); t1 = t3 / 10; t5 = Math.Round(t1); t2 = t5 * 10; }
string_from_object = FromObject(obj=code_block_6.t2)
code_block_7 = CodeBlock { ","; 0; }
split = String.Split(str=string_from_object, separator0=code_block_7.out0)
getItemAtIndex_3 = List.GetItemAtIndex(list=split@L2, index=code_block_7.out1)
code_block_8 = CodeBlock(y=поиск_в_имени_типа_2, x=getItemAtIndex_3) { y+x; }
uniqueItems = List.UniqueItems(list=code_block_8)
python_script = Python(IN[0]=forceChildsEval)
# ---------- python_script.python (25 lines) ----------
#Copyright(c) 2016, Dimitar Venkov
# @5devene, dimitar.ven@gmail.com

import clr

clr.AddReference("RevitServices")
import RevitServices
from RevitServices.Persistence import DocumentManager
doc = DocumentManager.Instance.CurrentDBDocument

clr.AddReference("RevitAPI")
from Autodesk.Revit.DB import *

clr.AddReference("RevitNodes")
import Revit
clr.ImportExtensions(Revit.Elements)


result = []

fec = FilteredElementCollector(doc).OfClass(WallType)
for i in fec:
	result.append(i.ToDSType(True))
	
OUT = result
# ----------------------------------------
name = Family.Name(family=python_script)
contains_2 = String.Contains(str=name, searchFor=code_block_8@L1)
sum_of_true = Python(IN[0]=contains_2)
# ---------- sum_of_true.python (12 lines) ----------
lists = IN[0]
test = []

for list in lists:
	for i,l in enumerate(list):
		if len(test) > i+1:
			if l == True and test[i] != True:
				test[i] = l
		else:
			test.append(l)

OUT = test
# ----------------------------------------
code_block_9 = CodeBlock { "Уровни"; }
byName = Category.ByName(name=code_block_9)
all_elements_of_category = ElementsOfCategory(Category=byName)
code_block_10 = CodeBlock { "Фасад"; }
getParameterValueByName_2 = Element.GetParameterValueByName(element=all_elements_of_category, parameterName=code_block_10)
sortByKey_2 = List.SortByKey(list=all_elements_of_category, keys=getParameterValueByName_2)
name_2 = Level.Name(level=sortByKey_2.sorted_list)
уровень_размещения = Levels("Этаж -2")  # graph input
name_3 = Level.Name(level=уровень_размещения)
eq = name_2 == name_3
code_block_11 = CodeBlock { true; }
indexOf = List.IndexOf(list=eq, element=code_block_11)
code_block_12 = CodeBlock(i=indexOf) { i+1; }
getItemAtIndex_4 = List.GetItemAtIndex(list=sortByKey_2.sorted_list, index=code_block_12)
code_block_13 = CodeBlock(endlevel=getItemAtIndex_4) { endlevel; }
elevation = Level.Elevation(level=code_block_13)
filterByBoolMask_4 = List.FilterByBoolMask(list=sortByKey_2.sorted_list, mask=eq)
code_block_14 = CodeBlock(startlevel=filterByBoolMask_4.in) { startlevel[0]; }
elevation_2 = Level.Elevation(level=code_block_14)
code_block_15 = CodeBlock(x=elevation, y=elevation_2) { x-y; }
round_2 = Math.Round(number=code_block_15)
filterByBoolMask_5 = List.FilterByBoolMask(list=getItemAtIndex_2, mask=lt)
code_block_16 = CodeBlock(curves=filterByBoolMask_5.out) { curves; }
высота_стены = DoubleSlider(300, range=0..1000 step 0.1)  # graph input
filterByBoolMask_6 = List.FilterByBoolMask(list=python_script, mask=contains_2@L2)
flatten_3 = List.Flatten(list=filterByBoolMask_6.in)
code_block_17 = CodeBlock { "WallCenterline"; false; }
disallowWallJoinAtEnd = BoolSelector(true)  # graph input
floor_whigh_bool = BoolSelector(true)  # graph input
толщина_перекрытия = DoubleSlider(500, range=0..1100 step 0.1)  # graph input
convert_between_units = DynamoConvert(толщина_перекрытия, MeasurementType="Length", FromConversion="Millimeters", ToConversion="Feet")
del_Regions = BoolSelector(true)  # graph input
true_привязка_к_уровню_false = BoolSelector(true)  # "(True) - Привязка к Уровню. (False) - Высота стены."; graph input
смещение_с_низу = BoolSelector(true)  # graph input
смещение_с_низу_2 = DoubleSlider(-300, range=-300..1100 step 0.1)  # graph input
convert_between_units_2 = DynamoConvert(смещение_с_низу_2, MeasurementType="Length", FromConversion="Millimeters", ToConversion="Feet")
byCurveAndLevel = Python(IN[0]=code_block_16, IN[1]=высота_стены, IN[2]=code_block_14, IN[3]=flatten_3, IN[4]=code_block_17.out0, IN[5]=code_block_17.out1, IN[6]=code_block_17.out1, IN[7]=filterByBoolMask.in, IN[8]=disallowWallJoinAtEnd, IN[9]=code_block_13, IN[10]=floor_whigh_bool, IN[11]=convert_between_units, IN[12]=del_Regions, IN[13]=true_привязка_к_уровню_false, IN[14]=смещение_с_низу, IN[15]=convert_between_units_2)  # "Wall.ByCurveAndLevel"
# ---------- byCurveAndLevel.python (119 lines) ----------
import clr
import sys
# sys.path.append("C:/Program Files (x86)/IronPython 2.7/Lib")
import os
import shutil
import glob
import traceback
import json
import inspect
import gc  # garbage collector
import ctypes
import collections

clr.AddReference('RevitServices')
import RevitServices
from RevitServices.Persistence import DocumentManager
from RevitServices.Transactions import TransactionManager
doc = DocumentManager.Instance.CurrentDBDocument

clr.AddReference('RevitAPI')
import Autodesk
from Autodesk.Revit.DB import *

clr.AddReference('RevitNodes')
import Revit
clr.ImportExtensions(Revit.Elements)
clr.ImportExtensions(Revit.GeometryConversion)

from System.Diagnostics import Stopwatch, Process, StackTrace

UIunit = Document.GetUnits(doc).GetFormatOptions(UnitType.UT_Length).DisplayUnits

if isinstance(IN[0], list):
	lines = IN[0]
else:
	lines = [IN[0]]

height=IN[1]
level = UnwrapElement(IN[2])
types = UnwrapElement(IN[3])
location = IN[4]
flip=IN[5]
Struc = IN[6]
filledregions = UnwrapElement(IN[7])
disallowjoin = IN[8]
endlevel = UnwrapElement(IN[9])
floor_whigh_bool = IN[10]
floor_whigh_dim = IN[11]
del_regions = IN[12] 
level_attach = IN[13]
wall_base_offset_bool = IN[14]
wall_base_offset_dim = IN[15]
elements= []

"""
if location == "WallCenterline":
	locationLine=0
elif location == "CoreCenterline":
	locationLine=1
elif location == "FinishFaceExterior":
	locationLine=2	
elif location == "FinishFaceInterior":
	locationLine=3	
elif location == "CoreExterior":
	locationLine=4
elif location == "CoreInterior":
	locationLine=5
else:
	locationLine=0
"""
locationLine=0

#TransactionManager.Instance.ForceCloseTransaction()
TransactionManager.Instance.EnsureInTransaction(doc)
for line,type in zip(lines,types):
	if height != None:
		wall = Wall.Create(doc, line.ToRevitType(), type.Id, level.Id, (UnitUtils.ConvertToInternalUnits(height,UIunit)),0,flip,Struc)
	else :
		wall = Wall.Create(doc, line.ToRevitType() ,level.Id ,Struc)
		if type != None:
			wall.ChangeTypeId(type.Id)
	location = wall.get_Parameter(BuiltInParameter.WALL_KEY_REF_PARAM)
	location.Set(locationLine)
	elements.append(wall)	
#TransactionManager.Instance.TransactionTaskDone()

if disallowjoin:
	for w in elements:
		if WallUtils.IsWallJoinAllowedAtEnd(w, 0):
			WallUtils.DisallowWallJoinAtEnd(w, 0)
		if WallUtils.IsWallJoinAllowedAtEnd(w, 1):
			WallUtils.DisallowWallJoinAtEnd(w, 1)
if level_attach:			
	if floor_whigh_bool:
		for wall in elements:
			wall.get_Parameter(BuiltInParameter.WALL_HEIGHT_TYPE).Set(endlevel.Id)
			wall.get_Parameter(BuiltInParameter.WALL_TOP_OFFSET).Set(-floor_whigh_dim)	
TransactionManager.Instance.ForceCloseTransaction()

TransactionManager.Instance.EnsureInTransaction(doc)
if del_regions:
	for f in filledregions:
		doc.Delete(f.Id)

if wall_base_offset_bool:
	for wall in elements:
		wall.get_Parameter(BuiltInParameter.WALL_BASE_OFFSET).Set(wall_base_offset_dim)
TransactionManager.Instance.ForceCloseTransaction()

process_list = ["Revit", "Revit.exe", "Autodesk Revit"]
clear = ctypes.windll.kernel32.K32EmptyWorkingSet
all_proceses = [Process.GetProcessesByName(procs) for procs in process_list]
process_counter = sum([len(procs) for procs in all_proceses])
clear_proceses_k = [clear(p.Handle) for procs in all_proceses for p in procs]
clear_proceses_d = [p.Dispose() for procs in all_proceses for p in procs]
del process_list, clear, all_proceses, clear_proceses_k
gc.collect()

OUT = elements
# ----------------------------------------
поиск_в_имени_типа_3 = StringInput("ADSK_Внутренняя_Бетон_")  # graph input
