# Dynamo graph 0.Пакетное объединение массива.dyn (Dynamo 1.3.2.2480)

forceChildrensEval = ForceChildrensEval()  # unwired: arg0

# group: Get Revit Selection:
forceChildrensEval_2 = ForceChildrensEval()  # unwired: arg0
pys_get_revit_selection = Python(IN[0]=forceChildrensEval_2)
# ---------- pys_get_revit_selection.python (22 lines) ----------
import clr
clr.AddReference('RevitServices')
clr.AddReference('RevitAPI')
from Autodesk.Revit.DB import *
import RevitServices
from RevitServices.Persistence import DocumentManager
from Autodesk.Revit.ApplicationServices import Application

reset = IN[0]

doc = DocumentManager.Instance.CurrentDBDocument
uidoc = DocumentManager.Instance.CurrentUIApplication.ActiveUIDocument
ids = uidoc.Selection.GetElementIds()

idd = [str(i) for i in ids]

if isinstance(idd, list) == True:
	elems = [doc.GetElement(ElementId(int(i))) for i in idd]
else:
	elems = doc.GetElement(ElementId(int(idd)))

OUT = elems
# ----------------------------------------

code_block = CodeBlock(Flor=pys_get_revit_selection) { Flor; }
объединить_геометрию = BoolSelector(true)
python_script = Python(IN[0]=forceChildrensEval, IN[1]=code_block, IN[2]=code_block, IN[3]=объединить_геометрию)
# ---------- python_script.python (39 lines) ----------
if IN[3] == True:
	import clr

	clr.AddReference('ProtoGeometry')
	from Autodesk.DesignScript.Geometry import *
	
	clr.AddReference('RevitAPI')
	import Autodesk
	
	clr.AddReference('RevitServices')
	import RevitServices
	from RevitServices.Persistence import DocumentManager
	from RevitServices.Transactions import TransactionManager
	
	clr.AddReference("RevitNodes")
	import Revit
	clr.ImportExtensions(Revit.Elements)
	
	dataEnteringNode = IN
	
	reset = IN[0]
	items1 = UnwrapElement(IN[1])
	items2 = UnwrapElement(IN[2])
	
	doc = DocumentManager.Instance.CurrentDBDocument
	
	results = 0
	
	TransactionManager.Instance.EnsureInTransaction(doc)
	for item1 in items1:
		for item2 in items2:
			try:
				result = Autodesk.Revit.DB.JoinGeometryUtils.JoinGeometry(doc,item1,item2)
				results = results + 1
			except:
				pass
	TransactionManager.Instance.TransactionTaskDone()

OUT = results
# ----------------------------------------
количество_объединённых = Watch(python_script)  # "Количество объединённых элементов"
