# Dynamo graph 3.Создание стен по Цветовым облостям V0.3 (полученым из DWG, заливка стен).dyn (Dynamo 1.3.2.2480)

# note: ВСЁ ОСТАЛЬНОЕ

# group: ЭЛЕМЕНТЫ УПРАВЛЕНИЯ
# note: ПЕРЕМЕННЫЕ ЗНАЧЕНИЯ
# note: ЭЛЕМЕНТЫ УПРАВЛЕНИЯ

# group: ПОЛУЧАЕМ ДАННЫЕ ИЗ РЕВИТ
# note: ПОЛУЧАЕМ ДАННЫЕ ИЗ РЕВИТ

# group: ПРОВЕРОЧНЫЕ НОДЫ
# note: ПРОВЕРОЧНЫЕ НОДЫ

# group: КЛЮЧЕВЫЕ МОМЕНТЫ РАБОТЫ 1
# note: ИТОГОВАЯ КОНСОЛИДАЦИЯ ДАННЫХ

# group: ИСПОЛНИТЕЛЬНЫЕ НОДЫ (фильтрование, подбор, списки и т.д.)
# note: ИСПОЛНИТЕЛЬНЫЕ НОДЫ
# note: НОДЫ РАБОТАЮЩИЕ С ДАННЫМИ

# group: ПЕРЕДАЁМ ИНФОРМАЦИЮ В РЕВИТ
# note: ПЕРЕДАЁМ ИНФОРМАЦИЮ В РЕВИТ

# group: ЗАПАСНЫЕ ВАРИАНТЫ, ДОПОЛНИТЕЛЬНЫЕ ОПЦИИ
# note: ЗАПАСНЫЕ
# note: ДОПОЛНИТЕЛЬНЫЕ. Градации серово по важности, темнее - важнее

# group: ПРИМЕЧАНИЯ ПО ЦВЕТОВОЙ ГРУППИРОВКЕ
# note: GUIDELINES

# group: КЛЮЧЕВЫЕ МОМЕНТЫ РАБОТЫ 2
# note: НОДЫ РАБОТАЮЩИЕ С ДАННЫМИ
# note: ИСПОЛНИТЕЛЬНЫЕ НОДЫ

# group: ЭЛЕМЕНТЫ УПРАВЛЕНИЯ Dyno Studio
# note: Dyno Studio

# group: ЭЛЕМЕНТЫ УПРАВЛЕНИЯ 2 УРОВЕНЬ
# note: ЭЛЕМЕНТЫ УПРАВЛЕНИЯ
# note: ПЕРЕМЕННЫЕ ЗНАЧЕНИЯ

boolean = BoolSelector(true)  # frozen
code_block = CodeBlock { 1; 2; }
if_ = Python(IN[0]=boolean, IN[1]=code_block.out0, IN[2]=code_block.out1)
# ---------- if_.python (12 lines) ----------
import clr
boolean = IN[0]
true = UnwrapElement(IN[1])
false = UnwrapElement(IN[2])

if boolean:
	out = true
else:
	out = false

#Назначьте вывод переменной OUT.
OUT = out
# ----------------------------------------
geometry = Element.Geometry()  # unwired: arg0
setParameterByName = Element.SetParameterByName()  # unwired: element, parameterName, value
getParameterValueByName = Element.GetParameterValueByName()  # unwired: element, parameterName

# group: Parameters name from language
parameters_name_from_language = Python()  # frozen
# ---------- parameters_name_from_language.python (18 lines) ----------
import clr
clr.AddReference('RevitServices')
import RevitServices
from RevitServices.Persistence import DocumentManager

uiapp = DocumentManager.Instance.CurrentUIApplication
app = uiapp.Application
lng = app.Language
rus = ["Тип","Имя семейства","Имя типа"]
enu = ["Type","Family name","Type name"]
out = []
if str(lng) == "Russian":
	out = rus
else:
	out = enu
#English_USA
#Russian
OUT = out
# ----------------------------------------

# group: элементы внутри групп
members = Python()  # "Group.Members"; frozen; unwired: IN[0]
# ---------- members.python (19 lines) ----------
import clr
clr.AddReference('RevitAPI')
from Autodesk.Revit.DB import *

clr.AddReference("RevitNodes")
import Revit
clr.ImportExtensions(Revit.Elements)

groups = UnwrapElement(IN[0])
elementlist = list()
for item in groups:
	try:
		memberlist = list()
		for member in item.GetMemberIds():
			memberlist.append(item.Document.GetElement(member))
		elementlist.append(memberlist)
	except:
		elementlist.append(list())
OUT = elementlist
# ----------------------------------------

выбрать_элементы_в_модели = DSModelElementsSelection()

# group: Get Revit Selection:
forceChildrensEval = ForceChildrensEval()  # unwired: arg0
pys_get_revit_selection = Python(IN[0]=forceChildrensEval)
# ---------- pys_get_revit_selection.python (22 lines) ----------
import clr
clr.AddReference('RevitServices')
clr.AddReference('RevitAPI')
from Autodesk.Revit.DB import *
import RevitServices
from RevitServices.Persistence import DocumentManager
from Autodesk.Revit.ApplicationServices import Application

reset = IN[0]

doc = DocumentManager.Instance.CurrentDBDocument
uidoc = DocumentManager.Instance.CurrentUIApplication.ActiveUIDocument
ids = uidoc.Selection.GetElementIds()

idd = [str(i) for i in ids]

if isinstance(idd, list) == True:
	elems = [doc.GetElement(ElementId(int(i))) for i in idd]
else:
	elems = doc.GetElement(ElementId(int(idd)))

OUT = elems
# ----------------------------------------

if_2 = Python(IN[0]=выбрать_элементы_в_модели, IN[1]=pys_get_revit_selection)
# ---------- if_2.python (12 lines) ----------
import clr

true = UnwrapElement(IN[0])
false = UnwrapElement(IN[1])

if true == None:
	out = false
else:
	out = true

#Назначьте вывод переменной OUT.
OUT = out
# ----------------------------------------
type = Object.Type(if_2)
code_block_2 = CodeBlock { "FilledRegion"; }
contains = String.Contains(str=type, searchFor=code_block_2)
filterByBoolMask = List.FilterByBoolMask(list=if_2, mask=contains)
boundingBox = Geometry.BoundingBox(filterByBoolMask.in)
toCuboid = BoundingBox.ToCuboid(boundingBox)
explode = Geometry.Explode(toCuboid)
flatten = Flatten(explode)
code_block_3 = CodeBlock { 0.5; 1; }
getIsoline = Surface.GetIsoline(flatten, arg2=code_block_3.out0)
getIsoline_2 = Surface.GetIsoline(flatten, code_block_3.out1, code_block_3.out0)
create = List.Create(getIsoline, getIsoline_2)
transpose = List.Transpose(create)
length = Curve.Length(transpose)
round = Math.Round(length)
sortByKey = List.SortByKey(list=transpose@L2, keys=round@L2)
code_block_4 = CodeBlock { 1; 0; }
getItemAtIndex = List.GetItemAtIndex(list=sortByKey.sorted_list@L2, index=code_block_4.out0)
length_2 = Curve.Length(getItemAtIndex)
не_создавать_стены_меньше = DoubleSlider(100, range=0..100 step 0.1)
lt = length_2 < не_создавать_стены_меньше
filterByBoolMask_2 = List.FilterByBoolMask(list=getItemAtIndex, mask=lt)
forceChildrensEval_2 = ForceChildrensEval()  # unwired: arg0
python_script = Python(IN[0]=forceChildrensEval_2)
# ---------- python_script.python (25 lines) ----------
#Copyright(c) 2016, Dimitar Venkov
# @5devene, dimitar.ven@gmail.com

import clr

clr.AddReference("RevitServices")
import RevitServices
from RevitServices.Persistence import DocumentManager
doc = DocumentManager.Instance.CurrentDBDocument

clr.AddReference("RevitAPI")
from Autodesk.Revit.DB import *

clr.AddReference("RevitNodes")
import Revit
clr.ImportExtensions(Revit.Elements)


result = []

fec = FilteredElementCollector(doc).OfClass(WallType)
for i in fec:
	result.append(i.ToDSType(True))
	
OUT = result
# ----------------------------------------
name = Family.Name(python_script)
поиск_в_имени_типа = StringInput("Внутренняя_Газобетон_")
getItemAtIndex_2 = List.GetItemAtIndex(list=sortByKey.sorted_keys@L2, index=code_block_4.out1)
filterByBoolMask_3 = List.FilterByBoolMask(list=getItemAtIndex_2, mask=lt)
string_from_object = FromObject(filterByBoolMask_3.out)
code_block_5 = CodeBlock { ","; 0; }
split = String.Split(string_from_object, code_block_5.out0)
getItemAtIndex_3 = List.GetItemAtIndex(list=split@L2, index=code_block_5.out1)
code_block_6 = CodeBlock(y=поиск_в_имени_типа, x=getItemAtIndex_3) { y+x; }
contains_2 = String.Contains(str=name, searchFor=code_block_6@L1)
allFalse = AllFalse(contains_2@L2)
filterByBoolMask_4 = List.FilterByBoolMask(list=filterByBoolMask_2.out, mask=allFalse)
code_block_7 = CodeBlock(curves=filterByBoolMask_4.out) { curves; }
create_2 = List.Create()  # unwired: arg0
map = List.Map(list=code_block_7, f_x=create_2)
code_block_8 = CodeBlock { "Уровни"; }
byName = Category.ByName(code_block_8)
all_elements_of_category = ElementsOfCategory(byName)
name_2 = Level.Name(all_elements_of_category)
уровень_размещения = Levels("Этаж 02")
name_3 = Level.Name(уровень_размещения)
eq = name_2 == name_3
filterByBoolMask_5 = List.FilterByBoolMask(list=all_elements_of_category, mask=eq)
code_block_9 = CodeBlock(startlevel=filterByBoolMask_5.in) { startlevel; }
count = List.Count(code_block_7)
ofRepeatedItem = List.OfRepeatedItem(item=code_block_9, amount=count)
code_block_10 = CodeBlock { true; }
indexOf = IndexOf(eq, code_block_10)
code_block_11 = CodeBlock(i=indexOf) { i+1; }
getItemAtIndex_4 = List.GetItemAtIndex(list=all_elements_of_category, index=code_block_11)
code_block_12 = CodeBlock(endlevel=getItemAtIndex_4) { endlevel; }
ofRepeatedItem_2 = List.OfRepeatedItem(item=code_block_12, amount=count)
filterByBoolMask_6 = List.FilterByBoolMask(list=python_script, mask=contains_2@L2)
flatten_2 = Flatten(filterByBoolMask_6.in)
create_3 = List.Create()  # unwired: arg0
map_2 = List.Map(list=flatten_2, f_x=create_3)
byCurveAndLevels = Wall.ByCurveAndLevels(map, ofRepeatedItem, ofRepeatedItem_2, map_2)
current = Document.Current()  # frozen
activeView = Document.ActiveView(current)
code_block_13 = CodeBlock { "Связанный уровень"; }
getParameterValueByName_2 = Element.GetParameterValueByName(element=activeView, parameterName=code_block_13)
faces = Element.Faces(filterByBoolMask.in)
length_3 = Curve.Length(code_block_7)
