# Dynamo graph 3.Создание стен по Цветовым облостям V0.6 (полученым из DWG, заливка стен).dyn (Dynamo 1.3.4.6666)

# note: ВСЁ ОСТАЛЬНОЕ

# group: ЭЛЕМЕНТЫ УПРАВЛЕНИЯ
# note: ПЕРЕМЕННЫЕ ЗНАЧЕНИЯ
# note: ЭЛЕМЕНТЫ УПРАВЛЕНИЯ

# group: ПОЛУЧАЕМ ДАННЫЕ ИЗ РЕВИТ
# note: ПОЛУЧАЕМ ДАННЫЕ ИЗ РЕВИТ

# group: ПРОВЕРОЧНЫЕ НОДЫ
# note: ПРОВЕРОЧНЫЕ НОДЫ

# group: КЛЮЧЕВЫЕ МОМЕНТЫ РАБОТЫ 1
# note: ИТОГОВАЯ КОНСОЛИДАЦИЯ ДАННЫХ

# group: ИСПОЛНИТЕЛЬНЫЕ НОДЫ (фильтрование, подбор, списки и т.д.)
# note: ИСПОЛНИТЕЛЬНЫЕ НОДЫ
# note: НОДЫ РАБОТАЮЩИЕ С ДАННЫМИ

# group: ПЕРЕДАЁМ ИНФОРМАЦИЮ В РЕВИТ
# note: ПЕРЕДАЁМ ИНФОРМАЦИЮ В РЕВИТ

# group: ЗАПАСНЫЕ ВАРИАНТЫ, ДОПОЛНИТЕЛЬНЫЕ ОПЦИИ
# note: ЗАПАСНЫЕ
# note: ДОПОЛНИТЕЛЬНЫЕ. Градации серово по важности, темнее - важнее

# group: ПРИМЕЧАНИЯ ПО ЦВЕТОВОЙ ГРУППИРОВКЕ
# note: GUIDELINES

# group: КЛЮЧЕВЫЕ МОМЕНТЫ РАБОТЫ 2
# note: НОДЫ РАБОТАЮЩИЕ С ДАННЫМИ
# note: ИСПОЛНИТЕЛЬНЫЕ НОДЫ

# group: ЭЛЕМЕНТЫ УПРАВЛЕНИЯ Dyno Studio
# note: Dyno Studio

# group: ЭЛЕМЕНТЫ УПРАВЛЕНИЯ 2 УРОВЕНЬ
# note: ЭЛЕМЕНТЫ УПРАВЛЕНИЯ
# note: ПЕРЕМЕННЫЕ ЗНАЧЕНИЯ

boolean = BoolSelector(true)  # frozen
code_block = CodeBlock { 1; 2; }
if_ = Python(IN[0]=boolean, IN[1]=code_block.out0, IN[2]=code_block.out1)
# ---------- if_.python (12 lines) ----------
import clr
boolean = IN[0]
true = UnwrapElement(IN[1])
false = UnwrapElement(IN[2])

if boolean:
	out = true
else:
	out = false

#Назначьте вывод переменной OUT.
OUT = out
# ----------------------------------------
geometry = Element.Geometry()  # unwired: arg0
setParameterByName = Element.SetParameterByName()  # unwired: element, parameterName, value
getParameterValueByName = Element.GetParameterValueByName()  # unwired: element, parameterName

# group: Parameters name from language
parameters_name_from_language = Python()  # frozen
# ---------- parameters_name_from_language.python (18 lines) ----------
import clr
clr.AddReference('RevitServices')
import RevitServices
from RevitServices.Persistence import DocumentManager

uiapp = DocumentManager.Instance.CurrentUIApplication
app = uiapp.Application
lng = app.Language
rus = ["Тип","Имя семейства","Имя типа"]
enu = ["Type","Family name","Type name"]
out = []
if str(lng) == "Russian":
	out = rus
else:
	out = enu
#English_USA
#Russian
OUT = out
# ----------------------------------------

# group: элементы внутри групп
members = Python()  # "Group.Members"; frozen; unwired: IN[0]
# ---------- members.python (19 lines) ----------
import clr
clr.AddReference('RevitAPI')
from Autodesk.Revit.DB import *

clr.AddReference("RevitNodes")
import Revit
clr.ImportExtensions(Revit.Elements)

groups = UnwrapElement(IN[0])
elementlist = list()
for item in groups:
	try:
		memberlist = list()
		for member in item.GetMemberIds():
			memberlist.append(item.Document.GetElement(member))
		elementlist.append(memberlist)
	except:
		elementlist.append(list())
OUT = elementlist
# ----------------------------------------

выбрать_элементы_в_модели = DSModelElementsSelection()

# group: Get Revit Selection:
forceChildrensEval = ForceChildrensEval()  # unwired: arg0
pys_get_revit_selection = Python(IN[0]=forceChildrensEval)
# ---------- pys_get_revit_selection.python (22 lines) ----------
import clr
clr.AddReference('RevitServices')
clr.AddReference('RevitAPI')
from Autodesk.Revit.DB import *
import RevitServices
from RevitServices.Persistence import DocumentManager
from Autodesk.Revit.ApplicationServices import Application

reset = IN[0]

doc = DocumentManager.Instance.CurrentDBDocument
uidoc = DocumentManager.Instance.CurrentUIApplication.ActiveUIDocument
ids = uidoc.Selection.GetElementIds()

idd = [str(i) for i in ids]

if isinstance(idd, list) == True:
	elems = [doc.GetElement(ElementId(int(i))) for i in idd]
else:
	elems = doc.GetElement(ElementId(int(idd)))

OUT = elems
# ----------------------------------------

if_2 = Python(IN[0]=выбрать_элементы_в_модели, IN[1]=pys_get_revit_selection)
# ---------- if_2.python (12 lines) ----------
import clr

true = UnwrapElement(IN[0])
false = UnwrapElement(IN[1])

if true == None:
	out = false
else:
	out = true

#Назначьте вывод переменной OUT.
OUT = out
# ----------------------------------------
type = Object.Type(if_2)
code_block_2 = CodeBlock { "FilledRegion"; }
contains = String.Contains(str=type, searchFor=code_block_2)
filterByBoolMask = List.FilterByBoolMask(list=if_2, mask=contains)
faces = Element.Faces(filterByBoolMask.in)
flatten = Flatten(faces)
perimeterCurves = Surface.PerimeterCurves(flatten)
count = List.Count(perimeterCurves@L2)
code_block_3 = CodeBlock(l=count) { l!=4; }
filterByBoolMask_2 = List.FilterByBoolMask(list=filterByBoolMask.in, mask=code_block_3)
boundingBox = Geometry.BoundingBox(filterByBoolMask_2.out)
toCuboid = BoundingBox.ToCuboid(boundingBox)
explode = Geometry.Explode(toCuboid)
flatten_2 = Flatten(explode)
code_block_4 = CodeBlock { 0.5; 1; }
getIsoline = Surface.GetIsoline(flatten_2, arg2=code_block_4.out0)
getIsoline_2 = Surface.GetIsoline(flatten_2, code_block_4.out1, code_block_4.out0)
create = List.Create(getIsoline, getIsoline_2)
transpose = List.Transpose(create)
length = Curve.Length(transpose)
round = Math.Round(length)
sortByKey = List.SortByKey(list=transpose@L2, keys=round@L2)
code_block_5 = CodeBlock { 1; 0; }
getItemAtIndex = List.GetItemAtIndex(list=sortByKey.sorted_list@L2, index=code_block_5.out0)
length_2 = Curve.Length(getItemAtIndex)
не_создавать_стены_меньше = DoubleSlider(100, range=0..100 step 0.1)
lt = length_2 < не_создавать_стены_меньше
filterByBoolMask_3 = List.FilterByBoolMask(list=getItemAtIndex, mask=lt)
code_block_6 = CodeBlock(curves=filterByBoolMask_3.out) { curves; }
length_3 = Curve.Length(code_block_6)
create_2 = List.Create()  # unwired: arg0
map = List.Map(list=code_block_6, f_x=create_2)
forceChildrensEval_2 = ForceChildrensEval()  # unwired: arg0
python_script = Python(IN[0]=forceChildrensEval_2)
# ---------- python_script.python (25 lines) ----------
#Copyright(c) 2016, Dimitar Venkov
# @5devene, dimitar.ven@gmail.com

import clr

clr.AddReference("RevitServices")
import RevitServices
from RevitServices.Persistence import DocumentManager
doc = DocumentManager.Instance.CurrentDBDocument

clr.AddReference("RevitAPI")
from Autodesk.Revit.DB import *

clr.AddReference("RevitNodes")
import Revit
clr.ImportExtensions(Revit.Elements)


result = []

fec = FilteredElementCollector(doc).OfClass(WallType)
for i in fec:
	result.append(i.ToDSType(True))
	
OUT = result
# ----------------------------------------
name = Family.Name(python_script)
поиск_в_имени_типа = StringInput("ADSK_Внутренняя_Газобетон_")
getItemAtIndex_2 = List.GetItemAtIndex(list=sortByKey.sorted_keys@L2, index=code_block_5.out1)
filterByBoolMask_4 = List.FilterByBoolMask(list=getItemAtIndex_2, mask=lt)
code_block_7 = CodeBlock(t4=filterByBoolMask_4.out) { t3 = Math.Round(t4); t1 = t3 / 10; t5 = Math.Round(t1); t2 = t5 * 10; }
string_from_object = FromObject(code_block_7.t2)
code_block_8 = CodeBlock { ","; 0; }
split = String.Split(string_from_object, code_block_8.out0)
getItemAtIndex_3 = List.GetItemAtIndex(list=split@L2, index=code_block_8.out1)
code_block_9 = CodeBlock(y=поиск_в_имени_типа, x=getItemAtIndex_3) { y+x; }
contains_2 = String.Contains(str=name, searchFor=code_block_9@L1)
filterByBoolMask_5 = List.FilterByBoolMask(list=python_script, mask=contains_2@L2)
flatten_3 = Flatten(filterByBoolMask_5.in)
create_3 = List.Create()  # unwired: arg0
map_2 = List.Map(list=flatten_3, f_x=create_3)
duplicate_item_indices = Python()  # frozen; unwired: IN[0]
# ---------- duplicate_item_indices.python (24 lines) ----------
#Copyright(c) 2015, Konrad Sobon
# @arch_laboratory, http://archi-lab.net

import clr
clr.AddReference('ProtoGeometry')
from Autodesk.DesignScript.Geometry import *
#The inputs to this node will be stored as a list in the IN variable.
dataEnteringNode = IN

mylist = IN[0]

seen, result, unique = set(), [], []
for a in mylist:
	for idx, item in enumerate(a):
	    if item not in seen:
	    	seen.add(item)
	    	unique.append(idx)        
	    	# First time seeing the element
	    else:
	    	result.append(idx)
	    	# Already seen, add the index to the result

#Assign your output to the OUT variable
OUT = unique, result, seen
# ----------------------------------------
filterByBoolMask_6 = List.FilterByBoolMask(list=perimeterCurves, mask=code_block_3)
code_block_10 = CodeBlock(test=filterByBoolMask_6.in) { test; }
length_4 = Curve.Length(code_block_10)
round_2 = Math.Round(length_4)
minimumItem = List.MinimumItem(round_2@L2)
sortByKey_2 = List.SortByKey(list=code_block_10@L2, keys=round_2@L2)
groupByKey = List.GroupByKey(list=sortByKey_2.sorted_list@L2, keys=sortByKey_2.sorted_keys@L2)
code_block_11 = CodeBlock { 0; }
getItemAtIndex_4 = List.GetItemAtIndex(list=groupByKey.groups@L3, index=code_block_11)
code_block_12 = CodeBlock { 0.5; }
pointAtParameter = Curve.PointAtParameter(curve=getItemAtIndex_4, param=code_block_12)
normalAtParameter = Curve.NormalAtParameter(curve=getItemAtIndex_4, param=code_block_12)
reverse = Vector.Reverse(normalAtParameter)
flatten_4 = Flatten(round_2)
maximumItem = List.MaximumItem(flatten_4)
code_block_13 = CodeBlock(x=maximumItem) { x*2; }
byStartPointDirectionLength = Line.ByStartPointDirectionLength(startPoint=pointAtParameter, direction=reverse, length=code_block_13)
byJoinedCurves = PolyCurve.ByJoinedCurves(code_block_10)
intersect = Geometry.Intersect(geometry=byStartPointDirectionLength@L2, other=byJoinedCurves, lacing=Longest)
splitByPoints = Curve.SplitByPoints(curve=byStartPointDirectionLength, points=intersect)
code_block_14 = CodeBlock { 0; }
getItemAtIndex_5 = List.GetItemAtIndex(list=splitByPoints@@L2, index=code_block_14)
flatten_5 = Flatten(getItemAtIndex_5)
pointAtParameter_2 = Curve.PointAtParameter(curve=getItemAtIndex_5, param=code_block_12)
string_from_object_2 = FromObject(pointAtParameter_2)
duplicate_item_indices_2 = Python(IN[0]=string_from_object_2)
# ---------- duplicate_item_indices_2.python (24 lines) ----------
#Copyright(c) 2015, Konrad Sobon
# @arch_laboratory, http://archi-lab.net

import clr
clr.AddReference('ProtoGeometry')
from Autodesk.DesignScript.Geometry import *
#The inputs to this node will be stored as a list in the IN variable.
dataEnteringNode = IN

mylist = IN[0]

seen, result, unique = set(), [], []
sort = []
for a in mylist:
	for idx, item in enumerate(a):
	    if item not in seen:
	    	seen.add(item)
	    	sort.append(False)
	    else:
	    	sort.append(True)
	    	# Already seen, add the index to the result

#Assign your output to the OUT variable
OUT = sort
# ----------------------------------------
filterByBoolMask_7 = List.FilterByBoolMask(list=flatten_5, mask=duplicate_item_indices_2)
length_5 = Curve.Length(filterByBoolMask_7.out)
не_создавать_стены_меньше_2 = DoubleSlider(100, range=0..100 step 0.1)
lt_2 = length_5 < не_создавать_стены_меньше_2
filterByBoolMask_8 = List.FilterByBoolMask(list=filterByBoolMask_7.out, mask=lt_2)
allFalse = AllFalse(contains_2@L2)
filterByBoolMask_9 = List.FilterByBoolMask(list=filterByBoolMask_3.out, mask=allFalse)
join = List.Join(filterByBoolMask_8.out, filterByBoolMask_9.out)
flatten_6 = Flatten(getItemAtIndex_4)
filterByBoolMask_10 = List.FilterByBoolMask(list=flatten_6, mask=duplicate_item_indices_2)
length_6 = Curve.Length(filterByBoolMask_10.out)
code_block_15 = CodeBlock(t4=length_6) { t3 = Math.Round(t4); x = t3; t1 = x / 10; t5 = Math.Round(t1); x1 = t5; t2 = x1 * 10; }
filterByBoolMask_11 = List.FilterByBoolMask(list=code_block_15.t2, mask=lt_2)
join_2 = List.Join(filterByBoolMask_11.out, code_block_7.t2)

# group: Нет ли не учтенных в типоразмеров?
uniqueItems = List.UniqueItems(join_2)

uniqueItems_2 = List.UniqueItems(code_block_9)
sum_of_true = Python(IN[0]=contains_2)
# ---------- sum_of_true.python (12 lines) ----------
lists = IN[0]
test = []

for list in lists:
	for i,l in enumerate(list):
		if len(test) > i+1:
			if l == True and test[i] != True:
				test[i] = l
		else:
			test.append(l)

OUT = test
# ----------------------------------------
wait_then_passthrough = Custom[Wait Then Passthrough]()  # unwired: anyData, secondsToWait
code_block_16 = CodeBlock { "Уровни"; }
byName = Category.ByName(code_block_16)
all_elements_of_category = ElementsOfCategory(byName)
name_2 = Level.Name(all_elements_of_category)
уровень_размещения = Levels("Этаж 01")
name_3 = Level.Name(уровень_размещения)
eq = name_2 == name_3
filterByBoolMask_12 = List.FilterByBoolMask(list=all_elements_of_category, mask=eq)
code_block_17 = CodeBlock(startlevel=filterByBoolMask_12.in) { startlevel[0]; }
count_2 = List.Count(code_block_6)
ofRepeatedItem = List.OfRepeatedItem(item=code_block_17, amount=count_2)
code_block_18 = CodeBlock { true; }
indexOf = IndexOf(eq, code_block_18)
code_block_19 = CodeBlock(i=indexOf) { i+1; }
getItemAtIndex_6 = List.GetItemAtIndex(list=all_elements_of_category, index=code_block_19)
code_block_20 = CodeBlock(endlevel=getItemAtIndex_6) { endlevel; }
ofRepeatedItem_2 = List.OfRepeatedItem(item=code_block_20, amount=count_2)
byCurveAndLevels = Wall.ByCurveAndLevels(code_block_6, ofRepeatedItem, ofRepeatedItem_2, flatten_3)  # frozen
passthrough = Custom[Passthrough](passThrough=filterByBoolMask.in, waitFor=byCurveAndLevels)  # Forces a sequential order of execution. The node wired into the output of the Passthrough node will be executed *after* the node wired into the waitFor input (e.g. important for some Revit operations). The value of the passThrough input will be passed on to the node wired into the output port of the Passthrough node.
delete = archilab.Revit.Elements.Elements.Delete(passthrough)
forceChildrensEval_3 = ForceChildrensEval()  # unwired: arg0
python_script_2 = Python(IN[0]=forceChildrensEval_3)
# ---------- python_script_2.python (24 lines) ----------
import clr
clr.AddReference('ProtoGeometry')
from Autodesk.DesignScript.Geometry import *
clr.AddReference('RevitAPI')
from Autodesk.Revit.DB import *
import Autodesk
clr.AddReference("RevitServices")
import RevitServices
from RevitServices.Persistence import DocumentManager
from RevitServices.Transactions import TransactionManager
doc = DocumentManager.Instance.CurrentDBDocument
uidoc = DocumentManager.Instance.CurrentUIApplication.ActiveUIDocument
ids = uidoc.Selection.GetElementIds()
idd = [str(i) for i in ids]
if isinstance(idd, list) == True:
	elems = [doc.GetElement(ElementId(int(i))) for i in idd]
else:
	elems = doc.GetElement(ElementId(int(idd)))
TransactionManager.Instance.EnsureInTransaction(doc)
for e in elems:
	Autodesk.Revit.DB.WallUtils.DisallowWallJoinAtEnd(e, 0)
	Autodesk.Revit.DB.WallUtils.DisallowWallJoinAtEnd(e, 1)
TransactionManager.Instance.TransactionTaskDone()
OUT = elems
# ----------------------------------------
wall_bycurveandlevel = Custom[Wall ByCurveAndLevel]()  # Creates a wall using the specified guiding curve and level.; unwired: curve, Level
elevation = Level.Elevation(ofRepeatedItem_2)
elevation_2 = Level.Elevation(ofRepeatedItem)
code_block_21 = CodeBlock(x=elevation, y=elevation_2) { x-y; }
round_3 = Math.Round(code_block_21)
code_block_22 = CodeBlock { "WallCenterline"; false; }
byCurveAndLevel = Python(IN[0]=code_block_6, IN[1]=round_3, IN[2]=ofRepeatedItem, IN[3]=flatten_3, IN[4]=code_block_22.out0, IN[5]=code_block_22.out1, IN[6]=code_block_22.out1)  # "Wall.ByCurveAndLevel"
# ---------- byCurveAndLevel.python (66 lines) ----------
import clr
clr.AddReference('RevitServices')
import RevitServices
from RevitServices.Persistence import DocumentManager
from RevitServices.Transactions import TransactionManager
doc = DocumentManager.Instance.CurrentDBDocument

clr.AddReference('RevitAPI')
import Autodesk
from Autodesk.Revit.DB import *

clr.AddReference('RevitNodes')
import Revit
clr.ImportExtensions(Revit.Elements)
clr.ImportExtensions(Revit.GeometryConversion)

UIunit = Document.GetUnits(doc).GetFormatOptions(UnitType.UT_Length).DisplayUnits

if isinstance(IN[0], list):
	lines = IN[0]
else:
	lines = [IN[0]]

height=IN[1]
level = UnwrapElement(IN[2])
types = UnwrapElement(IN[3])
location = IN[4]
flip=IN[5]
Struc = IN[6]
ele= []

"""
if location == "WallCenterline":
	locationLine=0
elif location == "CoreCenterline":
	locationLine=1
elif location == "FinishFaceExterior":
	locationLine=2	
elif location == "FinishFaceInterior":
	locationLine=3	
elif location == "CoreExterior":
	locationLine=4
elif location == "CoreInterior":
	locationLine=5
else:
	locationLine=0
"""
locationLine=0

TransactionManager.Instance.EnsureInTransaction(doc)
for line,type in zip(lines,types):
	if height != None:
		wall = Wall.Create(doc, line.ToRevitType(), type.Id, level.Id, (UnitUtils.ConvertToInternalUnits(height,UIunit)),0,flip,Struc)
	else :
		wall = Wall.Create(doc, line.ToRevitType() ,level.Id ,Struc)
		if type != None:
			wall.ChangeTypeId(type.Id)
		else:
			pass
	location = wall.get_Parameter(BuiltInParameter.WALL_KEY_REF_PARAM)
	location.Set(locationLine)
	ele.append(wall)	
TransactionManager.Instance.TransactionTaskDone()

if isinstance(IN[0], list): OUT = ele 
else: OUT = ele[0]
# ----------------------------------------
