# Dynamo graph Стены.РазрешитьСоединение по типу.dyn (Dynamo 2.3.0.5885)

разрешить_соединение = BoolSelector(true)  # graph input
wall_types = WallTypes("Тип 4 - АР_Наружные_Фасад_Ут-120.От-10_по монолиту_RAL 9003")
walls_by_type_collector = Python(IN[0]=wall_types)
# ---------- walls_by_type_collector.python (25 lines) ----------
import clr
clr.AddReference('RevitServices')
clr.AddReference('RevitAPI')
from Autodesk.Revit.DB import *
import RevitServices
from RevitServices.Persistence import DocumentManager
from Autodesk.Revit.ApplicationServices import Application
clr.AddReference('RevitAPIUI')
from Autodesk.Revit.UI.Selection import ISelectionFilter, ObjectType
clr.AddReference("RevitServices")
import RevitServices
from RevitServices.Persistence import DocumentManager
from RevitServices.Transactions import TransactionManager

#reset = IN[0]

doc = DocumentManager.Instance.CurrentDBDocument
uidoc = DocumentManager.Instance.CurrentUIApplication.ActiveUIDocument
type_id = UnwrapElement(IN[0]).Id.IntegerValue

all_walls = FilteredElementCollector(doc).OfCategory(BuiltInCategory.OST_Walls).WhereElementIsNotElementType()

filtred_walls = [wall for wall in all_walls if wall.WallType.Id.IntegerValue == type_id]

OUT = filtred_walls
# ----------------------------------------
wall_types_2 = WallTypes("Тип 3 - АР_Наружные_Фасад_ГБ-200.Ут-120.От-10_лоджии_RAL 9003")
walls_by_type_collector_2 = Python(IN[0]=wall_types_2)  # same code as walls_by_type_collector
join = List.Join(list0=walls_by_type_collector, list1=walls_by_type_collector_2)
python = Python(IN[0]=разрешить_соединение, IN[1]=join)
# ---------- python.python (72 lines) ----------
import clr
clr.AddReference('RevitServices')
clr.AddReference('RevitAPI')
from Autodesk.Revit.DB import *
import RevitServices
from RevitServices.Persistence import DocumentManager
from Autodesk.Revit.ApplicationServices import Application
clr.AddReference('RevitAPIUI')
from Autodesk.Revit.UI.Selection import ISelectionFilter, ObjectType
clr.AddReference("RevitServices")
import RevitServices
from RevitServices.Persistence import DocumentManager
from RevitServices.Transactions import TransactionManager


class CustomISelectionFilterList(ISelectionFilter):
	def __init__(self):
		pass
	def AllowElement(self, e):
		if e.Category.Id.IntegerValue == BuiltInCategory.OST_Walls.GetHashCode():
			return True
		else:
			return False
	def AllowReference(self, ref):
		return False

#reset = IN[0]

doc = DocumentManager.Instance.CurrentDBDocument
uidoc = DocumentManager.Instance.CurrentUIApplication.ActiveUIDocument


#refs = uidoc.Selection.PickObjects(ObjectType.Element,CustomISelectionFilterList(), "Выбрать элементы.")
#elems = [doc.GetElement(re.ElementId) for re in refs ]
#rezult = []

TransactionManager.Instance.EnsureInTransaction(doc)
if IN[0]:
	for wall in UnwrapElement(IN[1]):
		WallUtils.AllowWallJoinAtEnd(wall, 0)
		WallUtils.AllowWallJoinAtEnd(wall, 1)
"""
	for e in elems:
		wallc = e.Location
		TransactionManager.Instance.EnsureInTransaction(doc)
		join1 = wallc.set_JoinType(0,JoinType.Miter)
		join2 = wallc.set_JoinType(1,JoinType.Miter)
		TransactionManager.Instance.TransactionTaskDone()
		rezult.append(wallc)
else:
	for e in elems:
		wallc = e.Location
		TransactionManager.Instance.EnsureInTransaction(doc)
		join1 = wallc.set_JoinType(0,JoinType.Abut)
		join2 = wallc.set_JoinType(1,JoinType.Abut)
		TransactionManager.Instance.TransactionTaskDone()
		rezult.append(wallc)
"""

		
TransactionManager.Instance.TransactionTaskDone()	
"""
ids = uidoc.Selection.GetElementIds()

idd = [str(i) for i in ids]

if isinstance(idd, list) == True:
	elems = [doc.GetElement(ElementId(int(i))) for i in idd]
else:
	elems = doc.GetElement(ElementId(int(idd)))
"""
OUT = len(IN[1])
# ----------------------------------------
select_model_elements = DSModelElementsSelection()  # 2 picked in the model
watch = Watch(select_model_elements)
