# Dynamo graph Стены.Соединение и Отсоединение стен (с фильтром выбора).dyn (Dynamo 1.3.4.6666)

treu_miter_углом_false_abut = BoolSelector(true)  # "Treu - Miter(Углом), False - Abut(Стыковое)"
forceChildrensEval = ForceChildrensEval(treu_miter_углом_false_abut)
treu_allowjoin_false = BoolSelector(true)  # "Treu - AllowJoin, False - DisallowJoin"
forceChildrensEval_2 = ForceChildrensEval(treu_allowjoin_false)
pys_get_revit_selection = Python(IN[0]=forceChildrensEval_2)
# ---------- pys_get_revit_selection.python (56 lines) ----------
import clr
clr.AddReference('RevitServices')
clr.AddReference('RevitAPI')
from Autodesk.Revit.DB import *
import RevitServices
from RevitServices.Persistence import DocumentManager
from Autodesk.Revit.ApplicationServices import Application
clr.AddReference('RevitAPIUI')
from Autodesk.Revit.UI.Selection import ISelectionFilter, ObjectType
clr.AddReference("RevitServices")
import RevitServices
from RevitServices.Persistence import DocumentManager
from RevitServices.Transactions import TransactionManager


class CustomISelectionFilterList(ISelectionFilter):
	def __init__(self):
		pass
	def AllowElement(self, e):
		if e.Category.Id.IntegerValue == BuiltInCategory.OST_Walls.GetHashCode():
			return True
		else:
			return False
	def AllowReference(self, ref):
		return False

#reset = IN[0]

doc = DocumentManager.Instance.CurrentDBDocument
uidoc = DocumentManager.Instance.CurrentUIApplication.ActiveUIDocument


refs = uidoc.Selection.PickObjects(ObjectType.Element,CustomISelectionFilterList(), "Выбрать элементы.")
elems = [doc.GetElement(re.ElementId) for re in refs ]
	
TransactionManager.Instance.EnsureInTransaction(doc)
if IN[0]:
	for e in elems:
		WallUtils.AllowWallJoinAtEnd(e, 0)
		WallUtils.AllowWallJoinAtEnd(e, 1)
else:
	for e in elems:
		WallUtils.DisallowWallJoinAtEnd(e, 0)
		WallUtils.DisallowWallJoinAtEnd(e, 1)
TransactionManager.Instance.TransactionTaskDone()	
"""
ids = uidoc.Selection.GetElementIds()

idd = [str(i) for i in ids]

if isinstance(idd, list) == True:
	elems = [doc.GetElement(ElementId(int(i))) for i in idd]
else:
	elems = doc.GetElement(ElementId(int(idd)))
"""
OUT = elems
# ----------------------------------------
pys_get_revit_selection_2 = Python(IN[0]=forceChildrensEval, IN[1]=pys_get_revit_selection)
# ---------- pys_get_revit_selection_2.python (66 lines) ----------
import clr
clr.AddReference('RevitServices')
clr.AddReference('RevitAPI')
from Autodesk.Revit.DB import *
import RevitServices
from RevitServices.Persistence import DocumentManager
from Autodesk.Revit.ApplicationServices import Application
clr.AddReference('RevitAPIUI')
from Autodesk.Revit.UI.Selection import ISelectionFilter, ObjectType
clr.AddReference("RevitServices")
import RevitServices
from RevitServices.Persistence import DocumentManager
from RevitServices.Transactions import TransactionManager


class CustomISelectionFilterList(ISelectionFilter):
	def __init__(self):
		pass
	def AllowElement(self, e):
		if e.Category.Id.IntegerValue == BuiltInCategory.OST_Walls.GetHashCode():
			return True
		else:
			return False
	def AllowReference(self, ref):
		return False

#reset = IN[0]

doc = DocumentManager.Instance.CurrentDBDocument
uidoc = DocumentManager.Instance.CurrentUIApplication.ActiveUIDocument


#refs = uidoc.Selection.PickObjects(ObjectType.Element,CustomISelectionFilterList(), "Выбрать элементы.")
#elems = [doc.GetElement(re.ElementId) for re in refs ]
elems = UnwrapElement(IN[1])
rezult = []

TransactionManager.Instance.EnsureInTransaction(doc)
if IN[0]:
	for e in elems:
		wallc = e.Location
		TransactionManager.Instance.EnsureInTransaction(doc)
		join1 = wallc.set_JoinType(0,JoinType.Miter)
		join2 = wallc.set_JoinType(1,JoinType.Miter)
		TransactionManager.Instance.TransactionTaskDone()
		rezult.append(wallc)
else:
	for e in elems:
		wallc = e.Location
		TransactionManager.Instance.EnsureInTransaction(doc)
		join1 = wallc.set_JoinType(0,JoinType.Abut)
		join2 = wallc.set_JoinType(1,JoinType.Abut)
		TransactionManager.Instance.TransactionTaskDone()
		rezult.append(wallc)
TransactionManager.Instance.TransactionTaskDone()	
"""
ids = uidoc.Selection.GetElementIds()

idd = [str(i) for i in ids]

if isinstance(idd, list) == True:
	elems = [doc.GetElement(ElementId(int(i))) for i in idd]
else:
	elems = doc.GetElement(ElementId(int(idd)))
"""
OUT = elems
# ----------------------------------------
