# Dynamo graph 5.(Select&Push) Выравнивание по вертикали.dyn (Dynamo 1.2.1.3083)

# group: Get Revit Selection:
forceChildrensEval = ForceChildrensEval()  # unwired: arg0
pys_get_revit_selection = Python(IN[0]=forceChildrensEval)
# ---------- pys_get_revit_selection.python (22 lines) ----------
import clr
clr.AddReference('RevitServices')
clr.AddReference('RevitAPI')
from Autodesk.Revit.DB import *
import RevitServices
from RevitServices.Persistence import DocumentManager
from Autodesk.Revit.ApplicationServices import Application

reset = IN[0]

doc = DocumentManager.Instance.CurrentDBDocument
uidoc = DocumentManager.Instance.CurrentUIApplication.ActiveUIDocument
ids = uidoc.Selection.GetElementIds()

idd = [str(i) for i in ids]

if isinstance(idd, list) == True:
	elems = [doc.GetElement(ElementId(int(i))) for i in idd]
else:
	elems = doc.GetElement(ElementId(int(idd)))

OUT = elems
# ----------------------------------------

getLocation = Element.GetLocation(pys_get_revit_selection)
deconstructPoint = Geometry.Points.DeconstructPoint(getLocation)
по_первому_элементу_или_по = BoolSelector(false)  # "По первому элементу, или по выбраному?"
firstItem = List.FirstItem(getLocation)
элемент_для_выравнивания = DSModelElementSelection()  # 1 picked in the model
getLocation_2 = Element.GetLocation(элемент_для_выравнивания)
if_ = If(test=по_первому_элементу_или_по, true=firstItem, false=getLocation_2)
deconstructPoint_2 = Geometry.Points.DeconstructPoint(if_)
code_block = CodeBlock(x=deconstructPoint.out0, x1=deconstructPoint_2.out0, y=deconstructPoint.out1, y1=deconstructPoint_2.out1) { x-(x-x1); y-(y-y1); }
точка_в_которую_переместится = Point.ByCoordinates(x=code_block.out0, y=code_block.out1, z=deconstructPoint.out2)  # "Точка в которую переместится элемент"
setLocation = Element.SetLocation(pys_get_revit_selection, точка_в_которую_переместится)
