# Dynamo graph 5.(Select&Push) Выравнивание по нескольким вертикалям.dyn (Dynamo 1.2.1.3083)

# group: Get Revit Selection:
forceChildrensEval = ForceChildrensEval()  # unwired: arg0
pys_get_revit_selection = Python(IN[0]=forceChildrensEval)
# ---------- pys_get_revit_selection.python (22 lines) ----------
import clr
clr.AddReference('RevitServices')
clr.AddReference('RevitAPI')
from Autodesk.Revit.DB import *
import RevitServices
from RevitServices.Persistence import DocumentManager
from Autodesk.Revit.ApplicationServices import Application

reset = IN[0]

doc = DocumentManager.Instance.CurrentDBDocument
uidoc = DocumentManager.Instance.CurrentUIApplication.ActiveUIDocument
ids = uidoc.Selection.GetElementIds()

idd = [str(i) for i in ids]

if isinstance(idd, list) == True:
	elems = [doc.GetElement(ElementId(int(i))) for i in idd]
else:
	elems = doc.GetElement(ElementId(int(idd)))

OUT = elems
# ----------------------------------------

# note: Группировка по этажам
getLocation = Element.GetLocation(pys_get_revit_selection)
deconstructPoint = Geometry.Points.DeconstructPoint(getLocation)
round = Math.Round(deconstructPoint.out2)
sortByKey = List.SortByKey(list=pys_get_revit_selection, keys=round)
groupByKey = List.GroupByKey(list=sortByKey.sorted_list, keys=sortByKey.sorted_keys)
# note: Разворачиваем группировку по столбцам
transpose = List.Transpose(groupByKey.groups)
removeNulls = Lists.Manage.RemoveNulls(transpose)
getLocation_2 = Element.GetLocation(removeNulls)
# note: Получаем разницу между элементом для выравнивания и остальными
deconstructPoint_2 = Geometry.Points.DeconstructPoint(getLocation_2)
firstItem = List.FirstItem(getLocation_2@L2)
deconstructPoint_3 = Geometry.Points.DeconstructPoint(firstItem)
code_block = CodeBlock(x=deconstructPoint_2.out0, x1=deconstructPoint_3.out0, y=deconstructPoint_2.out1, y1=deconstructPoint_3.out1) { x-(x-x1); y-(y-y1); }
точка_в_которую_переместится = Point.ByCoordinates(x=code_block.out0, y=code_block.out1, z=deconstructPoint_2.out2)  # "Точка в которую переместится элемент"
# note: Новое положение элементов
setLocation = Element.SetLocation(removeNulls, точка_в_которую_переместится)
code_block_2 = CodeBlock(x=deconstructPoint_2.out0, x1=deconstructPoint_3.out0, y=deconstructPoint_2.out1, y1=deconstructPoint_3.out1) { Math.Round(x-x1)-(y-y1); }
# note: Подкрашивает отклонившиеся окна
code_block_3 = CodeBlock { 0; 1; }
remapRange = Math.RemapRange(numbers=code_block_2, newMin=code_block_3.out0, newMax=code_block_3.out1)
code_block_4 = CodeBlock(x=remapRange) { 1-x; }
color_range = ColorRange(arg2=code_block_4)  # unwired: arg0, arg1
overrideColorInView = Element.OverrideColorInView(element=removeNulls, color=color_range)
