# Dynamo graph 5.(Select&Push) Исправление уровня элемента.1.1.dyn (Dynamo 1.3.1.1736)

categories = Categories("Levels")
all_elements_of_category = ElementsOfCategory(categories)
parameters = Element.Parameters(all_elements_of_category)

# group: Get Revit Selection:
forceChildrensEval = ForceChildrensEval()  # unwired: arg0
pys_get_revit_selection = Python(IN[0]=forceChildrensEval)
# ---------- pys_get_revit_selection.python (22 lines) ----------
import clr
clr.AddReference('RevitServices')
clr.AddReference('RevitAPI')
from Autodesk.Revit.DB import *
import RevitServices
from RevitServices.Persistence import DocumentManager
from Autodesk.Revit.ApplicationServices import Application

reset = IN[0]

doc = DocumentManager.Instance.CurrentDBDocument
uidoc = DocumentManager.Instance.CurrentUIApplication.ActiveUIDocument
ids = uidoc.Selection.GetElementIds()

idd = [str(i) for i in ids]

if isinstance(idd, list) == True:
	elems = [doc.GetElement(ElementId(int(i))) for i in idd]
else:
	elems = doc.GetElement(ElementId(int(idd)))

OUT = elems
# ----------------------------------------

create = List.Create(all_elements_of_category)
count = Count(pys_get_revit_selection)
cycle = List.Cycle(list=create, amount=count)
# note: Параметры по языку ревит
application_language = Python(IN[0]=forceChildrensEval)
# ---------- application_language.python (10 lines) ----------
import clr
clr.AddReference('RevitServices')
import RevitServices
from RevitServices.Persistence import DocumentManager

doc = DocumentManager.Instance.CurrentDBDocument
uidoc = DocumentManager.Instance.CurrentUIApplication
app = uidoc.Application

OUT = app.Language
# ----------------------------------------
string_from_object = FromObject(application_language)
code_block = CodeBlock { "English_USA"; }
eq = string_from_object == code_block
code_block_2 = CodeBlock { "Level"; "Sill Height"; "Elevation"; "Уровень"; "Высота нижнего бруса"; "Фасад"; }
create_2 = List.Create(code_block_2.out0, code_block_2.out1, code_block_2.out2)
create_3 = List.Create(code_block_2.out3, code_block_2.out4, code_block_2.out5)
if_ = If(test=eq, true=create_2, false=create_3)
code_block_3 = CodeBlock(Parametr=if_) { Parametr[0]; Parametr[1]; Parametr[2]; }
getParameterValueByName = Element.GetParameterValueByName(element=all_elements_of_category, parameterName=code_block_3.out2)
round = Math.Round(getParameterValueByName)
getParameterValueByName_2 = Element.GetParameterValueByName(element=pys_get_revit_selection, parameterName=code_block_3.out1)
высота_подоконика = IntegerSlider(-160, range=-160..600 step 1)
# note: Находим правильные уровни
getParameterValueByName_3 = Element.GetParameterValueByName(element=pys_get_revit_selection, parameterName=code_block_3.out0)
getParameterValueByName_4 = Element.GetParameterValueByName(element=getParameterValueByName_3, parameterName=code_block_3.out2)
code_block_4 = CodeBlock(x=getParameterValueByName_2, H=высота_подоконика, lvlH=getParameterValueByName_4) { Math.Round(x)-H+Math.Round(lvlH); }
eq_2 = round == code_block_4@L1
filterByBoolMask = List.FilterByBoolMask(list=cycle, mask=eq_2)
flatten = Flatten(filterByBoolMask.in)
pys_get_revit_selection_2 = Python(IN[0]=forceChildrensEval, IN[1]=pys_get_revit_selection, IN[2]=flatten)
# ---------- pys_get_revit_selection_2.python (34 lines) ----------
import clr
clr.AddReference('RevitAPI')
from Autodesk.Revit.DB import *

clr.AddReference("RevitNodes")
import Revit
clr.ImportExtensions(Revit.Elements)
clr.ImportExtensions(Revit.GeometryConversion)

clr.AddReference("RevitServices")
import RevitServices
from RevitServices.Persistence import DocumentManager
from RevitServices.Transactions import TransactionManager

doc = DocumentManager.Instance.CurrentDBDocument

reset = IN[0]
element = UnwrapElement(IN[1])
ref_level = UnwrapElement(IN[2])

TransactionManager.Instance.EnsureInTransaction(doc)

for i,x in enumerate(element):
	ref_levelid = ref_level[i].Id
	
	object_param_level = x.get_Parameter(BuiltInParameter.FAMILY_LEVEL_PARAM)

	object_level = doc.GetElement(object_param_level.AsElementId())

	object_param_level.Set(ref_levelid)

TransactionManager.Instance.TransactionTaskDone()

OUT = element
# ----------------------------------------
cycle_2 = List.Cycle(list=высота_подоконика, amount=count)
setParameterByName = Element.SetParameterByName(element=pys_get_revit_selection_2, parameterName=code_block_3.out1, value=cycle_2)
code_block_5 = CodeBlock { "Level"; "Sill Height"; "Elevation"; "Уровень"; "Высота подоконика"; "Подъём"; }
parameters_2 = Element.Parameters(pys_get_revit_selection)
