# Dynamo graph 4.(Push) Цвет перекрытий по глубине относительно уровня вида.dyn (Dynamo 1.3.3.4111)

current = Document.Current()
activeView = Document.ActiveView(current)
parameters = Element.Parameters(activeView)
categories = Categories("Floors")
all_elements_of_category = ElementsOfCategory(categories)

# group: 1
rus_eng = BoolSelector(true)
# note: Средства управления
levels = Levels("0.000")

code_block = CodeBlock { {"Уровень","Имя","Смещение от уровня"}; }
code_block_2 = CodeBlock { {"Level","Name","Elevation at Bottom"}; }
if_ = If(test=rus_eng, true=code_block, false=code_block_2)
code_block_3 = CodeBlock(Уровень=if_, Имя=if_, Смещение_от_уровня=if_) { Уровень[0]; Имя[1]; Смещение_от_уровня[2]; "Связанный уровень"; }
getParameterValueByName = Element.GetParameterValueByName(element=all_elements_of_category, parameterName=code_block_3.out0)
getParameterValueByName_2 = Element.GetParameterValueByName(element=getParameterValueByName, parameterName=code_block_3.out1)
выбранный_уровень = Element.GetParameterValueByName(element=levels, parameterName=code_block_3.out1)
eq = getParameterValueByName_2 == выбранный_уровень
filterByBoolMask = List.FilterByBoolMask(list=all_elements_of_category, mask=eq)
code_block_4 = CodeBlock { color1 = DSCore.Color.ByARGB(1,255, 0, 0); color2 = DSCore.Color.ByARGB(1,21, 0, 255); }
create = List.Create(code_block_4.color1, code_block_4.color2)
code_block_5 = CodeBlock { 0; 1; }
create_2 = List.Create(code_block_5.out0, code_block_5.out1)
getParameterValueByName_3 = Element.GetParameterValueByName(element=filterByBoolMask.in, parameterName=code_block_3.out2)
round = Math.Round(getParameterValueByName_3)
code_block_6 = CodeBlock { 0; 255; 1; }
remapRange = Math.RemapRange(numbers=round, newMin=code_block_6.out0, newMax=code_block_6.out2)
code_block_7 = CodeBlock(x=remapRange) { 1-x; }
color_range = ColorRange(create, create_2, code_block_7)
overrideColorInView = Element.OverrideColorInView(element=filterByBoolMask.in, color=color_range)
minimumItem = List.MinimumItem(round)
maximumItem = List.MaximumItem(round)
watch = Watch(levels)
уровень_вида = Element.GetParameterValueByName(element=activeView, parameterName=code_block_3.out3)
