# Dynamo graph 4.(Push) Цвет перекрытий по общим координатам Z.dyn (Dynamo 1.3.3.4111)

all_elements_in_active_view = ElementsInView()
параметры = CodeBlock { "Связанный уровень"; "Категория"; "Перекрытия"; }
# note: Работа с элементами ревит
getParameterValueByName = Element.GetParameterValueByName(element=all_elements_in_active_view, parameterName=параметры.out1)
string_from_object = FromObject(getParameterValueByName)
eq = string_from_object == параметры.out2
filterByBoolMask = List.FilterByBoolMask(list=all_elements_in_active_view, mask=eq)
code_block = CodeBlock { color1 = DSCore.Color.ByARGB(1,255, 0, 0); color2 = DSCore.Color.ByARGB(1,21, 0, 255); }
create = List.Create(code_block.color1, code_block.color2)
code_block_2 = CodeBlock { 0; 1; }
create_2 = List.Create(code_block_2.out0, code_block_2.out1)
# note: Определение координат в общей системе
boundingBox = Element.BoundingBox(filterByBoolMask.in)
maxPoint = BoundingBox.MaxPoint(boundingBox)
Z = Point.Z(maxPoint)
# note: Цветовая схема
round = Math.Round(Z)
code_block_3 = CodeBlock { 0; 255; 1; }
remapRange = Math.RemapRange(numbers=round, newMin=code_block_3.out0, newMax=code_block_3.out2)
code_block_4 = CodeBlock(x=remapRange) { 1-x; }
color_range = ColorRange(create, create_2, code_block_4)
overrideColorInView = Element.OverrideColorInView(element=filterByBoolMask.in, color=color_range)
minimumItem = List.MinimumItem(round)
maximumItem = List.MaximumItem(round)
random = Math.Random(round)

# group: Get Revit Selection:
forceChildrensEval = ForceChildrensEval()  # unwired: arg0
pys_get_revit_selection = Python(IN[0]=forceChildrensEval)
# ---------- pys_get_revit_selection.python (22 lines) ----------
import clr
clr.AddReference('RevitServices')
clr.AddReference('RevitAPI')
from Autodesk.Revit.DB import *
import RevitServices
from RevitServices.Persistence import DocumentManager
from Autodesk.Revit.ApplicationServices import Application

reset = IN[0]

doc = DocumentManager.Instance.CurrentDBDocument
uidoc = DocumentManager.Instance.CurrentUIApplication.ActiveUIDocument
ids = uidoc.Selection.GetElementIds()

idd = [str(i) for i in ids]

if isinstance(idd, list) == True:
	elems = [doc.GetElement(ElementId(int(i))) for i in idd]
else:
	elems = doc.GetElement(ElementId(int(idd)))

OUT = elems
# ----------------------------------------

code_block_5 = CodeBlock { color1 = DSCore.Color.ByARGB(255, 255, 252, 217); color2 = DSCore.Color.ByARGB(0, 47, 57, 87); }
