# Dynamo graph 4.(Select&Push) Перекрытия.по топографии (выбрать элементы и запустить).dyn (Dynamo 1.2.1.3083)

code_block = CodeBlock()
# ---------- code_block.designscript (21 lines) ----------
def transpose1(l1,l2,l3)
{
return = {l1,l2,l3};
};

def Mesh2PS(m1,fn1,n)
{
vp = m1.VertexPositions;
fi = m1.FaceIndices;
ptslist = transpose1(vp[fi.A],vp[fi.B],vp[fi.C]);
sflist = Surface.ByPerimeterPoints(ptslist<1>);
return = [Imperative]
{
while (Count(sflist) > n)
{
sflist = List.Chop(sflist,n);
sflist = __Map(fn1,sflist);
}
return = PolySurface.ByJoinedSurfaces(sflist);
}
};
# ----------------------------------------

# group: Get Revit Selection:
forceChildrensEval = ForceChildrensEval()  # unwired: arg0
pys_get_revit_selection = Python(IN[0]=forceChildrensEval)
# ---------- pys_get_revit_selection.python (22 lines) ----------
import clr
clr.AddReference('RevitServices')
clr.AddReference('RevitAPI')
from Autodesk.Revit.DB import *
import RevitServices
from RevitServices.Persistence import DocumentManager
from Autodesk.Revit.ApplicationServices import Application

reset = IN[0]

doc = DocumentManager.Instance.CurrentDBDocument
uidoc = DocumentManager.Instance.CurrentUIApplication.ActiveUIDocument
ids = uidoc.Selection.GetElementIds()

idd = [str(i) for i in ids]

if isinstance(idd, list) == True:
	elems = [doc.GetElement(ElementId(int(i))) for i in idd]
else:
	elems = doc.GetElement(ElementId(int(idd)))

OUT = elems
# ----------------------------------------

code_block_2 = CodeBlock { "Category"; "Topography"; "Floors"; }
getParameterValueByName = Element.GetParameterValueByName(element=pys_get_revit_selection, parameterName=code_block_2.out0)
string_from_object = FromObject(getParameterValueByName)
find_topography = Equals(string_from_object, code_block_2.out1)
filterByBoolMask = List.FilterByBoolMask(list=pys_get_revit_selection, mask=find_topography)
find_floors = Equals(string_from_object, code_block_2.out2)
filterByBoolMask_2 = List.FilterByBoolMask(list=pys_get_revit_selection, mask=find_floors)
code_block_3 = CodeBlock(Topographys=filterByBoolMask.in, Floors=filterByBoolMask_2.in) { Topographys[0]; Floors[0]; }
byJoinedSurfaces = PolySurface.ByJoinedSurfaces()  # unwired: arg0
code_block_4 = CodeBlock(t1=code_block_3.out0, f1=byJoinedSurfaces) { Mesh2PS(t1.Mesh,f1,10); }
surfaces = PolySurface.Surfaces(code_block_4)
perimeterCurves = Surface.PerimeterCurves(surfaces)
flatten = Flatten(perimeterCurves)
code_block_5 = CodeBlock { fetchModelCurves:bool = false; }
code_block_6 = CodeBlock { refresh:bool = true; }
python_script = Python(IN[0]=code_block_3.out1, IN[1]=code_block_5, IN[2]=code_block_6)
# ---------- python_script.python (87 lines) ----------
#Copyright(c) 2016, Dimitar Venkov
# @5devene, dimitar.ven@gmail.com

import clr
import math

clr.AddReference("RevitServices")
import RevitServices
from RevitServices.Persistence import DocumentManager
from RevitServices.Transactions import TransactionManager
doc = DocumentManager.Instance.CurrentDBDocument

clr.AddReference("RevitNodes")
import Revit
clr.ImportExtensions(Revit.Elements)
clr.ImportExtensions(Revit.GeometryConversion)

clr.AddReference("RevitAPI")
from Autodesk.Revit.DB import *

def tolist(obj1):
	if hasattr(obj1,"__iter__"): return obj1
	else: return [obj1]

def output1(l1):
	if len(l1) == 1: return l1[0]
	else: return l1

elements = UnwrapElement(tolist(IN[0]))
getModel = IN[1]

accepted_mc = "Autodesk.Revit.DB.ModelLine, Autodesk.Revit.DB.ModelArc, Autodesk.Revit.DB.ModelEllipse, Autodesk.Revit.DB.ModelHermiteSpline, Autodesk.Revit.DB.ModelNurbSpline"

def almost_eq(line, mc):
	line2 = mc.Location.Curve
	xyz1 = line.Evaluate(0.5, True)
	if not line2.IsBound:
		xyz2 = line2.Center
		try: xyz1 = line.Center
		except: pass
	else:
		xyz2 = line2.Evaluate(0.5, True)
	if xyz1.DistanceTo(xyz2) <= 0.0001:
		return True
	else:
		return False

def clean1(l1):
	for i in xrange(len(l1)):
		l1[i] = [x for x in l1[i] if x != None]
	return l1

def getSketch(el1):
	t1 = SubTransaction(doc)
	t1.Start()
	deleted = doc.Delete(el1.Id)
	t1.RollBack()
	
	profile,mc = CurveArrArray(), []
	for d in deleted:
		test_el = doc.GetElement(d)
		el_type = test_el.GetType().ToString()
		if el_type == "Autodesk.Revit.DB.Sketch":
			profile = test_el.Profile
			if not getModel:
				break
		elif getModel and el_type in accepted_mc : mc.append(test_el)
	ordered_mc = []
	if getModel:
		ordered_mc = [[None] * i.Size for i in profile]
	curves = [[None] * i.Size for i in profile]
	for i in xrange(profile.Size):
		for j in xrange(profile[i].Size):
			curves[i][j] = profile[i][j].ToProtoType()
			if getModel:
				for k in xrange(len(mc)):
					if almost_eq(profile[i][j], mc[k]):
						ordered_mc[i][j] = mc[k].ToDSType(True)
						del mc[k]
						break
						
	return curves, clean1(ordered_mc)

TransactionManager.Instance.EnsureInTransaction(doc)
result = map(getSketch, elements)
TransactionManager.Instance.TransactionTaskDone()
OUT = output1([r[0] for r in result]), output1([r[1] for r in result])
# ----------------------------------------
flatten_2 = Flatten(python_script)
byJoinedCurves = PolyCurve.ByJoinedCurves(flatten_2)
patch = Curve.Patch(byJoinedCurves)
code_block_7 = CodeBlock { Vector.ZAxis().Reverse(); }
project = Curve.Project(curve=flatten, baseGeometry=patch, projectionDirection=code_block_7)
flatten_3 = Flatten(project)
intersect = Geometry.Intersect(geometry=flatten_3, other=byJoinedCurves)
flatten_4 = Flatten(intersect)
points = Topography.Points(code_block_3.out0)
project_2 = Point.Project(points, patch, code_block_7)
flatten_5 = Flatten(project_2)
startPoint = Curve.StartPoint(flatten_2)
join = List.Join(flatten_4, flatten_5, startPoint)
pruneDuplicates = Point.PruneDuplicates(points=join)
project_3 = Point.Project(pruneDuplicates, code_block_4, code_block_7, lacing=Longest)
ZAxis = Vector.ZAxis()
project_4 = Point.Project(pruneDuplicates, code_block_4, ZAxis, lacing=Longest)
python_script_2 = Python(IN[0]=project_3, IN[1]=project_4)
# ---------- python_script_2.python (7 lines) ----------
inlist = IN[0]
OUT = []
for i, el in enumerate(inlist):
	if el:
		OUT.append(el)
	else:
		OUT.append(IN[1][i])
# ----------------------------------------
flatten_6 = Flatten(python_script_2)
code_block_8 = CodeBlock(Floors=code_block_3.out1) { Floors; }
python_script_3 = Python(IN[0]=flatten_6, IN[1]=code_block_8)
# ---------- python_script_3.python (35 lines) ----------
# coding: cp1251
#!/usr/bin/python
# http://dronov-architects.ru/
# http://scripterr.ru/
# Its a gift and gratitude for:
# Pavel Lukjanchenko https://www.youtube.com/user/Pashasevkav

# Source: https://landarchbim.com/2016/09/14/make-hardscape-follow-topo-update/

import clr
clr.AddReference('RevitAPI')
from Autodesk.Revit.DB import *

clr.AddReference("RevitNodes")
import Revit
clr.ImportExtensions(Revit.GeometryConversion)

clr.AddReference("RevitServices")
import RevitServices
from RevitServices.Persistence import DocumentManager
from RevitServices.Transactions import TransactionManager

doc = DocumentManager.Instance.CurrentDBDocument
xyzs = IN[0]
slabshape = UnwrapElement(IN[1])
successlist = list()
faillist = list()

TransactionManager.Instance.EnsureInTransaction(doc)
slabshape.SlabShapeEditor.ResetSlabShape()
for item in xyzs:
	slabshape.SlabShapeEditor.DrawPoint(item.ToXyz())
TransactionManager.Instance.TransactionTaskDone()

OUT = slabshape
# ----------------------------------------
parameters = Element.Parameters(pys_get_revit_selection)
