# Dynamo graph 4.Перекрытия создание точек.dyn (Dynamo 1.3.3.4111)

# group: КЛЮЧЕВЫЕ МОМЕНТЫ РАБОТЫ 1
# note: КОНСОЛИДАЦИЯ И СЛОЖНЫЕ ОБРАБОТКИ

# group: ИСПОЛНИТЕЛЬНЫЕ НОДЫ (фильтрование, подбор, списки и т.д.)
# note: ИСПОЛНИТЕЛЬНЫЕ НОДЫ

# group: ЗАПАСНЫЕ ВАРИАНТЫ, ДОПОЛНИТЕЛЬНЫЕ ОПЦИИ
# note: ЗАПАСНЫЕ
# note: ДОПОЛНИТЕЛЬНЫЕ. Градации серово по важности, темнее - важнее

# group: КЛЮЧЕВЫЕ МОМЕНТЫ РАБОТЫ 2
# note: УСЛОЖНЕННЫЕ КОНСТРУКЦИИ
# note: УСЛОЖНЕНЫЕ КОНСТРУКЦИИ

# group: Python ноды
# note: Python

# group: ЭЛЕМЕНТЫ УПРАВЛЕНИЯ 2 УРОВЕНЬ
# note: ПЕРЕМЕННЫЕ ЗНАЧЕНИЯ
# note: ЭЛЕМЕНТЫ УПРАВЛЕНИЯ

# group: Запуск питона из внешнего файла
# note: Py - files

# group: ЭЛЕМЕНТЫ УПРАВЛЕНИЯ
# note: ПЕРЕМЕННЫЕ ЗНАЧЕНИЯ
# note: ЭЛЕМЕНТЫ УПРАВЛЕНИЯ

# group: ПОЛУЧАЕМ ДАННЫЕ
# note: ПОЛУЧАЕМ ДАННЫЕ ИЗ РЕВИТ и других источников

# group: ПРОВЕРОЧНЫЕ НОДЫ
# note: ПРОВЕРОЧНЫЕ НОДЫ

# group: ПЕРЕДАЁМ ИНФОРМАЦИЮ
# note: ПЕРЕДАЁМ ИНФОРМАЦИЮ В РЕВИТ
# note: ПЕРЕДАЁМ ИНФОРМАЦИЮ ЕЩЁ КУДА-ТО

# group: ПРИМЕЧАНИЯ ПО ЦВЕТОВОЙ ГРУППИРОВКЕ
# note: GUIDELINES

code_block = CodeBlock()
# ---------- code_block.designscript (21 lines) ----------
def transpose1(l1,l2,l3)
{
return = {l1,l2,l3};
};

def Mesh2PS(m1,fn1,n)
{
vp = m1.VertexPositions;
fi = m1.FaceIndices;
ptslist = transpose1(vp[fi.A],vp[fi.B],vp[fi.C]);
sflist = Surface.ByPerimeterPoints(ptslist<1>);
return = [Imperative]
{
while (Count(sflist) > n)
{
sflist = List.Chop(sflist,n);
sflist = __Map(fn1,sflist);
}
return = PolySurface.ByJoinedSurfaces(sflist);
}
};
# ----------------------------------------
forceChildrensEval = ForceChildrensEval()  # frozen; unwired: arg0

# group: Get Revit Selection:
pys_get_revit_selection = Python(IN[0]=forceChildrensEval)
# ---------- pys_get_revit_selection.python (22 lines) ----------
import clr
clr.AddReference('RevitServices')
clr.AddReference('RevitAPI')
from Autodesk.Revit.DB import *
import RevitServices
from RevitServices.Persistence import DocumentManager
from Autodesk.Revit.ApplicationServices import Application

reset = IN[0]

doc = DocumentManager.Instance.CurrentDBDocument
uidoc = DocumentManager.Instance.CurrentUIApplication.ActiveUIDocument
ids = uidoc.Selection.GetElementIds()

idd = [str(i) for i in ids]

if isinstance(idd, list) == True:
	elems = [doc.GetElement(ElementId(int(i))) for i in idd]
else:
	elems = doc.GetElement(ElementId(int(idd)))

OUT = elems
# ----------------------------------------

code_block_2 = CodeBlock { "Category"; "Topography"; "Floors"; }
getParameterValueByName = Element.GetParameterValueByName(element=pys_get_revit_selection, parameterName=code_block_2.out0)
string_from_object = FromObject(getParameterValueByName)
find_topography = Equals(string_from_object, code_block_2.out1)
filterByBoolMask = List.FilterByBoolMask(list=pys_get_revit_selection, mask=find_topography)
find_floors = Equals(string_from_object, code_block_2.out2)
filterByBoolMask_2 = List.FilterByBoolMask(list=pys_get_revit_selection, mask=find_floors)
code_block_3 = CodeBlock(Topographys=filterByBoolMask.in, Floors=filterByBoolMask_2.in) { Topographys[0]; Floors[0]; }
byJoinedSurfaces = PolySurface.ByJoinedSurfaces()  # unwired: arg0
code_block_4 = CodeBlock(t1=code_block_3.out0, f1=byJoinedSurfaces) { Mesh2PS(t1.Mesh,f1,10); }
surfaces = PolySurface.Surfaces(code_block_4)
perimeterCurves = Surface.PerimeterCurves(surfaces)
flatten = Flatten(perimeterCurves)
code_block_5 = CodeBlock { fetchModelCurves:bool = false; }
code_block_6 = CodeBlock { refresh:bool = true; }
python_script = Python(IN[0]=code_block_3.out1, IN[1]=code_block_5, IN[2]=code_block_6)
# ---------- python_script.python (87 lines) ----------
#Copyright(c) 2016, Dimitar Venkov
# @5devene, dimitar.ven@gmail.com

import clr
import math

clr.AddReference("RevitServices")
import RevitServices
from RevitServices.Persistence import DocumentManager
from RevitServices.Transactions import TransactionManager
doc = DocumentManager.Instance.CurrentDBDocument

clr.AddReference("RevitNodes")
import Revit
clr.ImportExtensions(Revit.Elements)
clr.ImportExtensions(Revit.GeometryConversion)

clr.AddReference("RevitAPI")
from Autodesk.Revit.DB import *

def tolist(obj1):
	if hasattr(obj1,"__iter__"): return obj1
	else: return [obj1]

def output1(l1):
	if len(l1) == 1: return l1[0]
	else: return l1

elements = UnwrapElement(tolist(IN[0]))
getModel = IN[1]

accepted_mc = "Autodesk.Revit.DB.ModelLine, Autodesk.Revit.DB.ModelArc, Autodesk.Revit.DB.ModelEllipse, Autodesk.Revit.DB.ModelHermiteSpline, Autodesk.Revit.DB.ModelNurbSpline"

def almost_eq(line, mc):
	line2 = mc.Location.Curve
	xyz1 = line.Evaluate(0.5, True)
	if not line2.IsBound:
		xyz2 = line2.Center
		try: xyz1 = line.Center
		except: pass
	else:
		xyz2 = line2.Evaluate(0.5, True)
	if xyz1.DistanceTo(xyz2) <= 0.0001:
		return True
	else:
		return False

def clean1(l1):
	for i in xrange(len(l1)):
		l1[i] = [x for x in l1[i] if x != None]
	return l1

def getSketch(el1):
	t1 = SubTransaction(doc)
	t1.Start()
	deleted = doc.Delete(el1.Id)
	t1.RollBack()
	
	profile,mc = CurveArrArray(), []
	for d in deleted:
		test_el = doc.GetElement(d)
		el_type = test_el.GetType().ToString()
		if el_type == "Autodesk.Revit.DB.Sketch":
			profile = test_el.Profile
			if not getModel:
				break
		elif getModel and el_type in accepted_mc : mc.append(test_el)
	ordered_mc = []
	if getModel:
		ordered_mc = [[None] * i.Size for i in profile]
	curves = [[None] * i.Size for i in profile]
	for i in xrange(profile.Size):
		for j in xrange(profile[i].Size):
			curves[i][j] = profile[i][j].ToProtoType()
			if getModel:
				for k in xrange(len(mc)):
					if almost_eq(profile[i][j], mc[k]):
						ordered_mc[i][j] = mc[k].ToDSType(True)
						del mc[k]
						break
						
	return curves, clean1(ordered_mc)

TransactionManager.Instance.EnsureInTransaction(doc)
result = map(getSketch, elements)
TransactionManager.Instance.TransactionTaskDone()
OUT = output1([r[0] for r in result]), output1([r[1] for r in result])
# ----------------------------------------
flatten_2 = Flatten(python_script)
byJoinedCurves = PolyCurve.ByJoinedCurves(flatten_2)
patch = Curve.Patch(byJoinedCurves)
code_block_7 = CodeBlock { Vector.ZAxis().Reverse(); }
project = Curve.Project(curve=flatten, baseGeometry=patch, projectionDirection=code_block_7)
flatten_3 = Flatten(project)
intersect = Geometry.Intersect(geometry=flatten_3, other=byJoinedCurves)
flatten_4 = Flatten(intersect)
points = Topography.Points(code_block_3.out0)
project_2 = Point.Project(points, patch, code_block_7)
flatten_5 = Flatten(project_2)
startPoint = Curve.StartPoint(flatten_2)
join = List.Join(flatten_4, flatten_5, startPoint)
pruneDuplicates = Point.PruneDuplicates(points=join)
project_3 = Point.Project(pruneDuplicates, code_block_4, code_block_7, lacing=Longest)
ZAxis = Vector.ZAxis()
project_4 = Point.Project(pruneDuplicates, code_block_4, ZAxis, lacing=Longest)
python_script_2 = Python(IN[0]=project_3, IN[1]=project_4)
# ---------- python_script_2.python (7 lines) ----------
inlist = IN[0]
OUT = []
for i, el in enumerate(inlist):
	if el:
		OUT.append(el)
	else:
		OUT.append(IN[1][i])
# ----------------------------------------
flatten_6 = Flatten(python_script_2)
code_block_8 = CodeBlock(Floors=code_block_3.out1) { Floors; }
python_script_3 = Python(IN[0]=flatten_6, IN[1]=code_block_8)
# ---------- python_script_3.python (35 lines) ----------
# coding: cp1251
#!/usr/bin/python
# http://dronov-architects.ru/
# http://scripterr.ru/
# Its a gift and gratitude for:
# Pavel Lukjanchenko https://www.youtube.com/user/Pashasevkav

# Source: https://landarchbim.com/2016/09/14/make-hardscape-follow-topo-update/

import clr
clr.AddReference('RevitAPI')
from Autodesk.Revit.DB import *

clr.AddReference("RevitNodes")
import Revit
clr.ImportExtensions(Revit.GeometryConversion)

clr.AddReference("RevitServices")
import RevitServices
from RevitServices.Persistence import DocumentManager
from RevitServices.Transactions import TransactionManager

doc = DocumentManager.Instance.CurrentDBDocument
xyzs = IN[0]
slabshape = UnwrapElement(IN[1])
successlist = list()
faillist = list()

TransactionManager.Instance.EnsureInTransaction(doc)
slabshape.SlabShapeEditor.ResetSlabShape()
for item in xyzs:
	slabshape.SlabShapeEditor.DrawPoint(item.ToXyz())
TransactionManager.Instance.TransactionTaskDone()

OUT = slabshape
# ----------------------------------------
parameters = Element.Parameters(pys_get_revit_selection)
boolean = BoolSelector(true)  # frozen
code_block_9 = CodeBlock { 1; 2; }
if_ = Python(IN[0]=boolean, IN[1]=code_block_9.out0, IN[2]=code_block_9.out1)
# ---------- if_.python (12 lines) ----------
import clr
boolean = IN[0]
true = UnwrapElement(IN[1])
false = UnwrapElement(IN[2])

if boolean:
	out = true
else:
	out = false

#Назначьте вывод переменной OUT.
OUT = out
# ----------------------------------------
parameters_2 = Element.Parameters()  # unwired: arg0
geometry = Element.Geometry()  # unwired: arg0
setParameterByName = Element.SetParameterByName()  # unwired: element, parameterName, value
# note: ВСЁ ОСТАЛЬНОЕ
getParameterValueByName_2 = Element.GetParameterValueByName()  # unwired: element, parameterName
путь_к_файлу_python = Filename(".\N.Отделка помещений_сбор элементов вокруг_1.7.py")  # frozen
forceChildrensEval_2 = ForceChildrensEval()  # unwired: arg0
find_file_and_import_it = Python(IN[0]=путь_к_файлу_python, IN[1]=forceChildrensEval_2)
# ---------- find_file_and_import_it.python (11 lines) ----------
import sys
sys.path.append('C:\Program Files (x86)\IronPython 2.7\Lib')
import codecs

try:
	filePath = IN[0]
	with codecs.open(filePath, 'rb', "utf-8") as inf:
		lines = inf.readlines()
	OUT = ''.join(lines)
except:
	OUT = "No file"
# ----------------------------------------
python_script_from_string = PythonStringNode(script=find_file_and_import_it)  # unwired: IN[0]
regenerate = Python()  # frozen; unwired: IN[0]
# ---------- regenerate.python (26 lines) ----------
import clr

# Import DocumentManager and TransactionManager
clr.AddReference("RevitServices")
import RevitServices
from RevitServices.Persistence import DocumentManager


# Import RevitAPI
clr.AddReference("RevitAPI")
import Autodesk
from Autodesk.Revit.DB import *

doc = DocumentManager.Instance.CurrentDBDocument


#The inputs to this node will be stored as a list in the IN variable.
list = IN[0]


if list:
	doc.Regenerate()
	out = "Regeneration complete"
else:
	out = "fail"
OUT = out
# ----------------------------------------
members = Python()  # "Object.Members"; frozen; unwired: IN[0]
# ---------- members.python (14 lines) ----------
import clr

items = IN[0]
elementlist = list()

try:
	clr.AddReference('RevitAPI')
	from Autodesk.Revit.DB import *
	for item in items:
		elementlist.append(dir(UnwrapElement(item)))
except:
	for item in items:
		elementlist.append(dir(item))
OUT = elementlist
# ----------------------------------------
filteredElementCollector = Python()  # frozen; unwired: IN[0]
# ---------- filteredElementCollector.python (29 lines) ----------
if IN[1]:
	import clr
	
	# Import DocumentManager and TransactionManager
	clr.AddReference("RevitServices")
	import RevitServices
	from RevitServices.Persistence import DocumentManager
	
	
	# Import RevitAPI
	clr.AddReference("RevitAPI")
	import Autodesk
	from Autodesk.Revit.DB import *
	
	doc = DocumentManager.Instance.CurrentDBDocument
	uiapp = DocumentManager.Instance.CurrentUIApplication
	app = uiapp.Application
	
	from System.Collections.Generic import *
	
	
	#The inputs to this node will be stored as a list in the IN variable.
	dataEnteringNode = IN
	collector = FilteredElementCollector(doc)
	elements = collector.OfCategory(BuiltInCategory.OST_Views).ToElements()
	
	OUT = sheetInstances
else:
	OUT = "скрипт не выполнен"
# ----------------------------------------
select_model_elements = DSModelElementsSelection()  # 2 picked in the model
shablon_python_shablon = Python(IN[0]=select_model_elements)  # frozen
# ---------- shablon_python_shablon.python (77 lines) ----------
# -*- coding: utf-8 -*- 
#-----------------------Импоорт библиотек----------------------
import clr
clr.AddReference('RevitAPI')
import Autodesk
from Autodesk.Revit.DB import *

clr.AddReference("RevitNodes") 
import Revit
from Revit.Elements import *

clr.ImportExtensions(Revit.Elements) #ToDSType не работает без
clr.ImportExtensions(Revit.GeometryConversion) #ToXyz не работает без

clr.AddReference("RevitServices")
import RevitServices
from RevitServices.Persistence import DocumentManager
from RevitServices.Transactions import TransactionManager

clr.AddReference('ProtoGeometry')
from Autodesk.DesignScript.Geometry import *

clr.AddReference("RevitNodes")
import Revit

# Import ToProtoType, ToRevitType geometry conversion extension methods
clr.ImportExtensions(Revit.GeometryConversion)

#-----------------------ИМПОРТ БИБЛИОТЕК----------------------
"""-"""
#-----------------------ФУНКЦИИ----------------------

def __x__(x):
	x="x"
	return x
	
#-----------------------ФУНКЦИИ----------------------
"""-"""
#-----------------------АПИ ПАРАМЕТРЫ----------------------

doc = DocumentManager.Instance.CurrentDBDocument
#link_doc = UnwrapElement(IN[1])
#uiapp = DocumentManager.Instance.CurrentUIApplication
#app = uiapp.Application
#version = app.VersionNumber
#options = Autodesk.Revit.DB.SpatialElementBoundaryOptions()

#-----------------------АПИ ПАРАМЕТРЫ----------------------
"""-"""
#-----------------------РАБОЧИЕ ПАРАМЕТРЫ----------------------

rooms = UnwrapElement(IN[0])

#-----------------------РАБОЧИЕ ПАРАМЕТРЫ----------------------	
"""-"""
#-----------------------ТЕСТОВЫЕ ПАРАМЕТРЫ----------------------

list = []

#-----------------------ТЕСТОВЫЕ ПАРАМЕТРЫ----------------------
"""-"""
#-----------------------НАЧАЛО СКРИПТА----------------------

x = 0
if rooms == None:
	rooms = [0,0]

for room in rooms:
	#list.append(room.GetSubelements())
	#list.append(room.GetSubComponentIds())
	list.append(room.SuperComponent)
	
#TransactionManager.Instance.EnsureInTransaction(doc)
#TransactionManager.Instance.TransactionTaskDone()
#-----------------------КОНЕЦ СКРИПТА----------------------

OUT = list
# ----------------------------------------

# group: Parameters name from language
parameters_name_from_language = Python()  # frozen
# ---------- parameters_name_from_language.python (18 lines) ----------
import clr
clr.AddReference('RevitServices')
import RevitServices
from RevitServices.Persistence import DocumentManager

uiapp = DocumentManager.Instance.CurrentUIApplication
app = uiapp.Application
lng = app.Language
rus = ["Тип","Имя семейства","Имя типа"]
enu = ["Type","Family name","Type name"]
out = []
if str(lng) == "Russian":
	out = rus
else:
	out = enu
#English_USA
#Russian
OUT = out
# ----------------------------------------

categories = Categories()  # frozen
all_elements_of_category = ElementsOfCategory(categories)

# group: Get Revit Selection:
forceChildrensEval_3 = ForceChildrensEval()  # frozen; unwired: arg0
pys_get_revit_selection_2 = Python(IN[0]=forceChildrensEval_3)  # same code as pys_get_revit_selection

# group: элементы внутри групп
members_2 = Python()  # "Group.Members"; frozen; unwired: IN[0]
# ---------- members_2.python (19 lines) ----------
import clr
clr.AddReference('RevitAPI')
from Autodesk.Revit.DB import *

clr.AddReference("RevitNodes")
import Revit
clr.ImportExtensions(Revit.Elements)

groups = UnwrapElement(IN[0])
elementlist = list()
for item in groups:
	try:
		memberlist = list()
		for member in item.GetMemberIds():
			memberlist.append(item.Document.GetElement(member))
		elementlist.append(memberlist)
	except:
		elementlist.append(list())
OUT = elementlist
# ----------------------------------------

solids = Element.Solids(select_model_elements)
flatten_7 = Flatten(solids)
byUnion = Solid.ByUnion(flatten_7)
explode = Geometry.Explode(byUnion)
deconstructSurface = Geometry.Surfaces.DeconstructSurface(explode)
watch = Watch(deconstructSurface.out1)
addSplitLine = Custom[SlabShape.AddSplitLine]()  # Adds split lines to Revit Floors; unwired: Floor_element, Curve_s
addSplitLineWithElevation = Rhythm.Revit.Elements.Roof.AddSplitLineWithElevation()  # unwired: arg0, arg1, arg2
floor = DSModelElementSelection()  # 1 picked in the model
watch_2 = Watch(deconstructSurface.out0)
flatten_8 = Flatten(watch_2)
создать_линии = Python(IN[0]=floor, IN[1]=flatten_8)
# ---------- создать_линии.python (47 lines) ----------
#Copyright (c) mostafa el ayoubi ,  2017
#Data-Shapes www.data-shapes.net , mostafa.elayoubi@data-shapes.net

import clr
clr.AddReference('RevitAPI')
from Autodesk.Revit.DB import *
clr.AddReference('RevitServices')
from RevitServices.Persistence import DocumentManager
from RevitServices.Transactions import TransactionManager

clr.AddReference("RevitNodes")
import Revit

# Import ToProtoType, ToRevitType geometry conversion extension methods
clr.ImportExtensions(Revit.GeometryConversion)


doc = DocumentManager.Instance.CurrentDBDocument
floor = UnwrapElement(IN[0])
sshpe = floor.SlabShapeEditor

def tolist(input):
	if isinstance(input,list):
		return UnwrapElement(input)
	else:
		return [UnwrapElement(input)]

def dscurvevertices(curve):
	rvtline = curve.ToRevitType()#list(curve.ToRevitType())#.get_Geometry(Options()))[0]
	return rvtline.GetEndPoint(0) , rvtline.GetEndPoint(1)

def drawline(slabshape,line):
	sp = slabshape.DrawPoint(dscurvevertices(line)[0])
	ep = slabshape.DrawPoint(dscurvevertices(line)[1])
	slabshape.DrawSplitLine(sp,ep)
	return  slabshape

curves = UnwrapElement(IN[1])

TransactionManager.Instance.EnsureInTransaction(doc)

for c in curves:
	drawline(sshpe,c)

TransactionManager.Instance.TransactionTaskDone()

OUT = floor
# ----------------------------------------
vertices = Topology.Vertices(explode)
pointGeometry = Vertex.PointGeometry(vertices)
flatten_9 = Flatten(pointGeometry)
создать_точки = Python(IN[0]=floor, IN[1]=flatten_9)  # frozen
# ---------- создать_точки.python (48 lines) ----------
#Copyright (c) mostafa el ayoubi ,  2017
#Data-Shapes www.data-shapes.net , mostafa.elayoubi@data-shapes.net

import clr
clr.AddReference('RevitAPI')
from Autodesk.Revit.DB import *
clr.AddReference('RevitServices')
from RevitServices.Persistence import DocumentManager
from RevitServices.Transactions import TransactionManager

clr.AddReference("RevitNodes")
import Revit

# Import ToProtoType, ToRevitType geometry conversion extension methods
clr.ImportExtensions(Revit.GeometryConversion)


doc = DocumentManager.Instance.CurrentDBDocument
floor = UnwrapElement(IN[0])
sshpe = floor.SlabShapeEditor

def tolist(input):
	if isinstance(input,list):
		return UnwrapElement(input)
	else:
		return [UnwrapElement(input)]

def dscurvevertices(curve):
	rvtline = curve.ToRevitType()#list(curve.ToRevitType())#.get_Geometry(Options()))[0]
	return rvtline#rvtline.GetEndPoint(0) , rvtline.GetEndPoint(1)

def drawline(slabshape,line):
	slabshape.DrawPoint(dscurvevertices(line))
	return  slabshape

#curves = UnwrapElement(IN[1])
points = UnwrapElement(IN[1])

TransactionManager.Instance.EnsureInTransaction(doc)

for p in points:
	drawline(sshpe,p)
#for c in curves:
#	drawline(sshpe,c)

TransactionManager.Instance.TransactionTaskDone()

OUT = floor
# ----------------------------------------
watch_3 = Watch(flatten_9)
Z = Point.Z(pointGeometry)
minimumItem = List.MinimumItem(Z@L2)
eq = Z == minimumItem
filterByBoolMask_3 = List.FilterByBoolMask(list=pointGeometry, mask=eq)
watch_4 = Watch(filterByBoolMask_3.in)
