# Dynamo graph floor by room.dyn (Dynamo 1.3.4.6666)

# group: ЗАПАСНЫЕ ВАРИАНТЫ, ДОПОЛНИТЕЛЬНЫЕ ОПЦИИ
# note: ДОПОЛНИТЕЛЬНЫЕ. Градации серово по важности, темнее - важнее
# note: ЗАПАСНЫЕ

# group: КЛЮЧЕВЫЕ МОМЕНТЫ РАБОТЫ 2
# note: УСЛОЖНЕННЫЕ КОНСТРУКЦИИ
# note: УСЛОЖНЕНЫЕ КОНСТРУКЦИИ

# group: Запуск питона из внешнего файла
# note: Py - files

# group: КЛЮЧЕВЫЕ МОМЕНТЫ РАБОТЫ 1
# note: КОНСОЛИДАЦИЯ И СЛОЖНЫЕ ОБРАБОТКИ

# group: Python ноды
# note: Python

# group: ИСПОЛНИТЕЛЬНЫЕ НОДЫ (фильтрование, подбор, списки и т.д.)
# note: ИСПОЛНИТЕЛЬНЫЕ НОДЫ

# group: ЭЛЕМЕНТЫ УПРАВЛЕНИЯ 2 УРОВЕНЬ
# note: ЭЛЕМЕНТЫ УПРАВЛЕНИЯ
# note: ПЕРЕМЕННЫЕ ЗНАЧЕНИЯ

# group: ЭЛЕМЕНТЫ УПРАВЛЕНИЯ
# note: ПЕРЕМЕННЫЕ ЗНАЧЕНИЯ
# note: ЭЛЕМЕНТЫ УПРАВЛЕНИЯ

# group: ПОЛУЧАЕМ ДАННЫЕ
# note: ПОЛУЧАЕМ ДАННЫЕ ИЗ РЕВИТ и других источников

# group: ПРОВЕРОЧНЫЕ НОДЫ
# note: ПРОВЕРОЧНЫЕ НОДЫ

# group: ПЕРЕДАЁМ ИНФОРМАЦИЮ
# note: ПЕРЕДАЁМ ИНФОРМАЦИЮ В РЕВИТ
# note: ПЕРЕДАЁМ ИНФОРМАЦИЮ ЕЩЁ КУДА-ТО

# group: ПРИМЕЧАНИЯ ПО ЦВЕТОВОЙ ГРУППИРОВКЕ
# note: GUIDELINES

список_категорий = StringInput("Стены, Колонны")
python_script_фильтруем_элементы = Python(IN[1]=список_категорий)  # "Python Script - Фильтруем элементы по именам категорий"; frozen; unwired: IN[0]
# ---------- python_script_фильтруем_элементы.python (12 lines) ----------
import clr
clr.AddReference('RevitAPI')
from Autodesk.Revit.DB import BuiltInParameter

elements = UnwrapElement(IN[0])
cats = UnwrapElement(IN[1])

filtred_elements = [e for e in elements if e.get_Parameter(BuiltInParameter.ELEM_CATEGORY_PARAM).AsValueString() in cats]
filtred_cats = [fe.get_Parameter(BuiltInParameter.ELEM_CATEGORY_PARAM).AsValueString() if not fe.get_Parameter(BuiltInParameter.DPART_ORIGINAL_CATEGORY) else fe.get_Parameter(BuiltInParameter.DPART_ORIGINAL_CATEGORY).AsString() for fe in filtred_elements ]

#OUT = [e for e in elements if e.get_Parameter(BuiltInParameter.ELEM_CATEGORY_PARAM).AsValueString() in cats]
OUT = (filtred_elements,filtred_cats)
# ----------------------------------------
список_категорий_2 = StringInput("Части, Окна, Панели витража, Несущие колонны, Ограждение")
список_категорий_3 = StringInput("Части, Стены")
python_script_фильтруем_элементы_2 = Python(IN[1]=список_категорий_3)  # "Python Script - Фильтруем элементы по именам категорий"; frozen; unwired: IN[0]; same code as python_script_фильтруем_элементы
forceChildrensEval = ForceChildrensEval()  # unwired: arg0

# group: Get Revit Selection:
pys_get_revit_selection = Python(IN[0]=forceChildrensEval)
# ---------- pys_get_revit_selection.python (22 lines) ----------
import clr
clr.AddReference('RevitServices')
clr.AddReference('RevitAPI')
from Autodesk.Revit.DB import *
import RevitServices
from RevitServices.Persistence import DocumentManager
from Autodesk.Revit.ApplicationServices import Application

reset = IN[0]

doc = DocumentManager.Instance.CurrentDBDocument
uidoc = DocumentManager.Instance.CurrentUIApplication.ActiveUIDocument
ids = uidoc.Selection.GetElementIds()

idd = [str(i) for i in ids]

if isinstance(idd, list) == True:
	elems = [doc.GetElement(ElementId(int(i))) for i in idd]
else:
	elems = doc.GetElement(ElementId(int(idd)))

OUT = elems
# ----------------------------------------

boundaries = Custom[Room.Boundaries](room=pys_get_revit_selection)  # Gets a list of all boundary elements of a given room or area
floor_types = FloorTypes("ADSK_Cтяжка80")
levels = Levels("Этаж 01")
byOutlineTypeAndLevel = Floor.ByOutlineTypeAndLevel(outlineCurves=boundaries.curves, floorType=floor_types, level=levels)
code_block = CodeBlock { "Смещение от уровня"; 80; }
setParameterByName = Element.SetParameterByName(element=byOutlineTypeAndLevel, parameterName=code_block.out0, value=code_block.out1)
getParameterValueByName = Element.GetParameterValueByName()  # unwired: element, parameterName
# note: ВСЁ ОСТАЛЬНОЕ
parameters = Element.Parameters()  # unwired: arg0

# group: Собрать элементы из Групп и Сборок
не_учитывает_под_группы_в = Python()  # "Не учитывает под. группы в группах"; frozen; unwired: IN[0]
# ---------- не_учитывает_под_группы_в.python (33 lines) ----------
import clr
clr.AddReference('RevitAPI')
from Autodesk.Revit.DB import ElementId, BuiltInCategory, Document
clr.AddReference("RevitServices")
from RevitServices.Persistence import DocumentManager

#clr.AddReference("RevitNodes")
#import Revit
#clr.ImportExtensions(Revit.Elements)

doc = DocumentManager.Instance.CurrentDBDocument

groups = UnwrapElement(IN[0])
#elementlist = list()

#elementlist = [item.Category.Id for item in groups]
elementlist = [[doc.GetElement(member) for member in item.GetMemberIds()] if item.Category.Id == ElementId(-2000095) or item.Category.Id == ElementId(-2000267) else item for item in groups ]
"""
for item in groups:
	if item != None:
		if item.Category.Name == BuiltInCategory.OST_IOSModelGroups or item.Category.Name == BuiltInCategory.OST_Assemblies:
			try:
				memberlist = list()
				for member in item.GetMemberIds():
					memberlist.append(item.Document.GetElement(member))
				elementlist.append(memberlist)
			except:
				elementlist.append(list())
		else:
			elementlist.append(item)
"""

OUT = elementlist
# ----------------------------------------
flatten = Flatten(не_учитывает_под_группы_в)

geometry = Element.Geometry()  # unwired: arg0
linkelemid_by_tag = Python()  # frozen; unwired: IN[0], IN[1]
# ---------- linkelemid_by_tag.python (117 lines) ----------
# -*- coding: utf-8 -*- 
#-----------------------Импоорт библиотек----------------------
import clr
clr.AddReference('RevitAPI')
import Autodesk
from Autodesk.Revit.DB import *

clr.AddReference("RevitNodes") 
import Revit
from Revit.Elements import *

clr.ImportExtensions(Revit.Elements) #ToDSType не работает без
clr.ImportExtensions(Revit.GeometryConversion) #ToXyz не работает без

clr.AddReference("RevitServices")
import RevitServices
from RevitServices.Persistence import DocumentManager
from RevitServices.Transactions import TransactionManager

clr.AddReference('ProtoGeometry')
from Autodesk.DesignScript.Geometry import *

import System
clr.AddReference('System')
from System.Collections.Generic import List

#-----------------------ИМПОРТ БИБЛИОТЕК----------------------
"""-"""
#-----------------------ФУНКЦИИ----------------------

def __x__(x):
	x="x"
	return x
	
#-----------------------ФУНКЦИИ----------------------
"""-"""
#-----------------------АПИ ПАРАМЕТРЫ----------------------

#doc = DocumentManager.Instance.CurrentDBDocument
#link_doc = UnwrapElement(IN[1])
#uiapp = DocumentManager.Instance.CurrentUIApplication
#app = uiapp.Application
#version = app.VersionNumber
#options = Autodesk.Revit.DB.SpatialElementBoundaryOptions()

#g_id_list = []
#g_id_list.append(ElementId(group))

#bxList = List[ElementId](g_id_list) #АЙ ЛИСТ КОЛЕКТИОН
#move = Transform.CreateTranslation(-wall.Orientation*2) #смещение
#cl.CreateTransformed(move)

#-----------------------АПИ ПАРАМЕТРЫ----------------------
"""-"""
#-----------------------РАБОЧИЕ ПАРАМЕТРЫ----------------------
link_inst = UnwrapElement(IN[0])
loc_elem = UnwrapElement(IN[1])

doc = DocumentManager.Instance.CurrentDBDocument
uidoc = DocumentManager.Instance.CurrentUIDocument

link_doc = link_inst.GetLinkDocument()
#walls = FilteredElementCollector(doc).OfCategory(BuiltInCategory.OST_Walls).ToElements()
link_tags = FilteredElementCollector(doc).OfClass(IndependentTag)

test = []
tag_ids = []
linked_ids = []
linkins_ids = []
host_ids = []

opt = Options()
opt.ComputeReferences = True

view = doc.ActiveView

elems_list = []

for w in link_tags:
	tag_elem_id = w.TaggedElementId
	#tag_ids.append(w.TaggedLocalElementId)
	linked_ids.append(tag_elem_id.LinkedElementId)
	#linkins_ids.append(tag_elem_id.LinkInstanceId.ToString())
	#host_ids.append(tag_elem_id.HostElementId)
	
#link_elem_geom = link_doc.GetElement(linked_ids[0]).get_Geometry(opt)#.GetReferences()
#elem_geom2 = doc.GetElement(walls[4].Id).Geometry[opt]
for g in linked_ids:
	elems_list.append(link_doc.GetElement(g))
	
#geom_centr_point = link_elem_geom.ComputeCentroid()
#uidoc.ShowElements(link_elem)
#ref_insp = ReferenceIntersector(linked_ids[0], FindReferenceTarget.Element, view )
#ref_contx = ref_insp.FindNearest(test[0],test[0].Multiply(3))
elem = elems_list[1]

if elem.Location.GetType() == LocationCurve:
	location = elem.Location.Curve.Evaluate(0.5, True)
elif elem.Location.GetType() == LocationPoint:
	location = elem.Location.Point
ref = Reference(elem).CreateLinkReference(link_inst)

TransactionManager.Instance.EnsureInTransaction(doc)

"""#2019
newtag = IndependentTag.Create(doc,view.Id,ref,True,TagMode.TM_ADDBY_CATEGORY,TagOrientation.Horizontal,location)
"""
#2017 не работает для связанных файлов
newtag = doc.Create.NewTag(view, elem, False, TagMode.TM_ADDBY_CATEGORY, TagOrientation.Horizontal, location)

TransactionManager.Instance.EnsureInTransaction(doc)

#TransactionManager.Instance.TransactionTaskDone()
#newtag= doc.NewTag(view,elems_list[0],True,TagMode.TM_ADDBY_CATEGORY,TagOrientation.Horizontal,centr)


OUT = newtag
# ----------------------------------------
boolean = BoolSelector(true)  # frozen
code_block_2 = CodeBlock { 1; 2; }
if_ = Python(IN[0]=boolean, IN[1]=code_block_2.out0, IN[2]=code_block_2.out1)
# ---------- if_.python (4 lines) ----------
if IN[0]:
	OUT = UnwrapElement(IN[1])
else:
	OUT = UnwrapElement(IN[2])
# ----------------------------------------
som_workset = Python()  # frozen; unwired: IN[0]
# ---------- som_workset.python (30 lines) ----------
# -*- coding: utf-8 -*- 
#-----------------------Импоорт библиотек----------------------
import clr
clr.AddReference('RevitAPI')
import Autodesk
from Autodesk.Revit.DB import *

clr.AddReference("RevitNodes") 
import Revit
from Revit.Elements import *

clr.ImportExtensions(Revit.Elements) #ToDSType не работает без
clr.ImportExtensions(Revit.GeometryConversion) #ToXyz не работает без

clr.AddReference("RevitServices")
import RevitServices
from RevitServices.Persistence import DocumentManager
from RevitServices.Transactions import TransactionManager

clr.AddReference('ProtoGeometry')
from Autodesk.DesignScript.Geometry import *

doc = DocumentManager.Instance.CurrentDBDocument
wt = doc.GetWorksetTable()
walls = UnwrapElement(IN[0])

worksets_name = [wt.GetWorkset(e.WorksetId).Name for e in walls]
worksets = [wt.GetWorkset(e.WorksetId) for e in walls]

OUT = worksets,worksets_name
# ----------------------------------------
bring_me_you_test = Python()  # frozen; unwired: IN[0]
# ---------- bring_me_you_test.python (67 lines) ----------
import clr

import sys 
sys.path.append("C:\Program Files (x86)\IronPython 2.7\Lib")
import inspect

# Import DocumentManager and TransactionManager
clr.AddReference("RevitServices")
import RevitServices
from RevitServices.Persistence import DocumentManager
from RevitServices.Transactions import TransactionManager

# Import RevitAPI
clr.AddReference("RevitAPI")
import Autodesk
from Autodesk.Revit.DB import *

doc = DocumentManager.Instance.CurrentDBDocument
uiapp = DocumentManager.Instance.CurrentUIApplication
app = uiapp.Application

from System.Collections.Generic import *

clr.AddReference("RevitNodes") 
import Revit
from Revit.Elements import *

clr.ImportExtensions(Revit.Elements) #ToDSType не работает без
clr.ImportExtensions(Revit.GeometryConversion) #ToXyz не работает без

import System
from System import Type,Byte,DateTime,Text,IO
clr.AddReference('System')
from System.Collections.Generic import List

file_path = 'C:\\temp\\test_log.txt'

def LogSave(info):
	IO.File.AppendAllLines(file_path, flatten(info), Text.Encoding.Unicode)

def combine_results(list):
	str_list = [str(i) for i in list]
	return ", ".join(str_list)

def flatten(container):
    for i in container:
        if isinstance(i, (list,tuple)):
            for j in flatten(i):
                yield j
        else:
            yield i


#The inputs to this node will be stored as a list in the IN variable.
dataEnteringNode = IN
collector = FilteredElementCollector(doc)
elements = collector.OfCategory(BuiltInCategory.OST_Views).ToElements()

shedule_inctance = UnwrapElement(IN[0])

she_id = shedule_inctance.ScheduleId
she_element = doc.GetElement(she_id)
she_element.TemporaryViewModes
#LogSave([str(de) for de in dir(she_element)])
she_type_id = she_element.GetTypeId()

OUT = inspect.getdoc(she_element.setElementType)
# ----------------------------------------
shablon_python_shablon = Python()  # frozen; unwired: IN[0], IN[1]
# ---------- shablon_python_shablon.python (81 lines) ----------
# -*- coding: utf-8 -*- 
#-----------------------Импоорт библиотек----------------------
import clr
clr.AddReference('RevitAPI')
import Autodesk
from Autodesk.Revit.DB import *

clr.AddReference("RevitNodes") 
import Revit
from Revit.Elements import *

clr.ImportExtensions(Revit.Elements) #ToDSType не работает без
clr.ImportExtensions(Revit.GeometryConversion) #ToXyz не работает без

clr.AddReference("RevitServices")
import RevitServices
from RevitServices.Persistence import DocumentManager
from RevitServices.Transactions import TransactionManager

clr.AddReference('ProtoGeometry')
from Autodesk.DesignScript.Geometry import *

import System
clr.AddReference('System')
from System.Collections.Generic import List

#-----------------------ИМПОРТ БИБЛИОТЕК----------------------
"""-"""
#-----------------------ФУНКЦИИ----------------------

def __x__(x):
	x="x"
	return x
	
#-----------------------ФУНКЦИИ----------------------
"""-"""
#-----------------------АПИ ПАРАМЕТРЫ----------------------

doc = DocumentManager.Instance.CurrentDBDocument
#link_doc = UnwrapElement(IN[1])
#uiapp = DocumentManager.Instance.CurrentUIApplication
#app = uiapp.Application
#version = app.VersionNumber
#options = Autodesk.Revit.DB.SpatialElementBoundaryOptions()

#g_id_list = []
#g_id_list.append(ElementId(group))

#bxList = List[ElementId](g_id_list) #АЙ ЛИСТ КОЛЕКТИОН
#move = Transform.CreateTranslation(-wall.Orientation*2) #смещение
#cl.CreateTransformed(move)

#-----------------------АПИ ПАРАМЕТРЫ----------------------
"""-"""
#-----------------------РАБОЧИЕ ПАРАМЕТРЫ----------------------

rooms = UnwrapElement(IN[0])
catId = ElementId(IN[1])

#-----------------------РАБОЧИЕ ПАРАМЕТРЫ----------------------	
"""-"""
#-----------------------ТЕСТОВЫЕ ПАРАМЕТРЫ----------------------

test = []

#-----------------------ТЕСТОВЫЕ ПАРАМЕТРЫ----------------------
"""-"""
#-----------------------НАЧАЛО СКРИПТА----------------------

TransactionManager.Instance.EnsureInTransaction(doc)

ds = Autodesk.Revit.DB.DirectShape.CreateElement(doc, catId);
i_solid_list = List[Solid]()
i_gobj_ilist = List[GeometryObject](i_solid_list)
newDS = ds.SetShape(i_gobj_ilist)

TransactionManager.Instance.TransactionTaskDone()
#TransactionManager.Instance.ForceCloseTransaction().


OUT = newDS
# ----------------------------------------

# group: Get Revit Selection:
forceChildrensEval_2 = DummyNode(inputCount=1, outputCount=1, legacyNodeName=Prorubim.DS.Common.ForceChildrensEval, nodeNature=Deprecated)  # "Prorubim.DS.Common.ForceChildrensEval"; unwired: arg0
pys_get_revit_selection_2 = Python(IN[0]=forceChildrensEval_2)  # same code as pys_get_revit_selection

# group: Parameters name from language
parameters_name_from_language = Python()  # frozen
# ---------- parameters_name_from_language.python (18 lines) ----------
import clr
clr.AddReference('RevitServices')
import RevitServices
from RevitServices.Persistence import DocumentManager

uiapp = DocumentManager.Instance.CurrentUIApplication
app = uiapp.Application
lng = app.Language
rus = ["Тип","Имя семейства","Имя типа"]
enu = ["Type","Family name","Type name"]
out = []
if str(lng) == "Russian":
	out = rus
else:
	out = enu
#English_USA
#Russian
OUT = out
# ----------------------------------------

regenerate = Python()  # frozen; unwired: IN[0]
# ---------- regenerate.python (26 lines) ----------
import clr

# Import DocumentManager and TransactionManager
clr.AddReference("RevitServices")
import RevitServices
from RevitServices.Persistence import DocumentManager


# Import RevitAPI
clr.AddReference("RevitAPI")
import Autodesk
from Autodesk.Revit.DB import *

doc = DocumentManager.Instance.CurrentDBDocument


#The inputs to this node will be stored as a list in the IN variable.
list = IN[0]


if list:
	doc.Regenerate()
	out = "Regeneration complete"
else:
	out = "fail"
OUT = out
# ----------------------------------------
members = Python()  # "Object.Members"; frozen; unwired: IN[0]
# ---------- members.python (14 lines) ----------
import clr

items = IN[0]
elementlist = list()

try:
	clr.AddReference('RevitAPI')
	from Autodesk.Revit.DB import *
	for item in items:
		elementlist.append(dir(UnwrapElement(item)))
except:
	for item in items:
		elementlist.append(dir(item))
OUT = elementlist
# ----------------------------------------
filteredElementCollector = Python()  # frozen; unwired: IN[0]
# ---------- filteredElementCollector.python (29 lines) ----------
if IN[1]:
	import clr
	
	# Import DocumentManager and TransactionManager
	clr.AddReference("RevitServices")
	import RevitServices
	from RevitServices.Persistence import DocumentManager
	
	
	# Import RevitAPI
	clr.AddReference("RevitAPI")
	import Autodesk
	from Autodesk.Revit.DB import *
	
	doc = DocumentManager.Instance.CurrentDBDocument
	uiapp = DocumentManager.Instance.CurrentUIApplication
	app = uiapp.Application
	
	from System.Collections.Generic import *
	
	
	#The inputs to this node will be stored as a list in the IN variable.
	dataEnteringNode = IN
	collector = FilteredElementCollector(doc)
	elements = collector.OfCategory(BuiltInCategory.OST_Views).ToElements()
	
	OUT = sheetInstances
else:
	OUT = "скрипт не выполнен"
# ----------------------------------------
som_dir = Python()  # frozen; unwired: IN[0]
# ---------- som_dir.python (62 lines) ----------
# -*- coding: utf-8 -*- 
#-----------------------Импоорт библиотек----------------------
import clr
clr.AddReference('RevitAPI')
import Autodesk
from Autodesk.Revit.DB import *

clr.AddReference("RevitNodes") 
import Revit
from Revit.Elements import *

clr.ImportExtensions(Revit.Elements) #ToDSType не работает без
clr.ImportExtensions(Revit.GeometryConversion) #ToXyz не работает без

clr.AddReference("RevitServices")
import RevitServices
from RevitServices.Persistence import DocumentManager
from RevitServices.Transactions import TransactionManager

clr.AddReference('ProtoGeometry')
from Autodesk.DesignScript.Geometry import *

#-----------------------ИМПОРТ БИБЛИОТЕК----------------------
"""-"""
#-----------------------ФУНКЦИИ----------------------

def __x__(x):
	x="x"
	return x
	
#-----------------------ФУНКЦИИ----------------------
"""-"""
#-----------------------АПИ ПАРАМЕТРЫ----------------------

doc = DocumentManager.Instance.CurrentDBDocument
#link_doc = UnwrapElement(IN[1])
#uiapp = DocumentManager.Instance.CurrentUIApplication
#app = uiapp.Application
#version = app.VersionNumber
#options = Autodesk.Revit.DB.SpatialElementBoundaryOptions()

#-----------------------АПИ ПАРАМЕТРЫ----------------------
"""-"""
#-----------------------РАБОЧИЕ ПАРАМЕТРЫ----------------------

test1 = UnwrapElement(IN[0])

#-----------------------РАБОЧИЕ ПАРАМЕТРЫ----------------------	
"""-"""
#-----------------------ТЕСТОВЫЕ ПАРАМЕТРЫ----------------------

test = []

#-----------------------ТЕСТОВЫЕ ПАРАМЕТРЫ----------------------
"""-"""
#-----------------------НАЧАЛО СКРИПТА----------------------

#TransactionManager.Instance.EnsureInTransaction(doc)
#TransactionManager.Instance.TransactionTaskDone()
#-----------------------КОНЕЦ СКРИПТА----------------------

OUT = dir(RevitServices.Persistence.DocumentManager.CurrentUIApplication)
# ----------------------------------------
array_i_lambda = Python()  # frozen; unwired: IN[0]
# ---------- array_i_lambda.python (25 lines) ----------
from System import *
from System.Collections.Generic import List

ja_spisok = ["1","2","A","B"]

ja_spisok_spiskov = [["1","2"],["A","B"]]

ja_korteg_kortegey = (("1","2"),("A","B"))

ja_spisok_arrayof = []

for ja in ja_spisok_spiskov:
	ja_spisok_arrayof.append(Array[str](ja))

strArray = Array[Array[str]](ja_spisok_arrayof)

strArray2 = Array[Array[str]](ja_korteg_kortegey)

strArray3 = Array[Array[str]](tuple(tuple(x) for x in ja_spisok_spiskov))

f = lambda x: tuple(x)

strArray4 = Array[Array[str]](f(f(x) for x in ja_spisok_spiskov))

OUT = strArray4
# ----------------------------------------
pick_object = Python()  # frozen; unwired: IN[0]
# ---------- pick_object.python (26 lines) ----------
#Copyright(c) 2016, Dimitar Venkov
# @5devene, dimitar.ven@gmail.com

import clr

clr.AddReference("RevitAPIUI")
from  Autodesk.Revit.UI import *

clr.AddReference("RevitServices")
import RevitServices
from RevitServices.Persistence import DocumentManager
doc = DocumentManager.Instance.CurrentDBDocument
uidoc=DocumentManager.Instance.CurrentUIApplication.ActiveUIDocument

clr.AddReference("RevitNodes")
import Revit
clr.ImportExtensions(Revit.Elements)

sel1 = uidoc.Selection
ot1 = Selection.ObjectType.Element
ot2 = Selection.ObjectType.LinkedElement
li_ref = sel1.PickObject(ot1, "Select a link instance first.")
el_ref = sel1.PickObject(ot2, "Pick a linked element.")
Link1 = doc.GetElement(li_ref.ElementId)
LinkDoc = Link1.GetLinkDocument()
OUT = LinkDoc.GetElement(el_ref.LinkedElementId).ToDSType(True)
# ----------------------------------------
test = Python()  # frozen; unwired: IN[0]
# ---------- test.python (28 lines) ----------
# -*- coding: utf-8 -*- 
#-----------------------Импоорт библиотек----------------------
import clr
clr.AddReference('RevitAPI')
import Autodesk
from Autodesk.Revit.DB import *
from Autodesk.Revit.DB.ExternalService import *

clr.AddReference("RevitNodes") 
import Revit
from Revit.Elements import *

clr.ImportExtensions(Revit.Elements) #ToDSType не работает без
clr.ImportExtensions(Revit.GeometryConversion) #ToXyz не работает без

clr.AddReference("RevitServices")
import RevitServices
from RevitServices.Persistence import DocumentManager
from RevitServices.Transactions import TransactionManager

clr.AddReference('ProtoGeometry')
from Autodesk.DesignScript.Geometry import *

doc = DocumentManager.Instance.CurrentDBDocument

serviceId = ExternalServices.BuiltInExternalServices.DirectContext3DService

OUT = serviceId
# ----------------------------------------

# group: элементы внутри групп
members_2 = Python()  # "Group.Members"; frozen; unwired: IN[0]
# ---------- members_2.python (19 lines) ----------
import clr
clr.AddReference('RevitAPI')
from Autodesk.Revit.DB import *

clr.AddReference("RevitNodes")
import Revit
clr.ImportExtensions(Revit.Elements)

groups = UnwrapElement(IN[0])
elementlist = list()
for item in groups:
	try:
		memberlist = list()
		for member in item.GetMemberIds():
			memberlist.append(item.Document.GetElement(member))
		elementlist.append(memberlist)
	except:
		elementlist.append(list())
OUT = elementlist
# ----------------------------------------

# group: САМЫЙ ГЛАВНЫЙ ТЕСТ КАТЕГОИИ == БУИЛДИН
select_test = DSModelElementSelection()  # frozen
самый_главный_тест_категоии = Python(IN[0]=select_test)  # "САМЫЙ ГЛАВНЫЙ ТЕСТ КАТЕГОИИ == БУИЛДИН"
# ---------- самый_главный_тест_категоии.python (17 lines) ----------
import clr

clr.AddReference("RevitAPIUI")
from  Autodesk.Revit.UI import Selection

clr.AddReference("RevitServices")
from RevitServices.Persistence import DocumentManager

clr.AddReference('RevitAPI')
from Autodesk.Revit.DB import *

#doc = DocumentManager.Instance.CurrentDBDocument
test_element = UnwrapElement(IN[0])

#OUT = test_element.Category.Id == BuiltInCategory.OST_Parts, BuiltInCategory.OST_Parts.CompareTo(BuiltInCategory.OST_Parts) BuiltInCategory.OST_Parts.CompareTo(test_element.Category.Id.IntegerValue)
#OUT = test_element.Category.Id.IntegerValue, BuiltInCategory.OST_Parts.GetHashCode(), dir(BuiltInCategory.OST_Parts)
OUT = test_element.Category.Id.IntegerValue == BuiltInCategory.OST_Parts.GetHashCode(), dir(BuiltInCategory.OST_Parts)
# ----------------------------------------

transactionmanager_test = Python()  # unwired: IN[0]
# ---------- transactionmanager_test.python (41 lines) ----------
import clr

import sys 
sys.path.append("C:\Program Files (x86)\IronPython 2.7\Lib")
import inspect

# Import DocumentManager and TransactionManager
clr.AddReference("RevitServices")
import RevitServices
from RevitServices.Persistence import DocumentManager
from RevitServices.Transactions import TransactionManager

# Import RevitAPI
clr.AddReference("RevitAPI")
import Autodesk
from Autodesk.Revit.DB import *

doc = DocumentManager.Instance.CurrentDBDocument
uiapp = DocumentManager.Instance.CurrentUIApplication
app = uiapp.Application

from System.Collections.Generic import *

clr.AddReference("RevitNodes") 
import Revit
from Revit.Elements import *

clr.ImportExtensions(Revit.Elements) #ToDSType не работает без
clr.ImportExtensions(Revit.GeometryConversion) #ToXyz не работает без

import System
from System import Type,Byte,DateTime,Text,IO
clr.AddReference('System')
from System.Collections.Generic import List

t1 = TransactionManager.Instance
t2 = t1.EnsureInTransaction(doc)


OUT = dir(t1.SetupManager), dir(t1)#, dir(t2)
TransactionManager.ForceCloseTransaction(t1)
# ----------------------------------------
перезапуск = BoolSelector(true)
округделние_с_переводом_в_стринг = Python(IN[0]=перезапуск)  # "Округделние с переводом в стринг с фиксированым количеством знаков"
# ---------- округделние_с_переводом_в_стринг.python (9 lines) ----------
import clr
clr.AddReference("System")
from System import Math

list = [1.000,2.0002,3.111]

OUT = [Math.Round(l,3).ToString("N3") for l in list] # NET метод

OUT = ["{0:.3f}".format(float(l)) for l in list] # Python метод
# ----------------------------------------
forceChildrensEval_3 = ForceChildrensEval()  # unwired: arg0
load_dll = Python(IN[0]=forceChildrensEval_3)
# ---------- load_dll.python (44 lines) ----------
# -*- coding: utf-8 -*- 
#-----------------------Импоорт библиотек----------------------
import clr
clr.AddReference('RevitAPI')
import Autodesk
from Autodesk.Revit.DB import *
from Autodesk.Revit.DB.Analysis import *
from Autodesk.Revit.DB.Events import *
from Autodesk.Revit.Creation import *


clr.AddReference("RevitNodes") 
import Revit
from Revit.Elements import *

clr.ImportExtensions(Revit.Elements) #ToDSType не работает без
clr.ImportExtensions(Revit.GeometryConversion) #ToXyz не работает без

clr.AddReference("RevitServices")
import RevitServices
from RevitServices.Persistence import DocumentManager
from RevitServices.Transactions import TransactionManager

clr.AddReference('ProtoGeometry')
from Autodesk.DesignScript.Geometry import *

import System
from System import Type,Byte,DateTime,Text,IO
clr.AddReference('System')
from System.Collections.Generic import List

clr.AddReferenceToFileAndPath(r"C:\VS\source\repos\SheduleToExcelDll\SheduleToExcelDll\bin\Debug\SheduleToExcelDll.dll")
import SheduleToExcelDll
from SheduleToExcelDll import Class1

ids = UnwrapElement(IN[0])

test = SheduleToExcelDll.Class1
test2 = 0

#test2 = test.FilterSelect()
#test.ExportAllSchedules()

OUT = test2, 0, Class1.test
# ----------------------------------------
путь_к_файлу_python = Filename(".\N.Отделка помещений_сбор элементов вокруг_1.7.py")  # frozen
forceChildrensEval_4 = ForceChildrensEval(путь_к_файлу_python)
find_file_and_import_it = Python(IN[0]=forceChildrensEval_4)
# ---------- find_file_and_import_it.python (11 lines) ----------
import sys
sys.path.append('C:\Program Files (x86)\IronPython 2.7\Lib')
import codecs

try:
	filePath = IN[0]
	with codecs.open(filePath, 'rb', "utf-8") as inf:
		lines = inf.readlines()
	OUT = ''.join(lines)
except:
	OUT = "No file"
# ----------------------------------------
python_script_from_string = PythonStringNode(script=find_file_and_import_it)  # unwired: IN[0]
select_model_elements = DSModelElementsSelection()
id = Element.Id(select_model_elements)
preselectedLinkElement = Python()  # unwired: IN[0]
# ---------- preselectedLinkElement.python (55 lines) ----------
import clr

clr.AddReference("System")
from System.Collections.Generic import List

clr.AddReference("RevitAPIUI")
from  Autodesk.Revit.UI import *
from  Autodesk.Revit.UI.Selection import ISelectionFilter

import clr
clr.AddReference('RevitAPI')
import Autodesk
from Autodesk.Revit.DB import *

clr.AddReference("RevitServices")
import RevitServices
from RevitServices.Persistence import DocumentManager
from RevitServices.Transactions import TransactionManager

clr.AddReference("RevitNodes")
import Revit
clr.ImportExtensions(Revit.Elements)

class iSF(ISelectionFilter):
	def AllowElement(self, element):
		return True
	def AllowReference(self, refer, point):
		return True

doc = DocumentManager.Instance.CurrentDBDocument
uidoc = DocumentManager.Instance.CurrentUIApplication.ActiveUIDocument

link = UnwrapElement(IN[0])

#el_ref = UnwrapElement(sel1.PickObjects(ot2, "Select the linked elements and press Finish."))

LinkDoc = link.GetLinkDocument()
#walls = FilteredElementCollector(LinkDoc).OfCategory(BuiltInCategory.OST_Walls).ToElementIds()
walls2 = FilteredElementCollector(LinkDoc).OfCategory(BuiltInCategory.OST_Walls).ToElements()
ref_list = []
for elem in walls2:
	ref_list.append(Reference(elem).CreateLinkReference(link))

ilisrt_ref = List[Reference](ref_list)

#newids = [LinkElementId(link.Id,w) for w in walls]
#newids2 = [nw.LinkedElementId for nw in newids]
#ilist = List[ElementId](newids2)

sel1 = uidoc.Selection
ot2 = Selection.ObjectType.LinkedElement
#sel1.SetElementIds(ilist)
sel1.PickObjects(ot2,iSF(),"blablabla",ilisrt_ref)

OUT = 1
# ----------------------------------------

# group: САМЫЙ ГЛАВНЫЙ ТЕСТ КАТЕГОИИ == БУИЛДИН
select_test_2 = DSModelElementSelection()
самый_главный_тест_категоии_2 = Python(IN[0]=select_test_2)  # "САМЫЙ ГЛАВНЫЙ ТЕСТ КАТЕГОИИ == БУИЛДИН"; same code as самый_главный_тест_категоии

# group: САМЫЙ ГЛАВНЫЙ ТЕСТ КАТЕГОИИ == БУИЛДИН
select_test_3 = DSModelElementSelection()  # frozen
самый_главный_тест_категоии_3 = Python(IN[0]=select_test_3)  # "САМЫЙ ГЛАВНЫЙ ТЕСТ КАТЕГОИИ == БУИЛДИН"; same code as самый_главный_тест_категоии
