# Dynamo graph 4.Размещать на основе Edges формы.dyn (Dynamo 1.3.1.1736)

# group: Get Revit Selection:
forceChildrensEval = ForceChildrensEval()  # unwired: arg0
pys_get_revit_selection = Python(IN[0]=forceChildrensEval)
# ---------- pys_get_revit_selection.python (22 lines) ----------
import clr
clr.AddReference('RevitServices')
clr.AddReference('RevitAPI')
from Autodesk.Revit.DB import *
import RevitServices
from RevitServices.Persistence import DocumentManager
from Autodesk.Revit.ApplicationServices import Application

reset = IN[0]

doc = DocumentManager.Instance.CurrentDBDocument
uidoc = DocumentManager.Instance.CurrentUIApplication.ActiveUIDocument
ids = uidoc.Selection.GetElementIds()

idd = [str(i) for i in ids]

if isinstance(idd, list) == True:
	elems = [doc.GetElement(ElementId(int(i))) for i in idd]
else:
	elems = doc.GetElement(ElementId(int(idd)))

OUT = elems
# ----------------------------------------

select_edges = SelectEdges()
levels = Levels("Этаж 01")
family_types = FamilyTypes("ADSK_Колонна бетонная_Квадратная:300x300")
beamByCurve = StructuralFraming.BeamByCurve(curve=select_edges, level=levels, structuralFramingType=family_types)  # frozen
endPoint = Curve.EndPoint(select_edges)
startPoint = Curve.StartPoint(select_edges)
byStartPointEndPoint = Line.ByStartPointEndPoint(startPoint=endPoint, endPoint=startPoint)
columnByCurve = StructuralFraming.ColumnByCurve(curve=byStartPointEndPoint, level=levels, structuralColumnType=family_types)
reverse = Curve.Reverse()  # unwired: arg0
