# Dynamo graph 4.Размещать на основе face.dyn (Dynamo 1.3.1.1736)

select_face = DSFaceSelection()  # 1 picked in the model
perimeterCurves = Surface.PerimeterCurves(select_face)
levels = Levels("P01")
family_types = FamilyTypes("S-Фасонные элементы сендвич панелей (балка):Нащельник угловой")
beamByCurve = StructuralFraming.BeamByCurve(curve=perimeterCurves, level=levels, structuralFramingType=family_types)
