# Dynamo graph Прописать отметку отверстия.dyn (Dynamo 1.3.0.875)

categories = Categories("GenericModel")
forceChildrensEval = ForceChildrensEval()  # unwired: arg0
activeView = Python(IN[0]=forceChildrensEval)  # "Springs.Doc.ActiveView"
# ---------- activeView.python (14 lines) ----------
#Copyright(c) 2016, Dimitar Venkov
# @5devene, dimitar.ven@gmail.com

import clr

clr.AddReference("RevitServices")
import RevitServices
from RevitServices.Persistence import DocumentManager
doc = DocumentManager.Instance.CurrentDBDocument
clr.AddReference("RevitNodes")
import Revit
clr.ImportExtensions(Revit.Elements)

OUT = doc.ActiveView.ToDSType(True)
# ----------------------------------------
byCategoryAndView = archilab.Revit.Selection.Select.ByCategoryAndView(categories, activeView)
string = StringInput("GKS_Отв_Отметка верх")
string_2 = StringInput("GKS_Отв_Отметка абс")
getLocation = Element.GetLocation(byCategoryAndView)
Z = Point.Z(getLocation)
levels = Levels("К8 01 Этаж (0.000)")
elevation = Level.Elevation(levels)
watch = Watch(elevation)
code_block = CodeBlock(a=Z, b=watch) { (a-b-c)/1000; c=0; }  # unwired: c
watch_2 = Watch(code_block.out0)
code_block_2 = CodeBlock { 142.10; }
code_block_3 = CodeBlock(a=watch_2, b=code_block_2) { a+b; }
boundingBox = Geometry.BoundingBox(byCategoryAndView)
maxPoint = BoundingBox.MaxPoint(boundingBox)
Z_2 = Point.Z(maxPoint)
minPoint = BoundingBox.MinPoint(boundingBox)
Z_3 = Point.Z(minPoint)
sub = Z_2 - Z_3
code_block_4 = CodeBlock { 1; }
sub_2 = sub - code_block_4
code_block_5 = CodeBlock { 1000; }
div = sub_2 / code_block_5
sub_3 = watch_2 - div
string_3 = StringInput("GKS_Отв_Отметка низ")
setparameterbyname_with_catch = Python(IN[0]=byCategoryAndView, IN[1]=string, IN[2]=string_2, IN[3]=watch_2, IN[4]=code_block_3, IN[5]=sub_3, IN[6]=string_3, IN[7]=forceChildrensEval)  # "SetParameterByName with catch exception"
# ---------- setparameterbyname_with_catch.python (29 lines) ----------
import clr
clr.AddReference('ProtoGeometry')
from Autodesk.DesignScript.Geometry import *
import clr
clr.AddReference('RevitNodes')
import Revit
#Введенные в этом узле данные сохраняется в виде списка в переменных IN.
elements = IN[0]
paramName1 = IN[1]
paramName2 = IN[2]
paramVal1 = IN[3]
paramVal2 = IN[4]
paramName3 = IN[6]
paramVal3 = IN[5]
rezet = IN[7]

for i in range(len(elements)):
	try:
		elements[i].SetParameterByName(paramName1,paramVal1[i])
		elements[i].SetParameterByName(paramName2,paramVal2[i])
		elements[i].SetParameterByName(paramName3,paramVal3[i])
		
	except:
		paramName1 = paramName1
	


#Назначьте вывод переменной OUT.
OUT = paramVal3
# ----------------------------------------
watch_3 = Watch(setparameterbyname_with_catch)

# group: Get Revit Selection:
forceChildrensEval_2 = ForceChildrensEval()  # unwired: arg0
pys_get_revit_selection = Python(IN[0]=forceChildrensEval_2)
# ---------- pys_get_revit_selection.python (22 lines) ----------
import clr
clr.AddReference('RevitServices')
clr.AddReference('RevitAPI')
from Autodesk.Revit.DB import *
import RevitServices
from RevitServices.Persistence import DocumentManager
from Autodesk.Revit.ApplicationServices import Application

reset = IN[0]

doc = DocumentManager.Instance.CurrentDBDocument
uidoc = DocumentManager.Instance.CurrentUIApplication.ActiveUIDocument
ids = uidoc.Selection.GetElementIds()

idd = [str(i) for i in ids]

if isinstance(idd, list) == True:
	elems = [doc.GetElement(ElementId(int(i))) for i in idd]
else:
	elems = doc.GetElement(ElementId(int(idd)))

OUT = elems
# ----------------------------------------
