# Dynamo graph Отметка отверстия.dyn (Dynamo 1.2.1.3083)

categories = Categories("Sprinklers")
all_elements_of_category = ElementsOfCategory(categories)
параметры = CodeBlock { "Смещение"; "GKS_Отв_Отметка"; "Стена"; }
getParameterValueByName = Element.GetParameterValueByName(element=all_elements_of_category, parameterName=параметры.out2)
code_block = CodeBlock { 1; }
eq = getParameterValueByName == code_block
filterByBoolMask = List.FilterByBoolMask(list=all_elements_of_category, mask=eq)
getParameterValueByName_2 = Element.GetParameterValueByName(element=filterByBoolMask.in, parameterName=параметры.out0)
setParameterByName = Element.SetParameterByName(element=filterByBoolMask.in, parameterName=параметры.out1, value=getParameterValueByName_2)
watch = Watch(all_elements_of_category)
boolean = BoolSelector(true)  # frozen
activeView = Custom[Springs.Doc.ActiveView](refresh=boolean@L1)  # Selects the current document's active view. Supports more view types than the built-in option. Will be depreciated once the bult in node works with all plan types.
byCategoryAndView = Archilab.Grimshaw.Selection.Select.ByCategoryAndView(arg1=activeView)  # unwired: arg0
string = StringInput("Высота установки")
getLocation = Element.GetLocation()  # unwired: arg0
Z = Point.Z(getLocation)
levels = Levels()  # frozen
elevation = Level.Elevation(levels)
watch_2 = Watch(elevation)
code_block_2 = CodeBlock(a=Z, b=watch_2) { (a-b-c)/1000; c=0; }  # unwired: c
format = Python(IN[0]=code_block_2.out0)
# ---------- format.python (15 lines) ----------
import clr
clr.AddReference('ProtoGeometry')
from Autodesk.DesignScript.Geometry import *
#Введенные в этом узле данные сохраняется в виде списка в переменных IN.
list_in = IN[0]
list_out = []

for i in range(len(list_in)):
	k = round(list_in[i],1)
	str  = '{:.1f}'.format(k)
	list_out.append(str)
	

#Назначьте вывод переменной OUT.
OUT = list_out
# ----------------------------------------
watch_3 = Watch(format)
setparameterbyname_with_catch = Python(IN[0]=byCategoryAndView, IN[1]=string, IN[2]=watch_3)  # "SetParameterByName with catch exception"; unwired: IN[3]
# ---------- setparameterbyname_with_catch.python (21 lines) ----------
import clr
clr.AddReference('ProtoGeometry')
from Autodesk.DesignScript.Geometry import *
import clr
clr.AddReference('RevitNodes')
import Revit
#Введенные в этом узле данные сохраняется в виде списка в переменных IN.
elements = IN[0]
paramName = IN[1]
paramVal = IN[2]

for i in range(len(elements)):
	try:
		elements[i].SetParameterByName(paramName,paramVal[i])
	except:
		paramName = paramName
	


#Назначьте вывод переменной OUT.
OUT = elements
# ----------------------------------------
watch_4 = Watch(setparameterbyname_with_catch)
renumberGridsByCurve = Custom[Rhythm.RenumberGridsByCurve]()  # This node will renumber grids in order of curve drawn through them. Select either letters or numbers. (Alphanumeric coming soon); unwired: modelCurve, startCharacter
