# Dynamo graph 5-Пересечение геометрии (можно связанные файлы).dyn (Dynamo 1.3.0.875)

# note: ВСЁ ОСТАЛЬНОЕ

# group: КЛЮЧЕВЫЕ МОМЕНТЫ РАБОТЫ
# note: ИТОГОВАЯ КОНСОЛИДАЦИЯ ДАННЫХ

# group: ЗАПАСНЫЕ ВАРИАНТЫ, ДОПОЛНИТЕЛЬНЫЕ ОПЦИИ
# note: ДОПОЛНИТЕЛЬНЫЕ. Градации серово по важности, темнее - важнее
# note: ЗАПАСНЫЕ

# group: ИСПОЛНИТЕЛЬНЫЕ НОДЫ (фильтрование, подбор, списки и т.д.)
# note: НОДЫ РАБОТАЮЩИЕ С ДАННЫМИ
# note: ИСПОЛНИТЕЛЬНЫЕ НОДЫ

# group: ПРОВЕРОЧНЫЕ НОДЫ
# note: ПРОВЕРОЧНЫЕ НОДЫ

# group: ПЕРЕДАЁМ ИНФОРМАЦИЮ В РЕВИТ
# note: ПЕРЕДАЁМ ИНФОРМАЦИЮ В РЕВИТ

# group: УПРАВЛЯЮЩИЕ НОДЫ
# note: ПЕРЕМЕННЫЕ ЗНАЧЕНИЯ

# group: ПРИМЕЧАНИЯ ПО ЦВЕТОВОЙ ГРУППИРОВКЕ
# note: GUIDELINES

# group: ПОЛУЧАЕМ ДАННЫЕ ИЗ РЕВИТ
# note: ПОЛУЧАЕМ ДАННЫЕ ИЗ РЕВИТ

# group: ЭЛЕМЕНТЫ В ВАШЕЙ МОДЕЛИ ИЛИ В СВЯЗАННОМ ФАЙЛЕ
категория_1 = Categories("SecurityDevices")
элементы_из_связанного_файла_1 = BoolSelector(false)
часть_имени_связанного_файла_1 = StringInput("ОВ")

python_script = Python(IN[0]=элементы_из_связанного_файла_1, IN[1]=часть_имени_связанного_файла_1)
# ---------- python_script.python (41 lines) ----------
# Подгрузка библиотек
import clr
clr.AddReference('ProtoGeometry')
from Autodesk.DesignScript.Geometry import *

clr.AddReference('RevitAPI')
import Autodesk
from Autodesk.Revit.DB import *

clr.AddReference('RevitServices')
import RevitServices
from RevitServices.Persistence import DocumentManager
from RevitServices.Transactions import TransactionManager

import math

# Получение текущего проекта
doc = DocumentManager.Instance.CurrentDBDocument

# Получение списка связанных файлов

linkInstances = FilteredElementCollector(doc).OfClass(Autodesk.Revit.DB.RevitLinkInstance)

isLink = IN[0] # Определение того, в связанном ли файле находятся сети
nameLink = IN[1] # Часть имени файла с сетями для корректного определения
linkInst = "текущий документ"

# Фильтрация связанных файлов
if isLink:
	a = 0
	for inst in linkInstances:
		if nameLink in inst.Name:
			linkDoc = inst.GetLinkDocument()
			linkInst = inst
			a = 1
	if a == 0:
		linkDoc = doc
else:
	linkDoc = doc
	
OUT = ([linkDoc, linkInst])
# ----------------------------------------
code_block = CodeBlock(Doc=python_script, Inst=python_script) { Doc[0]; Inst[1]; }
# note: ПОЛУЧАЕМ ЭЛЕМЕНТЫ
python_script_2 = Python(IN[0]=категория_1, IN[1]=code_block.out0, IN[2]=code_block.out1)
# ---------- python_script_2.python (45 lines) ----------
#python nodes in dynamo 1.0
#proposed by Julien Benoit @jbenoit44 
#http://aecuandme.wordpress.com/
import System
import clr
clr.AddReference('ProtoGeometry')
from Autodesk.DesignScript.Geometry import *
# Import ToDSType(bool) extension method
clr.AddReference("RevitNodes")
import Revit
clr.ImportExtensions(Revit.Elements)
# Import geometry conversion extension methods
clr.ImportExtensions(Revit.GeometryConversion)
# Import DocumentManager and TransactionManager
clr.AddReference("RevitServices")
import RevitServices
from RevitServices.Persistence import DocumentManager
from RevitServices.Transactions import TransactionManager
from System.Collections.Generic import *
# Import RevitAPI
clr.AddReference("RevitAPI")
import Autodesk
from Autodesk.Revit.DB import *

doc = DocumentManager.Instance.CurrentDBDocument
uiapp = DocumentManager.Instance.CurrentUIApplication
app = uiapp.Application
uidoc=DocumentManager.Instance.CurrentUIApplication.ActiveUIDocument

cat = IN[0]
LinkDoc=IN[1]
LinkInst = IN[2]

BuiltIn = System.Enum.ToObject(BuiltInCategory, cat.Id)

elementlist = []
typelist=[]
T = []

collector = FilteredElementCollector(LinkDoc)
filter = ElementCategoryFilter(BuiltIn)
list=collector.WherePasses(filter).WhereElementIsNotElementType().ToElements()


OUT = list
# ----------------------------------------
name = Element.Name(python_script_2)
string = StringInput("Короб")
contains = String.Contains(str=name, searchFor=string)
filterByBoolMask = List.FilterByBoolMask(list=python_script_2, mask=contains)

# group: ЭЛЕМЕНТЫ В ВАШЕЙ МОДЕЛИ ИЛИ В СВЯЗАННОМ ФАЙЛЕ
категория_2 = Categories("PipeCurves")
элементы_из_связанного_файла_2 = BoolSelector(true)
часть_имени_связанного_файла_2 = StringInput("ВК")

python_script_3 = Python(IN[0]=элементы_из_связанного_файла_2, IN[1]=часть_имени_связанного_файла_2)
# ---------- python_script_3.python (40 lines) ----------
# Подгрузка библиотек
import clr
clr.AddReference('ProtoGeometry')
from Autodesk.DesignScript.Geometry import *

clr.AddReference('RevitAPI')
import Autodesk
from Autodesk.Revit.DB import *

clr.AddReference('RevitServices')
import RevitServices
from RevitServices.Persistence import DocumentManager
from RevitServices.Transactions import TransactionManager

import math

# Получение текущего проекта
doc = DocumentManager.Instance.CurrentDBDocument

# Получение списка связанных файлов

linkInstances = FilteredElementCollector(doc).OfClass(Autodesk.Revit.DB.RevitLinkInstance)

isLink = IN[0] # Определение того, в связанном ли файле находятся сети
nameLink = IN[1] # Часть имени файла с сетями для корректного определения

# Фильтрация связанных файлов
if isLink:
	a = 0
	for inst in linkInstances:
		if nameLink in inst.Name:
			linkDoc = inst.GetLinkDocument()
			linkInst = inst
			a = 1
	if a == 0:
		linkDoc = doc
else:
	linkDoc = doc
	
OUT = ([linkDoc, linkInst])
# ----------------------------------------
code_block_2 = CodeBlock(Doc=python_script_3, Inst=python_script_3) { Doc[0]; Inst[1]; }
python_script_4 = Python(IN[0]=категория_2, IN[1]=code_block_2.out0, IN[2]=code_block_2.out1)  # same code as python_script_2
solids = Element.Solids(python_script_4)
flatten = Flatten(solids)
solids_2 = Element.Solids(filterByBoolMask.in)
flatten_2 = Flatten(solids_2)
# note: ПОЛУЧЕНИЕ ЭЛЕМЕНТОВ ПОПАВШИХ В ПЕРЕСЕЧЕНИЕ
doesIntersect = Geometry.DoesIntersect(geometry=flatten, other=flatten_2, lacing=CrossProduct)
flatten_3 = Flatten(doesIntersect)
uniqueItems = List.UniqueItems(flatten_3)
code_block_3 = CodeBlock(a=uniqueItems) { a[1]; }
allIndicesOf = List.AllIndicesOf(list=doesIntersect, item=code_block_3, lacing=CrossProduct)
flatten_4 = Flatten(allIndicesOf)
getItemAtIndex = List.GetItemAtIndex(list=filterByBoolMask.in, index=flatten_4)
# note: МОЖНО ЗАБРАТЬ ПАРАМЕТРЫ И ОТПРАВИТЬ ИХ В ОТЧЁТ
firstItem = List.FirstItem(getItemAtIndex)
parameters = Element.Parameters(firstItem)
семейство_для_размещения_в_месте = FamilyTypes()  # "СЕМЕЙСТВО ДЛЯ РАЗМЕЩЕНИЯ В МЕСТЕ ПЕРЕСЕЧЕНИЯ"; frozen
code_block_4 = CodeBlock { "Маркер_коллизии"; }
byName = FamilyType.ByName(code_block_4)
allFalse = AllFalse(doesIntersect, lacing=Longest)
filterByBoolMask_2 = List.FilterByBoolMask(list=flatten, mask=allFalse)
flatten_5 = Flatten(filterByBoolMask_2.out)
code_block_5 = CodeBlock { "Hi"; "Wi"; "H"; }

# group: Выступ габартов маркера
выступ_размеров_маркера = DoubleSlider(500, range=100..1000 step 100)

filterByBoolMask_3 = List.FilterByBoolMask(list=python_script_4, mask=allFalse)

# group: Цвета для переопределения
uniqueItems_2 = List.UniqueItems(getItemAtIndex)
code_block_6 = CodeBlock { 0; 255; }
byARGB = Color.ByARGB(a=code_block_6.out0, r=code_block_6.out1, g=code_block_6.out0, b=code_block_6.out0)
uniqueItems_3 = List.UniqueItems(filterByBoolMask_3.out)
byARGB_2 = Color.ByARGB(a=code_block_6.out0, r=code_block_6.out0, g=code_block_6.out0, b=code_block_6.out1)

# group: ЭЛЕМЕНТ В МОДЕЛИ ИМЕЮЩИЙ ПЕРЕСЕЧЕНИЕ
overrideColorInView = Element.OverrideColorInView(element=uniqueItems_2, color=byARGB)
overrideColorInView_2 = Element.OverrideColorInView(element=uniqueItems_3, color=byARGB_2)

solids_3 = Element.Solids(uniqueItems_2)
flatten_6 = Flatten(solids_3)

# group (continued): Цвета для переопределения
byGeometryColor = Display.Display.ByGeometryColor(flatten_6, byARGB, lacing=Longest)

intersect = Geometry.Intersect(geometry=flatten_5, other=flatten_6, lacing=CrossProduct)
clean = List.Clean(list=intersect@L1)
# note: ПОЛУЧАЕМ ТОЧКИ И ГАБАРИТЫ ДЛЯ СЕМЕЙСТВА
flatten_7 = Flatten(clean)
centroid = Solid.Centroid(flatten_7)

# group: СОЗДАННЫЕ МАРКЕРЫ КОЛЛИЗИИ
# note: СОЗДАННЫЕ МАРКЕРЫ КОЛЛИЗИИ
byPoint = FamilyInstance.ByPoint(familyType=byName, point=centroid)

boundingBox = Geometry.BoundingBox(flatten_7)
maxPoint = BoundingBox.MaxPoint(boundingBox)
X = Point.X(maxPoint)
minPoint = BoundingBox.MinPoint(boundingBox)
X_2 = Point.X(minPoint)
Y = Point.Y(maxPoint)
Y_2 = Point.Y(minPoint)
Z = Point.Z(maxPoint)
Z_2 = Point.Z(minPoint)
code_block_7 = CodeBlock(x=X, x1=X_2, a=выступ_размеров_маркера, y=Y, y1=Y_2, z=Z, z1=Z_2) { x-x1+a; y-y1+a; z-z1+a; }
code_block_8 = CodeBlock(x=code_block_7.out0) { x; }
setParameterByName = Element.SetParameterByName(element=byPoint, parameterName=code_block_5.out1, value=code_block_8)
code_block_9 = CodeBlock(y=code_block_7.out1) { y; }
setParameterByName_2 = Element.SetParameterByName(element=setParameterByName, parameterName=code_block_5.out0, value=code_block_9)
code_block_10 = CodeBlock(z=code_block_7.out2) { z; }
setParameterByName_3 = Element.SetParameterByName(element=setParameterByName_2, parameterName=code_block_5.out2, value=code_block_10)
