# Dynamo graph Colour Override Active View Reset.dyn (Dynamo 1.3.0.875)

categories = Categories("SecurityDevices")
all_elements_of_category = ElementsOfCategory(categories)
name = Element.Name(all_elements_of_category)
string = StringInput("Короб")
contains = String.Contains(str=name, searchFor=string)
filterByBoolMask = List.FilterByBoolMask(list=all_elements_of_category, mask=contains)
flatten = Flatten(filterByBoolMask.in)
current = Document.Current()
activeView = Document.ActiveView(current)
resetOverridesInView = Custom[Element.ResetOverridesInView Clockwork](element=flatten, view=activeView)  # "Element.ResetOverridesInView"; Resets all overrides for an element in a given view
