# Dynamo graph Возврат исходных цветов после проверки коллизий.dyn (Dynamo 1.3.0.875)

# note: ВСЁ ОСТАЛЬНОЕ

# group: КЛЮЧЕВЫЕ МОМЕНТЫ РАБОТЫ
# note: ИТОГОВАЯ КОНСОЛИДАЦИЯ ДАННЫХ

# group: ЗАПАСНЫЕ ВАРИАНТЫ, ДОПОЛНИТЕЛЬНЫЕ ОПЦИИ
# note: ДОПОЛНИТЕЛЬНЫЕ. Градации серово по важности, темнее - важнее
# note: ЗАПАСНЫЕ

# group: ИСПОЛНИТЕЛЬНЫЕ НОДЫ (фильтрование, подбор, списки и т.д.)
# note: НОДЫ РАБОТАЮЩИЕ С ДАННЫМИ
# note: ИСПОЛНИТЕЛЬНЫЕ НОДЫ

# group: ПРОВЕРОЧНЫЕ НОДЫ
# note: ПРОВЕРОЧНЫЕ НОДЫ

# group: ПЕРЕДАЁМ ИНФОРМАЦИЮ В РЕВИТ
# note: ПЕРЕДАЁМ ИНФОРМАЦИЮ В РЕВИТ

# group: УПРАВЛЯЮЩИЕ НОДЫ
# note: ПЕРЕМЕННЫЕ ЗНАЧЕНИЯ

# group: ПРИМЕЧАНИЯ ПО ЦВЕТОВОЙ ГРУППИРОВКЕ
# note: GUIDELINES

# group: ПОЛУЧАЕМ ДАННЫЕ ИЗ РЕВИТ
# note: ПОЛУЧАЕМ ДАННЫЕ ИЗ РЕВИТ

# group: ЭЛЕМЕНТЫ В ВАШЕЙ МОДЕЛИ ИЛИ В СВЯЗАННОМ ФАЙЛЕ
категория_1 = Categories("SecurityDevices")
элементы_из_связанного_файла_1 = BoolSelector(false)
часть_имени_связанного_файла_1 = StringInput("ОВ")

python_script = Python(IN[0]=элементы_из_связанного_файла_1, IN[1]=часть_имени_связанного_файла_1)
# ---------- python_script.python (41 lines) ----------
# Подгрузка библиотек
import clr
clr.AddReference('ProtoGeometry')
from Autodesk.DesignScript.Geometry import *

clr.AddReference('RevitAPI')
import Autodesk
from Autodesk.Revit.DB import *

clr.AddReference('RevitServices')
import RevitServices
from RevitServices.Persistence import DocumentManager
from RevitServices.Transactions import TransactionManager

import math

# Получение текущего проекта
doc = DocumentManager.Instance.CurrentDBDocument

# Получение списка связанных файлов

linkInstances = FilteredElementCollector(doc).OfClass(Autodesk.Revit.DB.RevitLinkInstance)

isLink = IN[0] # Определение того, в связанном ли файле находятся сети
nameLink = IN[1] # Часть имени файла с сетями для корректного определения
linkInst = "текущий документ"

# Фильтрация связанных файлов
if isLink:
	a = 0
	for inst in linkInstances:
		if nameLink in inst.Name:
			linkDoc = inst.GetLinkDocument()
			linkInst = inst
			a = 1
	if a == 0:
		linkDoc = doc
else:
	linkDoc = doc
	
OUT = ([linkDoc, linkInst])
# ----------------------------------------
# note: ПОЛУЧАЕМ ЭЛЕМЕНТЫ
code_block = CodeBlock(Doc=python_script, Inst=python_script) { Doc[0]; Inst[1]; }
python_script_2 = Python(IN[0]=категория_1, IN[1]=code_block.out0, IN[2]=code_block.out1)
# ---------- python_script_2.python (45 lines) ----------
#python nodes in dynamo 1.0
#proposed by Julien Benoit @jbenoit44 
#http://aecuandme.wordpress.com/
import System
import clr
clr.AddReference('ProtoGeometry')
from Autodesk.DesignScript.Geometry import *
# Import ToDSType(bool) extension method
clr.AddReference("RevitNodes")
import Revit
clr.ImportExtensions(Revit.Elements)
# Import geometry conversion extension methods
clr.ImportExtensions(Revit.GeometryConversion)
# Import DocumentManager and TransactionManager
clr.AddReference("RevitServices")
import RevitServices
from RevitServices.Persistence import DocumentManager
from RevitServices.Transactions import TransactionManager
from System.Collections.Generic import *
# Import RevitAPI
clr.AddReference("RevitAPI")
import Autodesk
from Autodesk.Revit.DB import *

doc = DocumentManager.Instance.CurrentDBDocument
uiapp = DocumentManager.Instance.CurrentUIApplication
app = uiapp.Application
uidoc=DocumentManager.Instance.CurrentUIApplication.ActiveUIDocument

cat = IN[0]
LinkDoc=IN[1]
LinkInst = IN[2]

BuiltIn = System.Enum.ToObject(BuiltInCategory, cat.Id)

elementlist = []
typelist=[]
T = []

collector = FilteredElementCollector(LinkDoc)
filter = ElementCategoryFilter(BuiltIn)
list=collector.WherePasses(filter).WhereElementIsNotElementType().ToElements()


OUT = list
# ----------------------------------------

# group: Цвета для переопределения
uniqueItems = List.UniqueItems(python_script_2)
code_block_2 = CodeBlock { 255; 255; }
byARGB = Color.ByARGB(a=code_block_2.out0, r=code_block_2.out1, g=code_block_2.out1, b=code_block_2.out1)

# group: ЭЛЕМЕНТ В МОДЕЛИ ИМЕЮЩИЙ ПЕРЕСЕЧЕНИЕ
overrideColorInView = Element.OverrideColorInView(element=uniqueItems, color=byARGB)

code_block_3 = CodeBlock { 1; }
greyscaleByNormalizedValue = Custom[Color.GreyscaleByNormalizedValue](dbl=code_block_3)  # Creates a greyscale color based on a normalized value (0 = black, 1 = white)
