# Dynamo graph Копировать лист с легендами.dyn (Dynamo 1.3.2.2480)

sheets = Sheets("9.3.3 : Заземление. Оси АА-ББ, 9/1-9/13")
boolean = BoolSelector(true)
boolean_2 = BoolSelector(true)
forceChildrensEval = ForceChildrensEval(boolean_2)
code_block = CodeBlock { 1; }
string = StringInput("1")
duplicate = Revit.Sheet.Duplicate(sheets, boolean, forceChildrensEval, code_block, string)
watch = Watch(duplicate.out0)
watch_2 = Watch(duplicate.out1)
