# Dynamo graph Создать листы с видами.dyn (Dynamo 1.2.1.3083)

forceChildrensEval = ForceChildrensEval()  # unwired: arg0
views = Views("К8 02 Этаж - Левая часть")
create = List.Create(views)
views_2 = Views("Примечание. ЭМ")
views_3 = Views("УГО. ЭМ")
string = StringInput("План")
code_block = CodeBlock { 207; }
add = string + code_block
code_block_2 = CodeBlock { "L"; }
add_2 = code_block_2 + code_block
family_types = FamilyTypes("СиМ Рамка ЭОМ:МЕГА")
byNameNumberTitleBlockAndViews = Sheet.ByNameNumberTitleBlockAndViews(add, add_2, family_types)  # unwired: arg3
watch = Watch(byNameNumberTitleBlockAndViews)
string_2 = StringInput("СиМ Корпус")
string_3 = StringInput("Корпус 8")
setParameterByName = Element.SetParameterByName(element=watch, parameterName=string_2, value=string_3)
