# Dynamo graph Проименовать огнезадерживающие клапаны.dyn (Dynamo 1.3.0.875)

# group: Импорт комнат из связного файла
get_documents = Custom[Get Documents]()  # Queries all linked Revit files and retrieves their Name, LinkInstance and Document properties.
categories = Categories("Rooms")
getFromLinkedFile = Custom[Element.GetFromLinkedFile](Link_Instance=get_documents.Link_Instance, Link_Document=get_documents.Link_Doc, Category=categories)  # Get elements from link document instance based on category
clear_list = Custom[Clear List](Input=getFromLinkedFile)  # This node will remove all Null and Empty Lists from any list.
code_block = CodeBlock { "Назначение"; }
getParameterValueByName = Element.GetParameterValueByName(element=getFromLinkedFile, parameterName=code_block)
code_block_2 = CodeBlock { "Квартира"; }
contains = String.Contains(str=getParameterValueByName, searchFor=code_block_2)
filterByBoolMask = List.FilterByBoolMask(list=clear_list, mask=contains)
watch = Watch(filterByBoolMask.in)

# group: Выбор клапанов в проекте
family_types = FamilyTypes("Клапан огнезадерживающий:Клапан огнезадерживающий")
byFamilyType = FamilyInstance.ByFamilyType(family_types)

# group: смещение клапанов вниз под помещения АР
code_block_3 = CodeBlock { "Смещение по высоте"; 2000; }
setParameterByName = Element.SetParameterByName(element=byFamilyType, parameterName=code_block_3.out0, value=code_block_3.out1)

# group: Расчет включений элементтов
code_block_4 = CodeBlock(Element=watch) { Element; }
code_block_5 = CodeBlock(item=code_block_4) { Flatten({item}); }
code_block_6 = CodeBlock(ElementCheck=setParameterByName) { ElementCheck; }
code_block_7 = CodeBlock(item=code_block_6) { Flatten({item}); }
code_block_8 = CodeBlock { 0.5; }
code_block_9 = CodeBlock(Tolerance=code_block_8) { Tolerance; }
forceChildrensEval = ForceChildrensEval()  # unwired: arg0
python_script = Python(IN[0]=code_block_5, IN[1]=code_block_7, IN[2]=code_block_9, IN[3]=forceChildrensEval)
# ---------- python_script.python (64 lines) ----------
#python nodes in dynamo 1.0
#proposed by Julien Benoit @jbenoit44 
#http://aecuandme.wordpress.com/
import clr
clr.AddReference('ProtoGeometry')
from Autodesk.DesignScript.Geometry import *
# Import ToDSType(bool) extension method
clr.AddReference("RevitNodes")
import Revit
clr.ImportExtensions(Revit.Elements)
# Import geometry conversion extension methods
clr.ImportExtensions(Revit.GeometryConversion)
# Import DocumentManager and TransactionManager
clr.AddReference("RevitServices")
import RevitServices
from RevitServices.Persistence import DocumentManager
from RevitServices.Transactions import TransactionManager
from System.Collections.Generic import *
# Import RevitAPI
clr.AddReference("RevitAPI")
import Autodesk
from Autodesk.Revit.DB import *
import itertools
import operator

doc = DocumentManager.Instance.CurrentDBDocument
uiapp = DocumentManager.Instance.CurrentUIApplication
app = uiapp.Application
uidoc=DocumentManager.Instance.CurrentUIApplication.ActiveUIDocument
activeV=doc.ActiveView

host = []
finst=[]
finstID=[]
for i in IN[0]:
	host.append(UnwrapElement(i))
for i in IN[1]:
	finst.append(UnwrapElement(i))
for i in IN[1]:
	finstID.append(UnwrapElement(i).Id)	


superset=[]
hloop=[]


for h in host:
	try:
		collection = List[ElementId](finstID)
		collector=FilteredElementCollector(doc,collection)
		a=h.BoundingBox[activeV]
		c=Outline (a.Min,a.Max)
		d=BoundingBoxIntersectsFilter(c,float(IN[2]))
		e=collector.WherePasses(d).ToElements()
		setlist=[]
		hostlist=[]
		hostlist.append(h)
		setlist.append(e)
		all_lists = [hostlist,setlist]
		c=reduce(operator.add, all_lists)
		superset.append(c)
	except:
		c = 0	
OUT=superset
# ----------------------------------------
flatten = Flatten()  # unwired: arg0
map = List.Map(list=python_script, f_x=flatten)
count = List.Count()  # unwired: arg0
map_2 = List.Map(list=map, f_x=count)
code_block_10 = CodeBlock { 1; }
gt = map_2 > code_block_10
filterByBoolMask_2 = List.FilterByBoolMask(list=map, mask=gt)
transpose = List.Transpose(filterByBoolMask_2.in)

# group: Чек маркировать/не маркировать
code_block_11 = CodeBlock(x=transpose) { x[1]; }
string = StringInput("Маркировать")
getParameterValueByName_2 = Element.GetParameterValueByName(element=code_block_11, parameterName=string)
code_block_12 = CodeBlock { 1; }
eq = getParameterValueByName_2 == code_block_12
code_block_13 = CodeBlock(x=transpose) { x[0]; }

# group: Маркировка
filterByBoolMask_3 = List.FilterByBoolMask(list=code_block_11, mask=eq)
string_2 = StringInput("Наименование")
code_block_14 = CodeBlock { "К."; }
filterByBoolMask_4 = List.FilterByBoolMask(list=code_block_13, mask=eq)
code_block_15 = CodeBlock { "Номер секции"; }
getParameterValueByName_3 = Element.GetParameterValueByName(element=filterByBoolMask_4.in, parameterName=code_block_15)
string_3 = StringInput("С")
split = String.Split(getParameterValueByName_3, string_3)
transpose_2 = List.Transpose(split)
code_block_16 = CodeBlock { "."; }
code_block_17 = CodeBlock { "Уровень"; }
getParameterValueByName_4 = Element.GetParameterValueByName(element=filterByBoolMask_3.in, parameterName=code_block_17)
name = Level.Name(getParameterValueByName_4)
string_4 = StringInput(" ")
split_2 = String.Split(name, string_4)
transpose_3 = List.Transpose(split_2)
code_block_18 = CodeBlock { "Номер функции"; }
getParameterValueByName_5 = Element.GetParameterValueByName(element=filterByBoolMask_4.in, parameterName=code_block_18)
string_5 = StringInput("Кв")
split_3 = String.Split(getParameterValueByName_5, string_5)
transpose_4 = List.Transpose(split_3)
code_block_19 = CodeBlock(a=code_block_14, e=transpose_2, c=code_block_16, b=transpose_3, d=transpose_4) { OUT=a+e[0]+c+b[1]+c+d[0]; }
setParameterByName_2 = Element.SetParameterByName(element=filterByBoolMask_3.in, parameterName=string_2, value=code_block_19)

# group: смещение клапанов обратно
code_block_20 = CodeBlock { "Смещение по высоте"; 2750; }
setParameterByName_3 = Element.SetParameterByName(element=setParameterByName_2, parameterName=code_block_20.out0, value=code_block_20.out1)

внимание = StringInput("Если высота осталась 2000, значит, что клапан НЕ попадает в помещение!! Или помещения не размечены")
