# Dynamo graph Прописать высоту установки.dyn (Dynamo 1.2.1.3083)

categories = Categories("ElectricalFixtures")
forceChildrensEval = ForceChildrensEval()  # unwired: arg0
activeView = Custom[Springs.Doc.ActiveView](refresh=forceChildrensEval)  # Selects the current document's active view. Supports more view types than the built-in option. Will be depreciated once the bult in node works with all plan types.
byCategoryAndView = Archilab.Grimshaw.Selection.Select.ByCategoryAndView(categories, activeView)
create = List.Create(byCategoryAndView)
flatten = Flatten(create)
string = StringInput("Высота установки")
getLocation = Element.GetLocation(flatten)
Z = Point.Z(getLocation)
levels = Levels("К8 -1 Этаж")
elevation = Level.Elevation(levels)
watch = Watch(elevation)
code_block = CodeBlock(a=Z, b=watch) { (a-b-c)/1000; c=0; }  # unwired: c
format = Python(IN[0]=code_block.out0)
# ---------- format.python (15 lines) ----------
import clr
clr.AddReference('ProtoGeometry')
from Autodesk.DesignScript.Geometry import *
#Введенные в этом узле данные сохраняется в виде списка в переменных IN.
list_in = IN[0]
list_out = []

for i in range(len(list_in)):
	k = round(list_in[i],1)
	str  = '{:.1f}'.format(k)
	list_out.append(str)
	

#Назначьте вывод переменной OUT.
OUT = list_out
# ----------------------------------------
watch_2 = Watch(format)
setparameterbyname_with_catch = Python(IN[0]=flatten, IN[1]=string, IN[2]=watch_2, IN[3]=levels)  # "SetParameterByName with catch exception"
# ---------- setparameterbyname_with_catch.python (21 lines) ----------
import clr
clr.AddReference('ProtoGeometry')
from Autodesk.DesignScript.Geometry import *
import clr
clr.AddReference('RevitNodes')
import Revit
#Введенные в этом узле данные сохраняется в виде списка в переменных IN.
elements = IN[0]
paramName = IN[1]
paramVal = IN[2]

for i in range(len(elements)):
	try:
		elements[i].SetParameterByName(paramName,paramVal[i])
	except:
		paramName = paramName
	


#Назначьте вывод переменной OUT.
OUT = elements
# ----------------------------------------
watch_3 = Watch(setparameterbyname_with_catch)
categories_2 = Categories("LightingDevices")
byCategoryAndView_2 = Archilab.Grimshaw.Selection.Select.ByCategoryAndView(categories_2, activeView)
categories_3 = Categories("LightingFixtures")
byCategoryAndView_3 = Archilab.Grimshaw.Selection.Select.ByCategoryAndView(categories_3, activeView)
categories_4 = Categories("DataDevices")
byCategoryAndView_4 = Archilab.Grimshaw.Selection.Select.ByCategoryAndView(categories_4, activeView)
