# Dynamo graph Прописать количество светильников в помещении.dyn (Dynamo 1.2.1.3083)

categories = Categories("LightingFixtures")
all_family_types_of_category = Custom[All Family Types Of Category](category=categories)  # Gets all family types/symbols of a given category in the model (does *not *work for system families)
all_elements_of_family_type = ElementsOfFamilyType(all_family_types_of_category)
flatten = Flatten(all_elements_of_family_type)
forceChildrensEval = ForceChildrensEval()  # unwired: arg0
activeView = Custom[Springs.Doc.ActiveView](refresh=forceChildrensEval)  # Selects the current document's active view. Supports more view types than the built-in option. Will be depreciated once the bult in node works with all plan types.
byCategoryAndView = Archilab.Grimshaw.Selection.Select.ByCategoryAndView(categories, activeView)
watch = Watch(byCategoryAndView)
flatten_2 = Flatten(watch)
watch_2 = Watch(flatten_2)
get_documents = Custom[Get Documents]()  # Queries all linked Revit files and retrieves their Name, LinkInstance and Document properties.
categories_2 = Categories("Rooms")
getFromLinkedFile = Custom[Element.GetFromLinkedFile](Link_Instance=get_documents.Link_Instance, Link_Document=get_documents.Link_Doc, Category=categories_2)  # Get elements from link document instance based on category
elements_in_room = Custom[Elements in Room](Elements=watch_2, Rooms=getFromLinkedFile)  # This node will check if any of the elements are inside any of the supplied rooms.
boolean = BoolSelector(false)
clean = List.Clean(list=elements_in_room, preserveIndices=boolean)
watch_3 = Watch(clean)
string = StringInput("Количество в помещении")
lf_amount_in_room = Python(IN[0]=watch_3, IN[1]=string, IN[2]=forceChildrensEval)
# ---------- lf_amount_in_room.python (33 lines) ----------
import clr
clr.AddReference('ProtoGeometry')
from Autodesk.DesignScript.Geometry import *
clr.AddReference('RevitNodes')
import Revit
#Введенные в этом узле данные сохраняется в виде списка в переменных IN.
list1 = IN[0]
param = IN[1]
list2 = []
list3 = []

k = len(IN)

for i in range(len(list1)):
	if len(list1[i])<>0:
		list3 = list1[i]
		l=len(list3)
		for k in range(len(list3)):
			num=0
			for n in range(len(list3)):
				if list3[k].Name == list3[n].Name :
					num = num+1		
			try:
				list3[k].SetParameterByName(param,num)
			except:
				num = num
		
		
		list2.append(len(list1[i]))
		

#Назначьте вывод переменной OUT.
OUT = list2
# ----------------------------------------
watch_4 = Watch(lf_amount_in_room)
current = Document.Current()
activeView_2 = Document.ActiveView(current)
watch_5 = Watch(elements_in_room)
