# Dynamo graph Проименовать_щиты_механизации.dyn (Dynamo 1.3.0.875)

# group: Вводной блок
get_documents = Custom[Get Documents]()  # Queries all linked Revit files and retrieves their Name, LinkInstance and Document properties.
code_block = CodeBlock(x=get_documents.Link_Instance, y=get_documents.Link_Doc) { x[0]; y[0]; }
categories = Categories("Rooms")
getFromLinkedFile = Custom[Element.GetFromLinkedFile](Link_Instance=code_block.out0, Link_Document=code_block.out1, Category=categories)  # Get elements from link document instance based on category
clear_list = Custom[Clear List](Input=getFromLinkedFile)  # This node will remove all Null and Empty Lists from any list.
code_block_2 = CodeBlock { "Назначение"; }
getParameterValueByName = Element.GetParameterValueByName(element=getFromLinkedFile, parameterName=code_block_2)
code_block_3 = CodeBlock { "Квартира"; }
contains = String.Contains(str=getParameterValueByName, searchFor=code_block_3)
code_block_4 = CodeBlock { "Уровень"; }
getParameterValueByName_2 = Element.GetParameterValueByName(element=getFromLinkedFile, parameterName=code_block_4)
code_block_5 = CodeBlock { ""; }
ne = getParameterValueByName_2 != code_block_5
and_ = contains && ne
filterByBoolMask = List.FilterByBoolMask(list=clear_list, mask=and_)
watch = Watch(filterByBoolMask.in)
family_types = FamilyTypes("Щит механизации:Щит механизации")
byFamilyType = FamilyInstance.ByFamilyType(family_types)

# group: Выбор элементов на активном виде (для переименования ВСЕХ элементов в файле обойти)
all_elements_in_active_view = ElementsInView()
name = Element.Name(byFamilyType)
filterByName = Custom[Elements.FilterByName](elements=all_elements_in_active_view, searchString=name)  # Retrieves those elements from a collection whose names match the search string
transpose = List.Transpose(filterByName.in@L1)
clear_list_2 = Custom[Clear List](Input=transpose)

# group: Расчет включений элементов в пространства
code_block_6 = CodeBlock(Element=watch) { Element; }
code_block_7 = CodeBlock(item=code_block_6) { Flatten({item}); }
code_block_8 = CodeBlock(ElementCheck=clear_list_2) { ElementCheck; }
code_block_9 = CodeBlock(item=code_block_8) { Flatten({item}); }
code_block_10 = CodeBlock { 0.1; }
code_block_11 = CodeBlock(Tolerance=code_block_10) { Tolerance; }
forceChildrensEval = ForceChildrensEval()  # unwired: arg0
python_script = Python(IN[0]=code_block_7, IN[1]=code_block_9, IN[2]=code_block_11, IN[3]=forceChildrensEval)
# ---------- python_script.python (64 lines) ----------
#python nodes in dynamo 1.0
#proposed by Julien Benoit @jbenoit44 
#http://aecuandme.wordpress.com/
import clr
clr.AddReference('ProtoGeometry')
from Autodesk.DesignScript.Geometry import *
# Import ToDSType(bool) extension method
clr.AddReference("RevitNodes")
import Revit
clr.ImportExtensions(Revit.Elements)
# Import geometry conversion extension methods
clr.ImportExtensions(Revit.GeometryConversion)
# Import DocumentManager and TransactionManager
clr.AddReference("RevitServices")
import RevitServices
from RevitServices.Persistence import DocumentManager
from RevitServices.Transactions import TransactionManager
from System.Collections.Generic import *
# Import RevitAPI
clr.AddReference("RevitAPI")
import Autodesk
from Autodesk.Revit.DB import *
import itertools
import operator

doc = DocumentManager.Instance.CurrentDBDocument
uiapp = DocumentManager.Instance.CurrentUIApplication
app = uiapp.Application
uidoc=DocumentManager.Instance.CurrentUIApplication.ActiveUIDocument
activeV=doc.ActiveView

host = []
finst=[]
finstID=[]
for i in IN[0]:
	host.append(UnwrapElement(i))
for i in IN[1]:
	finst.append(UnwrapElement(i))
for i in IN[1]:
	finstID.append(UnwrapElement(i).Id)	


superset=[]
hloop=[]


for h in host:
	try:
		collection = List[ElementId](finstID)
		collector=FilteredElementCollector(doc,collection)
		a=h.BoundingBox[activeV]
		c=Outline (a.Min,a.Max)
		d=BoundingBoxIntersectsFilter(c,float(IN[2]))
		e=collector.WherePasses(d).ToElements()
		setlist=[]
		hostlist=[]
		hostlist.append(h)
		setlist.append(e)
		all_lists = [hostlist,setlist]
		c=reduce(operator.add, all_lists)
		superset.append(c)
	except:
		c = 0	
OUT=superset
# ----------------------------------------
flatten = Flatten()  # unwired: arg0
map = List.Map(list=python_script, f_x=flatten)
count = List.Count()  # unwired: arg0
map_2 = List.Map(list=map, f_x=count)
code_block_12 = CodeBlock { 1; }
gt = map_2 > code_block_12
filterByBoolMask_2 = List.FilterByBoolMask(list=map, mask=gt)

# group: Фильтр дубликатов комнат
transpose_2 = List.Transpose(filterByBoolMask_2.in)
code_block_13 = CodeBlock(x=transpose_2) { x[1]; }
id = Element.Id(code_block_13)
string_from_object = FromObject(id)
sortDuplicateStrings = Lists.Strings.SortDuplicateStrings(string_from_object)
code_block_14 = CodeBlock { 0; }
getItemAtIndex = List.GetItemAtIndex(list=sortDuplicateStrings.out1@L1, index=code_block_14)
индекс_индексов = Python(IN[0]=sortDuplicateStrings.out1)
# ---------- индекс_индексов.python (16 lines) ----------
import clr
clr.AddReference('ProtoGeometry')
from Autodesk.DesignScript.Geometry import *
#Введенные в этом узле данные сохраняется в виде списка в переменных IN.
dataEnteringNode = IN
List=IN[0]
List1=[]
k=0
i=0
for i in List:	
	List2=[]
	for k in i:
		k=i.index(k)+1
		List2.append(k)
	List1.append(List2)
OUT=List1
# ----------------------------------------
getItemAtIndex_2 = List.GetItemAtIndex(list=индекс_индексов@L1, index=code_block_14)
replaceItemAtIndex = Custom[List.ReplaceItemAtIndex+](seq=string_from_object, index=getItemAtIndex, replacement=getItemAtIndex_2)  # Replaces the item at a given index (or list of indices) of a list by another item
code_block_15 = CodeBlock { 1; }
eq = replaceItemAtIndex == code_block_15
filterByBoolMask_3 = List.FilterByBoolMask(list=code_block_13, mask=eq)
code_block_16 = CodeBlock(x=transpose_2) { x[0]; }
filterByBoolMask_4 = List.FilterByBoolMask(list=code_block_16, mask=eq)

# group: Переименование щитов квартир (имя панели, питающий щит, номер группы)
string = StringInput("Номер группы")
code_block_17 = CodeBlock { "ЩЭ."; "ЩМ."; "."; }
code_block_18 = CodeBlock { "Номер секции"; }
getParameterValueByName_3 = Element.GetParameterValueByName(element=filterByBoolMask_4.in, parameterName=code_block_18)
фильтрация_букв = Python(IN[0]=getParameterValueByName_3)
# ---------- фильтрация_букв.python (13 lines) ----------
import clr
import re
clr.AddReference('ProtoGeometry')
from Autodesk.DesignScript.Geometry import *
#Введенные в этом узле данные сохраняется в виде списка в переменных IN.
regex=IN[0]
list=[]
for i in regex:
	k=re.sub("[^0-9]", "", i)

	list.append(k)
OUT=list
#Out: 'abdE'
# ----------------------------------------
code_block_19 = CodeBlock { "Уровень"; }
getParameterValueByName_4 = Element.GetParameterValueByName(element=filterByBoolMask_3.in, parameterName=code_block_19)
name_2 = Level.Name(getParameterValueByName_4)
string_2 = StringInput(" ")
split = String.Split(name_2, string_2)
transpose_3 = List.Transpose(split)
code_block_20 = CodeBlock { "Номер функции"; }
getParameterValueByName_5 = Element.GetParameterValueByName(element=filterByBoolMask_4.in, parameterName=code_block_20)
фильтрация_букв_2 = Python(IN[0]=getParameterValueByName_5)  # same code as фильтрация_букв
code_block_21 = CodeBlock(a=code_block_17.out0, e=фильтрация_букв, c=code_block_17.out2, b=transpose_3, a1=code_block_17.out1, d=фильтрация_букв_2) { OUT1=a+e+c+b[1]; OUT2=a1+e+c+b[1]+c+d; }
toNumber = String.ToNumber(фильтрация_букв_2)
sortDuplicateStrings_2 = Lists.Strings.SortDuplicateStrings(code_block_21.OUT1)
getItemAtIndex_3 = List.GetItemAtIndex(list=toNumber, index=sortDuplicateStrings_2.out1)
sortIndexByValue = SortIndexByValue(getItemAtIndex_3)
getItemAtIndex_4 = List.GetItemAtIndex(list=getItemAtIndex_3@L2, index=sortIndexByValue@L2)
indexOf = IndexOf(toNumber, getItemAtIndex_4@L1)
индекс_индексов_2 = Python(IN[0]=sortDuplicateStrings_2.out1)
# ---------- индекс_индексов_2.python (14 lines) ----------
import clr
clr.AddReference('ProtoGeometry')
from Autodesk.DesignScript.Geometry import *
#Введенные в этом узле данные сохраняется в виде списка в переменных IN.
dataEnteringNode = IN
List=IN[0]
List1=[]
for i in List:	
	List2=[]
	for k in i:
		k=i.index(k)+1
		List2.append(k)
	List1.append(List2)
OUT=List1
# ----------------------------------------
code_block_22 = CodeBlock { 0; }
getItemAtIndex_5 = List.GetItemAtIndex(list=индекс_индексов_2@L1, index=code_block_22)
replaceItemAtIndex_2 = Custom[List.ReplaceItemAtIndex+](seq=code_block_21.OUT1, index=indexOf, replacement=getItemAtIndex_5)
setParameterByName = Element.SetParameterByName(element=filterByBoolMask_3.in, parameterName=string, value=replaceItemAtIndex_2)
string_3 = StringInput("Питающий щит")
setParameterByName_2 = Element.SetParameterByName(element=filterByBoolMask_3.in, parameterName=string_3, value=code_block_21.OUT1)
string_4 = StringInput("Имя панели")
setParameterByName_3 = Element.SetParameterByName(element=filterByBoolMask_3.in, parameterName=string_4, value=code_block_21.OUT2)
