# Dynamo graph Маркировка этажных щитов.dyn (Dynamo 1.3.0.875)

get_documents = Custom[Get Documents]()  # Queries all linked Revit files and retrieves their Name, LinkInstance and Document properties.
code_block = CodeBlock(x=get_documents.Link_Instance, y=get_documents.Link_Doc) { x[0]; y[0]; }
categories = Categories("Rooms")
getFromLinkedFile = Custom[Element.GetFromLinkedFile](Link_Instance=code_block.out0, Link_Document=code_block.out1, Category=categories)  # Get elements from link document instance based on category
clear_list = Custom[Clear List](Input=getFromLinkedFile)  # This node will remove all Null and Empty Lists from any list.
code_block_2 = CodeBlock { "Назначение"; }
getParameterValueByName = Element.GetParameterValueByName(element=getFromLinkedFile, parameterName=code_block_2)
code_block_3 = CodeBlock { "Квартира"; }
contains = String.Contains(str=getParameterValueByName, searchFor=code_block_3)
code_block_4 = CodeBlock { "Уровень"; }
getParameterValueByName_2 = Element.GetParameterValueByName(element=getFromLinkedFile, parameterName=code_block_4)
code_block_5 = CodeBlock { ""; }
ne = getParameterValueByName_2 != code_block_5
and_ = contains && ne
filterByBoolMask = List.FilterByBoolMask(list=clear_list, mask=and_)
watch = Watch(filterByBoolMask.in)
code_block_6 = CodeBlock(Element=watch) { Element; }
code_block_7 = CodeBlock(item=code_block_6) { Flatten({item}); }
all_elements_in_active_view = ElementsInView()
family_types = FamilyTypes("УЭРМ:1 квартира")
byFamilyType = FamilyInstance.ByFamilyType(family_types)
name = Element.Name(byFamilyType)
filterByName = Custom[Elements.FilterByName](elements=all_elements_in_active_view, searchString=name)  # Retrieves those elements from a collection whose names match the search string
family_types_2 = FamilyTypes("УЭРМ:2 квартиры")
byFamilyType_2 = FamilyInstance.ByFamilyType(family_types_2)
name_2 = Element.Name(byFamilyType_2)
filterByName_2 = Custom[Elements.FilterByName](elements=all_elements_in_active_view, searchString=name_2)
family_types_3 = FamilyTypes("УЭРМ:3 квартиры")
byFamilyType_3 = FamilyInstance.ByFamilyType(family_types_3)
name_3 = Element.Name(byFamilyType_3)
filterByName_3 = Custom[Elements.FilterByName](elements=all_elements_in_active_view, searchString=name_3)
family_types_4 = FamilyTypes("УЭРМ:4 квартиры")
byFamilyType_4 = FamilyInstance.ByFamilyType(family_types_4)
name_4 = Element.Name(byFamilyType_4)
filterByName_4 = Custom[Elements.FilterByName](elements=all_elements_in_active_view, searchString=name_4)
family_types_5 = FamilyTypes("УЭРМ:5 квартир")
byFamilyType_5 = FamilyInstance.ByFamilyType(family_types_5)
name_5 = Element.Name(byFamilyType_5)
filterByName_5 = Custom[Elements.FilterByName](elements=all_elements_in_active_view, searchString=name_5)
family_types_6 = FamilyTypes("УЭРМ:6 квартир")
byFamilyType_6 = FamilyInstance.ByFamilyType(family_types_6)
name_6 = Element.Name(byFamilyType_6)
filterByName_6 = Custom[Elements.FilterByName](elements=all_elements_in_active_view, searchString=name_6)
create = List.Create(filterByName.in, filterByName_2.in, filterByName_3.in, filterByName_4.in, filterByName_5.in, filterByName_6.in)
flatten = Flatten(create)
removeNulls = Lists.Manage.RemoveNulls(flatten)
uniqueItems = List.UniqueItems(removeNulls)
code_block_8 = CodeBlock(ElementCheck=uniqueItems) { ElementCheck; }
code_block_9 = CodeBlock(item=code_block_8) { Flatten({item}); }
code_block_10 = CodeBlock { 0.1; }
code_block_11 = CodeBlock(Tolerance=code_block_10) { Tolerance; }
forceChildrensEval = ForceChildrensEval()  # unwired: arg0
python_script = Python(IN[0]=code_block_7, IN[1]=code_block_9, IN[2]=code_block_11, IN[3]=forceChildrensEval)
# ---------- python_script.python (64 lines) ----------
#python nodes in dynamo 1.0
#proposed by Julien Benoit @jbenoit44 
#http://aecuandme.wordpress.com/
import clr
clr.AddReference('ProtoGeometry')
from Autodesk.DesignScript.Geometry import *
# Import ToDSType(bool) extension method
clr.AddReference("RevitNodes")
import Revit
clr.ImportExtensions(Revit.Elements)
# Import geometry conversion extension methods
clr.ImportExtensions(Revit.GeometryConversion)
# Import DocumentManager and TransactionManager
clr.AddReference("RevitServices")
import RevitServices
from RevitServices.Persistence import DocumentManager
from RevitServices.Transactions import TransactionManager
from System.Collections.Generic import *
# Import RevitAPI
clr.AddReference("RevitAPI")
import Autodesk
from Autodesk.Revit.DB import *
import itertools
import operator

doc = DocumentManager.Instance.CurrentDBDocument
uiapp = DocumentManager.Instance.CurrentUIApplication
app = uiapp.Application
uidoc=DocumentManager.Instance.CurrentUIApplication.ActiveUIDocument
activeV=doc.ActiveView

host = []
finst=[]
finstID=[]
for i in IN[0]:
	host.append(UnwrapElement(i))
for i in IN[1]:
	finst.append(UnwrapElement(i))
for i in IN[1]:
	finstID.append(UnwrapElement(i).Id)	


superset=[]
hloop=[]


for h in host:
	try:
		collection = List[ElementId](finstID)
		collector=FilteredElementCollector(doc,collection)
		a=h.BoundingBox[activeV]
		c=Outline (a.Min,a.Max)
		d=BoundingBoxIntersectsFilter(c,float(IN[2]))
		e=collector.WherePasses(d).ToElements()
		setlist=[]
		hostlist=[]
		hostlist.append(h)
		setlist.append(e)
		all_lists = [hostlist,setlist]
		c=reduce(operator.add, all_lists)
		superset.append(c)
	except:
		c = 0	
OUT=superset
# ----------------------------------------
flatten_2 = Flatten()  # unwired: arg0
map = List.Map(list=python_script, f_x=flatten_2)
count = List.Count()  # unwired: arg0
map_2 = List.Map(list=map, f_x=count)
code_block_12 = CodeBlock { 1; }
gt = map_2 > code_block_12
filterByBoolMask_2 = List.FilterByBoolMask(list=map, mask=gt)

# group: Переименование щитов квартир (имя панели, питающий щит, номер группы)
code_block_13 = CodeBlock { "ЩЭ."; "ЩМ."; "."; }
code_block_14 = CodeBlock { "Номер секции"; }
getParameterValueByName_3 = Element.GetParameterValueByName(parameterName=code_block_14)  # unwired: element
фильтрация_букв = Python(IN[0]=getParameterValueByName_3)
# ---------- фильтрация_букв.python (13 lines) ----------
import clr
import re
clr.AddReference('ProtoGeometry')
from Autodesk.DesignScript.Geometry import *
#Введенные в этом узле данные сохраняется в виде списка в переменных IN.
regex=IN[0]
list=[]
for i in regex:
	k=re.sub("[^0-9]", "", i)

	list.append(k)
OUT=list
#Out: 'abdE'
# ----------------------------------------
code_block_15 = CodeBlock { "Уровень"; }
getParameterValueByName_4 = Element.GetParameterValueByName(parameterName=code_block_15)  # unwired: element
name_7 = Level.Name(getParameterValueByName_4)
string = StringInput(" ")
split = String.Split(name_7, string)
transpose = List.Transpose(split)
code_block_16 = CodeBlock { "Номер функции"; }
getParameterValueByName_5 = Element.GetParameterValueByName(parameterName=code_block_16)  # unwired: element
фильтрация_букв_2 = Python(IN[0]=getParameterValueByName_5)  # same code as фильтрация_букв
code_block_17 = CodeBlock(a=code_block_13.out0, e=фильтрация_букв, c=code_block_13.out2, b=transpose, a1=code_block_13.out1, d=фильтрация_букв_2) { OUT1=a+e+c+b[1]; OUT2=a1+e+c+b[1]+c+d; }
sortDuplicateStrings = Lists.Strings.SortDuplicateStrings(code_block_17.OUT1)
string_2 = StringInput("Номер группы")
toNumber = String.ToNumber(фильтрация_букв_2)
getItemAtIndex = List.GetItemAtIndex(list=toNumber)  # unwired: index
sortIndexByValue = SortIndexByValue(getItemAtIndex)
getItemAtIndex_2 = List.GetItemAtIndex(list=getItemAtIndex@L2, index=sortIndexByValue@L2)
indexOf = IndexOf(toNumber, getItemAtIndex_2@L1)
индекс_индексов = Python()  # unwired: IN[0]
# ---------- индекс_индексов.python (14 lines) ----------
import clr
clr.AddReference('ProtoGeometry')
from Autodesk.DesignScript.Geometry import *
#Введенные в этом узле данные сохраняется в виде списка в переменных IN.
dataEnteringNode = IN
List=IN[0]
List1=[]
for i in List:	
	List2=[]
	for k in i:
		k=i.index(k)+1
		List2.append(k)
	List1.append(List2)
OUT=List1
# ----------------------------------------
code_block_18 = CodeBlock { 0; }
getItemAtIndex_3 = List.GetItemAtIndex(list=индекс_индексов@L1, index=code_block_18)
replaceItemAtIndex = Custom[List.ReplaceItemAtIndex+](seq=code_block_17.OUT1, index=indexOf, replacement=getItemAtIndex_3)  # Replaces the item at a given index (or list of indices) of a list by another item
setParameterByName = Element.SetParameterByName(parameterName=string_2, value=replaceItemAtIndex)  # unwired: element
string_3 = StringInput("Питающий щит")
setParameterByName_2 = Element.SetParameterByName(parameterName=string_3, value=code_block_17.OUT1)  # unwired: element
string_4 = StringInput("Имя панели")
setParameterByName_3 = Element.SetParameterByName(parameterName=string_4, value=code_block_17.OUT2)  # unwired: element

code_block_19 = CodeBlock {  }
