# Dynamo graph Перевод-всех-осей-в-2D.dyn (Dynamo 1.3.2.2480)

# group: На всех видах из фильтра или только планах?
all_plans = BoolSelector(false)

# group: Фильтрация видов по "содержит"
# note: При пустом значении, исполняется ко всем видам, при несуществующем- к активному
параметр = StringInput("Группа вида")
create = List.Create(параметр)
значение = StringInput("Уравнивание")
create_2 = List.Create(значение)

# group: Work zone
python_script = Python(IN[0]=all_plans, IN[1]=create, IN[2]=create_2)
# ---------- python_script.python (90 lines) ----------
import clr
clr.AddReference('ProtoGeometry')
from Autodesk.DesignScript.Geometry import *
clr.AddReference("RevitServices")
import RevitServices
from RevitServices.Persistence import DocumentManager
from RevitServices.Transactions import TransactionManager
clr.AddReference("RevitAPI")
import Autodesk
from Autodesk.Revit.DB import *
doc = DocumentManager.Instance.CurrentDBDocument
from System.Collections.Generic import *
clr.AddReference("RevitNodes")
import Revit
clr.ImportExtensions(Revit.Elements)

all = IN[0]
pars = IN[1]
value = IN[2]
views = FilteredElementCollector(doc).OfClass(View).ToElements()
grids = FilteredElementCollector(doc).OfCategory(BuiltInCategory.OST_Grids).WhereElementIsNotElementType().ToElements()

list=[]
TransactionManager.Instance.EnsureInTransaction(doc)
try:
	if pars[0]=="":
		for view in views:
			if not view.IsTemplate:
				for view in views:
					type = view.ViewType	
					if type == ViewType.FloorPlan or type == ViewType.Section or type == ViewType.Elevation or type == ViewType.CeilingPlan:
						for grid in grids:
							try:
								grid.SetDatumExtentType(DatumEnds.End1,view,DatumExtentType.ViewSpecific)
								grid.SetDatumExtentType(DatumEnds.End0,view,DatumExtentType.ViewSpecific)
							except:
								a=1						
	else:
		if all == True:
			for view in views:
				if not view.IsTemplate:
					for view in views:
						type = view.ViewType
						
						if type == ViewType.FloorPlan or type == ViewType.Section or type == ViewType.Elevation or type == ViewType.CeilingPlan:
							i=0
							t=0
							for par in pars:
								p = view.LookupParameter(par).AsString()
								if value[i]==p:
									t=t+1
								i=i+1
							if t==i and t>0:
								for grid in grids:
									try:
										grid.SetDatumExtentType(DatumEnds.End1,view,DatumExtentType.ViewSpecific)
										grid.SetDatumExtentType(DatumEnds.End0,view,DatumExtentType.ViewSpecific)
									except:
										a=1								
		else:
			for view in views:
				if not view.IsTemplate:
					for view in views:
						type = view.ViewType
						if type == ViewType.FloorPlan:	
							i=0
							t=0
							for par in pars:
								p = view.LookupParameter(par).AsString()
								if value[i]==p:
									t=t+1
								i=i+1
							if t==i and t>0:
								for grid in grids:
									try:
										grid.SetDatumExtentType(DatumEnds.End1,view,DatumExtentType.ViewSpecific)
										grid.SetDatumExtentType(DatumEnds.End0,view,DatumExtentType.ViewSpecific)
									except:
										a=1								
											
except:
	try:
		view = doc.ActiveView
		for grid in grids:
			grid.SetDatumExtentType(DatumEnds.End1,view,DatumExtentType.ViewSpecific)
			grid.SetDatumExtentType(DatumEnds.End0,view,DatumExtentType.ViewSpecific)
	except:
		a=1
TransactionManager.Instance.TransactionTaskDone()
OUT = grids
# ----------------------------------------
