# Dynamo graph номер группы шита.dyn (Dynamo 1.3.0.875)

boolean = BoolSelector(true)
forceChildrensEval = ForceChildrensEval(boolean)
currentSelection = Custom[Springs.Collector.CurrentSelection](refresh=forceChildrensEval)  # Gets the currently selected elements. Connect a boolean switch to refresh the selection.
string = StringInput("Марка")
electricalCircuit = Custom[Element.ElectricalCircuit](Element=currentSelection)  # Returns the electrical circuit of the element
string_2 = StringInput("Номер цепи")
getParameterValueByName = Element.GetParameterValueByName(element=electricalCircuit, parameterName=string_2)
setParameterByName = Element.SetParameterByName(element=currentSelection, parameterName=string, value=getParameterValueByName)
