# Dynamo graph номер группы щита (стабильная).dyn (Dynamo 1.3.0.875)

boolean = BoolSelector(true)
forceChildrensEval = ForceChildrensEval(boolean)
currentSelection = Custom[Springs.Collector.CurrentSelection](refresh=forceChildrensEval)  # Gets the currently selected elements. Connect a boolean switch to refresh the selection.
categories = Categories("ElectricalEquipment")
activeView = Custom[Springs.Doc.ActiveView](refresh=boolean)  # Selects the current document's active view. Supports more view types than the built-in option. Will be depreciated once the bult in node works with all plan types.
byCategoryAndView = Archilab.Grimshaw.Selection.Select.ByCategoryAndView(categories, activeView)
forceChildrensEval_2 = ForceChildrensEval(byCategoryAndView)
watch = Watch(forceChildrensEval_2)
string = StringInput("Марка")
electricalCircuit = Python(IN[0]=watch)  # "Element.ElectricalCircuit"
# ---------- electricalCircuit.python (35 lines) ----------
import clr
clr.AddReference('ProtoGeometry')
from Autodesk.DesignScript.Geometry import *

#The inputs to this node will be stored as a list in the IN variables.
if isinstance(IN[0],list):
	toggle = 0
	element = UnwrapElement(IN[0])
else:
	toggle = 1
	element = [UnwrapElement(IN[0])]

def getSystem(elem):
	system = elem.MEPModel.ElectricalSystems
	
	if system.Size == 0:
		return None
	elif system.Size == 1:	
		for sys in system:
			return sys
	else:
		return [x for x in system]

listout = []	
for x in element:
	try:
		system = getSystem(x)
		listout.append(system)
	except:
		listout.append(None)
#Assign your output to the OUT variable.
if toggle:
	OUT = system
else:
	OUT = listout
# ----------------------------------------
string_2 = StringInput("Номер цепи")
python_script = Python(IN[0]=electricalCircuit, IN[1]=string_2)
# ---------- python_script.python (29 lines) ----------
import clr
clr.AddReference('ProtoGeometry')
from Autodesk.DesignScript.Geometry import *

# Import ToDSType(bool) extension method
clr.AddReference("RevitNodes")
import Revit
clr.ImportExtensions(Revit.Elements)

dataEnteringNode = IN

list = dataEnteringNode[0]
pname = dataEnteringNode[1]

outlist = []

for e in list:
	try:
		outlist.append(e.GetParameterValueByName(pname))
	except:
		outlist.append(0)
		
	
		
		
		
	

OUT = outlist
# ----------------------------------------
python_script_2 = Python(IN[0]=watch, IN[1]=string, IN[2]=python_script)  # unwired: IN[3]
# ---------- python_script_2.python (34 lines) ----------
import clr
clr.AddReference('ProtoGeometry')
from Autodesk.DesignScript.Geometry import *

# Import ToDSType(bool) extension method
clr.AddReference("RevitNodes")
import Revit
clr.ImportExtensions(Revit.Elements)

dataEnteringNode = IN

elements = dataEnteringNode[0]
pname = dataEnteringNode[1]
circuitnumbers = dataEnteringNode[2]


outlist = []
k =0 

for e in elements:
	try:
		e.SetParameterByName(pname, circuitnumbers[k].ToString())
		outlist.append(e.GetParameterValueByName(pname))
	except:	
		outlist.append(e.GetParameterValueByName(pname))
	k=k+1
		
	
		
		
		
	

OUT = outlist
# ----------------------------------------
