# Dynamo graph номер группы щита.dyn (Dynamo 1.3.0.875)

boolean = BoolSelector(true)
forceChildrensEval = ForceChildrensEval(boolean)
currentSelection = Custom[Springs.Collector.CurrentSelection](refresh=forceChildrensEval)  # Gets the currently selected elements. Connect a boolean switch to refresh the selection.
current = Document.Current()
activeView = Document.ActiveView(current)
categories = Categories("ElectricalEquipment")
activeView_2 = Custom[Springs.Doc.ActiveView](refresh=boolean)  # Selects the current document's active view. Supports more view types than the built-in option. Will be depreciated once the bult in node works with all plan types.
selectByCategoryAndView = Custom[SelectByCategoryAndView](category=categories, view=activeView_2, refresh=boolean)  # Выбрать элементы по категории и виду
string = StringInput("Марка")
boolean_2 = BoolSelector(true)
setElectricSystemNameToElement = Custom[SetElectricSystemNameToElement](elements=selectByCategoryAndView, parametrName=string, refresh=boolean_2)  # Записать номер группы в свойство элемента
code_block = CodeBlock {  }
