# Dynamo graph Расстановка крышек кабельных лотков.dyn (Dynamo 1.3.0.875)

categories = Categories("CableTray")
all_elements_of_category = ElementsOfCategory(categories)
string = StringInput("Крышка лотка")
getParameterValueByName = Element.GetParameterValueByName(element=all_elements_of_category, parameterName=string)
code_block = CodeBlock { 1; }
eq = getParameterValueByName == code_block
filterByBoolMask = List.FilterByBoolMask(list=all_elements_of_category, mask=eq)
string_2 = StringInput("Перегородка")
getParameterValueByName_2 = Element.GetParameterValueByName(element=filterByBoolMask.in, parameterName=string_2)
code_block_2 = CodeBlock { 1; }
eq_2 = getParameterValueByName_2 == code_block_2
filterByBoolMask_2 = List.FilterByBoolMask(list=filterByBoolMask.in, mask=eq_2)
python_script = Python(IN[0]=filterByBoolMask_2.out)
# ---------- python_script.python (13 lines) ----------
import clr

clr.AddReference('RevitAPI')
from Autodesk.Revit.DB import *

clr.AddReference('RevitNodes')
import Revit
clr.ImportExtensions(Revit.GeometryConversion)
clr.ImportExtensions(Revit.Elements)

elements = UnwrapElement(IN[0])

OUT=[e.Location.Curve.ToProtoType(True) for e in elements]
# ----------------------------------------
startPoint = Curve.StartPoint(python_script)
endPoint = Curve.EndPoint(python_script)
create = List.Create(startPoint, endPoint)
transpose = List.Transpose(create)
family_types = FamilyTypes("Крышка лотка:Без перегородки")
byPoints = AdaptiveComponent.ByPoints(points=transpose, familyType=family_types)
python_script_2 = Python(IN[0]=filterByBoolMask_2.in)  # same code as python_script
startPoint_2 = Curve.StartPoint(python_script_2)
endPoint_2 = Curve.EndPoint(python_script_2)
create_2 = List.Create(startPoint_2, endPoint_2)
transpose_2 = List.Transpose(create_2)
family_types_2 = FamilyTypes("Крышка лотка:С перегородкой")
byPoints_2 = AdaptiveComponent.ByPoints(points=transpose_2, familyType=family_types_2)
