# Dynamo graph Расстановка-светильников-с-Dynamo-из-DIALUX-4.12.dyn (Dynamo 1.3.0.875)

family_types = FamilyTypes()
boolean = BoolSelector(false)
выберите_stf_из_dialux_4_12 = Filename("..\..\Desktop\%D0%9F%D1%80%D0%BE%D0%B5%D0%BA%D1%8211.stf")
categories = Categories("Rooms")
all_elements_of_category = ElementsOfCategory(categories)
дополнительно_переместить = DoubleInput(0)  # "Дополнительно переместить светильники вниз на мм"
pys_светильники_в_помещения = Python(IN[0]=boolean, IN[1]=выберите_stf_из_dialux_4_12, IN[2]=all_elements_of_category, IN[3]=дополнительно_переместить)
# ---------- pys_светильники_в_помещения.python (90 lines) ----------
import clr

clr.AddReference('RevitAPI')
from Autodesk.Revit.DB import *
clr.AddReference('ProtoGeometry')
from Autodesk.DesignScript.Geometry import *
#--------------Входные данные
reset = IN[0]
STFD = IN[1]
rooms = UnwrapElement(IN[2])
movedown = IN[3]
list1=[]
idlist = []
outlist=[]
roomlist=[]
l3=[]
test=[]
test1=[]
test2=[]
test3=[]
#Открытие IFC файла
Dstf = open(STFD)
Dlines = Dstf.readlines()
#Отделение шапки
Dlines1 = []
k=0
for Dline in Dlines:
	Dline=Dline.replace('\n','')
	if "ENDSEC;" in Dline:
		k=0
	if "[PROJECT]" in Dline:
		k=1		
	if k==1:
		Dlines1.append(Dline)
#Разделить строки на группы строк по помещениям
Dl1 = []
Dl2 = []		
for Dline in Dlines1:
	if "[ROOM." in Dline:
		Dl2.append(Dl1)
		Dl1=[]
	else:
		Dl1.append(Dline)
#Работа со строками относящимися к каждому помещению отдельно
list25=[]
list24=[]
for room in rooms:
	Rnumber = room.Number
	Rname = room.LookupParameter('Имя').AsString()
	#list24=[]
	for DRoom in Dl2:
		Dnumber=''
		Dname=''
		for Dline in DRoom:
			if 'Name=' in Dline:
				Dnumber = Dline[5:Dline.find(' ')].replace(' ','')
				Dname = Dline[Dline.find(' ')+1:]
		if Dnumber == Rnumber.replace('.','') and Dname == Rname:
			list23=[]
			Zroom = room.Location.Point.Z*304.8			
			for Dline in DRoom:		
				if 'Lum' in Dline and 'Nr' not in Dline:
					a = Dline[3:Dline.find('=')]
					if a.find('.Pos')<0 and a.find('.Rot')<0:
						name=Dline[Dline.find('=')+1:]
						if list23.Count>1:
							list24.append(list23)
							list23=[]
						list23.append(name)	
					if a.find('.Pos')>0:
						pt = Dline[Dline.find('=')+1:]
						X = float(pt[:pt.find(' ')])*1000
						pt = pt[pt.find(' ')+1:]
						Y = float(pt[:pt.find(' ')])*1000
						Z = float(pt[pt.find(' ')+1:])*1000+Zroom-movedown
						list23.append(X)
						list23.append(Y)
						list23.append(Z)
					if a.find('.Rot')>0:
						pt = Dline[Dline.find('=')+1:]
						angle = float(pt[pt.rfind(' ')+1:])-10
						list23.append(angle)
			if list23.Count>1:
				list24.append(list23)
			#if list24.Count>0:
				#list25.append(list24)					
#Закрытие IFC файла
Dstf.close()
#Вывод результата
OUT = list24
# ----------------------------------------
transpose = List.Transpose(pys_светильники_в_помещения)
code_block = CodeBlock(a=transpose) { a[1]; a[2]; a[3]; a[4]; a[0]; }
byCoordinates = FamilyInstance.ByCoordinates(family_types, code_block.out0, code_block.out1, code_block.out2)
setRotation = FamilyInstance.SetRotation(familyInstance=byCoordinates, degree=code_block.out3)
string = StringInput("Марка")
setParameterByName = Element.SetParameterByName(element=setRotation, parameterName=string, value=code_block.out4)
