# Dynamo graph УГО.dyn (Dynamo 1.2.1.3083)

doesIntersect = Geometry.DoesIntersect()  # unwired: geometry, other
family_types = FamilyTypes("УГО коробка:Dynamo")
all_elements_of_family_type = ElementsOfFamilyType(family_types)
flatten = Flatten(all_elements_of_family_type)
categories = Categories("Lines")
all_elements_of_category = ElementsOfCategory(categories)
flatten_2 = Flatten(all_elements_of_category)
setIntersection = SetIntersection(flatten, flatten_2)
watch = Watch(flatten)
watch_2 = Watch(flatten_2)
select_model_lines_by_style = Custom[Select Model Lines by Style]()  # This node will select all model lines in the revit project by a line style name.; unwired: Style_Name
location = Custom[Element.Location](element=flatten)  # Returns the location of an element as an XYZ (or if it's line-based the start and end point of the line), along with some booleans to help filtering the results. Use this for some element types (e.g. walls or lines) that do not work with the built-in Get Family Instance Location node.
watch_3 = Watch(location.points)
location_2 = Custom[Element.Location](element=flatten_2)
watch_4 = Watch(location_2.curves)
setIntersection_2 = SetIntersection(watch_3, watch_4)  # frozen
watch_5 = Watch(setIntersection_2)
intersectionChecker = Custom[Tool.IntersectionChecker](Element_A=watch_3, Element_B=watch_4)  # frozen; Checks if elements have a geometrical intersection. The result is a list of list, with First Element is checked against the others.
watch_6 = Watch(intersectionChecker.Intersecting_Elements)
doesIntersect_2 = Geometry.DoesIntersect(geometry=watch_3, other=watch_4)
color = Material.Color(flatten_2)
surfacePatternColor = Material.SurfacePatternColor(flatten_2)
overrideColorInView = Element.OverrideColorInView()  # unwired: element, color
