# Dynamo graph выбор нескольких категорий на активном виде, включая выбранный тип линий.dyn (Dynamo 1.3.2.2480)

# group: Выбор категорий на активном виде
code_block = CodeBlock { refresh:bool = true; }
forceChildrensEval = ForceChildrensEval()  # unwired: arg0
элементы_активного_вида = Python(IN[0]=code_block, IN[1]=forceChildrensEval)
# ---------- элементы_активного_вида.python (38 lines) ----------
#Copyright(c) 2016, Dimitar Venkov
# @5devene, dimitar.ven@gmail.com

#inspired by Troy Gates https://forums.autodesk.com/t5/revit-api/revit-api-selected-element-set-order/td-p/5597203

import clr

clr.AddReference("RevitAPIUI")
from  Autodesk.Revit.UI import *

clr.AddReference("RevitServices")
import RevitServices
from RevitServices.Persistence import DocumentManager
doc = DocumentManager.Instance.CurrentDBDocument
uidoc=DocumentManager.Instance.CurrentUIApplication.ActiveUIDocument

clr.AddReference("RevitNodes")
import Revit
clr.ImportExtensions(Revit.Elements)

def output1(l1):
	if len(l1) == 1: return l1[0]
	else: return l1

sel1 = uidoc.Selection
obt1 = Selection.ObjectType.Element
msg1 = 'Pick elements in the desired order, hit ESC to stop picking.'
out1 = []

flag = True
TaskDialog.Show("Spring Nodes", msg1)
while flag:
	try:
		el1 = doc.GetElement(sel1.PickObject(obt1, msg1).ElementId)
		out1.append(el1.ToDSType(True))
	except : flag = False

OUT = output1(out1)
# ----------------------------------------
getCategory = Element.GetCategory(элементы_активного_вида)
активный_вид = Python(IN[0]=code_block, IN[1]=forceChildrensEval)
# ---------- активный_вид.python (14 lines) ----------
#Copyright(c) 2016, Dimitar Venkov
# @5devene, dimitar.ven@gmail.com

import clr

clr.AddReference("RevitServices")
import RevitServices
from RevitServices.Persistence import DocumentManager
doc = DocumentManager.Instance.CurrentDBDocument
clr.AddReference("RevitNodes")
import Revit
clr.ImportExtensions(Revit.Elements)

OUT = doc.ActiveView.ToDSType(True)
# ----------------------------------------
code_block_2 = CodeBlock { 2; }

byCategoryAndView = archilab.Revit.Selection.Select.ByCategoryAndView(getCategory, активный_вид)

# group (continued): Выбор категорий на активном виде
flatten = List.Flatten(list=byCategoryAndView, amt=code_block_2)

# group: Фильтр линий из категорий
code_block_3 = CodeBlock { "DetailCurve"; }
filterByString = Custom[List.FilterByString](list=flatten, String=code_block_3)  # Filter a list by a string match

# group: Выбор линий на активном виде
code_block_4 = CodeBlock { "DetailCurve"; }
filterByString_2 = Custom[List.FilterByString](list=элементы_активного_вида, String=code_block_4)
forceChildrensEval_2 = ForceChildrensEval()  # unwired: arg0
python_script = Python(IN[0]=filterByString_2.Match, IN[1]=forceChildrensEval_2)
# ---------- python_script.python (30 lines) ----------
#Copyright (c) mostafa el ayoubi
#Data-Shapes 2016 elayoub.mostafa@gmail.com

import clr
clr.AddReference('RevitServices')
import RevitServices
from RevitServices.Persistence import DocumentManager
clr.AddReference('RevitAPI')
from Autodesk.Revit.DB import *
clr.AddReference('RevitNodes')
import Revit
clr.ImportExtensions(Revit.Elements)


doc = DocumentManager.Instance.CurrentDBDocument

if isinstance(IN[0],list):
	lines = UnwrapElement(IN[0])
else:
	lines = [UnwrapElement(IN[0])]
	
linestyles = []
linestyleids = []

for l in lines:
	linestyles.append(l.LineStyle.Name)
	linestyleids.append(l.LineStyle)


OUT = [linestyles,linestyleids]
# ----------------------------------------
code_block_5 = CodeBlock(out=python_script) { out[0]; }
python_script_2 = Python(IN[0]=code_block_5)
# ---------- python_script_2.python (26 lines) ----------
#Copyright (c) mostafa el ayoubi
#Data-Shapes 2016 elayoub.mostafa@gmail.com

import clr
clr.AddReference('RevitServices')
import RevitServices
from RevitServices.Persistence import DocumentManager
clr.AddReference('RevitAPI')
from Autodesk.Revit.DB import *


doc = DocumentManager.Instance.CurrentDBDocument

if isinstance(IN[0],list):
	names = UnwrapElement(IN[0])
else:
	names = [UnwrapElement(IN[0])]
	
alllines = FilteredElementCollector(doc).OfCategory(BuiltInCategory.OST_Lines)

lines = []

for n in names:
	lines.append([x for x in alllines if x.LineStyle.Name == n ])

OUT = lines
# ----------------------------------------
all_elements_in_active_view = ElementsInView()
containsItem = List.ContainsItem(list=all_elements_in_active_view, item=python_script_2@L1)
filterByBoolMask = List.FilterByBoolMask(list=python_script_2@L2, mask=containsItem)

# group: Выделение элементов
create = List.Create(filterByString.Other, filterByBoolMask.in)
flatten_2 = Flatten(create)
python_script_3 = Python(IN[0]=flatten_2)
# ---------- python_script_3.python (39 lines) ----------
#python nodes in dynamo 1.0
#proposed by Julien Benoit @jbenoit44 
#http://aecuandme.wordpress.com/
import clr
clr.AddReference('ProtoGeometry')
from Autodesk.DesignScript.Geometry import *
# Import ToDSType(bool) extension method
clr.AddReference("RevitNodes")
import Revit
clr.ImportExtensions(Revit.Elements)
# Import geometry conversion extension methods
clr.ImportExtensions(Revit.GeometryConversion)
# Import DocumentManager and TransactionManager
clr.AddReference("RevitServices")
import RevitServices
from RevitServices.Persistence import DocumentManager
from RevitServices.Transactions import TransactionManager
from System.Collections.Generic import *
import System.Object
# Import RevitAPI
clr.AddReference("RevitAPI")
import Autodesk
from Autodesk.Revit.DB import *

doc = DocumentManager.Instance.CurrentDBDocument
uiapp = DocumentManager.Instance.CurrentUIApplication
app = uiapp.Application
uidoc=DocumentManager.Instance.CurrentUIApplication.ActiveUIDocument

input = UnwrapElement(IN[0])
elt=[]
for i in input:
	elt.append(i.Id)

collection = List[ElementId](elt)

uidoc.Selection.SetElementIds(collection)

OUT = input,collection
# ----------------------------------------
