# Dynamo graph выбор нескольких категорий на активном виде.dyn (Dynamo 1.3.2.2480)

code_block = CodeBlock { refresh:bool = true; }
forceChildrensEval = ForceChildrensEval()  # unwired: arg0
выделение_элементов_активного = Python(IN[0]=code_block, IN[1]=forceChildrensEval)  # "выделение элементов активного вида"
# ---------- выделение_элементов_активного.python (38 lines) ----------
#Copyright(c) 2016, Dimitar Venkov
# @5devene, dimitar.ven@gmail.com

#inspired by Troy Gates https://forums.autodesk.com/t5/revit-api/revit-api-selected-element-set-order/td-p/5597203

import clr

clr.AddReference("RevitAPIUI")
from  Autodesk.Revit.UI import *

clr.AddReference("RevitServices")
import RevitServices
from RevitServices.Persistence import DocumentManager
doc = DocumentManager.Instance.CurrentDBDocument
uidoc=DocumentManager.Instance.CurrentUIApplication.ActiveUIDocument

clr.AddReference("RevitNodes")
import Revit
clr.ImportExtensions(Revit.Elements)

def output1(l1):
	if len(l1) == 1: return l1[0]
	else: return l1

sel1 = uidoc.Selection
obt1 = Selection.ObjectType.Element
msg1 = 'Pick elements in the desired order, hit ESC to stop picking.'
out1 = []

flag = True
TaskDialog.Show("Spring Nodes", msg1)
while flag:
	try:
		el1 = doc.GetElement(sel1.PickObject(obt1, msg1).ElementId)
		out1.append(el1.ToDSType(True))
	except : flag = False

OUT = output1(out1)
# ----------------------------------------
getCategory = Element.GetCategory(выделение_элементов_активного)
активный_вид = Python(IN[0]=code_block, IN[1]=forceChildrensEval)
# ---------- активный_вид.python (14 lines) ----------
#Copyright(c) 2016, Dimitar Venkov
# @5devene, dimitar.ven@gmail.com

import clr

clr.AddReference("RevitServices")
import RevitServices
from RevitServices.Persistence import DocumentManager
doc = DocumentManager.Instance.CurrentDBDocument
clr.AddReference("RevitNodes")
import Revit
clr.ImportExtensions(Revit.Elements)

OUT = doc.ActiveView.ToDSType(True)
# ----------------------------------------
byCategoryAndView = archilab.Revit.Selection.Select.ByCategoryAndView(getCategory, активный_вид)
flatten = Flatten(byCategoryAndView)

# group: Выделение элементов
python_script = Python(IN[0]=flatten)
# ---------- python_script.python (39 lines) ----------
#python nodes in dynamo 1.0
#proposed by Julien Benoit @jbenoit44 
#http://aecuandme.wordpress.com/
import clr
clr.AddReference('ProtoGeometry')
from Autodesk.DesignScript.Geometry import *
# Import ToDSType(bool) extension method
clr.AddReference("RevitNodes")
import Revit
clr.ImportExtensions(Revit.Elements)
# Import geometry conversion extension methods
clr.ImportExtensions(Revit.GeometryConversion)
# Import DocumentManager and TransactionManager
clr.AddReference("RevitServices")
import RevitServices
from RevitServices.Persistence import DocumentManager
from RevitServices.Transactions import TransactionManager
from System.Collections.Generic import *
import System.Object
# Import RevitAPI
clr.AddReference("RevitAPI")
import Autodesk
from Autodesk.Revit.DB import *

doc = DocumentManager.Instance.CurrentDBDocument
uiapp = DocumentManager.Instance.CurrentUIApplication
app = uiapp.Application
uidoc=DocumentManager.Instance.CurrentUIApplication.ActiveUIDocument

input = UnwrapElement(IN[0])
elt=[]
for i in input:
	elt.append(i.Id)

collection = List[ElementId](elt)

uidoc.Selection.SetElementIds(collection)

OUT = input,collection
# ----------------------------------------
