# Dynamo graph выбор по комметариям.dyn (Dynamo 1.3.0.875)

# group: Выбор на активном виде
all_elements_in_active_view = ElementsInView()
name = Element.Name(all_elements_in_active_view)
springs_selectelements_ordered = Custom[Springs.SelectElements(ordered)]()  # Select multiple elements from the Revit document in the desired order. Hit ESC to stop picking. To refresh the node, connect a boolean switch node.
code_block = CodeBlock(x=springs_selectelements_ordered) { x[0]; }
name_2 = Element.Name(code_block)
containsItem = List.ContainsItem(list=name@L1, item=name_2)
filterByBoolMask = List.FilterByBoolMask(list=all_elements_in_active_view@L2, mask=containsItem)
code_block_2 = CodeBlock { "Комментарии"; }
getParameterValueByName = Element.GetParameterValueByName(element=filterByBoolMask.in, parameterName=code_block_2)

# group: UI
code_block_3 = CodeBlock { "Введите искомый комментарий"; }
code_block_4 = CodeBlock { 0; }
code_block_5 = CodeBlock { "ОК"; }
ui_textbox_data = Custom[UI.TextBox Data]()  # Create Data for TextBox input in UI.MultipleInputForm ++ . Check out www.data-shapes.net for more informations
code_block_6 = CodeBlock { 1; }
code_block_7 = CodeBlock { "Отмена"; }
forceChildrensEval = ForceChildrensEval()  # unwired: arg0
ui_multipleinputform = Custom[UI.MultipleInputForm ++](Description_optional=code_block_3, Logo_optional=code_block_4, ButtonText_optional=code_block_5, Inputs=ui_textbox_data, Toggle=code_block_6, CancelButtonText_optional=code_block_7, Width_optional=forceChildrensEval)  # Create a form with multiple inputs. see www.data-shapes.net for tutorials and infos!
eq = getParameterValueByName@L1 == ui_multipleinputform.User_Inputs

transpose = List.Transpose(eq)

# group (continued): UI
filterByBoolMask_2 = List.FilterByBoolMask(list=filterByBoolMask.in, mask=transpose)

# group: Выделение элементов
code_block_8 = CodeBlock(Element=filterByBoolMask_2.in) { Element; }
code_block_9 = CodeBlock(item=code_block_8) { Flatten({item}); }
python_script = Python(IN[0]=code_block_9)
# ---------- python_script.python (39 lines) ----------
#python nodes in dynamo 1.0
#proposed by Julien Benoit @jbenoit44 
#http://aecuandme.wordpress.com/
import clr
clr.AddReference('ProtoGeometry')
from Autodesk.DesignScript.Geometry import *
# Import ToDSType(bool) extension method
clr.AddReference("RevitNodes")
import Revit
clr.ImportExtensions(Revit.Elements)
# Import geometry conversion extension methods
clr.ImportExtensions(Revit.GeometryConversion)
# Import DocumentManager and TransactionManager
clr.AddReference("RevitServices")
import RevitServices
from RevitServices.Persistence import DocumentManager
from RevitServices.Transactions import TransactionManager
from System.Collections.Generic import *
import System.Object
# Import RevitAPI
clr.AddReference("RevitAPI")
import Autodesk
from Autodesk.Revit.DB import *

doc = DocumentManager.Instance.CurrentDBDocument
uiapp = DocumentManager.Instance.CurrentUIApplication
app = uiapp.Application
uidoc=DocumentManager.Instance.CurrentUIApplication.ActiveUIDocument

input = UnwrapElement(IN[0])
elt=[]
for i in input:
	elt.append(i.Id)

collection = List[ElementId](elt)

uidoc.Selection.SetElementIds(collection)

OUT = input,collection
# ----------------------------------------
