# Dynamo graph выбор-удаление аналогичных линий на активном виде(UI).dyn (Dynamo 1.3.2.2480)

# group: Выделение линии на активном виде
empty = List.Empty()
code_block = CodeBlock { reset:bool = true; }
python_script = Python(IN[0]=empty, IN[1]=code_block)
# ---------- python_script.python (42 lines) ----------
#python nodes in dynamo 1.0
#proposed by Julien Benoit @jbenoit44 
#http://aecuandme.wordpress.com/
import clr
clr.AddReference('ProtoGeometry')
from Autodesk.DesignScript.Geometry import *
# Import ToDSType(bool) extension method
clr.AddReference("RevitNodes")
import Revit
clr.ImportExtensions(Revit.Elements)
# Import geometry conversion extension methods
clr.ImportExtensions(Revit.GeometryConversion)
# Import DocumentManager and TransactionManager
clr.AddReference("RevitServices")
import RevitServices
from RevitServices.Persistence import DocumentManager
from RevitServices.Transactions import TransactionManager
from System.Collections.Generic import *
# Import RevitAPI
clr.AddReference("RevitAPI")
import Autodesk
from Autodesk.Revit.DB import *

doc = DocumentManager.Instance.CurrentDBDocument
uiapp = DocumentManager.Instance.CurrentUIApplication
app = uiapp.Application
uidoc=DocumentManager.Instance.CurrentUIApplication.ActiveUIDocument

sel=[]
elt=[]
# Start Transaction
TransactionManager.Instance.EnsureInTransaction(doc)

sel=uidoc.Selection.GetElementIds()

for i in sel:
	elt.append(doc.GetElement(i).ToDSType(True))
		
# End Transaction
TransactionManager.Instance.TransactionTaskDone()

OUT=elt
# ----------------------------------------

# group: Выбор линий на активном виде
forceChildrensEval = ForceChildrensEval()  # unwired: arg0
python_script_2 = Python(IN[0]=python_script, IN[1]=forceChildrensEval)
# ---------- python_script_2.python (30 lines) ----------
#Copyright (c) mostafa el ayoubi
#Data-Shapes 2016 elayoub.mostafa@gmail.com

import clr
clr.AddReference('RevitServices')
import RevitServices
from RevitServices.Persistence import DocumentManager
clr.AddReference('RevitAPI')
from Autodesk.Revit.DB import *
clr.AddReference('RevitNodes')
import Revit
clr.ImportExtensions(Revit.Elements)


doc = DocumentManager.Instance.CurrentDBDocument

if isinstance(IN[0],list):
	lines = UnwrapElement(IN[0])
else:
	lines = [UnwrapElement(IN[0])]
	
linestyles = []
linestyleids = []

for l in lines:
	linestyles.append(l.LineStyle.Name)
	linestyleids.append(l.LineStyle)


OUT = [linestyles,linestyleids]
# ----------------------------------------
code_block_2 = CodeBlock(out=python_script_2) { out[0]; }
python_script_3 = Python(IN[0]=code_block_2)
# ---------- python_script_3.python (26 lines) ----------
#Copyright (c) mostafa el ayoubi
#Data-Shapes 2016 elayoub.mostafa@gmail.com

import clr
clr.AddReference('RevitServices')
import RevitServices
from RevitServices.Persistence import DocumentManager
clr.AddReference('RevitAPI')
from Autodesk.Revit.DB import *


doc = DocumentManager.Instance.CurrentDBDocument

if isinstance(IN[0],list):
	names = UnwrapElement(IN[0])
else:
	names = [UnwrapElement(IN[0])]
	
alllines = FilteredElementCollector(doc).OfCategory(BuiltInCategory.OST_Lines)

lines = []

for n in names:
	lines.append([x for x in alllines if x.LineStyle.Name == n ])

OUT = lines
# ----------------------------------------
all_elements_in_active_view = ElementsInView()
containsItem = List.ContainsItem(list=all_elements_in_active_view, item=python_script_3@L1)
filterByBoolMask = List.FilterByBoolMask(list=python_script_3@L2, mask=containsItem)

# group: UI
code_block_3 = CodeBlock { 0; }
code_block_4 = CodeBlock { "ОК"; }
code_block_5 = CodeBlock { "Выберите действие"; }
code_block_6 = CodeBlock { 1; }
code_block_7 = CodeBlock { "Выделить/удалить"; }
ui_boolean_input = Custom[UI.Boolean input](InputName=code_block_5, DefaultValue=code_block_6, SideText=code_block_7)  # Creates a boolean input for UI.MultipleInputForm ++ . Check out www.data-shapes.net for more infos!
code_block_8 = CodeBlock { 1; }
code_block_9 = CodeBlock { "Отмена"; }
forceChildrensEval_2 = ForceChildrensEval()  # unwired: arg0
ui_multipleinputform = Custom[UI.MultipleInputForm ++](Logo_optional=code_block_3, ButtonText_optional=code_block_4, Inputs=ui_boolean_input, Toggle=code_block_8, CancelButtonText_optional=code_block_9, Width_optional=forceChildrensEval_2)  # Create a form with multiple inputs. see www.data-shapes.net for tutorials and infos!
code_block_10 = CodeBlock { 1; }
eq = ui_multipleinputform.User_Inputs == code_block_10
filterByBoolMask_2 = List.FilterByBoolMask(list=filterByBoolMask.in, mask=eq)
ne = ui_multipleinputform.User_Inputs != code_block_10
filterByBoolMask_3 = List.FilterByBoolMask(list=filterByBoolMask.in, mask=ne)

# group: Выделение элементов
code_block_11 = CodeBlock(Element=filterByBoolMask_2.in) { Element; }
code_block_12 = CodeBlock(item=code_block_11) { Flatten({item}); }
python_script_4 = Python(IN[0]=code_block_12)
# ---------- python_script_4.python (39 lines) ----------
#python nodes in dynamo 1.0
#proposed by Julien Benoit @jbenoit44 
#http://aecuandme.wordpress.com/
import clr
clr.AddReference('ProtoGeometry')
from Autodesk.DesignScript.Geometry import *
# Import ToDSType(bool) extension method
clr.AddReference("RevitNodes")
import Revit
clr.ImportExtensions(Revit.Elements)
# Import geometry conversion extension methods
clr.ImportExtensions(Revit.GeometryConversion)
# Import DocumentManager and TransactionManager
clr.AddReference("RevitServices")
import RevitServices
from RevitServices.Persistence import DocumentManager
from RevitServices.Transactions import TransactionManager
from System.Collections.Generic import *
import System.Object
# Import RevitAPI
clr.AddReference("RevitAPI")
import Autodesk
from Autodesk.Revit.DB import *

doc = DocumentManager.Instance.CurrentDBDocument
uiapp = DocumentManager.Instance.CurrentUIApplication
app = uiapp.Application
uidoc=DocumentManager.Instance.CurrentUIApplication.ActiveUIDocument

input = UnwrapElement(IN[0])
elt=[]
for i in input:
	elt.append(i.Id)

collection = List[ElementId](elt)

uidoc.Selection.SetElementIds(collection)

OUT = input,collection
# ----------------------------------------

# group: удаление элементов
delete = archilab.Revit.Elements.Elements.Delete(filterByBoolMask_3.in)
