# Dynamo graph 0.Удаление шаблонов и фильтров_0.5.dyn (Dynamo 1.3.3.4111)

# note: ВСЁ ОСТАЛЬНОЕ

# group: Название кустом ноды [НАЗВАНИЕ ПАКЕТА] для распакованных кустомных нодов
# note: НОДЫ РАБОТАЮЩИЕ С ДАННЫМИ
# note: ИСПОЛНИТЕЛЬНЫЕ НОДЫ

# group: КЛЮЧЕВЫЕ МОМЕНТЫ РАБОТЫ
# note: ИТОГОВАЯ КОНСОЛИДАЦИЯ ДАННЫХ

# group: ИСПОЛНИТЕЛЬНЫЕ НОДЫ (фильтрование, подбор, списки и т.д.)
# note: НОДЫ РАБОТАЮЩИЕ С ДАННЫМИ
# note: ИСПОЛНИТЕЛЬНЫЕ НОДЫ

# group: ЗАПАСНЫЕ ВАРИАНТЫ, ДОПОЛНИТЕЛЬНЫЕ ОПЦИИ
# note: ДОПОЛНИТЕЛЬНЫЕ. Градации серово по важности, темнее - важнее
# note: ЗАПАСНЫЕ

# group: ПЕРЕДАЁМ ИНФОРМАЦИЮ В РЕВИТ
# note: ПЕРЕДАЁМ ИНФОРМАЦИЮ В РЕВИТ

# group: ПРОВЕРОЧНЫЕ НОДЫ
# note: ПРОВЕРОЧНЫЕ НОДЫ

# group: ЭЛЕМЕНТЫ УПРАВЛЕНИЯ 1 УРОВЕНЬ
# note: ПЕРЕМЕННЫЕ ЗНАЧЕНИЯ
# note: ЭЛЕМЕНТЫ УПРАВЛЕНИЯ

# group: ПРИМЕЧАНИЯ ПО ЦВЕТОВОЙ ГРУППИРОВКЕ
# note: GUIDELINES

# group: ПОЛУЧАЕМ ДАННЫЕ ИЗ РЕВИТ
# note: ПОЛУЧАЕМ ДАННЫЕ ИЗ РЕВИТ

# group: ЭЛЕМЕНТЫ УПРАВЛЕНИЯ 2 УРОВЕНЬ
# note: ЭЛЕМЕНТЫ УПРАВЛЕНИЯ
# note: ПЕРЕМЕННЫЕ ЗНАЧЕНИЯ

# group: ЭЛЕМЕНТЫ УПРАВЛЕНИЯ Dyno Studio
# note: Dyno Studio

удаляем_шаблоны = BoolSelector(false)
t_удалить_всё = BoolSelector(false)
t_удалить_не_использованное = BoolSelector(false)
t_выбрать_и_удалить = BoolSelector(false)
t_выбрать_и_оставить = BoolSelector(false)
create = List.Create(t_удалить_всё, t_удалить_не_использованное, t_выбрать_и_удалить, t_выбрать_и_оставить)
code_block = CodeBlock { {false,false,false,false}; }

# group: [Prorubim]
forceChildrensEval = ForceChildrensEval()  # unwired: arg0

if_ = Python(IN[0]=удаляем_шаблоны, IN[1]=create, IN[2]=code_block, IN[3]=forceChildrensEval)
# ---------- if_.python (12 lines) ----------
import clr
boolean = IN[0]
true = UnwrapElement(IN[1])
false = UnwrapElement(IN[2])

if boolean:
	out = true
else:
	out = false

#Назначьте вывод переменной OUT.
OUT = out
# ----------------------------------------
code_block_2 = CodeBlock(list=if_) { list[0]; list[1]; list[2]; list[3]; }
удалить_все_шаблоны_вида = Python(IN[0]=code_block_2.out0)
# ---------- удалить_все_шаблоны_вида.python (28 lines) ----------
if IN[0] == True:
	import clr
	clr.AddReference('RevitAPI')
	from Autodesk.Revit.DB import*
	clr.AddReference('RevitServices')
	from RevitServices.Persistence import DocumentManager
	from RevitServices.Transactions import TransactionManager
	
	doc = DocumentManager.Instance.CurrentDBDocument
	
	views = FilteredElementCollector(doc).OfClass(View)
	appliedtemplates = [v.ViewTemplateId for v in views]
	templates = [v.Id for v in views if v.IsTemplate == True]
	ln=len(templates)
	"""
	toDelete = []
	for t in templates:
		if t not in appliedtemplates:
			toDelete.append(t)
	"""
	TransactionManager.Instance.EnsureInTransaction(doc)
	for e in templates:
		doc.Delete(e)
	TransactionManager.Instance.TransactionTaskDone()
	
	OUT = str(ln)+' Template(s) deleted' 
else:
	pass
# ----------------------------------------
удалить_не_использованные = Python(IN[0]=code_block_2.out1)  # "Удалить не использованные шаблоны вида"
# ---------- удалить_не_использованные.python (27 lines) ----------
if IN[0] == True:
	import clr
	clr.AddReference('RevitAPI')
	from Autodesk.Revit.DB import*
	clr.AddReference('RevitServices')
	from RevitServices.Persistence import DocumentManager
	from RevitServices.Transactions import TransactionManager
	
	doc = DocumentManager.Instance.CurrentDBDocument
	
	views = FilteredElementCollector(doc).OfClass(View)
	appliedtemplates = [v.ViewTemplateId for v in views]
	templates = [v.Id for v in views if v.IsTemplate == True]
	
	toDelete = []
	for t in templates:
		if t not in appliedtemplates:
			toDelete.append(t)
	
	TransactionManager.Instance.EnsureInTransaction(doc)
	for e in toDelete:
		doc.Delete(e)
	TransactionManager.Instance.TransactionTaskDone()
	
	OUT = '%d Template(s) deleted' %(len(toDelete))
else:
	pass
# ----------------------------------------
formTabs = StringInput("Варианты запуска")
получаем_список_шаблонов = Python(IN[0]=code_block_2.out2)
# ---------- получаем_список_шаблонов.python (19 lines) ----------
if IN[0] == True:
	import clr
	clr.AddReference('RevitAPI')
	from Autodesk.Revit.DB import*
	clr.AddReference('RevitServices')
	from RevitServices.Persistence import DocumentManager
	from RevitServices.Transactions import TransactionManager
	
	doc = DocumentManager.Instance.CurrentDBDocument
	
	views = FilteredElementCollector(doc).OfClass(View)
	appliedtemplates = [v.ViewTemplateId for v in views]
	templatesID = [v.Id for v in views if v.IsTemplate == True]
	templates = [v for v in views if v.IsTemplate == True]
	templatesName = [v.Name for v in views if v.IsTemplate == True]
	
	OUT = templatesName, templatesID, templates
else:
	OUT = [[],[],[]]
# ----------------------------------------
code_block_3 = CodeBlock(list=получаем_список_шаблонов) { list[0]; list[1]; }
sort = List.Sort(code_block_3.out0)
create_2 = List.Create(sort)

# group: DynoStudio.ShowDialog [Prorubim]
code_block_4 = CodeBlock { "Удалить выбранные шаблоны"; "templates_to_del"; }
showDialog = Prorubim.DynoNodes.DynoStudio.ShowDialog(code_block_4.out0, code_block_4.out1, create_2, code_block_2.out2)

contains = String.Contains(str=code_block_3.out0, searchFor=showDialog, lacing=CrossProduct)
allFalse = AllFalse(contains@L2)
filterByBoolMask = List.FilterByBoolMask(list=code_block_3.out1, mask=allFalse)
code_block_5 = CodeBlock(SELECTET=filterByBoolMask.out) { SELECTET; }
получаем_список_шаблонов_2 = Python(IN[0]=code_block_2.out3)  # same code as получаем_список_шаблонов
code_block_6 = CodeBlock(list=получаем_список_шаблонов_2) { list[0]; list[1]; }
sort_2 = List.Sort(code_block_6.out0)
create_3 = List.Create(sort_2)

# group: DynoStudio.ShowDialog [Prorubim]
code_block_7 = CodeBlock { "Сохранить выбранные шаблоны"; "templates_to_save"; }
showDialog_2 = Prorubim.DynoNodes.DynoStudio.ShowDialog(code_block_7.out0, code_block_7.out1, create_3, code_block_2.out3)

contains_2 = String.Contains(str=code_block_6.out0, searchFor=showDialog_2, lacing=CrossProduct)
allFalse_2 = AllFalse(contains_2@L2)
filterByBoolMask_2 = List.FilterByBoolMask(list=code_block_6.out1, mask=allFalse_2)
code_block_8 = CodeBlock(dontSELECTET=filterByBoolMask_2.in) { dontSELECTET; }
удалить_по_фильтру = Python(IN[0]=forceChildrensEval, IN[1]=code_block_5, IN[2]=code_block_8)
# ---------- удалить_по_фильтру.python (24 lines) ----------
import clr
clr.AddReference('RevitAPI')
from Autodesk.Revit.DB import*
clr.AddReference('RevitServices')
from RevitServices.Persistence import DocumentManager
from RevitServices.Transactions import TransactionManager
doc = DocumentManager.Instance.CurrentDBDocument

toDelete = []
select = IN[1]
notselect = IN[2]
if len(select) > 0:
	toDelete = select
elif len(notselect) > 0:
	toDelete = notselect
else:
	pass

TransactionManager.Instance.EnsureInTransaction(doc)
for e in toDelete:
	doc.Delete(e)
TransactionManager.Instance.TransactionTaskDone()

OUT = '%d Template(s) deleted' %(len(toDelete))
# ----------------------------------------
количество_удалённых_шаблонов = Watch(удалить_по_фильтру)
удаляем_фильтры = BoolSelector(false)
f_удалить_всё = BoolSelector(false)
f_удалить_не_использованное = BoolSelector(true)
f_выбрать_и_удалить = BoolSelector(false)
f_выбрать_и_оставить = BoolSelector(false)
create_4 = List.Create(f_удалить_всё, f_удалить_не_использованное, f_выбрать_и_удалить, f_выбрать_и_оставить)
code_block_9 = CodeBlock { {false,false,false,false}; }
if_2 = Python(IN[0]=удаляем_фильтры, IN[1]=create_4, IN[2]=code_block_9, IN[3]=forceChildrensEval)  # same code as if_
code_block_10 = CodeBlock(list=if_2) { list[0]; list[1]; list[2]; list[3]; }
удалить_не_использованные_2 = Python(IN[0]=code_block_10.out1)  # "Удалить не использованные фильтры [Modelical]"
# ---------- удалить_не_использованные_2.python (74 lines) ----------
#Note: The methods used in this script has been taken from Paul Wintour's BVN package and reused to achieve the purpose oh the same. https://parametricmonkey.com/2016/03/09/get-unused-filters/
if IN[0] == True:
	import clr
	clr.AddReference('ProtoGeometry')
	from Autodesk.DesignScript.Geometry import *
	
	clr.AddReference("System.Core")
	import System.Linq
	clr.ImportExtensions(System.Linq)
	
	clr.AddReference("RevitAPI")
	import Autodesk.Revit
	from Autodesk.Revit.Exceptions import InvalidOperationException
	from Autodesk.Revit.DB import *
	from Autodesk.Revit.DB import ElementId
	from System.Collections.Generic import *
	
	# Import ToDSType(bool) extension method
	clr.AddReference("RevitNodes")
	import Revit
	clr.ImportExtensions(Revit.Elements)
	
	# Import DocumentManager
	clr.AddReference("RevitServices")
	import RevitServices
	from RevitServices.Persistence import DocumentManager
	from RevitServices.Transactions import TransactionManager
	from RevitServices.Persistence import DocumentManager
	
	def GetUsedFilterIds(doc):
	  views = FilteredElementCollector(doc).OfClass(View).ToElements()
	  usedFilterIds = []
	  for view in views:
	    viewFilterIds = []
	    try:
	      viewFilterIds = view.GetFilters()
	    except InvalidOperationException, e:
	      pass # this exception happens when a view doesn't support filters
	    usedFilterIds.extend(viewFilterIds)
	  return usedFilterIds
	
	def GetUnusedFilters(doc):
	  usedFilterIds = GetUsedFilterIds(doc).ToList[ElementId]()
	  unusedFilters = FilteredElementCollector(doc).OfClass(ParameterFilterElement).Excluding(usedFilterIds).ToElements()
	  return list(f.ToDSType(True) for f in unusedFilters)
	
	#The inputs to this node will be stored as a list in the IN variables.
	
	bool = IN[0]
	output = "Set Toggle to TRUE to delete unused filters"
	
	doc = DocumentManager.Instance.CurrentDBDocument
	
	filters = GetUnusedFilters(doc)
	filters2 = UnwrapElement(filters)
	filtersID = []
	filtersNames = []
	
	if bool == True:
		for f in filters2:
			filtersID.append(f.Id)
	
		TransactionManager.Instance.EnsureInTransaction(doc)
	
		for f in filtersID:
			filtersNames.append(doc.GetElement(f).Name)
			doc.Delete(f)
	
		TransactionManager.Instance.TransactionTaskDone()
		output = filtersNames
	#Assign your output to the OUT variable.
	OUT = output
else:
	pass
# ----------------------------------------
удалить_все_фильтры = Python(IN[0]=code_block_10.out0)
# ---------- удалить_все_фильтры.python (52 lines) ----------
if IN[0] == True:
	import clr
	clr.AddReference('ProtoGeometry')
	from Autodesk.DesignScript.Geometry import *
	
	clr.AddReference("System.Core")
	import System.Linq
	clr.ImportExtensions(System.Linq)
	
	clr.AddReference("RevitAPI")
	import Autodesk.Revit
	from Autodesk.Revit.Exceptions import InvalidOperationException
	from Autodesk.Revit.DB import *
	from Autodesk.Revit.DB import ElementId
	from System.Collections.Generic import *
	
	# Import ToDSType(bool) extension method
	clr.AddReference("RevitNodes")
	import Revit
	clr.ImportExtensions(Revit.Elements)
	
	# Import DocumentManager
	clr.AddReference("RevitServices")
	import RevitServices
	from RevitServices.Persistence import DocumentManager
	from RevitServices.Transactions import TransactionManager
	from RevitServices.Persistence import DocumentManager
	
	doc = DocumentManager.Instance.CurrentDBDocument
	
	Filters = FilteredElementCollector(doc).OfClass(ParameterFilterElement).ToElements()
	
	#The inputs to this node will be stored as a list in the IN variables.
	
	filtersID = []
	filtersNames = []
	
	for f in Filters:
		filtersID.append(f.Id)

	TransactionManager.Instance.EnsureInTransaction(doc)

	for f in filtersID:
		filtersNames.append(doc.GetElement(f).Name)
		doc.Delete(f)

	TransactionManager.Instance.TransactionTaskDone()
	output = filtersNames
	#Assign your output to the OUT variable.
	OUT = output
else:
	pass
# ----------------------------------------
получаем_список_шаблонов_3 = Python(IN[0]=code_block_10.out2)
# ---------- получаем_список_шаблонов_3.python (46 lines) ----------
if IN[0] == True:
	import clr
	clr.AddReference('ProtoGeometry')
	from Autodesk.DesignScript.Geometry import *
	
	clr.AddReference("System.Core")
	import System.Linq
	clr.ImportExtensions(System.Linq)
	
	clr.AddReference("RevitAPI")
	import Autodesk.Revit
	from Autodesk.Revit.Exceptions import InvalidOperationException
	from Autodesk.Revit.DB import *
	from Autodesk.Revit.DB import ElementId
	from System.Collections.Generic import *
	
	# Import ToDSType(bool) extension method
	clr.AddReference("RevitNodes")
	import Revit
	clr.ImportExtensions(Revit.Elements)
	
	# Import DocumentManager
	clr.AddReference("RevitServices")
	import RevitServices
	from RevitServices.Persistence import DocumentManager
	from RevitServices.Transactions import TransactionManager
	from RevitServices.Persistence import DocumentManager
	
	doc = DocumentManager.Instance.CurrentDBDocument
	
	Filters = FilteredElementCollector(doc).OfClass(ParameterFilterElement).ToElements()
	
	#The inputs to this node will be stored as a list in the IN variables.
	
	filtersID = []
	filtersNames = []
	
	for f in Filters:
		filtersID.append(f.Id)

	for f in filtersID:
		filtersNames.append(doc.GetElement(f).Name)

	OUT = filtersNames, filtersID
else:
	OUT = [[],[]]
# ----------------------------------------
code_block_11 = CodeBlock(list=получаем_список_шаблонов_3) { list[0]; list[1]; }
sort_3 = List.Sort(code_block_11.out0)
create_5 = List.Create(sort_3)

# group: DynoStudio.ShowDialog [Prorubim]
code_block_12 = CodeBlock { "Удалить выбранные фильтры"; "filters_to_del"; }
showDialog_3 = Prorubim.DynoNodes.DynoStudio.ShowDialog(code_block_12.out0, code_block_12.out1, create_5, code_block_10.out2)

contains_3 = String.Contains(str=code_block_11.out0, searchFor=showDialog_3, lacing=CrossProduct)
allFalse_3 = AllFalse(contains_3@L2)
filterByBoolMask_3 = List.FilterByBoolMask(list=code_block_11.out1, mask=allFalse_3)
code_block_13 = CodeBlock(SELECTET=filterByBoolMask_3.out) { SELECTET; }
получаем_список_шаблонов_4 = Python(IN[0]=code_block_10.out3)  # same code as получаем_список_шаблонов_3
code_block_14 = CodeBlock(list=получаем_список_шаблонов_4) { list[0]; list[1]; }
sort_4 = List.Sort(code_block_14.out0)
create_6 = List.Create(sort_4)

# group: DynoStudio.ShowDialog [Prorubim]
code_block_15 = CodeBlock { "Сохранить выбранные фильтры"; "filters_to_save"; }
showDialog_4 = Prorubim.DynoNodes.DynoStudio.ShowDialog(code_block_15.out0, code_block_15.out1, create_6, code_block_10.out3)

contains_4 = String.Contains(str=code_block_14.out0, searchFor=showDialog_4, lacing=CrossProduct)
allFalse_4 = AllFalse(contains_4@L2)
filterByBoolMask_4 = List.FilterByBoolMask(list=code_block_14.out1, mask=allFalse_4)
code_block_16 = CodeBlock(dontSELECTET=filterByBoolMask_4.in) { dontSELECTET; }
удалить_по_фильтру_2 = Python(IN[0]=forceChildrensEval, IN[1]=code_block_13, IN[2]=code_block_16)  # same code as удалить_по_фильтру
количество_удалённых_шаблонов_2 = Watch(удалить_по_фильтру_2)
