# Dynamo graph D2_ 3Д виды СОЗДАТЬ по элементам_0.965.dyn (Dynamo 2.3.0.5885)

# group: ПОЛУЧАЕМ ДАННЫЕ
# note: ПОЛУЧАЕМ ДАННЫЕ ИЗ РЕВИТ и других источников

# group: ЭЛЕМЕНТЫ УПРАВЛЕНИЯ
# note: ЭЛЕМЕНТЫ УПРАВЛЕНИЯ
# note: ПЕРЕМЕННЫЕ ЗНАЧЕНИЯ

# group: Python ноды
# note: Python

# group: ЭЛЕМЕНТЫ УПРАВЛЕНИЯ 2 УРОВЕНЬ
# note: ЭЛЕМЕНТЫ УПРАВЛЕНИЯ
# note: ПЕРЕМЕННЫЕ ЗНАЧЕНИЯ

# group: ПРОВЕРОЧНЫЕ НОДЫ
# note: ПРОВЕРОЧНЫЕ НОДЫ

# group: Запуск питона из внешнего файла
# note: Py - files

# group: ЗАПАСНЫЕ ВАРИАНТЫ, ДОПОЛНИТЕЛЬНЫЕ ОПЦИИ
# note: ЗАПАСНЫЕ
# note: ДОПОЛНИТЕЛЬНЫЕ. Градации серово по важности, темнее - важнее

# group: КЛЮЧЕВЫЕ МОМЕНТЫ РАБОТЫ 2
# note: УСЛОЖНЕНЫЕ КОНСТРУКЦИИ
# note: УСЛОЖНЕННЫЕ КОНСТРУКЦИИ

# group: КЛЮЧЕВЫЕ МОМЕНТЫ РАБОТЫ 1
# note: КОНСОЛИДАЦИЯ И СЛОЖНЫЕ ОБРАБОТКИ

# group: ИСПОЛНИТЕЛЬНЫЕ НОДЫ (фильтрование, подбор, списки и т.д.)
# note: ИСПОЛНИТЕЛЬНЫЕ НОДЫ

# group: ПЕРЕДАЁМ ИНФОРМАЦИЮ
# note: ПЕРЕДАЁМ ИНФОРМАЦИЮ В РЕВИТ
# note: ПЕРЕДАЁМ ИНФОРМАЦИЮ ЕЩЁ КУДА-ТО

# group: ПРИМЕЧАНИЯ ПО ЦВЕТОВОЙ ГРУППИРОВКЕ
# note: GUIDELINES

categories = Categories()  # nothing selected; frozen
all_elements_of_category = ElementsOfCategory(Category=categories)

# group: Get Revit Selection:
pys_get_revit_selection = Python()  # unwired: IN[0]
# ---------- pys_get_revit_selection.python (22 lines) ----------
import clr
clr.AddReference('RevitServices')
clr.AddReference('RevitAPI')
from Autodesk.Revit.DB import *
import RevitServices
from RevitServices.Persistence import DocumentManager
from Autodesk.Revit.ApplicationServices import Application

reset = IN[0]

doc = DocumentManager.Instance.CurrentDBDocument
uidoc = DocumentManager.Instance.CurrentUIApplication.ActiveUIDocument
ids = uidoc.Selection.GetElementIds()

idd = [str(i) for i in ids]

if isinstance(idd, list) == True:
	elems = [doc.GetElement(ElementId(int(i))) for i in idd]
else:
	elems = doc.GetElement(ElementId(int(idd)))

OUT = elems
# ----------------------------------------

parameters = Element.Parameters()  # unwired: element
# note: ВСЁ ОСТАЛЬНОЕ
getParameterValueByName = Element.GetParameterValueByName()  # unwired: element, parameterName
boolean = BoolSelector(true)  # frozen
code_block = CodeBlock { 1; 2; }
if_ = Python(IN[0]=boolean, IN[1]=code_block.out0, IN[2]=code_block.out1)
# ---------- if_.python (12 lines) ----------
import clr
boolean = IN[0]
true = UnwrapElement(IN[1])
false = UnwrapElement(IN[2])

if boolean:
	out = true
else:
	out = false

#Назначьте вывод переменной OUT.
OUT = out
# ----------------------------------------
geometry = Element.Geometry()  # unwired: element
setParameterByName = Element.SetParameterByName()  # unwired: element, parameterName, value

# group: Parameters name from language
parameters_name_from_language = Python()  # graph input; frozen
# ---------- parameters_name_from_language.python (18 lines) ----------
import clr
clr.AddReference('RevitServices')
import RevitServices
from RevitServices.Persistence import DocumentManager

uiapp = DocumentManager.Instance.CurrentUIApplication
app = uiapp.Application
lng = app.Language
rus = ["Тип","Имя семейства","Имя типа"]
enu = ["Type","Family name","Type name"]
out = []
if str(lng) == "Russian":
	out = rus
else:
	out = enu
#English_USA
#Russian
OUT = out
# ----------------------------------------

# group: элементы внутри групп
members = Python()  # "Group.Members"; frozen; unwired: IN[0]
# ---------- members.python (19 lines) ----------
import clr
clr.AddReference('RevitAPI')
from Autodesk.Revit.DB import *

clr.AddReference("RevitNodes")
import Revit
clr.ImportExtensions(Revit.Elements)

groups = UnwrapElement(IN[0])
elementlist = list()
for item in groups:
	try:
		memberlist = list()
		for member in item.GetMemberIds():
			memberlist.append(item.Document.GetElement(member))
		elementlist.append(memberlist)
	except:
		elementlist.append(list())
OUT = elementlist
# ----------------------------------------

shablon_python_shablon = Python()  # frozen; unwired: IN[0]
# ---------- shablon_python_shablon.python (69 lines) ----------
# -*- coding: utf-8 -*- 
#-----------------------Импоорт библиотек----------------------
import clr
clr.AddReference('RevitAPI')
import Autodesk
from Autodesk.Revit.DB import *

clr.AddReference("RevitNodes") 
import Revit
from Revit.Elements import *

clr.ImportExtensions(Revit.Elements) #ToDSType не работает без
clr.ImportExtensions(Revit.GeometryConversion) #ToXyz не работает без

clr.AddReference("RevitServices")
import RevitServices
from RevitServices.Persistence import DocumentManager
from RevitServices.Transactions import TransactionManager

clr.AddReference('ProtoGeometry')
from Autodesk.DesignScript.Geometry import *

#-----------------------ИМПОРТ БИБЛИОТЕК----------------------
"""-"""
#-----------------------ФУНКЦИИ----------------------

def __x__(x):
	x="x"
	return x
	
#-----------------------ФУНКЦИИ----------------------
"""-"""
#-----------------------АПИ ПАРАМЕТРЫ----------------------

doc = DocumentManager.Instance.CurrentDBDocument
#link_doc = UnwrapElement(IN[1])
#uiapp = DocumentManager.Instance.CurrentUIApplication
#app = uiapp.Application
#version = app.VersionNumber
#options = Autodesk.Revit.DB.SpatialElementBoundaryOptions()
calculator = SpatialElementGeometryCalculator(doc)

#-----------------------АПИ ПАРАМЕТРЫ----------------------
"""-"""
#-----------------------РАБОЧИЕ ПАРАМЕТРЫ----------------------

rooms = UnwrapElement(IN[0])

#-----------------------РАБОЧИЕ ПАРАМЕТРЫ----------------------	
"""-"""
#-----------------------ТЕСТОВЫЕ ПАРАМЕТРЫ----------------------

test = []

#-----------------------ТЕСТОВЫЕ ПАРАМЕТРЫ----------------------
"""-"""
#-----------------------НАЧАЛО СКРИПТА----------------------

x = 0
if rooms == None:
	rooms = [0,0]

for room in rooms:
	x=__x__(x)+__x__(x)
#TransactionManager.Instance.EnsureInTransaction(doc)
#TransactionManager.Instance.TransactionTaskDone()
#-----------------------КОНЕЦ СКРИПТА----------------------

OUT = x
# ----------------------------------------
members_2 = Python()  # "Object.Members"; frozen; unwired: IN[0]
# ---------- members_2.python (14 lines) ----------
import clr

items = IN[0]
elementlist = list()

try:
	clr.AddReference('RevitAPI')
	from Autodesk.Revit.DB import *
	for item in items:
		elementlist.append(dir(UnwrapElement(item)))
except:
	for item in items:
		elementlist.append(dir(item))
OUT = elementlist
# ----------------------------------------
regenerate = Python()  # frozen; unwired: IN[0]
# ---------- regenerate.python (26 lines) ----------
import clr

# Import DocumentManager and TransactionManager
clr.AddReference("RevitServices")
import RevitServices
from RevitServices.Persistence import DocumentManager


# Import RevitAPI
clr.AddReference("RevitAPI")
import Autodesk
from Autodesk.Revit.DB import *

doc = DocumentManager.Instance.CurrentDBDocument


#The inputs to this node will be stored as a list in the IN variable.
list = IN[0]


if list:
	doc.Regenerate()
	out = "Regeneration complete"
else:
	out = "fail"
OUT = out
# ----------------------------------------
filteredElementCollector = Python()  # frozen; unwired: IN[0]
# ---------- filteredElementCollector.python (29 lines) ----------
if IN[1]:
	import clr
	
	# Import DocumentManager and TransactionManager
	clr.AddReference("RevitServices")
	import RevitServices
	from RevitServices.Persistence import DocumentManager
	
	
	# Import RevitAPI
	clr.AddReference("RevitAPI")
	import Autodesk
	from Autodesk.Revit.DB import *
	
	doc = DocumentManager.Instance.CurrentDBDocument
	uiapp = DocumentManager.Instance.CurrentUIApplication
	app = uiapp.Application
	
	from System.Collections.Generic import *
	
	
	#The inputs to this node will be stored as a list in the IN variable.
	dataEnteringNode = IN
	collector = FilteredElementCollector(doc)
	elements = collector.OfCategory(BuiltInCategory.OST_Views).ToElements()
	
	OUT = sheetInstances
else:
	OUT = "скрипт не выполнен"
# ----------------------------------------
rezzet = BoolSelector(true)  # graph input

# group: Get Revit Selection:
pys_get_revit_selection_2 = Python(IN[0]=rezzet)  # same code as pys_get_revit_selection
code_block_2 = CodeBlock { "Неприсоединенная высота"; }
getParameterValueByName_2 = Element.GetParameterValueByName(element=pys_get_revit_selection_2, parameterName=code_block_2)
sortByKey = List.SortByKey(list=pys_get_revit_selection_2, keys=getParameterValueByName_2)

имя_параметра_для_заполнения_и = StringInput("Марка")  # "Имя параметра для заполнения и фильтрации:"; graph input
номер_стартовой_марки = DoubleInput(4000)  # graph input
count = List.Count(list=sortByKey.sorted_list)
code_block_3 = CodeBlock(start_value=номер_стартовой_марки, count=count) { start_value..(start_value+count-1); }
string_from_object = FromObject(obj=code_block_3)
code_block_4 = CodeBlock(x=string_from_object) { "Perete "+x; }
setParameterByName_2 = Element.SetParameterByName(element=sortByKey.sorted_list, parameterName=имя_параметра_для_заполнения_и, value=code_block_4)
отступ_границ_3d_вида = DoubleInput(500)  # graph input

# group: Создание Границ 3D вида
code_block_5 = CodeBlock(element=setParameterByName_2) { element; }
boundingBox = Element.BoundingBox(element=code_block_5)
minPoint = BoundingBox.MinPoint(boundingBox=boundingBox)
code_block_6 = CodeBlock(Offset=отступ_границ_3d_вида) { Offset; }
code_block_7 = CodeBlock(a=code_block_6) { -a; }
byCoordinates = Vector.ByCoordinates(x=code_block_7, y=code_block_7, z=code_block_7)
add = Point.Add(point=minPoint, vectorToAdd=byCoordinates)
maxPoint = BoundingBox.MaxPoint(boundingBox=boundingBox)
byCoordinates_2 = Vector.ByCoordinates(x=code_block_6, y=code_block_6, z=code_block_6)
add_2 = Point.Add(point=maxPoint, vectorToAdd=byCoordinates_2)

# group: Графика 2Д и 3Д видов
выбрать_вид_шаблон_3d_вида = Views("{3D} копия 1")  # graph input
масштаб_3d = DoubleInput(50)  # graph input
code_block_8 = CodeBlock { 000; 198; 099; }
byARGB = Color.ByARGB(r=code_block_8.out0, g=code_block_8.out1, b=code_block_8.out2)
прозрачность = DoubleInput(40)  # graph input
образец_заливки_для_стен = FillPatterns("600 x 1200 мм")  # graph input
масштаб_2d = DoubleInput(50)  # graph input
выбрать_вид_шаблон_2d_вида = Views("Этаж 1")  # graph input

toCuboid = BoundingBox.ToCuboid(boundingBox=boundingBox)
centroid = Solid.Centroid(solid=toCuboid)
создание_3d_вида = Python(IN[0]=setParameterByName_2, IN[1]=add, IN[2]=add_2, IN[3]=имя_параметра_для_заполнения_и, IN[4]=выбрать_вид_шаблон_3d_вида, IN[5]=масштаб_3d, IN[6]=rezzet, IN[7]=centroid, IN[8]=byARGB, IN[9]=прозрачность, IN[10]=образец_заливки_для_стен)
# ---------- создание_3d_вида.python (134 lines) ----------
import clr
clr.AddReference("RevitNodes")
import Revit
clr.ImportExtensions(Revit.Elements)
# Import geometry conversion extension methods
clr.ImportExtensions(Revit.GeometryConversion)
# Import DocumentManager and TransactionManager
clr.AddReference("RevitServices")
import RevitServices
from RevitServices.Persistence import DocumentManager
from RevitServices.Transactions import TransactionManager
# Import RevitAPI
clr.AddReference("RevitAPI")
import Autodesk
from Autodesk.Revit.DB import FilteredElementCollector, View, View3D, Element, StorageType, ViewFamily, ViewFamilyType, FillPatternElement, FillPatternTarget, XYZ

import System 
from System import Byte


def param_value(element):
	mark_p = element.LookupParameter(FildName)
	if mark_p.StorageType == StorageType.String:
		mark = mark_p.AsString()
	elif mark_p.StorageType == StorageType.Double:
		mark = mark_p.AsDouble()
	elif mark_p.StorageType == StorageType.Integer:
		mark = mark_p.AsInteger()
	elif mark_p.StorageType == StorageType.ElementId:
		mark = mark_p.AsElementId()
	else:
		mark = ""
	return mark

def plist(box,transformInverse):
	p_list
	p_list.append(XYZ(box.Min.X, box.Min.Y, box.Min.Z))
	p_list.append(XYZ(box.Max.X, box.Min.Y, box.Min.Z))
	p_list.append(XYZ(box.Max.X, box.Max.Y, box.Min.Z))
	p_list.append(XYZ(box.Min.X, box.Max.Y, box.Min.Z))
	
	p_list.append(XYZ(box.Max.X, box.Max.Y, box.Max.Z))
	p_list.append(XYZ(box.Min.X, box.Max.Y, box.Max.Z))
	p_list.append(XYZ(box.Min.X, box.Min.Y, box.Max.Z))
	p_list.append(XYZ(box.Max.X, box.Min.Y, box.Max.Z))
	
	new_p_list = []
	new_x_list = []
	new_y_list = []
	
	for p in p_list:
		new_p_list.append(transformInverse.OfPoint(p))
		new_x_list.append(transformInverse.OfPoint(p).X)
		new_y_list.append(transformInverse.OfPoint(p).Y)
	
	new_min_x = min(new_x_list)
	new_min_y = min(new_y_list)
	
	new_max_x = max(new_x_list)
	new_max_y = max(new_y_list)
	
	return new_min_x,new_min_y,new_max_x,new_max_y
	

doc = DocumentManager.Instance.CurrentDBDocument
uiapp = DocumentManager.Instance.CurrentUIApplication
app = uiapp.Application

viewtypes = FilteredElementCollector(doc).OfClass(ViewFamilyType)
typeid = [v.Id for v in viewtypes if v.ViewFamily == ViewFamily.ThreeDimensional][0]


gSettings = Autodesk.Revit.DB.OverrideGraphicSettings()
dy_color = UnwrapElement(IN[8])
color = Autodesk.Revit.DB.Color(Byte.Parse(str(dy_color.Red)), Byte.Parse(str(dy_color.Green)), Byte.Parse(str(dy_color.Blue)))
fillPatDraft = UnwrapElement(IN[10])#FillPatternElement.GetFillPatternElementByName(doc, FillPatternTarget.Drafting, "Сплошная заливка")
gSettings.SetSurfaceForegroundPatternColor(color)
#gSettings.SetSurfaceForegroundPatternId(fillPatDraft.Id)
gSettings.SetSurfaceTransparency(IN[9])


Min=[]
Max=[]
TagPoint=[]

wall = UnwrapElement(IN[0])
[Min.append(UnwrapElement(i.ToXyz(True))) for i in IN[1]]
[Max.append(UnwrapElement(i.ToXyz(True))) for i in IN[2]]
FildName = IN[3]
view_tamplate = UnwrapElement(IN[4])
scale = IN[5]
[TagPoint.append(UnwrapElement(i.ToXyz(True))) for i in IN[7]]

count = 0
view_list=[]
fail_list=[]
test=[]


#for w,mi,ma,tg in zip(wall,Min,Max,TagPoint):
for w,mi,ma in zip(wall,Min,Max):
	p_list = []
	min_max = []
	TransactionManager.Instance.EnsureInTransaction(doc)
	new_view = View3D.CreateIsometric(doc, typeid)
	TransactionManager.Instance.TransactionTaskDone()
	
	box = app.Create.NewBoundingBoxXYZ()
	box.Min = mi
	box.Max = ma
	a = View3D.SetSectionBox(new_view,box)
	#count = count + 1
	new_view.SetElementOverrides(w.Id, gSettings)
	new_view.SaveOrientationAndLock()
	new_view.Scale = scale
	new_view.ViewTemplateId = view_tamplate.ViewTemplateId
	
	new_view.CropBoxActive = True
	bb = new_view.CropBox
	transformInverse = bb.Transform.Inverse
	new_min_x,new_min_y,new_max_x,new_max_y = plist(box,transformInverse)	
	bb.Min = XYZ(new_min_x,new_min_y,0)
	bb.Max = XYZ(new_max_x,new_max_y,0)
	new_view.CropBox = bb
	view_list.append(new_view)
	#test.append(IndependentTag.Create(doc, new_view.Id, Reference(w), True,TagMode.TM_ADDBY_CATEGORY,TagOrientation.Horizontal,tg))
	"""
	try:
		new_view.ViewName = param_value(w)
		view_list.append(new_view)
	except:
		fail_list.append(new_view)
	"""
OUT= view_list#,fail_list
# ----------------------------------------
flatten = List.Flatten(list=создание_3d_вида)

# group: Параметры группировки новых видов
имя_параметра_для_группировки = StringInput("Раздел проекта")  # "Имя параметра для группировки видов и спецификаций:"; graph input
прификс_для_группировки_в = StringInput("Сгенерированные")  # "Прификс для группировки в диспечере:"; graph input
code_block_9 = CodeBlock(prfx=прификс_для_группировки_в) { prfx+" 3Д виды"; }
code_block_10 = CodeBlock(prfx=прификс_для_группировки_в) { prfx+" Спецификации"; }
code_block_11 = CodeBlock(prfx=прификс_для_группировки_в) { prfx+" 2Д виды"; }

setParameterByName_3 = Element.SetParameterByName(element=flatten, parameterName=имя_параметра_для_группировки, value=code_block_9)
создание_спецификации = Python(IN[0]=rezzet, IN[1]=setParameterByName_2, IN[2]=имя_параметра_для_заполнения_и)
# ---------- создание_спецификации.python (70 lines) ----------
import clr

# Import DocumentManager and TransactionManager
clr.AddReference("RevitServices")
import RevitServices
from RevitServices.Persistence import DocumentManager
from RevitServices.Transactions import TransactionManager

# Import RevitAPI
clr.AddReference("RevitAPI")
import Autodesk
from Autodesk.Revit.DB import View, StorageType, ScheduleFilter, ScheduleFilterType

doc = DocumentManager.Instance.CurrentDBDocument

def param_value(element):
	mark_p = element.LookupParameter(FildName)
	if mark_p.StorageType == StorageType.String:
		mark = mark_p.AsString()
	elif mark_p.StorageType == StorageType.Double:
		mark = mark_p.AsDouble()
	elif mark_p.StorageType == StorageType.Integer:
		mark = mark_p.AsInteger()
	elif mark_p.StorageType == StorageType.ElementId:
		mark = mark_p.AsElementId()
	else:
		mark = ""
	return mark


clr.AddReference("RevitNodes")
import Revit
clr.ImportExtensions(Revit.Elements)


sch_dupopt = Autodesk.Revit.DB.ViewDuplicateOption.Duplicate
startshedule = doc.ActiveView
walls = UnwrapElement(IN[1])
FildName = IN[2]

new_sche_list = []


for w in walls:
	mark = param_value(w)

	TransactionManager.Instance.EnsureInTransaction(doc)
	new_sche_id = startshedule.Duplicate(sch_dupopt)
	TransactionManager.Instance.TransactionTaskDone()
	
	new_sche = doc.GetElement(new_sche_id)
	n_sch_def = new_sche.Definition
	FieldCount = n_sch_def.GetFieldCount()
	
	count = 0
	
	while count < FieldCount:
		test_fild = n_sch_def.GetField(count)
		if test_fild.GetName() == FildName:
			fild = test_fild
		else:
			pass
		count += 1
		
	sch_filter = ScheduleFilter(fild.FieldId,ScheduleFilterType.Equal,mark)
	n_sch_def.AddFilter(sch_filter)
	#new_sche.ViewName = str(mark)
	new_sche_list.append(new_sche)

OUT = new_sche_list
# ----------------------------------------
flatten_2 = List.Flatten(list=создание_спецификации)
setParameterByName_4 = Element.SetParameterByName(element=flatten_2, parameterName=имя_параметра_для_группировки, value=code_block_10)
watch = Watch(sortByKey.sorted_list)
getLocation = Element.GetLocation(element=watch)
startPoint = Curve.StartPoint(curve=getLocation)
endPoint = Curve.EndPoint(curve=getLocation)
code_block_12 = CodeBlock(point1=endPoint) { point1.X; point1.Y; point1.Z; }
code_block_13 = CodeBlock { "Неприсоединенная высота"; }
getParameterValueByName_3 = Element.GetParameterValueByName(element=watch, parameterName=code_block_13)
code_block_14 = CodeBlock(z=code_block_12.out2, h=getParameterValueByName_3) { z+h; }
byCoordinates_3 = Point.ByCoordinates(x=code_block_12.out0, y=code_block_12.out1, z=code_block_14)
code_block_15 = CodeBlock(point1=startPoint) { point1.X; point1.Y; point1.Z; }
code_block_16 = CodeBlock(z=code_block_15.out2, h=getParameterValueByName_3) { z+h; }
byCoordinates_4 = Point.ByCoordinates(x=code_block_15.out0, y=code_block_15.out1, z=code_block_16)
create = List.Create(item0=startPoint, item1=endPoint, item2=byCoordinates_3, item3=byCoordinates_4)
transpose = List.Transpose(lists=create)
byPerimeterPoints = Surface.ByPerimeterPoints(points=transpose)
coordinateSystemAtParameter = Surface.CoordinateSystemAtParameter(surface=byPerimeterPoints)
отступ_границ_2d_вида = DoubleInput(500)  # graph input
глубина_2d_вида = DoubleInput(500)  # graph input
code_block_17 = CodeBlock(x=отступ_границ_2d_вида, y=отступ_границ_2d_вида, z=глубина_2d_вида) { -x; -y; -z; }
byCoordinates_5 = Point.ByCoordinates(x=code_block_17.out0, y=code_block_17.out1, z=code_block_17.out2)
length = Curve.Length(curve=getLocation)
code_block_18 = CodeBlock(x=getParameterValueByName_3, h=отступ_границ_2d_вида, y=length, z=глубина_2d_вида) { x+h; y+h; z; }
byCoordinates_6 = Point.ByCoordinates(x=code_block_18.out0, y=code_block_18.out1, z=code_block_18.z)
element_types = ElementTypes("ViewFamilyType")  # graph input
all_elements_of_type = ElementsOfType(element_type=element_types)
name = Element.Name(element=all_elements_of_type)
имя_семейства_разреза = StringInput("Номер вида")  # graph input
eq = name == имя_семейства_разреза
filterByBoolMask = List.FilterByBoolMask(list=all_elements_of_type, mask=eq)
code_block_19 = CodeBlock(ViewFamilyType=filterByBoolMask.in) { ViewFamilyType[0]; }
byCoordinateSystemMinPointMaxPoint = Python(IN[0]=rezzet, IN[1]=coordinateSystemAtParameter, IN[2]=byCoordinates_5, IN[3]=byCoordinates_6, IN[4]=code_block_19)  # "SectionView.ByCoordinateSystemMinPointMaxPoint"
# ---------- byCoordinateSystemMinPointMaxPoint.python (58 lines) ----------
import clr
clr.AddReference('RevitAPI')
import Autodesk
from Autodesk.Revit.DB import ViewSection, BoundingBoxXYZ, Transform

clr.AddReference("RevitNodes") 
import Revit
clr.ImportExtensions(Revit.GeometryConversion)

clr.AddReference("RevitServices")
import RevitServices
from RevitServices.Persistence import DocumentManager
from RevitServices.Transactions import TransactionManager


def ByCoordinateSystemMinPointMaxPoint(cs,minPoint,maxPoint):
	return ToRevitBoundingBox(cs,minPoint,maxPoint)
	
def ToRevitBoundingBox(cs,minPoint,maxPoint):
	convertUnits = True
	rbb = BoundingBoxXYZ()
	rbb.Enabled = True
	rbb.Transform = ToTransform(cs,convertUnits)
	rbb.Max = maxPoint.ToXyz(convertUnits)	
	rbb.Min = minPoint.ToXyz(convertUnits)
	return rbb

def ToTransform(cs,convertUnits):
	trans = Transform.Identity
	trans.Origin = cs.Origin.ToXyz(convertUnits)	
	trans.BasisX = cs.XAxis.ToXyz()
	trans.BasisY = cs.YAxis.ToXyz()
	trans.BasisZ = cs.ZAxis.ToXyz()
	return trans

doc = DocumentManager.Instance.CurrentDBDocument	
cs = UnwrapElement(IN[1])
minPoint = UnwrapElement(IN[2])
maxPoint = UnwrapElement(IN[3])
elem_f_type = UnwrapElement(IN[4])

l_cs = len(cs)
l_maxP = len(maxPoint)
sec_view_list = []

if l_cs == l_maxP:
	TransactionManager.Instance.EnsureInTransaction(doc)
	count = 0
	while l_cs > count:
		bb = ByCoordinateSystemMinPointMaxPoint(cs[count],minPoint,maxPoint[count])
		sec_view_list.append(ViewSection.CreateSection(doc,elem_f_type.Id,bb))
		count +=1
	TransactionManager.Instance.TransactionTaskDone()
else:
	pass


OUT = sec_view_list
# ----------------------------------------
setParameterByName_5 = Element.SetParameterByName(element=byCoordinateSystemMinPointMaxPoint, parameterName=имя_параметра_для_группировки, value=code_block_11)
# note: ЕСЛИ ПАКЕТ НОДОВ [Prorubim] НЕ УСТАНОВЛЕН, и по каким-то причинам не может быть установлен, или возникает проблема с дубликатами видов, ЗАМЕНИТЬ СВЯЗЬ С НОЙДОЙ [Prorubim][ForceChildrensEval] НА СВЯЗЬ С НОДОЙ -= rezzet =- ПРИ ВОЗНИКНОВЕНИИ ДУБЛИКАТОВ ВИДА, ПЕРЕД ПЕРЕЗАПУСКОМ СКРИПТА, БУДЕТ НЕОБХОДИМО ПЕРЕКЛЮЧАТЬ БУЛЕВЫЙ ПЕРЕКЛЮЧАТЕЛЬ В НОДЕ -= rezzet =-
pys_get_revit_selection_3 = Python()  # frozen; unwired: IN[0]
# ---------- pys_get_revit_selection_3.python (47 lines) ----------
import clr
clr.AddReference('RevitAPI')
from Autodesk.Revit.DB import *
from Autodesk.Revit.ApplicationServices import Application

clr.AddReference("RevitNodes") 
import Revit
from Revit.Elements import *

clr.AddReference("RevitServices")
import RevitServices
from RevitServices.Persistence import DocumentManager
from RevitServices.Transactions import TransactionManager

clr.ImportExtensions(Revit.Elements) #ToDSType не работает без
clr.ImportExtensions(Revit.GeometryConversion)

reset = IN[0]

doc = DocumentManager.Instance.CurrentDBDocument
uidoc = DocumentManager.Instance.CurrentUIApplication.ActiveUIDocument
ids = uidoc.Selection.GetElementIds()
uiapp = DocumentManager.Instance.CurrentUIApplication
app = uiapp.Application


view3d = doc.ActiveView

box = view3d.GetSectionBox()
#count = count + 1

view3d.CropBoxActive = True
bb = view3d.CropBox
transformInverse = bb.Transform.Inverse
#min_max = bb_all_points(bb)#,transformInverse)
#new_min = transformInverse.OfPoint(min_max[0])
#new_max = transformInverse.OfPoint(min_max[1])
new_min = transformInverse.OfPoint(box.Min)
new_max = transformInverse.OfPoint(box.Max)
bb.Min = XYZ(new_min.X,new_min.Y,0)
bb.Max = XYZ(new_max.X,new_max.Y,0)

TransactionManager.Instance.EnsureInTransaction(doc)
view3d.CropBox = bb
TransactionManager.Instance.TransactionTaskDone()

OUT = box.Min,box.Max,bb.Min,bb.Max
# ----------------------------------------
pys_get_revit_selection_4 = Python()  # frozen; unwired: IN[0]
# ---------- pys_get_revit_selection_4.python (73 lines) ----------
import clr
clr.AddReference('RevitAPI')
from Autodesk.Revit.DB import *
from Autodesk.Revit.ApplicationServices import Application

clr.AddReference("RevitNodes") 
import Revit
from Revit.Elements import *

clr.ImportExtensions(Revit.Elements) #ToDSType не работает без
clr.ImportExtensions(Revit.GeometryConversion)

clr.AddReference("RevitServices")
import RevitServices
from RevitServices.Persistence import DocumentManager
from RevitServices.Transactions import TransactionManager

reset = IN[0]
p_list = []

doc = DocumentManager.Instance.CurrentDBDocument
uidoc = DocumentManager.Instance.CurrentUIApplication.ActiveUIDocument
ids = uidoc.Selection.GetElementIds()
uiapp = DocumentManager.Instance.CurrentUIApplication
app = uiapp.Application

def plist(box,transformInverse):
	p_list
	p_list.append(XYZ(box.Min.X, box.Min.Y, box.Min.Z))
	p_list.append(XYZ(box.Max.X, box.Min.Y, box.Min.Z))
	p_list.append(XYZ(box.Max.X, box.Max.Y, box.Min.Z))
	p_list.append(XYZ(box.Min.X, box.Max.Y, box.Min.Z))
	
	p_list.append(XYZ(box.Max.X, box.Max.Y, box.Max.Z))
	p_list.append(XYZ(box.Min.X, box.Max.Y, box.Max.Z))
	p_list.append(XYZ(box.Min.X, box.Min.Y, box.Max.Z))
	p_list.append(XYZ(box.Max.X, box.Min.Y, box.Max.Z))
	
	new_p_list = []
	new_x_list = []
	new_y_list = []
	
	for p in p_list:
		new_p_list.append(transformInverse.OfPoint(p))
		new_x_list.append(transformInverse.OfPoint(p).X)
		new_y_list.append(transformInverse.OfPoint(p).Y)
	
	new_min_x = min(new_x_list)
	new_min_y = min(new_y_list)
	
	new_max_x = max(new_x_list)
	new_max_y = max(new_y_list)
	
	return new_min_x,new_min_y,new_max_x,new_max_y

view3d = doc.ActiveView

box = view3d.GetSectionBox()
#count = count + 1

view3d.CropBoxActive = True
bb = view3d.CropBox
transformInverse = bb.Transform.Inverse

new_min_x,new_min_y,new_max_x,new_max_y = plist(box,transformInverse)

TransactionManager.Instance.EnsureInTransaction(doc)
bb.Min = XYZ(new_min_x,new_min_y,0)
bb.Max = XYZ(new_max_x,new_max_y,0)
view3d.CropBox = bb
TransactionManager.Instance.TransactionTaskDone()

OUT = bb.Min
# ----------------------------------------
настройка_видимости_элементов_на = Python(IN[0]=setParameterByName_2, IN[1]=byARGB, IN[2]=byCoordinateSystemMinPointMaxPoint, IN[3]=масштаб_2d, IN[4]=прозрачность, IN[5]=выбрать_вид_шаблон_2d_вида, IN[6]=rezzet, IN[7]=имя_параметра_для_заполнения_и, IN[8]=образец_заливки_для_стен)  # "Настройка видимости элементов на 2D виде"
# ---------- настройка_видимости_элементов_на.python (62 lines) ----------
import clr

clr.AddReference("RevitServices")
import RevitServices
from RevitServices.Persistence import DocumentManager
from RevitServices.Transactions import TransactionManager
#from System.Collections.Generic import *
# Import RevitAPI
clr.AddReference("RevitAPI")
import Autodesk
from Autodesk.Revit.DB import View, Element, StorageType, FillPatternElement, FillPatternTarget

import System 
from System import Byte

def param_value(element):
	mark_p = element.LookupParameter(IN[7])
	if mark_p.StorageType == StorageType.String:
		mark = mark_p.AsString()
	elif mark_p.StorageType == StorageType.Double:
		mark = mark_p.AsDouble()
	elif mark_p.StorageType == StorageType.Integer:
		mark = mark_p.AsInteger()
	elif mark_p.StorageType == StorageType.ElementId:
		mark = mark_p.AsElementId()
	else:
		mark = ""
	return mark

doc = DocumentManager.Instance.CurrentDBDocument


gSettings = Autodesk.Revit.DB.OverrideGraphicSettings()
dy_color = UnwrapElement(IN[1])
color = Autodesk.Revit.DB.Color(Byte.Parse(str(dy_color.Red)), Byte.Parse(str(dy_color.Green)), Byte.Parse(str(dy_color.Blue)))
fillPatDraft = UnwrapElement(IN[8])#FillPatternElement.GetFillPatternElementByName(doc, FillPatternTarget.Drafting, "Сплошная заливка")
gSettings.SetSurfaceForegroundPatternColor(color)
#gSettings.SetSurfaceForegroundPatternId(fillPatDraft.Id)
gSettings.SetSurfaceTransparency(IN[4])


wall = UnwrapElement(IN[0])
sections = UnwrapElement(IN[2])
scale = IN[3]
view_tamplate = UnwrapElement(IN[5])
#FildName = IN[7]
view_list=[]
fail_list=[]

for w,se in zip(wall,sections):
	se.SetElementOverrides(w.Id, gSettings)
	se.Scale = scale
	se.ViewTemplateId = view_tamplate.ViewTemplateId
	view_list.append(se)
	"""
	try:
		se.ViewName = param_value(w)
		view_list.append(se)
	except:
		fail_list.append(se)
	"""
OUT= view_list#,fail_list
# ----------------------------------------

# group: Тип формата
выбрать_тип_формата_для = FamilyTypes("Следующий лист - Текст:A2×3A")  # "Выбрать тип формата, для размещении на листе:"; graph input

# group: XY на листе
x = DoubleSlider(-1, range=-1..1 step 0.1)  # graph input
y = DoubleSlider(0.6, range=-1..1 step 0.1)  # graph input
create_2 = List.Create(item0=x, item1=y)

создание_листа = Python(IN[0]=rezzet, IN[1]=flatten_2, IN[2]=flatten, IN[3]=настройка_видимости_элементов_на, IN[4]=выбрать_тип_формата_для, IN[5]=create_2)
# ---------- создание_листа.python (55 lines) ----------
import clr
clr.AddReference('RevitAPI')
from Autodesk.Revit.DB import StorageType, FilteredElementCollector, BuiltInCategory, View, Viewport, ViewSheet, XYZ, ScheduleSheetInstance, Options 

clr.AddReference("RevitServices")
import RevitServices
from RevitServices.Persistence import DocumentManager
from RevitServices.Transactions import TransactionManager

def param_value(element):
	mark_p = element.LookupParameter(FildName)
	if mark_p.StorageType == StorageType.String:
		mark = mark_p.AsString()
	elif mark_p.StorageType == StorageType.Double:
		mark = mark_p.AsDouble()
	elif mark_p.StorageType == StorageType.Integer:
		mark = mark_p.AsInteger()
	elif mark_p.StorageType == StorageType.ElementId:
		mark = mark_p.AsElementId()
	else:
		mark = ""
	return mark

doc = DocumentManager.Instance.CurrentDBDocument
new_sheet_list = []
test=[]

viewport_types = FilteredElementCollector(doc).OfCategory(BuiltInCategory.OST_ViewportLabel)


shedules = UnwrapElement(IN[1])
views = UnwrapElement(IN[2])
sections = UnwrapElement(IN[3])
Title_type = UnwrapElement(IN[4])
x = IN[5][0]
y = IN[5][1]

TransactionManager.Instance.EnsureInTransaction(doc)

for v,sh,se in zip(views,shedules,sections):
	new_sheet = ViewSheet.Create(doc, Title_type.Id);
	title_block = [tb for tb in FilteredElementCollector(doc).OwnedByView(new_sheet.Id).OfCategory(BuiltInCategory.OST_TitleBlocks)]
	bb = title_block[0].GetOriginalGeometry(Options()).GetBoundingBox()
	min = bb.Min
	max = bb.Max
	#new_sheet.Name = v.ViewName
	new_3d_vp = Viewport.Create(doc, new_sheet.Id, v.Id, XYZ(min.X/1.9,max.Y*1.5,0))#min)#XYZ(x,y,0))
	new_2d_vp = Viewport.Create(doc, new_sheet.Id, se.Id, XYZ(max.X*0.8,max.Y,0))#max)#XYZ(x/3,y-0.1,0))
	ScheduleSheetInstance.Create(doc, new_sheet.Id, sh.Id, XYZ(max.X*1.5,(max.Y)*1.9,0))#max)#XYZ(x+0.3,y+0.2,0))


	new_sheet_list.append(new_sheet)
TransactionManager.Instance.TransactionTaskDone()

OUT = views,sections,shedules,new_sheet_list
# ----------------------------------------
code_block_20 = CodeBlock { 0; 1; 2; 3; }
листы = List.GetItemAtIndex(list=создание_листа, index=code_block_20.out3)
code_block_21 = CodeBlock(prfx=прификс_для_группировки_в) { prfx+" Листы"; }
setParameterByName_6 = Element.SetParameterByName(element=листы, parameterName=имя_параметра_для_группировки, value=code_block_21)
code_block_22 = CodeBlock { "Имя листа"; }
code_block_23 = CodeBlock(all_name=code_block_4) { all_name; }
setParameterByName_7 = Element.SetParameterByName(element=setParameterByName_6, parameterName=code_block_22, value=code_block_23)
n3д_виды = List.GetItemAtIndex(list=создание_листа, index=code_block_20.out0)  # "3Д Виды"
code_block_24 = CodeBlock { "Имя вида"; }
setParameterByName_8 = Element.SetParameterByName(element=n3д_виды, parameterName=code_block_24, value=code_block_23)
n2д_виды = List.GetItemAtIndex(list=создание_листа, index=code_block_20.out1)  # "2Д Виды"
setParameterByName_9 = Element.SetParameterByName(element=n2д_виды, parameterName=code_block_24, value=code_block_23)
спецификации = List.GetItemAtIndex(list=создание_листа, index=code_block_20.out2)
setParameterByName_10 = Element.SetParameterByName(element=спецификации, parameterName=code_block_24, value=code_block_23)
