# Dynamo graph Создание фильтро 0.98.1.dyn (Dynamo 1.3.3.4111)

# note: ВСЁ ОСТАЛЬНОЕ

# group: КЛЮЧЕВЫЕ МОМЕНТЫ РАБОТЫ 2
# note: НОДЫ РАБОТАЮЩИЕ С ДАННЫМИ
# note: ИСПОЛНИТЕЛЬНЫЕ НОДЫ

# group: ЗАПАСНЫЕ ВАРИАНТЫ, ДОПОЛНИТЕЛЬНЫЕ ОПЦИИ
# note: ДОПОЛНИТЕЛЬНЫЕ. Градации серово по важности, темнее - важнее
# note: ЗАПАСНЫЕ

# group: КЛЮЧЕВЫЕ МОМЕНТЫ РАБОТЫ 1
# note: ИТОГОВАЯ КОНСОЛИДАЦИЯ ДАННЫХ

# group: ИСПОЛНИТЕЛЬНЫЕ НОДЫ (фильтрование, подбор, списки и т.д.)
# note: ИСПОЛНИТЕЛЬНЫЕ НОДЫ
# note: НОДЫ РАБОТАЮЩИЕ С ДАННЫМИ

# group: ЭЛЕМЕНТЫ УПРАВЛЕНИЯ 2 УРОВЕНЬ
# note: ПЕРЕМЕННЫЕ ЗНАЧЕНИЯ
# note: ЭЛЕМЕНТЫ УПРАВЛЕНИЯ

# group: ЭЛЕМЕНТЫ УПРАВЛЕНИЯ
# note: ПЕРЕМЕННЫЕ ЗНАЧЕНИЯ
# note: ЭЛЕМЕНТЫ УПРАВЛЕНИЯ

# group: ПРОВЕРОЧНЫЕ НОДЫ
# note: ПРОВЕРОЧНЫЕ НОДЫ

# group: ПЕРЕДАЁМ ИНФОРМАЦИЮ В РЕВИТ
# note: ПЕРЕДАЁМ ИНФОРМАЦИЮ В РЕВИТ

# group: ЭЛЕМЕНТЫ УПРАВЛЕНИЯ Dyno Studio
# note: Dyno Studio

# group: ПРИМЕЧАНИЯ ПО ЦВЕТОВОЙ ГРУППИРОВКЕ
# note: GUIDELINES

# group: ПОЛУЧАЕМ ДАННЫЕ ИЗ РЕВИТ
# note: ПОЛУЧАЕМ ДАННЫЕ ИЗ РЕВИТ

current = Document.Current()
activeView = Document.ActiveView(current)
t_своё_имя = BoolSelector(false)
шаблон_имени = StringInput("Шаблон имени")
code_block = CodeBlock { {"Equals","NotEquals","Greater","GreaterOrEquals","Less","LessOrEquals"}; }
fi_v = StringInput("")
all_elements_in_active_view = ElementsInView()
getCategory = Element.GetCategory(all_elements_in_active_view)
string_from_object = FromObject(getCategory)
categories = Categories("Floors")
string_from_object_2 = FromObject(categories)
eq = string_from_object == string_from_object_2
filterByBoolMask = List.FilterByBoolMask(list=all_elements_in_active_view, mask=eq)
lastItem = List.LastItem(filterByBoolMask.in)
firstItem = List.FirstItem(lastItem)
parameters = Element.Parameters(firstItem)
string_from_object_3 = FromObject(parameters)
code_block_2 = CodeBlock { ":"; }
split = String.Split(string_from_object_3, code_block_2)
transpose = List.Transpose(split)
code_block_3 = CodeBlock(param=transpose) { param[0]; }
trimTrailingWhitespace = String.TrimTrailingWhitespace(code_block_3)
uniqueItems = List.UniqueItems(trimTrailingWhitespace)
code_block_4 = CodeBlock { {"Семейство","Семейство и типоразмер"}; }
allIndicesOf = List.AllIndicesOf(list=uniqueItems, item=code_block_4)
flatten = Flatten(allIndicesOf)
removeItemAtIndex = List.RemoveItemAtIndex(list=uniqueItems, indices=flatten)
all_elements_of_category = ElementsOfCategory(categories)

# group: Убираем из списка витражи
code_block_5 = CodeBlock(x=string_from_object_2, t9=all_elements_of_category)
# ---------- code_block_5.designscript (8 lines) ----------
x == "Стены";
t3 = t9;
element1 = t3.ElementType;
t4 = element1.GetParameterValueByName("Имя семейства");
t5 = t4 == "Витраж";
t6 = DSCore.List.FilterByBoolMask(t3, t5);
t7 = __TryGetValueFromNestedDictionaries(t6, "in");
t8 = __TryGetValueFromNestedDictionaries(t6, "out");
# ----------------------------------------
if_ = Python(IN[0]=code_block_5.out0, IN[1]=all_elements_of_category, IN[2]=code_block_5.t8)
# ---------- if_.python (12 lines) ----------
import clr
boolean = IN[0]
true = UnwrapElement(IN[1])
false = UnwrapElement(IN[2])

if boolean:
	out = false
else:
	out = true

#Назначьте вывод переменной OUT.
OUT = out
# ----------------------------------------

getParameterValueByName = Element.GetParameterValueByName(element=if_, parameterName=removeItemAtIndex, lacing=CrossProduct)
string_from_object_4 = FromObject(getParameterValueByName)
transpose_2 = List.Transpose(string_from_object_4)
uniqueItems_2 = List.UniqueItems(transpose_2@L2)
count = List.Count(uniqueItems_2@L2)
code_block_6 = CodeBlock(param=removeItemAtIndex, count=count) { param+" = "+count; }
code_block_7 = CodeBlock { 1; }
gt = count > code_block_7
filterByBoolMask_2 = List.FilterByBoolMask(list=code_block_6, mask=gt)
filterByBoolMask_3 = List.FilterByBoolMask(list=count, mask=gt)
sortByKey = List.SortByKey(list=filterByBoolMask_2.in, keys=filterByBoolMask_3.in)
reverse = List.Reverse(sortByKey.sorted_list)

# group: DynoStudio.ShowDialog [Prorubim]
code_block_8 = CodeBlock { {"Черного","Белого","Крастного","Синего","Зелёного","Жёлтого"}; }
code_block_9 = CodeBlock { {"Белому","Черному","Зелёному","Крастному","Синему","Жёлтому"}; }
code_block_10 = CodeBlock(fi_r=code_block, fi_v=fi_v, t_fi=reverse, t1=reverse, rz=code_block_8, zs=code_block_9)
# ---------- code_block_10.designscript (4 lines) ----------
"Настройки";
{"fi_r","fi_v","filter_i","filters_graphics","rz","zs","zcut","zprojection","ms","execute","colors_type","new_parameter","param_name","transparency"};
to_list = {fi_r,fi_v,t_fi,t1,rz,zs,{true,false},{true,false},{"по параметру","по количеству"},{false,true},{false,true},{false,true},fi_v,1};
true;
# ----------------------------------------
showDialog = Prorubim.DynoNodes.DynoStudio.ShowDialog(code_block_10.out0, code_block_10.out1, code_block_10.to_list, code_block_10.out3)
code_block_11 = CodeBlock(fir=showDialog, fiv=showDialog, tfi=showDialog, t1=showDialog, rz=showDialog, zs=showDialog, zc=showDialog, zp=showDialog, ms=showDialog, ex=showDialog, ct=showDialog, np=showDialog, pn=showDialog, tr=showDialog) { fir[0]; fiv[1]; tfi[2]; t1[3]; rz[4]; zs[5]; zc[6]; zp[7]; ms[8]; ex[9]; ct[10]; np[11]; pn[12]; tr[13]; }
create = List.Create(code_block_11.out2, code_block_11.out3)
string_from_object_5 = FromObject(create)
code_block_12 = CodeBlock { " = "; }
split_2 = String.Split(string_from_object_5, code_block_12)
transpose_3 = List.Transpose(split_2)
code_block_13 = CodeBlock(param=transpose_3) { param[0]; }
trimTrailingWhitespace_2 = String.TrimTrailingWhitespace(code_block_13)
code_block_14 = CodeBlock(tfi=trimTrailingWhitespace_2, t1=trimTrailingWhitespace_2) { tfi[0]; t1[1]; }
code_block_15 = CodeBlock(fir=code_block_11.out0, fiv=code_block_11.out1) { fir; fiv; ""; }
watch = Watch(showDialog)

if_text = Python(IN[0]=code_block_11.out12, IN[1]=code_block_14.out1)
# ---------- if_text.python (10 lines) ----------
true = UnwrapElement(IN[0])
false = UnwrapElement(IN[1])

if true == "":
	out = false
else:
	out = true

#Назначьте вывод переменной OUT.
OUT = out
# ----------------------------------------
code_block_16 = CodeBlock(elements=filterByBoolMask.in) { elements; }

# group: Параметр 1
getParameterValueByName_2 = Element.GetParameterValueByName(element=code_block_16, parameterName=if_text, lacing=Longest)
if_type_famalytype_сборкаtype = Python(IN[0]=if_text, IN[1]=getParameterValueByName_2)
# ---------- if_type_famalytype_сборкаtype.python (21 lines) ----------
import clr

clr.AddReference("RevitNodes")
import Revit

clr.AddReference('RevitAPI')
from Autodesk.Revit.DB import *

test = UnwrapElement(IN[0])
varlist = UnwrapElement(IN[1])
nvl = []

if "Тип" in test:
	out = "Имя типа"
	for n in varlist:
		nvl.append(n.LookupParameter("Имя типа").AsString())
else:
	out = test
	nvl = varlist

OUT = nvl,out
# ----------------------------------------
code_block_17 = CodeBlock(elem_var=if_type_famalytype_сборкаtype, param_name=if_type_famalytype_сборкаtype) { elem_var[0]; param_name[1]; }
code_block_18 = CodeBlock { ""; }
ne = code_block_17.out0 != code_block_18
filterByBoolMask_4 = List.FilterByBoolMask(list=code_block_17.out0, mask=ne)
uniqueItems_3 = List.UniqueItems(filterByBoolMask_4.in)
parameterByName = Parameter.ParameterByName(element=code_block_16, name=code_block_17.out1, lacing=Longest)
filterByBoolMask_5 = List.FilterByBoolMask(list=parameterByName, mask=ne)
count_2 = List.Count(filterByBoolMask_5.in)
count_3 = List.Count(uniqueItems_3)
code_block_19 = CodeBlock(x=count_2, y=count_3) { x-y; }
dropItems = List.DropItems(list=filterByBoolMask_5.in, amount=code_block_19)
code_block_20 = CodeBlock { "Equals"; }
parameterType = Parameter.ParameterType(dropItems)
if_на_тип_параметра_конвертация = Python(IN[0]=parameterType, IN[1]=uniqueItems_3)
# ---------- if_на_тип_параметра_конвертация.python (56 lines) ----------
import clr

clr.AddReference('RevitAPI')
from Autodesk.Revit.DB import *

clr.AddReference('RevitServices')
import RevitServices
from RevitServices.Persistence import DocumentManager
from RevitServices.Transactions import TransactionManager

doc = DocumentManager.Instance.CurrentDBDocument
unit = doc.GetUnits()
gfo = str(unit.GetFormatOptions(UnitType.UT_Length).DisplayUnits)

test = IN[0][0]
values = UnwrapElement(IN[1])
feet = 304.8
sqr_foot = 0.09290304
cub_foot = 0.028316846592
conv_values = []
conv_values2 = []

def ff(x):
	for v in values:
		if test == "Length" and gfo == "DUT_METERS":
			conv_values.append(v/x*1000)
		else:
			conv_values.append(v/x)
	return conv_values

if test == "Length":
	ff(feet)
elif test == "Area":
	ff(sqr_foot)
elif test == "Volume":
	ff(cub_foot)
elif test == "Text":
	conv_values = values
elif test == "Invalid":
	if values[0].GetType().ToString() == "Autodesk.Revit.DB.Level":
		for v in values:
			conv_values.append(int(v.Id.ToString()))
	else:
		try:
			for v in values:
				conv_values.append(v.LookupParameter("Имя").AsString())
		except:
			try:
				for v in values:
					conv_values.append(v.LookupParameter("Имя типа").AsString())
			except:
				conv_values = values
else:
	conv_values = values

OUT = conv_values
# ----------------------------------------

# group: Создание имени фильтра вручную
count_4 = List.Count(uniqueItems_3)
code_block_21 = CodeBlock(x=count_4) { 1..x; }
code_block_22 = CodeBlock(S=шаблон_имени, x=code_block_21) { S+"_"+x; }

code_block_23 = CodeBlock { null; }
if_2 = Python(IN[0]=code_block_11.out11, IN[1]=dropItems, IN[2]=code_block_23, IN[3]=code_block_11.out9)
# ---------- if_2.python (13 lines) ----------
import clr
boolean = IN[0]
boolean2 = IN[3]
true = UnwrapElement(IN[1])
false = UnwrapElement(IN[2])

if boolean and boolean2:
	out = true
else:
	out = false

#Назначьте вывод переменной OUT.
OUT = out
# ----------------------------------------

# group: Создание нового параметра
code_block_24 = CodeBlock(p_name=if_text) { "s.p. "+p_name; "Other"; }
code_block_25 = CodeBlock(t2=if_2) { t1 = DSCore.List.FirstItem(t2); t3 = t1.ParameterType; t4 = t1.Group; }
if_invalid_param = Python(IN[0]=code_block_25.t3)
# ---------- if_invalid_param.python (9 lines) ----------
test = IN[0]


if test == "Invalid":
	out = "Text"
else:
	out = test

OUT = out
# ----------------------------------------
code_block_26 = CodeBlock { true; }
code_block_27 = CodeBlock(cat_list=categories) { cat_list; }

# group: Блокиратор выполнения
code_block_28 = CodeBlock { null; }
if_3 = Python(IN[0]=code_block_11.out11, IN[1]=code_block_24.out0, IN[2]=code_block_28)
# ---------- if_3.python (12 lines) ----------
import clr
boolean = IN[0]
true = UnwrapElement(IN[1])
false = UnwrapElement(IN[2])

if boolean:
	out = true
else:
	out = false

#Назначьте вывод переменной OUT.
OUT = out
# ----------------------------------------

# group (continued): Создание нового параметра
createProjectParameter = Parameter.CreateProjectParameter(if_3, code_block_24.out1, if_invalid_param, code_block_25.t4, code_block_26, code_block_27)

create_2 = List.Create(createProjectParameter, if_3)
end = Revit.Transaction.Transaction.End(create_2)
code_block_29 = CodeBlock(param=end) { param[1]; }
start = Revit.Transaction.Transaction.Start(code_block_29)
if_4 = Python(IN[0]=code_block_11.out11, IN[1]=start, IN[2]=if_text, IN[3]=code_block_11.out9)  # same code as if_2

# group: Генерируем имена фильтров
cycle = List.Cycle(list=if_4, amount=count_4)
code_block_30 = CodeBlock(param=cycle) { param; }
code_block_31 = CodeBlock(cat=string_from_object_2, param=code_block_30, value=uniqueItems_3) { "s.f. "+cat+" "+param+" "+value; }

t_авто_имя = BoolSelector(true)

# group: Проверяем наличие фильтра с таким именем
element_types = ElementTypes("ParameterFilterElement")
all_elements_of_type = ElementsOfType(element_types)
name = Element.Name(all_elements_of_type)
watch_2 = Watch(name)
проверка_существования_имени = Python(IN[0]=watch_2, IN[1]=code_block_31, IN[2]=t_авто_имя)  # "Проверка существования имени - WHILE !!!"
# ---------- проверка_существования_имени.python (29 lines) ----------
if IN[2]:
	filters = IN[0]
	new = IN[1]
	ok = []
	new2 = new
	test2 = []
	
	
	while len(new2) > 0:
		new3 = []
		for n in new2:
			test = []
			for f in filters:
				if n == f:
					test.append(True)
				else:
					test.append(False)
			if any(test):
				test2.append(True)
				new3.append(n+" (+1)")
			else:
				test2.append(False)
				ok.append(n)
		new2 = []
		new2 = new3	

	OUT = ok
else:
	pass
# ----------------------------------------

if_5 = Python(IN[0]=t_своё_имя, IN[1]=code_block_22, IN[2]=проверка_существования_имени)  # same code as if_3
byName = Category.ByName(string_from_object_2)

# group: Параметр 1
eq_2 = code_block_15.fiv == code_block_15.out2
code_block_32 = CodeBlock { 0; }
parameterByName_2 = Parameter.ParameterByName(element=code_block_16, name=code_block_14.out0, lacing=Longest)
parameterType_2 = Parameter.ParameterType(parameterByName_2)
create_3 = List.Create(code_block_15.fiv)
flatten_2 = Flatten(create_3)
if_на_тип_параметра_конвертация_2 = Python(IN[0]=parameterType_2, IN[1]=flatten_2)
# ---------- if_на_тип_параметра_конвертация_2.python (55 lines) ----------
import clr

clr.AddReference('RevitAPI')
from Autodesk.Revit.DB import *

clr.AddReference('RevitServices')
import RevitServices
from RevitServices.Persistence import DocumentManager
from RevitServices.Transactions import TransactionManager

doc = DocumentManager.Instance.CurrentDBDocument
unit = doc.GetUnits()
gfo = str(unit.GetFormatOptions(UnitType.UT_Length).DisplayUnits)

test = IN[0][0]
values = UnwrapElement(IN[1])
feet = 304.8
sqr_foot = 0.09290304
cub_foot = 0.028316846592
conv_values = []
conv_values2 = []

def ff(x):
	for v in values:
		conv_values.append(v/x)
	return conv_values

if test == "Length":
	ff(feet)
	if gfo == "DUT_METERS":
		conv_values[0] = conv_values[0]*1000
elif test == "Area":
	ff(sqr_foot)
elif test == "Volume":
	ff(cub_foot)
elif test == "Text":
	conv_values = values
elif test == "Invalid":
	if values[0].GetType().ToString() == "Autodesk.Revit.DB.Level":
		for v in values:
			conv_values.append(int(v.Id.ToString()))
	else:
		try:
			for v in values:
				conv_values.append(v.LookupParameter("Имя").AsString())
		except:
			try:
				for v in values:
					conv_values.append(v.LookupParameter("Имя типа").AsString())
			except:
				conv_values = values
else:
	conv_values = values

OUT = conv_values
# ----------------------------------------
byRuleType = Revit.Filter.FilterRule.ByRuleType(code_block_15.fir, if_на_тип_параметра_конвертация_2, parameterByName_2)
if_6 = Python(IN[0]=eq_2, IN[1]=code_block_32, IN[2]=byRuleType)  # same code as if_3

filterByBoolMask_6 = List.FilterByBoolMask(list=code_block_16, mask=ne)
if_на_тип_параметра_round = Python(IN[0]=filterByBoolMask_4.in)
# ---------- if_на_тип_параметра_round.python (15 lines) ----------
test = UnwrapElement(IN[0])
out = []

for t in test:
	if type(t).__name__ == "float":
		out.append(round(t, 2))
	else:
		try:
			t.LookupParameter("Имя").AsString()
			out.append(t.LookupParameter("Имя").AsString())
		except:
			out.append(t)


OUT = out
# ----------------------------------------
setParameterByName = Element.SetParameterByName(element=filterByBoolMask_6.in, parameterName=start, value=if_на_тип_параметра_round)
end_2 = Revit.Transaction.Transaction.End(setParameterByName)
start_2 = Revit.Transaction.Transaction.Start(end_2)
parameterByName_3 = Parameter.ParameterByName(element=start_2, name=start, lacing=Longest)
getParameterValueByName_3 = Element.GetParameterValueByName(element=start_2, parameterName=start, lacing=Longest)
code_block_33 = CodeBlock { ""; }
ne_2 = getParameterValueByName_3 != code_block_33
filterByBoolMask_7 = List.FilterByBoolMask(list=parameterByName_3, mask=ne_2)
count_5 = List.Count(filterByBoolMask_7.in)
filterByBoolMask_8 = List.FilterByBoolMask(list=getParameterValueByName_3, mask=ne_2)
uniqueItems_4 = List.UniqueItems(filterByBoolMask_8.in)
count_6 = List.Count(uniqueItems_4)
code_block_34 = CodeBlock(x=count_5, y=count_6) { x-y; }
dropItems_2 = List.DropItems(list=filterByBoolMask_7.in, amount=code_block_34)
parameterType_3 = Parameter.ParameterType(dropItems_2)
if_на_тип_параметра_конвертация_3 = Python(IN[0]=parameterType_3, IN[1]=uniqueItems_4)  # same code as if_на_тип_параметра_конвертация
if_7 = Python(IN[0]=code_block_11.out11, IN[1]=if_на_тип_параметра_конвертация_3, IN[2]=dropItems_2, IN[3]=if_на_тип_параметра_конвертация, IN[4]=dropItems)
# ---------- if_7.python (14 lines) ----------
import clr
boolean = IN[0]
new_value = UnwrapElement(IN[1])
new_param = UnwrapElement(IN[2])
old_value = UnwrapElement(IN[3])
old_param = UnwrapElement(IN[4])

if boolean:
	out = [new_value,new_param]
else:
	out = [old_value,old_param]

#Назначьте вывод переменной OUT.
OUT = out
# ----------------------------------------
code_block_35 = CodeBlock(value=if_7, param=if_7) { value[0]; param[1]; }

# group (continued): Параметр 1
byRuleType_2 = Revit.Filter.FilterRule.ByRuleType(code_block_20, code_block_35.out0, code_block_35.out1)

# group: Блокиратор выполнения execute +-
code_block_36 = CodeBlock { null; }
if_8 = Python(IN[0]=code_block_11.out9, IN[1]=byRuleType_2, IN[2]=code_block_36)  # same code as if_3

# group: Если параметр текстовый, для него создаётся массив чисел, для генерирования цвета
count_7 = List.Count(code_block_35.out0)
code_block_37 = CodeBlock(x=count_7) { 0..x; }
if_9 = Python(IN[0]=uniqueItems_3, IN[1]=code_block_35.out0, IN[2]=code_block_37)
# ---------- if_9.python (23 lines) ----------
import clr
string = UnwrapElement(IN[0])
number = UnwrapElement(IN[1])
floatarray = UnwrapElement(IN[2])
booleans = []

for s in string:
	if type(s) == float:
		booleans.append("true")
	else:
		booleans.append("false")
"""
for s in string:
	s1 = str(s)
	booleans.append(s1.isdigit())
"""
for boolean in booleans:
	if boolean == "true":
		out = number
	else:
		out = floatarray

OUT = out
# ----------------------------------------
forceChildrensEval = ForceChildrensEval()  # unwired: arg0
if_массив_по_параметру_массив_по = Python(IN[0]=code_block_11.out8, IN[1]=if_9, IN[2]=code_block_37, IN[3]=forceChildrensEval)  # "if (массив по параметру, массив по количеству)"
# ---------- if_массив_по_параметру_массив_по.python (11 lines) ----------
boolean = IN[0]
true = UnwrapElement(IN[1])
false = UnwrapElement(IN[2])

if boolean == "по параметру":
	out = true
else:
	out = false

#Назначьте вывод переменной OUT.
OUT = out
# ----------------------------------------

# group: Определяем графику
forceChildrensEval_2 = ForceChildrensEval()  # unwired: arg0
code_block_38 = CodeBlock(rz=code_block_11.out4, zs=code_block_11.out5) { rz; zs; }
code_block_39 = CodeBlock()
# ---------- code_block_39.designscript (6 lines) ----------
color_red = Color.ByARGB(255, 255, 0, 0);
color_green = Color.ByARGB(255, 0, 255, 0);
color_blue = Color.ByARGB(255, 0, 0, 255);
color_yellow = Color.ByARGB(255, 255, 255, 0);
color_white = Color.ByARGB(255, 255, 255, 255);
color_black = Color.ByARGB(255, 0, 0, 0);
# ----------------------------------------
create_4 = List.Create(code_block_39.color_red, code_block_39.color_green, code_block_39.color_blue, code_block_39.color_yellow, code_block_39.color_white, code_block_39.color_black)
if_на_цвет = Python(IN[0]=forceChildrensEval_2, IN[1]=code_block_38.rz, IN[2]=code_block_38.zs, IN[3]=create_4)
# ---------- if_на_цвет.python (48 lines) ----------
d0 = 0
d255 = 255
rzt = IN[1]
zst = IN[2]
red = IN[3][0]
green = IN[3][1]
blue = IN[3][2]
yellow = IN[3][3]
white = IN[3][4]
black = IN[3][5]
colors = []
ind = []
#d = dict.fromkeys(IN[10], IN[11])


if rzt == "Черного":
	colors.append(black)
elif rzt == "Белого":
	colors.append(white)	
elif rzt == "Крастного":
	colors.append(red)
elif rzt == "Синего":
	colors.append(blue)
elif rzt == "Зелёного":
	colors.append(green)
elif rzt == "Жёлтого":
	colors.append(yellow)	
else:
	pass

if zst == "Белому":
	colors.append(white)
elif zst == "Черному":
	colors.append(black)
elif zst == "Зелёному":
	colors.append(green)
elif zst == "Крастному":
	colors.append(red)
elif zst == "Синему":
	colors.append(blue)
elif zst == "Жёлтому":
	colors.append(yellow)	
else:
	pass



OUT = colors
# ----------------------------------------
code_block_40 = CodeBlock(colors=if_на_цвет) { colors; 0..1; }
flatten_3 = Flatten(if_массив_по_параметру_массив_по)
code_block_41 = CodeBlock { 0; 1; }
remapRange = Math.RemapRange(numbers=flatten_3, newMin=code_block_41.out0, newMax=code_block_41.out1)
color_range = ColorRange(code_block_40.colors, code_block_40.out1, remapRange)
shuffle = List.Shuffle(remapRange)
color_range_2 = ColorRange(arg2=shuffle)  # unwired: arg0, arg1
if_10 = Python(IN[0]=code_block_11.out10, IN[1]=color_range, IN[2]=color_range_2)
# ---------- if_10.python (12 lines) ----------
import clr
boolean = IN[0]
true = UnwrapElement(IN[2])
false = UnwrapElement(IN[1])

if boolean:
	out = true
else:
	out = false

#Назначьте вывод переменной OUT.
OUT = out
# ----------------------------------------
fill_patterns = FillPatterns("Сплошная заливка")
if_11 = Python(IN[0]=code_block_11.out6, IN[1]=code_block_11.out7, IN[2]=fill_patterns)
# ---------- if_11.python (20 lines) ----------
import clr
cut = IN[0]
projection = IN[1]
pattern = IN[2]
cutp = []
projp = []

if cut:
	cutp = pattern
else:
	pass

if projection:
	projp = pattern
else:
	pass


#Назначьте вывод переменной OUT.
OUT = cutp,projp
# ----------------------------------------
code_block_42 = CodeBlock(cut=if_11, projection=if_11, transparency=code_block_11.out13) { cut[0]; projection[1]; transparency; }
byProperties = Revit.Filter.OverrideGraphicSettings.ByProperties(if_10, if_10, arg4=code_block_42.out0, arg5=code_block_42.out1, arg10=code_block_42.transparency)

# group: Если не разбить на списки, в каждом фильтре будут все значения
create_5 = List.Create()  # unwired: arg0
map = List.Map(list=if_5, f_x=create_5)
map_2 = List.Map(list=if_8, f_x=create_5)
count_8 = List.Count(map_2@L3)
map_3 = List.Map(list=byProperties, f_x=create_5)

# group: определяем есть ли исключающий фильтр
code_block_43 = CodeBlock(excepting_filter=if_6) { excepting_filter; }
join = List.Join()  # unwired: arg0, arg1

ofRepeatedItem = List.OfRepeatedItem(item=code_block_43, amount=count_8)
flatten_4 = Flatten(ofRepeatedItem)

# group (continued): Если не разбить на списки, в каждом фильтре будут все значения
map_4 = List.Map(list=flatten_4, f_x=create_5)

# group (continued): определяем есть ли исключающий фильтр
combine = List.Combine(join, map_4, map_2)
if_12 = Python(IN[0]=code_block_43, IN[1]=map_2, IN[2]=combine)
# ---------- if_12.python (12 lines) ----------
import clr
boolean = IN[0]
true = UnwrapElement(IN[1])
false = UnwrapElement(IN[2])

if boolean == 0:
	out = true
else:
	out = false

#Назначьте вывод переменной OUT.
OUT = out
# ----------------------------------------

byRules = Revit.Filter.ParameterFilterElement.ByRules(map, byName, if_12)
addFilter = View.AddFilter(activeView, byRules)
видимость_вкл_выкл = BoolSelector(true)
setFilterOverrides = View.SetFilterOverrides(view=addFilter, parameterFilter=byRules, overrides=map_3, hide=видимость_вкл_выкл)
formTabs = StringInput("Параметры для формирования фильтров")
z_projection_line_patterns = LinePatterns()
z_halftone = BoolSelector(false)
z_detail_level = DetailLevel()
z_transparency = IntegerSlider(1, range=0..100 step 1)
z_projectionlineweight = IntegerSlider(1, range=1..16 step 1)
z_cutlineweight = IntegerSlider(1, range=1..16 step 1)
z_cut_line_patterns = LinePatterns()
z_projection_fill_patterns = FillPatterns()
z_cut_fill_patterns = FillPatterns()
byARGB = Color.ByARGB()
z_сгенерировать_cutfillcolor = BoolSelector(true)
z_сгенерировать = BoolSelector(true)  # "z) сгенерировать projectionFillColor"
z_сгенерировать_2 = BoolSelector(false)  # "z) сгенерировать projectionLineColor"
z_сгенерировать_cutlinecolor = BoolSelector(false)
code_block_44 = CodeBlock { {"Крастного","Синего","Зелёного"}; }
code_block_45 = CodeBlock { {"Зелёному","Крастному","Синему"}; }
code_block_46 = CodeBlock { {"Один тон","От светлого к темному","От темного к светлому"}; }
code_block_47 = CodeBlock()
# ---------- code_block_47.designscript (2 lines) ----------
{"red","green","blue","yellow","white","black"};
{Color.ByARGB(255, 255, 0, 0),Color.ByARGB(255, 0, 255, 0),Color.ByARGB(255, 0, 0, 255),Color.ByARGB(255, 255, 255, 0),Color.ByARGB(255, 255, 255, 255),Color.ByARGB(255, 0, 0, 0)};
# ----------------------------------------
