# Dynamo graph Автовырезание шахт из перекрытий.dyn (Dynamo 1.3.3.4651)

# group: Элементы геометрии внутри динамо, для визуальной проверки
geometry = Element.Geometry()  # unwired: arg0
geometry_2 = Element.Geometry()  # unwired: arg0

forceChildrensEval = ForceChildrensEval()  # unwired: arg0
categories = Categories("Floors")
all_elements_of_category = ElementsOfCategory(categories)
code_block = CodeBlock(Flor=all_elements_of_category) { Flor; }
categories_2 = Categories("SpecialityEquipment")
all_elements_of_category_2 = ElementsOfCategory(categories_2)
code_block_2 = CodeBlock(shaft=all_elements_of_category_2) { shaft; }
вырезание_геометрии_отмена = BoolSelector(true)  # "Вырезание геометрии/Отмена вырезания"
python_script = Python(IN[0]=forceChildrensEval, IN[1]=code_block, IN[2]=code_block_2, IN[3]=вырезание_геометрии_отмена)
# ---------- python_script.python (32 lines) ----------
if IN[3] == False:
	import clr

clr.AddReference('RevitAPI')
import Autodesk

clr.AddReference('RevitServices')
import RevitServices
from RevitServices.Persistence import DocumentManager
from RevitServices.Transactions import TransactionManager

dataEnteringNode = IN

reset = IN[0]
items1 = UnwrapElement(IN[1])
items2 = UnwrapElement(IN[2])

doc = DocumentManager.Instance.CurrentDBDocument

results = []

TransactionManager.Instance.EnsureInTransaction(doc)
for item1 in items1:
	for item2 in items2:
		try:
			result = Autodesk.Revit.DB.InstanceVoidCutUtils.RemoveInstanceVoidCut(doc,item1,item2)
			results.append(result)
		except:
			pass
TransactionManager.Instance.TransactionTaskDone()

OUT = results
# ----------------------------------------
python_script_2 = Python(IN[0]=forceChildrensEval, IN[1]=code_block, IN[2]=code_block_2, IN[3]=вырезание_геометрии_отмена)
# ---------- python_script_2.python (25 lines) ----------
if IN[3] == True:
	import clr

clr.AddReference('RevitAPI')
import Autodesk

clr.AddReference('RevitServices')
import RevitServices
from RevitServices.Persistence import DocumentManager
from RevitServices.Transactions import TransactionManager

reset = IN[0]
items1 = UnwrapElement(IN[1])
items2 = UnwrapElement(IN[2])

doc = DocumentManager.Instance.CurrentDBDocument

TransactionManager.Instance.EnsureInTransaction(doc)
for item1 in items1:
	for item2 in items2:
		try:
			result = Autodesk.Revit.DB.InstanceVoidCutUtils.AddInstanceVoidCut(doc,item1,item2)
		except:
			pass
TransactionManager.Instance.TransactionTaskDone()
# ----------------------------------------
