# Dynamo graph Пересечение потолка и инжинерии0.4.dyn (Dynamo 1.3.1.1736)

# group: КЛЮЧЕВЫЕ МОМЕНТЫ РАБОТЫ
# note: ИТОГОВАЯ КОНСОЛИДАЦИЯ ДАННЫХ

# group: ЗАПАСНЫЕ ВАРИАНТЫ, ДОПОЛНИТЕЛЬНЫЕ ОПЦИИ
# note: ДОПОЛНИТЕЛЬНЫЕ. Градации серово по важности, темнее - важнее
# note: ЗАПАСНЫЕ

# group: ИСПОЛНИТЕЛЬНЫЕ НОДЫ (фильтрование, подбор, списки и т.д.)
# note: НОДЫ РАБОТАЮЩИЕ С ДАННЫМИ
# note: ИСПОЛНИТЕЛЬНЫЕ НОДЫ

# group: ПРОВЕРОЧНЫЕ НОДЫ
# note: ПРОВЕРОЧНЫЕ НОДЫ

# group: ПЕРЕДАЁМ ИНФОРМАЦИЮ В РЕВИТ
# note: ПЕРЕДАЁМ ИНФОРМАЦИЮ В РЕВИТ

# group: ПЕРЕМЕННЫЕ ЗНАЧЕНИЯ
# note: ПЕРЕМЕННЫЕ ЗНАЧЕНИЯ

# group: ПРИМЕЧАНИЯ ПО ЦВЕТОВОЙ ГРУППИРОВКЕ
# note: GUIDELINES

# group: ПОЛУЧАЕМ ДАННЫЕ ИЗ РЕВИТ
# note: ПОЛУЧАЕМ ДАННЫЕ ИЗ РЕВИТ

категория_в_данной_модели = Categories("Ceilings")
all_elements_of_category = ElementsOfCategory(категория_в_данной_модели)
watch = Watch(all_elements_of_category)
getFromLinkedFile = Custom[Element.GetFromLinkedFile]()  # Get elements from link document instance based on category; unwired: Link_Instance, Link_Document, Category
get_documents = Custom[Get Documents]()  # Queries all linked Revit files and retrieves their Name, LinkInstance and Document properties.
# note: ВСЁ ОСТАЛЬНОЕ
empty = List.Empty()
# note: НОДЫ СОБИРАЮТ СВЯЗАННЫЕ ФАЙЛЫ
python_script = Python(IN[0]=empty)
# ---------- python_script.python (50 lines) ----------
#Copyright(c) 2015, Konrad K Sobon
# @arch_laboratory, http://archi-lab.net

# Huge thanks to Andreas Dieckmann for 
# adding link path functionality

import clr
clr.AddReference('ProtoGeometry')
from Autodesk.DesignScript.Geometry import *

# Import DocumentManager and TransactionManager
clr.AddReference("RevitServices")
import RevitServices
from RevitServices.Persistence import DocumentManager
from RevitServices.Transactions import TransactionManager

from System.Collections.Generic import *

# Import RevitAPI
clr.AddReference("RevitAPI")
import Autodesk
from Autodesk.Revit.DB import *
from Autodesk.Revit.DB.Analysis import *

doc = DocumentManager.Instance.CurrentDBDocument
uiapp = DocumentManager.Instance.CurrentUIApplication
app = uiapp.Application

# Import ToDSType(bool) extension method
clr.AddReference("RevitNodes")
import Revit
clr.ImportExtensions(Revit.Elements)

#The inputs to this node will be stored as a list in the IN variable.
dataEnteringNode = IN

collector = Autodesk.Revit.DB.FilteredElementCollector(doc)
linkInstances = collector.OfClass(Autodesk.Revit.DB.RevitLinkInstance)

linkDoc, linkName, linkPath = [], [], []
for i in linkInstances:
	linkDoc.append(i.GetLinkDocument())
	linkName.append(i.Name)
	try:
		linkPath.append(i.GetLinkDocument().PathName)
	except:
		linkPath.append(None)
		pass

OUT = linkDoc, linkName, linkInstances, linkPath
# ----------------------------------------
number = DoubleInput(1)
getItemAtIndex = List.GetItemAtIndex(list=python_script, index=number)
code_block = CodeBlock(Link_Name=getItemAtIndex) { Link_Name; }
number_2 = DoubleInput(3)
getItemAtIndex_2 = List.GetItemAtIndex(list=python_script, index=number_2)
code_block_2 = CodeBlock(Link_Path=getItemAtIndex_2) { Link_Path; }
номер_связанного_файла_0_если = CodeBlock { 2; }  # "НОМЕР СВЯЗАННОГО ФАЙЛА (0 если связь одна)"
number_3 = DoubleInput(2)
getItemAtIndex_3 = List.GetItemAtIndex(list=python_script, index=number_3)
code_block_3 = CodeBlock(Link_Instance=getItemAtIndex_3) { Link_Instance; }
number_4 = DoubleInput(0)
getItemAtIndex_4 = List.GetItemAtIndex(list=python_script, index=number_4)
code_block_4 = CodeBlock(Link_Doc=getItemAtIndex_4) { Link_Doc; }
# note: ПОЛУЧАЕМ ЭЛЕМЕНТЫ ИЗ СВЯЗАННОЙ МОДЕЛИ
code_block_5 = CodeBlock(x=номер_связанного_файла_0_если, LI=code_block_3, LD=code_block_4) { x; LI[x]; LD[x]; }
code_block_6 = CodeBlock(Link_Document=code_block_5.out2) { Link_Document; }
firstItem = List.FirstItem(code_block_6)
категория_в_связанной_модели = Categories("DuctCurves")
code_block_7 = CodeBlock(Categori=категория_в_связанной_модели) { Categori; }
code_block_8 = CodeBlock(Link_Instance=code_block_5.out1) { Link_Instance; }
python_script_2 = Python(IN[0]=firstItem, IN[1]=code_block_7, IN[2]=code_block_8)
# ---------- python_script_2.python (46 lines) ----------
#python nodes in dynamo 1.0
#proposed by Julien Benoit @jbenoit44 
#http://aecuandme.wordpress.com/
import System
import clr
clr.AddReference('ProtoGeometry')
from Autodesk.DesignScript.Geometry import *
# Import ToDSType(bool) extension method
clr.AddReference("RevitNodes")
import Revit
clr.ImportExtensions(Revit.Elements)
# Import geometry conversion extension methods
clr.ImportExtensions(Revit.GeometryConversion)
# Import DocumentManager and TransactionManager
clr.AddReference("RevitServices")
import RevitServices
from RevitServices.Persistence import DocumentManager
from RevitServices.Transactions import TransactionManager
from System.Collections.Generic import *
# Import RevitAPI
clr.AddReference("RevitAPI")
import Autodesk
from Autodesk.Revit.DB import *

doc = DocumentManager.Instance.CurrentDBDocument
uiapp = DocumentManager.Instance.CurrentUIApplication
app = uiapp.Application
uidoc=DocumentManager.Instance.CurrentUIApplication.ActiveUIDocument

LinkDoc=IN[0]
cat = IN[1]
LinkInst = IN[2]

BuiltIn = System.Enum.ToObject(BuiltInCategory, cat.Id)

elementlist = []
typelist=[]
T = []


collector = FilteredElementCollector(LinkDoc)
filter = ElementCategoryFilter(BuiltIn)
list=collector.WherePasses(filter).WhereElementIsNotElementType().ToElements()


OUT = list
# ----------------------------------------
code_block_9 = CodeBlock(Elemnts=python_script_2) { Elemnts; }
# note: ОТФИЛЬТРОВЫВАЕМ НЕОБХОДИМОЕ
code_block_10 = CodeBlock { "Уровень"; "Комментарии"; "ПроездыМашины"; "Comments"; }
getParameterValueByName = Element.GetParameterValueByName(element=all_elements_of_category, parameterName=code_block_10.out1)
eq = getParameterValueByName == code_block_10.out2
filterByBoolMask = List.FilterByBoolMask(list=all_elements_of_category, mask=eq)
faces = Element.Faces(filterByBoolMask.in)
flatten = Flatten(faces)
solids = Element.Solids(code_block_9)
flatten_2 = Flatten(solids)
# note: ПОЛУЧЕНИЕ ЭЛЕМЕНТОВ ПОПАВШИХ В ПЕРЕСЕЧЕНИЕ
doesIntersect = Geometry.DoesIntersect(geometry=flatten, other=flatten_2, lacing=CrossProduct)
flatten_3 = Flatten(doesIntersect)
uniqueItems = List.UniqueItems(flatten_3)
code_block_11 = CodeBlock(a=uniqueItems) { a[1]; }
allIndicesOf = List.AllIndicesOf(list=doesIntersect, item=code_block_11, lacing=CrossProduct)
flatten_4 = Flatten(allIndicesOf)
getItemAtIndex_5 = List.GetItemAtIndex(list=code_block_9, index=flatten_4)
# note: МОЖНО ЗАБРАТЬ ИЗ ВОЗДУХОВОДОВ ПАРАМЕТРЫ И ОТПРАВИТЬ ИХ В ОТЧЁТ
firstItem_2 = List.FirstItem(getItemAtIndex_5)
parameters = Element.Parameters(firstItem_2)
# note: Цветовая схема
round = Math.Round()  # unwired: arg0
minimumItem = List.MinimumItem(round)
maximumItem = List.MaximumItem(round)
code_block_12 = CodeBlock { 0; 1; }
remapRange = Math.RemapRange(numbers=round, newMin=code_block_12.out0, newMax=code_block_12.out1)
code_block_13 = CodeBlock(x=remapRange) { 1-x; }
color_range = ColorRange(arg2=code_block_13)  # unwired: arg0, arg1
# note: ПЕРЕСЕЧЕНИЕ, ПРИ БОЛЬШОМ КОЛИЧЕСТВЕ ЭЛЕМЕНТОВ БУДЕТ КОЛАПАС
intersect = Geometry.Intersect(geometry=flatten, other=flatten_2, lacing=CrossProduct)  # frozen
категория_в_связанной_модели_2 = Categories("PipeCurves")
категория_в_связанной_модели_3 = Categories("CableTray")
семейство_для_размещения_в_месте = FamilyTypes("Маркер_коллизии:Маркер_коллизии")  # "СЕМЕЙСТВО ДЛЯ РАЗМЕЩЕНИЯ В МЕСТЕ ПЕРЕСЕЧЕНИЯ"
allFalse = AllFalse(doesIntersect, lacing=Longest)
filterByBoolMask_2 = List.FilterByBoolMask(list=flatten, mask=allFalse)
solids_2 = Element.Solids(getItemAtIndex_5)
flatten_5 = Flatten(solids_2)
intersect_2 = Geometry.Intersect(geometry=filterByBoolMask_2.out, other=flatten_5, lacing=CrossProduct)
# note: ПОЛУЧАЕМ ТОЧКИ И ГАБАРИТЫ ДЛЯ СЕМЕЙСТВА
clean = List.Clean(list=intersect_2@L1)
flatten_6 = Flatten(clean)
code_block_14 = CodeBlock { 0.5; }
pointAtParameter = Surface.PointAtParameter(surface=flatten_6, u=code_block_14, v=code_block_14)
byPoint = FamilyInstance.ByPoint(familyType=семейство_для_размещения_в_месте, point=pointAtParameter)
code_block_15 = CodeBlock { "Hi"; "Wi"; }
perimeterCurves = Surface.PerimeterCurves(flatten_6)
transpose = List.Transpose(perimeterCurves)
code_block_16 = CodeBlock(a=transpose) { a[0]; a[1]; }
length = Curve.Length(code_block_16.out0)
setParameterByName = Element.SetParameterByName(element=byPoint, parameterName=code_block_15.out0, value=length)
length_2 = Curve.Length(code_block_16.out1)
setParameterByName_2 = Element.SetParameterByName(element=setParameterByName, parameterName=code_block_15.out1, value=length_2)
code_block_17 = CodeBlock { "Комементарии"; }
string_from_object = FromObject(code_block_7)
count = List.Count(byPoint)
ofRepeatedItem = List.OfRepeatedItem(item=string_from_object, amount=count)
setParameterByName_3 = Element.SetParameterByName(element=setParameterByName_2, parameterName=code_block_17, value=ofRepeatedItem)
