# Dynamo graph 1.ИЗ ПАРАМЕТРА В ПАРАМЕТР.dyn (Dynamo 1.3.1.1736)

categories = Categories("Rooms")
all_elements_of_category = ElementsOfCategory(categories)
в_параметр = StringInput("Площадь на 27.07.2018")
forceChildrensEval = ForceChildrensEval()  # unwired: arg0
из_параметра = StringInput("Площадь")
getParameterValueByName = Element.GetParameterValueByName(element=all_elements_of_category, parameterName=из_параметра)
заменяем_пустоту_на_0 = Python(IN[0]=forceChildrensEval, IN[1]=getParameterValueByName)
# ---------- заменяем_пустоту_на_0.python (12 lines) ----------
import clr

list = IN[1]
new_list = []

for i in list:
	if len(str(i)) == 0:
		new_list.append(0)
	else:
		new_list.append(i)

OUT = new_list
# ----------------------------------------
setParameterByName = Element.SetParameterByName(element=all_elements_of_category, parameterName=в_параметр, value=заменяем_пустоту_на_0)
