# Dynamo graph 1.Из Excel в параметры помещений, по автостоянке.dyn (Dynamo 1.3.3.4111)

# note: Смотрим для проверки получаймых данных.
# Последовательность данных должна быть такая же, как в выбраных элементах. Не должно быть смешения данных между списками

# group: КЛЮЧЕВЫЕ МОМЕНТЫ РАБОТЫ 1
# note: КОНСОЛИДАЦИЯ И СЛОЖНЫЕ ОБРАБОТКИ

# group: ЗАПАСНЫЕ ВАРИАНТЫ, ДОПОЛНИТЕЛЬНЫЕ ОПЦИИ
# note: ЗАПАСНЫЕ
# note: ДОПОЛНИТЕЛЬНЫЕ. Градации серово по важности, темнее - важнее

# group: КЛЮЧЕВЫЕ МОМЕНТЫ РАБОТЫ 2
# note: УСЛОЖНЕННЫЕ КОНСТРУКЦИИ
# note: УСЛОЖНЕНЫЕ КОНСТРУКЦИИ

# group: Python ноды
# note: Python

# group: Запуск питона из внешнего файла
# note: Py - files

# group: ЭЛЕМЕНТЫ УПРАВЛЕНИЯ
# note: ПЕРЕМЕННЫЕ ЗНАЧЕНИЯ
# note: ЭЛЕМЕНТЫ УПРАВЛЕНИЯ

# group: ПОЛУЧАЕМ ДАННЫЕ
# note: ПОЛУЧАЕМ ДАННЫЕ ИЗ РЕВИТ и других источников

# group: ПРОВЕРОЧНЫЕ НОДЫ
# note: ПРОВЕРОЧНЫЕ НОДЫ

# group: ИСПОЛНИТЕЛЬНЫЕ НОДЫ (фильтрование, подбор, списки и т.д.)
# note: ИСПОЛНИТЕЛЬНЫЕ НОДЫ

# group: ПЕРЕДАЁМ ИНФОРМАЦИЮ
# note: ПЕРЕДАЁМ ИНФОРМАЦИЮ В РЕВИТ
# note: ПЕРЕДАЁМ ИНФОРМАЦИЮ ЕЩЁ КУДА-ТО

# group: ПРИМЕЧАНИЯ ПО ЦВЕТОВОЙ ГРУППИРОВКЕ
# note: GUIDELINES

# group: ЭЛЕМЕНТЫ УПРАВЛЕНИЯ 2 УРОВЕНЬ
# note: ЭЛЕМЕНТЫ УПРАВЛЕНИЯ
# note: ПЕРЕМЕННЫЕ ЗНАЧЕНИЯ

путь_к_файлу_excel = Filename("..\..\..\..\..\Pictures\ИСКРА-ПАРК\ведомость помещений автостоянки.xlsx")
fromPath = FileObject(путь_к_файлу_excel)  # "File.FromPath"
имя_листа = StringInput("Лист3")
readFromFile = Excel.ReadFromFile(file=fromPath, sheetName=имя_листа)
py_clear_убираем_пустоту_и = Python(IN[0]=readFromFile)  # "py.Clear ++ (Убираем пустоту и одинарные списки)"
# ---------- py_clear_убираем_пустоту_и.python (27 lines) ----------
import clr

def ClearList(_list):
    out = []
    for _list1 in _list:
        if _list1 is None:
            continue
        if isinstance(_list1, list):
             _list1 = ClearList(_list1)
             if not _list1:
                 continue
        out.append(_list1)
    return out

newlist1 = ClearList(IN[0])
newlist2 = []

for list in newlist1:
	if len(list) == 2:
		if "a" in list[0]:
			newlist2.append(list)
		else:
			pass
	else:
		pass
		
OUT = newlist2
# ----------------------------------------
transpose = List.Transpose(readFromFile)
code_block = CodeBlock(nember=transpose, name=transpose, area=transpose, kat=transpose, otd=transpose) { nember[0]; name[1]; area[2]; kat[3]; otd[4]; }
номера_помещений_из_спецификации = String.TrimWhitespace(code_block.out0)
code_block_2 = CodeBlock { "."; }
split = String.Split(номера_помещений_из_спецификации, code_block_2)
transpose_2 = List.Transpose(split)
code_block_3 = CodeBlock(x=transpose_2, y=transpose_2, k=transpose_2, e=transpose_2, n=transpose_2) { x[0]+"."+y[1]+"."+k[2]+e[3]+"."+n[4]; }
запуск = BoolSelector(false)
categories = Categories("Rooms")
all_elements_of_category = ElementsOfCategory(categories)
code_block_4 = CodeBlock { "Уровень"; "Комментарии"; "Площадь"; }
getParameterValueByName = Element.GetParameterValueByName(element=all_elements_of_category, parameterName=code_block_4.out0)
levels = Levels("Этаж -3")
name = Level.Name(levels)
code_block_5 = CodeBlock(x=getParameterValueByName, y=name) { x==y; }
filterByBoolMask = List.FilterByBoolMask(list=all_elements_of_category, mask=code_block_5)
code_block_6 = CodeBlock(x=filterByBoolMask.in) { x; }
getParameterValueByName_2 = Element.GetParameterValueByName(element=code_block_6, parameterName=code_block_4.out1)
code_block_7 = CodeBlock { "Машиноместо"; }
code_block_8 = CodeBlock(x=getParameterValueByName_2, y=code_block_7) { x==y; }
filterByBoolMask_2 = List.FilterByBoolMask(list=code_block_6, mask=code_block_8)
code_block_9 = CodeBlock { "Номер"; }
getParameterValueByName_3 = Element.GetParameterValueByName(element=filterByBoolMask_2.out, parameterName=code_block_9)
code_block_10 = CodeBlock { "."; }
split_2 = String.Split(getParameterValueByName_3, code_block_10)
transpose_3 = List.Transpose(split_2)
code_block_11 = CodeBlock(x=transpose_3) { x[2]; x[3]; }
groupByKey = List.GroupByKey(list=filterByBoolMask_2.out, keys=code_block_11.out0)
groupByKey_2 = List.GroupByKey(list=code_block_11.out1, keys=code_block_11.out0)
toNumber = String.ToNumber(groupByKey_2.groups)
sortByKey = List.SortByKey(list=groupByKey.groups@L2, keys=toNumber@L2)
flatten = Flatten(sortByKey.sorted_list)
code_block_12 = CodeBlock { "АБН_Площадь М/м по П"; "Вместимость"; "АБН_Площадь по стадии П"; "Имя"; "ADSK_Категория помещения"; "АБН_Тип отделки"; }
запись_в_параметры = BoolSelector(true)
watch = Watch(code_block.out4)
code_block_13 = CodeBlock { ""; }
isNull = Object.IsNull()  # unwired: arg0
replaceByCondition = Replace(watch, code_block_13, isNull)
watch_2 = Watch(replaceByCondition)
to = String.TrimWhitespace(watch_2)  # "String.To"
code_block_14 = CodeBlock(value=to) { value; null; }
if_ = Python(IN[0]=запись_в_параметры, IN[1]=code_block_14.value, IN[2]=code_block_14.out1)
# ---------- if_.python (12 lines) ----------
import clr
boolean = IN[0]
true = UnwrapElement(IN[1])
false = UnwrapElement(IN[2])

if boolean:
	out = true
else:
	out = false

#Назначьте вывод переменной OUT.
OUT = out
# ----------------------------------------
setParameterByName = Element.SetParameterByName(element=flatten, parameterName=code_block_12.out5, value=if_)
python_script = Python()  # frozen; unwired: IN[0], IN[1], IN[2], IN[3], IN[4]
# ---------- python_script.python (54 lines) ----------
if IN[4]:
	import clr

	clr.AddReference('RevitAPI')
	import Autodesk
	from Autodesk.Revit.DB import *

	clr.AddReference('RevitServices')
	import RevitServices
	from RevitServices.Persistence import DocumentManager
	from RevitServices.Transactions import TransactionManager

	from time import time
	tic = time()

	doc = DocumentManager.Instance.CurrentDBDocument

	number = IN[0]
	area = IN[1]
	param_get = IN[2]
	param_set = IN[3]
	d = {}

	rooms_list = FilteredElementCollector(doc).OfCategory(BuiltInCategory.OST_Rooms)

	dict_excel = dict(zip(number, area))
	x=0
	y=0
	
	TransactionManager.Instance.EnsureInTransaction(doc)
	for r in rooms_list:
		if "a" in r.LookupParameter(param_get).AsString():
			x=x+1
			for d in dict_excel:	
				if str(d) == r.LookupParameter(param_get).AsString():
					y=y+1
					
					(r.LookupParameter(param_set)).Set((float(dict_excel[d])*10.7639)) #Convert square foot to square meter
					
				else:
					pass
		else:
			pass
	TransactionManager.Instance.TransactionTaskDone()
			
	toc = time()
	
	xx=float(dict_excel[d])
	yy=dict_excel[d]
	
	all_time=toc-tic
	OUT = x,y,all_time,xx,yy
else:
	OUT = "not run"
# ----------------------------------------
getParameterValueByName_4 = Element.GetParameterValueByName(element=flatten, parameterName=code_block_9)
проверяем_совпадения_из_revit = Watch(getParameterValueByName_4)
eq = номера_помещений_из_спецификации == проверяем_совпадения_из_revit
uniqueItems = List.UniqueItems(eq)
проверяем_совпадения = Watch(uniqueItems)
toNumber_2 = String.ToNumber(to)
code_block_15 = CodeBlock { false; }
indexOf = IndexOf(eq, code_block_15)
индексы_несовпавших_элементов = Watch(indexOf)
flatten_2 = Flatten(split_2)
setParameterByName_2 = Element.SetParameterByName(element=filterByBoolMask_2.out, parameterName=code_block_9, value=flatten_2)  # frozen

# group: Get Revit Selection:
forceChildrensEval = ForceChildrensEval()  # frozen; unwired: arg0
pys_get_revit_selection = Python(IN[0]=forceChildrensEval)
# ---------- pys_get_revit_selection.python (22 lines) ----------
import clr
clr.AddReference('RevitServices')
clr.AddReference('RevitAPI')
from Autodesk.Revit.DB import *
import RevitServices
from RevitServices.Persistence import DocumentManager
from Autodesk.Revit.ApplicationServices import Application

reset = IN[0]

doc = DocumentManager.Instance.CurrentDBDocument
uidoc = DocumentManager.Instance.CurrentUIApplication.ActiveUIDocument
ids = uidoc.Selection.GetElementIds()

idd = [str(i) for i in ids]

if isinstance(idd, list) == True:
	elems = [doc.GetElement(ElementId(int(i))) for i in idd]
else:
	elems = doc.GetElement(ElementId(int(idd)))

OUT = elems
# ----------------------------------------

boolean = BoolSelector(true)  # frozen
code_block_16 = CodeBlock { 1; 2; }
if_2 = Python(IN[0]=boolean, IN[1]=code_block_16.out0, IN[2]=code_block_16.out1)  # same code as if_
parameters = Element.Parameters()  # unwired: arg0
geometry = Element.Geometry()  # unwired: arg0
setParameterByName_3 = Element.SetParameterByName()  # unwired: element, parameterName, value
# note: ВСЁ ОСТАЛЬНОЕ
getParameterValueByName_5 = Element.GetParameterValueByName()  # unwired: element, parameterName

# group: Parameters name from language
parameters_name_from_language = Python()  # frozen
# ---------- parameters_name_from_language.python (18 lines) ----------
import clr
clr.AddReference('RevitServices')
import RevitServices
from RevitServices.Persistence import DocumentManager

uiapp = DocumentManager.Instance.CurrentUIApplication
app = uiapp.Application
lng = app.Language
rus = ["Тип","Имя семейства","Имя типа"]
enu = ["Type","Family name","Type name"]
out = []
if str(lng) == "Russian":
	out = rus
else:
	out = enu
#English_USA
#Russian
OUT = out
# ----------------------------------------

# group: элементы внутри групп
members = Python()  # "Group.Members"; frozen; unwired: IN[0]
# ---------- members.python (19 lines) ----------
import clr
clr.AddReference('RevitAPI')
from Autodesk.Revit.DB import *

clr.AddReference("RevitNodes")
import Revit
clr.ImportExtensions(Revit.Elements)

groups = UnwrapElement(IN[0])
elementlist = list()
for item in groups:
	try:
		memberlist = list()
		for member in item.GetMemberIds():
			memberlist.append(item.Document.GetElement(member))
		elementlist.append(memberlist)
	except:
		elementlist.append(list())
OUT = elementlist
# ----------------------------------------

путь_к_файлу_python = Filename(".\N.Отделка помещений_сбор элементов вокруг_1.7.py")  # frozen
forceChildrensEval_2 = ForceChildrensEval()  # unwired: arg0
не_читает_кирилицу = Python(IN[0]=путь_к_файлу_python, IN[1]=forceChildrensEval_2)
# ---------- не_читает_кирилицу.python (9 lines) ----------
try:
	filePath = IN[0]

	with open(filePath, 'rb') as inf:
	    lines = inf.readlines()

	OUT = ''.join(lines)
except Exception, e:
	OUT = "No file"
# ----------------------------------------
python_script_from_string = PythonStringNode(script=не_читает_кирилицу)  # unwired: IN[0]
categories_2 = Categories()  # frozen
all_elements_of_category_2 = ElementsOfCategory(categories_2)
regenerate = Python()  # frozen; unwired: IN[0]
# ---------- regenerate.python (26 lines) ----------
import clr

# Import DocumentManager and TransactionManager
clr.AddReference("RevitServices")
import RevitServices
from RevitServices.Persistence import DocumentManager


# Import RevitAPI
clr.AddReference("RevitAPI")
import Autodesk
from Autodesk.Revit.DB import *

doc = DocumentManager.Instance.CurrentDBDocument


#The inputs to this node will be stored as a list in the IN variable.
list = IN[0]


if list:
	doc.Regenerate()
	out = "Regeneration complete"
else:
	out = "fail"
OUT = out
# ----------------------------------------
shablon_python_shablon = Python()  # frozen; unwired: IN[0]
# ---------- shablon_python_shablon.python (68 lines) ----------
# -*- coding: utf-8 -*- 
#-----------------------Импоорт библиотек----------------------
import clr
clr.AddReference('RevitAPI')
import Autodesk
from Autodesk.Revit.DB import *

clr.AddReference("RevitNodes") 
import Revit
from Revit.Elements import *

clr.ImportExtensions(Revit.Elements) #ToDSType не работает без
clr.ImportExtensions(Revit.GeometryConversion)

clr.AddReference("RevitServices")
import RevitServices
from RevitServices.Persistence import DocumentManager

clr.AddReference('ProtoGeometry')
from Autodesk.DesignScript.Geometry import *

#-----------------------ИМПОРТ БИБЛИОТЕК----------------------
"""-"""
#-----------------------ФУНКЦИИ----------------------

def __x__(x):
	x="x"
	return x
	
#-----------------------ФУНКЦИИ----------------------
"""-"""
#-----------------------АПИ ПАРАМЕТРЫ----------------------

doc = DocumentManager.Instance.CurrentDBDocument
#link_doc = UnwrapElement(IN[1])
#uiapp = DocumentManager.Instance.CurrentUIApplication
#app = uiapp.Application
#version = app.VersionNumber
#options = Autodesk.Revit.DB.SpatialElementBoundaryOptions()
calculator = SpatialElementGeometryCalculator(doc)

#-----------------------АПИ ПАРАМЕТРЫ----------------------
"""-"""
#-----------------------РАБОЧИЕ ПАРАМЕТРЫ----------------------

rooms = UnwrapElement(IN[0])

#-----------------------РАБОЧИЕ ПАРАМЕТРЫ----------------------	
"""-"""
#-----------------------ТЕСТОВЫЕ ПАРАМЕТРЫ----------------------

test = []

#-----------------------ТЕСТОВЫЕ ПАРАМЕТРЫ----------------------
"""-"""
#-----------------------НАЧАЛО СКРИПТА----------------------

x = 0
if rooms == None:
	rooms = [0,0]

for room in rooms:
	x=__x__(x)+__x__(x)
#TransactionManager.Instance.EnsureInTransaction(doc)
#TransactionManager.Instance.TransactionTaskDone()
#-----------------------КОНЕЦ СКРИПТА----------------------

OUT = x
# ----------------------------------------
путь_к_файлу_python_2 = Filename("..\..\..\Z.Тест\1.Распознавание и сопоставление параметров через словари.py")
forceChildrensEval_3 = ForceChildrensEval()  # unwired: arg0
не_читает_кирилицу_2 = Python(IN[0]=путь_к_файлу_python_2, IN[1]=forceChildrensEval_3)  # same code as не_читает_кирилицу
python_script_from_string_2 = PythonStringNode(script=не_читает_кирилицу_2, IN[0]=code_block.out0, IN[1]=code_block.out1, IN[2]=getParameterValueByName_3, IN[3]=filterByBoolMask_2.out)
code_block_17 = CodeBlock(группировка=groupByKey.unique_keys) { группировка; }
code_block_18 = CodeBlock { "p1"; "???"; }
replace = String.Replace(str=getParameterValueByName_4, searchFor=code_block_18.out0, replaceWith=code_block_18.out1)
getParameterValueByName_6 = Element.GetParameterValueByName(element=code_block_6, parameterName=code_block_4.out1)
