# Dynamo graph 1.Из Excel в параметры помещений, по номерам квартир _ ММ.dyn (Dynamo 1.3.3.4111)

# note: ВСЁ ОСТАЛЬНОЕ

# group: ЭЛЕМЕНТЫ УПРАВЛЕНИЯ
# note: ПЕРЕМЕННЫЕ ЗНАЧЕНИЯ
# note: ЭЛЕМЕНТЫ УПРАВЛЕНИЯ

# group: ПОЛУЧАЕМ ДАННЫЕ ИЗ РЕВИТ
# note: ПОЛУЧАЕМ ДАННЫЕ ИЗ РЕВИТ

# group: ЭЛЕМЕНТЫ УПРАВЛЕНИЯ 2 УРОВЕНЬ
# note: ЭЛЕМЕНТЫ УПРАВЛЕНИЯ
# note: ПЕРЕМЕННЫЕ ЗНАЧЕНИЯ

# group: ПРОВЕРОЧНЫЕ НОДЫ
# note: ПРОВЕРОЧНЫЕ НОДЫ

# group: ЭЛЕМЕНТЫ УПРАВЛЕНИЯ Dyno Studio
# note: Dyno Studio

# group: КЛЮЧЕВЫЕ МОМЕНТЫ РАБОТЫ 1
# note: ИТОГОВАЯ КОНСОЛИДАЦИЯ ДАННЫХ

# group: ИСПОЛНИТЕЛЬНЫЕ НОДЫ (фильтрование, подбор, списки и т.д.)
# note: ИСПОЛНИТЕЛЬНЫЕ НОДЫ
# note: НОДЫ РАБОТАЮЩИЕ С ДАННЫМИ

# group: ЗАПАСНЫЕ ВАРИАНТЫ, ДОПОЛНИТЕЛЬНЫЕ ОПЦИИ
# note: ЗАПАСНЫЕ
# note: ДОПОЛНИТЕЛЬНЫЕ. Градации серово по важности, темнее - важнее

# group: КЛЮЧЕВЫЕ МОМЕНТЫ РАБОТЫ 2
# note: ИСПОЛНИТЕЛЬНЫЕ НОДЫ
# note: НОДЫ РАБОТАЮЩИЕ С ДАННЫМИ

# group: ПЕРЕДАЁМ ИНФОРМАЦИЮ В РЕВИТ
# note: ПЕРЕДАЁМ ИНФОРМАЦИЮ В РЕВИТ

# group: ПРИМЕЧАНИЯ ПО ЦВЕТОВОЙ ГРУППИРОВКЕ
# note: GUIDELINES

boolean = BoolSelector(true)  # frozen
code_block = CodeBlock { 1; 2; }
if_ = Python(IN[0]=boolean, IN[1]=code_block.out0, IN[2]=code_block.out1)
# ---------- if_.python (12 lines) ----------
import clr
boolean = IN[0]
true = UnwrapElement(IN[1])
false = UnwrapElement(IN[2])

if boolean:
	out = true
else:
	out = false

#Назначьте вывод переменной OUT.
OUT = out
# ----------------------------------------
parameters = Element.Parameters()  # unwired: arg0
geometry = Element.Geometry()  # unwired: arg0
getParameterValueByName = Element.GetParameterValueByName()  # unwired: element, parameterName

# group: Parameters name from language
parameters_name_from_language = Python()  # frozen
# ---------- parameters_name_from_language.python (18 lines) ----------
import clr
clr.AddReference('RevitServices')
import RevitServices
from RevitServices.Persistence import DocumentManager

uiapp = DocumentManager.Instance.CurrentUIApplication
app = uiapp.Application
lng = app.Language
rus = ["Тип","Имя семейства","Имя типа"]
enu = ["Type","Family name","Type name"]
out = []
if str(lng) == "Russian":
	out = rus
else:
	out = enu
#English_USA
#Russian
OUT = out
# ----------------------------------------

setParameterByName = Element.SetParameterByName()  # unwired: element, parameterName, value

# group: элементы внутри групп
members = Python()  # "Group.Members"; frozen; unwired: IN[0]
# ---------- members.python (19 lines) ----------
import clr
clr.AddReference('RevitAPI')
from Autodesk.Revit.DB import *

clr.AddReference("RevitNodes")
import Revit
clr.ImportExtensions(Revit.Elements)

groups = UnwrapElement(IN[0])
elementlist = list()
for item in groups:
	try:
		memberlist = list()
		for member in item.GetMemberIds():
			memberlist.append(item.Document.GetElement(member))
		elementlist.append(memberlist)
	except:
		elementlist.append(list())
OUT = elementlist
# ----------------------------------------

byName = Family.ByName()  # unwired: arg0
путь_к_файлу_excel = Filename("..\..\..\..\..\Pictures\ИСКРА-ПАРК\К2_Ведомость машиномест.xlsx")
fromPath = FileObject(путь_к_файлу_excel)  # "File.FromPath"
имя_листа = StringInput("Лист3")
readFromFile = Excel.ReadFromFile(file=fromPath, sheetName=имя_листа)
py_clear_убираем_пустоту_и = Python(IN[0]=readFromFile)  # "py.Clear ++ (Убираем пустоту и одинарные списки)"
# ---------- py_clear_убираем_пустоту_и.python (27 lines) ----------
import clr

def ClearList(_list):
    out = []
    for _list1 in _list:
        if _list1 is None:
            continue
        if isinstance(_list1, list):
             _list1 = ClearList(_list1)
             if not _list1:
                 continue
        out.append(_list1)
    return out

newlist1 = ClearList(IN[0])
newlist2 = []

for list in newlist1:
	if len(list) == 2:
		if "a" in list[0]:
			newlist2.append(list)
		else:
			pass
	else:
		pass
		
OUT = newlist2
# ----------------------------------------
transpose = List.Transpose(readFromFile)
code_block_2 = CodeBlock(nember=transpose, area=transpose, type=transpose) { nember[0]; area[3]; type[2]; }
номера_помещений = String.TrimWhitespace(code_block_2.out0)
code_block_3 = CodeBlock { "."; }
split = String.Split(номера_помещений, code_block_3)
transpose_2 = List.Transpose(split)
code_block_4 = CodeBlock(x=transpose_2, y=transpose_2, k=transpose_2, e=transpose_2, n=transpose_2) { x[0]+"."+y[1]+"."+k[2]+e[3]+"."+n[4]; }
запуск = BoolSelector(false)
code_block_5 = CodeBlock { "."; }
split_2 = String.Split(arg1=code_block_5)  # unwired: arg0
transpose_3 = List.Transpose(split_2)
code_block_6 = CodeBlock(x=transpose_3, y=transpose_3, e=transpose_3, n=transpose_3) { x[0]+"."+y[1]+".a"+e[2]+"."+n[3]; }
end = Revit.Transaction.Transaction.End(code_block_6)
start = Revit.Transaction.Transaction.Start(end)
python_script = Python()  # frozen; unwired: IN[0], IN[1], IN[2], IN[3], IN[4]
# ---------- python_script.python (54 lines) ----------
if IN[4]:
	import clr

	clr.AddReference('RevitAPI')
	import Autodesk
	from Autodesk.Revit.DB import *

	clr.AddReference('RevitServices')
	import RevitServices
	from RevitServices.Persistence import DocumentManager
	from RevitServices.Transactions import TransactionManager

	from time import time
	tic = time()

	doc = DocumentManager.Instance.CurrentDBDocument

	number = IN[0]
	area = IN[1]
	param_get = IN[2]
	param_set = IN[3]
	d = {}

	rooms_list = FilteredElementCollector(doc).OfCategory(BuiltInCategory.OST_Rooms)

	dict_excel = dict(zip(number, area))
	x=0
	y=0
	
	TransactionManager.Instance.EnsureInTransaction(doc)
	for r in rooms_list:
		if "a" in r.LookupParameter(param_get).AsString():
			x=x+1
			for d in dict_excel:	
				if str(d) == r.LookupParameter(param_get).AsString():
					y=y+1
					
					(r.LookupParameter(param_set)).Set((float(dict_excel[d])*10.7639)) #Convert square foot to square meter
					
				else:
					pass
		else:
			pass
	TransactionManager.Instance.TransactionTaskDone()
			
	toc = time()
	
	xx=float(dict_excel[d])
	yy=dict_excel[d]
	
	all_time=toc-tic
	OUT = x,y,all_time,xx,yy
else:
	OUT = "not run"
# ----------------------------------------
categories = Categories("Rooms")
all_elements_of_category = ElementsOfCategory(categories)
code_block_7 = CodeBlock { "Уровень"; "Квартира"; }
getParameterValueByName_2 = Element.GetParameterValueByName(element=all_elements_of_category, parameterName=code_block_7.out0)
levels = Levels("Этаж -3")
name = Level.Name(levels)
code_block_8 = CodeBlock(x=getParameterValueByName_2, y=name) { x==y; }
filterByBoolMask = List.FilterByBoolMask(list=all_elements_of_category, mask=code_block_8)
code_block_9 = CodeBlock(x=filterByBoolMask.in) { x; }
code_block_10 = CodeBlock { "Имя"; }
getParameterValueByName_3 = Element.GetParameterValueByName(element=code_block_9, parameterName=code_block_10)
sortByKey = List.SortByKey(list=code_block_9, keys=getParameterValueByName_3)
eq = номера_помещений == sortByKey.sorted_keys
uniqueItems = List.UniqueItems(eq)
проверяем_совпадения = Watch(uniqueItems)
проверяем_совпадения_2 = Watch(sortByKey.sorted_keys)
code_block_11 = CodeBlock { false; }
indexOf = IndexOf(eq, code_block_11)
индексы_несовпавших_элементов = Watch(indexOf)
code_block_12 = CodeBlock { "АБН_Площадь М/м по П"; "Вместимость"; }
запись_в_параметры = BoolSelector(true)
# note: Смотрим для проверки получаймых данных.
# Последовательность данных должна быть такая же, как в выбраных элементах. Не должно быть смешения данных между списками
площадь_помещений = String.TrimWhitespace(code_block_2.out1)
toNumber = String.ToNumber(площадь_помещений)
code_block_13 = CodeBlock(value=toNumber) { value; null; }
if_2 = Python(IN[0]=запись_в_параметры, IN[1]=code_block_13.value, IN[2]=code_block_13.out1)  # same code as if_
setParameterByName_2 = Element.SetParameterByName(element=sortByKey.sorted_list, parameterName=code_block_12.out0, value=if_2)
тип_машиноместа = String.TrimWhitespace(code_block_2.out2)
setParameterByName_3 = Element.SetParameterByName(element=setParameterByName_2, parameterName=code_block_12.out1, value=тип_машиноместа)
