# Dynamo graph 1.Из Excel в параметры помещений, по номерам квартир.dyn (Dynamo 1.3.3.4111)

# note: ВСЁ ОСТАЛЬНОЕ

# group: ЭЛЕМЕНТЫ УПРАВЛЕНИЯ
# note: ПЕРЕМЕННЫЕ ЗНАЧЕНИЯ
# note: ЭЛЕМЕНТЫ УПРАВЛЕНИЯ

# group: ПОЛУЧАЕМ ДАННЫЕ ИЗ РЕВИТ
# note: ПОЛУЧАЕМ ДАННЫЕ ИЗ РЕВИТ

# group: ЭЛЕМЕНТЫ УПРАВЛЕНИЯ 2 УРОВЕНЬ
# note: ЭЛЕМЕНТЫ УПРАВЛЕНИЯ
# note: ПЕРЕМЕННЫЕ ЗНАЧЕНИЯ

# group: ПРОВЕРОЧНЫЕ НОДЫ
# note: ПРОВЕРОЧНЫЕ НОДЫ

# group: ЭЛЕМЕНТЫ УПРАВЛЕНИЯ Dyno Studio
# note: Dyno Studio

# group: КЛЮЧЕВЫЕ МОМЕНТЫ РАБОТЫ 1
# note: ИТОГОВАЯ КОНСОЛИДАЦИЯ ДАННЫХ

# group: ИСПОЛНИТЕЛЬНЫЕ НОДЫ (фильтрование, подбор, списки и т.д.)
# note: ИСПОЛНИТЕЛЬНЫЕ НОДЫ
# note: НОДЫ РАБОТАЮЩИЕ С ДАННЫМИ

# group: ЗАПАСНЫЕ ВАРИАНТЫ, ДОПОЛНИТЕЛЬНЫЕ ОПЦИИ
# note: ЗАПАСНЫЕ
# note: ДОПОЛНИТЕЛЬНЫЕ. Градации серово по важности, темнее - важнее

# group: КЛЮЧЕВЫЕ МОМЕНТЫ РАБОТЫ 2
# note: ИСПОЛНИТЕЛЬНЫЕ НОДЫ
# note: НОДЫ РАБОТАЮЩИЕ С ДАННЫМИ

# group: ПЕРЕДАЁМ ИНФОРМАЦИЮ В РЕВИТ
# note: ПЕРЕДАЁМ ИНФОРМАЦИЮ В РЕВИТ

# group: ПРИМЕЧАНИЯ ПО ЦВЕТОВОЙ ГРУППИРОВКЕ
# note: GUIDELINES

boolean = BoolSelector(true)  # frozen
code_block = CodeBlock { 1; 2; }
if_ = Python(IN[0]=boolean, IN[1]=code_block.out0, IN[2]=code_block.out1)
# ---------- if_.python (12 lines) ----------
import clr
boolean = IN[0]
true = UnwrapElement(IN[1])
false = UnwrapElement(IN[2])

if boolean:
	out = true
else:
	out = false

#Назначьте вывод переменной OUT.
OUT = out
# ----------------------------------------
parameters = Element.Parameters()  # unwired: arg0
geometry = Element.Geometry()  # unwired: arg0
getParameterValueByName = Element.GetParameterValueByName()  # unwired: element, parameterName

# group: Parameters name from language
parameters_name_from_language = Python()  # frozen
# ---------- parameters_name_from_language.python (18 lines) ----------
import clr
clr.AddReference('RevitServices')
import RevitServices
from RevitServices.Persistence import DocumentManager

uiapp = DocumentManager.Instance.CurrentUIApplication
app = uiapp.Application
lng = app.Language
rus = ["Тип","Имя семейства","Имя типа"]
enu = ["Type","Family name","Type name"]
out = []
if str(lng) == "Russian":
	out = rus
else:
	out = enu
#English_USA
#Russian
OUT = out
# ----------------------------------------

setParameterByName = Element.SetParameterByName()  # unwired: element, parameterName, value

# group: элементы внутри групп
members = Python()  # "Group.Members"; frozen; unwired: IN[0]
# ---------- members.python (19 lines) ----------
import clr
clr.AddReference('RevitAPI')
from Autodesk.Revit.DB import *

clr.AddReference("RevitNodes")
import Revit
clr.ImportExtensions(Revit.Elements)

groups = UnwrapElement(IN[0])
elementlist = list()
for item in groups:
	try:
		memberlist = list()
		for member in item.GetMemberIds():
			memberlist.append(item.Document.GetElement(member))
		elementlist.append(memberlist)
	except:
		elementlist.append(list())
OUT = elementlist
# ----------------------------------------

byName = Family.ByName()  # unwired: arg0
путь_к_файлу_python = Filename(".\1.Из Excel в параметры помещений, по номерам квартир.py")
forceChildrensEval = ForceChildrensEval()  # unwired: arg0
find_file_and_import_it = Python(IN[0]=путь_к_файлу_python, IN[1]=forceChildrensEval)
# ---------- find_file_and_import_it.python (9 lines) ----------
try:
	filePath = IN[0]

	with open(filePath, 'rb') as inf:
	    lines = inf.readlines()

	OUT = ''.join(lines)
except Exception, e:
	OUT = "No file"
# ----------------------------------------
путь_к_файлу_excel = Filename("..\..\..\..\..\Pictures\ИСКРА-ПАРК\ведомость помещений автостоянки.xlsx")
fromPath = FileObject(путь_к_файлу_excel)  # "File.FromPath"
имя_листа = StringInput("Лист1")
readFromFile = Excel.ReadFromFile(file=fromPath, sheetName=имя_листа)
py_clear_убираем_пустоту_и = Python(IN[0]=readFromFile)  # "py.Clear ++ (Убираем пустоту и одинарные списки)"
# ---------- py_clear_убираем_пустоту_и.python (27 lines) ----------
import clr

def ClearList(_list):
    out = []
    for _list1 in _list:
        if _list1 is None:
            continue
        if isinstance(_list1, list):
             _list1 = ClearList(_list1)
             if not _list1:
                 continue
        out.append(_list1)
    return out

newlist1 = ClearList(IN[0])
newlist2 = []

for list in newlist1:
	if len(list) == 2:
		if "a" in list[0]:
			newlist2.append(list)
		else:
			pass
	else:
		pass
		
OUT = newlist2
# ----------------------------------------
transpose = List.Transpose(py_clear_убираем_пустоту_и)
code_block_2 = CodeBlock(nember=transpose, area=transpose) { nember[0]; area[1]; }
номера_помещений = String.TrimWhitespace(code_block_2.out0)
code_block_3 = CodeBlock { "."; }
split = String.Split(номера_помещений, code_block_3)
transpose_2 = List.Transpose(split)
code_block_4 = CodeBlock(x=transpose_2, y=transpose_2, k=transpose_2, e=transpose_2, n=transpose_2) { x[0]+"."+y[1]+"."+k[2]+e[3]+"."+n[4]; }
# note: Смотрим для проверки получаймых данных.
# Последовательность данных должна быть такая же, как в выбраных элементах. Не должно быть смешения данных между списками
площадь_помещений = String.TrimWhitespace(code_block_2.out1)
code_block_5 = CodeBlock { "Номер"; "***Площадь по стадии П"; }
запуск = BoolSelector(false)
python_script_from_string = PythonStringNode(script=find_file_and_import_it, IN[0]=code_block_4, IN[1]=площадь_помещений, IN[2]=code_block_5.out0, IN[3]=code_block_5.out1, IN[4]=запуск)
categories = Categories("Rooms")
all_elements_of_category = ElementsOfCategory(categories)
code_block_6 = CodeBlock { "Назначение"; "Квартира"; }
getParameterValueByName_2 = Element.GetParameterValueByName(element=all_elements_of_category, parameterName=code_block_6.out0)
code_block_7 = CodeBlock(x=getParameterValueByName_2, y=code_block_6.out1) { x==y; }
filterByBoolMask = List.FilterByBoolMask(list=all_elements_of_category, mask=code_block_7)
code_block_8 = CodeBlock(x=filterByBoolMask.in) { x; }
getParameterValueByName_3 = Element.GetParameterValueByName(element=code_block_8, parameterName=code_block_5.out0)
code_block_9 = CodeBlock { "."; }
split_2 = String.Split(getParameterValueByName_3, code_block_9)
transpose_3 = List.Transpose(split_2)
code_block_10 = CodeBlock(x=transpose_3, y=transpose_3, e=transpose_3, n=transpose_3) { x[0]+"."+y[1]+".a"+e[2]+"."+n[3]; }
end = Revit.Transaction.Transaction.End(code_block_10)
start = Revit.Transaction.Transaction.Start(end)
setParameterByName_2 = Element.SetParameterByName(element=code_block_8, parameterName=code_block_5.out0, value=start)  # frozen
