# Dynamo graph В EXCEL - Создание списка GUID и Taimliner.dyn (Dynamo 1.3.3.4111)

# group: ЭЛЕМЕНТЫ УПРАВЛЕНИЯ
# note: ПЕРЕМЕННЫЕ ЗНАЧЕНИЯ
# note: ЭЛЕМЕНТЫ УПРАВЛЕНИЯ

# group: ПОЛУЧАЕМ ДАННЫЕ
# note: ПОЛУЧАЕМ ДАННЫЕ ИЗ РЕВИТ и других источников

# group: ПРОВЕРОЧНЫЕ НОДЫ
# note: ПРОВЕРОЧНЫЕ НОДЫ

# group: КЛЮЧЕВЫЕ МОМЕНТЫ РАБОТЫ 1
# note: КОНСОЛИДАЦИЯ И СЛОЖНЫЕ ОБРАБОТКИ

# group: ИСПОЛНИТЕЛЬНЫЕ НОДЫ (фильтрование, подбор, списки и т.д.)
# note: ИСПОЛНИТЕЛЬНЫЕ НОДЫ

# group: ПЕРЕДАЁМ ИНФОРМАЦИЮ
# note: ПЕРЕДАЁМ ИНФОРМАЦИЮ В РЕВИТ
# note: ПЕРЕДАЁМ ИНФОРМАЦИЮ ЕЩЁ КУДА-ТО

# group: ЗАПАСНЫЕ ВАРИАНТЫ, ДОПОЛНИТЕЛЬНЫЕ ОПЦИИ
# note: ЗАПАСНЫЕ
# note: ДОПОЛНИТЕЛЬНЫЕ. Градации серово по важности, темнее - важнее

# group: ПРИМЕЧАНИЯ ПО ЦВЕТОВОЙ ГРУППИРОВКЕ
# note: GUIDELINES

# group: КЛЮЧЕВЫЕ МОМЕНТЫ РАБОТЫ 2
# note: УСЛОЖНЕННЫЕ КОНСТРУКЦИИ
# note: УСЛОЖНЕНЫЕ КОНСТРУКЦИИ

# group: Python ноды
# note: Python

# group: ЭЛЕМЕНТЫ УПРАВЛЕНИЯ 2 УРОВЕНЬ
# note: ЭЛЕМЕНТЫ УПРАВЛЕНИЯ
# note: ПЕРЕМЕННЫЕ ЗНАЧЕНИЯ

# group: Запуск питона из внешнего файла
# note: Py - files

# group: Get Revit Selection:
forceChildrensEval = ForceChildrensEval()  # frozen; unwired: arg0
pys_get_revit_selection = Python(IN[0]=forceChildrensEval)
# ---------- pys_get_revit_selection.python (22 lines) ----------
import clr
clr.AddReference('RevitServices')
clr.AddReference('RevitAPI')
from Autodesk.Revit.DB import *
import RevitServices
from RevitServices.Persistence import DocumentManager
from Autodesk.Revit.ApplicationServices import Application

reset = IN[0]

doc = DocumentManager.Instance.CurrentDBDocument
uidoc = DocumentManager.Instance.CurrentUIApplication.ActiveUIDocument
ids = uidoc.Selection.GetElementIds()

idd = [str(i) for i in ids]

if isinstance(idd, list) == True:
	elems = [doc.GetElement(ElementId(int(i))) for i in idd]
else:
	elems = doc.GetElement(ElementId(int(idd)))

OUT = elems
# ----------------------------------------

boolean = BoolSelector(true)  # frozen
code_block = CodeBlock { 1; 2; }
if_ = Python(IN[0]=boolean, IN[1]=code_block.out0, IN[2]=code_block.out1)
# ---------- if_.python (12 lines) ----------
import clr
boolean = IN[0]
true = UnwrapElement(IN[1])
false = UnwrapElement(IN[2])

if boolean:
	out = true
else:
	out = false

#Назначьте вывод переменной OUT.
OUT = out
# ----------------------------------------
geometry = Element.Geometry()  # unwired: arg0
setParameterByName = Element.SetParameterByName()  # unwired: element, parameterName, value
# note: ВСЁ ОСТАЛЬНОЕ
getParameterValueByName = Element.GetParameterValueByName()  # unwired: element, parameterName

# group: Parameters name from language
parameters_name_from_language = Python()  # frozen
# ---------- parameters_name_from_language.python (18 lines) ----------
import clr
clr.AddReference('RevitServices')
import RevitServices
from RevitServices.Persistence import DocumentManager

uiapp = DocumentManager.Instance.CurrentUIApplication
app = uiapp.Application
lng = app.Language
rus = ["Тип","Имя семейства","Имя типа"]
enu = ["Type","Family name","Type name"]
out = []
if str(lng) == "Russian":
	out = rus
else:
	out = enu
#English_USA
#Russian
OUT = out
# ----------------------------------------

# group: элементы внутри групп
members = Python()  # "Group.Members"; frozen; unwired: IN[0]
# ---------- members.python (19 lines) ----------
import clr
clr.AddReference('RevitAPI')
from Autodesk.Revit.DB import *

clr.AddReference("RevitNodes")
import Revit
clr.ImportExtensions(Revit.Elements)

groups = UnwrapElement(IN[0])
elementlist = list()
for item in groups:
	try:
		memberlist = list()
		for member in item.GetMemberIds():
			memberlist.append(item.Document.GetElement(member))
		elementlist.append(memberlist)
	except:
		elementlist.append(list())
OUT = elementlist
# ----------------------------------------

путь_к_файлу_python = Filename(".\N.Отделка помещений_сбор элементов вокруг_1.7.py")  # frozen
forceChildrensEval_2 = ForceChildrensEval()  # unwired: arg0
не_читает_кирилицу = Python(IN[0]=путь_к_файлу_python, IN[1]=forceChildrensEval_2)
# ---------- не_читает_кирилицу.python (9 lines) ----------
try:
	filePath = IN[0]

	with open(filePath, 'rb') as inf:
	    lines = inf.readlines()

	OUT = ''.join(lines)
except Exception, e:
	OUT = "No file"
# ----------------------------------------
python_script_from_string = PythonStringNode(script=не_читает_кирилицу)  # unwired: IN[0]
categories = Categories()  # frozen
all_elements_of_category = ElementsOfCategory(categories)
regenerate = Python()  # frozen; unwired: IN[0]
# ---------- regenerate.python (26 lines) ----------
import clr

# Import DocumentManager and TransactionManager
clr.AddReference("RevitServices")
import RevitServices
from RevitServices.Persistence import DocumentManager


# Import RevitAPI
clr.AddReference("RevitAPI")
import Autodesk
from Autodesk.Revit.DB import *

doc = DocumentManager.Instance.CurrentDBDocument


#The inputs to this node will be stored as a list in the IN variable.
list = IN[0]


if list:
	doc.Regenerate()
	out = "Regeneration complete"
else:
	out = "fail"
OUT = out
# ----------------------------------------
shablon_python_shablon = Python()  # frozen; unwired: IN[0]
# ---------- shablon_python_shablon.python (69 lines) ----------
# -*- coding: utf-8 -*- 
#-----------------------Импоорт библиотек----------------------
import clr
clr.AddReference('RevitAPI')
import Autodesk
from Autodesk.Revit.DB import *

clr.AddReference("RevitNodes") 
import Revit
from Revit.Elements import *

clr.ImportExtensions(Revit.Elements) #ToDSType не работает без
clr.ImportExtensions(Revit.GeometryConversion)

clr.AddReference("RevitServices")
import RevitServices
from RevitServices.Persistence import DocumentManager
from RevitServices.Transactions import TransactionManager

clr.AddReference('ProtoGeometry')
from Autodesk.DesignScript.Geometry import *

#-----------------------ИМПОРТ БИБЛИОТЕК----------------------
"""-"""
#-----------------------ФУНКЦИИ----------------------

def __x__(x):
	x="x"
	return x
	
#-----------------------ФУНКЦИИ----------------------
"""-"""
#-----------------------АПИ ПАРАМЕТРЫ----------------------

doc = DocumentManager.Instance.CurrentDBDocument
#link_doc = UnwrapElement(IN[1])
#uiapp = DocumentManager.Instance.CurrentUIApplication
#app = uiapp.Application
#version = app.VersionNumber
#options = Autodesk.Revit.DB.SpatialElementBoundaryOptions()
calculator = SpatialElementGeometryCalculator(doc)

#-----------------------АПИ ПАРАМЕТРЫ----------------------
"""-"""
#-----------------------РАБОЧИЕ ПАРАМЕТРЫ----------------------

rooms = UnwrapElement(IN[0])

#-----------------------РАБОЧИЕ ПАРАМЕТРЫ----------------------	
"""-"""
#-----------------------ТЕСТОВЫЕ ПАРАМЕТРЫ----------------------

test = []

#-----------------------ТЕСТОВЫЕ ПАРАМЕТРЫ----------------------
"""-"""
#-----------------------НАЧАЛО СКРИПТА----------------------

x = 0
if rooms == None:
	rooms = [0,0]

for room in rooms:
	x=__x__(x)+__x__(x)
#TransactionManager.Instance.EnsureInTransaction(doc)
#TransactionManager.Instance.TransactionTaskDone()
#-----------------------КОНЕЦ СКРИПТА----------------------

OUT = x
# ----------------------------------------
members_2 = Python()  # "Object.Members"; frozen; unwired: IN[0]
# ---------- members_2.python (14 lines) ----------
import clr

items = IN[0]
elementlist = list()

try:
	clr.AddReference('RevitAPI')
	from Autodesk.Revit.DB import *
	for item in items:
		elementlist.append(dir(UnwrapElement(item)))
except:
	for item in items:
		elementlist.append(dir(item))
OUT = elementlist
# ----------------------------------------
parameters = Element.Parameters()  # unwired: arg0
file_path = Filename("..\..\..\..\test\Список элементов с GUID и Taimliner.xlsx")
code_block_2 = CodeBlock { "Лист1"; 0; }
all_elements_in_active_view = ElementsInView()
type = Object.Type(all_elements_in_active_view)
code_block_3 = CodeBlock { "Point"; }
contains = String.Contains(str=type, searchFor=code_block_3)
filterByBoolMask = List.FilterByBoolMask(list=all_elements_in_active_view, mask=contains)
code_block_4 = CodeBlock { "ABN_Taimliner"; }
getParameterValueByName_2 = Element.GetParameterValueByName(element=filterByBoolMask.out, parameterName=code_block_4)
sortByKey = List.SortByKey(list=filterByBoolMask.out, keys=getParameterValueByName_2)
getCategory = Element.GetCategory(sortByKey.sorted_list)
elementType = Python(IN[0]=sortByKey.sorted_list)  # "Element.ElementType+"
# ---------- elementType.python (12 lines) ----------
import clr
clr.AddReference('RevitAPI')
from Autodesk.Revit.DB import *

items = UnwrapElement(IN[0])
typelist = list()
for item in items:
	try: 
		typelist.append(item.Document.GetElement(item.GetTypeId()))
	except:
		typelist.append(None)
OUT = typelist
# ----------------------------------------
string_from_object = FromObject(elementType)
uniqueId = Element.UniqueId(sortByKey.sorted_list)
getParameterValueByName_3 = Element.GetParameterValueByName(element=sortByKey.sorted_list, parameterName=code_block_4)
create = List.Create(getCategory, string_from_object, uniqueId, getParameterValueByName_3)
transpose = List.Transpose(create)
boolean_2 = BoolSelector(true)
writeToFile = Excel.WriteToFile(filePath=file_path, sheetName=code_block_2.out0, startRow=code_block_2.out1, startCol=code_block_2.out1, data=transpose, overWrite=boolean_2)
