# Dynamo graph Запись параметра элемента, фильтры по категориям.dyn (Dynamo 1.3.3.4111)

# note: ВСЁ ОСТАЛЬНОЕ

# group: ЗАПАСНЫЕ ВАРИАНТЫ, ДОПОЛНИТЕЛЬНЫЕ ОПЦИИ
# note: ДОПОЛНИТЕЛЬНЫЕ. Градации серово по важности, темнее - важнее
# note: ЗАПАСНЫЕ

# group: КЛЮЧЕВЫЕ МОМЕНТЫ РАБОТЫ 2
# note: НОДЫ РАБОТАЮЩИЕ С ДАННЫМИ
# note: ИСПОЛНИТЕЛЬНЫЕ НОДЫ

# group: КЛЮЧЕВЫЕ МОМЕНТЫ РАБОТЫ 1
# note: ИТОГОВАЯ КОНСОЛИДАЦИЯ ДАННЫХ

# group: ИСПОЛНИТЕЛЬНЫЕ НОДЫ (фильтрование, подбор, списки и т.д.)
# note: ИСПОЛНИТЕЛЬНЫЕ НОДЫ
# note: НОДЫ РАБОТАЮЩИЕ С ДАННЫМИ

# group: ЭЛЕМЕНТЫ УПРАВЛЕНИЯ 2 УРОВЕНЬ
# note: ПЕРЕМЕННЫЕ ЗНАЧЕНИЯ
# note: ЭЛЕМЕНТЫ УПРАВЛЕНИЯ

# group: ПРОВЕРОЧНЫЕ НОДЫ
# note: ПРОВЕРОЧНЫЕ НОДЫ

# group: ПЕРЕДАЁМ ИНФОРМАЦИЮ В РЕВИТ
# note: ПЕРЕДАЁМ ИНФОРМАЦИЮ В РЕВИТ

# group: ЭЛЕМЕНТЫ УПРАВЛЕНИЯ Dyno Studio
# note: Dyno Studio

# group: ЭЛЕМЕНТЫ УПРАВЛЕНИЯ
# note: ПЕРЕМЕННЫЕ ЗНАЧЕНИЯ
# note: ЭЛЕМЕНТЫ УПРАВЛЕНИЯ

# group: ПРИМЕЧАНИЯ ПО ЦВЕТОВОЙ ГРУППИРОВКЕ
# note: GUIDELINES

# group: ПОЛУЧАЕМ ДАННЫЕ ИЗ РЕВИТ
# note: ПОЛУЧАЕМ ДАННЫЕ ИЗ РЕВИТ

параметр_1 = StringInput("Бетон В")
выбрать_элементы = DSModelElementsSelection()
getCategory = Element.GetCategory(выбрать_элементы)
string_from_object = FromObject(getCategory)
категории_имя_или_имена_через = StringInput("Панели витража")  # "Категории (имя, или имена через заяпятую)"
code_block = CodeBlock { ","; }
split = String.Split(категории_имя_или_имена_через, code_block)
trimWhitespace = String.TrimWhitespace(split)
eq = string_from_object == trimWhitespace  # lacing=CrossProduct
allFalse = AllFalse(eq@L2)
filterByBoolMask = List.FilterByBoolMask(list=выбрать_элементы, mask=allFalse)
параметр_1_2 = StringInput("АБН_Тип панели витража")
значение_параметра_1 = StringInput("Однокамерный балкон")
setParameterByName = Element.SetParameterByName(element=filterByBoolMask.out, parameterName=параметр_1_2, value=значение_параметра_1)
количество_элементов = Watch(setParameterByName)
выбрать_элементы_2 = DSModelElementsSelection()
getCategory_2 = Element.GetCategory(выбрать_элементы_2)
string_from_object_2 = FromObject(getCategory_2)
categories = Categories("StructuralFraming")
string_from_object_3 = FromObject(categories)
string_from_object_4 = FromObject(string_from_object_3)
eq_2 = string_from_object_2 == string_from_object_4
filterByBoolMask_2 = List.FilterByBoolMask(list=выбрать_элементы_2, mask=eq_2)
параметр_2 = StringInput("")
code_block_2 = CodeBlock { 1; }
setParameterByName_2 = Element.SetParameterByName(element=setParameterByName, parameterName=параметр_2, value=code_block_2)  # frozen
значение_параметра_2 = StringInput("1")
setParameterByName_3 = Element.SetParameterByName()  # unwired: element, parameterName, value
parameters = Element.Parameters(выбрать_элементы_2)
geometry = Element.Geometry()  # unwired: arg0
getParameterValueByName = Element.GetParameterValueByName()  # unwired: element, parameterName
boolean = BoolSelector(true)  # frozen
code_block_3 = CodeBlock { 1; 2; }
if_ = Python(IN[0]=boolean, IN[1]=code_block_3.out0, IN[2]=code_block_3.out1)
# ---------- if_.python (12 lines) ----------
import clr
boolean = IN[0]
true = UnwrapElement(IN[1])
false = UnwrapElement(IN[2])

if boolean:
	out = true
else:
	out = false

#Назначьте вывод переменной OUT.
OUT = out
# ----------------------------------------

# group: элементы внутри групп
members = Python()  # "Group.Members"; frozen; unwired: IN[0]
# ---------- members.python (19 lines) ----------
import clr
clr.AddReference('RevitAPI')
from Autodesk.Revit.DB import *

clr.AddReference("RevitNodes")
import Revit
clr.ImportExtensions(Revit.Elements)

groups = UnwrapElement(IN[0])
elementlist = list()
for item in groups:
	try:
		memberlist = list()
		for member in item.GetMemberIds():
			memberlist.append(item.Document.GetElement(member))
		elementlist.append(memberlist)
	except:
		elementlist.append(list())
OUT = elementlist
# ----------------------------------------

# group: Get Revit Selection:
forceChildrensEval = ForceChildrensEval()  # frozen; unwired: arg0
pys_get_revit_selection = Python(IN[0]=forceChildrensEval)
# ---------- pys_get_revit_selection.python (22 lines) ----------
import clr
clr.AddReference('RevitServices')
clr.AddReference('RevitAPI')
from Autodesk.Revit.DB import *
import RevitServices
from RevitServices.Persistence import DocumentManager
from Autodesk.Revit.ApplicationServices import Application

reset = IN[0]

doc = DocumentManager.Instance.CurrentDBDocument
uidoc = DocumentManager.Instance.CurrentUIApplication.ActiveUIDocument
ids = uidoc.Selection.GetElementIds()

idd = [str(i) for i in ids]

if isinstance(idd, list) == True:
	elems = [doc.GetElement(ElementId(int(i))) for i in idd]
else:
	elems = doc.GetElement(ElementId(int(idd)))

OUT = elems
# ----------------------------------------

# group: Parameters name from language
parameters_name_from_language = Python()  # frozen
# ---------- parameters_name_from_language.python (18 lines) ----------
import clr
clr.AddReference('RevitServices')
import RevitServices
from RevitServices.Persistence import DocumentManager

uiapp = DocumentManager.Instance.CurrentUIApplication
app = uiapp.Application
lng = app.Language
rus = ["Тип","Имя семейства","Имя типа"]
enu = ["Type","Family name","Type name"]
out = []
if str(lng) == "Russian":
	out = rus
else:
	out = enu
#English_USA
#Russian
OUT = out
# ----------------------------------------

категории_имя_или_имена_через_2 = StringInput("Стены, Перекрытия, Каркас несущий")  # "Категории (имя, или имена через заяпятую)"
code_block_4 = CodeBlock { "Тип"; "Имя типа"; "железо"; true; }
getParameterValueByName_2 = Element.GetParameterValueByName(element=filterByBoolMask.out, parameterName=code_block_4.out0)
getParameterValueByName_3 = Element.GetParameterValueByName(element=getParameterValueByName_2, parameterName=code_block_4.out1)
contains = String.Contains(str=getParameterValueByName_3, searchFor=code_block_4.out2, ignoreCase=code_block_4.out3)
filterByBoolMask_3 = List.FilterByBoolMask(list=filterByBoolMask.out, mask=contains)
