# Dynamo graph Из Группы в элемент группы (перенос значения параметра).dyn (Dynamo 1.3.4.6666)

# group: ЭЛЕМЕНТЫ УПРАВЛЕНИЯ
# note: ПЕРЕМЕННЫЕ ЗНАЧЕНИЯ
# note: ЭЛЕМЕНТЫ УПРАВЛЕНИЯ

# group: ПОЛУЧАЕМ ДАННЫЕ
# note: ПОЛУЧАЕМ ДАННЫЕ ИЗ РЕВИТ и других источников

# group: ПРОВЕРОЧНЫЕ НОДЫ
# note: ПРОВЕРОЧНЫЕ НОДЫ

# group: КЛЮЧЕВЫЕ МОМЕНТЫ РАБОТЫ 1
# note: КОНСОЛИДАЦИЯ И СЛОЖНЫЕ ОБРАБОТКИ

# group: ИСПОЛНИТЕЛЬНЫЕ НОДЫ (фильтрование, подбор, списки и т.д.)
# note: ИСПОЛНИТЕЛЬНЫЕ НОДЫ

# group: ПЕРЕДАЁМ ИНФОРМАЦИЮ
# note: ПЕРЕДАЁМ ИНФОРМАЦИЮ В РЕВИТ
# note: ПЕРЕДАЁМ ИНФОРМАЦИЮ ЕЩЁ КУДА-ТО

# group: ЗАПАСНЫЕ ВАРИАНТЫ, ДОПОЛНИТЕЛЬНЫЕ ОПЦИИ
# note: ЗАПАСНЫЕ
# note: ДОПОЛНИТЕЛЬНЫЕ. Градации серово по важности, темнее - важнее

# group: ПРИМЕЧАНИЯ ПО ЦВЕТОВОЙ ГРУППИРОВКЕ
# note: GUIDELINES

# group: КЛЮЧЕВЫЕ МОМЕНТЫ РАБОТЫ 2
# note: УСЛОЖНЕННЫЕ КОНСТРУКЦИИ
# note: УСЛОЖНЕНЫЕ КОНСТРУКЦИИ

# group: Python ноды
# note: Python

# group: ЭЛЕМЕНТЫ УПРАВЛЕНИЯ 2 УРОВЕНЬ
# note: ЭЛЕМЕНТЫ УПРАВЛЕНИЯ
# note: ПЕРЕМЕННЫЕ ЗНАЧЕНИЯ

# group: Запуск питона из внешнего файла
# note: Py - files

# group: Get Revit Selection:
forceChildrensEval = ForceChildrensEval()  # frozen; unwired: arg0
pys_get_revit_selection = Python(IN[0]=forceChildrensEval)
# ---------- pys_get_revit_selection.python (22 lines) ----------
import clr
clr.AddReference('RevitServices')
clr.AddReference('RevitAPI')
from Autodesk.Revit.DB import *
import RevitServices
from RevitServices.Persistence import DocumentManager
from Autodesk.Revit.ApplicationServices import Application

reset = IN[0]

doc = DocumentManager.Instance.CurrentDBDocument
uidoc = DocumentManager.Instance.CurrentUIApplication.ActiveUIDocument
ids = uidoc.Selection.GetElementIds()

idd = [str(i) for i in ids]

if isinstance(idd, list) == True:
	elems = [doc.GetElement(ElementId(int(i))) for i in idd]
else:
	elems = doc.GetElement(ElementId(int(idd)))

OUT = elems
# ----------------------------------------

parameters = Element.Parameters()  # unwired: arg0
geometry = Element.Geometry()  # unwired: arg0
categories = Categories("IOSModelGroups")  # frozen
all_elements_of_category = ElementsOfCategory(categories)

# group: Собрать элементы из Групп и Сборок
не_учитывает_под_группы_в = Python(IN[0]=all_elements_of_category)  # "Не учитывает под. группы в группах"
# ---------- не_учитывает_под_группы_в.python (33 lines) ----------
import clr
clr.AddReference('RevitAPI')
from Autodesk.Revit.DB import ElementId, BuiltInCategory, Document
clr.AddReference("RevitServices")
from RevitServices.Persistence import DocumentManager

#clr.AddReference("RevitNodes")
#import Revit
#clr.ImportExtensions(Revit.Elements)

doc = DocumentManager.Instance.CurrentDBDocument

groups = UnwrapElement(IN[0])
#elementlist = list()

#elementlist = [item.Category.Id for item in groups]
elementlist = [[doc.GetElement(member) for member in item.GetMemberIds()] if item.Category.Id == ElementId(-2000095) or item.Category.Id == ElementId(-2000267) else item for item in groups ]
"""
for item in groups:
	if item != None:
		if item.Category.Name == BuiltInCategory.OST_IOSModelGroups or item.Category.Name == BuiltInCategory.OST_Assemblies:
			try:
				memberlist = list()
				for member in item.GetMemberIds():
					memberlist.append(item.Document.GetElement(member))
				elementlist.append(memberlist)
			except:
				elementlist.append(list())
		else:
			elementlist.append(item)
"""

OUT = elementlist
# ----------------------------------------

getCategory = Element.GetCategory(не_учитывает_под_группы_в)
name = Category.Name(getCategory)
code_block = CodeBlock(x=name) { x == "Стены"; }
filterByBoolMask = List.FilterByBoolMask(list=не_учитывает_под_группы_в, mask=code_block)
watch = Watch(filterByBoolMask.in)
code_block_2 = CodeBlock { "ADSK_Номер квартиры"; }
code_block_3 = CodeBlock { "Тип"; "Имя типа"; }
getParameterValueByName = Element.GetParameterValueByName(element=all_elements_of_category, parameterName=code_block_3.out0)
getParameterValueByName_2 = Element.GetParameterValueByName(element=getParameterValueByName, parameterName=code_block_3.out1)
setParameterByName = Element.SetParameterByName(element=watch, parameterName=code_block_2, value=getParameterValueByName_2)
getParameterValueByName_3 = Element.GetParameterValueByName()  # unwired: element, parameterName

# group: Parameters name from language
parameters_name_from_language = Python()  # frozen
# ---------- parameters_name_from_language.python (18 lines) ----------
import clr
clr.AddReference('RevitServices')
import RevitServices
from RevitServices.Persistence import DocumentManager

uiapp = DocumentManager.Instance.CurrentUIApplication
app = uiapp.Application
lng = app.Language
rus = ["Тип","Имя семейства","Имя типа"]
enu = ["Type","Family name","Type name"]
out = []
if str(lng) == "Russian":
	out = rus
else:
	out = enu
#English_USA
#Russian
OUT = out
# ----------------------------------------

# group: элементы внутри групп
members = Python()  # "Group.Members"; frozen; unwired: IN[0]
# ---------- members.python (19 lines) ----------
import clr
clr.AddReference('RevitAPI')
from Autodesk.Revit.DB import *

clr.AddReference("RevitNodes")
import Revit
clr.ImportExtensions(Revit.Elements)

groups = UnwrapElement(IN[0])
elementlist = list()
for item in groups:
	try:
		memberlist = list()
		for member in item.GetMemberIds():
			memberlist.append(item.Document.GetElement(member))
		elementlist.append(memberlist)
	except:
		elementlist.append(list())
OUT = elementlist
# ----------------------------------------

путь_к_файлу_python = Filename(".\N.Отделка помещений_сбор элементов вокруг_1.7.py")  # frozen
forceChildrensEval_2 = ForceChildrensEval(путь_к_файлу_python)
find_file_and_import_it = Python(IN[0]=forceChildrensEval_2)
# ---------- find_file_and_import_it.python (11 lines) ----------
import sys
sys.path.append('C:\Program Files (x86)\IronPython 2.7\Lib')
import codecs

try:
	filePath = IN[0]
	with codecs.open(filePath, 'rb', "utf-8") as inf:
		lines = inf.readlines()
	OUT = ''.join(lines)
except:
	OUT = "No file"
# ----------------------------------------
python_script_from_string = PythonStringNode(script=find_file_and_import_it)  # unwired: IN[0]
categories_2 = Categories()  # frozen
all_elements_of_category_2 = ElementsOfCategory(categories_2)
regenerate = Python()  # frozen; unwired: IN[0]
# ---------- regenerate.python (26 lines) ----------
import clr

# Import DocumentManager and TransactionManager
clr.AddReference("RevitServices")
import RevitServices
from RevitServices.Persistence import DocumentManager


# Import RevitAPI
clr.AddReference("RevitAPI")
import Autodesk
from Autodesk.Revit.DB import *

doc = DocumentManager.Instance.CurrentDBDocument


#The inputs to this node will be stored as a list in the IN variable.
list = IN[0]


if list:
	doc.Regenerate()
	out = "Regeneration complete"
else:
	out = "fail"
OUT = out
# ----------------------------------------
members_2 = Python()  # "Object.Members"; frozen; unwired: IN[0]
# ---------- members_2.python (14 lines) ----------
import clr

items = IN[0]
elementlist = list()

try:
	clr.AddReference('RevitAPI')
	from Autodesk.Revit.DB import *
	for item in items:
		elementlist.append(dir(UnwrapElement(item)))
except:
	for item in items:
		elementlist.append(dir(item))
OUT = elementlist
# ----------------------------------------
filteredElementCollector = Python()  # frozen; unwired: IN[0]
# ---------- filteredElementCollector.python (29 lines) ----------
if IN[1]:
	import clr
	
	# Import DocumentManager and TransactionManager
	clr.AddReference("RevitServices")
	import RevitServices
	from RevitServices.Persistence import DocumentManager
	
	
	# Import RevitAPI
	clr.AddReference("RevitAPI")
	import Autodesk
	from Autodesk.Revit.DB import *
	
	doc = DocumentManager.Instance.CurrentDBDocument
	uiapp = DocumentManager.Instance.CurrentUIApplication
	app = uiapp.Application
	
	from System.Collections.Generic import *
	
	
	#The inputs to this node will be stored as a list in the IN variable.
	dataEnteringNode = IN
	collector = FilteredElementCollector(doc)
	elements = collector.OfCategory(BuiltInCategory.OST_Views).ToElements()
	
	OUT = sheetInstances
else:
	OUT = "скрипт не выполнен"
# ----------------------------------------
boolean = BoolSelector(true)  # frozen
code_block_4 = CodeBlock { 1; 2; }
if_ = Python(IN[0]=boolean, IN[1]=code_block_4.out0, IN[2]=code_block_4.out1)
# ---------- if_.python (4 lines) ----------
if IN[0]:
	OUT = UnwrapElement(IN[1])
else:
	OUT = UnwrapElement(IN[2])
# ----------------------------------------
som_dir = Python()  # frozen; unwired: IN[0]
# ---------- som_dir.python (62 lines) ----------
# -*- coding: utf-8 -*- 
#-----------------------Импоорт библиотек----------------------
import clr
clr.AddReference('RevitAPI')
import Autodesk
from Autodesk.Revit.DB import *

clr.AddReference("RevitNodes") 
import Revit
from Revit.Elements import *

clr.ImportExtensions(Revit.Elements) #ToDSType не работает без
clr.ImportExtensions(Revit.GeometryConversion) #ToXyz не работает без

clr.AddReference("RevitServices")
import RevitServices
from RevitServices.Persistence import DocumentManager
from RevitServices.Transactions import TransactionManager

clr.AddReference('ProtoGeometry')
from Autodesk.DesignScript.Geometry import *

#-----------------------ИМПОРТ БИБЛИОТЕК----------------------
"""-"""
#-----------------------ФУНКЦИИ----------------------

def __x__(x):
	x="x"
	return x
	
#-----------------------ФУНКЦИИ----------------------
"""-"""
#-----------------------АПИ ПАРАМЕТРЫ----------------------

doc = DocumentManager.Instance.CurrentDBDocument
#link_doc = UnwrapElement(IN[1])
#uiapp = DocumentManager.Instance.CurrentUIApplication
#app = uiapp.Application
#version = app.VersionNumber
#options = Autodesk.Revit.DB.SpatialElementBoundaryOptions()

#-----------------------АПИ ПАРАМЕТРЫ----------------------
"""-"""
#-----------------------РАБОЧИЕ ПАРАМЕТРЫ----------------------

test1 = UnwrapElement(IN[0])

#-----------------------РАБОЧИЕ ПАРАМЕТРЫ----------------------	
"""-"""
#-----------------------ТЕСТОВЫЕ ПАРАМЕТРЫ----------------------

test = []

#-----------------------ТЕСТОВЫЕ ПАРАМЕТРЫ----------------------
"""-"""
#-----------------------НАЧАЛО СКРИПТА----------------------

#TransactionManager.Instance.EnsureInTransaction(doc)
#TransactionManager.Instance.TransactionTaskDone()
#-----------------------КОНЕЦ СКРИПТА----------------------

OUT = dir(RevitServices.Persistence.DocumentManager.CurrentUIApplication)
# ----------------------------------------
array_i_lambda = Python()  # frozen; unwired: IN[0]
# ---------- array_i_lambda.python (25 lines) ----------
from System import *
from System.Collections.Generic import List

ja_spisok = ["1","2","A","B"]

ja_spisok_spiskov = [["1","2"],["A","B"]]

ja_korteg_kortegey = (("1","2"),("A","B"))

ja_spisok_arrayof = []

for ja in ja_spisok_spiskov:
	ja_spisok_arrayof.append(Array[str](ja))

strArray = Array[Array[str]](ja_spisok_arrayof)

strArray2 = Array[Array[str]](ja_korteg_kortegey)

strArray3 = Array[Array[str]](tuple(tuple(x) for x in ja_spisok_spiskov))

f = lambda x: tuple(x)

strArray4 = Array[Array[str]](f(f(x) for x in ja_spisok_spiskov))

OUT = strArray4
# ----------------------------------------
pick_object = Python()  # frozen; unwired: IN[0]
# ---------- pick_object.python (26 lines) ----------
#Copyright(c) 2016, Dimitar Venkov
# @5devene, dimitar.ven@gmail.com

import clr

clr.AddReference("RevitAPIUI")
from  Autodesk.Revit.UI import *

clr.AddReference("RevitServices")
import RevitServices
from RevitServices.Persistence import DocumentManager
doc = DocumentManager.Instance.CurrentDBDocument
uidoc=DocumentManager.Instance.CurrentUIApplication.ActiveUIDocument

clr.AddReference("RevitNodes")
import Revit
clr.ImportExtensions(Revit.Elements)

sel1 = uidoc.Selection
ot1 = Selection.ObjectType.Element
ot2 = Selection.ObjectType.LinkedElement
li_ref = sel1.PickObject(ot1, "Select a link instance first.")
el_ref = sel1.PickObject(ot2, "Pick a linked element.")
Link1 = doc.GetElement(li_ref.ElementId)
LinkDoc = Link1.GetLinkDocument()
OUT = LinkDoc.GetElement(el_ref.LinkedElementId).ToDSType(True)
# ----------------------------------------
select_link_file = DSModelElementSelection()
forceChildrensEval_3 = ForceChildrensEval(select_link_file)
preselectedLinkElement = Python(IN[0]=forceChildrensEval_3)
# ---------- preselectedLinkElement.python (55 lines) ----------
import clr

clr.AddReference("System")
from System.Collections.Generic import List

clr.AddReference("RevitAPIUI")
from  Autodesk.Revit.UI import *
from  Autodesk.Revit.UI.Selection import ISelectionFilter

import clr
clr.AddReference('RevitAPI')
import Autodesk
from Autodesk.Revit.DB import *

clr.AddReference("RevitServices")
import RevitServices
from RevitServices.Persistence import DocumentManager
from RevitServices.Transactions import TransactionManager

clr.AddReference("RevitNodes")
import Revit
clr.ImportExtensions(Revit.Elements)

class iSF(ISelectionFilter):
	def AllowElement(self, element):
		return True
	def AllowReference(self, refer, point):
		return True

doc = DocumentManager.Instance.CurrentDBDocument
uidoc = DocumentManager.Instance.CurrentUIApplication.ActiveUIDocument

link = UnwrapElement(IN[0])

#el_ref = UnwrapElement(sel1.PickObjects(ot2, "Select the linked elements and press Finish."))

LinkDoc = link.GetLinkDocument()
#walls = FilteredElementCollector(LinkDoc).OfCategory(BuiltInCategory.OST_Walls).ToElementIds()
walls2 = FilteredElementCollector(LinkDoc).OfCategory(BuiltInCategory.OST_Walls).ToElements()
ref_list = []
for elem in walls2:
	ref_list.append(Reference(elem).CreateLinkReference(link))

ilisrt_ref = List[Reference](ref_list)

#newids = [LinkElementId(link.Id,w) for w in walls]
#newids2 = [nw.LinkedElementId for nw in newids]
#ilist = List[ElementId](newids2)

sel1 = uidoc.Selection
ot2 = Selection.ObjectType.LinkedElement
#sel1.SetElementIds(ilist)
sel1.PickObjects(ot2,iSF(),"blablabla",ilisrt_ref)

OUT = 1
# ----------------------------------------

# group: Get Revit Selection:
# note: ВСЁ ОСТАЛЬНОЕ
forceChildrensEval_4 = ForceChildrensEval()  # unwired: arg0
pys_get_revit_selection_2 = Python(IN[0]=forceChildrensEval_4)  # same code as pys_get_revit_selection

parameters_2 = Element.Parameters(pys_get_revit_selection_2)
geometry_2 = Element.Geometry(pys_get_revit_selection_2)
список_категорий = StringInput("Части, Окна, Панели витража, Несущие колонны, Ограждение")
список_категорий_2 = StringInput("Части, Стены")
python_script_фильтруем_элементы = Python(IN[1]=список_категорий_2)  # "Python Script - Фильтруем элементы по именам категорий"; unwired: IN[0]
# ---------- python_script_фильтруем_элементы.python (12 lines) ----------
import clr
clr.AddReference('RevitAPI')
from Autodesk.Revit.DB import BuiltInParameter

elements = UnwrapElement(IN[0])
cats = UnwrapElement(IN[1])

filtred_elements = [e for e in elements if e.get_Parameter(BuiltInParameter.ELEM_CATEGORY_PARAM).AsValueString() in cats]
filtred_cats = [fe.get_Parameter(BuiltInParameter.ELEM_CATEGORY_PARAM).AsValueString() if not fe.get_Parameter(BuiltInParameter.DPART_ORIGINAL_CATEGORY) else fe.get_Parameter(BuiltInParameter.DPART_ORIGINAL_CATEGORY).AsString() for fe in filtred_elements ]

#OUT = [e for e in elements if e.get_Parameter(BuiltInParameter.ELEM_CATEGORY_PARAM).AsValueString() in cats]
OUT = (filtred_elements,filtred_cats)
# ----------------------------------------
som_workset = Python()  # unwired: IN[0]
# ---------- som_workset.python (30 lines) ----------
# -*- coding: utf-8 -*- 
#-----------------------Импоорт библиотек----------------------
import clr
clr.AddReference('RevitAPI')
import Autodesk
from Autodesk.Revit.DB import *

clr.AddReference("RevitNodes") 
import Revit
from Revit.Elements import *

clr.ImportExtensions(Revit.Elements) #ToDSType не работает без
clr.ImportExtensions(Revit.GeometryConversion) #ToXyz не работает без

clr.AddReference("RevitServices")
import RevitServices
from RevitServices.Persistence import DocumentManager
from RevitServices.Transactions import TransactionManager

clr.AddReference('ProtoGeometry')
from Autodesk.DesignScript.Geometry import *

doc = DocumentManager.Instance.CurrentDBDocument
wt = doc.GetWorksetTable()
walls = UnwrapElement(IN[0])

worksets_name = [wt.GetWorkset(e.WorksetId).Name for e in walls]
worksets = [wt.GetWorkset(e.WorksetId) for e in walls]

OUT = worksets,worksets_name
# ----------------------------------------
linkelemid_by_tag = Python()  # unwired: IN[0], IN[1]
# ---------- linkelemid_by_tag.python (117 lines) ----------
# -*- coding: utf-8 -*- 
#-----------------------Импоорт библиотек----------------------
import clr
clr.AddReference('RevitAPI')
import Autodesk
from Autodesk.Revit.DB import *

clr.AddReference("RevitNodes") 
import Revit
from Revit.Elements import *

clr.ImportExtensions(Revit.Elements) #ToDSType не работает без
clr.ImportExtensions(Revit.GeometryConversion) #ToXyz не работает без

clr.AddReference("RevitServices")
import RevitServices
from RevitServices.Persistence import DocumentManager
from RevitServices.Transactions import TransactionManager

clr.AddReference('ProtoGeometry')
from Autodesk.DesignScript.Geometry import *

import System
clr.AddReference('System')
from System.Collections.Generic import List

#-----------------------ИМПОРТ БИБЛИОТЕК----------------------
"""-"""
#-----------------------ФУНКЦИИ----------------------

def __x__(x):
	x="x"
	return x
	
#-----------------------ФУНКЦИИ----------------------
"""-"""
#-----------------------АПИ ПАРАМЕТРЫ----------------------

#doc = DocumentManager.Instance.CurrentDBDocument
#link_doc = UnwrapElement(IN[1])
#uiapp = DocumentManager.Instance.CurrentUIApplication
#app = uiapp.Application
#version = app.VersionNumber
#options = Autodesk.Revit.DB.SpatialElementBoundaryOptions()

#g_id_list = []
#g_id_list.append(ElementId(group))

#bxList = List[ElementId](g_id_list) #АЙ ЛИСТ КОЛЕКТИОН
#move = Transform.CreateTranslation(-wall.Orientation*2) #смещение
#cl.CreateTransformed(move)

#-----------------------АПИ ПАРАМЕТРЫ----------------------
"""-"""
#-----------------------РАБОЧИЕ ПАРАМЕТРЫ----------------------
link_inst = UnwrapElement(IN[0])
loc_elem = UnwrapElement(IN[1])

doc = DocumentManager.Instance.CurrentDBDocument
uidoc = DocumentManager.Instance.CurrentUIDocument

link_doc = link_inst.GetLinkDocument()
#walls = FilteredElementCollector(doc).OfCategory(BuiltInCategory.OST_Walls).ToElements()
link_tags = FilteredElementCollector(doc).OfClass(IndependentTag)

test = []
tag_ids = []
linked_ids = []
linkins_ids = []
host_ids = []

opt = Options()
opt.ComputeReferences = True

view = doc.ActiveView

elems_list = []

for w in link_tags:
	tag_elem_id = w.TaggedElementId
	#tag_ids.append(w.TaggedLocalElementId)
	linked_ids.append(tag_elem_id.LinkedElementId)
	#linkins_ids.append(tag_elem_id.LinkInstanceId.ToString())
	#host_ids.append(tag_elem_id.HostElementId)
	
#link_elem_geom = link_doc.GetElement(linked_ids[0]).get_Geometry(opt)#.GetReferences()
#elem_geom2 = doc.GetElement(walls[4].Id).Geometry[opt]
for g in linked_ids:
	elems_list.append(link_doc.GetElement(g))
	
#geom_centr_point = link_elem_geom.ComputeCentroid()
#uidoc.ShowElements(link_elem)
#ref_insp = ReferenceIntersector(linked_ids[0], FindReferenceTarget.Element, view )
#ref_contx = ref_insp.FindNearest(test[0],test[0].Multiply(3))
elem = elems_list[1]

if elem.Location.GetType() == LocationCurve:
	location = elem.Location.Curve.Evaluate(0.5, True)
elif elem.Location.GetType() == LocationPoint:
	location = elem.Location.Point
ref = Reference(elem).CreateLinkReference(link_inst)

TransactionManager.Instance.EnsureInTransaction(doc)

"""#2019
newtag = IndependentTag.Create(doc,view.Id,ref,True,TagMode.TM_ADDBY_CATEGORY,TagOrientation.Horizontal,location)
"""
#2017 не работает для связанных файлов
newtag = doc.Create.NewTag(view, elem, False, TagMode.TM_ADDBY_CATEGORY, TagOrientation.Horizontal, location)

TransactionManager.Instance.EnsureInTransaction(doc)

#TransactionManager.Instance.TransactionTaskDone()
#newtag= doc.NewTag(view,elems_list[0],True,TagMode.TM_ADDBY_CATEGORY,TagOrientation.Horizontal,centr)


OUT = newtag
# ----------------------------------------
test = Python()  # frozen; unwired: IN[0]
# ---------- test.python (28 lines) ----------
# -*- coding: utf-8 -*- 
#-----------------------Импоорт библиотек----------------------
import clr
clr.AddReference('RevitAPI')
import Autodesk
from Autodesk.Revit.DB import *
from Autodesk.Revit.DB.ExternalService import *

clr.AddReference("RevitNodes") 
import Revit
from Revit.Elements import *

clr.ImportExtensions(Revit.Elements) #ToDSType не работает без
clr.ImportExtensions(Revit.GeometryConversion) #ToXyz не работает без

clr.AddReference("RevitServices")
import RevitServices
from RevitServices.Persistence import DocumentManager
from RevitServices.Transactions import TransactionManager

clr.AddReference('ProtoGeometry')
from Autodesk.DesignScript.Geometry import *

doc = DocumentManager.Instance.CurrentDBDocument

serviceId = ExternalServices.BuiltInExternalServices.DirectContext3DService

OUT = serviceId
# ----------------------------------------
путь_к_файлу_python_2 = Filename("Z.Тест\DirectContext3D.py")
forceChildrensEval_5 = ForceChildrensEval(путь_к_файлу_python_2)
find_file_and_import_it_2 = Python(IN[0]=forceChildrensEval_5)  # same code as find_file_and_import_it
python_script_from_string_2 = PythonStringNode(script=find_file_and_import_it_2)  # unwired: IN[0]
список_категорий_3 = StringInput("Стены, Колонны")
python_script_фильтруем_элементы_2 = Python(IN[0]=не_учитывает_под_группы_в, IN[1]=список_категорий_3)  # "Python Script - Фильтруем элементы по именам категорий"; same code as python_script_фильтруем_элементы
name_2 = Family.Name(all_elements_of_category)
name_3 = Parameter.Name()  # unwired: arg0
categories_3 = Categories("Parts")
all_elements_of_category_3 = ElementsOfCategory(categories_3)
code_block_5 = CodeBlock { "ADSK_Номер квартиры"; }
getparents = Custom[Parts.Getparents](Parts=all_elements_of_category_3)  # Returns parents of selected Parts
getParameterValueByName_4 = Element.GetParameterValueByName(element=getparents, parameterName=code_block_5)
setParameterByName_2 = Element.SetParameterByName(element=all_elements_of_category_3, parameterName=code_block_5, value=getParameterValueByName_4)
