# Dynamo graph Изминение стадии элемента внутри группы_выбор.dyn (Dynamo 1.3.2.2480)

# note: ВСЁ ОСТАЛЬНОЕ

# group: ЗАПАСНЫЕ ВАРИАНТЫ, ДОПОЛНИТЕЛЬНЫЕ ОПЦИИ
# note: ДОПОЛНИТЕЛЬНЫЕ. Градации серово по важности, темнее - важнее
# note: ЗАПАСНЫЕ

# group: КЛЮЧЕВЫЕ МОМЕНТЫ РАБОТЫ 2
# note: НОДЫ РАБОТАЮЩИЕ С ДАННЫМИ
# note: ИСПОЛНИТЕЛЬНЫЕ НОДЫ

# group: КЛЮЧЕВЫЕ МОМЕНТЫ РАБОТЫ 1
# note: ИТОГОВАЯ КОНСОЛИДАЦИЯ ДАННЫХ

# group: ИСПОЛНИТЕЛЬНЫЕ НОДЫ (фильтрование, подбор, списки и т.д.)
# note: ИСПОЛНИТЕЛЬНЫЕ НОДЫ
# note: НОДЫ РАБОТАЮЩИЕ С ДАННЫМИ

# group: ЭЛЕМЕНТЫ УПРАВЛЕНИЯ 2 УРОВЕНЬ
# note: ПЕРЕМЕННЫЕ ЗНАЧЕНИЯ
# note: ЭЛЕМЕНТЫ УПРАВЛЕНИЯ

# group: ПРОВЕРОЧНЫЕ НОДЫ
# note: ПРОВЕРОЧНЫЕ НОДЫ

# group: ПЕРЕДАЁМ ИНФОРМАЦИЮ В РЕВИТ
# note: ПЕРЕДАЁМ ИНФОРМАЦИЮ В РЕВИТ

# group: ЭЛЕМЕНТЫ УПРАВЛЕНИЯ Dyno Studio
# note: Dyno Studio

# group: ЭЛЕМЕНТЫ УПРАВЛЕНИЯ
# note: ПЕРЕМЕННЫЕ ЗНАЧЕНИЯ
# note: ЭЛЕМЕНТЫ УПРАВЛЕНИЯ

# group: ПРИМЕЧАНИЯ ПО ЦВЕТОВОЙ ГРУППИРОВКЕ
# note: GUIDELINES

# group: ПОЛУЧАЕМ ДАННЫЕ ИЗ РЕВИТ
# note: ПОЛУЧАЕМ ДАННЫЕ ИЗ РЕВИТ

выбрать_элементы = DSModelElementsSelection()
getCategory = Element.GetCategory(выбрать_элементы)
string_from_object = FromObject(getCategory)
categories = Categories("Walls")
string_from_object_2 = FromObject(categories)
string_from_object_3 = FromObject(string_from_object_2)
eq = string_from_object == string_from_object_3
filterByBoolMask = List.FilterByBoolMask(list=выбрать_элементы, mask=eq)
параметр_1 = StringInput("Стадия возведения")
phases = PhaseUI("Отделка квартир")
setParameterByName = Element.SetParameterByName(element=filterByBoolMask.in, parameterName=параметр_1, value=phases)
количество_элементов = Watch(setParameterByName)
setParameterByName_2 = Element.SetParameterByName()  # unwired: element, parameterName, value
parameters = Element.Parameters(filterByBoolMask.in)
geometry = Element.Geometry()  # unwired: arg0
boolean = BoolSelector(true)  # frozen
code_block = CodeBlock { 1; 2; }
if_ = Python(IN[0]=boolean, IN[1]=code_block.out0, IN[2]=code_block.out1)
# ---------- if_.python (12 lines) ----------
import clr
boolean = IN[0]
true = UnwrapElement(IN[1])
false = UnwrapElement(IN[2])

if boolean:
	out = true
else:
	out = false

#Назначьте вывод переменной OUT.
OUT = out
# ----------------------------------------

# group: элементы внутри групп
members = Python()  # "Group.Members"; frozen; unwired: IN[0]
# ---------- members.python (19 lines) ----------
import clr
clr.AddReference('RevitAPI')
from Autodesk.Revit.DB import *

clr.AddReference("RevitNodes")
import Revit
clr.ImportExtensions(Revit.Elements)

groups = UnwrapElement(IN[0])
elementlist = list()
for item in groups:
	try:
		memberlist = list()
		for member in item.GetMemberIds():
			memberlist.append(item.Document.GetElement(member))
		elementlist.append(memberlist)
	except:
		elementlist.append(list())
OUT = elementlist
# ----------------------------------------

# group: Get Revit Selection:
forceChildrensEval = ForceChildrensEval()  # frozen; unwired: arg0
pys_get_revit_selection = Python(IN[0]=forceChildrensEval)
# ---------- pys_get_revit_selection.python (22 lines) ----------
import clr
clr.AddReference('RevitServices')
clr.AddReference('RevitAPI')
from Autodesk.Revit.DB import *
import RevitServices
from RevitServices.Persistence import DocumentManager
from Autodesk.Revit.ApplicationServices import Application

reset = IN[0]

doc = DocumentManager.Instance.CurrentDBDocument
uidoc = DocumentManager.Instance.CurrentUIApplication.ActiveUIDocument
ids = uidoc.Selection.GetElementIds()

idd = [str(i) for i in ids]

if isinstance(idd, list) == True:
	elems = [doc.GetElement(ElementId(int(i))) for i in idd]
else:
	elems = doc.GetElement(ElementId(int(idd)))

OUT = elems
# ----------------------------------------

# group: Parameters name from language
parameters_name_from_language = Python()  # frozen
# ---------- parameters_name_from_language.python (18 lines) ----------
import clr
clr.AddReference('RevitServices')
import RevitServices
from RevitServices.Persistence import DocumentManager

uiapp = DocumentManager.Instance.CurrentUIApplication
app = uiapp.Application
lng = app.Language
rus = ["Тип","Имя семейства","Имя типа"]
enu = ["Type","Family name","Type name"]
out = []
if str(lng) == "Russian":
	out = rus
else:
	out = enu
#English_USA
#Russian
OUT = out
# ----------------------------------------
