# Dynamo graph DWG_Links_reload_from_path.dyn (Dynamo 1.3.3.4111)

forceChildrensEval = ForceChildrensEval()  # unwired: arg0
directory_path = Directory("C:\test\SP")
file_name_contains_text = StringInput("Стадия П")
python_script = Python(IN[0]=forceChildrensEval, IN[1]=directory_path, IN[2]=file_name_contains_text)
# ---------- python_script.python (68 lines) ----------
import clr
clr.AddReference('ProtoGeometry')
from Autodesk.DesignScript.Geometry import *
# Import ToDSType(bool) extension method
clr.AddReference("RevitNodes")
import Revit
clr.ImportExtensions(Revit.Elements)
# Import geometry conversion extension methods
clr.ImportExtensions(Revit.GeometryConversion)
# Import DocumentManager and TransactionManager
clr.AddReference("RevitServices")
import RevitServices
from RevitServices.Persistence import DocumentManager
from RevitServices.Transactions import TransactionManager
from System.Collections.Generic import *
# Import RevitAPI
clr.AddReference("RevitAPI")
import Autodesk
from Autodesk.Revit.DB import *

doc = DocumentManager.Instance.CurrentDBDocument
uiapp = DocumentManager.Instance.CurrentUIApplication
app = uiapp.Application
uidoc=DocumentManager.Instance.CurrentUIApplication.ActiveUIDocument
collector = Autodesk.Revit.DB.FilteredElementCollector(doc)
linkInstances = collector.OfClass(ImportInstance).WhereElementIsNotElementType()

reset = IN[0]
folderpath = IN[1]
prifix = IN[2]
reloadedlinks = []
reloadednames = []
linkedlist = []
importlist = []
count = 0
testnames = []

for item in linkInstances:
	if item.IsLinked and item.LookupParameter("Имя").AsString() not in testnames:
		if prifix != "":
			name = item.LookupParameter("Имя").AsString()
			if prifix in name:
				testnames.append(item.LookupParameter("Имя").AsString())
				linkedlist.append(item)
			else:
				pass
		else:
			linkedlist.append(item)
	else:
		importlist.append(item)
		
		
for i in linkedlist:
	name = i.LookupParameter("Имя").AsString()
	path = folderpath + "\\" + name
	CADLinkType = doc.GetElement(i.GetTypeId())
	
	TransactionManager.Instance.EnsureInTransaction(doc)
	try:
		CADLinkType.LoadFrom(path)
		count = count+1
	except:
		pass
	TransactionManager.Instance.TransactionTaskDone()
	reloadedlinks.append(CADLinkType)
	reloadednames.append(name)

OUT= "Обновлено ссылок="+str(count),reloadednames,reloadedlinks
# ----------------------------------------
