# Dynamo graph RS_save_doc_from_server.dyn (Dynamo 1.3.3.4651)

путь_к_файлу_python = Filename(".\RS_save_doc_from_server.py")
forceChildrensEval = ForceChildrensEval()  # unwired: arg0
find_file_and_import_it = Python(IN[0]=путь_к_файлу_python, IN[1]=forceChildrensEval)
# ---------- find_file_and_import_it.python (11 lines) ----------
import sys
sys.path.append('C:\Program Files (x86)\IronPython 2.7\Lib')
import codecs

try:
	filePath = IN[0]
	with codecs.open(filePath, 'rb', "utf-8") as inf:
		lines = inf.readlines()
	OUT = ''.join(lines)
except:
	OUT = "No file"
# ----------------------------------------

# group: ЕСЛИ НЕ СРАБАТЫВАЕТ значит ПЕРЕНАЗНАЧЕНО ВНУТРИ СКРИПТА
server_name = StringInput("bim.mtrx.net.ru")
project_folder_name = StringInput("Ореховый")
new_path = Directory("C:\test\RevitServer_backup")
копируем_папки_или_весь_сервер = BoolSelector(true)
foldersе_через_запятую = StringInput("КР")

python_script_from_string = PythonStringNode(script=find_file_and_import_it, IN[0]=server_name, IN[1]=project_folder_name, IN[2]=new_path, IN[3]=копируем_папки_или_весь_сервер, IN[4]=foldersе_через_запятую, IN[5]=forceChildrensEval)
