# Dynamo graph RVT_Links_reload_from_path.dyn (Dynamo 1.3.3.4111)

reload = Custom[RevitLinkType.Reload]()  # frozen; Reloads a Revit or IFC link.; unwired: revitLinkType
forceChildrensEval = ForceChildrensEval()  # unwired: arg0
написать_путь_или_выбрать_папку = BoolSelector(true)
directory_path_string = StringInput("rsn:\\")
directory_path = Directory("C:\Users\babinovan\Pictures\ИСКРА-ПАРК\МОДЕЛь из СПИЧ\Отсоединено")
if_ = If(test=написать_путь_или_выбрать_папку, true=directory_path_string, false=directory_path)
file_name_contains_text = StringInput("AR")
file_prifix_если_нужен = StringInput("")
python_script = Python(IN[0]=forceChildrensEval, IN[1]=if_, IN[2]=file_name_contains_text, IN[3]=file_prifix_если_нужен)
# ---------- python_script.python (48 lines) ----------
#python nodes in dynamo 1.0.0
#originally by Nicklas Østertgaard  nvo@bimshark.com / nvo@shl.fk
import clr
clr.AddReference('ProtoGeometry')
from Autodesk.DesignScript.Geometry import *
# Import ToDSType(bool) extension method
clr.AddReference("RevitNodes")
import Revit
clr.ImportExtensions(Revit.Elements)
# Import geometry conversion extension methods
clr.ImportExtensions(Revit.GeometryConversion)
# Import DocumentManager and TransactionManager
clr.AddReference("RevitServices")
import RevitServices
from RevitServices.Persistence import DocumentManager
from RevitServices.Transactions import TransactionManager
from System.Collections.Generic import *
# Import RevitAPI
clr.AddReference("RevitAPI")
import Autodesk
from Autodesk.Revit.DB import *
doc = DocumentManager.Instance.CurrentDBDocument
uiapp = DocumentManager.Instance.CurrentUIApplication
app = uiapp.Application
uidoc=DocumentManager.Instance.CurrentUIApplication.ActiveUIDocument
collector = Autodesk.Revit.DB.FilteredElementCollector(doc)
linkInstances = collector.OfClass(Autodesk.Revit.DB.RevitLinkInstance)
folderpath = IN[1]
reloadedlinks = []
testname = IN[2]
prifix = IN[3]

for i in linkInstances:
	name = i.Name
	if testname in name:
		path = folderpath + "\\" + name
		path = path.rsplit(' : ',2)[0]
		path = path.replace(".rvt",prifix+".rvt")
		filepath = FilePath(path)
		RevitLinkType  = doc.GetElement(i.GetTypeId())
		try:
			RevitLinkType.LoadFrom(filepath,None)
			reloadedlinks.append(path)#RevitLinkType)
		except:
			reloadedlinks.append("fail"+"―"+path)
	else:
		pass
OUT= reloadedlinks
# ----------------------------------------
отчёт_по_загрузке = Watch(python_script)
directory_path_string_2 = StringInput("\\Sh35fs4\департамент заказчика\Отдел информационного моделирования\Искра-Парк\04_Входящие\МОДЕЛь из СПИЧ\Модели с проверками")
