# Dynamo graph RVT_Links_reload_from_server.dyn (Dynamo 1.3.3.4111)

перезапуск = BoolSelector(true)
directory_path_string = StringInput("RSN://")
file_name_contains_text = StringInput("-AR_R17")
добавить_прификс_или_убрать = BoolSelector(true)
file_prifix_если_нужен = StringInput("")
python_script = Python(IN[0]=перезапуск, IN[1]=directory_path_string, IN[2]=file_name_contains_text, IN[3]=добавить_прификс_или_убрать, IN[4]=file_prifix_если_нужен)
# ---------- python_script.python (44 lines) ----------
import clr
clr.AddReference("RevitServices")
import RevitServices
from RevitServices.Persistence import DocumentManager
from RevitServices.Transactions import TransactionManager

clr.AddReference("RevitAPI")
import Autodesk
from Autodesk.Revit.DB import ModelPathUtils

doc = DocumentManager.Instance.CurrentDBDocument
uiapp = DocumentManager.Instance.CurrentUIApplication
app = uiapp.Application
uidoc=DocumentManager.Instance.CurrentUIApplication.ActiveUIDocument
collector = Autodesk.Revit.DB.FilteredElementCollector(doc)
linkInstances = collector.OfClass(Autodesk.Revit.DB.RevitLinkInstance)
folderpath = IN[1]
reloadedlinks = []
testname = IN[2]
prif_bool = IN[3]
prifix = IN[4]

for i in linkInstances:
	name = i.Name
	if testname in name:
		if "RSN" in folderpath:
			path = folderpath + "/" + name
		else:
			path = folderpath + "\\" + name
		path = path.rsplit(' : ',2)[0]
		if prif_bool:
			path = path.replace(".rvt",prifix+".rvt")
		else:
			path = path.replace(prifix+".rvt",".rvt")
		filepath = ModelPathUtils.ConvertUserVisiblePathToModelPath(path)
		RevitLinkType  = doc.GetElement(i.GetTypeId())
		try:
			RevitLinkType.LoadFrom(filepath,None)
			reloadedlinks.append(path)
		except:
			reloadedlinks.append("fail"+"―"+path)
	else:
		pass
OUT= reloadedlinks
# ----------------------------------------
отчёт_по_загрузке = Watch(python_script)
directory_path_string_2 = StringInput("RSN://bim.mtrx.net.ru/Ореховый")
directory_path = Directory("D:\ГПЪ\Орех_next")
directory_path_2 = Directory("C:\test")
directory_path_string_3 = StringInput("RSN://")
file_name_contains_text_2 = StringInput("HWAC")
