# Dynamo graph Освобождение занятых файлов.dyn (Dynamo 1.3.3.4111)

# group: ЗАПАСНЫЕ ВАРИАНТЫ, ДОПОЛНИТЕЛЬНЫЕ ОПЦИИ
# note: ДОПОЛНИТЕЛЬНЫЕ. Градации серово по важности, темнее - важнее
# note: ЗАПАСНЫЕ

# group: КЛЮЧЕВЫЕ МОМЕНТЫ РАБОТЫ 1
# note: КОНСОЛИДАЦИЯ И СЛОЖНЫЕ ОБРАБОТКИ

# group: КЛЮЧЕВЫЕ МОМЕНТЫ РАБОТЫ 2
# note: УСЛОЖНЕННЫЕ КОНСТРУКЦИИ
# note: УСЛОЖНЕНЫЕ КОНСТРУКЦИИ

# group: Python ноды
# note: Python

# group: Запуск питона из внешнего файла
# note: Py - files

# group: ПОЛУЧАЕМ ДАННЫЕ
# note: ПОЛУЧАЕМ ДАННЫЕ ИЗ РЕВИТ и других источников

# group: ИСПОЛНИТЕЛЬНЫЕ НОДЫ (фильтрование, подбор, списки и т.д.)
# note: ИСПОЛНИТЕЛЬНЫЕ НОДЫ

# group: ЭЛЕМЕНТЫ УПРАВЛЕНИЯ 2 УРОВЕНЬ
# note: ЭЛЕМЕНТЫ УПРАВЛЕНИЯ
# note: ПЕРЕМЕННЫЕ ЗНАЧЕНИЯ

# group: ЭЛЕМЕНТЫ УПРАВЛЕНИЯ
# note: ПЕРЕМЕННЫЕ ЗНАЧЕНИЯ
# note: ЭЛЕМЕНТЫ УПРАВЛЕНИЯ

# group: ПРОВЕРОЧНЫЕ НОДЫ
# note: ПРОВЕРОЧНЫЕ НОДЫ

# group: ПЕРЕДАЁМ ИНФОРМАЦИЮ
# note: ПЕРЕДАЁМ ИНФОРМАЦИЮ В РЕВИТ
# note: ПЕРЕДАЁМ ИНФОРМАЦИЮ ЕЩЁ КУДА-ТО

# group: ПРИМЕЧАНИЯ ПО ЦВЕТОВОЙ ГРУППИРОВКЕ
# note: GUIDELINES

code_block = CodeBlock { {"17_06-05-01-AR_R17.rvt"}; }
code_block_2 = CodeBlock(x=code_block) { "rsn:///АР/"+x; }
parameters = Element.Parameters()  # unwired: arg0
geometry = Element.Geometry()  # unwired: arg0
setParameterByName = Element.SetParameterByName()  # unwired: element, parameterName, value
# note: ВСЁ ОСТАЛЬНОЕ
getParameterValueByName = Element.GetParameterValueByName()  # unwired: element, parameterName
boolean = BoolSelector(true)  # frozen
code_block_3 = CodeBlock { 1; 2; }
if_ = Python(IN[0]=boolean, IN[1]=code_block_3.out0, IN[2]=code_block_3.out1)
# ---------- if_.python (12 lines) ----------
import clr
boolean = IN[0]
true = UnwrapElement(IN[1])
false = UnwrapElement(IN[2])

if boolean:
	out = true
else:
	out = false

#Назначьте вывод переменной OUT.
OUT = out
# ----------------------------------------
members = Python()  # "Object.Members"; frozen; unwired: IN[0]
# ---------- members.python (14 lines) ----------
import clr

items = IN[0]
elementlist = list()

try:
	clr.AddReference('RevitAPI')
	from Autodesk.Revit.DB import *
	for item in items:
		elementlist.append(dir(UnwrapElement(item)))
except:
	for item in items:
		elementlist.append(dir(item))
OUT = elementlist
# ----------------------------------------
filteredElementCollector = Python()  # frozen; unwired: IN[0]
# ---------- filteredElementCollector.python (29 lines) ----------
if IN[1]:
	import clr
	
	# Import DocumentManager and TransactionManager
	clr.AddReference("RevitServices")
	import RevitServices
	from RevitServices.Persistence import DocumentManager
	
	
	# Import RevitAPI
	clr.AddReference("RevitAPI")
	import Autodesk
	from Autodesk.Revit.DB import *
	
	doc = DocumentManager.Instance.CurrentDBDocument
	uiapp = DocumentManager.Instance.CurrentUIApplication
	app = uiapp.Application
	
	from System.Collections.Generic import *
	
	
	#The inputs to this node will be stored as a list in the IN variable.
	dataEnteringNode = IN
	collector = FilteredElementCollector(doc)
	elements = collector.OfCategory(BuiltInCategory.OST_Views).ToElements()
	
	OUT = sheetInstances
else:
	OUT = "скрипт не выполнен"
# ----------------------------------------
shablon_python_shablon = Python()  # frozen; unwired: IN[0]
# ---------- shablon_python_shablon.python (76 lines) ----------
# -*- coding: utf-8 -*- 
#-----------------------Импоорт библиотек----------------------
import clr
clr.AddReference('RevitAPI')
import Autodesk
from Autodesk.Revit.DB import *

clr.AddReference("RevitNodes") 
import Revit
from Revit.Elements import *

clr.ImportExtensions(Revit.Elements) #ToDSType не работает без
clr.ImportExtensions(Revit.GeometryConversion) #ToXyz не работает без

clr.AddReference("RevitServices")
import RevitServices
from RevitServices.Persistence import DocumentManager
from RevitServices.Transactions import TransactionManager

clr.AddReference('ProtoGeometry')
from Autodesk.DesignScript.Geometry import *

#-----------------------ИМПОРТ БИБЛИОТЕК----------------------
"""-"""
#-----------------------ФУНКЦИИ----------------------

def __x__(x):
	x="x"
	return x
	
#-----------------------ФУНКЦИИ----------------------
"""-"""
#-----------------------АПИ ПАРАМЕТРЫ----------------------

doc = DocumentManager.Instance.CurrentDBDocument
#link_doc = UnwrapElement(IN[1])
#uiapp = DocumentManager.Instance.CurrentUIApplication
#app = uiapp.Application
#version = app.VersionNumber
#options = Autodesk.Revit.DB.SpatialElementBoundaryOptions()
calculator = SpatialElementGeometryCalculator(doc)

g_id_list = []
g_id_list.append(ElementId(group))

bxList = List[ElementId](g_id_list) #АЙ ЛИСТ КОЛЕКТИОН
move = Transform.CreateTranslation(-wall.Orientation*2) #смещение
cl.CreateTransformed(move)

#-----------------------АПИ ПАРАМЕТРЫ----------------------
"""-"""
#-----------------------РАБОЧИЕ ПАРАМЕТРЫ----------------------

rooms = UnwrapElement(IN[0])

#-----------------------РАБОЧИЕ ПАРАМЕТРЫ----------------------	
"""-"""
#-----------------------ТЕСТОВЫЕ ПАРАМЕТРЫ----------------------

test = []

#-----------------------ТЕСТОВЫЕ ПАРАМЕТРЫ----------------------
"""-"""
#-----------------------НАЧАЛО СКРИПТА----------------------

x = 0
if rooms == None:
	rooms = [0,0]

for room in rooms:
	x=__x__(x)+__x__(x)
#TransactionManager.Instance.EnsureInTransaction(doc)
#TransactionManager.Instance.TransactionTaskDone()
#-----------------------КОНЕЦ СКРИПТА----------------------

OUT = x
# ----------------------------------------

# group: Get Revit Selection:
forceChildrensEval = ForceChildrensEval()  # frozen; unwired: arg0
pys_get_revit_selection = Python(IN[0]=forceChildrensEval)
# ---------- pys_get_revit_selection.python (22 lines) ----------
import clr
clr.AddReference('RevitServices')
clr.AddReference('RevitAPI')
from Autodesk.Revit.DB import *
import RevitServices
from RevitServices.Persistence import DocumentManager
from Autodesk.Revit.ApplicationServices import Application

reset = IN[0]

doc = DocumentManager.Instance.CurrentDBDocument
uidoc = DocumentManager.Instance.CurrentUIApplication.ActiveUIDocument
ids = uidoc.Selection.GetElementIds()

idd = [str(i) for i in ids]

if isinstance(idd, list) == True:
	elems = [doc.GetElement(ElementId(int(i))) for i in idd]
else:
	elems = doc.GetElement(ElementId(int(idd)))

OUT = elems
# ----------------------------------------

# group: Parameters name from language
parameters_name_from_language = Python()  # frozen
# ---------- parameters_name_from_language.python (18 lines) ----------
import clr
clr.AddReference('RevitServices')
import RevitServices
from RevitServices.Persistence import DocumentManager

uiapp = DocumentManager.Instance.CurrentUIApplication
app = uiapp.Application
lng = app.Language
rus = ["Тип","Имя семейства","Имя типа"]
enu = ["Type","Family name","Type name"]
out = []
if str(lng) == "Russian":
	out = rus
else:
	out = enu
#English_USA
#Russian
OUT = out
# ----------------------------------------

# group: элементы внутри групп
members_2 = Python()  # "Group.Members"; frozen; unwired: IN[0]
# ---------- members_2.python (19 lines) ----------
import clr
clr.AddReference('RevitAPI')
from Autodesk.Revit.DB import *

clr.AddReference("RevitNodes")
import Revit
clr.ImportExtensions(Revit.Elements)

groups = UnwrapElement(IN[0])
elementlist = list()
for item in groups:
	try:
		memberlist = list()
		for member in item.GetMemberIds():
			memberlist.append(item.Document.GetElement(member))
		elementlist.append(memberlist)
	except:
		elementlist.append(list())
OUT = elementlist
# ----------------------------------------

путь_к_файлу_python = Filename(".\N.Отделка помещений_сбор элементов вокруг_1.7.py")  # frozen
forceChildrensEval_2 = ForceChildrensEval()  # unwired: arg0
find_file_and_import_it = Python(IN[0]=путь_к_файлу_python, IN[1]=forceChildrensEval_2)
# ---------- find_file_and_import_it.python (11 lines) ----------
import sys
sys.path.append('C:\Program Files (x86)\IronPython 2.7\Lib')
import codecs

try:
	filePath = IN[0]
	with codecs.open(filePath, 'rb', "utf-8") as inf:
		lines = inf.readlines()
	OUT = ''.join(lines)
except:
	OUT = "No file"
# ----------------------------------------
python_script_from_string = PythonStringNode(script=find_file_and_import_it)  # unwired: IN[0]
categories = Categories()  # frozen
all_elements_of_category = ElementsOfCategory(categories)
regenerate = Python()  # frozen; unwired: IN[0]
# ---------- regenerate.python (26 lines) ----------
import clr

# Import DocumentManager and TransactionManager
clr.AddReference("RevitServices")
import RevitServices
from RevitServices.Persistence import DocumentManager


# Import RevitAPI
clr.AddReference("RevitAPI")
import Autodesk
from Autodesk.Revit.DB import *

doc = DocumentManager.Instance.CurrentDBDocument


#The inputs to this node will be stored as a list in the IN variable.
list = IN[0]


if list:
	doc.Regenerate()
	out = "Regeneration complete"
else:
	out = "fail"
OUT = out
# ----------------------------------------
file_path = Filename("..\..\..\..\..\..\..\test\test_projects\serv_test.rvt")
create = List.Create(file_path)
code_block_4 = CodeBlock { {"roms_test_s.rvt","roms_test_s2.rvt"}; }
code_block_5 = CodeBlock(x=code_block_4) { "C:\\test\\"+x; }
code_block_6 = CodeBlock { {"C:\\test\\roms_test_s.rvt"}; }

# group: Парсер ревитсервера
code_block_7 = CodeBlock { "Павлова 38"; }
code_block_8 = CodeBlock {  }
code_block_9 = CodeBlock { "Павлова 38/АР"; }
forceChildrensEval_3 = ForceChildrensEval()  # unwired: arg0
python_script = Python(IN[0]=code_block_8, IN[1]=code_block_9, IN[2]=forceChildrensEval_3)
# ---------- python_script.python (84 lines) ----------
# -*- coding: utf-8 -*- 
#-----------------------Импоорт библиотек----------------------
import clr
import sys 
sys.path.append("C:\Program Files (x86)\IronPython 2.7\Lib")
import os

import System
from System import Guid
from System import DateTime
from System.IO import StreamReader
from System.Net import WebRequest
clr.AddReference('System.Web.Extensions')
from System.Web.Script.Serialization import JavaScriptSerializer 

clr.AddReference('RevitAPI')
import Autodesk
from Autodesk.Revit.DB import ModelPathUtils


clr.AddReference("RevitServices")
import RevitServices
from RevitServices.Persistence import DocumentManager

#-----------------------ФУНКЦИИ----------------------

def rsnrequest(p_f_n):
	request = WebRequest.Create("http://"+revit_server_name+"/RevitServerAdminRESTService"+version+"/AdminRESTService.svc/|"+p_f_n+"|/contents")		
	request.Method = "GET"
	request.Headers.Add("User-Name", os.environ.get('USERNAME'))
	request.Headers.Add("User-Machine-Name", os.getenv('COMPUTERNAME', 'defaultValue'))
	request.Headers.Add("Operation-GUID", Guid.NewGuid().ToString())

	rsp = request.GetResponse()
	stream_reader = StreamReader(rsp.GetResponseStream())

	jsonData = stream_reader.ReadToEnd()

	json = JavaScriptSerializer().DeserializeObject(jsonData)
	return (json)

def folderpars(folderslist):
	for fldr in folderslist:
		path = "rsn://"+revit_server_name+"/"+project_folder_name+"/"+fldr+"/"
		json = rsnrequest(project_folder_name+"|"+fldr)	
		model_data_list = json["Models"]
		models_list = [m["Name"] for m in model_data_list]
		for model in models_list:
			#mpatch = ModelPathUtils.ConvertUserVisiblePathToModelPath(path+model)
			paths.append(path+model)
	return paths	

#-----------------------АПИ ПАРАМЕТРЫ----------------------

app = DocumentManager.Instance.CurrentUIApplication.Application
version = app.VersionNumber

#-----------------------РАБОЧИЕ ПАРАМЕТРЫ----------------------

revit_server_name = IN[0] #Server name: ""
folder_path = IN[1] #Project folder name: "Павлова 38"

paths = []

out = None

#-----------------------НАЧАЛО СКРИПТА----------------------
if "/" in folder_path:
	corect_folder = folder_path.replace("/", "|")	
else:
	corect_folder = folder_path


#path = "rsn://"+revit_server_name+"/"+project_folder_name
if "|" in corect_folder:
	project_folder_name = corect_folder.split("|")[0]
	out = folderpars([corect_folder.split("|")[1]])
else:
	json = rsnrequest(corect_folder)
	folder_data_list = json["Folders"]
	find_folders_list = [m["Name"] for m in folder_data_list]
	out = folderpars(find_folders_list)

OUT = out
# ----------------------------------------
code_block_10 = CodeBlock(x=python_script) { {x[1]}; }

code_block_11 = CodeBlock()
# ---------- code_block_11.designscript (53 lines) ----------
"
# -*- coding: utf-8 -*-
if IN[1]:
 import clr

 clr.AddReference('RevitServices')
 import RevitServices
 from RevitServices.Persistence import DocumentManager
 from RevitServices.Transactions import TransactionManager

 clr.AddReference('RevitAPI')
 import Autodesk.Revit.DB
 from Autodesk.Revit.DB import TransactWithCentralOptions, SynchronizeWithCentralOptions, RelinquishOptions, ModelPathUtils, OpenOptions, BasicFileInfo

 def re_file(f):
  mpath = ModelPathUtils.ConvertUserVisiblePathToModelPath(f)
  doc = app.OpenDocumentFile(mpath,OpenOptions())
  transOpts = TransactWithCentralOptions()
  syncOpts = SynchronizeWithCentralOptions()
  relinquishOpts = RelinquishOptions(True)
  syncOpts.SetRelinquishOptions(relinquishOpts)
  syncOpts.SaveLocalAfter = False

  TransactionManager.Instance.EnsureInTransaction(doc)
  TransactionManager.Instance.ForceCloseTransaction()

  doc.SynchronizeWithCentral(transOpts, syncOpts)
  doc.Close()

 uiapp = DocumentManager.Instance.CurrentUIApplication
 app = uiapp.Application
 synh_list = ['Обновлено:']
 fali_list = ['Ошибки:']
 loacl_list = ['Локальные:']
 file_list = IN[2]

 for f in file_list:
  if 'rsn://' in f:
   re_file(f)
   synh_list.append('Обновлён файл хранилища: '+f)
  elif BasicFileInfo.Extract(f).IsCentral:
   f_centr_path = BasicFileInfo.Extract(f).CentralPath
   if f == f_centr_path:
    re_file(f)
    synh_list.append('Обновлён файл хранилища: '+f)
   else:
    fali_list.append('Ошибка пути. Путь к файлу: '+f+' Путь к файлу хранилища:'+f_centr_path)
  else:
   loacl_list.append('Локальный файл: '+f)
 OUT = synh_list,fali_list,loacl_list
else:
 OUT = 'not run'
";
# ----------------------------------------
forceChildrensEval_4 = ForceChildrensEval()  # unwired: arg0
выполнить = BoolSelector(true)

# group: Парсер локальной папки
directory_path = Directory("M:\Павлова 38\Сводная модель")
парсер_локальной_папки = Python(IN[0]=directory_path)
# ---------- парсер_локальной_папки.python (11 lines) ----------
import sys
sys.path.append('C:\Program Files (x86)\IronPython 2.7\Lib')
import os
import glob

dir = IN[0]

names = os.listdir(dir)
names2 = glob.glob(dir+"\\*.rvt")

OUT = names2
# ----------------------------------------

python_script_from_string_2 = PythonStringNode(script=code_block_11, IN[0]=forceChildrensEval_4, IN[1]=выполнить, IN[2]=парсер_локальной_папки)
directory_path_string = StringInput("RSN://ya.tvoi.adres.revit.servera.ru/папка проекта/если надо то подпапка/КАКОЕТО_ИМЯ_ФАЙЛА_AR.rvt")
code_block_12 = CodeBlock {  }
