# Dynamo graph Парсинк файлов в папке.dyn (Dynamo 2.7.0.9206)

folder_to = Directory("C:\test")  # graph input
name_prifix = StringInput("N21")
file_name = StringInput("setup.txt")
code_block = CodeBlock(fix=name_prifix, name=file_name) { fix+name; }
directory_path = Directory("C:\code\git\bimreport\BimReport.bundle\Contents\N2021\Images")  # graph input
парсер_локальной_папки = Python(IN[0]=folder_to, IN[1]=code_block, IN[2]=directory_path, IN[3]=name_prifix)  # IronPython2
# ---------- парсер_локальной_папки.python (26 lines) ----------
import sys
sys.path.append('C:\Program Files (x86)\IronPython 2.7\Lib')
import os
import glob

to_folder = IN[0]
to_file = IN[1]

dir = IN[2]
pfix = IN[3]

names = os.listdir(dir)
#folder_and_names = glob.glob("\\*.*")
folder_and_names = glob.glob(dir+"\\*.*")

#file = open('C:\\test\\text.txt', 'w')

file = open(to_folder+"\\"+to_file, 'w')

for name, f_name in zip(names, folder_and_names):
	file.write("<File Id='{}' DiskId='1' Source='{}'/>\n".format(pfix+name, f_name))
#	file.write(name + '\n') "Shepherd {} is {} years old.".format(shepherd, age)

file.close()

OUT = folder_and_names
# ----------------------------------------
directory_path_2 = Directory("C:\code\git\bimreport\BimReport.bundle\Contents\N2020\Images")  # graph input
парсер_локальной_папки_2 = Python(IN[0]=folder_to, IN[1]=code_block, IN[2]=directory_path, IN[3]=name_prifix)  # IronPython2; same code as парсер_локальной_папки
