# Dynamo graph Отделка лестниц_3.dyn (Dynamo 1.3.3.4651)

# group: ЭЛЕМЕНТЫ УПРАВЛЕНИЯ
# note: ПЕРЕМЕННЫЕ ЗНАЧЕНИЯ
# note: ЭЛЕМЕНТЫ УПРАВЛЕНИЯ

# group: ПОЛУЧАЕМ ДАННЫЕ
# note: ПОЛУЧАЕМ ДАННЫЕ ИЗ РЕВИТ и других источников

# group: ПРОВЕРОЧНЫЕ НОДЫ
# note: ПРОВЕРОЧНЫЕ НОДЫ

# group: КЛЮЧЕВЫЕ МОМЕНТЫ РАБОТЫ 1
# note: КОНСОЛИДАЦИЯ И СЛОЖНЫЕ ОБРАБОТКИ

# group: ИСПОЛНИТЕЛЬНЫЕ НОДЫ (фильтрование, подбор, списки и т.д.)
# note: ИСПОЛНИТЕЛЬНЫЕ НОДЫ

# group: ПЕРЕДАЁМ ИНФОРМАЦИЮ
# note: ПЕРЕДАЁМ ИНФОРМАЦИЮ В РЕВИТ
# note: ПЕРЕДАЁМ ИНФОРМАЦИЮ ЕЩЁ КУДА-ТО

# group: ЗАПАСНЫЕ ВАРИАНТЫ, ДОПОЛНИТЕЛЬНЫЕ ОПЦИИ
# note: ЗАПАСНЫЕ
# note: ДОПОЛНИТЕЛЬНЫЕ. Градации серово по важности, темнее - важнее

# group: ПРИМЕЧАНИЯ ПО ЦВЕТОВОЙ ГРУППИРОВКЕ
# note: GUIDELINES

# group: КЛЮЧЕВЫЕ МОМЕНТЫ РАБОТЫ 2
# note: УСЛОЖНЕННЫЕ КОНСТРУКЦИИ
# note: УСЛОЖНЕНЫЕ КОНСТРУКЦИИ

# group: Python ноды
# note: Python

# group: ЭЛЕМЕНТЫ УПРАВЛЕНИЯ 2 УРОВЕНЬ
# note: ЭЛЕМЕНТЫ УПРАВЛЕНИЯ
# note: ПЕРЕМЕННЫЕ ЗНАЧЕНИЯ

# group: Запуск питона из внешнего файла
# note: Py - files

# group: Get Revit Selection:
forceChildrensEval = ForceChildrensEval()  # frozen; unwired: arg0
pys_get_revit_selection = Python(IN[0]=forceChildrensEval)
# ---------- pys_get_revit_selection.python (22 lines) ----------
import clr
clr.AddReference('RevitServices')
clr.AddReference('RevitAPI')
from Autodesk.Revit.DB import *
import RevitServices
from RevitServices.Persistence import DocumentManager
from Autodesk.Revit.ApplicationServices import Application

reset = IN[0]

doc = DocumentManager.Instance.CurrentDBDocument
uidoc = DocumentManager.Instance.CurrentUIApplication.ActiveUIDocument
ids = uidoc.Selection.GetElementIds()

idd = [str(i) for i in ids]

if isinstance(idd, list) == True:
	elems = [doc.GetElement(ElementId(int(i))) for i in idd]
else:
	elems = doc.GetElement(ElementId(int(idd)))

OUT = elems
# ----------------------------------------

boolean = BoolSelector(true)  # frozen
code_block = CodeBlock { 1; 2; }
if_ = Python(IN[0]=boolean, IN[1]=code_block.out0, IN[2]=code_block.out1)
# ---------- if_.python (12 lines) ----------
import clr
boolean = IN[0]
true = UnwrapElement(IN[1])
false = UnwrapElement(IN[2])

if boolean:
	out = true
else:
	out = false

#Назначьте вывод переменной OUT.
OUT = out
# ----------------------------------------
parameters = Element.Parameters()  # unwired: arg0
geometry = Element.Geometry()  # unwired: arg0
setParameterByName = Element.SetParameterByName()  # unwired: element, parameterName, value
# note: ВСЁ ОСТАЛЬНОЕ
getParameterValueByName = Element.GetParameterValueByName()  # unwired: element, parameterName

# group: Parameters name from language
parameters_name_from_language = Python()  # frozen
# ---------- parameters_name_from_language.python (18 lines) ----------
import clr
clr.AddReference('RevitServices')
import RevitServices
from RevitServices.Persistence import DocumentManager

uiapp = DocumentManager.Instance.CurrentUIApplication
app = uiapp.Application
lng = app.Language
rus = ["Тип","Имя семейства","Имя типа"]
enu = ["Type","Family name","Type name"]
out = []
if str(lng) == "Russian":
	out = rus
else:
	out = enu
#English_USA
#Russian
OUT = out
# ----------------------------------------

# group: элементы внутри групп
members = Python()  # "Group.Members"; frozen; unwired: IN[0]
# ---------- members.python (19 lines) ----------
import clr
clr.AddReference('RevitAPI')
from Autodesk.Revit.DB import *

clr.AddReference("RevitNodes")
import Revit
clr.ImportExtensions(Revit.Elements)

groups = UnwrapElement(IN[0])
elementlist = list()
for item in groups:
	try:
		memberlist = list()
		for member in item.GetMemberIds():
			memberlist.append(item.Document.GetElement(member))
		elementlist.append(memberlist)
	except:
		elementlist.append(list())
OUT = elementlist
# ----------------------------------------

categories = Categories()  # frozen
all_elements_of_category = ElementsOfCategory(categories)
путь_к_файлу_python = Filename("..\РАБОЧИЕ СКРИПТЫ\7. ОТДЕЛКА\7.Отделка помещений__геометрия из__Лестниц_без ступенек_с записью в параметры.py")
forceChildrensEval_2 = ForceChildrensEval(путь_к_файлу_python)
find_file_and_import_it = Python(IN[0]=forceChildrensEval_2)
# ---------- find_file_and_import_it.python (11 lines) ----------
import sys
sys.path.append('C:\Program Files (x86)\IronPython 2.7\Lib')
import codecs

try:
	filePath = IN[0]
	with codecs.open(filePath, 'rb', "utf-8") as inf:
		lines = inf.readlines()
	OUT = ''.join(lines)
except:
	OUT = "No file"
# ----------------------------------------
select_model_element = DSModelElementSelection()
code_block_2 = CodeBlock(x=select_model_element) { {x}; }
переместить_к_основанию_лестницы = BoolSelector(true)
python_script_from_string = PythonStringNode(script=find_file_and_import_it, IN[1]=code_block_2, IN[2]=переместить_к_основанию_лестницы)  # frozen; unwired: IN[0], IN[3], IN[4]
regenerate = Python()  # frozen; unwired: IN[0]
# ---------- regenerate.python (26 lines) ----------
import clr

# Import DocumentManager and TransactionManager
clr.AddReference("RevitServices")
import RevitServices
from RevitServices.Persistence import DocumentManager


# Import RevitAPI
clr.AddReference("RevitAPI")
import Autodesk
from Autodesk.Revit.DB import *

doc = DocumentManager.Instance.CurrentDBDocument


#The inputs to this node will be stored as a list in the IN variable.
list = IN[0]


if list:
	doc.Regenerate()
	out = "Regeneration complete"
else:
	out = "fail"
OUT = out
# ----------------------------------------
members_2 = Python()  # "Object.Members"; frozen; unwired: IN[0]
# ---------- members_2.python (14 lines) ----------
import clr

items = IN[0]
elementlist = list()

try:
	clr.AddReference('RevitAPI')
	from Autodesk.Revit.DB import *
	for item in items:
		elementlist.append(dir(UnwrapElement(item)))
except:
	for item in items:
		elementlist.append(dir(item))
OUT = elementlist
# ----------------------------------------
filteredElementCollector = Python()  # frozen; unwired: IN[0]
# ---------- filteredElementCollector.python (29 lines) ----------
if IN[1]:
	import clr
	
	# Import DocumentManager and TransactionManager
	clr.AddReference("RevitServices")
	import RevitServices
	from RevitServices.Persistence import DocumentManager
	
	
	# Import RevitAPI
	clr.AddReference("RevitAPI")
	import Autodesk
	from Autodesk.Revit.DB import *
	
	doc = DocumentManager.Instance.CurrentDBDocument
	uiapp = DocumentManager.Instance.CurrentUIApplication
	app = uiapp.Application
	
	from System.Collections.Generic import *
	
	
	#The inputs to this node will be stored as a list in the IN variable.
	dataEnteringNode = IN
	collector = FilteredElementCollector(doc)
	elements = collector.OfCategory(BuiltInCategory.OST_Views).ToElements()
	
	OUT = sheetInstances
else:
	OUT = "скрипт не выполнен"
# ----------------------------------------
shablon_python_shablon = Python()  # frozen; unwired: IN[0]
# ---------- shablon_python_shablon.python (69 lines) ----------
# -*- coding: utf-8 -*- 
#-----------------------Импоорт библиотек----------------------
import clr
clr.AddReference('RevitAPI')
import Autodesk
from Autodesk.Revit.DB import *

clr.AddReference("RevitNodes") 
import Revit
from Revit.Elements import *

clr.ImportExtensions(Revit.Elements) #ToDSType не работает без
clr.ImportExtensions(Revit.GeometryConversion) #ToXyz не работает без

clr.AddReference("RevitServices")
import RevitServices
from RevitServices.Persistence import DocumentManager
from RevitServices.Transactions import TransactionManager

clr.AddReference('ProtoGeometry')
from Autodesk.DesignScript.Geometry import *

#-----------------------ИМПОРТ БИБЛИОТЕК----------------------
"""-"""
#-----------------------ФУНКЦИИ----------------------

def __x__(x):
	x="x"
	return x
	
#-----------------------ФУНКЦИИ----------------------
"""-"""
#-----------------------АПИ ПАРАМЕТРЫ----------------------

doc = DocumentManager.Instance.CurrentDBDocument
#link_doc = UnwrapElement(IN[1])
#uiapp = DocumentManager.Instance.CurrentUIApplication
#app = uiapp.Application
#version = app.VersionNumber
#options = Autodesk.Revit.DB.SpatialElementBoundaryOptions()
calculator = SpatialElementGeometryCalculator(doc)

#-----------------------АПИ ПАРАМЕТРЫ----------------------
"""-"""
#-----------------------РАБОЧИЕ ПАРАМЕТРЫ----------------------

rooms = UnwrapElement(IN[0])

#-----------------------РАБОЧИЕ ПАРАМЕТРЫ----------------------	
"""-"""
#-----------------------ТЕСТОВЫЕ ПАРАМЕТРЫ----------------------

test = []

#-----------------------ТЕСТОВЫЕ ПАРАМЕТРЫ----------------------
"""-"""
#-----------------------НАЧАЛО СКРИПТА----------------------

x = 0
if rooms == None:
	rooms = [0,0]

for room in rooms:
	x=__x__(x)+__x__(x)
#TransactionManager.Instance.EnsureInTransaction(doc)
#TransactionManager.Instance.TransactionTaskDone()
#-----------------------КОНЕЦ СКРИПТА----------------------

OUT = x
# ----------------------------------------
select_faces = SelectFaces()
forceChildrensEval_3 = ForceChildrensEval(select_faces)
flatten = Flatten(forceChildrensEval_3)
null_cleaner = Python(IN[0]=flatten)
# ---------- null_cleaner.python (1 lines) ----------
OUT = [s for s in IN[0] if s != None]
# ----------------------------------------
stairs_element_cleaner = Python(IN[0]=null_cleaner)
# ---------- stairs_element_cleaner.python (15 lines) ----------
import clr
clr.AddReference('RevitAPI')
import Autodesk
from Autodesk.Revit.DB import Document,ElementId,Category,BuiltInCategory

clr.AddReference("RevitServices")
import RevitServices
from RevitServices.Persistence import DocumentManager

faces = UnwrapElement(IN[0])
doc = DocumentManager.Instance.CurrentDBDocument

facelist = [face for face in faces if doc.GetElement(face.Tags.LookupTag("RevitFaceReference").ElementId).Category.Name != Autodesk.Revit.DB.Category.GetCategory(doc,BuiltInCategory.OST_Stairs).Name]

OUT = facelist
# ----------------------------------------
code_block_3 = CodeBlock { 0.5; }
pointAtParameter = Surface.PointAtParameter(surface=stairs_element_cleaner, u=code_block_3, v=code_block_3)
face_duplicate_cleaner = Python(IN[0]=stairs_element_cleaner, IN[1]=pointAtParameter)
# ---------- face_duplicate_cleaner.python (14 lines) ----------
import clr
clr.AddReference('ProtoGeometry')
from Autodesk.DesignScript.Geometry import Surface

surfs = IN[0]
points = IN[1]
dict = {}
out = []
	
dict = {p:s for p,s in zip(points,surfs)}	

[out.append(s) for s in dict.values() if len(s.PerimeterCurves()) >2]

OUT = out
# ----------------------------------------
code_block_4 = CodeBlock(paint=face_duplicate_cleaner) { paint; }
code_block_5 = CodeBlock()
# ---------- code_block_5.designscript (5 lines) ----------
"___Лестницы_Торец лестницы  на стене";
"___Лестницы_Отделка ступенек";
"___Лестницы_Отделка площадок";
"___Лестницы_Покраска маршей и площадок";
"Кирпич, обычный";
# ----------------------------------------
forceChildrensEval_4 = ForceChildrensEval(code_block_5.out3)
byName = Material.ByName(forceChildrensEval_4)
покрасить_убрать_краску = BoolSelector(true)
paint = Python(IN[0]=code_block_4, IN[1]=byName, IN[2]=покрасить_убрать_краску)
# ---------- paint.python (56 lines) ----------
# -*- coding: utf-8 -*- 
import clr
clr.AddReference('RevitAPI')
import Autodesk
from Autodesk.Revit.DB import *

clr.AddReference("RevitServices")
import RevitServices
from RevitServices.Persistence import DocumentManager
from RevitServices.Transactions import TransactionManager

fails = 0

def PaintFace0(surf, mat):
    elemRef = surf.Tags.LookupTag("RevitFaceReference")
    elem = doc.GetElement(elemRef)
    face = elem.GetGeometryObjectFromReference(elemRef)
    if not doc.IsPainted(elem.Id, face):
		try:
			return doc.Paint(elem.Id, face, mat.Id)
		except:
			fails =+ 1

def PaintFace(surf, mat):
	elemRef = surf.Tags.LookupTag("RevitFaceReference")
	elem = doc.GetElement(elemRef)
	face = elem.GetGeometryObjectFromReference(elemRef)
	try:
		return doc.Paint(elem.Id, face, mat.Id)
	except:
		fails =+ 1

def RemovePaintFromFace(surf, mat):
    elemRef = surf.Tags.LookupTag("RevitFaceReference")
    elem = doc.GetElement(elemRef)
    face = elem.GetGeometryObjectFromReference(elemRef)
    if doc.IsPainted(elem.Id, face):
		try:
			return doc.RemovePaint(elem.Id, face)
		except:
			fails =+ 1

doc = DocumentManager.Instance.CurrentDBDocument
faces = UnwrapElement(IN[0])
mat = UnwrapElement(IN[1])

TransactionManager.Instance.EnsureInTransaction(doc)
if IN[2]:
	new = [PaintFace(f,mat) for f in faces if f != None]
	work = "Painted"
else:
	new = [RemovePaintFromFace(f,mat) for f in faces if f != None]
	work = "UnPainted"
TransactionManager.Instance.ForceCloseTransaction()	

OUT = 'Faces {0} = {1}, fails = {2}'.format(work,str(len(new)),str(fails))
# ----------------------------------------
categories_2 = Categories("Stairs")
all_elements_of_category_2 = ElementsOfCategory(categories_2)
type = Object.Type(all_elements_of_category_2)
getCategory = Element.GetCategory(all_elements_of_category_2)
string_from_object = FromObject(getCategory)
code_block_6 = CodeBlock(x=type, y=string_from_object) { x == "Revit.Elements.FamilyInstance"; y == "Лестницы"; }
filterByBoolMask = List.FilterByBoolMask(list=all_elements_of_category_2, mask=code_block_6.out1)
code_block_7 = CodeBlock(x=filterByBoolMask.in) { x; }
code_block_8 = CodeBlock { "___Лестницы_"; 0; }
code_block_9 = CodeBlock(x=code_block_8.out0) { x+"без отделки"; }
categories_3 = Categories("Materials")
all_elements_of_category_3 = ElementsOfCategory(categories_3)
name = Material.Name(all_elements_of_category_3)
contains = String.Contains(str=name, searchFor=code_block_8.out0)
filterByBoolMask_2 = List.FilterByBoolMask(list=name, mask=contains)
addItemToEnd = List.AddItemToEnd(item=code_block_9, list=filterByBoolMask_2.in)
python_script_from_string_2 = PythonStringNode(script=find_file_and_import_it, IN[0]=code_block_7, IN[1]=addItemToEnd)
select_model_elements = DSModelElementsSelection()
