# Dynamo graph Links-select_multiply elements and brake to PARTS_0.4.dyn (Dynamo 1.3.4.6666)

# note: ВСЁ ОСТАЛЬНОЕ

select_link_file = DSModelElementSelection()
get_link_elem_ref = Python(IN[0]=select_link_file)
# ---------- get_link_elem_ref.python (17 lines) ----------
import clr

clr.AddReference("RevitAPIUI")
from  Autodesk.Revit.UI import Selection

clr.AddReference("RevitServices")
from RevitServices.Persistence import DocumentManager

#doc = DocumentManager.Instance.CurrentDBDocument
uidoc = DocumentManager.Instance.CurrentUIApplication.ActiveUIDocument

sel1 = uidoc.Selection
ot2 = Selection.ObjectType.LinkedElement
el_ref = UnwrapElement(sel1.PickObjects(ot2, "Select the linked elements and press Finish."))


OUT = el_ref
# ----------------------------------------
boolean = BoolSelector(false)
selectlinkedelements_and = Python(IN[0]=select_link_file, IN[1]=get_link_elem_ref, IN[2]=boolean)  # "SelectLinkedElements and CreateParts"
# ---------- selectlinkedelements_and.python (40 lines) ----------
import clr
clr.AddReference("System")
from System.Collections.Generic import List

clr.AddReference('RevitAPI')
from Autodesk.Revit.DB import PartUtils, LinkElementId

clr.AddReference("RevitServices")
from RevitServices.Persistence import DocumentManager
from RevitServices.Transactions import TransactionManager

doc = DocumentManager.Instance.CurrentDBDocument
uidoc = DocumentManager.Instance.CurrentUIApplication.ActiveUIDocument

link = UnwrapElement(IN[0])
el_ref = UnwrapElement(IN[1])
LinkDoc = link.GetLinkDocument()
excepts = []

Lel_id = [r1.LinkedElementId for r1 in el_ref]
eList = List[LinkElementId]()
[eList.Add(LinkElementId(link.Id,e)) for e in Lel_id if PartUtils.IsValidForCreateParts(doc,LinkElementId(link.Id,e))]

if IN[2]:
	TransactionManager.Instance.EnsureInTransaction(doc)
	PartUtils.CreateParts(doc,eList)
	TransactionManager.Instance.ForceCloseTransaction()
else:
	for e in eList:
		try:
			TransactionManager.Instance.EnsureInTransaction(doc)
			PartUtils.CreateParts(doc,List[LinkElementId]([e]))
			TransactionManager.Instance.ForceCloseTransaction()
		except:
			excepts.append(e)
			
partsid = [PartUtils.GetAssociatedParts(doc, e, True, True) for e in eList]
parts = [doc.GetElement(i) for id in partsid for i in id]

OUT = excepts,parts
# ----------------------------------------
