# Dynamo graph from Revit To Navis_1.1_(Parts).dyn (Dynamo 1.3.4.6666)

# group: ЗАПАСНЫЕ ВАРИАНТЫ, ДОПОЛНИТЕЛЬНЫЕ ОПЦИИ
# note: ДОПОЛНИТЕЛЬНЫЕ. Градации серово по важности, темнее - важнее
# note: ЗАПАСНЫЕ

# group: КЛЮЧЕВЫЕ МОМЕНТЫ РАБОТЫ 1
# note: КОНСОЛИДАЦИЯ И СЛОЖНЫЕ ОБРАБОТКИ

# group: КЛЮЧЕВЫЕ МОМЕНТЫ РАБОТЫ 2
# note: УСЛОЖНЕННЫЕ КОНСТРУКЦИИ
# note: УСЛОЖНЕНЫЕ КОНСТРУКЦИИ

# group: Python ноды
# note: Python

# group: Запуск питона из внешнего файла
# note: Py - files

# group: ЭЛЕМЕНТЫ УПРАВЛЕНИЯ
# note: ПЕРЕМЕННЫЕ ЗНАЧЕНИЯ
# note: ЭЛЕМЕНТЫ УПРАВЛЕНИЯ

# group: ПОЛУЧАЕМ ДАННЫЕ
# note: ПОЛУЧАЕМ ДАННЫЕ ИЗ РЕВИТ и других источников

# group: ПРОВЕРОЧНЫЕ НОДЫ
# note: ПРОВЕРОЧНЫЕ НОДЫ

# group: ИСПОЛНИТЕЛЬНЫЕ НОДЫ (фильтрование, подбор, списки и т.д.)
# note: ИСПОЛНИТЕЛЬНЫЕ НОДЫ

# group: ПЕРЕДАЁМ ИНФОРМАЦИЮ
# note: ПЕРЕДАЁМ ИНФОРМАЦИЮ В РЕВИТ
# note: ПЕРЕДАЁМ ИНФОРМАЦИЮ ЕЩЁ КУДА-ТО

# group: ЭЛЕМЕНТЫ УПРАВЛЕНИЯ 2 УРОВЕНЬ
# note: ЭЛЕМЕНТЫ УПРАВЛЕНИЯ
# note: ПЕРЕМЕННЫЕ ЗНАЧЕНИЯ

# group: ПРИМЕЧАНИЯ ПО ЦВЕТОВОЙ ГРУППИРОВКЕ
# note: GUIDELINES

путь_к_файлу_python = Filename(".\Генерация поисковых наборов_3.py")
forceChildrensEval = ForceChildrensEval(путь_к_файлу_python)
find_file_and_import_it = Python(IN[0]=forceChildrensEval)
# ---------- find_file_and_import_it.python (11 lines) ----------
import sys
sys.path.append('C:\Program Files (x86)\IronPython 2.7\Lib')
import codecs

try:
	filePath = IN[0]
	with codecs.open(filePath, 'rb', "utf-8") as inf:
		lines = inf.readlines()
	OUT = ''.join(lines)
except:
	OUT = "No file"
# ----------------------------------------
start_FOLDER = StringInput("""<?xml version="1.0" encoding="UTF-8" ?>

<exchange xmlns:xsi="http://www.w3.org/2001/XMLSchema-instance" xsi:noNamespaceSchemaLocation="http://download.autodesk.com/us/navisworks/schemas/nw-exchange-12.0.xsd" units="ft">
  <selectionsets>
    <viewfolder name="__FOLDER_1__" guid="__FOLDER_1_GUID__">
      __FOLDER_2_SET__
    </viewfolder>
  </selectionsets>
</exchange>
""")
имя_общей_папки = StringInput("К3 Ведомость 56 v2 Сводник (Ант япы+Гран)- 2019-04-24")
FOLDER2 = StringInput("""<viewfolder name="__FOLDER_2__" guid="__FOLDER_2_GUID__">
  __SELECTION_SET__
</viewfolder>""")
pys_get_revit_selection = Python()  # unwired: IN[0]
# ---------- pys_get_revit_selection.python (22 lines) ----------
import clr
clr.AddReference('RevitServices')
clr.AddReference('RevitAPI')
from Autodesk.Revit.DB import *
import RevitServices
from RevitServices.Persistence import DocumentManager
from Autodesk.Revit.ApplicationServices import Application

reset = IN[0]

doc = DocumentManager.Instance.CurrentDBDocument
uidoc = DocumentManager.Instance.CurrentUIApplication.ActiveUIDocument
ids = uidoc.Selection.GetElementIds()

idd = [str(i) for i in ids]

if isinstance(idd, list) == True:
	elems = [doc.GetElement(ElementId(int(i))) for i in idd]
else:
	elems = doc.GetElement(ElementId(int(idd)))

OUT = elems
# ----------------------------------------
выбрать_элементы_select_m_elms = DSModelElementsSelection()  # "Выбрать элементы (Select M. Elms.) или выбрать прямо в ревите."; 2 picked in the model
create = List.Create(pys_get_revit_selection, выбрать_элементы_select_m_elms)
flatten = Flatten(create)
clean = List.Clean(list=flatten)

# group: Собрать элементы из Групп и Сборок
python_script = Python(IN[0]=clean)
# ---------- python_script.python (24 lines) ----------
import clr
clr.AddReference('RevitAPI')
from Autodesk.Revit.DB import *

clr.AddReference("RevitNodes")
import Revit
clr.ImportExtensions(Revit.Elements)

groups = UnwrapElement(IN[0])
elementlist = list()
for item in groups:
	if item != None:
		if item.Category.Name == "Группы модели" or item.Category.Name == "Сборки":
			try:
				memberlist = list()
				for member in item.GetMemberIds():
					memberlist.append(item.Document.GetElement(member))
				elementlist.append(memberlist)
			except:
				elementlist.append(list())
		else:
			elementlist.append(item)
		
OUT = elementlist
# ----------------------------------------
flatten_2 = Flatten(python_script)

список_категорий = StringInput("Стены, Части")
python_script_2 = Python(IN[0]=flatten_2, IN[1]=список_категорий)
# ---------- python_script_2.python (8 lines) ----------
import clr
clr.AddReference('RevitAPI')
from Autodesk.Revit.DB import BuiltInParameter

elements = UnwrapElement(IN[0])
cats = UnwrapElement(IN[1])

OUT = [e for e in elements if e.get_Parameter(BuiltInParameter.ELEM_CATEGORY_PARAM).AsValueString() in cats]
# ----------------------------------------
getCategory = Element.GetCategory(python_script_2)
string_from_object = FromObject(getCategory)
code_block = CodeBlock { "Исходная категория"; }
getParameterValueByName = Element.GetParameterValueByName(element=python_script_2, parameterName=code_block)
python_script_3 = Python(IN[0]=string_from_object, IN[1]=getParameterValueByName)
# ---------- python_script_3.python (1 lines) ----------
OUT = [cat if len(base_cat) == 0 else base_cat for cat,base_cat in zip(IN[0],IN[1])]
# ----------------------------------------
groupByKey = List.GroupByKey(list=python_script_2, keys=python_script_3)
имена_под_папок = CodeBlock(__FOLDERs_2__=groupByKey.unique_keys) { __FOLDERs_2__; }
SELECTION_SET = StringInput("""<selectionset name="__SELECTIONSET_NAME__" guid="__SELECTIONSET_GUID__">
      <findspec mode="all" disjoint="0">
        <conditions>
          <condition test="equals" flags="10">
            <category>
              <name internal="Document">Document</name>
            </category>
            <property>
              <name internal="Title">Title</name>
            </property>
            <value>
              <data type="wstring">__FILE_TITLE__</data>
            </value>
          </condition>
    <condition test="equals" flags="10">
            <category>
              <name internal="Category">Category</name>
            </category>
            <property>
              <name internal="Name">Name</name>
            </property>
            <value>
              <data type="wstring">__CATEGORY__</data>
            </value>
          </condition>
          __CONDITIONS__
        </conditions>
        <locator>/</locator>
      </findspec>
    </selectionset>""")
condition___type_name = StringInput("""          <condition test="equals" flags="10">
              <category>
                <name internal="LcRevitData_Element">Объект</name>
              </category>
              <property>
                <name internal="LcRevitPropertyElementType">Тип</name>
              </property>
              <value>
                <data type="wstring">__TYPE_NAME__</data>
              </value>
          </condition>""")
condition___mat_name = StringInput("""            <condition test="equals" flags="10">
              <category>
                <name internal="LcRevitMaterialProperties">Материал Revit</name>
              </category>
              <property>
                <name internal="LcOaSceneBaseUserName">Имя</name>
              </property>
              <value>
                <data type="wstring">__MAT_NAME__</data>
              </value>
            </condition>""")
condition___o_name = StringInput("""<condition test="equals" flags="10">
            <category>
              <name internal="LcRevitData_Element">Объект</name>
            </category>
            <property>
              <name internal="LcRevitPropertyElementName">Имя</name>
            </property>
            <value>
              <data type="wstring">__O_NAME__</data>
            </value>
          </condition>""")
create_2 = List.Create(condition___type_name, condition___mat_name, condition___o_name)
python_script_from_string = PythonStringNode(script=find_file_and_import_it, IN[0]=start_FOLDER, IN[1]=имя_общей_папки, IN[2]=FOLDER2, IN[3]=имена_под_папок, IN[4]=SELECTION_SET, IN[5]=groupByKey.groups, IN[6]=create_2)
parameters = Element.Parameters(python_script_from_string)
geometry = Element.Geometry()  # unwired: arg0
setParameterByName = Element.SetParameterByName()  # unwired: element, parameterName, value
# note: ВСЁ ОСТАЛЬНОЕ
getParameterValueByName_2 = Element.GetParameterValueByName()  # unwired: element, parameterName

# group: Get Revit Selection:
forceChildrensEval_2 = ForceChildrensEval()  # unwired: arg0
pys_get_revit_selection_2 = Python(IN[0]=forceChildrensEval_2)  # same code as pys_get_revit_selection

boolean = BoolSelector(true)  # frozen
code_block_2 = CodeBlock { 1; 2; }
if_ = Python(IN[0]=boolean, IN[1]=code_block_2.out0, IN[2]=code_block_2.out1)
# ---------- if_.python (12 lines) ----------
import clr
boolean = IN[0]
true = UnwrapElement(IN[1])
false = UnwrapElement(IN[2])

if boolean:
	out = true
else:
	out = false

#Назначьте вывод переменной OUT.
OUT = out
# ----------------------------------------

# group: Parameters name from language
parameters_name_from_language = Python()  # frozen
# ---------- parameters_name_from_language.python (18 lines) ----------
import clr
clr.AddReference('RevitServices')
import RevitServices
from RevitServices.Persistence import DocumentManager

uiapp = DocumentManager.Instance.CurrentUIApplication
app = uiapp.Application
lng = app.Language
rus = ["Тип","Имя семейства","Имя типа"]
enu = ["Type","Family name","Type name"]
out = []
if str(lng) == "Russian":
	out = rus
else:
	out = enu
#English_USA
#Russian
OUT = out
# ----------------------------------------

путь_к_файлу_python_2 = Filename(".\N.Отделка помещений_сбор элементов вокруг_1.7.py")  # frozen
forceChildrensEval_3 = ForceChildrensEval()  # unwired: arg0
find_file_and_import_it_2 = Python(IN[0]=путь_к_файлу_python_2, IN[1]=forceChildrensEval_3)  # same code as find_file_and_import_it
python_script_from_string_2 = PythonStringNode(script=find_file_and_import_it_2)  # unwired: IN[0]
categories = Categories()  # frozen
all_elements_of_category = ElementsOfCategory(categories)
regenerate = Python()  # frozen; unwired: IN[0]
# ---------- regenerate.python (26 lines) ----------
import clr

# Import DocumentManager and TransactionManager
clr.AddReference("RevitServices")
import RevitServices
from RevitServices.Persistence import DocumentManager


# Import RevitAPI
clr.AddReference("RevitAPI")
import Autodesk
from Autodesk.Revit.DB import *

doc = DocumentManager.Instance.CurrentDBDocument


#The inputs to this node will be stored as a list in the IN variable.
list = IN[0]


if list:
	doc.Regenerate()
	out = "Regeneration complete"
else:
	out = "fail"
OUT = out
# ----------------------------------------
members = Python()  # "Object.Members"; frozen; unwired: IN[0]
# ---------- members.python (14 lines) ----------
import clr

items = IN[0]
elementlist = list()

try:
	clr.AddReference('RevitAPI')
	from Autodesk.Revit.DB import *
	for item in items:
		elementlist.append(dir(UnwrapElement(item)))
except:
	for item in items:
		elementlist.append(dir(item))
OUT = elementlist
# ----------------------------------------
shablon_python_shablon = Python()  # frozen; unwired: IN[0]
# ---------- shablon_python_shablon.python (74 lines) ----------
# -*- coding: utf-8 -*- 
#-----------------------Импоорт библиотек----------------------
import clr
clr.AddReference('RevitAPI')
import Autodesk
from Autodesk.Revit.DB import *

clr.AddReference("RevitNodes") 
import Revit
from Revit.Elements import *

clr.ImportExtensions(Revit.Elements) #ToDSType не работает без
clr.ImportExtensions(Revit.GeometryConversion) #ToXyz не работает без

clr.AddReference("RevitServices")
import RevitServices
from RevitServices.Persistence import DocumentManager
from RevitServices.Transactions import TransactionManager

clr.AddReference('ProtoGeometry')
from Autodesk.DesignScript.Geometry import *

#-----------------------ИМПОРТ БИБЛИОТЕК----------------------
"""-"""
#-----------------------ФУНКЦИИ----------------------

def __x__(x):
	x="x"
	return x
	
#-----------------------ФУНКЦИИ----------------------
"""-"""
#-----------------------АПИ ПАРАМЕТРЫ----------------------

doc = DocumentManager.Instance.CurrentDBDocument
#link_doc = UnwrapElement(IN[1])
#uiapp = DocumentManager.Instance.CurrentUIApplication
#app = uiapp.Application
#version = app.VersionNumber
#options = Autodesk.Revit.DB.SpatialElementBoundaryOptions()
calculator = SpatialElementGeometryCalculator(doc)

g_id_list = []
g_id_list.append(ElementId(group))

bxList = List[ElementId](g_id_list) #АЙ ЛИСТ КОЛЕКТИОН

#-----------------------АПИ ПАРАМЕТРЫ----------------------
"""-"""
#-----------------------РАБОЧИЕ ПАРАМЕТРЫ----------------------

rooms = UnwrapElement(IN[0])

#-----------------------РАБОЧИЕ ПАРАМЕТРЫ----------------------	
"""-"""
#-----------------------ТЕСТОВЫЕ ПАРАМЕТРЫ----------------------

test = []

#-----------------------ТЕСТОВЫЕ ПАРАМЕТРЫ----------------------
"""-"""
#-----------------------НАЧАЛО СКРИПТА----------------------

x = 0
if rooms == None:
	rooms = [0,0]

for room in rooms:
	x=__x__(x)+__x__(x)
#TransactionManager.Instance.EnsureInTransaction(doc)
#TransactionManager.Instance.TransactionTaskDone()
#-----------------------КОНЕЦ СКРИПТА----------------------

OUT = x
# ----------------------------------------

# group: элементы внутри групп
members_2 = Python()  # "Group.Members"; frozen; unwired: IN[0]
# ---------- members_2.python (19 lines) ----------
import clr
clr.AddReference('RevitAPI')
from Autodesk.Revit.DB import *

clr.AddReference("RevitNodes")
import Revit
clr.ImportExtensions(Revit.Elements)

groups = UnwrapElement(IN[0])
elementlist = list()
for item in groups:
	try:
		memberlist = list()
		for member in item.GetMemberIds():
			memberlist.append(item.Document.GetElement(member))
		elementlist.append(memberlist)
	except:
		elementlist.append(list())
OUT = elementlist
# ----------------------------------------

all_elements_in_active_view = ElementsInView()  # frozen
getCategory_2 = Element.GetCategory(all_elements_in_active_view)
string_from_object_2 = FromObject(getCategory_2)
список_категорий_2 = StringInput("Части, Окна, Панели витража, Несущие колонны, Ограждение")
code_block_3 = CodeBlock { ", "; }
split = String.Split(список_категорий_2, code_block_3)
containsItem = List.ContainsItem(list=string_from_object_2, item=split, lacing=CrossProduct)
allFalse = AllFalse(containsItem@L2)
filterByBoolMask = List.FilterByBoolMask(list=all_elements_in_active_view, mask=allFalse)
getCategory_3 = Element.GetCategory(all_elements_in_active_view)
string_from_object_3 = FromObject(getCategory_3)
uniqueItems = List.UniqueItems(string_from_object_3)
save_path_and_filename = StringInput("C:\test\xml\56_К3_Планы.xml")
writeToFile = CSV.WriteToFile(save_path_and_filename, python_script_from_string)
filteredElementCollector = Python(IN[0]=forceChildrensEval_2)
# ---------- filteredElementCollector.python (27 lines) ----------
import clr

# Import DocumentManager and TransactionManager
clr.AddReference("RevitServices")
import RevitServices
from RevitServices.Persistence import DocumentManager


# Import RevitAPI
clr.AddReference("RevitAPI")
import Autodesk
from Autodesk.Revit.DB import *

doc = DocumentManager.Instance.CurrentDBDocument
uiapp = DocumentManager.Instance.CurrentUIApplication
uidoc = DocumentManager.Instance.CurrentUIDocument
app = uiapp.Application

from System.Collections.Generic import *


#The inputs to this node will be stored as a list in the IN variable.
dataEnteringNode = IN[0]
collector = FilteredElementCollector(doc)
elements = collector.OwnedByView(uidoc.ActiveView.Id).ToElements()

OUT = elements
# ----------------------------------------
getCategory_4 = Element.GetCategory(filteredElementCollector)
getCategory_5 = Element.GetCategory(flatten_2)  # frozen
string_from_object_4 = FromObject(getCategory_5)
code_block_4 = CodeBlock { ", "; }
split_2 = String.Split(список_категорий, code_block_4)
containsItem_2 = List.ContainsItem(list=string_from_object_4, item=split_2, lacing=CrossProduct)
allFalse_2 = AllFalse(containsItem_2@L2)
filterByBoolMask_2 = List.FilterByBoolMask(list=flatten_2, mask=allFalse_2)
