# Dynamo graph Share_files.dyn (Dynamo 2.3.0.5885)
# packages: Prorubim Core Kit 2.x 0.5.0

путь_к_файлу_python = Filename(".\Share_files_worker.py")
forceChildsEval = ForceChildsEval(passObject=путь_к_файлу_python)
find_file_and_import_it = Python(IN[0]=forceChildsEval)
# ---------- find_file_and_import_it.python (11 lines) ----------
import sys
sys.path.append('C:\Program Files (x86)\IronPython 2.7\Lib')
import codecs

try:
	filePath = IN[0]
	with codecs.open(filePath, 'rb', "utf-8") as inf:
		lines = inf.readlines()
	OUT = ''.join(lines)
except:
	OUT = "No file"
# ----------------------------------------
path_from = Directory("C:\test\shared_test_from")  # graph input
path_to = Directory("C:\test\shared_test_to")  # graph input
code_block = CodeBlock { ["20", "30"]; }
save_performanceadviser_rules = BoolSelector(false)  # "Save PerformanceAdviser Rules /// Create Shared files"
python_script_from_string = PythonStringNode(script=find_file_and_import_it, IN[0]=path_from, IN[1]=path_to, IN[2]=code_block, IN[3]=save_performanceadviser_rules)
watch = Watch(python_script_from_string)
project_folder_name = StringInput("AR-4")  # graph input
