# Dynamo graph 0.Удалить DWG импортированные.dyn (Dynamo 1.3.2.2480)

удалить = BoolSelector(false)
forceChildrensEval = ForceChildrensEval()  # unwired: arg0
python_script = Python(IN[0]=forceChildrensEval)
# ---------- python_script.python (21 lines) ----------
import clr
clr.AddReference('RevitAPI')
from Autodesk.Revit.DB import *
import Autodesk

clr.AddReference("RevitServices")
import RevitServices
from RevitServices.Persistence import DocumentManager

doc = DocumentManager.Instance.CurrentDBDocument
# need to learn how to implement LINQ here...
collector = FilteredElementCollector(doc)
impinst = collector.OfClass(ImportInstance).ToElements()
linkedlist = list()
importlist = list()
for item in impinst:
	if item.IsLinked:
		linkedlist.append(item)
	else:
		importlist.append(item)
OUT = (linkedlist,importlist)
# ----------------------------------------
code_block = CodeBlock(links=python_script, imports=python_script) { links[0]; imports[1]; }
code_block_2 = CodeBlock { null; }
forceChildrensEval_2 = ForceChildrensEval()  # unwired: arg0
if_ = Python(IN[0]=удалить, IN[1]=code_block.out1, IN[2]=code_block_2, IN[3]=forceChildrensEval_2)
# ---------- if_.python (12 lines) ----------
import clr
boolean = IN[0]
true = UnwrapElement(IN[1])
false = UnwrapElement(IN[2])

if boolean:
	out = true
else:
	out = false

#Назначьте вывод переменной OUT.
OUT = out
# ----------------------------------------
delete = Elements.Element.Delete(if_)
code_block_3 = CodeBlock { "Имя"; }
getParameterValueByName = Element.GetParameterValueByName(element=code_block.out1, parameterName=code_block_3)
uniqueItems = List.UniqueItems(getParameterValueByName)
imported_dwg = Watch(uniqueItems)
getParameterValueByName_2 = Element.GetParameterValueByName(element=code_block.out0, parameterName=code_block_3)
uniqueItems_2 = List.UniqueItems(getParameterValueByName_2)
link_dwg = Watch(uniqueItems_2)
