# Dynamo graph 0.Удалить ВСЕ неиспользуемые шаблоны.dyn (Dynamo 1.3.1.1736)

точно_хочешь_удалить_все = BoolSelector(false)  # "Точно хочешь удалить ВСЕ неиспользуемые шаблоны?"
удалить_не_использованное = Python(IN[0]=точно_хочешь_удалить_все)  # unwired: IN[1]
# ---------- удалить_не_использованное.python (27 lines) ----------
if IN[0] == True:
	import clr
	clr.AddReference('RevitAPI')
	from Autodesk.Revit.DB import*
	clr.AddReference('RevitServices')
	from RevitServices.Persistence import DocumentManager
	from RevitServices.Transactions import TransactionManager
	
	doc = DocumentManager.Instance.CurrentDBDocument
	
	views = FilteredElementCollector(doc).OfClass(View)
	appliedtemplates = [v.ViewTemplateId for v in views]
	templates = [v.Id for v in views if v.IsTemplate == True]
	
	toDelete = []
	for t in templates:
		if t not in appliedtemplates:
			toDelete.append(t)
	
	TransactionManager.Instance.EnsureInTransaction(doc)
	for e in toDelete:
		doc.Delete(e)
	TransactionManager.Instance.TransactionTaskDone()
	
	OUT = '%d Template(s) deleted' %(len(toDelete))
else:
	pass
# ----------------------------------------
количество_удалённых_шаблонов = Watch(удалить_не_использованное)
