# Dynamo graph 0.Удалить параметры_0.1.dyn (Dynamo 1.3.3.4111)

# note: ВСЁ ОСТАЛЬНОЕ

# group: ЭЛЕМЕНТЫ УПРАВЛЕНИЯ
# note: ПЕРЕМЕННЫЕ ЗНАЧЕНИЯ
# note: ЭЛЕМЕНТЫ УПРАВЛЕНИЯ

# group: ПОЛУЧАЕМ ДАННЫЕ ИЗ РЕВИТ
# note: ПОЛУЧАЕМ ДАННЫЕ ИЗ РЕВИТ

# group: ПРОВЕРОЧНЫЕ НОДЫ
# note: ПРОВЕРОЧНЫЕ НОДЫ

# group: ЭЛЕМЕНТЫ УПРАВЛЕНИЯ 2 УРОВЕНЬ
# note: ЭЛЕМЕНТЫ УПРАВЛЕНИЯ
# note: ПЕРЕМЕННЫЕ ЗНАЧЕНИЯ

# group: ИСПОЛНИТЕЛЬНЫЕ НОДЫ (фильтрование, подбор, списки и т.д.)
# note: ИСПОЛНИТЕЛЬНЫЕ НОДЫ
# note: НОДЫ РАБОТАЮЩИЕ С ДАННЫМИ

# group: КЛЮЧЕВЫЕ МОМЕНТЫ РАБОТЫ
# note: ИТОГОВАЯ КОНСОЛИДАЦИЯ ДАННЫХ

# group: ПЕРЕДАЁМ ИНФОРМАЦИЮ В РЕВИТ
# note: ПЕРЕДАЁМ ИНФОРМАЦИЮ В РЕВИТ

# group: ЭЛЕМЕНТЫ УПРАВЛЕНИЯ Dyno Studio
# note: Dyno Studio

# group: ПРИМЕЧАНИЯ ПО ЦВЕТОВОЙ ГРУППИРОВКЕ
# note: GUIDELINES

# group: Название кустом ноды [НАЗВАНИЕ ПАКЕТА] для распакованных кустомных нодов
# note: НОДЫ РАБОТАЮЩИЕ С ДАННЫМИ
# note: ИСПОЛНИТЕЛЬНЫЕ НОДЫ

# group: ЗАПАСНЫЕ ВАРИАНТЫ, ДОПОЛНИТЕЛЬНЫЕ ОПЦИИ
# note: ЗАПАСНЫЕ
# note: ДОПОЛНИТЕЛЬНЫЕ. Градации серово по важности, темнее - важнее

boolean = BoolSelector(false)
element_types = ElementTypes("ParameterElement")
all_elements_of_type = ElementsOfType(element_types)
name = GlobalParameter.Name(all_elements_of_type)
string = StringInput("s.p")
contains = String.Contains(str=name, searchFor=string)
filterByBoolMask = List.FilterByBoolMask(list=all_elements_of_type, mask=contains)
element_types_2 = ElementTypes("ParameterElement")
all_elements_of_type_2 = ElementsOfType(element_types_2)
getCategory = Element.GetCategory(all_elements_of_type_2)
string_from_object = FromObject(getCategory)
string_from_object_2 = FromObject(getCategory)
uniqueItems = List.UniqueItems(string_from_object_2)
code_block = CodeBlock(list=string_from_object, i=uniqueItems) { list == i[1]; }
filterByBoolMask_2 = List.FilterByBoolMask(list=all_elements_of_type_2, mask=code_block)
if_ = Python(IN[0]=boolean, IN[1]=filterByBoolMask.in, IN[2]=filterByBoolMask_2.in)
# ---------- if_.python (12 lines) ----------
import clr
boolean = IN[0]
true = UnwrapElement(IN[1])
false = UnwrapElement(IN[2])

if boolean:
	out = true
else:
	out = false

#Назначьте вывод переменной OUT.
OUT = out
# ----------------------------------------
удалить = BoolSelector(false)
forceChildrensEval = ForceChildrensEval()  # unwired: arg0
tool_eraser_fix = Python(IN[0]=if_, IN[1]=удалить, IN[2]=forceChildrensEval)
# ---------- tool_eraser_fix.python (36 lines) ----------
count = 0
cantcount = 0

if IN[1]:
	import clr
	clr.AddReference("RevitServices")
	import RevitServices
	from RevitServices.Persistence import DocumentManager
	from RevitServices.Transactions import TransactionManager
	from System.Collections.Generic import *
	
	doc = DocumentManager.Instance.CurrentDBDocument
	uiapp = DocumentManager.Instance.CurrentUIApplication
	app = uiapp.Application
	
	elt = []
	for i in IN[0]:
		elt.append(UnwrapElement(i).Id)
	
	# Start Transaction
	TransactionManager.Instance.EnsureInTransaction(doc)
	cantdelete = []
	for item in elt:
		try:
			doc.Delete(item)
			count = count+1
		except:
			cantdelete.append(item)
			cantcount = cantcount+1
			
	# End Transaction
	TransactionManager.Instance.TransactionTaskDone()
	doc.Regenerate()
	OUT= "Удалено="+str(count), "Не смог удалить="+str(cantcount), ("Список не удалившихся элементов:", cantdelete)
else:
	OUT= "Удалено="+str(count)
# ----------------------------------------
code_block_2 = CodeBlock { 1; 2; }
watch = Watch(filterByBoolMask.in)
count = List.Count(watch)
python_script = Python()  # unwired: IN[0]
# ---------- python_script.python (2 lines) ----------
x = 0
OUT = x
# ----------------------------------------
name_2 = GlobalParameter.Name(filterByBoolMask_2.in)
code_block_3 = CodeBlock { GetAffectedElements; }  # unwired: GetAffectedElements
getValue = Custom[GlobalParameter.GetValue]()  # Gets the value of a global parameter (only in Revit 2016 R2 or later).; unwired: globalParameter
python_script_2 = Python()  # unwired: IN[0]
# ---------- python_script_2.python (37 lines) ----------
import clr
clr.AddReference('RevitAPI')
from Autodesk.Revit.DB import *

clr.AddReference("RevitNodes")
import Revit
clr.ImportExtensions(Revit.Elements)

clr.AddReference("RevitServices")
import RevitServices
from RevitServices.Persistence import DocumentManager
doc = DocumentManager.Instance.CurrentDBDocument

params = UnwrapElement(IN[0])
elementlist = list()
for param in params:
	# in Revit 2016 R2 or later
	try:
		# any params that do not have a unit
		if str(param.GetDefinition().UnitType) == "UT_Number":
			# booleans
			if str(param.GetDefinition().ParameterType) == "YesNo":
				elementlist.append(param.GetValue().Value == 1)
			# parameter types that contain element ids
			elif str(param.GetDefinition().ParameterType) == "Image" or str(param.GetDefinition().ParameterType) == "Material":
				elementlist.append(param.Document.GetElement(param.GetValue().Value))
			# everything else
			else:
				elementlist.append(param.GetValue().Value)
		# any params with units: convert vals to display unit
		else:
			formatoptions = doc.GetUnits().GetFormatOptions(param.GetDefinition().UnitType)
			elementlist.append(UnitUtils.ConvertFromInternalUnits(param.GetValue().Value,formatoptions.DisplayUnits))
	# any earlier Revit version does not support gloabl params
	except:
		elementlist.append(list())
OUT = elementlist
# ----------------------------------------
elementOfGlobalParameter = Python(IN[0]=filterByBoolMask_2.out)  # unwired: IN[1]
# ---------- elementOfGlobalParameter.python (24 lines) ----------
import clr
clr.AddReference('RevitAPI')
from Autodesk.Revit.DB import *

clr.AddReference("RevitNodes")
import Revit
clr.ImportExtensions(Revit.Elements)

clr.AddReference("RevitServices")
import RevitServices
from RevitServices.Persistence import DocumentManager
doc = DocumentManager.Instance.CurrentDBDocument

params = UnwrapElement(IN[0])
el = []
x=0
for p in params:
	n = p.Name
	try:
		d = GlobalParametersManager.IsUniqueName(doc,n)
		el.append(d)
	except:
		x=x+1
OUT = x,el
# ----------------------------------------
elementid_from_string = Custom[ElementID From String]()  # Converts String reference of Element ID to a usable element ID (Element must exist)
id_to_element = Custom[Id to Element]()  # Selects elements in a model from id input (ElementId, string, integer or GUID); unwired: Id
setValueToElementId = GlobalParameter.SetValueToElementId()  # unwired: arg0, arg1
code_block_4 = CodeBlock { ч; }  # frozen; unwired: ч
elementOfGlobalParameter_2 = Python(IN[0]=code_block_4)
# ---------- elementOfGlobalParameter_2.python (21 lines) ----------
import clr
clr.AddReference('RevitAPI')
from Autodesk.Revit.DB import *

clr.AddReference("RevitNodes")
import Revit
clr.ImportExtensions(Revit.Elements)

clr.AddReference("RevitServices")
import RevitServices
from RevitServices.Persistence import DocumentManager
doc = DocumentManager.Instance.CurrentDBDocument

params = UnwrapElement(IN[0])
el = []
x=0
for p in params:
	n = p.Name
	d = p.GetGeometryObjectFromReference()
	el.append(d)
OUT = x,el
# ----------------------------------------
members = Custom[Object.Members]()  # Gets a list of all members (properties and methods) of a selected element; unwired: element
getValue_2 = Custom[GlobalParameter.GetValue]()  # unwired: globalParameter
code_block_5 = CodeBlock { "222"; }
findByName = GlobalParameter.FindByName(code_block_5)
forceChildrensEval_2 = ForceChildrensEval()  # unwired: arg0
elementOfGlobalParameter_3 = Python(IN[0]=findByName, IN[1]=forceChildrensEval_2)
# ---------- elementOfGlobalParameter_3.python (19 lines) ----------
import clr
clr.AddReference('RevitAPI')
from Autodesk.Revit.DB import *

clr.AddReference("RevitNodes")
import Revit
clr.ImportExtensions(Revit.Elements)

clr.AddReference("RevitServices")
import RevitServices
from RevitServices.Persistence import DocumentManager
doc = DocumentManager.Instance.CurrentDBDocument

p = UnwrapElement(IN[0])
el = []
x=0
el = p.GetAffectedElements()

OUT = el
# ----------------------------------------
id = Parameter.Id(code_block_4)
hasValue = Parameter.HasValue(code_block_4)
isShared = Parameter.IsShared(code_block_4)
parameterType = Parameter.ParameterType(code_block_4)
parameterGroup = GlobalParameter.ParameterGroup(code_block_4)
nullSetParameter = Custom[Springs.NullSetParameter]()  # Similar to the built-in function but with the ability to handle null values. Part of the SmartCopyMon workflow.; unwired: element, parameter, value
nullGetParameter = Custom[Springs.NullGetParameter]()  # Similar to the built in node.Capable of handling null values, part of the SmartCopyMonitor workflow.; unwired: element, parameter
name_3 = GlobalParameter.Name(code_block_4)
get_type_parameter = Custom[Get Type Parameter](element=code_block_4, parameterName=name_3)  # This node will retrieve a type parameter by its name.
parameterIsReadOnly = Custom[Element.ParameterIsReadOnly]()  # Checks if a parameter of a given element is read-only; unwired: element, parameter
getParameterValueByNameAsString = Custom[GetParameterValueByNameAsString]()  # Returns paramter value as string. Same effect as lunchbox node, without python.; unwired: Element_s, Parameter_Name
familyParameters = Custom[FamilyDocument.FamilyParameters]()  # Retrieves all family parameters from the active family document. PLEASE NOTE: This node will only work in a family document!
byParamterValue = Archilab.Grimshaw.Selection.Select.ByParamterValue()  # unwired: arg0, arg1, arg2, arg3
