# Dynamo graph 0.Удалить параметры_0.2 (по группе).dyn (Dynamo 1.3.3.4111)

# group: КЛЮЧЕВЫЕ МОМЕНТЫ РАБОТЫ 1
# note: КОНСОЛИДАЦИЯ И СЛОЖНЫЕ ОБРАБОТКИ

# group: ИСПОЛНИТЕЛЬНЫЕ НОДЫ (фильтрование, подбор, списки и т.д.)
# note: ИСПОЛНИТЕЛЬНЫЕ НОДЫ

# group: ЗАПАСНЫЕ ВАРИАНТЫ, ДОПОЛНИТЕЛЬНЫЕ ОПЦИИ
# note: ЗАПАСНЫЕ
# note: ДОПОЛНИТЕЛЬНЫЕ. Градации серово по важности, темнее - важнее

# group: КЛЮЧЕВЫЕ МОМЕНТЫ РАБОТЫ 2
# note: УСЛОЖНЕННЫЕ КОНСТРУКЦИИ
# note: УСЛОЖНЕНЫЕ КОНСТРУКЦИИ

# group: ЭЛЕМЕНТЫ УПРАВЛЕНИЯ
# note: ПЕРЕМЕННЫЕ ЗНАЧЕНИЯ
# note: ЭЛЕМЕНТЫ УПРАВЛЕНИЯ

# group: ПРОВЕРОЧНЫЕ НОДЫ
# note: ПРОВЕРОЧНЫЕ НОДЫ

# group: ПЕРЕДАЁМ ИНФОРМАЦИЮ
# note: ПЕРЕДАЁМ ИНФОРМАЦИЮ В РЕВИТ
# note: ПЕРЕДАЁМ ИНФОРМАЦИЮ ЕЩЁ КУДА-ТО

# group: ПРИМЕЧАНИЯ ПО ЦВЕТОВОЙ ГРУППИРОВКЕ
# note: GUIDELINES

# group: Python ноды
# note: Python

# group: ЭЛЕМЕНТЫ УПРАВЛЕНИЯ 2 УРОВЕНЬ
# note: ЭЛЕМЕНТЫ УПРАВЛЕНИЯ
# note: ПЕРЕМЕННЫЕ ЗНАЧЕНИЯ

# group: Запуск питона из внешнего файла
# note: Py - files

# group: ПОЛУЧАЕМ ДАННЫЕ
# note: ПОЛУЧАЕМ ДАННЫЕ ИЗ РЕВИТ и других источников

element_types = ElementTypes("ParameterElement")
all_elements_of_type = ElementsOfType(element_types)
значение_группы_параметра = Python(IN[0]=all_elements_of_type)
# ---------- значение_группы_параметра.python (20 lines) ----------
# -*- coding: utf-8 -*- 
#-----------------------Импоорт библиотек----------------------
import clr
clr.AddReference('RevitAPI')
import Autodesk
from Autodesk.Revit.DB import InternalDefinition 
#-----------------------ИМПОРТ БИБЛИОТЕК----------------------

params = UnwrapElement(IN[0])

test = []

for p in params:
	test.append(str(p.GetDefinition().ParameterGroup))
	
#TransactionManager.Instance.EnsureInTransaction(doc)
#TransactionManager.Instance.TransactionTaskDone()
#-----------------------КОНЕЦ СКРИПТА----------------------

OUT = test
# ----------------------------------------
string = StringInput("PG_IFC")
eq = значение_группы_параметра == string
filterByBoolMask = List.FilterByBoolMask(list=all_elements_of_type, mask=eq)
name = GlobalParameter.Name(filterByBoolMask.in)
удалить = BoolSelector(false)
forceChildrensEval = ForceChildrensEval()  # unwired: arg0
tool_eraser_fix = Python(IN[0]=filterByBoolMask.in, IN[1]=удалить, IN[2]=forceChildrensEval)
# ---------- tool_eraser_fix.python (36 lines) ----------
count = 0
cantcount = 0

if IN[1]:
	import clr
	clr.AddReference("RevitServices")
	import RevitServices
	from RevitServices.Persistence import DocumentManager
	from RevitServices.Transactions import TransactionManager
	from System.Collections.Generic import *
	
	doc = DocumentManager.Instance.CurrentDBDocument
	uiapp = DocumentManager.Instance.CurrentUIApplication
	app = uiapp.Application
	
	elt = []
	for i in IN[0]:
		elt.append(UnwrapElement(i).Id)
	
	# Start Transaction
	TransactionManager.Instance.EnsureInTransaction(doc)
	cantdelete = []
	for item in elt:
		try:
			doc.Delete(item)
			count = count+1
		except:
			cantdelete.append(item)
			cantcount = cantcount+1
			
	# End Transaction
	TransactionManager.Instance.TransactionTaskDone()
	doc.Regenerate()
	OUT= "Удалено="+str(count), "Не смог удалить="+str(cantcount), ("Список не удалившихся элементов:", cantdelete)
else:
	OUT= "Удалено="+str(count)
# ----------------------------------------
boolean = BoolSelector(false)

# group: Инжинерные параметры
element_types_2 = ElementTypes("ParameterElement")
all_elements_of_type_2 = ElementsOfType(element_types_2)
getCategory = Element.GetCategory(all_elements_of_type_2)
string_from_object = FromObject(getCategory)
string_from_object_2 = FromObject(getCategory)
uniqueItems = List.UniqueItems(string_from_object_2)
code_block = CodeBlock(list=string_from_object, i=uniqueItems) { list == i[0]; }
filterByBoolMask_2 = List.FilterByBoolMask(list=all_elements_of_type_2, mask=code_block)
name_2 = GlobalParameter.Name(filterByBoolMask_2.in)
elementOfGlobalParameter = Python(IN[0]=filterByBoolMask_2.out)  # unwired: IN[1]
# ---------- elementOfGlobalParameter.python (24 lines) ----------
import clr
clr.AddReference('RevitAPI')
from Autodesk.Revit.DB import *

clr.AddReference("RevitNodes")
import Revit
clr.ImportExtensions(Revit.Elements)

clr.AddReference("RevitServices")
import RevitServices
from RevitServices.Persistence import DocumentManager
doc = DocumentManager.Instance.CurrentDBDocument

params = UnwrapElement(IN[0])
el = []
x=0
for p in params:
	n = p.Name
	try:
		d = GlobalParametersManager.IsUniqueName(doc,n)
		el.append(d)
	except:
		x=x+1
OUT = x,el
# ----------------------------------------

if_ = Python(IN[0]=boolean, IN[1]=filterByBoolMask.in, IN[2]=filterByBoolMask_2.in)
# ---------- if_.python (12 lines) ----------
import clr
boolean = IN[0]
true = UnwrapElement(IN[1])
false = UnwrapElement(IN[2])

if boolean:
	out = true
else:
	out = false

#Назначьте вывод переменной OUT.
OUT = out
# ----------------------------------------
code_block_2 = CodeBlock { 1; 2; }
watch = Watch(filterByBoolMask.in)
count = List.Count(watch)
python_script = Python()  # unwired: IN[0]
# ---------- python_script.python (2 lines) ----------
x = 0
OUT = x
# ----------------------------------------
boolean_2 = BoolSelector(true)  # frozen
code_block_3 = CodeBlock { 1; 2; }
if_2 = Python(IN[0]=boolean_2, IN[1]=code_block_3.out0, IN[2]=code_block_3.out1)  # same code as if_
parameters = Element.Parameters()  # unwired: arg0
geometry = Element.Geometry()  # unwired: arg0
setParameterByName = Element.SetParameterByName()  # unwired: element, parameterName, value
# note: ВСЁ ОСТАЛЬНОЕ
getParameterValueByName = Element.GetParameterValueByName()  # unwired: element, parameterName
regenerate = Python()  # frozen; unwired: IN[0]
# ---------- regenerate.python (26 lines) ----------
import clr

# Import DocumentManager and TransactionManager
clr.AddReference("RevitServices")
import RevitServices
from RevitServices.Persistence import DocumentManager


# Import RevitAPI
clr.AddReference("RevitAPI")
import Autodesk
from Autodesk.Revit.DB import *

doc = DocumentManager.Instance.CurrentDBDocument


#The inputs to this node will be stored as a list in the IN variable.
list = IN[0]


if list:
	doc.Regenerate()
	out = "Regeneration complete"
else:
	out = "fail"
OUT = out
# ----------------------------------------
shablon_python_shablon = Python()  # frozen; unwired: IN[0]
# ---------- shablon_python_shablon.python (73 lines) ----------
# -*- coding: utf-8 -*- 
#-----------------------Импоорт библиотек----------------------
import sys
sys.path.append('C:\Program Files (x86)\IronPython 2.7\Lib')

import clr
clr.AddReference('RevitAPI')
import Autodesk
from Autodesk.Revit.DB import *

clr.AddReference("RevitNodes") 
import Revit
from Revit.Elements import *

clr.ImportExtensions(Revit.Elements) #ToDSType не работает без
clr.ImportExtensions(Revit.GeometryConversion)

clr.AddReference("RevitServices")
import RevitServices
from RevitServices.Persistence import DocumentManager
from RevitServices.Transactions import TransactionManager

clr.AddReference('ProtoGeometry')
from Autodesk.DesignScript.Geometry import *
#-----------------------ИМПОРТ БИБЛИОТЕК----------------------
"""-"""
#-----------------------ФУНКЦИИ----------------------

def __x__(x):
	x="x"
	return x
	
#-----------------------ФУНКЦИИ----------------------
"""-"""
#-----------------------АПИ ПАРАМЕТРЫ----------------------

doc = DocumentManager.Instance.CurrentDBDocument
#link_doc = UnwrapElement(IN[1])
#uiapp = DocumentManager.Instance.CurrentUIApplication
#app = uiapp.Application
#version = app.VersionNumber
#options = Autodesk.Revit.DB.SpatialElementBoundaryOptions()
#options.StoreFreeBoundaryFaces = True --------- ЗАПИСЬ В PROPERTIS !!!!!!!!!!!!!!!
#options.SpatialElementBoundaryLocation = SpatialElementBoundaryLocation.Center --------- ЗАПИСЬ В Enumeration !!!!!!!!!!!!!!!
calculator = SpatialElementGeometryCalculator(doc)

#-----------------------АПИ ПАРАМЕТРЫ----------------------
"""-"""
#-----------------------РАБОЧИЕ ПАРАМЕТРЫ----------------------

rooms = UnwrapElement(IN[0])

#-----------------------РАБОЧИЕ ПАРАМЕТРЫ----------------------	
"""-"""
#-----------------------ТЕСТОВЫЕ ПАРАМЕТРЫ----------------------

test = []

#-----------------------ТЕСТОВЫЕ ПАРАМЕТРЫ----------------------
"""-"""
#-----------------------НАЧАЛО СКРИПТА----------------------

x = 0
if rooms == None:
	rooms = [0,0]

for room in rooms:
	x=__x__(x)+__x__(x)
#TransactionManager.Instance.EnsureInTransaction(doc)
#TransactionManager.Instance.TransactionTaskDone()
#-----------------------КОНЕЦ СКРИПТА----------------------

OUT = x
# ----------------------------------------
members = Python()  # "Object.Members"; frozen; unwired: IN[0]
# ---------- members.python (14 lines) ----------
import clr

items = IN[0]
elementlist = list()

try:
	clr.AddReference('RevitAPI')
	from Autodesk.Revit.DB import *
	for item in items:
		elementlist.append(dir(UnwrapElement(item)))
except:
	for item in items:
		elementlist.append(dir(item))
OUT = elementlist
# ----------------------------------------
filteredElementCollector = Python()  # frozen; unwired: IN[0]
# ---------- filteredElementCollector.python (29 lines) ----------
if IN[1]:
	import clr
	
	# Import DocumentManager and TransactionManager
	clr.AddReference("RevitServices")
	import RevitServices
	from RevitServices.Persistence import DocumentManager
	
	
	# Import RevitAPI
	clr.AddReference("RevitAPI")
	import Autodesk
	from Autodesk.Revit.DB import *
	
	doc = DocumentManager.Instance.CurrentDBDocument
	uiapp = DocumentManager.Instance.CurrentUIApplication
	app = uiapp.Application
	
	from System.Collections.Generic import *
	
	
	#The inputs to this node will be stored as a list in the IN variable.
	dataEnteringNode = IN
	collector = FilteredElementCollector(doc)
	elements = collector.OfCategory(BuiltInCategory.OST_Views).ToElements()
	
	OUT = sheetInstances
else:
	OUT = "скрипт не выполнен"
# ----------------------------------------

# group: Get Revit Selection:
forceChildrensEval_2 = ForceChildrensEval()  # frozen; unwired: arg0
pys_get_revit_selection = Python(IN[0]=forceChildrensEval_2)
# ---------- pys_get_revit_selection.python (22 lines) ----------
import clr
clr.AddReference('RevitServices')
clr.AddReference('RevitAPI')
from Autodesk.Revit.DB import *
import RevitServices
from RevitServices.Persistence import DocumentManager
from Autodesk.Revit.ApplicationServices import Application

reset = IN[0]

doc = DocumentManager.Instance.CurrentDBDocument
uidoc = DocumentManager.Instance.CurrentUIApplication.ActiveUIDocument
ids = uidoc.Selection.GetElementIds()

idd = [str(i) for i in ids]

if isinstance(idd, list) == True:
	elems = [doc.GetElement(ElementId(int(i))) for i in idd]
else:
	elems = doc.GetElement(ElementId(int(idd)))

OUT = elems
# ----------------------------------------

# group: Parameters name from language
parameters_name_from_language = Python()  # frozen
# ---------- parameters_name_from_language.python (18 lines) ----------
import clr
clr.AddReference('RevitServices')
import RevitServices
from RevitServices.Persistence import DocumentManager

uiapp = DocumentManager.Instance.CurrentUIApplication
app = uiapp.Application
lng = app.Language
rus = ["Тип","Имя семейства","Имя типа"]
enu = ["Type","Family name","Type name"]
out = []
if str(lng) == "Russian":
	out = rus
else:
	out = enu
#English_USA
#Russian
OUT = out
# ----------------------------------------

# group: элементы внутри групп
members_2 = Python()  # "Group.Members"; frozen; unwired: IN[0]
# ---------- members_2.python (19 lines) ----------
import clr
clr.AddReference('RevitAPI')
from Autodesk.Revit.DB import *

clr.AddReference("RevitNodes")
import Revit
clr.ImportExtensions(Revit.Elements)

groups = UnwrapElement(IN[0])
elementlist = list()
for item in groups:
	try:
		memberlist = list()
		for member in item.GetMemberIds():
			memberlist.append(item.Document.GetElement(member))
		elementlist.append(memberlist)
	except:
		elementlist.append(list())
OUT = elementlist
# ----------------------------------------

путь_к_файлу_python = Filename(".\N.Отделка помещений_сбор элементов вокруг_1.7.py")  # frozen
forceChildrensEval_3 = ForceChildrensEval()  # unwired: arg0
find_file_and_import_it = Python(IN[0]=путь_к_файлу_python, IN[1]=forceChildrensEval_3)
# ---------- find_file_and_import_it.python (11 lines) ----------
import sys
sys.path.append('C:\Program Files (x86)\IronPython 2.7\Lib')
import codecs

try:
	filePath = IN[0]
	with codecs.open(filePath, 'rb', "utf-8") as inf:
		lines = inf.readlines()
	OUT = ''.join(lines)
except:
	OUT = "No file"
# ----------------------------------------
python_script_from_string = PythonStringNode(script=find_file_and_import_it)  # unwired: IN[0]
categories = Categories()  # frozen
all_elements_of_category = ElementsOfCategory(categories)
groupByKey = List.GroupByKey(list=all_elements_of_type, keys=значение_группы_параметра)  # frozen
