# Dynamo graph 0.Удалить по категории  (или типу) и параметру с проверкой размещения на листе.dyn (Dynamo 1.3.0.875)

удалить = BoolSelector(true)
удалить_элементы_на_листах = BoolSelector(false)
без_фильтра_с_фильтром = BoolSelector(true)
по_категории_или_типу = BoolSelector(true)
categories = Categories("Views")
all_elements_of_category = ElementsOfCategory(categories)
clear_list = Python(IN[0]=all_elements_of_category)
# ---------- clear_list.python (23 lines) ----------
#Copyright(c) 2015, Konrad K Sobon
# @arch_laboratory, http://archi-lab.net

import clr
clr.AddReference('ProtoGeometry')
from Autodesk.DesignScript.Geometry import *
#The inputs to this node will be stored as a list in the IN variable.
dataEnteringNode = IN

def ClearList(_list):
    out = []
    for _list1 in _list:
        if _list1 is None:
            continue
        if isinstance(_list1, list):
             _list1 = ClearList(_list1)
             if not _list1:
                 continue
        out.append(_list1)
    return out

#Assign your output to the OUT variable
OUT = ClearList(IN[0])
# ----------------------------------------
element_types = ElementTypes("ViewSchedule")
all_elements_of_type = ElementsOfType(element_types)
clear_list_2 = Python(IN[0]=all_elements_of_type)  # same code as clear_list
forceChildrensEval = ForceChildrensEval()  # unwired: arg0
if_ = Python(IN[0]=по_категории_или_типу, IN[1]=clear_list, IN[2]=clear_list_2, IN[3]=forceChildrensEval)
# ---------- if_.python (12 lines) ----------
import clr
boolean = IN[0]
true = UnwrapElement(IN[1])
false = UnwrapElement(IN[2])

if boolean:
	out = true
else:
	out = false

#Назначьте вывод переменной OUT.
OUT = out
# ----------------------------------------
параметр_равен_или_содержит = BoolSelector(true)
параметр_по_которому_удаляем = StringInput("Корпус")
getParameterValueByName = Element.GetParameterValueByName(element=if_, parameterName=параметр_по_которому_удаляем)
значение_параметра = StringInput("8")
eq = getParameterValueByName == значение_параметра
boolean = BoolSelector(true)
contains = String.Contains(str=getParameterValueByName, searchFor=значение_параметра, ignoreCase=boolean)
forceChildrensEval_2 = ForceChildrensEval()  # unwired: arg0
if_2 = Python(IN[0]=параметр_равен_или_содержит, IN[1]=eq, IN[2]=contains, IN[3]=forceChildrensEval_2)  # same code as if_
filterByBoolMask = List.FilterByBoolMask(list=if_, mask=if_2)
forceChildrensEval_3 = ForceChildrensEval()  # unwired: arg0
if_3 = Python(IN[0]=без_фильтра_с_фильтром, IN[1]=if_, IN[2]=filterByBoolMask.in, IN[3]=forceChildrensEval_3)  # same code as if_

# group: Вид не расположен на листе?
code_block = CodeBlock { "Имя листа"; ""; }
getParameterValueByName_2 = Element.GetParameterValueByName(element=if_3, parameterName=code_block.out0)
eq_2 = getParameterValueByName_2 == code_block.out1
filterByBoolMask_2 = List.FilterByBoolMask(list=if_3, mask=eq_2)

forceChildrensEval_4 = ForceChildrensEval()  # unwired: arg0
if_4 = Python(IN[0]=удалить_элементы_на_листах, IN[1]=if_3, IN[2]=filterByBoolMask_2.in, IN[3]=forceChildrensEval_4)  # same code as if_
code_block_2 = CodeBlock { null; }
forceChildrensEval_5 = ForceChildrensEval()  # unwired: arg0
if_5 = Python(IN[0]=удалить, IN[1]=if_4, IN[2]=code_block_2, IN[3]=forceChildrensEval_5)  # same code as if_
delete = Archilab.Grimshaw.Elements.Element.Delete(if_5)
count = List.Count(if_3)
количество_элементов = Watch(count)
code_block_3 = CodeBlock { null; }
count_2 = List.Count(filterByBoolMask_2.out)
количество_элементов_на_листах = Watch(count_2)
