# Dynamo graph 0.Удалить по категории.dyn (Dynamo 1.3.1.1736)

удалить = BoolSelector(false)
categories = Categories("RoomSeparationLines")
all_elements_of_category = ElementsOfCategory(categories)
code_block = CodeBlock { null; }
forceChildrensEval = ForceChildrensEval()  # unwired: arg0
if_ = Python(IN[0]=удалить, IN[1]=all_elements_of_category, IN[2]=code_block, IN[3]=forceChildrensEval)
# ---------- if_.python (12 lines) ----------
import clr
boolean = IN[0]
true = UnwrapElement(IN[1])
false = UnwrapElement(IN[2])

if boolean:
	out = true
else:
	out = false

#Назначьте вывод переменной OUT.
OUT = out
# ----------------------------------------
delete = Elements.Element.Delete(if_)
count = List.Count(all_elements_of_category)
количество_элементов = Watch(count)
