# Dynamo graph 0.Удаляем все типы в семействе.dyn (Dynamo 1.3.3.4111)

python_script = Python()  # unwired: IN[0]
# ---------- python_script.python (26 lines) ----------
import clr
clr.AddReference('RevitAPI')
from Autodesk.Revit.DB import FamilyManager

clr.AddReference("RevitServices")
import RevitServices
from RevitServices.Persistence import DocumentManager
from RevitServices.Transactions import TransactionManager


doc = DocumentManager.Instance.CurrentDBDocument

TransactionManager.Instance.EnsureInTransaction(doc)

if doc.IsFamilyDocument:
	for ftype in doc.FamilyManager.Types:
		try:
			doc.FamilyManager.DeleteCurrentType()
		except:
			pass
	out = "Типы семейств удалены"
else:
	out = "Необходимо запустить внутри редактора семейств"
TransactionManager.Instance.TransactionTaskDone()

OUT = out
# ----------------------------------------
