# Dynamo graph 2.(Push) Del IMPORT lins.dyn (Dynamo 1.3.2.2480)

forceChildrensEval = ForceChildrensEval()  # unwired: arg0
string = StringInput("IMPORT")
python_script = Python(IN[0]=forceChildrensEval, IN[1]=string)
# ---------- python_script.python (19 lines) ----------
import clr
clr.AddReference('RevitAPI')
import Autodesk
from Autodesk.Revit.DB import FilteredElementCollector
clr.AddReference('RevitServices')
from RevitServices.Persistence import DocumentManager
from RevitServices.Transactions import TransactionManager

doc = DocumentManager.Instance.CurrentDBDocument
LPE = Autodesk.Revit.DB.LinePatternElement
FEC = FilteredElementCollector(doc).OfClass(clr.GetPythonType(LPE))
string = IN[1]
linesDel = [i.Id for i in FEC if "IMPORT" in i.Name or string in i.Name]
todell = len(linesDel)

TransactionManager.Instance.EnsureInTransaction(doc)
[doc.Delete(item) for item in linesDel]
TransactionManager.Instance.TransactionTaskDone()
OUT = todell
# ----------------------------------------
количество_удалённых = Watch(python_script)
