# Dynamo graph 2.(Push) Del empty sheet.dyn (Dynamo 1.3.0.875)

forceChildrensEval = ForceChildrensEval()  # unwired: arg0
string = StringInput("ИМПОРТ")
python_script = Python(IN[0]=forceChildrensEval, IN[1]=string)  # frozen
# ---------- python_script.python (18 lines) ----------
import clr
clr.AddReference('RevitAPI')
import Autodesk
from Autodesk.Revit.DB import FilteredElementCollector
clr.AddReference('RevitServices')
from RevitServices.Persistence import DocumentManager
from RevitServices.Transactions import TransactionManager

doc = DocumentManager.Instance.CurrentDBDocument
LPE = Autodesk.Revit.DB.LinePatternElement
FEC = FilteredElementCollector(doc).OfClass(clr.GetPythonType(LPE))
string = IN[1]
linesDel = [i.Id for i in FEC if "IMPORT" in i.Name or string in i.Name]

TransactionManager.Instance.EnsureInTransaction(doc)
[doc.Delete(item) for item in linesDel]
TransactionManager.Instance.TransactionTaskDone()
OUT = 0
# ----------------------------------------
createPlaceholder = Archilab.Grimshaw.Views.Sheet.CreatePlaceholder()  # unwired: arg0, arg1
byNumberAndName = Custom[PlaceholderSheet.ByNumberAndName]()  # Creates placeholder sheets; unwired: sheetNumber, sheetName
forceChildrensEval_2 = ForceChildrensEval()  # unwired: arg0
string_2 = StringInput("Тестовая")
forceChildrensEval_3 = ForceChildrensEval()  # unwired: arg0
categories = Categories("Sheets")
all_elements_of_category = ElementsOfCategory(categories)
python_script_2 = Python(IN[0]=forceChildrensEval_3, IN[1]=all_elements_of_category)  # frozen
# ---------- python_script_2.python (24 lines) ----------
import clr
clr.AddReference('RevitAPI')
import Autodesk
from Autodesk.Revit.DB import FilteredElementCollector
clr.AddReference('RevitServices')
from RevitServices.Persistence import DocumentManager
from RevitServices.Transactions import TransactionManager

doc = DocumentManager.Instance.CurrentDBDocument
sheets = UnwrapElement(IN[1])
list = []

TransactionManager.Instance.EnsureInTransaction(doc)

for s in sheets:
	list.append(s.IsPlaceholder())
		
"""	
for item in list:
	doc.Delete(item)

"""
TransactionManager.Instance.TransactionTaskDone()
OUT = list
# ----------------------------------------
