# Dynamo graph 2.(Push) Удаляем линии по имени.dyn (Dynamo 1.3.3.4111)

forceChildrensEval = ForceChildrensEval()  # unwired: arg0
содержится_в_имени_типа_линий = StringInput("Штрих")
python_script = Python(IN[0]=forceChildrensEval, IN[1]=содержится_в_имени_типа_линий)
# ---------- python_script.python (27 lines) ----------
import clr
clr.AddReference('RevitAPI')
import Autodesk
from Autodesk.Revit.DB import FilteredElementCollector
clr.AddReference('RevitServices')
from RevitServices.Persistence import DocumentManager
from RevitServices.Transactions import TransactionManager

doc = DocumentManager.Instance.CurrentDBDocument
LPE = Autodesk.Revit.DB.LinePatternElement
FEC = FilteredElementCollector(doc).OfClass(clr.GetPythonType(LPE))
string = UnwrapElement(IN[1])
list = []
list_of_del_line_names = []

TransactionManager.Instance.EnsureInTransaction(doc)

for i in FEC:
	if string in i.Name:
		list.append(i.Id)
		list_of_del_line_names.append(i.Name)
		
for item in list:
	doc.Delete(item)

TransactionManager.Instance.TransactionTaskDone()
OUT = list_of_del_line_names
# ----------------------------------------
