# Dynamo graph D2 Удалить по категории.dyn (Dynamo 2.3.0.5885)

удалить = BoolSelector(true)  # graph input
по_категории_или_типу = BoolSelector(true)  # graph input
categories = Categories("OST_PipeSegments")  # graph input
all_elements_of_category = ElementsOfCategory(Category=categories)
clear_list = Python(IN[0]=all_elements_of_category)
# ---------- clear_list.python (23 lines) ----------
#Copyright(c) 2015, Konrad K Sobon
# @arch_laboratory, http://archi-lab.net

import clr
clr.AddReference('ProtoGeometry')
from Autodesk.DesignScript.Geometry import *
#The inputs to this node will be stored as a list in the IN variable.
dataEnteringNode = IN

def ClearList(_list):
    out = []
    for _list1 in _list:
        if _list1 is None:
            continue
        if isinstance(_list1, list):
             _list1 = ClearList(_list1)
             if not _list1:
                 continue
        out.append(_list1)
    return out

#Assign your output to the OUT variable
OUT = ClearList(IN[0])
# ----------------------------------------
element_types = ElementTypes("ViewSchedule")  # graph input
all_elements_of_type = ElementsOfType(element_type=element_types)
clear_list_2 = Python(IN[0]=all_elements_of_type)  # same code as clear_list
if_ = Python(IN[0]=по_категории_или_типу, IN[1]=clear_list, IN[2]=clear_list_2)  # unwired: IN[3]
# ---------- if_.python (12 lines) ----------
import clr
boolean = IN[0]
true = UnwrapElement(IN[1])
false = UnwrapElement(IN[2])

if boolean:
	out = true
else:
	out = false

#Назначьте вывод переменной OUT.
OUT = out
# ----------------------------------------
code_block = CodeBlock { null; }
if_2 = Python(IN[0]=удалить, IN[1]=if_, IN[2]=code_block)  # same code as if_
delete = Element.Delete(element=if_2)
code_block_2 = CodeBlock { null; }
