# Dynamo graph ++Multiple Join (Unjoin) by category_1.1_(меньшее вырезает из большего).dyn (Dynamo 1.3.3.4111)

# note: ВСЁ ОСТАЛЬНОЕ

# group: ЗАПАСНЫЕ ВАРИАНТЫ, ДОПОЛНИТЕЛЬНЫЕ ОПЦИИ
# note: ДОПОЛНИТЕЛЬНЫЕ. Градации серово по важности, темнее - важнее
# note: ЗАПАСНЫЕ

# group: КЛЮЧЕВЫЕ МОМЕНТЫ РАБОТЫ 2
# note: НОДЫ РАБОТАЮЩИЕ С ДАННЫМИ
# note: ИСПОЛНИТЕЛЬНЫЕ НОДЫ

# group: КЛЮЧЕВЫЕ МОМЕНТЫ РАБОТЫ 1
# note: ИТОГОВАЯ КОНСОЛИДАЦИЯ ДАННЫХ

# group: ИСПОЛНИТЕЛЬНЫЕ НОДЫ (фильтрование, подбор, списки и т.д.)
# note: ИСПОЛНИТЕЛЬНЫЕ НОДЫ
# note: НОДЫ РАБОТАЮЩИЕ С ДАННЫМИ

# group: ЭЛЕМЕНТЫ УПРАВЛЕНИЯ 2 УРОВЕНЬ
# note: ПЕРЕМЕННЫЕ ЗНАЧЕНИЯ
# note: ЭЛЕМЕНТЫ УПРАВЛЕНИЯ

# group: ПЕРЕДАЁМ ИНФОРМАЦИЮ В РЕВИТ
# note: ПЕРЕДАЁМ ИНФОРМАЦИЮ В РЕВИТ

# group: ЭЛЕМЕНТЫ УПРАВЛЕНИЯ Dyno Studio
# note: Dyno Studio

# group: ЭЛЕМЕНТЫ УПРАВЛЕНИЯ
# note: ПЕРЕМЕННЫЕ ЗНАЧЕНИЯ
# note: ЭЛЕМЕНТЫ УПРАВЛЕНИЯ

# group: ПОЛУЧАЕМ ДАННЫЕ ИЗ РЕВИТ
# note: ПОЛУЧАЕМ ДАННЫЕ ИЗ РЕВИТ

# group: ПРОВЕРОЧНЫЕ НОДЫ
# note: ПРОВЕРОЧНЫЕ НОДЫ

# group: ПРИМЕЧАНИЯ ПО ЦВЕТОВОЙ ГРУППИРОВКЕ
# note: GUIDELINES

forceChildrensEval = ForceChildrensEval()  # unwired: arg0
forceChildrensEval_2 = ForceChildrensEval()  # unwired: arg0
pys_get_revit_selection = Python(IN[0]=forceChildrensEval_2)
# ---------- pys_get_revit_selection.python (22 lines) ----------
import clr
clr.AddReference('RevitServices')
clr.AddReference('RevitAPI')
from Autodesk.Revit.DB import *
import RevitServices
from RevitServices.Persistence import DocumentManager
from Autodesk.Revit.ApplicationServices import Application

reset = IN[0]

doc = DocumentManager.Instance.CurrentDBDocument
uidoc = DocumentManager.Instance.CurrentUIApplication.ActiveUIDocument
ids = uidoc.Selection.GetElementIds()

idd = [str(i) for i in ids]

if isinstance(idd, list) == True:
	elems = [doc.GetElement(ElementId(int(i))) for i in idd]
else:
	elems = doc.GetElement(ElementId(int(idd)))

OUT = elems
# ----------------------------------------
выбрать_элементы_select_m_elms = DSModelElementsSelection()  # "Выбрать элементы (Select M. Elms.) или выбрать прямо в ревите."
create = List.Create(pys_get_revit_selection, выбрать_элементы_select_m_elms)
flatten = Flatten(create)
clean = List.Clean(list=flatten)

# group: Собрать элементы из Групп и Сборок
python_script = Python(IN[0]=clean)
# ---------- python_script.python (24 lines) ----------
import clr
clr.AddReference('RevitAPI')
from Autodesk.Revit.DB import *

clr.AddReference("RevitNodes")
import Revit
clr.ImportExtensions(Revit.Elements)

groups = UnwrapElement(IN[0])
elementlist = list()
for item in groups:
	if item != None:
		if item.Category.Name == "Группы модели" or item.Category.Name == "Сборки":
			try:
				memberlist = list()
				for member in item.GetMemberIds():
					memberlist.append(item.Document.GetElement(member))
				elementlist.append(memberlist)
			except:
				elementlist.append(list())
		else:
			elementlist.append(item)
		
OUT = elementlist
# ----------------------------------------
flatten_2 = Flatten(python_script)

getCategory = Element.GetCategory(flatten_2)
string_from_object = FromObject(getCategory)
список_категорий = StringInput("Стены")
code_block = CodeBlock { ", "; }
split = String.Split(список_категорий, code_block)
containsItem = List.ContainsItem(list=string_from_object, item=split, lacing=CrossProduct)
allFalse = AllFalse(containsItem@L2)
filterByBoolMask = List.FilterByBoolMask(list=flatten_2, mask=allFalse)
code_block_2 = CodeBlock(Flor=filterByBoolMask.out) { Flor; }
объединить_геометрию_разделить = BoolSelector(true)  # "Объединить геометрию /// Разделить геометрию"
python_script_2 = Python()
# ---------- python_script_2.python (15 lines) ----------
import clr
import System
clr.AddReference('RevitAPI')
from Autodesk.Revit.DB import *
clr.AddReference("RevitNodes")
import Revit

bics = System.Enum.GetValues(BuiltInCategory)
cdata = []
for bic in bics:
	try:
		cdata.append((bic,ElementId(bic),Revit.Elements.Category.ById(ElementId(bic).IntegerValue)))
	except:
		pass
OUT = cdata
# ----------------------------------------
transpose = List.Transpose(python_script_2)
code_block_3 = CodeBlock(seq=transpose) { seq[0]; seq[2]; }
code_block_4 = CodeBlock(BuiltInCategories=code_block_3.out0) { BuiltInCategories; }
code_block_5 = CodeBlock(Categories=code_block_3.out1) { Categories; }
string_from_object_2 = FromObject(code_block_5)
containsItem_2 = List.ContainsItem(list=string_from_object_2, item=split, lacing=CrossProduct)
allFalse_2 = AllFalse(containsItem_2@L2)
filterByBoolMask_2 = List.FilterByBoolMask(list=code_block_4, mask=allFalse_2)
watch = Watch(filterByBoolMask_2.out)
filter_colector_by_list_1_0 = Python(IN[0]=forceChildrensEval, IN[1]=code_block_2, IN[2]=объединить_геометрию_разделить, IN[3]=watch)
# ---------- filter_colector_by_list_1_0.python (103 lines) ----------
results = 0
from time import time
tic = time() # время для начала отсчета http://dynamobim.ru/forums/topic/раздутый-файл-dyn-callsitetracedata/#post-8050

if IN[2] == True:
	import clr
	
	clr.AddReference('RevitAPI')
	import Autodesk
	from Autodesk.Revit.DB import GeometryInstance, FilteredElementCollector, JoinGeometryUtils, Options, ElementId, ElementIntersectsSolidFilter, BuiltInParameter
	
	clr.AddReference('RevitServices')
	import RevitServices
	from RevitServices.Persistence import DocumentManager
	from RevitServices.Transactions import TransactionManager
	
	clr.AddReference('System')
	from System.Collections.Generic import List
	
	def flatten_List(a, res=None):
		if res is None:
			res = []
		for i in a:
			if isinstance(a, list):
				flatten_List(i, res)
			else:
				res.append(i)
		return res
	
	
	def join(x,y):
		try:
			JoinGeometryUtils.JoinGeometry(doc,x,y)
			results = 1
		except:
			results = 0
		return results
	
	def join_s(x,y):
		try:
			JoinGeometryUtils.JoinGeometry(doc,x,y)
			JoinGeometryUtils.SwitchJoinOrder(doc,x,y)
			results = 1
		except:
			results = 0
		return results	
	
	opt = Options()
	doc = DocumentManager.Instance.CurrentDBDocument
	
	reset = IN[0]
	items1 = UnwrapElement(IN[1])
	buildinlist = UnwrapElement(IN[3])
	ids = []
	inter = []
	aliter = []
	alliter = []
	
	for i in items1:
		ids.append(i.Id)
		
	iids = List[ElementId](ids)

	for i1 in items1:	
		geomElem = i1.get_Geometry(opt)
		for geomObj in geomElem:
			ids.append(geomObj.ToString())
			if geomObj.ToString() == "Autodesk.Revit.DB.GeometryInstance":
				gsd = geomObj.GetInstanceGeometry()
				for g in gsd:
					if g != None: 
						geomSolid = g
					else:
						pass
				#results = results + 1
			else:
				geomSolid = geomObj
		iter = []

		for ost in buildinlist:
			iter = []
			items = FilteredElementCollector(doc,iids).OfCategory(ost).WhereElementIsNotElementType()
			iter.append(items.WherePasses(ElementIntersectsSolidFilter(geomSolid)).ToElements())
			inter = flatten_List(iter)
			for int in inter:
				if int.Id.ToString() == i1.Id.ToString():
					pass
				else:
					TransactionManager.Instance.EnsureInTransaction(doc)
					if JoinGeometryUtils.AreElementsJoined(doc,int,i1):
						pass
					else:
						if int.Category.Name == "Стены" and i1.Category.Name == "Стены":
							if int.Width <= i1.Width:
								results += join(int,i1)
							else:
								results += join(i1,int)

					TransactionManager.Instance.TransactionTaskDone()
					
toc = time() # время в конце
time = toc-tic
OUT = "Join elements = "+str(results), "Time in seconds = "+str(time)
# ----------------------------------------
количество_объединённых = Watch(filter_colector_by_list_1_0)  # "Количество объединённых элементов"
unjoin_filter_colector_by_list_1 = Python(IN[0]=forceChildrensEval, IN[1]=filterByBoolMask.out, IN[2]=объединить_геометрию_разделить)
# ---------- unjoin_filter_colector_by_list_1.python (39 lines) ----------
results = 0
from time import time
tic = time() # время для начала отсчета http://dynamobim.ru/forums/topic/раздутый-файл-dyn-callsitetracedata/#post-8050

if IN[2] == False:
	import clr
	
	clr.AddReference('RevitAPI')
	import Autodesk
	from Autodesk.Revit.DB import *#JoinGeometryUtils
	
	clr.AddReference('RevitServices')
	import RevitServices
	from RevitServices.Persistence import DocumentManager
	from RevitServices.Transactions import TransactionManager
	
	#clr.AddReference('System')
	#from System.Collections.Generic import List	
	
	#opt = Options()
	doc = DocumentManager.Instance.CurrentDBDocument
	
	reset = IN[0]
	items1 = UnwrapElement(IN[1])
	results = 0
	
	for i in items1:	
		test = JoinGeometryUtils.GetJoinedElements(doc, i)
		if test:
			for t in test:
				TransactionManager.Instance.EnsureInTransaction(doc)
				JoinGeometryUtils.UnjoinGeometry(doc,i,doc.GetElement(t))
				TransactionManager.Instance.TransactionTaskDone()
				results +=1

					
toc = time() # время в конце
time = toc-tic
OUT = "Unjoin elements = "+str(results), "Time in seconds = "+str(time)
# ----------------------------------------
