# Dynamo graph 00.Включить-Выключить параметр по экземпляру, у всего типа.dyn (Dynamo 1.3.0.875)

categories = Categories("SpecialityEquipment")
all_elements_of_category = ElementsOfCategory(categories)
flatten = Flatten(all_elements_of_category)
code_block = CodeBlock { "Текст"; }
включить_выключить = BoolSelector(false)
setParameterByName = Element.SetParameterByName(element=flatten, parameterName=code_block, value=включить_выключить)
