# Dynamo graph 00.Ungroup-Change-NWSE-Regroup.dyn (Dynamo 1.3.0.875)

# note: ВСЁ ОСТАЛЬНОЕ

# group: КЛЮЧЕВЫЕ МОМЕНТЫ РАБОТЫ
# note: ИТОГОВАЯ КОНСОЛИДАЦИЯ ДАННЫХ

# group: ИСПОЛНИТЕЛЬНЫЕ НОДЫ (фильтрование, подбор, списки и т.д.)
# note: НОДЫ РАБОТАЮЩИЕ С ДАННЫМИ
# note: ИСПОЛНИТЕЛЬНЫЕ НОДЫ

# group: ЗАПАСНЫЕ ВАРИАНТЫ, ДОПОЛНИТЕЛЬНЫЕ ОПЦИИ
# note: ДОПОЛНИТЕЛЬНЫЕ. Градации серово по важности, темнее - важнее
# note: ЗАПАСНЫЕ

# group: ПРОВЕРОЧНЫЕ НОДЫ
# note: ПРОВЕРОЧНЫЕ НОДЫ

# group: ПЕРЕДАЁМ ИНФОРМАЦИЮ В РЕВИТ
# note: ПЕРЕДАЁМ ИНФОРМАЦИЮ В РЕВИТ

# group: ЭЛЕМЕНТЫ УПРАВЛЕНИЯ
# note: ПЕРЕМЕННЫЕ ЗНАЧЕНИЯ
# note: ЭЛЕМЕНТЫ УПРАВЛЕНИЯ

# group: ПОЛУЧАЕМ ДАННЫЕ ИЗ РЕВИТ
# note: ПОЛУЧАЕМ ДАННЫЕ ИЗ РЕВИТ

# group: ПРИМЕЧАНИЯ ПО ЦВЕТОВОЙ ГРУППИРОВКЕ
# note: GUIDELINES

# group: Для элементов вне групп
forceChildrensEval = ForceChildrensEval()  # unwired: arg0
pys_get_revit_selection = Python(IN[0]=forceChildrensEval)
# ---------- pys_get_revit_selection.python (22 lines) ----------
import clr
clr.AddReference('RevitServices')
clr.AddReference('RevitAPI')
from Autodesk.Revit.DB import *
import RevitServices
from RevitServices.Persistence import DocumentManager
from Autodesk.Revit.ApplicationServices import Application

reset = IN[0]

doc = DocumentManager.Instance.CurrentDBDocument
uidoc = DocumentManager.Instance.CurrentUIApplication.ActiveUIDocument
ids = uidoc.Selection.GetElementIds()

idd = [str(i) for i in ids]

if isinstance(idd, list) == True:
	elems = [doc.GetElement(ElementId(int(i))) for i in idd]
else:
	elems = doc.GetElement(ElementId(int(idd)))

OUT = elems
# ----------------------------------------

code_block = CodeBlock(elements=pys_get_revit_selection) { elements; }
getCategory = Element.GetCategory(code_block)
string_from_object = FromObject(getCategory)
code_block_2 = CodeBlock { "Окна"; }
eq = string_from_object == code_block_2
filterByBoolMask = List.FilterByBoolMask(list=code_block, mask=eq)
code_block_3 = CodeBlock(to_NSEW=filterByBoolMask.in) { Flatten(to_NSEW); }

# group: Выбираем комнату для проверки
выбираем_комнату_для_проверки = DSModelElementSelection()  # "Выбираем комнату для проверки ориентации окон"

# group: Определяем окна развернутые внутрь
getLocation = Element.GetLocation(code_block_3)
facingOrientation = FamilyInstance.FacingOrientation(code_block_3)
code_block_4 = CodeBlock { 1000; }
translate = Geometry.Translate(geometry=getLocation, direction=facingOrientation, distance=code_block_4)
isInsideRoom = Room.IsInsideRoom(выбираем_комнату_для_проверки, translate)
filterByBoolMask_2 = List.FilterByBoolMask(list=code_block_3, mask=isInsideRoom)

разворачиваем_окна_направленные = Python(IN[0]=filterByBoolMask_2.out)  # "Разворачиваем окна направленные внутрь"
# ---------- разворачиваем_окна_направленные.python (22 lines) ----------
import clr
clr.AddReference('RevitAPI')
from Autodesk.Revit.DB import *

clr.AddReference("RevitServices")
import RevitServices
from RevitServices.Persistence import DocumentManager
from RevitServices.Transactions import TransactionManager

doc = DocumentManager.Instance.CurrentDBDocument
faminstances = UnwrapElement(IN[0])

elementlist = list()

TransactionManager.Instance.EnsureInTransaction(doc)
for item in faminstances:
    item.flipFacing()
    elementlist.append(item)

TransactionManager.Instance.TransactionTaskDone()

OUT = elementlist
# ----------------------------------------

# group (continued): Определяем окна развернутые внутрь
code_block_5 = CodeBlock(t2=разворачиваем_окна_направленные, t3=filterByBoolMask_2.in) { t4 = Flatten({t2, t3}); }

passthrough_clockwork = CodeBlock(passthrough=filterByBoolMask.out, waitfor=code_block_5) { {passthrough,waitfor}[0]; }
create = List.Create(passthrough_clockwork, code_block_5)
flatten = Flatten(create)

# group: Пакет Prorubim
forceChildrensEval_2 = ForceChildrensEval()  # frozen; unwired: arg0

# group: Get Revit Selection:
pys_get_revit_selection_2 = Python(IN[0]=forceChildrensEval_2)  # same code as pys_get_revit_selection
code_block_6 = CodeBlock(group=pys_get_revit_selection_2) { group; }

element_type_clockwork = Python(IN[0]=code_block_6)
# ---------- element_type_clockwork.python (12 lines) ----------
import clr
clr.AddReference('RevitAPI')
from Autodesk.Revit.DB import *

items = UnwrapElement(IN[0])
typelist = list()
for item in items:
	try: 
		typelist.append(item.Document.GetElement(item.GetTypeId()))
	except:
		typelist.append(list())
OUT = typelist
# ----------------------------------------
code_block_7 = CodeBlock { "Имя типа"; }
getParameterValueByName = Element.GetParameterValueByName(element=element_type_clockwork, parameterName=code_block_7)
string_from_object_2 = FromObject(getParameterValueByName)
прификс_к_имени_группы = StringInput(" (fix2)_1-К-1")
code_block_8 = CodeBlock(name=string_from_object_2, x=прификс_к_имени_группы) { name+x; }
passthrough_clockwork_2 = CodeBlock(passthrough=code_block_8, waitfor=flatten) { {passthrough,waitfor}[0]; }

# group: Пакет Prorubim
forceChildrensEval_3 = ForceChildrensEval()  # unwired: arg0

fromElements = Python(IN[0]=flatten, IN[1]=passthrough_clockwork_2, IN[2]=forceChildrensEval_3)  # "Group.FromElements"
# ---------- fromElements.python (28 lines) ----------
import clr
clr.AddReference('RevitAPI')
from Autodesk.Revit.DB import *
from System.Collections.Generic import *

clr.AddReference("RevitServices")
import RevitServices
from RevitServices.Persistence import DocumentManager
from RevitServices.Transactions import TransactionManager

doc = DocumentManager.Instance.CurrentDBDocument
items = UnwrapElement(IN[0])
newname = IN[1]
ids = list()
rejects = list()
for item in items:
	ids.append(item.Id)

items = List[ElementId](ids)

TransactionManager.Instance.EnsureInTransaction(doc)

group = doc.Create.NewGroup(items)
group.GroupType.Name = newname[0]

TransactionManager.Instance.TransactionTaskDone()

OUT = (group,newname)
# ----------------------------------------

# group: Thanks to Andreas for this script Download clockwork for more
ungroupElements = Python(IN[0]=code_block_6)  # "Group.UngroupElements"
# ---------- ungroupElements.python (34 lines) ----------
import clr
clr.AddReference('RevitAPI')
from Autodesk.Revit.DB import *

clr.AddReference("RevitNodes")
import Revit
clr.ImportExtensions(Revit.Elements)

clr.AddReference("RevitServices")
import RevitServices
from RevitServices.Persistence import DocumentManager
from RevitServices.Transactions import TransactionManager

doc = DocumentManager.Instance.CurrentDBDocument
groups = UnwrapElement(IN[0])
elementlist = []
for item in groups:
	try:
		memberlist = []
		for member in item.GetMemberIds():
			memberlist.append(doc.GetElement(member))
		elementlist.append(memberlist)
	except:
		elementlist.append(list())
		
TransactionManager.Instance.EnsureInTransaction(doc)
for group in groups:
	try:
		group.UngroupMembers()
	except:
		pass
TransactionManager.Instance.TransactionTaskDone()
		
OUT = elementlist
# ----------------------------------------

параметр_стороны_света = StringInput("*Cторона света")
basePoint = Coordinates.BasePoint()  # frozen
X = Point.X(basePoint)
Y = Point.Y(basePoint)
code_block_9 = CodeBlock { 1; }
add = Y + code_block_9
Z = Point.Z(basePoint)
byCoordinates = Point.ByCoordinates(x=X, y=add, z=Z)
byTwoPoints = Vector.ByTwoPoints(start=basePoint, end=byCoordinates)
ZAxis = Vector.ZAxis()

# group: Базовая точка проекта
select_basepoint = DSModelElementSelection()

code_block_10 = CodeBlock { "Угол от истинного севера"; }
parameterByName = Parameter.ParameterByName(element=select_basepoint, name=code_block_10)
value = Parameter.Value(parameterByName)
rotate = Vector.Rotate(byTwoPoints, ZAxis, value)

# group: Определяем сторону света
facingOrientation_2 = FamilyInstance.FacingOrientation(code_block_5)
angleAboutAxis = Vector.AngleAboutAxis(facingOrientation_2, rotate, ZAxis)
code_block_11 = CodeBlock(x=angleAboutAxis)
# ---------- code_block_11.designscript (15 lines) ----------
x<=67.5&&x>=22.5 ?
"Северо-Восток":
x<=112.5&&x>=67.6 ?
"Восток":
x<=157.5&&x>=112.6 ?
"Юго-Восток":
x<=202.5&&x>=157.6 ?
"Юг":
x<=247.5&&x>=202.6 ?
"Юго-Запад":
x<=292.5&&x>=247.6 ?
"Запад":
x<=337.5&&x>=292.6 ?
"Северо-Запад":
"Север";
# ----------------------------------------

setParameterByName = Element.SetParameterByName(element=code_block_5, parameterName=параметр_стороны_света, value=code_block_11)
element_types = ElementTypes("GroupType")
all_elements_of_type = ElementsOfType(element_types)
getParameterValueByName_2 = Element.GetParameterValueByName(element=all_elements_of_type, parameterName=code_block_7)

# group: Запись имени уровня в эксель
file_path = Filename("C:\test\Обмен даными.xlsx")
code_block_12 = CodeBlock { "Лист1"; 0; }
allInstances = Python(IN[0]=pys_get_revit_selection_2)  # "Element.AllInstances"
# ---------- allInstances.python (26 lines) ----------
import System
import clr
clr.AddReference('RevitAPI')
from Autodesk.Revit.DB import *

clr.AddReference("RevitServices")
import RevitServices
from RevitServices.Persistence import DocumentManager

doc = DocumentManager.Instance.CurrentDBDocument
elements = UnwrapElement(IN[0])

elementlist = list()
for e in elements:
	collector = FilteredElementCollector(doc)
	bic = System.Enum.ToObject(BuiltInCategory, e.Category.Id.IntegerValue)
	collector.OfCategory(bic)
	# This is a workaround
	# because I was to lazy to learn
	# how to implement LINQ in Python
	elist =  list()
	for item in collector.ToElements():
		if item.GetTypeId().IntegerValue == e.GetTypeId().IntegerValue:
			elist.append(item)
	elementlist.append(elist)
OUT = elementlist
# ----------------------------------------
code_block_13 = CodeBlock { "Базовый уровень"; }
getParameterValueByName_3 = Element.GetParameterValueByName(element=allInstances, parameterName=code_block_13)
flatten_2 = Flatten(getParameterValueByName_3)
CLEAN = Python(IN[0]=forceChildrensEval_2, IN[1]=flatten_2)
# ---------- CLEAN.python (23 lines) ----------
import clr
clr.AddReference('RevitServices')
clr.AddReference('RevitAPI')
from Autodesk.Revit.DB import *
import RevitServices
from RevitServices.Persistence import DocumentManager
from Autodesk.Revit.ApplicationServices import Application

reset = IN[0]
element = IN[1]
clean = []

doc = DocumentManager.Instance.CurrentDBDocument
uidoc = DocumentManager.Instance.CurrentUIApplication.ActiveUIDocument
ids = uidoc.Selection.GetElementIds()

for e in element:
	if len(str(e)) == 0:
		pass
	else:
		clean.append(e)

OUT = clean
# ----------------------------------------
code_block_14 = CodeBlock { "Имя"; }
getParameterValueByName_4 = Element.GetParameterValueByName(element=CLEAN, parameterName=code_block_14)
transpose = List.Transpose(getParameterValueByName_4)
boolean = BoolSelector(true)
writeToFile = Excel.WriteToFile(filePath=file_path, sheetName=code_block_12.out0, startRow=code_block_12.out1, startCol=code_block_12.out1, data=transpose, overWrite=boolean)

параметр_для_записи = StringInput("Комментарии")
значение_параметра = StringInput("Здание 1Корпус 3")
setParameterByName_2 = Element.SetParameterByName(element=flatten, parameterName=параметр_для_записи, value=значение_параметра)  # frozen
# note: Разукрашеваем группы
element_types_2 = ElementTypes("Group")
all_elements_of_type_2 = ElementsOfType(element_types_2)
getCategory_2 = Element.GetCategory(all_elements_of_type_2)
string_from_object_3 = FromObject(getCategory_2)
code_block_15 = CodeBlock { "Группы модели"; }
eq_2 = string_from_object_3 == code_block_15
filterByBoolMask_3 = List.FilterByBoolMask(list=all_elements_of_type_2, mask=eq_2)
code_block_16 = CodeBlock { "Тип"; }
getParameterValueByName_5 = Element.GetParameterValueByName(parameterName=code_block_16)  # unwired: element
groupByFunction = GroupByFunction(filterByBoolMask_3.in, getParameterValueByName_5)
flatten_3 = Flatten(groupByFunction)
group_members_clockwork = Python(IN[0]=flatten_3)
# ---------- group_members_clockwork.python (19 lines) ----------
import clr
clr.AddReference('RevitAPI')
from Autodesk.Revit.DB import *

clr.AddReference("RevitNodes")
import Revit
clr.ImportExtensions(Revit.Elements)

groups = UnwrapElement(IN[0])
elementlist = list()
for item in groups:
	try:
		memberlist = list()
		for member in item.GetMemberIds():
			memberlist.append(item.Document.GetElement(member))
		elementlist.append(memberlist)
	except:
		elementlist.append(list())
OUT = elementlist
# ----------------------------------------
code_block_17 = CodeBlock { "Тип"; }
getParameterValueByName_6 = Element.GetParameterValueByName(element=filterByBoolMask_3.in, parameterName=code_block_17)
uniqueItems = List.UniqueItems(getParameterValueByName_6)
allIndicesOf = List.AllIndicesOf(list=getParameterValueByName_6, item=uniqueItems)
count = Count(allIndicesOf)
code_block_18 = CodeBlock(x=count) { 1..x; }
count_2 = Count(allIndicesOf@L2)
ofRepeatedItem = List.OfRepeatedItem(item=code_block_18@L1, amount=count_2@L1)
flatten_4 = Flatten(ofRepeatedItem)
code_block_19 = CodeBlock { 0; 1; }
remapRange = Math.RemapRange(numbers=flatten_4, newMin=code_block_19.out0, newMax=code_block_19.out1)
code_block_20 = CodeBlock(x=remapRange) { 1-x; }
color_range = ColorRange(arg2=code_block_20)  # unwired: arg0, arg1
overrideColorInView = Element.OverrideColorInView(element=group_members_clockwork, color=color_range)
document = CodeBlock { Revit.Application.Document.Current.ActiveView; }  # "Document.ActiveViewFromCurrentDocument [CLOCKWORK]"
forceChildrensEval_4 = ForceChildrensEval()  # unwired: arg0
code_block_21 = CodeBlock(refresh=forceChildrensEval_4) { refresh; }
springs_collector_elementsinview = Python(IN[0]=document, IN[1]=code_block_21)  # "Springs.Collector.ElementsInView [SPRINGS]"
# ---------- springs_collector_elementsinview.python (35 lines) ----------
#Copyright(c) 2016, Dimitar Venkov
# @5devene, dimitar.ven@gmail.com

import clr

clr.AddReference("RevitServices")
import RevitServices
from RevitServices.Persistence import DocumentManager
doc = DocumentManager.Instance.CurrentDBDocument

clr.AddReference("RevitAPI")
from Autodesk.Revit.DB import FilteredElementCollector

clr.AddReference("RevitNodes")
import Revit
clr.ImportExtensions(Revit.Elements)

def tolist(obj1):
	if hasattr(obj1,"__iter__"): return obj1
	else: return [obj1]
def output1(l1):
	if len(l1) == 1: return l1[0]
	else: return l1

views = UnwrapElement(tolist(IN[0]))
elements = []

for i in xrange(len(views)):
	fec = FilteredElementCollector(doc, views[i].Id).WhereElementIsNotElementType().GetElementIterator()
	fec.Reset()
	view_el = []
	while fec.MoveNext():
		view_el.append(fec.Current.ToDSType(True))
	elements.append(view_el)
OUT = output1(elements)
# ----------------------------------------

# group: Для элементов вне групп
forceChildrensEval_5 = ForceChildrensEval()  # unwired: arg0
pys_get_revit_selection_3 = Python(IN[0]=forceChildrensEval_5)  # same code as pys_get_revit_selection
