# Dynamo graph 00._Ungroup-Change-Regroup_wall.dyn (Dynamo 1.3.1.1736)

# note: ВСЁ ОСТАЛЬНОЕ

# group: КЛЮЧЕВЫЕ МОМЕНТЫ РАБОТЫ
# note: ИТОГОВАЯ КОНСОЛИДАЦИЯ ДАННЫХ

# group: ИСПОЛНИТЕЛЬНЫЕ НОДЫ (фильтрование, подбор, списки и т.д.)
# note: НОДЫ РАБОТАЮЩИЕ С ДАННЫМИ
# note: ИСПОЛНИТЕЛЬНЫЕ НОДЫ

# group: ЗАПАСНЫЕ ВАРИАНТЫ, ДОПОЛНИТЕЛЬНЫЕ ОПЦИИ
# note: ДОПОЛНИТЕЛЬНЫЕ. Градации серово по важности, темнее - важнее
# note: ЗАПАСНЫЕ

# group: ПРОВЕРОЧНЫЕ НОДЫ
# note: ПРОВЕРОЧНЫЕ НОДЫ

# group: ПЕРЕДАЁМ ИНФОРМАЦИЮ В РЕВИТ
# note: ПЕРЕДАЁМ ИНФОРМАЦИЮ В РЕВИТ

# group: ЭЛЕМЕНТЫ УПРАВЛЕНИЯ
# note: ПЕРЕМЕННЫЕ ЗНАЧЕНИЯ
# note: ЭЛЕМЕНТЫ УПРАВЛЕНИЯ

# group: ПОЛУЧАЕМ ДАННЫЕ ИЗ РЕВИТ
# note: ПОЛУЧАЕМ ДАННЫЕ ИЗ РЕВИТ

# group: ПРИМЕЧАНИЯ ПО ЦВЕТОВОЙ ГРУППИРОВКЕ
# note: GUIDELINES

меняем_тип = BoolSelector(false)
разворачиваем_стены = BoolSelector(true)

# group: Для элементов вне групп
forceChildrensEval = ForceChildrensEval()  # unwired: arg0
pys_get_revit_selection = Python(IN[0]=forceChildrensEval)
# ---------- pys_get_revit_selection.python (22 lines) ----------
import clr
clr.AddReference('RevitServices')
clr.AddReference('RevitAPI')
from Autodesk.Revit.DB import *
import RevitServices
from RevitServices.Persistence import DocumentManager
from Autodesk.Revit.ApplicationServices import Application

reset = IN[0]

doc = DocumentManager.Instance.CurrentDBDocument
uidoc = DocumentManager.Instance.CurrentUIApplication.ActiveUIDocument
ids = uidoc.Selection.GetElementIds()

idd = [str(i) for i in ids]

if isinstance(idd, list) == True:
	elems = [doc.GetElement(ElementId(int(i))) for i in idd]
else:
	elems = doc.GetElement(ElementId(int(idd)))

OUT = elems
# ----------------------------------------

# group: Thanks to Andreas for this script Download clockwork for more
ungroupElements = Python(IN[0]=pys_get_revit_selection)  # "Group.UngroupElements"
# ---------- ungroupElements.python (34 lines) ----------
import clr
clr.AddReference('RevitAPI')
from Autodesk.Revit.DB import *

clr.AddReference("RevitNodes")
import Revit
clr.ImportExtensions(Revit.Elements)

clr.AddReference("RevitServices")
import RevitServices
from RevitServices.Persistence import DocumentManager
from RevitServices.Transactions import TransactionManager

doc = DocumentManager.Instance.CurrentDBDocument
groups = UnwrapElement(IN[0])
elementlist = []
for item in groups:
	try:
		memberlist = []
		for member in item.GetMemberIds():
			memberlist.append(doc.GetElement(member))
		elementlist.append(memberlist)
	except:
		elementlist.append(list())
		
TransactionManager.Instance.EnsureInTransaction(doc)
for group in groups:
	try:
		group.UngroupMembers()
	except:
		pass
TransactionManager.Instance.TransactionTaskDone()
		
OUT = elementlist
# ----------------------------------------

code_block = CodeBlock(elements=ungroupElements) { elements; }
getCategory = Element.GetCategory(code_block)
string_from_object = FromObject(getCategory)
code_block_2 = CodeBlock { "Стены"; }
eq = string_from_object == code_block_2
filterByBoolMask = List.FilterByBoolMask(list=code_block, mask=eq)
code_block_3 = CodeBlock { "Тип"; "АС_Газобетон (300мм)"; }
getParameterValueByName = Element.GetParameterValueByName(element=filterByBoolMask.in, parameterName=code_block_3.out0)
string_from_object_2 = FromObject(getParameterValueByName)
eq_2 = string_from_object_2 == code_block_3.out1
filterByBoolMask_2 = List.FilterByBoolMask(list=filterByBoolMask.in, mask=eq_2)
code_block_4 = CodeBlock { "Неприсоединенная высота"; 900; }
getParameterValueByName_2 = Element.GetParameterValueByName(element=filterByBoolMask_2.in, parameterName=code_block_4.out0)
eq_3 = getParameterValueByName_2 == code_block_4.out1
filterByBoolMask_3 = List.FilterByBoolMask(list=filterByBoolMask_2.in, mask=eq_3)
code_block_5 = CodeBlock(to_NSEW=filterByBoolMask_3.in) { Flatten(to_NSEW); }
get_documents = Custom[Get Documents]()  # Queries all linked Revit files and retrieves their Name, LinkInstance and Document properties.
номер_связаного_файла = IntegerSlider(9, range=0..10 step 1)
code_block_6 = CodeBlock(linl=get_documents.Link_Doc, x=номер_связаного_файла) { linl[x]; x; }
categories = Categories("MEPSpaces")
get_all_elements_from_linked = Custom[Get All Elements From Linked Model](LinkDoc=code_block_6.out0, Category=categories)  # This node is based on code posted by Julien Benoit. Big thanks to Julien for sharing his work. This node will retrieve all elements of a given category from a given linked model.
geometry = Element.Geometry(get_all_elements_from_linked)
flatten = Flatten(geometry)
byUnion = Solid.ByUnion(flatten)
getLocation = Element.GetLocation(code_block_5)
code_block_7 = CodeBlock { 0.5; }
pointAtParameter = Curve.PointAtParameter(curve=getLocation, param=code_block_7)
wall_exteriordirection_archi_lab = Python(IN[0]=code_block_5)  # "Wall.ExteriorDirection [Archi-lab_Grimshaw]"
# ---------- wall_exteriordirection_archi_lab.python (70 lines) ----------
# Copyright(c) 2015, Konrad K Sobon
# @arch_laboratory, http://archi-lab.net

import clr
clr.AddReference('ProtoGeometry')
from Autodesk.DesignScript.Geometry import *

# Import Element wrapper extension methods
clr.AddReference("RevitNodes")
import Revit
clr.ImportExtensions(Revit.Elements)

# Import geometry conversion extension methods
clr.ImportExtensions(Revit.GeometryConversion)

# Import RevitAPI
clr.AddReference("RevitAPI")
import Autodesk
from Autodesk.Revit.DB import *

import sys
pyt_path = r'C:\Program Files (x86)\IronPython 2.7\Lib'
sys.path.append(pyt_path)

#The inputs to this node will be stored as a list in the IN variable.
dataEnteringNode = IN

def ProcessList(_func, _list):
    return map( lambda x: ProcessList(_func, x) if type(x)==list else _func(x), _list )

def Unwrap(item):
	return UnwrapElement(item)

def GetExteriorWallDirection(item):
	if type(item) == Autodesk.Revit.DB.Wall:
		locationCurve = item.Location
		if locationCurve != None:
			curve = locationCurve.Curve
			direction = XYZ.BasisX
			if type(curve) == Autodesk.Revit.DB.Line:
				direction = curve.ComputeDerivatives(0, True).BasisX.Normalize()
			else:
				direction = (curve.GetEndPoint(1) - curve.GetEndPoint(0)).Normalize()
			exteriorDirection = XYZ.BasisZ.CrossProduct(direction)
			
			if item.Flipped:
				exteriorDirection = -exteriorDirection
			return exteriorDirection.ToVector()
	else:
		return "Not a Wall"

if isinstance(IN[0], list):
	walls = ProcessList(Unwrap, IN[0])
else:
	walls = [UnwrapElement(IN[0])]

try:
	errorReport = None
	output = ProcessList(GetExteriorWallDirection, walls)
except:
	# if error accurs anywhere in the process catch it
	import traceback
	errorReport = traceback.format_exc()


#Assign your output to the OUT variable
if errorReport == None:
	OUT = output
else:
	OUT = errorReport
# ----------------------------------------
code_block_8 = CodeBlock { 1000; }
translate = Geometry.Translate(geometry=pointAtParameter, direction=wall_exteriordirection_archi_lab, distance=code_block_8)
doesIntersect = Geometry.DoesIntersect(geometry=byUnion@L1, other=translate)
flatten_2 = Flatten(doesIntersect)
filterByBoolMask_4 = List.FilterByBoolMask(list=code_block_5, mask=flatten_2)
code_block_9 = CodeBlock { "Линия привязки"; 1; 2; }
setParameterByName = Element.SetParameterByName(element=filterByBoolMask_4.in, parameterName=code_block_9.out0, value=code_block_9.out1)
code_block_10 = CodeBlock { null; }
if_ = Python(IN[0]=разворачиваем_стены, IN[1]=setParameterByName, IN[2]=code_block_10)
# ---------- if_.python (12 lines) ----------
import clr
boolean = IN[0]
true = UnwrapElement(IN[1])
false = UnwrapElement(IN[2])

if boolean:
	out = true
else:
	out = false

#Назначьте вывод переменной OUT.
OUT = out
# ----------------------------------------
forceChildrensEval_2 = ForceChildrensEval()  # unwired: arg0
python_script = Python(IN[0]=if_, IN[1]=forceChildrensEval_2)
# ---------- python_script.python (23 lines) ----------
import clr
clr.AddReference('RevitAPI')
from Autodesk.Revit.DB import *

clr.AddReference("RevitServices")
import RevitServices
from RevitServices.Persistence import DocumentManager
from RevitServices.Transactions import TransactionManager

doc = DocumentManager.Instance.CurrentDBDocument
walls = UnwrapElement(IN[0])
elementlist = list()

TransactionManager.Instance.EnsureInTransaction(doc)
for item in walls:
	try:
		item.Flip()
		elementlist.append(item)
	except:
		elementlist.append(list())
TransactionManager.Instance.TransactionTaskDone()
		
OUT = elementlist
# ----------------------------------------
code_block_11 = CodeBlock(t2=python_script, t3=filterByBoolMask_4.out) { t4 = Flatten({t2, t3}); }
setParameterByName_2 = Element.SetParameterByName(element=code_block_11, parameterName=code_block_9.out0, value=code_block_9.out2)
code_block_12 = CodeBlock { null; }
if_2 = Python(IN[0]=меняем_тип, IN[1]=setParameterByName_2, IN[2]=code_block_12)  # same code as if_
code_block_13 = CodeBlock { "Тип"; "!ГКЛх2 - металл! (12,5мм+12,5мм+50мм)"; }
wall_types = WallTypes("!ГКЛх2 - металл! (12,5мм+12,5мм+50мм)")
setParameterByName_3 = Element.SetParameterByName(element=if_2, parameterName=code_block_13.out0, value=wall_types)
if_3 = Python(IN[0]=меняем_тип, IN[1]=code_block_12, IN[2]=setParameterByName_2)  # same code as if_
create = List.Create(setParameterByName_3, if_3)
clear_list = Python(IN[0]=create)
# ---------- clear_list.python (23 lines) ----------
#Copyright(c) 2015, Konrad K Sobon
# @arch_laboratory, http://archi-lab.net

import clr
clr.AddReference('ProtoGeometry')
from Autodesk.DesignScript.Geometry import *
#The inputs to this node will be stored as a list in the IN variable.
dataEnteringNode = IN

def ClearList(_list):
    out = []
    for _list1 in _list:
        if _list1 is None:
            continue
        if isinstance(_list1, list):
             _list1 = ClearList(_list1)
             if not _list1:
                 continue
        out.append(_list1)
    return out

#Assign your output to the OUT variable
OUT = ClearList(IN[0])
# ----------------------------------------
code_block_14 = CodeBlock(filter1=filterByBoolMask.out, filter2=filterByBoolMask_2.out, filter3=filterByBoolMask_3.out) { filter1; filter2; filter3; }
create_2 = List.Create(clear_list, code_block_14.filter1, code_block_14.filter2, code_block_14.filter3)
flatten_3 = Flatten(create_2)
code_block_15 = CodeBlock(t4=pys_get_revit_selection) { t3 = t4.GetParameterValueByName("Тип"); t5 = t3.GetParameterValueByName("Имя типа"); }
string_from_object_3 = FromObject(code_block_15.t5)
прификс_к_имени_группы = StringInput("(ГКЛ)")
прификс_к_имени_группы_2 = StringInput(" (исп)")
if_4 = Python(IN[0]=меняем_тип, IN[1]=прификс_к_имени_группы, IN[2]=прификс_к_имени_группы_2)  # same code as if_
code_block_16 = CodeBlock(name=string_from_object_3, x=if_4) { name+x; }
passthrough_clockwork = CodeBlock(passthrough=code_block_16, waitfor=flatten_3) { {passthrough,waitfor}[0]; }

# group: Пакет Prorubim
forceChildrensEval_3 = ForceChildrensEval()  # unwired: arg0

fromElements = Python(IN[0]=flatten_3, IN[1]=passthrough_clockwork, IN[2]=forceChildrensEval_3)  # "Group.FromElements"
# ---------- fromElements.python (28 lines) ----------
import clr
clr.AddReference('RevitAPI')
from Autodesk.Revit.DB import *
from System.Collections.Generic import *

clr.AddReference("RevitServices")
import RevitServices
from RevitServices.Persistence import DocumentManager
from RevitServices.Transactions import TransactionManager

doc = DocumentManager.Instance.CurrentDBDocument
items = UnwrapElement(IN[0])
newname = IN[1]
ids = list()
rejects = list()
for item in items:
	ids.append(item.Id)

items = List[ElementId](ids)

TransactionManager.Instance.EnsureInTransaction(doc)

group = doc.Create.NewGroup(items)
group.GroupType.Name = newname[0]

TransactionManager.Instance.TransactionTaskDone()

OUT = (group,newname)
# ----------------------------------------
coreCenterline = Custom[WallLocationLine.CoreCenterline]()  # Returns the WallLocationLine option for CoreCenterLine
finishFaceInterior = Custom[WallLocationLine.FinishFaceInterior]()  # Returns the WallLocationLine option for FinishFaceInterior
finishFaceExterior = Custom[WallLocationLine.FinishFaceExterior]()  # Returns the WallLocationLine option for FinishFaceExterior
forceChildrensEval_4 = ForceChildrensEval()  # unwired: arg0
count = List.Count(python_script)
количество_развернутых = Watch(count)
count_2 = List.Count(setParameterByName_3)
количество_измененных_элементов = Watch(count_2)
count_3 = List.Count(filterByBoolMask_3.in)
количество_найденых_элементов = Watch(count_3)
список_связей = Watch(get_documents.Link_Name)
