# Dynamo graph Запись параметра элемента внутри группы.dyn (Dynamo 1.3.0.875)

# group: ПОЛУЧАЕМ ДАННЫЕ ИЗ РЕВИТ
# note: ПОЛУЧАЕМ ДАННЫЕ ИЗ РЕВИТ

# group: ЭЛЕМЕНТЫ УПРАВЛЕНИЯ
# note: ЭЛЕМЕНТЫ УПРАВЛЕНИЯ
# note: ПЕРЕМЕННЫЕ ЗНАЧЕНИЯ

# group: ЭЛЕМЕНТЫ УПРАВЛЕНИЯ Dyno Studio
# note: Dyno Studio

# group: ЭЛЕМЕНТЫ УПРАВЛЕНИЯ 2 УРОВЕНЬ
# note: ЭЛЕМЕНТЫ УПРАВЛЕНИЯ
# note: ПЕРЕМЕННЫЕ ЗНАЧЕНИЯ

# group: ПРОВЕРОЧНЫЕ НОДЫ
# note: ПРОВЕРОЧНЫЕ НОДЫ

# group: КЛЮЧЕВЫЕ МОМЕНТЫ РАБОТЫ lvl1
# note: ИТОГОВАЯ КОНСОЛИДАЦИЯ ДАННЫХ

# group: ЗАПАСНЫЕ ВАРИАНТЫ, ДОПОЛНИТЕЛЬНЫЕ ОПЦИИ
# note: ЗАПАСНЫЕ
# note: ДОПОЛНИТЕЛЬНЫЕ. Градации серово по важности, темнее - важнее

# group: ИСПОЛНИТЕЛЬНЫЕ НОДЫ (фильтрование, подбор, списки и т.д.)
# note: ИСПОЛНИТЕЛЬНЫЕ НОДЫ
# note: НОДЫ РАБОТАЮЩИЕ С ДАННЫМИ

# group: КЛЮЧЕВЫЕ МОМЕНТЫ РАБОТЫ lvl2
# note: ИСПОЛНИТЕЛЬНЫЕ НОДЫ
# note: НОДЫ РАБОТАЮЩИЕ С ДАННЫМИ

# group: ПЕРЕДАЁМ ИНФОРМАЦИЮ В РЕВИТ
# note: ПЕРЕДАЁМ ИНФОРМАЦИЮ В РЕВИТ

# group: ПРИМЕЧАНИЯ ПО ЦВЕТОВОЙ ГРУППИРОВКЕ
# note: GUIDELINES

# group: Get Revit Selection:
current = Document.Current()
activeView = Document.ActiveView(current)
categories = Categories("VolumeOfInterest")
all_elements_of_category = ElementsOfCategory(categories)

# group: Get Revit Selection:
forceChildrensEval = ForceChildrensEval()  # unwired: arg0
pys_get_revit_selection = Python(IN[0]=forceChildrensEval)
# ---------- pys_get_revit_selection.python (22 lines) ----------
import clr
clr.AddReference('RevitServices')
clr.AddReference('RevitAPI')
from Autodesk.Revit.DB import *
import RevitServices
from RevitServices.Persistence import DocumentManager
from Autodesk.Revit.ApplicationServices import Application

reset = IN[0]

doc = DocumentManager.Instance.CurrentDBDocument
uidoc = DocumentManager.Instance.CurrentUIApplication.ActiveUIDocument
ids = uidoc.Selection.GetElementIds()

idd = [str(i) for i in ids]

if isinstance(idd, list) == True:
	elems = [doc.GetElement(ElementId(int(i))) for i in idd]
else:
	elems = doc.GetElement(ElementId(int(idd)))

OUT = elems
# ----------------------------------------

getCategory = Element.GetCategory(pys_get_revit_selection)
string_from_object = FromObject(getCategory)
code_block = CodeBlock { "Группы модели"; }
eq = string_from_object == code_block
filterByBoolMask = List.FilterByBoolMask(list=pys_get_revit_selection, mask=eq)
group_members_clockwork = Python(IN[0]=filterByBoolMask.in)
# ---------- group_members_clockwork.python (19 lines) ----------
import clr
clr.AddReference('RevitAPI')
from Autodesk.Revit.DB import *

clr.AddReference("RevitNodes")
import Revit
clr.ImportExtensions(Revit.Elements)

groups = UnwrapElement(IN[0])
elementlist = list()
for item in groups:
	try:
		memberlist = list()
		for member in item.GetMemberIds():
			memberlist.append(item.Document.GetElement(member))
		elementlist.append(memberlist)
	except:
		elementlist.append(list())
OUT = elementlist
# ----------------------------------------
getCategory_2 = Element.GetCategory(group_members_clockwork)
string_from_object_2 = FromObject(getCategory_2)
categories_2 = Categories("Walls")
string_from_object_3 = FromObject(categories_2)
string_from_object_4 = FromObject(string_from_object_3)
eq_2 = string_from_object_2 == string_from_object_4
filterByBoolMask_2 = List.FilterByBoolMask(list=group_members_clockwork, mask=eq_2)
getCategory_3 = Element.GetCategory(filterByBoolMask.out)
string_from_object_5 = FromObject(getCategory_3)
eq_3 = string_from_object_5 == string_from_object_3
filterByBoolMask_3 = List.FilterByBoolMask(list=filterByBoolMask.out, mask=eq_3)
flatten = Flatten(filterByBoolMask_2.out)
# note: ВСЁ ОСТАЛЬНОЕ
getCategory_4 = Element.GetCategory(flatten)
string_from_object_6 = FromObject(getCategory_4)
code_block_2 = CodeBlock { "Группы модели"; }
eq_4 = string_from_object_6 == code_block_2
filterByBoolMask_4 = List.FilterByBoolMask(list=flatten, mask=eq_4)
group_members_clockwork_2 = Python(IN[0]=filterByBoolMask_4.in)  # same code as group_members_clockwork
getCategory_5 = Element.GetCategory(group_members_clockwork_2)
string_from_object_7 = FromObject(getCategory_5)
string_from_object_8 = FromObject(string_from_object_3)
eq_5 = string_from_object_7 == string_from_object_8
filterByBoolMask_5 = List.FilterByBoolMask(list=group_members_clockwork_2, mask=eq_5)
create = List.Create(filterByBoolMask_2.in, filterByBoolMask_3.in, filterByBoolMask_5.in)
flatten_2 = Flatten(create)
code_block_3 = CodeBlock { "Имя"; }
getParameterValueByName = Element.GetParameterValueByName(element=all_elements_of_category, parameterName=code_block_3)
области_видимости_в_проекте = Watch(getParameterValueByName)
sort = List.Sort(области_видимости_в_проекте)

# group: DynoStudio.ShowDialog [Prorubim]
code_block_4 = CodeBlock()
# ---------- code_block_4.designscript (3 lines) ----------
"Выбрать область видимости и категорию";
"3dbox";
//"Category";
# ----------------------------------------
create_2 = List.Create(code_block_4.out1)
create_3 = List.Create(sort)
showDialog = Prorubim.DynoNodes.DynoStudio.ShowDialog(code_block_4.out0, create_2, create_3)
code_block_5 = CodeBlock(from_dino=showDialog) { from_dino[1]; from_dino[0]; }  # frozen

eq_6 = области_видимости_в_проекте == showDialog  # lacing=Longest
filterByBoolMask_6 = List.FilterByBoolMask(list=all_elements_of_category, mask=eq_6)
code_block_6 = CodeBlock(i=filterByBoolMask_6.in) { i[0]; }
geometry = Element.Geometry(code_block_6)
code_block_7 = CodeBlock { {3,4,6,8}; }
getItemAtIndex = List.GetItemAtIndex(list=geometry, index=code_block_7)
byJoinedCurves = PolyCurve.ByJoinedCurves(getItemAtIndex)
ZAxis = Vector.ZAxis()
code_block_8 = CodeBlock(i=geometry) { i[0]; }
length = Curve.Length(code_block_8)
round = Math.Round(length)
extrudeAsSolid = Curve.ExtrudeAsSolid(curve=byJoinedCurves, direction=ZAxis, distance=round)
element_location_clockwork_cut = Python(IN[0]=flatten_2)
# ---------- element_location_clockwork_cut.python (33 lines) ----------
import clr
import math
clr.AddReference('RevitAPI')
from Autodesk.Revit.DB import *

clr.AddReference("RevitNodes")
import Revit
clr.ImportExtensions(Revit.GeometryConversion)

items = UnwrapElement(IN[0])
pointlist = list()
curves = list()
curv_point_list = []

for item in items:
	try:
		# points and text notes
		pointlist.append(item.Coord.ToPoint())
	except:
		try:
			loc = item.Location
			if loc.ToString() == 'Autodesk.Revit.DB.LocationCurve':
				# line-based elements (e.g. walls)
				curves.append(loc.Curve.ToProtoType())
				curv_point_list.append((loc.Curve.ToProtoType()).PointAtParameter(0.5))
			elif loc.ToString() == 'Autodesk.Revit.DB.LocationPoint':
				# point-based elements
				pointlist.append(loc.Point.ToPoint())
			else:
				pass
		except:
			pass
OUT = (pointlist,curv_point_list)
# ----------------------------------------
flatten_3 = Flatten(element_location_clockwork_cut)
doesIntersect = Geometry.DoesIntersect(geometry=extrudeAsSolid, other=flatten_3)
filterByBoolMask_7 = List.FilterByBoolMask(list=flatten_2, mask=doesIntersect)
параметр = StringInput("*Тип помещения")
значение_параметра = StringInput("Ванна")
setParameterByName = Element.SetParameterByName(element=filterByBoolMask_7.in, parameterName=параметр, value=значение_параметра)
количество_элементов = Watch(setParameterByName)
categories_list = Python()  # frozen
# ---------- categories_list.python (19 lines) ----------
#Copyright (c) mostafa el ayoubi
#Data-Shapes www.data-shapes.net 2016 elayoub.mostafa@gmail.com


import clr
clr.AddReference('RevitAPI')
from Autodesk.Revit.DB import*
clr.AddReference('RevitServices')
from RevitServices.Persistence import DocumentManager


doc = DocumentManager.Instance.CurrentDBDocument


cat = doc.Settings.Categories



OUT = [x.Name for x in cat]
# ----------------------------------------
sort_2 = List.Sort(categories_list)  # frozen
element_location_clockwork = Python(IN[0]=flatten_2)  # frozen
# ---------- element_location_clockwork.python (68 lines) ----------
import clr
import math
clr.AddReference('RevitAPI')
from Autodesk.Revit.DB import *

clr.AddReference("RevitNodes")
import Revit
clr.ImportExtensions(Revit.GeometryConversion)

items = UnwrapElement(IN[0])
pointlist = list()
curvepointlist = list()
ispoint = list()
iscurve = list()
curves = list()
haslocation = list()
angles, hasrotation = [], []

for item in items:
	try:
		# points and text notes
		pointlist.append(item.Coord.ToPoint())
		ispoint.append(True)
		iscurve.append(False)
		haslocation.append(True)
		hasrotation.append(False)
	except:
		try:
			loc = item.Location
			if loc.ToString() == 'Autodesk.Revit.DB.LocationCurve':
				# line-based elements (e.g. walls)
				curvepoints = (loc.Curve.GetEndPoint(0).ToPoint(),loc.Curve.GetEndPoint(1).ToPoint())
				curvepointlist.append(curvepoints)
				curves.append(loc.Curve.ToProtoType())
				ispoint.append(False)
				iscurve.append(True)
				haslocation.append(True)
				hasrotation.append(False)
			elif loc.ToString() == 'Autodesk.Revit.DB.LocationPoint':
				# point-based elements
				pointlist.append(loc.Point.ToPoint())
				angles.append(math.degrees(loc.Rotation) )
				ispoint.append(True)
				iscurve.append(False)
				angles.append
				haslocation.append(True)
				hasrotation.append(True)
			else:
				ispoint.append(False)
				iscurve.append(False)
				haslocation.append(False)
				hasrotation.append(False)
		except:
			try:
				# curves
				curvepoints = (item.GetEndPoint(0).ToPoint(),item.GetEndPoint(1).ToPoint())
				curvepointlist.append(curvepoints)
				curves.append(item.ToProtoType())
				ispoint.append(False)
				iscurve.append(True)
				haslocation.append(True)
				hasrotation.append(False)
			except:
				ispoint.append(False)
				iscurve.append(False)
				haslocation.append(False)
				hasrotation.append(False)
OUT = (pointlist,curves)
# ----------------------------------------
code_block_9 = CodeBlock(t4=element_location_clockwork_cut) { points = t4; curve = t4; point1 = curve[1].PointAtParameter(0.5); t5 = {points[0], point1}; t6 = Flatten(t5); }  # frozen
