# Dynamo graph Цветовая группировка.dyn (Dynamo 1.3.2.2480)

# note: ВСЁ ОСТАЛЬНОЕ

# group: ПОЛУЧАЕМ ДАННЫЕ ИЗ РЕВИТ
# note: ПОЛУЧАЕМ ДАННЫЕ ИЗ РЕВИТ

# group: ЭЛЕМЕНТЫ УПРАВЛЕНИЯ
# note: ЭЛЕМЕНТЫ УПРАВЛЕНИЯ
# note: ПЕРЕМЕННЫЕ ЗНАЧЕНИЯ

# group: ЭЛЕМЕНТЫ УПРАВЛЕНИЯ Dyno Studio
# note: Dyno Studio

# group: ЭЛЕМЕНТЫ УПРАВЛЕНИЯ 2 УРОВЕНЬ
# note: ЭЛЕМЕНТЫ УПРАВЛЕНИЯ
# note: ПЕРЕМЕННЫЕ ЗНАЧЕНИЯ

# group: ПРОВЕРОЧНЫЕ НОДЫ
# note: ПРОВЕРОЧНЫЕ НОДЫ

# group: КЛЮЧЕВЫЕ МОМЕНТЫ РАБОТЫ
# note: ИТОГОВАЯ КОНСОЛИДАЦИЯ ДАННЫХ

# group: ЗАПАСНЫЕ ВАРИАНТЫ, ДОПОЛНИТЕЛЬНЫЕ ОПЦИИ
# note: ЗАПАСНЫЕ
# note: ДОПОЛНИТЕЛЬНЫЕ. Градации серово по важности, темнее - важнее

# group: ИСПОЛНИТЕЛЬНЫЕ НОДЫ (фильтрование, подбор, списки и т.д.)
# note: ИСПОЛНИТЕЛЬНЫЕ НОДЫ
# note: НОДЫ РАБОТАЮЩИЕ С ДАННЫМИ

# group: Название кустом ноды [НАЗВАНИЕ ПАКЕТА] для распакованных кустомных нодов
# note: ИСПОЛНИТЕЛЬНЫЕ НОДЫ
# note: НОДЫ РАБОТАЮЩИЕ С ДАННЫМИ

# group: ПЕРЕДАЁМ ИНФОРМАЦИЮ В РЕВИТ
# note: ПЕРЕДАЁМ ИНФОРМАЦИЮ В РЕВИТ

# group: ПРИМЕЧАНИЯ ПО ЦВЕТОВОЙ ГРУППИРОВКЕ
# note: GUIDELINES

# group: Get Revit Selection:
forceChildrensEval = ForceChildrensEval()  # unwired: arg0
pys_get_revit_selection = Python(IN[0]=forceChildrensEval)
# ---------- pys_get_revit_selection.python (22 lines) ----------
import clr
clr.AddReference('RevitServices')
clr.AddReference('RevitAPI')
from Autodesk.Revit.DB import *
import RevitServices
from RevitServices.Persistence import DocumentManager
from Autodesk.Revit.ApplicationServices import Application

reset = IN[0]

doc = DocumentManager.Instance.CurrentDBDocument
uidoc = DocumentManager.Instance.CurrentUIApplication.ActiveUIDocument
ids = uidoc.Selection.GetElementIds()

idd = [str(i) for i in ids]

if isinstance(idd, list) == True:
	elems = [doc.GetElement(ElementId(int(i))) for i in idd]
else:
	elems = doc.GetElement(ElementId(int(idd)))

OUT = elems
# ----------------------------------------

getCategory = Element.GetCategory(pys_get_revit_selection)
string_from_object = FromObject(getCategory)
code_block = CodeBlock { "Группы модели"; }
eq = string_from_object == code_block
filterByBoolMask = List.FilterByBoolMask(list=pys_get_revit_selection, mask=eq)
group_members_clockwork = Python(IN[0]=filterByBoolMask.in)
# ---------- group_members_clockwork.python (19 lines) ----------
import clr
clr.AddReference('RevitAPI')
from Autodesk.Revit.DB import *

clr.AddReference("RevitNodes")
import Revit
clr.ImportExtensions(Revit.Elements)

groups = UnwrapElement(IN[0])
elementlist = list()
for item in groups:
	try:
		memberlist = list()
		for member in item.GetMemberIds():
			memberlist.append(item.Document.GetElement(member))
		elementlist.append(memberlist)
	except:
		elementlist.append(list())
OUT = elementlist
# ----------------------------------------
getCategory_2 = Element.GetCategory(group_members_clockwork)
string_from_object_2 = FromObject(getCategory_2)
categories = Categories("Windows")
string_from_object_3 = FromObject(categories)
string_from_object_4 = FromObject(string_from_object_3)
eq_2 = string_from_object_2 == string_from_object_4
filterByBoolMask_2 = List.FilterByBoolMask(list=group_members_clockwork, mask=eq_2)
getCategory_3 = Element.GetCategory(filterByBoolMask.out)
string_from_object_5 = FromObject(getCategory_3)
eq_3 = string_from_object_5 == string_from_object_3
filterByBoolMask_3 = List.FilterByBoolMask(list=filterByBoolMask.out, mask=eq_3)
create = List.Create(filterByBoolMask_2.in, filterByBoolMask_3.in)
flatten = Flatten(create)
code_block_2 = CodeBlock { "Тип"; }
getParameterValueByName = Element.GetParameterValueByName(parameterName=code_block_2)  # unwired: element
groupByFunction = GroupByFunction(flatten, getParameterValueByName)
flatten_2 = Flatten(groupByFunction)

# group: Настройки цветов
code_block_3 = CodeBlock { color1 = DSCore.Color.ByARGB(255, 255, 0, 0); }
code_block_4 = CodeBlock { color1 = DSCore.Color.ByARGB(255, 255, 255, 0); }
code_block_5 = CodeBlock { color1 = DSCore.Color.ByARGB(0, 0, 55, 255); }
create_2 = List.Create(code_block_3, code_block_4, code_block_5)
code_block_6 = CodeBlock { 0; 0.5; 1; }
create_3 = List.Create(code_block_6.out0, code_block_6.out1, code_block_6.out2)

code_block_7 = CodeBlock { "Тип"; }
getParameterValueByName_2 = Element.GetParameterValueByName(element=flatten, parameterName=code_block_7)
uniqueItems = List.UniqueItems(getParameterValueByName_2)
allIndicesOf = List.AllIndicesOf(list=getParameterValueByName_2, item=uniqueItems)
count = Count(allIndicesOf)
code_block_8 = CodeBlock(x=count) { 1..x; }
count_2 = Count(allIndicesOf@L2)
ofRepeatedItem = List.OfRepeatedItem(item=code_block_8@L1, amount=count_2@L1)
flatten_3 = Flatten(ofRepeatedItem)
code_block_9 = CodeBlock { 0; 1; }
remapRange = Math.RemapRange(numbers=flatten_3, newMin=code_block_9.out0, newMax=code_block_9.out1)
code_block_10 = CodeBlock(x=remapRange) { 1-x; }
color_range = ColorRange(create_2, create_3, code_block_10)
fill_patterns = FillPatterns("Сплошная заливка")
# note: Разукрашеваем
byProperties = Revit.Filter.OverrideGraphicSettings.ByProperties(color_range, color_range, arg4=fill_patterns, arg5=fill_patterns)
code_block_11 = CodeBlock { false; }
overrideInView = Element.OverrideInView(element=flatten_2, overrides=byProperties, hide=code_block_11)
