# Dynamo graph 1.Нумерация элементов.dyn (Dynamo 1.3.2.2480)

# group: Get Revit Selection:
forceChildrensEval = ForceChildrensEval()  # unwired: arg0
pys_get_revit_selection = Python(IN[0]=forceChildrensEval)
# ---------- pys_get_revit_selection.python (22 lines) ----------
import clr
clr.AddReference('RevitServices')
clr.AddReference('RevitAPI')
from Autodesk.Revit.DB import *
import RevitServices
from RevitServices.Persistence import DocumentManager
from Autodesk.Revit.ApplicationServices import Application

reset = IN[0]

doc = DocumentManager.Instance.CurrentDBDocument
uidoc = DocumentManager.Instance.CurrentUIApplication.ActiveUIDocument
ids = uidoc.Selection.GetElementIds()

idd = [str(i) for i in ids]

if isinstance(idd, list) == True:
	elems = [doc.GetElement(ElementId(int(i))) for i in idd]
else:
	elems = doc.GetElement(ElementId(int(idd)))

OUT = elems
# ----------------------------------------

code_block = CodeBlock { "Номер помещения"; }
getParameterValueByName = Element.GetParameterValueByName(parameterName=code_block)  # unwired: element
groupByFunction = GroupByFunction(pys_get_revit_selection, getParameterValueByName)
code_block_2 = CodeBlock { "№ помещения"; }
count = Count(groupByFunction@L2)
code_block_3 = CodeBlock(x=count) { 1..x; }
string_from_object = FromObject(code_block_3)
setParameterByName = Element.SetParameterByName(element=groupByFunction, parameterName=code_block_2, value=string_from_object)
code_block_4 = CodeBlock { "Номер"; "№ помещения"; }
code_block_5 = CodeBlock { "Номер помещения"; "№ группы помещений"; }
getParameterValueByName_2 = Element.GetParameterValueByName(element=pys_get_revit_selection, parameterName=code_block_5.out0)
setParameterByName_2 = Element.SetParameterByName(element=pys_get_revit_selection, parameterName=code_block_5.out1, value=getParameterValueByName_2)
code_block_6 = CodeBlock { "Комментарии"; }
getParameterValueByName_3 = Element.GetParameterValueByName(parameterName=code_block_6)  # unwired: element
code_block_7 = CodeBlock(x=getParameterValueByName_3) { x == "МОП"; }
filterByBoolMask = List.FilterByBoolMask(mask=code_block_7)  # unwired: list
code_block_8 = CodeBlock { "Уровень"; }
getParameterValueByName_4 = Element.GetParameterValueByName(element=filterByBoolMask.in, parameterName=code_block_8)
toNumber = String.ToNumber(getParameterValueByName_4)
code_block_9 = CodeBlock(x=toNumber) { x >= 2; }
filterByBoolMask_2 = List.FilterByBoolMask(list=filterByBoolMask.in, mask=code_block_9)
code_block_10 = CodeBlock { "Помещения"; "Обобщенные модели"; }
byName = Category.ByName(code_block_10.out1)
all_elements_of_category = ElementsOfCategory(byName)
code_block_11 = CodeBlock { "00)Уровень"; }
getParameterValueByName_5 = Element.GetParameterValueByName(element=all_elements_of_category, parameterName=code_block_11)
code_block_12 = CodeBlock(x=getParameterValueByName_5) { x == "0"; }
filterByBoolMask_3 = List.FilterByBoolMask(list=all_elements_of_category, mask=code_block_12)  # frozen
count_2 = Count(filterByBoolMask_3.in)
code_block_13 = CodeBlock(x=count_2) { "Марка"; 1..x; }
string_from_object_2 = FromObject(code_block_13.out1)
code_block_14 = CodeBlock(x=string_from_object_2) { "0-"+x; }
setParameterByName_3 = Element.SetParameterByName(element=filterByBoolMask_3.in, parameterName=code_block_13.out0, value=code_block_14)
code_block_15 = CodeBlock { "№ отсека"; }
code_block_16 = CodeBlock { "Марка"; }
getParameterValueByName_6 = Element.GetParameterValueByName(element=all_elements_of_category, parameterName=code_block_16)
setParameterByName_4 = Element.SetParameterByName(element=all_elements_of_category, parameterName=code_block_15, value=getParameterValueByName_6)
