# Dynamo graph 00.Изменить рабочий набор по категории + с фильтром по типу.dyn (Dynamo 1.3.3.4111)

# group: ЗАПАСНЫЕ ВАРИАНТЫ, ДОПОЛНИТЕЛЬНЫЕ ОПЦИИ
# note: ЗАПАСНЫЕ
# note: ДОПОЛНИТЕЛЬНЫЕ. Градации серово по важности, темнее - важнее

# group: КЛЮЧЕВЫЕ МОМЕНТЫ РАБОТЫ 2
# note: УСЛОЖНЕННЫЕ КОНСТРУКЦИИ
# note: УСЛОЖНЕНЫЕ КОНСТРУКЦИИ

# group: Python ноды
# note: Python

# group: Запуск питона из внешнего файла
# note: Py - files

# group: ЭЛЕМЕНТЫ УПРАВЛЕНИЯ
# note: ПЕРЕМЕННЫЕ ЗНАЧЕНИЯ
# note: ЭЛЕМЕНТЫ УПРАВЛЕНИЯ

# group: ПОЛУЧАЕМ ДАННЫЕ
# note: ПОЛУЧАЕМ ДАННЫЕ ИЗ РЕВИТ и других источников

# group: ПРОВЕРОЧНЫЕ НОДЫ
# note: ПРОВЕРОЧНЫЕ НОДЫ

# group: КЛЮЧЕВЫЕ МОМЕНТЫ РАБОТЫ 1
# note: КОНСОЛИДАЦИЯ И СЛОЖНЫЕ ОБРАБОТКИ

# group: ИСПОЛНИТЕЛЬНЫЕ НОДЫ (фильтрование, подбор, списки и т.д.)
# note: ИСПОЛНИТЕЛЬНЫЕ НОДЫ

# group: ПЕРЕДАЁМ ИНФОРМАЦИЮ
# note: ПЕРЕДАЁМ ИНФОРМАЦИЮ В РЕВИТ
# note: ПЕРЕДАЁМ ИНФОРМАЦИЮ ЕЩЁ КУДА-ТО

# group: ПРИМЕЧАНИЯ ПО ЦВЕТОВОЙ ГРУППИРОВКЕ
# note: GUIDELINES

# group: ЭЛЕМЕНТЫ УПРАВЛЕНИЯ 2 УРОВЕНЬ
# note: ЭЛЕМЕНТЫ УПРАВЛЕНИЯ
# note: ПЕРЕМЕННЫЕ ЗНАЧЕНИЯ

forceChildrensEval = ForceChildrensEval()  # unwired: arg0

# group: WorksetsInDocument - [SWINGNODES]
python_script_workset_names_ids = Python(IN[0]=forceChildrensEval)
# ---------- python_script_workset_names_ids.python (32 lines) ----------
#python nodes in dynamo 1.2
#proposed by Severin SCHAEFER @severin.schaefer.architecte@gmail.com

import clr

# Import DocumentManager
clr.AddReference("RevitServices")
import RevitServices
from RevitServices.Persistence import DocumentManager

# Import RevitAPI
clr.AddReference("RevitAPI")
import Autodesk

# Import ToDSType(bool) extension method
clr.AddReference("RevitNodes")
import Revit
from Autodesk.Revit.DB import *
clr.ImportExtensions(Revit.Elements)

#Inputs
doc = DocumentManager.Instance.CurrentDBDocument

#Transaction
userWorksets = FilteredWorksetCollector(doc).OfKind(WorksetKind.UserWorkset)
names, ids = [], []
for i in userWorksets:
	names.append(i.Name)
	ids.append(i.Id)

#Outputs
OUT = userWorksets, names, ids
# ----------------------------------------
code_block = CodeBlock { 0; 1; 2; }
getItemAtIndex = List.GetItemAtIndex(list=python_script_workset_names_ids, index=code_block.out1)
workset_names = CodeBlock(Nam=getItemAtIndex) { Nam; }
getItemAtIndex_2 = List.GetItemAtIndex(list=python_script_workset_names_ids, index=code_block.out0)
code_block_2 = CodeBlock(Workst=getItemAtIndex_2) { Workst; }
getItemAtIndex_3 = List.GetItemAtIndex(list=python_script_workset_names_ids, index=code_block.out2)
code_block_3 = CodeBlock(Id_dqd=getItemAtIndex_3) { Id_dqd; }

workset_names_2 = Watch(workset_names)
изменить_рабочий_набор = BoolSelector(false)
categories = Categories("Floors")
all_elements_of_category = ElementsOfCategory(categories)
code_block_4 = CodeBlock { "Тип"; "Имя типа"; "Материал несущих конструкций"; }
getParameterValueByName = Element.GetParameterValueByName(element=all_elements_of_category, parameterName=code_block_4.out0)
getParameterValueByName_2 = Element.GetParameterValueByName(element=getParameterValueByName, parameterName=code_block_4.out1)
string = StringInput("железо")
boolean = BoolSelector(true)
contains = String.Contains(str=getParameterValueByName_2, searchFor=string, ignoreCase=boolean)
filterByBoolMask = List.FilterByBoolMask(list=all_elements_of_category, mask=contains)
code_block_5 = CodeBlock { {null,null}; }
if_ = Python(IN[0]=изменить_рабочий_набор, IN[1]=filterByBoolMask.in, IN[2]=code_block_5)
# ---------- if_.python (12 lines) ----------
import clr
boolean = IN[0]
true = UnwrapElement(IN[1])
false = UnwrapElement(IN[2])

if boolean:
	out = true
else:
	out = false

#Назначьте вывод переменной OUT.
OUT = out
# ----------------------------------------

# group: Выбираем номер рабочего набора из списка
номер_рабочего_набора = DoubleSlider(3, range=0..10 step 1)

getItemAtIndex_4 = List.GetItemAtIndex(list=code_block_2, index=номер_рабочего_набора)
element_setworkset_clockwork = Python(IN[0]=if_, IN[1]=getItemAtIndex_4)
# ---------- element_setworkset_clockwork.python (24 lines) ----------
import clr
clr.AddReference('RevitAPI')
from Autodesk.Revit.DB import *

clr.AddReference("RevitServices")
import RevitServices
from RevitServices.Persistence import DocumentManager
from RevitServices.Transactions import TransactionManager

doc = DocumentManager.Instance.CurrentDBDocument
faminsts = UnwrapElement(IN[0])
ws = UnwrapElement(IN[1])
elementlist = list()
faillist = list()
TransactionManager.Instance.EnsureInTransaction(doc)
for item in faminsts:
	try:
		param = item.get_Parameter(BuiltInParameter.ELEM_PARTITION_PARAM)
		param.Set(ws.Id.IntegerValue)
		elementlist.append(item)
	except:
		faillist.append("НЕТ ГЕОМЕТРИИ")
TransactionManager.Instance.TransactionTaskDone()
OUT = (elementlist,faillist)
# ----------------------------------------
flatten = Flatten(element_setworkset_clockwork)
результат = Watch(flatten)
getItemAtIndex_5 = List.GetItemAtIndex(list=code_block_3, index=номер_рабочего_набора)
string_from_object = FromObject(getItemAtIndex_5)
code_block_6 = CodeBlock { "Рабочий набор"; }
getParameterValueByName_3 = Element.GetParameterValueByName(element=all_elements_of_category, parameterName=code_block_6)
string_from_object_2 = FromObject(getParameterValueByName_3)
eq = string_from_object == string_from_object_2
filterByBoolMask_2 = List.FilterByBoolMask(list=filterByBoolMask.in, mask=eq)
watch = Watch(filterByBoolMask_2.out)

# group: Выбираем элементы в ревит
forceChildrensEval_2 = ForceChildrensEval()  # unwired: arg0
pys_setrevitselection = Python(IN[0]=forceChildrensEval_2, IN[1]=watch)
# ---------- pys_setrevitselection.python (30 lines) ----------
# ©2016, Khasan Mamaev
# www.dynamobim.ru

import clr
clr.AddReference('RevitServices')
clr.AddReference('RevitAPI')
from Autodesk.Revit.DB import *
import RevitServices
from RevitServices.Persistence import DocumentManager
from Autodesk.Revit.ApplicationServices import Application
clr.AddReference('RevitNodes')
import Revit
clr.ImportExtensions(Revit.Elements)
from Revit.Elements import *
clr.AddReference('System')
from System.Collections.Generic import List

reset = IN[0]

elems = IN[1]

doc = DocumentManager.Instance.CurrentDBDocument
uidoc = DocumentManager.Instance.CurrentUIApplication.ActiveUIDocument

ids = List[ElementId]()

for i in elems:
    ids.Add(UnwrapElement(i).Id)

uidoc.Selection.SetElementIds(ids)
# ----------------------------------------

if_2 = Python(IN[0]=изменить_рабочий_набор, IN[1]=номер_рабочего_набора, IN[2]=code_block_5)  # same code as if_
setParameterByName = Element.SetParameterByName()  # unwired: element, parameterName, value
parameters = Element.Parameters(getParameterValueByName)
geometry = Element.Geometry()  # unwired: arg0
# note: ВСЁ ОСТАЛЬНОЕ
getParameterValueByName_4 = Element.GetParameterValueByName()  # unwired: element, parameterName

# group: Get Revit Selection:
forceChildrensEval_3 = ForceChildrensEval()  # frozen; unwired: arg0
pys_get_revit_selection = Python(IN[0]=forceChildrensEval_3)
# ---------- pys_get_revit_selection.python (22 lines) ----------
import clr
clr.AddReference('RevitServices')
clr.AddReference('RevitAPI')
from Autodesk.Revit.DB import *
import RevitServices
from RevitServices.Persistence import DocumentManager
from Autodesk.Revit.ApplicationServices import Application

reset = IN[0]

doc = DocumentManager.Instance.CurrentDBDocument
uidoc = DocumentManager.Instance.CurrentUIApplication.ActiveUIDocument
ids = uidoc.Selection.GetElementIds()

idd = [str(i) for i in ids]

if isinstance(idd, list) == True:
	elems = [doc.GetElement(ElementId(int(i))) for i in idd]
else:
	elems = doc.GetElement(ElementId(int(idd)))

OUT = elems
# ----------------------------------------

boolean_2 = BoolSelector(true)  # frozen
code_block_7 = CodeBlock { 1; 2; }
if_3 = Python(IN[0]=boolean_2, IN[1]=code_block_7.out0, IN[2]=code_block_7.out1)  # same code as if_

# group: Parameters name from language
parameters_name_from_language = Python()  # frozen
# ---------- parameters_name_from_language.python (18 lines) ----------
import clr
clr.AddReference('RevitServices')
import RevitServices
from RevitServices.Persistence import DocumentManager

uiapp = DocumentManager.Instance.CurrentUIApplication
app = uiapp.Application
lng = app.Language
rus = ["Тип","Имя семейства","Имя типа"]
enu = ["Type","Family name","Type name"]
out = []
if str(lng) == "Russian":
	out = rus
else:
	out = enu
#English_USA
#Russian
OUT = out
# ----------------------------------------

путь_к_файлу_python = Filename(".\N.Отделка помещений_сбор элементов вокруг_1.7.py")  # frozen
forceChildrensEval_4 = ForceChildrensEval()  # unwired: arg0
find_file_and_import_it = Python(IN[0]=путь_к_файлу_python, IN[1]=forceChildrensEval_4)
# ---------- find_file_and_import_it.python (11 lines) ----------
import sys
sys.path.append('C:\Program Files (x86)\IronPython 2.7\Lib')
import codecs

try:
	filePath = IN[0]
	with codecs.open(filePath, 'rb', "utf-8") as inf:
		lines = inf.readlines()
	OUT = ''.join(lines)
except:
	OUT = "No file"
# ----------------------------------------
python_script_from_string = PythonStringNode(script=find_file_and_import_it)  # unwired: IN[0]
categories_2 = Categories()  # frozen
all_elements_of_category_2 = ElementsOfCategory(categories_2)
regenerate = Python()  # frozen; unwired: IN[0]
# ---------- regenerate.python (26 lines) ----------
import clr

# Import DocumentManager and TransactionManager
clr.AddReference("RevitServices")
import RevitServices
from RevitServices.Persistence import DocumentManager


# Import RevitAPI
clr.AddReference("RevitAPI")
import Autodesk
from Autodesk.Revit.DB import *

doc = DocumentManager.Instance.CurrentDBDocument


#The inputs to this node will be stored as a list in the IN variable.
list = IN[0]


if list:
	doc.Regenerate()
	out = "Regeneration complete"
else:
	out = "fail"
OUT = out
# ----------------------------------------
members = Python()  # "Object.Members"; frozen; unwired: IN[0]
# ---------- members.python (14 lines) ----------
import clr

items = IN[0]
elementlist = list()

try:
	clr.AddReference('RevitAPI')
	from Autodesk.Revit.DB import *
	for item in items:
		elementlist.append(dir(UnwrapElement(item)))
except:
	for item in items:
		elementlist.append(dir(item))
OUT = elementlist
# ----------------------------------------
filteredElementCollector = Python()  # frozen; unwired: IN[0]
# ---------- filteredElementCollector.python (29 lines) ----------
if IN[1]:
	import clr
	
	# Import DocumentManager and TransactionManager
	clr.AddReference("RevitServices")
	import RevitServices
	from RevitServices.Persistence import DocumentManager
	
	
	# Import RevitAPI
	clr.AddReference("RevitAPI")
	import Autodesk
	from Autodesk.Revit.DB import *
	
	doc = DocumentManager.Instance.CurrentDBDocument
	uiapp = DocumentManager.Instance.CurrentUIApplication
	app = uiapp.Application
	
	from System.Collections.Generic import *
	
	
	#The inputs to this node will be stored as a list in the IN variable.
	dataEnteringNode = IN
	collector = FilteredElementCollector(doc)
	elements = collector.OfCategory(BuiltInCategory.OST_Views).ToElements()
	
	OUT = sheetInstances
else:
	OUT = "скрипт не выполнен"
# ----------------------------------------
shablon_python_shablon = Python()  # frozen; unwired: IN[0]
# ---------- shablon_python_shablon.python (74 lines) ----------
# -*- coding: utf-8 -*- 
#-----------------------Импоорт библиотек----------------------
import clr
clr.AddReference('RevitAPI')
import Autodesk
from Autodesk.Revit.DB import *

clr.AddReference("RevitNodes") 
import Revit
from Revit.Elements import *

clr.ImportExtensions(Revit.Elements) #ToDSType не работает без
clr.ImportExtensions(Revit.GeometryConversion) #ToXyz не работает без

clr.AddReference("RevitServices")
import RevitServices
from RevitServices.Persistence import DocumentManager
from RevitServices.Transactions import TransactionManager

clr.AddReference('ProtoGeometry')
from Autodesk.DesignScript.Geometry import *

#-----------------------ИМПОРТ БИБЛИОТЕК----------------------
"""-"""
#-----------------------ФУНКЦИИ----------------------

def __x__(x):
	x="x"
	return x
	
#-----------------------ФУНКЦИИ----------------------
"""-"""
#-----------------------АПИ ПАРАМЕТРЫ----------------------

doc = DocumentManager.Instance.CurrentDBDocument
#link_doc = UnwrapElement(IN[1])
#uiapp = DocumentManager.Instance.CurrentUIApplication
#app = uiapp.Application
#version = app.VersionNumber
#options = Autodesk.Revit.DB.SpatialElementBoundaryOptions()
calculator = SpatialElementGeometryCalculator(doc)

g_id_list = []
g_id_list.append(ElementId(group))

bxList = List[ElementId](g_id_list) #АЙ ЛИСТ КОЛЕКТИОН

#-----------------------АПИ ПАРАМЕТРЫ----------------------
"""-"""
#-----------------------РАБОЧИЕ ПАРАМЕТРЫ----------------------

rooms = UnwrapElement(IN[0])

#-----------------------РАБОЧИЕ ПАРАМЕТРЫ----------------------	
"""-"""
#-----------------------ТЕСТОВЫЕ ПАРАМЕТРЫ----------------------

test = []

#-----------------------ТЕСТОВЫЕ ПАРАМЕТРЫ----------------------
"""-"""
#-----------------------НАЧАЛО СКРИПТА----------------------

x = 0
if rooms == None:
	rooms = [0,0]

for room in rooms:
	x=__x__(x)+__x__(x)
#TransactionManager.Instance.EnsureInTransaction(doc)
#TransactionManager.Instance.TransactionTaskDone()
#-----------------------КОНЕЦ СКРИПТА----------------------

OUT = x
# ----------------------------------------

# group: элементы внутри групп
members_2 = Python()  # "Group.Members"; frozen; unwired: IN[0]
# ---------- members_2.python (19 lines) ----------
import clr
clr.AddReference('RevitAPI')
from Autodesk.Revit.DB import *

clr.AddReference("RevitNodes")
import Revit
clr.ImportExtensions(Revit.Elements)

groups = UnwrapElement(IN[0])
elementlist = list()
for item in groups:
	try:
		memberlist = list()
		for member in item.GetMemberIds():
			memberlist.append(item.Document.GetElement(member))
		elementlist.append(memberlist)
	except:
		elementlist.append(list())
OUT = elementlist
# ----------------------------------------

string_2 = StringInput("газо")
string_3 = StringInput("отделка")
string_4 = StringInput("монолит")
string_5 = StringInput("фундамен")
name = Material.Name(getParameterValueByName_2)
записать_параметр = BoolSelector(true)
if_4 = Python(IN[0]=записать_параметр, IN[1]=filterByBoolMask.in)
# ---------- if_4.python (12 lines) ----------
import clr
boolean = IN[0]
true = UnwrapElement(IN[1])
false = None

if boolean:
	out = true
else:
	out = false

#Назначьте вывод переменной OUT.
OUT = out
# ----------------------------------------
параметр = StringInput("Включить аналитическую модель")
code_block_8 = CodeBlock { 1; 0; }
setParameterByName_2 = Element.SetParameterByName(element=if_4, parameterName=параметр, value=code_block_8.out1)
параметр_2 = StringInput("Несущие конструкции")
