# Dynamo graph 00.Изменить рабочий набор у стен.dyn (Dynamo 1.3.1.1736)

# group: ИСПОЛНИТЕЛЬНЫЕ НОДЫ (фильтрование, подбор, списки и т.д.)
# note: НОДЫ РАБОТАЮЩИЕ С ДАННЫМИ
# note: ИСПОЛНИТЕЛЬНЫЕ НОДЫ

# group: КЛЮЧЕВЫЕ МОМЕНТЫ РАБОТЫ
# note: ИТОГОВАЯ КОНСОЛИДАЦИЯ ДАННЫХ

# group: ЗАПАСНЫЕ ВАРИАНТЫ, ДОПОЛНИТЕЛЬНЫЕ ОПЦИИ
# note: ДОПОЛНИТЕЛЬНЫЕ. Градации серово по важности, темнее - важнее
# note: ЗАПАСНЫЕ

# group: ПЕРЕДАЁМ ИНФОРМАЦИЮ В РЕВИТ
# note: ПЕРЕДАЁМ ИНФОРМАЦИЮ В РЕВИТ

# group: ПРОВЕРОЧНЫЕ НОДЫ
# note: ПРОВЕРОЧНЫЕ НОДЫ

# group: ПРИМЕЧАНИЯ ПО ЦВЕТОВОЙ ГРУППИРОВКЕ
# note: GUIDELINES

# group: ЭЛЕМЕНТЫ УПРАВЛЕНИЯ
# note: ПЕРЕМЕННЫЕ ЗНАЧЕНИЯ
# note: ЭЛЕМЕНТЫ УПРАВЛЕНИЯ

# group: ПОЛУЧАЕМ ДАННЫЕ ИЗ РЕВИТ
# note: ПОЛУЧАЕМ ДАННЫЕ ИЗ РЕВИТ

# group: Название кустом ноды [НАЗВАНИЕ ПАКЕТА] для распакованных кустомных нодов
# note: НОДЫ РАБОТАЮЩИЕ С ДАННЫМИ
# note: ИСПОЛНИТЕЛЬНЫЕ НОДЫ

# note: ВСЁ ОСТАЛЬНОЕ
forceChildrensEval = ForceChildrensEval()  # unwired: arg0

# group: Get Revit Selection:
pys_get_revit_selection = Python(IN[0]=forceChildrensEval)  # frozen
# ---------- pys_get_revit_selection.python (22 lines) ----------
import clr
clr.AddReference('RevitServices')
clr.AddReference('RevitAPI')
from Autodesk.Revit.DB import *
import RevitServices
from RevitServices.Persistence import DocumentManager
from Autodesk.Revit.ApplicationServices import Application

reset = IN[0]

doc = DocumentManager.Instance.CurrentDBDocument
uidoc = DocumentManager.Instance.CurrentUIApplication.ActiveUIDocument
ids = uidoc.Selection.GetElementIds()

idd = [str(i) for i in ids]

if isinstance(idd, list) == True:
	elems = [doc.GetElement(ElementId(int(i))) for i in idd]
else:
	elems = doc.GetElement(ElementId(int(idd)))

OUT = elems
# ----------------------------------------

# group: Значение параметра "Рабочий набор" у выбранных элементов
code_block = CodeBlock { "Рабочий набор"; }
getParameterValueByName = Element.GetParameterValueByName(element=pys_get_revit_selection, parameterName=code_block)  # frozen

# group: WorksetsInDocument - [SWINGNODES]
python_script_workset_names_ids = Python(IN[0]=forceChildrensEval)
# ---------- python_script_workset_names_ids.python (32 lines) ----------
#python nodes in dynamo 1.2
#proposed by Severin SCHAEFER @severin.schaefer.architecte@gmail.com

import clr

# Import DocumentManager
clr.AddReference("RevitServices")
import RevitServices
from RevitServices.Persistence import DocumentManager

# Import RevitAPI
clr.AddReference("RevitAPI")
import Autodesk

# Import ToDSType(bool) extension method
clr.AddReference("RevitNodes")
import Revit
from Autodesk.Revit.DB import *
clr.ImportExtensions(Revit.Elements)

#Inputs
doc = DocumentManager.Instance.CurrentDBDocument

#Transaction
userWorksets = FilteredWorksetCollector(doc).OfKind(WorksetKind.UserWorkset)
names, ids = [], []
for i in userWorksets:
	names.append(i.Name)
	ids.append(i.Id)

#Outputs
OUT = userWorksets, names, ids
# ----------------------------------------
code_block_2 = CodeBlock { 0; 1; 2; }
getItemAtIndex = List.GetItemAtIndex(list=python_script_workset_names_ids, index=code_block_2.out1)
workset_names = CodeBlock(Nam=getItemAtIndex) { Nam; }
getItemAtIndex_2 = List.GetItemAtIndex(list=python_script_workset_names_ids, index=code_block_2.out0)
code_block_3 = CodeBlock(Workst=getItemAtIndex_2) { Workst; }
getItemAtIndex_3 = List.GetItemAtIndex(list=python_script_workset_names_ids, index=code_block_2.out2)
code_block_4 = CodeBlock(Id_dqd=getItemAtIndex_3) { Id_dqd; }

workset_names_2 = Watch(workset_names)
изменить_рабочий_набор = BoolSelector(false)
стены_или_перекрытия = BoolSelector(true)
code_block_5 = CodeBlock { "Стены"; "Перекрытия"; }
if_ = Python(IN[0]=стены_или_перекрытия, IN[1]=code_block_5.out0, IN[2]=code_block_5.out1)
# ---------- if_.python (12 lines) ----------
import clr
boolean = IN[0]
true = UnwrapElement(IN[1])
false = UnwrapElement(IN[2])

if boolean:
	out = true
else:
	out = false

#Назначьте вывод переменной OUT.
OUT = out
# ----------------------------------------
byName = Category.ByName(if_)
all_elements_of_category = ElementsOfCategory(byName)
getMaterials = Element.GetMaterials(element=all_elements_of_category)
code_block_6 = CodeBlock { "Имя"; }
getParameterValueByName_2 = Element.GetParameterValueByName(element=getMaterials, parameterName=code_block_6)
code_block_7 = CodeBlock { "АС Бетон - Железобетон"; "Бетон"; "Бетон - Газобетон"; }
eq = getParameterValueByName_2 == code_block_7.out2
allTrue = AllTrue(eq@L2)
filterByBoolMask = List.FilterByBoolMask(list=all_elements_of_category, mask=allTrue)
code_block_8 = CodeBlock { {0,0}; }
if_2 = Python(IN[0]=изменить_рабочий_набор, IN[1]=filterByBoolMask.in, IN[2]=code_block_8)  # same code as if_

# group: Выбираем номер рабочего набора из списка
номер_рабочего_набора = DoubleSlider(0, range=0..10 step 1)

getItemAtIndex_4 = List.GetItemAtIndex(list=code_block_3, index=номер_рабочего_набора)
element_setworkset_clockwork = Python(IN[0]=if_2, IN[1]=getItemAtIndex_4)
# ---------- element_setworkset_clockwork.python (24 lines) ----------
import clr
clr.AddReference('RevitAPI')
from Autodesk.Revit.DB import *

clr.AddReference("RevitServices")
import RevitServices
from RevitServices.Persistence import DocumentManager
from RevitServices.Transactions import TransactionManager

doc = DocumentManager.Instance.CurrentDBDocument
faminsts = UnwrapElement(IN[0])
ws = UnwrapElement(IN[1])
elementlist = list()
faillist = list()
TransactionManager.Instance.EnsureInTransaction(doc)
for item in faminsts:
	try:
		param = item.get_Parameter(BuiltInParameter.ELEM_PARTITION_PARAM)
		param.Set(ws.Id.IntegerValue)
		elementlist.append(item)
	except:
		faillist.append("НЕТ ГЕОМЕТРИИ")
TransactionManager.Instance.TransactionTaskDone()
OUT = (elementlist,faillist)
# ----------------------------------------
flatten = Flatten(element_setworkset_clockwork)
результат = Watch(flatten)
categories = Categories("Floors")
getItemAtIndex_5 = List.GetItemAtIndex(list=code_block_4, index=номер_рабочего_набора)
string_from_object = FromObject(getItemAtIndex_5)
code_block_9 = CodeBlock { "Рабочий набор"; }
getParameterValueByName_3 = Element.GetParameterValueByName(element=filterByBoolMask.in, parameterName=code_block_9)
string_from_object_2 = FromObject(getParameterValueByName_3)
eq_2 = string_from_object == string_from_object_2
filterByBoolMask_2 = List.FilterByBoolMask(list=filterByBoolMask.in, mask=eq_2)
geometry = Element.Geometry(filterByBoolMask_2.out)
watch = Watch(filterByBoolMask_2.out)
code_block_10 = CodeBlock { "Базовая зависимость"; "Группа неправильного рабочего набора"; }
getParameterValueByName_4 = Element.GetParameterValueByName(element=watch, parameterName=code_block_10.out0)
forceChildrensEval_2 = ForceChildrensEval()  # unwired: arg0
fromElements = Python(IN[0]=watch, IN[1]=code_block_10.out1, IN[2]=forceChildrensEval_2)  # "Group.FromElements"; frozen
# ---------- fromElements.python (28 lines) ----------
import clr
clr.AddReference('RevitAPI')
from Autodesk.Revit.DB import *
from System.Collections.Generic import *

clr.AddReference("RevitServices")
import RevitServices
from RevitServices.Persistence import DocumentManager
from RevitServices.Transactions import TransactionManager

doc = DocumentManager.Instance.CurrentDBDocument
items = UnwrapElement(IN[0])
newname = IN[1]
ids = list()
rejects = list()
for item in items:
	ids.append(item.Id)

items = List[ElementId](ids)

TransactionManager.Instance.EnsureInTransaction(doc)

group = doc.Create.NewGroup(items)
group.GroupType.Name = newname[0]

TransactionManager.Instance.TransactionTaskDone()

OUT = (group,newname)
# ----------------------------------------

# group: Выбираем элементы в ревит
forceChildrensEval_3 = ForceChildrensEval()  # unwired: arg0
pys_setrevitselection = Python(IN[0]=forceChildrensEval_3, IN[1]=watch)
# ---------- pys_setrevitselection.python (30 lines) ----------
# ©2016, Khasan Mamaev
# www.dynamobim.ru

import clr
clr.AddReference('RevitServices')
clr.AddReference('RevitAPI')
from Autodesk.Revit.DB import *
import RevitServices
from RevitServices.Persistence import DocumentManager
from Autodesk.Revit.ApplicationServices import Application
clr.AddReference('RevitNodes')
import Revit
clr.ImportExtensions(Revit.Elements)
from Revit.Elements import *
clr.AddReference('System')
from System.Collections.Generic import List

reset = IN[0]

elems = IN[1]

doc = DocumentManager.Instance.CurrentDBDocument
uidoc = DocumentManager.Instance.CurrentUIApplication.ActiveUIDocument

ids = List[ElementId]()

for i in elems:
    ids.Add(UnwrapElement(i).Id)

uidoc.Selection.SetElementIds(ids)
# ----------------------------------------
