# Dynamo graph 00.Изменить рабочий набор у элементов.dyn (Dynamo 1.3.3.4111)

# group: ИСПОЛНИТЕЛЬНЫЕ НОДЫ (фильтрование, подбор, списки и т.д.)
# note: НОДЫ РАБОТАЮЩИЕ С ДАННЫМИ
# note: ИСПОЛНИТЕЛЬНЫЕ НОДЫ

# group: КЛЮЧЕВЫЕ МОМЕНТЫ РАБОТЫ
# note: ИТОГОВАЯ КОНСОЛИДАЦИЯ ДАННЫХ

# group: ЗАПАСНЫЕ ВАРИАНТЫ, ДОПОЛНИТЕЛЬНЫЕ ОПЦИИ
# note: ДОПОЛНИТЕЛЬНЫЕ. Градации серово по важности, темнее - важнее
# note: ЗАПАСНЫЕ

# group: ПЕРЕДАЁМ ИНФОРМАЦИЮ В РЕВИТ
# note: ПЕРЕДАЁМ ИНФОРМАЦИЮ В РЕВИТ

# group: ПРОВЕРОЧНЫЕ НОДЫ
# note: ПРОВЕРОЧНЫЕ НОДЫ

# group: ПРИМЕЧАНИЯ ПО ЦВЕТОВОЙ ГРУППИРОВКЕ
# note: GUIDELINES

# group: ЭЛЕМЕНТЫ УПРАВЛЕНИЯ
# note: ПЕРЕМЕННЫЕ ЗНАЧЕНИЯ
# note: ЭЛЕМЕНТЫ УПРАВЛЕНИЯ

# group: ПОЛУЧАЕМ ДАННЫЕ ИЗ РЕВИТ
# note: ПОЛУЧАЕМ ДАННЫЕ ИЗ РЕВИТ

# group: Название кустом ноды [НАЗВАНИЕ ПАКЕТА] для распакованных кустомных нодов
# note: НОДЫ РАБОТАЮЩИЕ С ДАННЫМИ
# note: ИСПОЛНИТЕЛЬНЫЕ НОДЫ

# note: ВСЁ ОСТАЛЬНОЕ
forceChildrensEval = ForceChildrensEval()  # unwired: arg0

# group: WorksetsInDocument - [SWINGNODES]
python_script_workset_names_ids = Python(IN[0]=forceChildrensEval)
# ---------- python_script_workset_names_ids.python (32 lines) ----------
#python nodes in dynamo 1.2
#proposed by Severin SCHAEFER @severin.schaefer.architecte@gmail.com

import clr

# Import DocumentManager
clr.AddReference("RevitServices")
import RevitServices
from RevitServices.Persistence import DocumentManager

# Import RevitAPI
clr.AddReference("RevitAPI")
import Autodesk

# Import ToDSType(bool) extension method
clr.AddReference("RevitNodes")
import Revit
from Autodesk.Revit.DB import *
clr.ImportExtensions(Revit.Elements)

#Inputs
doc = DocumentManager.Instance.CurrentDBDocument

#Transaction
userWorksets = FilteredWorksetCollector(doc).OfKind(WorksetKind.UserWorkset)
names, ids = [], []
for i in userWorksets:
	names.append(i.Name)
	ids.append(i.Id)

#Outputs
OUT = userWorksets, names, ids
# ----------------------------------------
code_block = CodeBlock { 0; 1; 2; }
getItemAtIndex = List.GetItemAtIndex(list=python_script_workset_names_ids, index=code_block.out2)
code_block_2 = CodeBlock(Id_dqd=getItemAtIndex) { Id_dqd; }
getItemAtIndex_2 = List.GetItemAtIndex(list=python_script_workset_names_ids, index=code_block.out1)
workset_names = CodeBlock(Nam=getItemAtIndex_2) { Nam; }
getItemAtIndex_3 = List.GetItemAtIndex(list=python_script_workset_names_ids, index=code_block.out0)
code_block_3 = CodeBlock(Workst=getItemAtIndex_3) { Workst; }

# group: Get Revit Selection:
pys_get_revit_selection = Python(IN[0]=forceChildrensEval)
# ---------- pys_get_revit_selection.python (22 lines) ----------
import clr
clr.AddReference('RevitServices')
clr.AddReference('RevitAPI')
from Autodesk.Revit.DB import *
import RevitServices
from RevitServices.Persistence import DocumentManager
from Autodesk.Revit.ApplicationServices import Application

reset = IN[0]

doc = DocumentManager.Instance.CurrentDBDocument
uidoc = DocumentManager.Instance.CurrentUIApplication.ActiveUIDocument
ids = uidoc.Selection.GetElementIds()

idd = [str(i) for i in ids]

if isinstance(idd, list) == True:
	elems = [doc.GetElement(ElementId(int(i))) for i in idd]
else:
	elems = doc.GetElement(ElementId(int(idd)))

OUT = elems
# ----------------------------------------

# group: Значение параметра "Рабочий набор" у выбранных элементов
code_block_4 = CodeBlock { "Рабочий набор"; }
getParameterValueByName = Element.GetParameterValueByName(element=pys_get_revit_selection, parameterName=code_block_4)  # frozen

workset_names_2 = Watch(workset_names)
изменить_рабочий_набор = BoolSelector(false)
code_block_5 = CodeBlock { {0,0}; }
if_ = Python(IN[0]=изменить_рабочий_набор, IN[1]=pys_get_revit_selection, IN[2]=code_block_5)
# ---------- if_.python (12 lines) ----------
import clr
boolean = IN[0]
true = UnwrapElement(IN[1])
false = UnwrapElement(IN[2])

if boolean:
	out = true
else:
	out = false

#Назначьте вывод переменной OUT.
OUT = out
# ----------------------------------------

# group: Выбираем номер рабочего набора из списка
номер_рабочего_набора = DoubleSlider(4, range=0..10 step 1)

getItemAtIndex_4 = List.GetItemAtIndex(list=code_block_3, index=номер_рабочего_набора)
element_setworkset_clockwork = Python(IN[0]=if_, IN[1]=getItemAtIndex_4)
# ---------- element_setworkset_clockwork.python (24 lines) ----------
import clr
clr.AddReference('RevitAPI')
from Autodesk.Revit.DB import *

clr.AddReference("RevitServices")
import RevitServices
from RevitServices.Persistence import DocumentManager
from RevitServices.Transactions import TransactionManager

doc = DocumentManager.Instance.CurrentDBDocument
faminsts = UnwrapElement(IN[0])
ws = UnwrapElement(IN[1])
elementlist = list()
faillist = list()
TransactionManager.Instance.EnsureInTransaction(doc)
for item in faminsts:
	try:
		param = item.get_Parameter(BuiltInParameter.ELEM_PARTITION_PARAM)
		param.Set(ws.Id.IntegerValue)
		elementlist.append(item)
	except:
		faillist.append("НЕТ ГЕОМЕТРИИ")
TransactionManager.Instance.TransactionTaskDone()
OUT = (elementlist,faillist)
# ----------------------------------------
flatten = Flatten(element_setworkset_clockwork)
результат = Watch(flatten)
