# Dynamo graph D2 Создание фильтров v 2.dyn (Dynamo 2.3.0.5885)

# note: ВСЁ ОСТАЛЬНОЕ

# group: КЛЮЧЕВЫЕ МОМЕНТЫ РАБОТЫ 2
# note: НОДЫ РАБОТАЮЩИЕ С ДАННЫМИ
# note: ИСПОЛНИТЕЛЬНЫЕ НОДЫ

# group: ЗАПАСНЫЕ ВАРИАНТЫ, ДОПОЛНИТЕЛЬНЫЕ ОПЦИИ
# note: ДОПОЛНИТЕЛЬНЫЕ. Градации серово по важности, темнее - важнее
# note: ЗАПАСНЫЕ

# group: КЛЮЧЕВЫЕ МОМЕНТЫ РАБОТЫ 1
# note: ИТОГОВАЯ КОНСОЛИДАЦИЯ ДАННЫХ

# group: ИСПОЛНИТЕЛЬНЫЕ НОДЫ (фильтрование, подбор, списки и т.д.)
# note: ИСПОЛНИТЕЛЬНЫЕ НОДЫ
# note: НОДЫ РАБОТАЮЩИЕ С ДАННЫМИ

# group: ЭЛЕМЕНТЫ УПРАВЛЕНИЯ 2 УРОВЕНЬ
# note: ПЕРЕМЕННЫЕ ЗНАЧЕНИЯ
# note: ЭЛЕМЕНТЫ УПРАВЛЕНИЯ

# group: ЭЛЕМЕНТЫ УПРАВЛЕНИЯ
# note: ПЕРЕМЕННЫЕ ЗНАЧЕНИЯ
# note: ЭЛЕМЕНТЫ УПРАВЛЕНИЯ

# group: ПРОВЕРОЧНЫЕ НОДЫ
# note: ПРОВЕРОЧНЫЕ НОДЫ

# group: ПЕРЕДАЁМ ИНФОРМАЦИЮ В РЕВИТ
# note: ПЕРЕДАЁМ ИНФОРМАЦИЮ В РЕВИТ

# group: ЭЛЕМЕНТЫ УПРАВЛЕНИЯ Dyno Studio
# note: Dyno Studio

# group: ПРИМЕЧАНИЯ ПО ЦВЕТОВОЙ ГРУППИРОВКЕ
# note: GUIDELINES

# group: ПОЛУЧАЕМ ДАННЫЕ ИЗ РЕВИТ
# note: ПОЛУЧАЕМ ДАННЫЕ ИЗ РЕВИТ

current = Document.Current()
activeView = Document.ActiveView(document=current)
t_своё_имя = BoolSelector(false)  # graph input
шаблон_имени = StringInput("Шаблон имени")  # graph input
all_elements_in_active_view = ElementsInView()  # graph input
getCategory = Element.GetCategory(element=all_elements_in_active_view)
string_from_object = FromObject(obj=getCategory)
categories = Categories("OST_StructuralFoundation")  # graph input
string_from_object_2 = FromObject(obj=categories)
eq = string_from_object == string_from_object_2
filterByBoolMask = List.FilterByBoolMask(list=all_elements_in_active_view, mask=eq)
code_block = CodeBlock { "Тип"; }
getParameterValueByName = Element.GetParameterValueByName(element=filterByBoolMask.in, parameterName=code_block, lacing=Longest)

# group: Создание имени фильтра вручную
count = List.Count(list=getParameterValueByName)
code_block_2 = CodeBlock(x=count) { 1..x; }
code_block_3 = CodeBlock(S=шаблон_имени, x=code_block_2) { S+"_"+x; }

# group: Генерируем имена фильтров
cycle = List.Cycle(list=code_block, amount=count)
code_block_4 = CodeBlock(param=cycle) { param; }
code_block_5 = CodeBlock(cat=string_from_object_2, param=code_block_4, value=getParameterValueByName) { "s.f. "+cat+" "+param+" "+value; }

t_авто_имя = BoolSelector(true)  # graph input

# group: Проверяем наличие фильтра с таким именем
element_types = ElementTypes("ParameterFilterElement")  # graph input
all_elements_of_type = ElementsOfType(element_type=element_types)
name = Element.Name(element=all_elements_of_type)
watch = Watch(name)
проверка_существования_имени = Python(IN[0]=watch, IN[1]=code_block_5, IN[2]=t_авто_имя)  # "Проверка существования имени - WHILE !!!"
# ---------- проверка_существования_имени.python (29 lines) ----------
if IN[2]:
	filters = IN[0]
	new = IN[1]
	ok = []
	new2 = new
	test2 = []
	
	
	while len(new2) > 0:
		new3 = []
		for n in new2:
			test = []
			for f in filters:
				if n == f:
					test.append(True)
				else:
					test.append(False)
			if any(test):
				test2.append(True)
				new3.append(n+" (+1)")
			else:
				test2.append(False)
				ok.append(n)
		new2 = []
		new2 = new3	

	OUT = ok
else:
	pass
# ----------------------------------------

if_ = Python(IN[0]=t_своё_имя, IN[1]=code_block_3, IN[2]=проверка_существования_имени)
# ---------- if_.python (12 lines) ----------
import clr
boolean = IN[0]
true = UnwrapElement(IN[1])
false = UnwrapElement(IN[2])

if boolean:
	out = true
else:
	out = false

#Назначьте вывод переменной OUT.
OUT = out
# ----------------------------------------
byName = Category.ByName(name=string_from_object_2)
code_block_6 = CodeBlock(list=byName) { [list]; }
code_block_7 = CodeBlock { "Equals"; }
string_from_object_3 = FromObject(obj=getParameterValueByName)
parameterByName = Parameter.ParameterByName(element=filterByBoolMask.in, name=code_block)
byRuleType = Revit.Filter.FilterRule.ByRuleType(type=code_block_7, value=string_from_object_3, parameter=parameterByName)
count_2 = List.Count(list=getParameterValueByName)
code_block_8 = CodeBlock(x=count_2) { 0..x; }

# group: Определяем графику
code_block_9 = CodeBlock { rz; zs; }  # unwired: rz, zs
code_block_10 = CodeBlock()
# ---------- code_block_10.designscript (6 lines) ----------
color_red = Color.ByARGB(255, 255, 0, 0);
color_green = Color.ByARGB(255, 0, 255, 0);
color_blue = Color.ByARGB(255, 0, 0, 255);
color_yellow = Color.ByARGB(255, 255, 255, 0);
color_white = Color.ByARGB(255, 255, 255, 255);
color_black = Color.ByARGB(255, 0, 0, 0);
# ----------------------------------------
create = List.Create(item0=code_block_10.color_red, item1=code_block_10.color_green, item2=code_block_10.color_blue, item3=code_block_10.color_yellow, item4=code_block_10.color_white, item5=code_block_10.color_black)
if_на_цвет = Python(IN[1]=code_block_9.rz, IN[2]=code_block_9.zs, IN[3]=create)  # unwired: IN[0]
# ---------- if_на_цвет.python (48 lines) ----------
d0 = 0
d255 = 255
rzt = IN[1]
zst = IN[2]
red = IN[3][0]
green = IN[3][1]
blue = IN[3][2]
yellow = IN[3][3]
white = IN[3][4]
black = IN[3][5]
colors = []
ind = []
#d = dict.fromkeys(IN[10], IN[11])


if rzt == "Черного":
	colors.append(black)
elif rzt == "Белого":
	colors.append(white)	
elif rzt == "Крастного":
	colors.append(red)
elif rzt == "Синего":
	colors.append(blue)
elif rzt == "Зелёного":
	colors.append(green)
elif rzt == "Жёлтого":
	colors.append(yellow)	
else:
	pass

if zst == "Белому":
	colors.append(white)
elif zst == "Черному":
	colors.append(black)
elif zst == "Зелёному":
	colors.append(green)
elif zst == "Крастному":
	colors.append(red)
elif zst == "Синему":
	colors.append(blue)
elif zst == "Жёлтому":
	colors.append(yellow)	
else:
	pass



OUT = [green, red]
# ----------------------------------------
code_block_11 = CodeBlock(colors=if_на_цвет) { colors; 0..1; }
flatten = List.Flatten(list=code_block_8)
code_block_12 = CodeBlock { 0; 1; }
remapRange = Math.RemapRange(numbers=flatten, newMin=code_block_12.out0, newMax=code_block_12.out1)
color_range = ColorRange(colors=code_block_11.colors, indices=code_block_11.out1, value=remapRange)
shuffle = List.Shuffle(list=remapRange)
color_range_2 = ColorRange(value=shuffle)  # unwired: colors, indices
if_2 = Python(IN[1]=color_range, IN[2]=color_range_2)  # unwired: IN[0]
# ---------- if_2.python (12 lines) ----------
import clr
boolean = IN[0]
true = UnwrapElement(IN[2])
false = UnwrapElement(IN[1])

if boolean:
	out = true
else:
	out = false

#Назначьте вывод переменной OUT.
OUT = out
# ----------------------------------------
fill_patterns = FillPatterns("<Сплошная заливка>")  # graph input
byProperties = Revit.Filter.OverrideGraphicSettings.ByProperties(cutFillColor=if_2, projectionFillColor=if_2, cutFillPattern=fill_patterns, projectionFillPattern=fill_patterns)

# group: Если не разбить на списки, в каждом фильтре будут все значения
create_2 = List.Create()  # unwired: item0
map = List.Map(list=if_, f_x=create_2)
map_2 = List.Map(list=byRuleType, f_x=create_2)
map_3 = List.Map(list=byProperties, f_x=create_2)
count_3 = List.Count(list=map_2@L3)

byRules = Revit.Filter.ParameterFilterElement.ByRules(name=map, categories=code_block_6, rules=map_2)
addFilter = View.AddFilter(view=activeView, parameterFilter=byRules)
flatten_2 = List.Flatten(list=map_3)
видимость_вкл_выкл = BoolSelector(true)  # graph input
setFilterOverrides = View.SetFilterOverrides(view=addFilter, parameterFilter=byRules, overrides=flatten_2, hide=видимость_вкл_выкл)
all_elements_of_category = ElementsOfCategory(Category=categories)
flatten_3 = List.Flatten()  # unwired: list
flatten_4 = List.Flatten(list=map_2)
flatten_5 = List.Flatten(list=map)
ofRepeatedItem = List.OfRepeatedItem(item=categories, amount=count_3)
flatten_6 = List.Flatten(list=ofRepeatedItem)
