# Dynamo graph 4.Маркируем панели.dyn (Dynamo 1.3.1.1736)

# note: Фильтр для записи параметров

categories = Categories("Views")
all_elements_of_category = ElementsOfCategory(categories)
firstItem = List.FirstItem(all_elements_of_category)
parameters = Element.Parameters(firstItem)
categories_2 = Categories("CurtainWallPanels")  # frozen
all_elements_of_category_2 = ElementsOfCategory(categories_2)
code_block = CodeBlock { "Тип"; "Сендвич"; }
getParameterValueByName = Element.GetParameterValueByName(element=all_elements_of_category_2, parameterName=code_block.out0)
string_from_object = FromObject(getParameterValueByName)
contains = String.Contains(str=string_from_object, searchFor=code_block.out1)
filterByBoolMask = List.FilterByBoolMask(list=all_elements_of_category_2, mask=contains)
code_block_2 = CodeBlock { "Расчетная Высота"; }
getParameterValueByName_2 = Element.GetParameterValueByName(element=filterByBoolMask.in, parameterName=code_block_2)
code_block_3 = CodeBlock(x=getParameterValueByName_2) { x*1; }
isNull = Object.IsNull(code_block_3)
filterByBoolMask_2 = List.FilterByBoolMask(list=getParameterValueByName_2, mask=isNull)
filterByBoolMask_3 = List.FilterByBoolMask(list=filterByBoolMask.in, mask=isNull)
code_block_4 = CodeBlock(Elem=filterByBoolMask_3.out) { Elem; }

# group: Get Revit Selection:
forceChildrensEval = ForceChildrensEval()  # unwired: arg0
pys_get_revit_selection = Python(IN[0]=forceChildrensEval)
# ---------- pys_get_revit_selection.python (22 lines) ----------
import clr
clr.AddReference('RevitServices')
clr.AddReference('RevitAPI')
from Autodesk.Revit.DB import *
import RevitServices
from RevitServices.Persistence import DocumentManager
from Autodesk.Revit.ApplicationServices import Application

reset = IN[0]

doc = DocumentManager.Instance.CurrentDBDocument
uidoc = DocumentManager.Instance.CurrentUIApplication.ActiveUIDocument
ids = uidoc.Selection.GetElementIds()

idd = [str(i) for i in ids]

if isinstance(idd, list) == True:
	elems = [doc.GetElement(ElementId(int(i))) for i in idd]
else:
	elems = doc.GetElement(ElementId(int(idd)))

OUT = elems
# ----------------------------------------

code_block_5 = CodeBlock { "Марка"; }
getParameterValueByName_3 = Element.GetParameterValueByName(element=pys_get_revit_selection, parameterName=code_block_5)
sortByKey = List.SortByKey(list=pys_get_revit_selection, keys=getParameterValueByName_3)
code_block_6 = CodeBlock(list=sortByKey.sorted_list) { list; }
code_block_7 = CodeBlock(keys=sortByKey.sorted_keys) { keys; }
groupByKey = List.GroupByKey(list=code_block_6, keys=code_block_7)
code_block_8 = CodeBlock { 30; }
count = List.Count(groupByKey.unique_keys)
code_block_9 = CodeBlock(x=code_block_8, y=count) { x..x+y-1; }
code_block_10 = CodeBlock(x=code_block_9) { "р"+x; }
count_2 = List.Count(groupByKey.groups@L2)
ofRepeatedItem = List.OfRepeatedItem(item=code_block_10@L1, amount=count_2@L1)
string_from_object_2 = FromObject(ofRepeatedItem)
setParameterByName = Element.SetParameterByName(element=groupByKey.groups, parameterName=code_block_5, value=string_from_object_2)  # frozen

# group: Get Revit Selection:
forceChildrensEval_2 = ForceChildrensEval()  # frozen; unwired: arg0
pys_get_revit_selection_2 = Python(IN[0]=forceChildrensEval_2)  # same code as pys_get_revit_selection
byElement = CurtainPanel.ByElement(pys_get_revit_selection_2)

code_block_11 = CodeBlock { "Площадь"; }
getParameterValueByName_4 = Element.GetParameterValueByName(element=byElement, parameterName=code_block_11)
code_block_12 = CodeBlock(x=getParameterValueByName_4) { x*1; }
isNull_2 = Object.IsNull(code_block_12)
filterByBoolMask_4 = List.FilterByBoolMask(list=byElement, mask=isNull_2)
code_block_13 = CodeBlock { "Ширина"; }
getParameterValueByName_5 = Element.GetParameterValueByName(element=filterByBoolMask_4.out, parameterName=code_block_13, lacing=Longest)
code_block_14 = CodeBlock(x=getParameterValueByName_5) { x*1; }
isNull_3 = Object.IsNull(code_block_14)
filterByBoolMask_5 = List.FilterByBoolMask(list=filterByBoolMask_4.out, mask=isNull_3)
code_block_15 = CodeBlock(simpl=filterByBoolMask_5.out) { simpl; }
code_block_16 = CodeBlock { {"Расчетная Ширина","Расчетная Высота"}; }
code_block_17 = CodeBlock { {"Ширина","Высота"}; }
getParameterValueByName_6 = Element.GetParameterValueByName(element=code_block_15, parameterName=code_block_17, lacing=Longest)
code_block_18 = CodeBlock(x=getParameterValueByName_6) { x*1; }
round = Math.Round(code_block_18)
setParameterByName_2 = Element.SetParameterByName(element=code_block_15, parameterName=code_block_16, value=round, lacing=Longest)
flatten = Flatten(filterByBoolMask_5.in)
code_block_19 = CodeBlock { "Расчетная Высота"; }
geometry = Element.Geometry(filterByBoolMask_5.in)
boundingBox = Geometry.BoundingBox(geometry)
toCuboid = BoundingBox.ToCuboid(boundingBox)
explode = Geometry.Explode(toCuboid)
code_block_20 = CodeBlock { 1; 0.5; }
flatten_2 = List.Flatten(list=explode, amt=code_block_20.out0)
pointAtParameter = Surface.PointAtParameter(surface=flatten_2, u=code_block_20.out1, v=code_block_20.out1)
Z = Point.Z(pointAtParameter)
maximumItem = List.MaximumItem(Z@L2)
minimumItem = List.MinimumItem(Z@L2)
code_block_21 = CodeBlock(max=maximumItem, min=minimumItem) { max-min; }
floor = Math.Floor(code_block_21)
maximumItem_2 = List.MaximumItem(floor)
максимальная_высота_панели = Watch(maximumItem_2)
code_block_22 = CodeBlock(max=максимальная_высота_панели) { 1190-max; }
code_block_23 = CodeBlock(max=floor, koef=code_block_22) { max+koef; }
setParameterByName_3 = Element.SetParameterByName(element=flatten, parameterName=code_block_19, value=code_block_23, lacing=Longest)
code_block_24 = CodeBlock { "Расчетная высота"; }
getParameterValueByName_7 = Element.GetParameterValueByName(element=pys_get_revit_selection, parameterName=code_block_24)
sortByKey_2 = List.SortByKey(list=pys_get_revit_selection, keys=getParameterValueByName_7)
groupByKey_2 = List.GroupByKey(list=sortByKey_2.sorted_list, keys=sortByKey_2.sorted_keys)
getCalculatedValues = Custom[Schedule.GetCalculatedValues]()  # Get Schedule Calculated Values from name input; unwired: ViewSchedule_List, Calc_Val_Name_string
code_block_25 = CodeBlock { "Имя вида"; "Спецификация сендвича для маркировки"; }
getParameterValueByName_8 = Element.GetParameterValueByName(element=all_elements_of_category, parameterName=code_block_25.out0)
eq = getParameterValueByName_8 == code_block_25.out1
