# Dynamo graph Из легенды в изображение, и в параметр элемента_1.4.dyn (Dynamo 1.3.1.1736)

# group: ПОЛУЧАЕМ ДАННЫЕ
# note: ПОЛУЧАЕМ ДАННЫЕ ИЗ РЕВИТ и других источников

# group: ЭЛЕМЕНТЫ УПРАВЛЕНИЯ
# note: ЭЛЕМЕНТЫ УПРАВЛЕНИЯ
# note: ПЕРЕМЕННЫЕ ЗНАЧЕНИЯ

# group: ЭЛЕМЕНТЫ УПРАВЛЕНИЯ 2 УРОВЕНЬ
# note: ЭЛЕМЕНТЫ УПРАВЛЕНИЯ
# note: ПЕРЕМЕННЫЕ ЗНАЧЕНИЯ

# group: Python ноды
# note: Python

# group: ПРОВЕРОЧНЫЕ НОДЫ
# note: ПРОВЕРОЧНЫЕ НОДЫ

# group: Запуск питона из внешнего файла
# note: Py - files

# group: ЗАПАСНЫЕ ВАРИАНТЫ, ДОПОЛНИТЕЛЬНЫЕ ОПЦИИ
# note: ЗАПАСНЫЕ
# note: ДОПОЛНИТЕЛЬНЫЕ. Градации серово по важности, темнее - важнее

# group: КЛЮЧЕВЫЕ МОМЕНТЫ РАБОТЫ 2
# note: УСЛОЖНЕНЫЕ КОНСТРУКЦИИ
# note: УСЛОЖНЕННЫЕ КОНСТРУКЦИИ

# group: КЛЮЧЕВЫЕ МОМЕНТЫ РАБОТЫ 1
# note: КОНСОЛИДАЦИЯ И СЛОЖНЫЕ ОБРАБОТКИ

# group: ИСПОЛНИТЕЛЬНЫЕ НОДЫ (фильтрование, подбор, списки и т.д.)
# note: ИСПОЛНИТЕЛЬНЫЕ НОДЫ

# group: ПЕРЕДАЁМ ИНФОРМАЦИЮ
# note: ПЕРЕДАЁМ ИНФОРМАЦИЮ В РЕВИТ
# note: ПЕРЕДАЁМ ИНФОРМАЦИЮ ЕЩЁ КУДА-ТО

# group: ПРИМЕЧАНИЯ ПО ЦВЕТОВОЙ ГРУППИРОВКЕ
# note: GUIDELINES

forceChildrensEval = ForceChildrensEval()  # unwired: arg0
forceChildrensEval_2 = ForceChildrensEval()  # unwired: arg0
categories = Categories("Doors")
чистим_имена_типов = BoolSelector(false)
categories_2 = Categories("Windows")
if_ = Python(IN[0]=чистим_имена_типов, IN[1]=categories_2)
# ---------- if_.python (12 lines) ----------
import clr
boolean = IN[0]
true = IN[1]
false = None

if boolean:
	out = true
else:
	out = false

#Назначьте вывод переменной OUT.
OUT = out
# ----------------------------------------

# group: удаляем \,/,:,*,?,",<,>,|,+,.,%,!,@ из имен типов
all_family_types_of_category = Python(IN[0]=if_)
# ---------- all_family_types_of_category.python (23 lines) ----------
if IN[0]:
	import clr
	
	# Import DocumentManager and TransactionManager
	clr.AddReference("RevitServices")
	import RevitServices
	from RevitServices.Persistence import DocumentManager
	
	# Import RevitAPI
	clr.AddReference("RevitAPI")
	import Autodesk
	from Autodesk.Revit.DB import FilteredElementCollector
	
	doc = DocumentManager.Instance.CurrentDBDocument
	
	cat = UnwrapElement(IN[0])
	
	collector = FilteredElementCollector(doc)
	cat_types = collector.OfCategoryId(cat.Id).WhereElementIsElementType().ToElements()
	
	OUT = cat_types
else:
	pass
# ----------------------------------------
знак_для_замены = StringInput("-")
setName = Python(IN[0]=all_family_types_of_category, IN[1]=знак_для_замены)  # "Element.SetName"
# ---------- setName.python (34 lines) ----------
if IN[0]:
	import clr
	clr.AddReference('RevitAPI')
	from Autodesk.Revit.DB import Element
	
	clr.AddReference("RevitServices")
	import RevitServices
	from RevitServices.Persistence import DocumentManager
	from RevitServices.Transactions import TransactionManager
	
	doc = DocumentManager.Instance.CurrentDBDocument
	items = UnwrapElement(IN[0])
	fix_str = IN[1]
	#fail_string = '/,*,",|,+,.,%,!,@'
	fail_string = "\ : { } [ ] | ; < > ? ` ~ / * | + . % ! @" 
	fail_string_list = fail_string.split(" ") 
	new_names = []
	counter = 0
	
	for n in items:
		new4 = n.LookupParameter("Имя типа").AsString()
		for fs in fail_string_list:
			new = new4.replace(fs,fix_str)
			new4 = new
		new_names.append(new4)
	
	TransactionManager.Instance.EnsureInTransaction(doc)	
	for i, nn in zip(items,new_names):
		i.Name = nn
	TransactionManager.Instance.TransactionTaskDone()
	
	OUT = new_names
else:
	pass
# ----------------------------------------

создаём_по_существующим_легендам = BoolSelector(false)  # "Создаём по существующим легендам, или генерируем новые"
все_легенды_в_проекте = Python(IN[0]=создаём_по_существующим_легендам)
# ---------- все_легенды_в_проекте.python (32 lines) ----------
if IN[0] == True:
	import clr
	
	# Import DocumentManager and TransactionManager
	clr.AddReference("RevitServices")
	import RevitServices
	from RevitServices.Persistence import DocumentManager
	
	clr.AddReference("RevitNodes") 
	import Revit
	#from Revit.Elements import *
	clr.ImportExtensions(Revit.Elements)
	
	# Import RevitAPI
	clr.AddReference("RevitAPI")
	import Autodesk
	from Autodesk.Revit.DB import FilteredElementCollector, BuiltInCategory
	
	doc = DocumentManager.Instance.CurrentDBDocument
	
	
	collector = FilteredElementCollector(doc)
	sheets = collector.OfCategory(BuiltInCategory.OST_Views).ToElements()
	
	sheetInstances = []
	for i in sheets:
		if i.ViewType.ToString() == "Legend":
			sheetInstances.append(i.ToDSType(True))
	
	OUT = sheetInstances
else:
	OUT = "скрипт не выполнен"
# ----------------------------------------
параметр_для_фильтрации = StringInput("Назначение вида")
getParameterValueByName = Element.GetParameterValueByName(element=все_легенды_в_проекте, parameterName=параметр_для_фильтрации)
значение_параметра_текст = StringInput("Start")
code_block = CodeBlock(x=getParameterValueByName, y=значение_параметра_текст) { x==y; }
filterByBoolMask = List.FilterByBoolMask(list=все_легенды_в_проекте, mask=code_block)
все_легенды_в_проекте_2 = Python(IN[0]=создаём_по_существующим_легендам)
# ---------- все_легенды_в_проекте_2.python (28 lines) ----------
if IN[0] == False:
	import clr
	
	# Import DocumentManager and TransactionManager
	clr.AddReference("RevitServices")
	import RevitServices
	from RevitServices.Persistence import DocumentManager
	
	
	# Import RevitAPI
	clr.AddReference("RevitAPI")
	import Autodesk
	from Autodesk.Revit.DB import FilteredElementCollector, BuiltInCategory
	
	doc = DocumentManager.Instance.CurrentDBDocument
	
	
	collector = FilteredElementCollector(doc)
	legend = collector.OfCategory(BuiltInCategory.OST_Views).ToElements()
	
	legendInstances = []
	for i in legend:
		if i.ViewType.ToString() == "Legend":
			legendInstances.append(i)
	
	OUT = legendInstances
else:
	OUT = "скрипт не выполнен"
# ----------------------------------------
code_block_2 = CodeBlock { "Имя вида"; }
getParameterValueByName_2 = Element.GetParameterValueByName(element=все_легенды_в_проекте_2, parameterName=code_block_2)

# group: Имя стартовой легенды
code_block_3 = CodeBlock(x=getParameterValueByName_2) { x=="Start"; }

filterByBoolMask_2 = List.FilterByBoolMask(list=все_легенды_в_проекте_2, mask=code_block_3)
code_block_4 = CodeBlock(start_legend=filterByBoolMask_2.in) { start_legend[0]; }
all_elements_of_category = ElementsOfCategory(categories_2)
select_phase = RevitPhases("Проект")
element_phases_clockwork = Python(IN[0]=all_elements_of_category)
# ---------- element_phases_clockwork.python (22 lines) ----------
import clr
clr.AddReference('RevitAPI')
from Autodesk.Revit.DB import Element

items = UnwrapElement(IN[0])
createdlist = list()
demolist = list()

for item in items:
	try:
		if item.CreatedPhaseId.IntegerValue == -1:
			createdlist.append(None)
		else:
			createdlist.append(item.Document.GetElement(item.CreatedPhaseId))
		if item.DemolishedPhaseId.IntegerValue == -1:
			demolist.append(None)
		else:
			demolist.append(item.Document.GetElement(item.DemolishedPhaseId))
	except:
		createdlist.append(None)
		demolist.append(None)
OUT = createdlist#(createdlist,demolist)
# ----------------------------------------
equals = Equals(select_phase, element_phases_clockwork)
filterByBoolMask_3 = List.FilterByBoolMask(list=all_elements_of_category, mask=equals)
elementType = Element.ElementType(filterByBoolMask_3.in)
uniqueItems = List.UniqueItems(elementType)
string_from_object = FromObject(categories_2)
forceChildrensEval_3 = ForceChildrensEval()  # unwired: arg0
создание_легенд_по_family_type = Python(IN[0]=code_block_4, IN[1]=uniqueItems, IN[2]=string_from_object, IN[3]=forceChildrensEval_3)  # "создание легенд по family type in project"
# ---------- создание_легенд_по_family_type.python (39 lines) ----------
if IN[0]:
	import clr
	
	# Import DocumentManager and TransactionManager
	clr.AddReference("RevitServices")
	import RevitServices
	from RevitServices.Persistence import DocumentManager
	from RevitServices.Transactions import TransactionManager
	
	# Import RevitAPI
	clr.AddReference("RevitAPI")
	import Autodesk
	from Autodesk.Revit.DB import FilteredElementCollector, BuiltInCategory, Element
	
	doc = DocumentManager.Instance.CurrentDBDocument
	dupopt = Autodesk.Revit.DB.ViewDuplicateOption.WithDetailing 
	
	start_legend = UnwrapElement(IN[0])
	f_types = UnwrapElement(IN[1])
	prifix = IN[2]
	collectors = []
	plist = []
	new_legends_list = []
	
	for f_t in f_types:
		#TransactionManager.Instance.EnsureInTransaction(doc)
		nw_lg_view = doc.GetElement(start_legend.Duplicate(dupopt))
		nw_lg_view.LookupParameter("Имя вида").Set(prifix+"_"+f_t.LookupParameter("Имя типа").AsString())
		collectors = FilteredElementCollector(doc,nw_lg_view.Id).OfCategory(BuiltInCategory.OST_LegendComponents).ToElements()
		for c in collectors:
			plist.append(c.LookupParameter("Тип компонента").Set(f_t.Id))
		new_legends_list.append(nw_lg_view)
		#TransactionManager.Instance.TransactionTaskDone()
		
	OUT = new_legends_list
	#TransactionManager.Instance.ForceCloseTransaction()
else:
	pass
#TransactionManager.Instance.ForceCloseTransaction()
# ----------------------------------------
end = Revit.Transaction.Transaction.End(создание_легенд_по_family_type)
start = Revit.Transaction.Transaction.Start(end)
if_2 = Python(IN[0]=создаём_по_существующим_легендам, IN[1]=filterByBoolMask.in, IN[2]=start)
# ---------- if_2.python (14 lines) ----------
import clr
	
boolean = IN[0]
true =IN[1]
false = IN[2]


if boolean:
	out = true
else:
	out = false
		

OUT = out
# ----------------------------------------
все_legendcomponents_в_legend = Python(IN[0]=if_2)
# ---------- все_legendcomponents_в_legend.python (28 lines) ----------
import clr

# Import DocumentManager and TransactionManager
clr.AddReference("RevitServices")
import RevitServices
from RevitServices.Persistence import DocumentManager


# Import RevitAPI
clr.AddReference("RevitAPI")
import Autodesk
from Autodesk.Revit.DB import FilteredElementCollector, BuiltInCategory

doc = DocumentManager.Instance.CurrentDBDocument
#uiapp = DocumentManager.Instance.CurrentUIApplication
#app = uiapp.Application

#from System.Collections.Generic import *


#The inputs to this node will be stored as a list in the IN variable.
views = UnwrapElement(IN[0])
collectors = []

for v in views:
	collectors.append(FilteredElementCollector(doc,v.Id).OfCategory(BuiltInCategory.OST_LegendComponents).ToElements())

OUT = collectors
# ----------------------------------------
code_block_5 = CodeBlock { "Тип компонента"; }
getParameterValueByName_3 = Element.GetParameterValueByName(element=все_legendcomponents_в_legend, parameterName=code_block_5)
code_block_6 = CodeBlock { 0; }
getItemAtIndex = List.GetItemAtIndex(list=getParameterValueByName_3@L2, index=code_block_6)
flatten = Flatten(getItemAtIndex)
code_block_7 = CodeBlock { "АБН_Изображение"; }
code_block_8 = CodeBlock { "Имя вида"; }
getParameterValueByName_4 = Element.GetParameterValueByName(element=if_2, parameterName=code_block_8)
legendview_byname_prorubim = Prorubim.Common.Revit.Elements.LegendView.ByName(getParameterValueByName_4)
все_elements_in_legend_в_legend = Python(IN[0]=legendview_byname_prorubim)
# ---------- все_elements_in_legend_в_legend.python (28 lines) ----------
import clr

# Import DocumentManager and TransactionManager
clr.AddReference("RevitServices")
import RevitServices
from RevitServices.Persistence import DocumentManager


# Import RevitAPI
clr.AddReference("RevitAPI")
import Autodesk
from Autodesk.Revit.DB import FilteredElementCollector

doc = DocumentManager.Instance.CurrentDBDocument
#uiapp = DocumentManager.Instance.CurrentUIApplication
#app = uiapp.Application

#from System.Collections.Generic import *


#The inputs to this node will be stored as a list in the IN variable.
views = UnwrapElement(IN[0])
collectors = []

for v in views:
	collectors.append(FilteredElementCollector(doc,v.Id).ToElements())

OUT = collectors
# ----------------------------------------
directory_path = Directory("C:\test\jpg")
code_block_9 = CodeBlock(x=directory_path, y=getParameterValueByName_4) { x+"\\"+y+".png"; }
imageSize = DoubleInput(500)
loadImage = BoolSelector(true)
deleteImageFile = BoolSelector(false)

# group: Если здесь ошибка, проверить пути файлов, и наличие знаков: \,/,:,*,?,",<,>,|,+,.,%,!,@ в имени типа семейства, эти знаки запрещены, или не желательны в имени файлов.
view_exportobjectsasimage = Prorubim.Common.Revit.Elements.View.ExportObjectsAsImage(legendview_byname_prorubim, все_elements_in_legend_в_legend, code_block_9, imageSize, loadImage, deleteImageFile)  # "View.ExportObjectsAsImage [Prorubim]"

flatten_2 = Flatten(view_exportobjectsasimage.out1)
setParameterByName = Element.SetParameterByName(element=flatten, parameterName=code_block_7, value=flatten_2)
regenerate = Python(IN[0]=setParameterByName)  # frozen
# ---------- regenerate.python (26 lines) ----------
import clr

# Import DocumentManager and TransactionManager
clr.AddReference("RevitServices")
import RevitServices
from RevitServices.Persistence import DocumentManager


# Import RevitAPI
clr.AddReference("RevitAPI")
import Autodesk
from Autodesk.Revit.DB import *

doc = DocumentManager.Instance.CurrentDBDocument


#The inputs to this node will be stored as a list in the IN variable.
list = IN[0]


if list:
	doc.Regenerate()
	out = "Regeneration complete"
else:
	out = "fail"
OUT = out
# ----------------------------------------
export_image_by_view = Custom[Export Image by View [Archi-lab]]()  # frozen; This node will export a list of Views and save them as images (JPG, BMP etc).; unwired: View, FilePath, ExportRange, ImageFileType, ZoomFitType, PixelSize, ImageResolution, ZoomPercentage, FitDirectionType
export_image_by_view_archi_lab = Python()  # frozen; unwired: IN[0], IN[1], IN[2], IN[3], IN[4], IN[5], IN[6], IN[7], IN[8], IN[9]
# ---------- export_image_by_view_archi_lab.python (101 lines) ----------
#Copyright(c) 2015, Konrad K Sobon
# @arch_laboratory, http://archi-lab.net

import clr
clr.AddReference('ProtoGeometry')
from Autodesk.DesignScript.Geometry import *

# Import Element wrapper extension methods
clr.AddReference('RevitNodes')
import Revit
clr.ImportExtensions(Revit.Elements)

# Import geometry conversion extension methods
clr.ImportExtensions(Revit.GeometryConversion)

# Import DocumentManager and TransactionManager
clr.AddReference('RevitServices')
import RevitServices
from RevitServices.Persistence import DocumentManager
from RevitServices.Transactions import TransactionManager

doc = DocumentManager.Instance.CurrentDBDocument
uiapp = DocumentManager.Instance.CurrentUIApplication
app = uiapp.Application

# Import RevitAPI
clr.AddReference('RevitAPI')
import Autodesk
from Autodesk.Revit.DB import *

import System
from System import Array
from System.Collections.Generic import *

import sys
pyt_path = r'C:\Program Files (x86)\IronPython 2.7\Lib'
sys.path.append(pyt_path)

#The inputs to this node will be stored as a list in the IN variable.
dataEnteringNode = IN

views = UnwrapElement(IN[0])
filePath = IN[1]
exportRange = System.Enum.Parse(Autodesk.Revit.DB.ExportRange, IN[2])
fileType = System.Enum.Parse(Autodesk.Revit.DB.ImageFileType, IN[3])
zoomType = System.Enum.Parse(Autodesk.Revit.DB.ZoomFitType, IN[4])
pixelSize = IN[5]
imageRes = System.Enum.Parse(Autodesk.Revit.DB.ImageResolution, IN[6])
zoom = IN[7]
fitDirection = System.Enum.Parse(Autodesk.Revit.DB.FitDirectionType, IN[8])
RunIt = IN[9]

def CreateViewSet(views):
	viewSet = List[ElementId]()
	for i in views:
		viewSet.Add(i.Id)
	return viewSet

if RunIt:
	try:
		errorReport = None
		ieo = ImageExportOptions()
		ieo.FilePath = filePath
		
		if fileType != None:
			ieo.HLRandWFViewsFileType = fileType
		
		if zoomType != None:
			ieo.ZoomType = zoomType
			if ieo.ZoomType == ZoomFitType.FitToPage:
				if imageRes != None:
					ieo.ImageResolution = imageRes
				if pixelSize != None:
					ieo.PixelSize = pixelSize
				if fitDirection != None:
					ieo.FitDirection = fitDirection
			elif ieo.ZoomType == ZoomType.Zoom:
				if zoom != None:
					ieo.Zoom = zoom
		
		if len(views) > 1:
			ieo.ExportRange = ExportRange.SetOfViews
			ieo.SetViewsAndSheets(CreateViewSet(views))
		else:
			ieo.ExportRange = exportRange
		
		TransactionManager.Instance.EnsureInTransaction(doc)
		doc.ExportImage(ieo)
		TransactionManager.Instance.TransactionTaskDone()
	except:
		# if error accurs anywhere in the process catch it
		import traceback
		errorReport = traceback.format_exc()
else:
	errorReport = "RunIt is set to False."

#Assign your output to the OUT variable
if errorReport == None:
	OUT = views
else:
	OUT = errorReport
# ----------------------------------------
categories_3 = Categories()  # frozen
all_elements_of_category_2 = ElementsOfCategory(categories_3)

# group: Get Revit Selection:
forceChildrensEval_4 = ForceChildrensEval()  # frozen; unwired: arg0
pys_get_revit_selection = Python(IN[0]=forceChildrensEval_4)
# ---------- pys_get_revit_selection.python (22 lines) ----------
import clr
clr.AddReference('RevitServices')
clr.AddReference('RevitAPI')
from Autodesk.Revit.DB import *
import RevitServices
from RevitServices.Persistence import DocumentManager
from Autodesk.Revit.ApplicationServices import Application

reset = IN[0]

doc = DocumentManager.Instance.CurrentDBDocument
uidoc = DocumentManager.Instance.CurrentUIApplication.ActiveUIDocument
ids = uidoc.Selection.GetElementIds()

idd = [str(i) for i in ids]

if isinstance(idd, list) == True:
	elems = [doc.GetElement(ElementId(int(i))) for i in idd]
else:
	elems = doc.GetElement(ElementId(int(idd)))

OUT = elems
# ----------------------------------------

parameters = Element.Parameters()  # unwired: arg0
# note: ВСЁ ОСТАЛЬНОЕ
getParameterValueByName_5 = Element.GetParameterValueByName()  # unwired: element, parameterName
boolean = BoolSelector(true)  # frozen
code_block_10 = CodeBlock { 1; 2; }
if_3 = Python(IN[0]=boolean, IN[1]=code_block_10.out0, IN[2]=code_block_10.out1)
# ---------- if_3.python (12 lines) ----------
import clr
boolean = IN[0]
true = UnwrapElement(IN[1])
false = UnwrapElement(IN[2])

if boolean:
	out = true
else:
	out = false

#Назначьте вывод переменной OUT.
OUT = out
# ----------------------------------------
geometry = Element.Geometry()  # unwired: arg0
setParameterByName_2 = Element.SetParameterByName()  # unwired: element, parameterName, value

# group: Parameters name from language
parameters_name_from_language = Python()  # frozen
# ---------- parameters_name_from_language.python (18 lines) ----------
import clr
clr.AddReference('RevitServices')
import RevitServices
from RevitServices.Persistence import DocumentManager

uiapp = DocumentManager.Instance.CurrentUIApplication
app = uiapp.Application
lng = app.Language
rus = ["Тип","Имя семейства","Имя типа"]
enu = ["Type","Family name","Type name"]
out = []
if str(lng) == "Russian":
	out = rus
else:
	out = enu
#English_USA
#Russian
OUT = out
# ----------------------------------------

# group: элементы внутри групп
members = Python()  # "Group.Members"; frozen; unwired: IN[0]
# ---------- members.python (19 lines) ----------
import clr
clr.AddReference('RevitAPI')
from Autodesk.Revit.DB import *

clr.AddReference("RevitNodes")
import Revit
clr.ImportExtensions(Revit.Elements)

groups = UnwrapElement(IN[0])
elementlist = list()
for item in groups:
	try:
		memberlist = list()
		for member in item.GetMemberIds():
			memberlist.append(item.Document.GetElement(member))
		elementlist.append(memberlist)
	except:
		elementlist.append(list())
OUT = elementlist
# ----------------------------------------

shablon_python_shablon = Python()  # frozen; unwired: IN[0]
# ---------- shablon_python_shablon.python (69 lines) ----------
# -*- coding: utf-8 -*- 
#-----------------------Импоорт библиотек----------------------
import clr
clr.AddReference('RevitAPI')
import Autodesk
from Autodesk.Revit.DB import *

clr.AddReference("RevitNodes") 
import Revit
from Revit.Elements import *

clr.ImportExtensions(Revit.Elements) #ToDSType не работает без
clr.ImportExtensions(Revit.GeometryConversion)

clr.AddReference("RevitServices")
import RevitServices
from RevitServices.Persistence import DocumentManager
from RevitServices.Transactions import TransactionManager

clr.AddReference('ProtoGeometry')
from Autodesk.DesignScript.Geometry import *

#-----------------------ИМПОРТ БИБЛИОТЕК----------------------
"""-"""
#-----------------------ФУНКЦИИ----------------------

def __x__(x):
	x="x"
	return x
	
#-----------------------ФУНКЦИИ----------------------
"""-"""
#-----------------------АПИ ПАРАМЕТРЫ----------------------

doc = DocumentManager.Instance.CurrentDBDocument
#link_doc = UnwrapElement(IN[1])
#uiapp = DocumentManager.Instance.CurrentUIApplication
#app = uiapp.Application
#version = app.VersionNumber
#options = Autodesk.Revit.DB.SpatialElementBoundaryOptions()
calculator = SpatialElementGeometryCalculator(doc)

#-----------------------АПИ ПАРАМЕТРЫ----------------------
"""-"""
#-----------------------РАБОЧИЕ ПАРАМЕТРЫ----------------------

rooms = UnwrapElement(IN[0])

#-----------------------РАБОЧИЕ ПАРАМЕТРЫ----------------------	
"""-"""
#-----------------------ТЕСТОВЫЕ ПАРАМЕТРЫ----------------------

test = []

#-----------------------ТЕСТОВЫЕ ПАРАМЕТРЫ----------------------
"""-"""
#-----------------------НАЧАЛО СКРИПТА----------------------

x = 0
if rooms == None:
	rooms = [0,0]

for room in rooms:
	x=__x__(x)+__x__(x)
#TransactionManager.Instance.EnsureInTransaction(doc)
#TransactionManager.Instance.TransactionTaskDone()
#-----------------------КОНЕЦ СКРИПТА----------------------

OUT = x
# ----------------------------------------
members_2 = Python()  # "Object.Members"; frozen; unwired: IN[0]
# ---------- members_2.python (14 lines) ----------
import clr

items = IN[0]
elementlist = list()

try:
	clr.AddReference('RevitAPI')
	from Autodesk.Revit.DB import *
	for item in items:
		elementlist.append(dir(UnwrapElement(item)))
except:
	for item in items:
		elementlist.append(dir(item))
OUT = elementlist
# ----------------------------------------
путь_к_файлу_python = Filename(".\N.Отделка помещений_сбор элементов вокруг_1.7.py")  # frozen
forceChildrensEval_5 = ForceChildrensEval()  # frozen; unwired: arg0
не_читает_кирилицу = Python(IN[0]=путь_к_файлу_python, IN[1]=forceChildrensEval_5)
# ---------- не_читает_кирилицу.python (9 lines) ----------
try:
	filePath = IN[0]

	with open(filePath, 'rb') as inf:
	    lines = inf.readlines()

	OUT = ''.join(lines)
except Exception, e:
	OUT = "No file"
# ----------------------------------------
python_script_from_string = PythonStringNode(script=не_читает_кирилицу)  # unwired: IN[0]
regenerate_2 = Python()  # frozen; unwired: IN[0]; same code as regenerate
categories_4 = Categories("Walls")
удаляем_все_изображения = BoolSelector(false)
удаляем_все_изображения_2 = Python(IN[0]=удаляем_все_изображения)
# ---------- удаляем_все_изображения_2.python (35 lines) ----------
if IN[0] == True:
	import clr
	
	# Import DocumentManager and TransactionManager
	clr.AddReference("RevitServices")
	import RevitServices
	from RevitServices.Persistence import DocumentManager
	from RevitServices.Transactions import TransactionManager
	
	#clr.AddReference("RevitNodes") 
	#import Revit
	#from Revit.Elements import *
	#clr.ImportExtensions(Revit.Elements)
	
	# Import RevitAPI
	clr.AddReference("RevitAPI")
	import Autodesk
	from Autodesk.Revit.DB import FilteredElementCollector, BuiltInCategory, ImageType
	
	doc = DocumentManager.Instance.CurrentDBDocument
	
	
	collector = FilteredElementCollector(doc)
	x=0
	TransactionManager.Instance.EnsureInTransaction(doc)
	sheets = collector.OfClass(ImageType).WhereElementIsElementType().ToElementIds()
	sheetInstances = []
	for i in sheets:
		doc.Delete(i)
		x=x+1
	TransactionManager.Instance.TransactionTaskDone()
	
	OUT = x
else:
	OUT = "скрипт не выполнен"
# ----------------------------------------
