# Dynamo graph D1.3 Посмотреть объём выбранных элементов.dyn (Dynamo 1.3.4.6666)

выбрать_элементы_модели = DSModelElementsSelection()  # 6 picked in the model; frozen
перезапуск = BoolSelector(true)
# note: Выбрать элементы модели (методом API)
выбрать_элементы_модели_методом = Python(IN[0]=перезапуск)  # "Выбрать элементы модели (методом API)"
# ---------- выбрать_элементы_модели_методом.python (45 lines) ----------
# -*- coding: utf-8 -*-
# region Подключение библиотек
import sys
sys.path.append("C:\\Program Files (x86)\\IronPython 2.7\\Lib")

import clr
clr.AddReference("RevitAPIUI")
from Autodesk.Revit.UI import Selection
from Autodesk.Revit.UI.Selection import ISelectionFilter

clr.AddReference("RevitServices")
from RevitServices.Persistence import DocumentManager
from RevitServices.Transactions import TransactionManager
clr.AddReference('RevitAPI')
from Autodesk.Revit.DB import *  # Options, PartUtils, LinkElementId, 


# region Общие классы функции и параметры
class CustomIDuplicateTypeNamesHandler(IDuplicateTypeNamesHandler):
	def OnDuplicateTypeNamesFound(self, duplicate_type_names_handler_args):
		return DuplicateTypeAction.UseDestinationTypes


class TimeCounter:
	def __init__(self):
		self.time = System.Diagnostics.Stopwatch.StartNew()
		self.time.Start()
	def stop(self):
		self.time.Stop()
		return self.time.Elapsed


class CustomISelectionFilterList(ISelectionFilter):
	def AllowElement(self, e):
			return True
	def AllowReference(self, ref, point):
			return True

doc = DocumentManager.Instance.CurrentDBDocument
uidoc = DocumentManager.Instance.CurrentUIApplication.ActiveUIDocument
			
sel1 = uidoc.Selection
elements_referenses = sel1.PickObjects(Selection.ObjectType.Element, CustomISelectionFilterList(), "Select elements and press Finish.")

OUT = [doc.GetElement(ref.ElementId) for ref in elements_referenses]
# ----------------------------------------
code_block = CodeBlock { "Объем"; }
getParameterValueByName = Element.GetParameterValueByName(element=выбрать_элементы_модели_методом, parameterName=code_block)
string_from_object = FromObject(getParameterValueByName)
length = String.Length(string_from_object)
code_block_2 = CodeBlock(x=length) { x>0; }
filterByBoolMask = List.FilterByBoolMask(list=getParameterValueByName, mask=code_block_2)
sum = Math.Sum(filterByBoolMask.in)
объём_выбранных_элементов = Watch(sum)
