# Dynamo graph D2 Посмотреть объём выбранных элементов.dyn "Посмотреть объём выбранных элементов" (Dynamo 2.3.0.5885)

выбрать_элементы = DSModelElementsSelection()  # 7 picked in the model; graph input
code_block = CodeBlock { "Объем"; }
getParameterValueByName = Element.GetParameterValueByName(element=выбрать_элементы, parameterName=code_block)
string_from_object = FromObject(obj=getParameterValueByName)
length = String.Length(str=string_from_object)
code_block_2 = CodeBlock(x=length) { x>0; }
filterByBoolMask = List.FilterByBoolMask(list=getParameterValueByName, mask=code_block_2)
sum = Math.Sum(values=filterByBoolMask.in)
сумма_выбранных_элементов = Watch(sum)  # graph output
