# Dynamo graph from Revit To Navis_0.7.dyn (Dynamo 1.3.3.4111)

# note: ВСЁ ОСТАЛЬНОЕ

# group: ЭЛЕМЕНТЫ УПРАВЛЕНИЯ
# note: ПЕРЕМЕННЫЕ ЗНАЧЕНИЯ
# note: ЭЛЕМЕНТЫ УПРАВЛЕНИЯ

# group: ПОЛУЧАЕМ ДАННЫЕ ИЗ РЕВИТ
# note: ПОЛУЧАЕМ ДАННЫЕ ИЗ РЕВИТ

# group: ПРОВЕРОЧНЫЕ НОДЫ
# note: ПРОВЕРОЧНЫЕ НОДЫ

# group: ИСПОЛНИТЕЛЬНЫЕ НОДЫ (фильтрование, подбор, списки и т.д.)
# note: ИСПОЛНИТЕЛЬНЫЕ НОДЫ
# note: НОДЫ РАБОТАЮЩИЕ С ДАННЫМИ

# group: ЭЛЕМЕНТЫ УПРАВЛЕНИЯ 2 УРОВЕНЬ
# note: ЭЛЕМЕНТЫ УПРАВЛЕНИЯ
# note: ПЕРЕМЕННЫЕ ЗНАЧЕНИЯ

# group: ПЕРЕДАЁМ ИНФОРМАЦИЮ В РЕВИТ
# note: ПЕРЕДАЁМ ИНФОРМАЦИЮ В РЕВИТ

# group: ПРИМЕЧАНИЯ ПО ЦВЕТОВОЙ ГРУППИРОВКЕ
# note: GUIDELINES

# group: КЛЮЧЕВЫЕ МОМЕНТЫ РАБОТЫ 1
# note: ИТОГОВАЯ КОНСОЛИДАЦИЯ ДАННЫХ

# group: ЭЛЕМЕНТЫ УПРАВЛЕНИЯ Dyno Studio
# note: Dyno Studio

# group: КЛЮЧЕВЫЕ МОМЕНТЫ РАБОТЫ 2
# note: НОДЫ РАБОТАЮЩИЕ С ДАННЫМИ
# note: ИСПОЛНИТЕЛЬНЫЕ НОДЫ

# group: ЗАПАСНЫЕ ВАРИАНТЫ, ДОПОЛНИТЕЛЬНЫЕ ОПЦИИ
# note: ЗАПАСНЫЕ
# note: ДОПОЛНИТЕЛЬНЫЕ. Градации серово по важности, темнее - важнее

# group: ИСПОЛНИТЕЛЬНЫЕ НОДЫ 2 (фильтрование, подбор, списки и т.д.)
# note: НОДЫ РАБОТАЮЩИЕ С ДАННЫМИ
# note: ИСПОЛНИТЕЛЬНЫЕ НОДЫ

all_elements_in_active_view = ElementsInView()
string_from_object = FromObject(all_elements_in_active_view)
code_block = CodeBlock { "Group"; }
contains = String.Contains(str=string_from_object, searchFor=code_block)
filterByBoolMask = List.FilterByBoolMask(list=all_elements_in_active_view, mask=contains)

# group: элементы внутри групп
members = Python(IN[0]=filterByBoolMask.in)  # "Group.Members"
# ---------- members.python (19 lines) ----------
import clr
clr.AddReference('RevitAPI')
from Autodesk.Revit.DB import *

clr.AddReference("RevitNodes")
import Revit
clr.ImportExtensions(Revit.Elements)

groups = UnwrapElement(IN[0])
elementlist = list()
for item in groups:
	try:
		memberlist = list()
		for member in item.GetMemberIds():
			memberlist.append(item.Document.GetElement(member))
		elementlist.append(memberlist)
	except:
		elementlist.append(list())
OUT = elementlist
# ----------------------------------------

create = List.Create(members, filterByBoolMask.out)
flatten = Flatten(create)
code_block_2 = CodeBlock { "*Описание элемента"; }  # frozen
getParameterValueByName = Element.GetParameterValueByName(element=flatten, parameterName=code_block_2)
uniqueItems = List.UniqueItems(getParameterValueByName)
save_path_and_filename = StringInput("C:\test\xml\Корпус1 Секция 1.xml")
start_FOLDER = StringInput("""<?xml version="1.0" encoding="UTF-8" ?>

<exchange xmlns:xsi="http://www.w3.org/2001/XMLSchema-instance" xsi:noNamespaceSchemaLocation="http://download.autodesk.com/us/navisworks/schemas/nw-exchange-12.0.xsd" units="ft">
  <selectionsets>
    <viewfolder name="xxxFOLDERxxx" guid="xxxFOLDERxGUIDxxx">
      xxxFOLDER2SETxxx
    </viewfolder>
  </selectionsets>
</exchange>""")
watch = Watch(start_FOLDER)
folder1_name = StringInput("АР")
guid_generator = Python()
# ---------- guid_generator.python (5 lines) ----------
from System import Guid

temp = Guid.NewGuid().ToString()

OUT = temp
# ----------------------------------------
FOLDER2 = StringInput("""      <viewfolder name="xxxFOLDER2xxx" guid="xxxFOLDER2xGUIDxxx">
 xxxSELECTIONSETxxx
      </viewfolder>""")
watch_2 = Watch(FOLDER2)

# group: Parameters name from language
parameters_name_from_language = Python()
# ---------- parameters_name_from_language.python (18 lines) ----------
import clr
clr.AddReference('RevitServices')
import RevitServices
from RevitServices.Persistence import DocumentManager

uiapp = DocumentManager.Instance.CurrentUIApplication
app = uiapp.Application
lng = app.Language
rus = ["Тип","Имя семейства","Имя типа"]
enu = ["Type","Family Name","Type Name"]
out = []
if str(lng) == "Russian":
	out = rus
else:
	out = enu
#English_USA
#Russian
OUT = out
# ----------------------------------------

code_block_3 = CodeBlock(Tp_Pr=parameters_name_from_language) { Tp_Pr[0]; }
getParameterValueByName_2 = Element.GetParameterValueByName(element=flatten, parameterName=code_block_3)
uniqueItems_2 = List.UniqueItems(getParameterValueByName_2)
type = Object.Type(uniqueItems_2)
code_block_4 = CodeBlock { "String"; }
contains_2 = String.Contains(str=type, searchFor=code_block_4)
filterByBoolMask_2 = List.FilterByBoolMask(list=uniqueItems_2, mask=contains_2)
code_block_5 = CodeBlock(TyNm_Pr=parameters_name_from_language) { TyNm_Pr[2]; }
getParameterValueByName_3 = Element.GetParameterValueByName(element=filterByBoolMask_2.out, parameterName=code_block_5)
getCategory = Element.GetCategory(filterByBoolMask_2.out)
string_from_object_2 = FromObject(getCategory)
SELECTIONSET = StringInput("""        <selectionset name="xxxNAVISNAMExxx" guid="xxxGUIDxxx">
          <findspec mode="all" disjoint="0">
            <conditions>
              <condition test="equals" flags="10">
                <property>
                  <name internal="LcOaSceneBaseClassUserName">Тип</name>
                </property>
                <value>
                  <data type="wstring">xxxTYPExxx</data>
                </value>
              </condition>
       <condition test="equals" flags="10">
                <property>
                  <name internal="LcOaNodeSourceFile">Файл источника</name>
                </property>
                <value>
                  <data type="wstring">xxxFILExxx</data>
                </value>
              </condition>
            </conditions>
            <locator>/</locator>
          </findspec>
        </selectionset>""")
watch_3 = Watch(SELECTIONSET)
current = Document.Current()
filePath = Document.FilePath(current)
split_string = StringInput("\")
split = String.Split(filePath, split_string)
lastItem = List.LastItem(split)
code_block_6 = CodeBlock(FmNm_Pr=parameters_name_from_language) { FmNm_Pr[1]; }
getParameterValueByName_4 = Element.GetParameterValueByName(element=filterByBoolMask_2.out, parameterName=code_block_6)

# group: Прячем запятые
code_block_7 = CodeBlock { ","; "Æ"; }
replace = String.Replace(str=getParameterValueByName_3, searchFor=code_block_7.out0, replaceWith=code_block_7.out1)
replace_2 = String.Replace(str=getParameterValueByName_4, searchFor=code_block_7.out0, replaceWith=code_block_7.out1)

groupByKey = List.GroupByKey(list=replace, keys=string_from_object_2)

# group: GUID for FOLDER2
code_block_8 = CodeBlock(FOLDER2=groupByKey.unique_keys) { FOLDER2; }
count = List.Count(code_block_8)
code_block_9 = CodeBlock(x=count) { 1..x; }
guid_generator_2 = Python(IN[0]=code_block_9)
# ---------- guid_generator_2.python (11 lines) ----------
from System import Guid
inputlist = IN[0]
uuidlist = list()
uuidstrs = list()
for i in inputlist:
	temp = Guid.NewGuid()
	asString = temp.ToString()
	uuidlist.append(temp)
	uuidstrs.append(asString)

OUT = uuidstrs
# ----------------------------------------

# group: GUID for SELECTIONSET
code_block_10 = CodeBlock(groups_of_elements=groupByKey.groups) { groups_of_elements; }
count_2 = List.Count(code_block_10@L2)
code_block_11 = CodeBlock(x=count_2) { 1..x; }
guid_generator_3 = Python(IN[0]=code_block_11)
# ---------- guid_generator_3.python (14 lines) ----------
from System import Guid

inputlist = IN[0]
uuidstrs = []

for il in inputlist:
	uuid = []
	for i in il:
		temp = Guid.NewGuid()
		asString = temp.ToString()
		uuid.append(asString)
	uuidstrs.append(uuid)

OUT = uuidstrs
# ----------------------------------------

code_block_12 = CodeBlock(cat=getCategory, fam=replace_2, type=replace) { cat+": "+fam+": "+type; }
groupByKey_2 = List.GroupByKey(list=code_block_12, keys=string_from_object_2)

# group: SELECTIONSET
code_block_13 = CodeBlock { "xxxFILExxx"; "xxxNAVISNAMExxx"; "xxxGUIDxxx"; "xxxTYPExxx"; }
replace_3 = String.Replace(str=watch_3, searchFor=code_block_13.out0, replaceWith=lastItem)
replace_4 = String.Replace(str=replace_3, searchFor=code_block_13.out1, replaceWith=groupByKey.groups, lacing=Longest)
replace_5 = String.Replace(str=replace_4, searchFor=code_block_13.out2, replaceWith=guid_generator_3)
replace_6 = String.Replace(str=replace_5, searchFor=code_block_13.out3, replaceWith=groupByKey_2.groups)
watch_4 = Watch(replace_6)

string_from_array = FromArray()  # unwired: arg0
map = List.Map(list=watch_4, f_x=string_from_array)
code_block_14 = CodeBlock { "{"; "\r"; }
replace_7 = String.Replace(str=map, searchFor=code_block_14.out0, replaceWith=code_block_14.out1)
code_block_15 = CodeBlock { "}"; "\r"; }
replace_8 = String.Replace(str=replace_7, searchFor=code_block_15.out0, replaceWith=code_block_15.out1)
code_block_16 = CodeBlock { ","; "\r"; }
replace_9 = String.Replace(str=replace_8, searchFor=code_block_16.out0, replaceWith=code_block_16.out1)

# group: FOLDER 2
code_block_17 = CodeBlock { "xxxFOLDER2xxx"; "xxxFOLDER2xGUIDxxx"; "xxxSELECTIONSETxxx"; }
replace_10 = String.Replace(str=watch_2, searchFor=code_block_17.out0, replaceWith=code_block_8, lacing=Longest)
replace_11 = String.Replace(str=replace_10, searchFor=code_block_17.out1, replaceWith=guid_generator_2)
replace_12 = String.Replace(str=replace_11, searchFor=code_block_17.out2, replaceWith=replace_9)

string_from_array_2 = FromArray(replace_12)
code_block_18 = CodeBlock { "{"; "\r"; }
replace_13 = String.Replace(str=string_from_array_2, searchFor=code_block_18.out0, replaceWith=code_block_18.out1)
code_block_19 = CodeBlock { "}"; "\r"; }
replace_14 = String.Replace(str=replace_13, searchFor=code_block_19.out0, replaceWith=code_block_19.out1)
code_block_20 = CodeBlock { ","; "\r"; }
replace_15 = String.Replace(str=replace_14, searchFor=code_block_20.out0, replaceWith=code_block_20.out1)

# group: FOLDER 1
code_block_21 = CodeBlock { "xxxFOLDERxxx"; "xxxFOLDERxGUIDxxx"; "xxxFOLDER2SETxxx"; }
replace_16 = String.Replace(str=watch, searchFor=code_block_21.out0, replaceWith=folder1_name)
replace_17 = String.Replace(str=replace_16, searchFor=code_block_21.out1, replaceWith=guid_generator)
replace_18 = String.Replace(str=replace_17, searchFor=code_block_21.out2, replaceWith=replace_15)

# group: Возвращаем запятые
code_block_22 = CodeBlock { ","; "Æ"; }
replace_19 = String.Replace(str=replace_18, searchFor=code_block_22.out1, replaceWith=code_block_22.out0)

writeToFile = CSV.WriteToFile(save_path_and_filename, replace_19)
