# Dynamo graph from Revit To Navis_0.9_(Parts_по толщине части, не читается нормально в Невис).dyn (Dynamo 1.3.3.4111)

# note: ВСЁ ОСТАЛЬНОЕ

# group: ЗАПАСНЫЕ ВАРИАНТЫ, ДОПОЛНИТЕЛЬНЫЕ ОПЦИИ
# note: ДОПОЛНИТЕЛЬНЫЕ. Градации серово по важности, темнее - важнее
# note: ЗАПАСНЫЕ

# group: КЛЮЧЕВЫЕ МОМЕНТЫ РАБОТЫ 1
# note: КОНСОЛИДАЦИЯ И СЛОЖНЫЕ ОБРАБОТКИ

# group: КЛЮЧЕВЫЕ МОМЕНТЫ РАБОТЫ 2
# note: УСЛОЖНЕННЫЕ КОНСТРУКЦИИ
# note: УСЛОЖНЕНЫЕ КОНСТРУКЦИИ

# group: Python ноды
# note: Python

# group: Запуск питона из внешнего файла
# note: Py - files

# group: ЭЛЕМЕНТЫ УПРАВЛЕНИЯ
# note: ПЕРЕМЕННЫЕ ЗНАЧЕНИЯ
# note: ЭЛЕМЕНТЫ УПРАВЛЕНИЯ

# group: ПОЛУЧАЕМ ДАННЫЕ
# note: ПОЛУЧАЕМ ДАННЫЕ ИЗ РЕВИТ и других источников

# group: ПРОВЕРОЧНЫЕ НОДЫ
# note: ПРОВЕРОЧНЫЕ НОДЫ

# group: ИСПОЛНИТЕЛЬНЫЕ НОДЫ (фильтрование, подбор, списки и т.д.)
# note: ИСПОЛНИТЕЛЬНЫЕ НОДЫ

# group: ПЕРЕДАЁМ ИНФОРМАЦИЮ
# note: ПЕРЕДАЁМ ИНФОРМАЦИЮ В РЕВИТ
# note: ПЕРЕДАЁМ ИНФОРМАЦИЮ ЕЩЁ КУДА-ТО

# group: ЭЛЕМЕНТЫ УПРАВЛЕНИЯ 2 УРОВЕНЬ
# note: ЭЛЕМЕНТЫ УПРАВЛЕНИЯ
# note: ПЕРЕМЕННЫЕ ЗНАЧЕНИЯ

# group: ПРИМЕЧАНИЯ ПО ЦВЕТОВОЙ ГРУППИРОВКЕ
# note: GUIDELINES

save_path_and_filename = StringInput("C:\test\xml\Корпус1 Секция 1 (parts).xml")
start_FOLDER = StringInput("""<?xml version="1.0" encoding="UTF-8" ?>

<exchange xmlns:xsi="http://www.w3.org/2001/XMLSchema-instance" xsi:noNamespaceSchemaLocation="http://download.autodesk.com/us/navisworks/schemas/nw-exchange-12.0.xsd" units="ft">
  <selectionsets>
    <viewfolder name="xxxFOLDERxxx" guid="xxxFOLDERxGUIDxxx">
      xxxFOLDER2SETxxx
    </viewfolder>
  </selectionsets>
</exchange>""")
watch = Watch(start_FOLDER)
folder1_name = StringInput("ЧАСТИ")
guid_generator = Python()
# ---------- guid_generator.python (5 lines) ----------
from System import Guid

temp = Guid.NewGuid().ToString()

OUT = temp
# ----------------------------------------
FOLDER2 = StringInput("""      <viewfolder name="xxxFOLDER2xxx" guid="xxxFOLDER2xGUIDxxx">
 xxxSELECTIONSETxxx
      </viewfolder>""")
watch_2 = Watch(FOLDER2)
all_elements_in_active_view = ElementsInView()
getCategory = Element.GetCategory(all_elements_in_active_view)
code_block = CodeBlock(x=getCategory) { x=="Части"; }
filterByBoolMask = List.FilterByBoolMask(list=all_elements_in_active_view, mask=code_block)

# group: Parameters name from language
parameters_name_from_language = Python()
# ---------- parameters_name_from_language.python (18 lines) ----------
import clr
clr.AddReference('RevitServices')
import RevitServices
from RevitServices.Persistence import DocumentManager

uiapp = DocumentManager.Instance.CurrentUIApplication
app = uiapp.Application
lng = app.Language
rus = ["Толщина","Материал","Имя","Исходный тип"]
enu = ["Which","Material","Name","Source type"]
out = []
if str(lng) == "Russian":
	out = rus
else:
	out = enu
#English_USA
#Russian
OUT = out
# ----------------------------------------

code_block_2 = CodeBlock(FmNm_Pr=parameters_name_from_language) { FmNm_Pr[1]; FmNm_Pr[2]; }
getParameterValueByName = Element.GetParameterValueByName(element=filterByBoolMask.in, parameterName=code_block_2.out0)
getParameterValueByName_2 = Element.GetParameterValueByName(element=getParameterValueByName, parameterName=code_block_2.out1)
SELECTIONSET = StringInput("""<selectionset name="xxxNAVISNAMExxx" guid="xxxGUIDxxx">
      <findspec mode="all" disjoint="0">
        <conditions>
          <condition test="equals" flags="10">
            <property>
              <name internal="LcOaNodeSourceFile">Файл источника</name>
            </property>
            <value>
              <data type="wstring">xxxFILExxx</data>
            </value>
          </condition>
          <condition test="equals" flags="10">
            <category>
              <name internal="LcRevitData_Element">Element</name>
            </category>
            <property>
              <name internal="lcldrevit_parameter_-1001134">Толщина</name>
            </property>
            <value>
              <data type="linear">xxxTYPExxx</data>
            </value>
          </condition>
          <condition test="equals" flags="10">
            <category>
              <name internal="LcOaExMaterial">Материал</name>
            </category>
            <property>
              <name internal="LcOaSceneBaseUserName">Имя</name>
            </property>
            <value>
              <data type="wstring">xxxMATxxx</data>
            </value>
          </condition>
        </conditions>
        <locator>/</locator>
      </findspec>
    </selectionset>""")
watch_3 = Watch(SELECTIONSET)
current = Document.Current()
filePath = Document.FilePath(current)
split_string = StringInput("\")
split = String.Split(filePath, split_string)
lastItem = List.LastItem(split)
code_block_3 = CodeBlock(TyNm_Pr=parameters_name_from_language) { TyNm_Pr[0]; }
getParameterValueByName_3 = Element.GetParameterValueByName(element=filterByBoolMask.in, parameterName=code_block_3)
code_block_4 = CodeBlock(w=getParameterValueByName_3) { w/1000; }
string_from_object = FromObject(code_block_4)
code_block_5 = CodeBlock { 0; 5; }
substring = String.Substring(str=string_from_object, startIndex=code_block_5.out0, length=code_block_5.out1)
code_block_6 = CodeBlock(w=getParameterValueByName_3) { w/1000*3.28084; }
string_from_object_2 = FromObject(code_block_6)
code_block_7 = CodeBlock { ","; "."; }
replace = String.Replace(str=string_from_object_2, searchFor=code_block_7.out0, replaceWith=code_block_7.out1)

# group: Прячем запятые
code_block_8 = CodeBlock { ","; "Æ"; }
replace_2 = String.Replace(str=getParameterValueByName_2, searchFor=code_block_8.out0, replaceWith=code_block_8.out1)
replace_3 = String.Replace(str=substring, searchFor=code_block_8.out0, replaceWith=code_block_8.out1)
code_block_9 = CodeBlock(material=replace_2, source_type=replace) { material; source_type; }

flatten = Flatten(replace_2)

# group (continued): Прячем запятые
uniqueItems = List.UniqueItems(flatten)

# group: GUID for FOLDER2
code_block_10 = CodeBlock(FOLDER2=uniqueItems) { FOLDER2; }
count = List.Count(code_block_10)
code_block_11 = CodeBlock(x=count) { 1..x; }
guid_generator_2 = Python(IN[0]=code_block_11)
# ---------- guid_generator_2.python (11 lines) ----------
from System import Guid
inputlist = IN[0]
uuidlist = list()
uuidstrs = list()
for i in inputlist:
	temp = Guid.NewGuid()
	asString = temp.ToString()
	uuidlist.append(temp)
	uuidstrs.append(asString)

OUT = uuidstrs
# ----------------------------------------

flatten_2 = Flatten(replace_3)
groupByKey = List.GroupByKey(list=flatten_2, keys=flatten)
uniqueItems_2 = List.UniqueItems(groupByKey.groups@L2)

# group: GUID for SELECTIONSET
code_block_12 = CodeBlock(groups_of_elements=uniqueItems_2) { groups_of_elements; }
count_2 = List.Count(code_block_12@L2)
code_block_13 = CodeBlock(x=count_2) { 1..x; }
guid_generator_3 = Python(IN[0]=code_block_13)
# ---------- guid_generator_3.python (14 lines) ----------
from System import Guid

inputlist = IN[0]
uuidstrs = []

for il in inputlist:
	uuid = []
	for i in il:
		temp = Guid.NewGuid()
		asString = temp.ToString()
		uuid.append(asString)
	uuidstrs.append(uuid)

OUT = uuidstrs
# ----------------------------------------

ofRepeatedItem = List.OfRepeatedItem(item=uniqueItems@L1, amount=count_2@L1)

# group (continued): GUID for SELECTIONSET
code_block_14 = CodeBlock(N=code_block_13, Mat=ofRepeatedItem, Typ=code_block_12) { N+") "+Mat+"_____"+Typ; }

flatten_3 = Flatten(replace)
groupByKey_2 = List.GroupByKey(list=flatten_3, keys=flatten)
uniqueItems_3 = List.UniqueItems(groupByKey_2.groups@L2)

# group: SELECTIONSET
code_block_15 = CodeBlock { "xxxFILExxx"; "xxxNAVISNAMExxx"; "xxxGUIDxxx"; "xxxTYPExxx"; "xxxMATxxx"; }
replace_4 = String.Replace(str=watch_3, searchFor=code_block_15.out0, replaceWith=lastItem)
replace_5 = String.Replace(str=replace_4, searchFor=code_block_15.out1, replaceWith=code_block_14, lacing=Longest)
replace_6 = String.Replace(str=replace_5, searchFor=code_block_15.out2, replaceWith=guid_generator_3)
replace_7 = String.Replace(str=replace_6, searchFor=code_block_15.out3, replaceWith=uniqueItems_3)
replace_8 = String.Replace(str=replace_7, searchFor=code_block_15.out4, replaceWith=ofRepeatedItem)
watch_4 = Watch(replace_8)

string_from_array = FromArray()  # unwired: arg0
map = List.Map(list=watch_4, f_x=string_from_array)
code_block_16 = CodeBlock { "{"; "\r"; }
replace_9 = String.Replace(str=map, searchFor=code_block_16.out0, replaceWith=code_block_16.out1)
code_block_17 = CodeBlock { "}"; "\r"; }
replace_10 = String.Replace(str=replace_9, searchFor=code_block_17.out0, replaceWith=code_block_17.out1)
code_block_18 = CodeBlock { ","; "\r"; }
replace_11 = String.Replace(str=replace_10, searchFor=code_block_18.out0, replaceWith=code_block_18.out1)

# group: FOLDER 2
code_block_19 = CodeBlock { "xxxFOLDER2xxx"; "xxxFOLDER2xGUIDxxx"; "xxxSELECTIONSETxxx"; }
replace_12 = String.Replace(str=watch_2, searchFor=code_block_19.out0, replaceWith=code_block_10, lacing=Longest)
replace_13 = String.Replace(str=replace_12, searchFor=code_block_19.out1, replaceWith=guid_generator_2)
replace_14 = String.Replace(str=replace_13, searchFor=code_block_19.out2, replaceWith=replace_11)

string_from_array_2 = FromArray(replace_14)
code_block_20 = CodeBlock { "{"; "\r"; }
replace_15 = String.Replace(str=string_from_array_2, searchFor=code_block_20.out0, replaceWith=code_block_20.out1)
code_block_21 = CodeBlock { "}"; "\r"; }
replace_16 = String.Replace(str=replace_15, searchFor=code_block_21.out0, replaceWith=code_block_21.out1)
code_block_22 = CodeBlock { ","; "\r"; }
replace_17 = String.Replace(str=replace_16, searchFor=code_block_22.out0, replaceWith=code_block_22.out1)

# group: FOLDER 1
code_block_23 = CodeBlock { "xxxFOLDERxxx"; "xxxFOLDERxGUIDxxx"; "xxxFOLDER2SETxxx"; }
replace_18 = String.Replace(str=watch, searchFor=code_block_23.out0, replaceWith=folder1_name)
replace_19 = String.Replace(str=replace_18, searchFor=code_block_23.out1, replaceWith=guid_generator)
replace_20 = String.Replace(str=replace_19, searchFor=code_block_23.out2, replaceWith=replace_17)

# group: Возвращаем запятые
code_block_24 = CodeBlock { ","; "Æ"; }
replace_21 = String.Replace(str=replace_20, searchFor=code_block_24.out1, replaceWith=code_block_24.out0)

writeToFile = CSV.WriteToFile(save_path_and_filename, replace_21)
string_from_object_3 = FromObject(all_elements_in_active_view)
code_block_25 = CodeBlock { "Group"; }
contains = String.Contains(str=string_from_object_3, searchFor=code_block_25)
parameters = Element.Parameters()  # unwired: arg0
geometry = Element.Geometry()  # unwired: arg0
setParameterByName = Element.SetParameterByName()  # unwired: element, parameterName, value
# note: ВСЁ ОСТАЛЬНОЕ
getParameterValueByName_4 = Element.GetParameterValueByName()  # unwired: element, parameterName

# group: Get Revit Selection:
forceChildrensEval = ForceChildrensEval()  # frozen; unwired: arg0
pys_get_revit_selection = Python(IN[0]=forceChildrensEval)
# ---------- pys_get_revit_selection.python (22 lines) ----------
import clr
clr.AddReference('RevitServices')
clr.AddReference('RevitAPI')
from Autodesk.Revit.DB import *
import RevitServices
from RevitServices.Persistence import DocumentManager
from Autodesk.Revit.ApplicationServices import Application

reset = IN[0]

doc = DocumentManager.Instance.CurrentDBDocument
uidoc = DocumentManager.Instance.CurrentUIApplication.ActiveUIDocument
ids = uidoc.Selection.GetElementIds()

idd = [str(i) for i in ids]

if isinstance(idd, list) == True:
	elems = [doc.GetElement(ElementId(int(i))) for i in idd]
else:
	elems = doc.GetElement(ElementId(int(idd)))

OUT = elems
# ----------------------------------------

boolean = BoolSelector(true)  # frozen
code_block_26 = CodeBlock { 1; 2; }
if_ = Python(IN[0]=boolean, IN[1]=code_block_26.out0, IN[2]=code_block_26.out1)
# ---------- if_.python (12 lines) ----------
import clr
boolean = IN[0]
true = UnwrapElement(IN[1])
false = UnwrapElement(IN[2])

if boolean:
	out = true
else:
	out = false

#Назначьте вывод переменной OUT.
OUT = out
# ----------------------------------------

# group: Parameters name from language
parameters_name_from_language_2 = Python()  # frozen
# ---------- parameters_name_from_language_2.python (18 lines) ----------
import clr
clr.AddReference('RevitServices')
import RevitServices
from RevitServices.Persistence import DocumentManager

uiapp = DocumentManager.Instance.CurrentUIApplication
app = uiapp.Application
lng = app.Language
rus = ["Тип","Имя семейства","Имя типа"]
enu = ["Type","Family name","Type name"]
out = []
if str(lng) == "Russian":
	out = rus
else:
	out = enu
#English_USA
#Russian
OUT = out
# ----------------------------------------

путь_к_файлу_python = Filename(".\N.Отделка помещений_сбор элементов вокруг_1.7.py")  # frozen
forceChildrensEval_2 = ForceChildrensEval()  # unwired: arg0
find_file_and_import_it = Python(IN[0]=путь_к_файлу_python, IN[1]=forceChildrensEval_2)
# ---------- find_file_and_import_it.python (11 lines) ----------
import sys
sys.path.append('C:\Program Files (x86)\IronPython 2.7\Lib')
import codecs

try:
	filePath = IN[0]
	with codecs.open(filePath, 'rb', "utf-8") as inf:
		lines = inf.readlines()
	OUT = ''.join(lines)
except:
	OUT = "No file"
# ----------------------------------------
python_script_from_string = PythonStringNode(script=find_file_and_import_it)  # unwired: IN[0]
categories = Categories()  # frozen
all_elements_of_category = ElementsOfCategory(categories)
regenerate = Python()  # frozen; unwired: IN[0]
# ---------- regenerate.python (26 lines) ----------
import clr

# Import DocumentManager and TransactionManager
clr.AddReference("RevitServices")
import RevitServices
from RevitServices.Persistence import DocumentManager


# Import RevitAPI
clr.AddReference("RevitAPI")
import Autodesk
from Autodesk.Revit.DB import *

doc = DocumentManager.Instance.CurrentDBDocument


#The inputs to this node will be stored as a list in the IN variable.
list = IN[0]


if list:
	doc.Regenerate()
	out = "Regeneration complete"
else:
	out = "fail"
OUT = out
# ----------------------------------------
members = Python()  # "Object.Members"; frozen; unwired: IN[0]
# ---------- members.python (14 lines) ----------
import clr

items = IN[0]
elementlist = list()

try:
	clr.AddReference('RevitAPI')
	from Autodesk.Revit.DB import *
	for item in items:
		elementlist.append(dir(UnwrapElement(item)))
except:
	for item in items:
		elementlist.append(dir(item))
OUT = elementlist
# ----------------------------------------
filteredElementCollector = Python()  # frozen; unwired: IN[0]
# ---------- filteredElementCollector.python (29 lines) ----------
if IN[1]:
	import clr
	
	# Import DocumentManager and TransactionManager
	clr.AddReference("RevitServices")
	import RevitServices
	from RevitServices.Persistence import DocumentManager
	
	
	# Import RevitAPI
	clr.AddReference("RevitAPI")
	import Autodesk
	from Autodesk.Revit.DB import *
	
	doc = DocumentManager.Instance.CurrentDBDocument
	uiapp = DocumentManager.Instance.CurrentUIApplication
	app = uiapp.Application
	
	from System.Collections.Generic import *
	
	
	#The inputs to this node will be stored as a list in the IN variable.
	dataEnteringNode = IN
	collector = FilteredElementCollector(doc)
	elements = collector.OfCategory(BuiltInCategory.OST_Views).ToElements()
	
	OUT = sheetInstances
else:
	OUT = "скрипт не выполнен"
# ----------------------------------------
shablon_python_shablon = Python()  # frozen; unwired: IN[0]
# ---------- shablon_python_shablon.python (74 lines) ----------
# -*- coding: utf-8 -*- 
#-----------------------Импоорт библиотек----------------------
import clr
clr.AddReference('RevitAPI')
import Autodesk
from Autodesk.Revit.DB import *

clr.AddReference("RevitNodes") 
import Revit
from Revit.Elements import *

clr.ImportExtensions(Revit.Elements) #ToDSType не работает без
clr.ImportExtensions(Revit.GeometryConversion) #ToXyz не работает без

clr.AddReference("RevitServices")
import RevitServices
from RevitServices.Persistence import DocumentManager
from RevitServices.Transactions import TransactionManager

clr.AddReference('ProtoGeometry')
from Autodesk.DesignScript.Geometry import *

#-----------------------ИМПОРТ БИБЛИОТЕК----------------------
"""-"""
#-----------------------ФУНКЦИИ----------------------

def __x__(x):
	x="x"
	return x
	
#-----------------------ФУНКЦИИ----------------------
"""-"""
#-----------------------АПИ ПАРАМЕТРЫ----------------------

doc = DocumentManager.Instance.CurrentDBDocument
#link_doc = UnwrapElement(IN[1])
#uiapp = DocumentManager.Instance.CurrentUIApplication
#app = uiapp.Application
#version = app.VersionNumber
#options = Autodesk.Revit.DB.SpatialElementBoundaryOptions()
calculator = SpatialElementGeometryCalculator(doc)

g_id_list = []
g_id_list.append(ElementId(group))

bxList = List[ElementId](g_id_list) #АЙ ЛИСТ КОЛЕКТИОН

#-----------------------АПИ ПАРАМЕТРЫ----------------------
"""-"""
#-----------------------РАБОЧИЕ ПАРАМЕТРЫ----------------------

rooms = UnwrapElement(IN[0])

#-----------------------РАБОЧИЕ ПАРАМЕТРЫ----------------------	
"""-"""
#-----------------------ТЕСТОВЫЕ ПАРАМЕТРЫ----------------------

test = []

#-----------------------ТЕСТОВЫЕ ПАРАМЕТРЫ----------------------
"""-"""
#-----------------------НАЧАЛО СКРИПТА----------------------

x = 0
if rooms == None:
	rooms = [0,0]

for room in rooms:
	x=__x__(x)+__x__(x)
#TransactionManager.Instance.EnsureInTransaction(doc)
#TransactionManager.Instance.TransactionTaskDone()
#-----------------------КОНЕЦ СКРИПТА----------------------

OUT = x
# ----------------------------------------

# group: элементы внутри групп
members_2 = Python()  # "Group.Members"; frozen; unwired: IN[0]
# ---------- members_2.python (19 lines) ----------
import clr
clr.AddReference('RevitAPI')
from Autodesk.Revit.DB import *

clr.AddReference("RevitNodes")
import Revit
clr.ImportExtensions(Revit.Elements)

groups = UnwrapElement(IN[0])
elementlist = list()
for item in groups:
	try:
		memberlist = list()
		for member in item.GetMemberIds():
			memberlist.append(item.Document.GetElement(member))
		elementlist.append(memberlist)
	except:
		elementlist.append(list())
OUT = elementlist
# ----------------------------------------
