# Dynamo graph Оси_в_3Д.dyn (Dynamo 1.3.4.6666)

# group: ЭЛЕМЕНТЫ УПРАВЛЕНИЯ
# note: ПЕРЕМЕННЫЕ ЗНАЧЕНИЯ
# note: ЭЛЕМЕНТЫ УПРАВЛЕНИЯ

# group: ПОЛУЧАЕМ ДАННЫЕ
# note: ПОЛУЧАЕМ ДАННЫЕ ИЗ РЕВИТ и других источников

# group: ПРОВЕРОЧНЫЕ НОДЫ
# note: ПРОВЕРОЧНЫЕ НОДЫ

# group: КЛЮЧЕВЫЕ МОМЕНТЫ РАБОТЫ 1
# note: КОНСОЛИДАЦИЯ И СЛОЖНЫЕ ОБРАБОТКИ

# group: ИСПОЛНИТЕЛЬНЫЕ НОДЫ (фильтрование, подбор, списки и т.д.)
# note: ИСПОЛНИТЕЛЬНЫЕ НОДЫ

# group: ПЕРЕДАЁМ ИНФОРМАЦИЮ
# note: ПЕРЕДАЁМ ИНФОРМАЦИЮ В РЕВИТ
# note: ПЕРЕДАЁМ ИНФОРМАЦИЮ ЕЩЁ КУДА-ТО

# group: ЗАПАСНЫЕ ВАРИАНТЫ, ДОПОЛНИТЕЛЬНЫЕ ОПЦИИ
# note: ЗАПАСНЫЕ
# note: ДОПОЛНИТЕЛЬНЫЕ. Градации серово по важности, темнее - важнее

# group: ПРИМЕЧАНИЯ ПО ЦВЕТОВОЙ ГРУППИРОВКЕ
# note: GUIDELINES

# group: КЛЮЧЕВЫЕ МОМЕНТЫ РАБОТЫ 2
# note: УСЛОЖНЕННЫЕ КОНСТРУКЦИИ
# note: УСЛОЖНЕНЫЕ КОНСТРУКЦИИ

# group: Python ноды
# note: Python

# group: ЭЛЕМЕНТЫ УПРАВЛЕНИЯ 2 УРОВЕНЬ
# note: ЭЛЕМЕНТЫ УПРАВЛЕНИЯ
# note: ПЕРЕМЕННЫЕ ЗНАЧЕНИЯ

# group: Запуск питона из внешнего файла
# note: Py - files

# group: Get Revit Selection:
forceChildrensEval = ForceChildrensEval()  # frozen; unwired: arg0
pys_get_revit_selection = Python(IN[0]=forceChildrensEval)
# ---------- pys_get_revit_selection.python (22 lines) ----------
import clr
clr.AddReference('RevitServices')
clr.AddReference('RevitAPI')
from Autodesk.Revit.DB import *
import RevitServices
from RevitServices.Persistence import DocumentManager
from Autodesk.Revit.ApplicationServices import Application

reset = IN[0]

doc = DocumentManager.Instance.CurrentDBDocument
uidoc = DocumentManager.Instance.CurrentUIApplication.ActiveUIDocument
ids = uidoc.Selection.GetElementIds()

idd = [str(i) for i in ids]

if isinstance(idd, list) == True:
	elems = [doc.GetElement(ElementId(int(i))) for i in idd]
else:
	elems = doc.GetElement(ElementId(int(idd)))

OUT = elems
# ----------------------------------------

parameters = Element.Parameters()  # unwired: arg0
geometry = Element.Geometry()  # unwired: arg0
setParameterByName = Element.SetParameterByName()  # unwired: element, parameterName, value
getParameterValueByName = Element.GetParameterValueByName()  # unwired: element, parameterName

# group: Parameters name from language
parameters_name_from_language = Python()  # frozen
# ---------- parameters_name_from_language.python (18 lines) ----------
import clr
clr.AddReference('RevitServices')
import RevitServices
from RevitServices.Persistence import DocumentManager

uiapp = DocumentManager.Instance.CurrentUIApplication
app = uiapp.Application
lng = app.Language
rus = ["Тип","Имя семейства","Имя типа"]
enu = ["Type","Family name","Type name"]
out = []
if str(lng) == "Russian":
	out = rus
else:
	out = enu
#English_USA
#Russian
OUT = out
# ----------------------------------------

# group: элементы внутри групп
members = Python()  # "Group.Members"; frozen; unwired: IN[0]
# ---------- members.python (19 lines) ----------
import clr
clr.AddReference('RevitAPI')
from Autodesk.Revit.DB import *

clr.AddReference("RevitNodes")
import Revit
clr.ImportExtensions(Revit.Elements)

groups = UnwrapElement(IN[0])
elementlist = list()
for item in groups:
	try:
		memberlist = list()
		for member in item.GetMemberIds():
			memberlist.append(item.Document.GetElement(member))
		elementlist.append(memberlist)
	except:
		elementlist.append(list())
OUT = elementlist
# ----------------------------------------

путь_к_файлу_python = Filename(".\N.Отделка помещений_сбор элементов вокруг_1.7.py")  # frozen
forceChildrensEval_2 = ForceChildrensEval(путь_к_файлу_python)
find_file_and_import_it = Python(IN[0]=forceChildrensEval_2)
# ---------- find_file_and_import_it.python (11 lines) ----------
import sys
sys.path.append('C:\Program Files (x86)\IronPython 2.7\Lib')
import codecs

try:
	filePath = IN[0]
	with codecs.open(filePath, 'rb', "utf-8") as inf:
		lines = inf.readlines()
	OUT = ''.join(lines)
except:
	OUT = "No file"
# ----------------------------------------
python_script_from_string = PythonStringNode(script=find_file_and_import_it)  # unwired: IN[0]
categories = Categories()  # frozen
all_elements_of_category = ElementsOfCategory(categories)
regenerate = Python()  # frozen; unwired: IN[0]
# ---------- regenerate.python (26 lines) ----------
import clr

# Import DocumentManager and TransactionManager
clr.AddReference("RevitServices")
import RevitServices
from RevitServices.Persistence import DocumentManager


# Import RevitAPI
clr.AddReference("RevitAPI")
import Autodesk
from Autodesk.Revit.DB import *

doc = DocumentManager.Instance.CurrentDBDocument


#The inputs to this node will be stored as a list in the IN variable.
list = IN[0]


if list:
	doc.Regenerate()
	out = "Regeneration complete"
else:
	out = "fail"
OUT = out
# ----------------------------------------
members_2 = Python()  # "Object.Members"; frozen; unwired: IN[0]
# ---------- members_2.python (14 lines) ----------
import clr

items = IN[0]
elementlist = list()

try:
	clr.AddReference('RevitAPI')
	from Autodesk.Revit.DB import *
	for item in items:
		elementlist.append(dir(UnwrapElement(item)))
except:
	for item in items:
		elementlist.append(dir(item))
OUT = elementlist
# ----------------------------------------
filteredElementCollector = Python()  # frozen; unwired: IN[0]
# ---------- filteredElementCollector.python (29 lines) ----------
if IN[1]:
	import clr
	
	# Import DocumentManager and TransactionManager
	clr.AddReference("RevitServices")
	import RevitServices
	from RevitServices.Persistence import DocumentManager
	
	
	# Import RevitAPI
	clr.AddReference("RevitAPI")
	import Autodesk
	from Autodesk.Revit.DB import *
	
	doc = DocumentManager.Instance.CurrentDBDocument
	uiapp = DocumentManager.Instance.CurrentUIApplication
	app = uiapp.Application
	
	from System.Collections.Generic import *
	
	
	#The inputs to this node will be stored as a list in the IN variable.
	dataEnteringNode = IN
	collector = FilteredElementCollector(doc)
	elements = collector.OfCategory(BuiltInCategory.OST_Views).ToElements()
	
	OUT = sheetInstances
else:
	OUT = "скрипт не выполнен"
# ----------------------------------------
boolean = BoolSelector(true)  # frozen
code_block = CodeBlock { 1; 2; }
if_ = Python(IN[0]=boolean, IN[1]=code_block.out0, IN[2]=code_block.out1)
# ---------- if_.python (4 lines) ----------
if IN[0]:
	OUT = UnwrapElement(IN[1])
else:
	OUT = UnwrapElement(IN[2])
# ----------------------------------------
som_dir = Python()  # frozen; unwired: IN[0]
# ---------- som_dir.python (62 lines) ----------
# -*- coding: utf-8 -*- 
#-----------------------Импоорт библиотек----------------------
import clr
clr.AddReference('RevitAPI')
import Autodesk
from Autodesk.Revit.DB import *

clr.AddReference("RevitNodes") 
import Revit
from Revit.Elements import *

clr.ImportExtensions(Revit.Elements) #ToDSType не работает без
clr.ImportExtensions(Revit.GeometryConversion) #ToXyz не работает без

clr.AddReference("RevitServices")
import RevitServices
from RevitServices.Persistence import DocumentManager
from RevitServices.Transactions import TransactionManager

clr.AddReference('ProtoGeometry')
from Autodesk.DesignScript.Geometry import *

#-----------------------ИМПОРТ БИБЛИОТЕК----------------------
"""-"""
#-----------------------ФУНКЦИИ----------------------

def __x__(x):
	x="x"
	return x
	
#-----------------------ФУНКЦИИ----------------------
"""-"""
#-----------------------АПИ ПАРАМЕТРЫ----------------------

doc = DocumentManager.Instance.CurrentDBDocument
#link_doc = UnwrapElement(IN[1])
#uiapp = DocumentManager.Instance.CurrentUIApplication
#app = uiapp.Application
#version = app.VersionNumber
#options = Autodesk.Revit.DB.SpatialElementBoundaryOptions()

#-----------------------АПИ ПАРАМЕТРЫ----------------------
"""-"""
#-----------------------РАБОЧИЕ ПАРАМЕТРЫ----------------------

test1 = UnwrapElement(IN[0])

#-----------------------РАБОЧИЕ ПАРАМЕТРЫ----------------------	
"""-"""
#-----------------------ТЕСТОВЫЕ ПАРАМЕТРЫ----------------------

test = []

#-----------------------ТЕСТОВЫЕ ПАРАМЕТРЫ----------------------
"""-"""
#-----------------------НАЧАЛО СКРИПТА----------------------

#TransactionManager.Instance.EnsureInTransaction(doc)
#TransactionManager.Instance.TransactionTaskDone()
#-----------------------КОНЕЦ СКРИПТА----------------------

OUT = dir(RevitServices.Persistence.DocumentManager.CurrentUIApplication)
# ----------------------------------------
array_i_lambda = Python()  # frozen; unwired: IN[0]
# ---------- array_i_lambda.python (25 lines) ----------
from System import *
from System.Collections.Generic import List

ja_spisok = ["1","2","A","B"]

ja_spisok_spiskov = [["1","2"],["A","B"]]

ja_korteg_kortegey = (("1","2"),("A","B"))

ja_spisok_arrayof = []

for ja in ja_spisok_spiskov:
	ja_spisok_arrayof.append(Array[str](ja))

strArray = Array[Array[str]](ja_spisok_arrayof)

strArray2 = Array[Array[str]](ja_korteg_kortegey)

strArray3 = Array[Array[str]](tuple(tuple(x) for x in ja_spisok_spiskov))

f = lambda x: tuple(x)

strArray4 = Array[Array[str]](f(f(x) for x in ja_spisok_spiskov))

OUT = strArray4
# ----------------------------------------
select_model_element = DSModelElementSelection()
select_model_element_2 = DSModelElementSelection()
linkelemid_by_tag = Python(IN[0]=select_model_element, IN[1]=select_model_element_2)
# ---------- linkelemid_by_tag.python (80 lines) ----------
# -*- coding: utf-8 -*- 
#-----------------------Импоорт библиотек----------------------
import clr
clr.AddReference('RevitAPI')
import Autodesk
from Autodesk.Revit.DB import *

clr.AddReference("RevitNodes") 
import Revit
from Revit.Elements import *

clr.ImportExtensions(Revit.Elements) #ToDSType не работает без
clr.ImportExtensions(Revit.GeometryConversion) #ToXyz не работает без

clr.AddReference("RevitServices")
import RevitServices
from RevitServices.Persistence import DocumentManager
from RevitServices.Transactions import TransactionManager

clr.AddReference('ProtoGeometry')
from Autodesk.DesignScript.Geometry import *

import System
clr.AddReference('System')
from System.Collections.Generic import List

#-----------------------ИМПОРТ БИБЛИОТЕК----------------------
"""-"""
#-----------------------ФУНКЦИИ----------------------

def __x__(x):
	x="x"
	return x
	
#-----------------------ФУНКЦИИ----------------------
"""-"""
#-----------------------АПИ ПАРАМЕТРЫ----------------------

#doc = DocumentManager.Instance.CurrentDBDocument
#link_doc = UnwrapElement(IN[1])
#uiapp = DocumentManager.Instance.CurrentUIApplication
#app = uiapp.Application
#version = app.VersionNumber
#options = Autodesk.Revit.DB.SpatialElementBoundaryOptions()

#g_id_list = []
#g_id_list.append(ElementId(group))

#bxList = List[ElementId](g_id_list) #АЙ ЛИСТ КОЛЕКТИОН
#move = Transform.CreateTranslation(-wall.Orientation*2) #смещение
#cl.CreateTransformed(move)

#-----------------------АПИ ПАРАМЕТРЫ----------------------
"""-"""
#-----------------------РАБОЧИЕ ПАРАМЕТРЫ----------------------
link_inst = UnwrapElement(IN[0])
#loc_elem = UnwrapElement(IN[1])

#doc = DocumentManager.Instance.CurrentDBDocument

link_doc = link_inst.GetLinkDocument()
link_walls = FilteredElementCollector(link_doc).OfCategory(BuiltInCategory.OST_Walls).ToElements()
link_tags = FilteredElementCollector(link_doc).OfClass(IndependentTag)


tag_ids = []
linked_ids = []
linkins_ids = []
host_ids = []

for w in link_tags:
	tag_ids.append(w.TaggedElementId)
	linked_ids.append(w.TaggedElementId.LinkedElementId.ToString())
	linkins_ids.append(w.TaggedElementId.LinkInstanceId.ToString())
	host_ids.append(w.TaggedElementId.HostElementId)
	
link_elem = link_doc.GetElement(host_ids[0])


OUT = link_walls, ', '.join(linked_ids), ', '.join(linkins_ids), host_ids, link_elem
# ----------------------------------------
pick_object = Python()  # frozen; unwired: IN[0]
# ---------- pick_object.python (26 lines) ----------
#Copyright(c) 2016, Dimitar Venkov
# @5devene, dimitar.ven@gmail.com

import clr

clr.AddReference("RevitAPIUI")
from  Autodesk.Revit.UI import *

clr.AddReference("RevitServices")
import RevitServices
from RevitServices.Persistence import DocumentManager
doc = DocumentManager.Instance.CurrentDBDocument
uidoc=DocumentManager.Instance.CurrentUIApplication.ActiveUIDocument

clr.AddReference("RevitNodes")
import Revit
clr.ImportExtensions(Revit.Elements)

sel1 = uidoc.Selection
ot1 = Selection.ObjectType.Element
ot2 = Selection.ObjectType.LinkedElement
li_ref = sel1.PickObject(ot1, "Select a link instance first.")
el_ref = sel1.PickObject(ot2, "Pick a linked element.")
Link1 = doc.GetElement(li_ref.ElementId)
LinkDoc = Link1.GetLinkDocument()
OUT = LinkDoc.GetElement(el_ref.LinkedElementId).ToDSType(True)
# ----------------------------------------
forceChildrensEval_3 = ForceChildrensEval(select_model_element)
linkelemid_by_tag_2 = Python(IN[0]=forceChildrensEval_3, IN[1]=select_model_element_2)
# ---------- linkelemid_by_tag_2.python (117 lines) ----------
# -*- coding: utf-8 -*- 
#-----------------------Импоорт библиотек----------------------
import clr
clr.AddReference('RevitAPI')
import Autodesk
from Autodesk.Revit.DB import *

clr.AddReference("RevitNodes") 
import Revit
from Revit.Elements import *

clr.ImportExtensions(Revit.Elements) #ToDSType не работает без
clr.ImportExtensions(Revit.GeometryConversion) #ToXyz не работает без

clr.AddReference("RevitServices")
import RevitServices
from RevitServices.Persistence import DocumentManager
from RevitServices.Transactions import TransactionManager

clr.AddReference('ProtoGeometry')
from Autodesk.DesignScript.Geometry import *

import System
clr.AddReference('System')
from System.Collections.Generic import List

#-----------------------ИМПОРТ БИБЛИОТЕК----------------------
"""-"""
#-----------------------ФУНКЦИИ----------------------

def __x__(x):
	x="x"
	return x
	
#-----------------------ФУНКЦИИ----------------------
"""-"""
#-----------------------АПИ ПАРАМЕТРЫ----------------------

#doc = DocumentManager.Instance.CurrentDBDocument
#link_doc = UnwrapElement(IN[1])
#uiapp = DocumentManager.Instance.CurrentUIApplication
#app = uiapp.Application
#version = app.VersionNumber
#options = Autodesk.Revit.DB.SpatialElementBoundaryOptions()

#g_id_list = []
#g_id_list.append(ElementId(group))

#bxList = List[ElementId](g_id_list) #АЙ ЛИСТ КОЛЕКТИОН
#move = Transform.CreateTranslation(-wall.Orientation*2) #смещение
#cl.CreateTransformed(move)

#-----------------------АПИ ПАРАМЕТРЫ----------------------
"""-"""
#-----------------------РАБОЧИЕ ПАРАМЕТРЫ----------------------
link_inst = UnwrapElement(IN[0])
loc_elem = UnwrapElement(IN[1])

doc = DocumentManager.Instance.CurrentDBDocument
uidoc = DocumentManager.Instance.CurrentUIDocument

link_doc = link_inst.GetLinkDocument()
#walls = FilteredElementCollector(doc).OfCategory(BuiltInCategory.OST_Walls).ToElements()
link_tags = FilteredElementCollector(doc).OfClass(IndependentTag)

test = []
tag_ids = []
linked_ids = []
linkins_ids = []
host_ids = []

opt = Options()
opt.ComputeReferences = True

view = doc.ActiveView

elems_list = []

for w in link_tags:
	tag_elem_id = w.TaggedElementId
	#tag_ids.append(w.TaggedLocalElementId)
	linked_ids.append(tag_elem_id.LinkedElementId)
	#linkins_ids.append(tag_elem_id.LinkInstanceId.ToString())
	#host_ids.append(tag_elem_id.HostElementId)
	
#link_elem_geom = link_doc.GetElement(linked_ids[0]).get_Geometry(opt)#.GetReferences()
#elem_geom2 = doc.GetElement(walls[4].Id).Geometry[opt]
for g in linked_ids:
	elems_list.append(link_doc.GetElement(g))
	
#geom_centr_point = link_elem_geom.ComputeCentroid()
#uidoc.ShowElements(link_elem)
#ref_insp = ReferenceIntersector(linked_ids[0], FindReferenceTarget.Element, view )
#ref_contx = ref_insp.FindNearest(test[0],test[0].Multiply(3))
elem = elems_list[1]

if elem.Location.GetType() == LocationCurve:
	location = elem.Location.Curve.Evaluate(0.5, True)
elif elem.Location.GetType() == LocationPoint:
	location = elem.Location.Point
ref = Reference(elem).CreateLinkReference(link_inst)

TransactionManager.Instance.EnsureInTransaction(doc)

"""#2019
newtag = IndependentTag.Create(doc,view.Id,ref,True,TagMode.TM_ADDBY_CATEGORY,TagOrientation.Horizontal,location)
"""
#2017 не работает для связанных файлов
newtag = doc.Create.NewTag(view, elem, False, TagMode.TM_ADDBY_CATEGORY, TagOrientation.Horizontal, location)

TransactionManager.Instance.EnsureInTransaction(doc)

#TransactionManager.Instance.TransactionTaskDone()
#newtag= doc.NewTag(view,elems_list[0],True,TagMode.TM_ADDBY_CATEGORY,TagOrientation.Horizontal,centr)


OUT = newtag
# ----------------------------------------
select_model_element_3 = DSModelElementSelection()
linkelemid_by_tag_3 = Python(IN[0]=forceChildrensEval_3)
# ---------- linkelemid_by_tag_3.python (70 lines) ----------
# -*- coding: utf-8 -*- 
#-----------------------Импоорт библиотек----------------------
import clr
clr.AddReference('RevitAPI')
import Autodesk
from Autodesk.Revit.DB import *

clr.AddReference("RevitNodes") 
import Revit
from Revit.Elements import *

clr.ImportExtensions(Revit.Elements) #ToDSType не работает без
clr.ImportExtensions(Revit.GeometryConversion) #ToXyz не работает без

clr.AddReference("RevitServices")
import RevitServices
from RevitServices.Persistence import DocumentManager
from RevitServices.Transactions import TransactionManager

clr.AddReference('ProtoGeometry')
from Autodesk.DesignScript.Geometry import *

import System
clr.AddReference('System')
from System.Collections.Generic import List

#-----------------------ИМПОРТ БИБЛИОТЕК----------------------
"""-"""
#-----------------------ФУНКЦИИ----------------------

def __x__(x):
	x="x"
	return x
	
#-----------------------ФУНКЦИИ----------------------
"""-"""
#-----------------------АПИ ПАРАМЕТРЫ----------------------

doc = DocumentManager.Instance.CurrentDBDocument
#link_doc = UnwrapElement(IN[1])
#uiapp = DocumentManager.Instance.CurrentUIApplication
#app = uiapp.Application
#version = app.VersionNumber
#options = Autodesk.Revit.DB.SpatialElementBoundaryOptions()

#g_id_list = []
#g_id_list.append(ElementId(group))

#bxList = List[ElementId](g_id_list) #АЙ ЛИСТ КОЛЕКТИОН
#move = Transform.CreateTranslation(-wall.Orientation*2) #смещение
#cl.CreateTransformed(move)

#-----------------------АПИ ПАРАМЕТРЫ----------------------
"""-"""
#-----------------------РАБОЧИЕ ПАРАМЕТРЫ----------------------
link_inst = UnwrapElement(IN[0])
#loc_elem = UnwrapElement(IN[1])
bsp = FilteredElementCollector(doc).OfClass(BasePoint).ToElements()
bsp0 = bsp[0]
test = []
#doc = DocumentManager.Instance.CurrentDBDocument
#p_bsp = List[LocationPoint]([p.Location for p in bsp])
for bsp0 in bsp:
	x = bsp0.get_Parameter(BuiltInParameter.BASEPOINT_EASTWEST_PARAM).AsDouble()
	y = bsp0.get_Parameter(BuiltInParameter.BASEPOINT_NORTHSOUTH_PARAM).AsDouble()
	z = bsp0.get_Parameter(BuiltInParameter.BASEPOINT_ELEVATION_PARAM).AsDouble()
	new_point = XYZ(x,y,z)
	test.append(new_point.ToPoint())
	
OUT = test
# ----------------------------------------
code_block_2 = CodeBlock { Coordinates.BasePoint(); }
select_link_file = DSModelElementSelection()
forceChildrensEval_4 = ForceChildrensEval(select_link_file)
preselectedLinkElement = Python(IN[0]=forceChildrensEval_4)
# ---------- preselectedLinkElement.python (55 lines) ----------
import clr

clr.AddReference("System")
from System.Collections.Generic import List

clr.AddReference("RevitAPIUI")
from  Autodesk.Revit.UI import *
from  Autodesk.Revit.UI.Selection import ISelectionFilter

import clr
clr.AddReference('RevitAPI')
import Autodesk
from Autodesk.Revit.DB import *

clr.AddReference("RevitServices")
import RevitServices
from RevitServices.Persistence import DocumentManager
from RevitServices.Transactions import TransactionManager

clr.AddReference("RevitNodes")
import Revit
clr.ImportExtensions(Revit.Elements)

class iSF(ISelectionFilter):
	def AllowElement(self, element):
		return True
	def AllowReference(self, refer, point):
		return True

doc = DocumentManager.Instance.CurrentDBDocument
uidoc = DocumentManager.Instance.CurrentUIApplication.ActiveUIDocument

link = UnwrapElement(IN[0])

#el_ref = UnwrapElement(sel1.PickObjects(ot2, "Select the linked elements and press Finish."))

LinkDoc = link.GetLinkDocument()
#walls = FilteredElementCollector(LinkDoc).OfCategory(BuiltInCategory.OST_Walls).ToElementIds()
walls2 = FilteredElementCollector(LinkDoc).OfCategory(BuiltInCategory.OST_Walls).ToElements()
ref_list = []
for elem in walls2:
	ref_list.append(Reference(elem).CreateLinkReference(link))

ilisrt_ref = List[Reference](ref_list)

#newids = [LinkElementId(link.Id,w) for w in walls]
#newids2 = [nw.LinkedElementId for nw in newids]
#ilist = List[ElementId](newids2)

sel1 = uidoc.Selection
ot2 = Selection.ObjectType.LinkedElement
#sel1.SetElementIds(ilist)
sel1.PickObjects(ot2,iSF(),"blablabla",ilisrt_ref)

OUT = 1
# ----------------------------------------
create_annotation_tag_multi = Custom[Create Annotation Tag (Multi-Category)]()  # Note : This method is deprecated in Revit 2019. This node will create an annotation tag at a given location, of given type and in a supplied view. If only single view is supplied then all tags will be created in that view. Multi Category tag and Material Tag have been added to the original node. From archilab; unwired: TagLocations, TagType, Elements, Views
create_independent_tag = Custom[Create Independent Tag]()  # Works only in Revit 2018 and later. This node will create an annotation tag at a given location, of given type and in a supplied view. If only single view is supplied then all tags will be created in that view. The node works also with Linked Elements, Multi Category tag and Material Tag. From archilab; unwired: TagLocations, TagType, Elements, Views
byElementAndLocation = Tag.ByElementAndLocation()  # unwired: view, element, location
create_annotation_tag = Custom[Create Annotation Tag]()  # This node will create an annotation tag at a given location, of given type and in a supplied view. If only single view is supplied then all tags will be created in that view.; unwired: TagLocations, TagType, Elements, Views
array_i_list = Python()  # unwired: IN[0]
# ---------- array_i_list.python (27 lines) ----------
from System import *
from System.Collections.Generic import List

ja_spisok = ["1","2","A","B"]

ja_spisok_spiskov = [["1","2"],["A","B"]]

ja_korteg_kortegey = (("1","2"),("A","B"))

ja_spisok_arrayof = []

for ja in ja_spisok_spiskov:
	ja_spisok_arrayof.append(Array[str](ja))

strArray = Array[Array[str]](ja_spisok_arrayof)

strArray2 = Array[Array[str]](ja_korteg_kortegey)

strArray3 = Array[Array[str]](tuple(tuple(x) for x in ja_spisok_spiskov))

f = lambda x: tuple(x)

strArray4 = Array[Array[str]](f(f(x) for x in ja_spisok_spiskov))

strArray0 = Array[str](("1","2"))

OUT = list(strArray0),list(ja_spisok),[x for x in strArray3]
# ----------------------------------------

# group: Get Revit Selection:
# note: ВСЁ ОСТАЛЬНОЕ
forceChildrensEval_5 = ForceChildrensEval()  # unwired: arg0
pys_get_revit_selection_2 = Python(IN[0]=forceChildrensEval_5)  # same code as pys_get_revit_selection

parameters_2 = Element.Parameters(pys_get_revit_selection_2)
geometry_2 = Element.Geometry(pys_get_revit_selection_2)
select_model_elements = DSModelElementsSelection()
forceChildrensEval_6 = ForceChildrensEval(select_model_elements)
som_workset = Python(IN[0]=forceChildrensEval_6)
# ---------- som_workset.python (30 lines) ----------
# -*- coding: utf-8 -*- 
#-----------------------Импоорт библиотек----------------------
import clr
clr.AddReference('RevitAPI')
import Autodesk
from Autodesk.Revit.DB import *

clr.AddReference("RevitNodes") 
import Revit
from Revit.Elements import *

clr.ImportExtensions(Revit.Elements) #ToDSType не работает без
clr.ImportExtensions(Revit.GeometryConversion) #ToXyz не работает без

clr.AddReference("RevitServices")
import RevitServices
from RevitServices.Persistence import DocumentManager
from RevitServices.Transactions import TransactionManager

clr.AddReference('ProtoGeometry')
from Autodesk.DesignScript.Geometry import *

doc = DocumentManager.Instance.CurrentDBDocument
wt = doc.GetWorksetTable()
walls = UnwrapElement(IN[0])

worksets_name = [wt.GetWorkset(e.WorksetId).Name for e in walls]
worksets = [wt.GetWorkset(e.WorksetId) for e in walls]

OUT = worksets,worksets_name
# ----------------------------------------
type = archilab.Revit.Elements.Elements.Type(forceChildrensEval_6)
som_workset_2 = Python(IN[0]=type)
# ---------- som_workset_2.python (36 lines) ----------
# -*- coding: utf-8 -*- 
#-----------------------Импоорт библиотек----------------------
import clr
clr.AddReference('RevitAPI')
import Autodesk
from Autodesk.Revit.DB import *

clr.AddReference("RevitNodes") 
import Revit
from Revit.Elements import *

clr.ImportExtensions(Revit.Elements) #ToDSType не работает без
clr.ImportExtensions(Revit.GeometryConversion) #ToXyz не работает без

clr.AddReference("RevitServices")
import RevitServices
from RevitServices.Persistence import DocumentManager
from RevitServices.Transactions import TransactionManager

clr.AddReference('ProtoGeometry')
from Autodesk.DesignScript.Geometry import *

doc = DocumentManager.Instance.CurrentDBDocument
wt = doc.GetWorksetTable()
walls = UnwrapElement(IN[0])
worksets = []
#worksets_name = [wt.GetWorkset(e.WorksetId).Name for e in walls]
#worksets = [wt.GetWorkset(e.WorksetId) for e in walls]

for e in walls:
	try:
		worksets.append([e.WorksetId,wt.GetWorkset(e.WorksetId).Name,wt.GetWorkset(e.WorksetId)])
	except:
		pass

OUT = worksets#,worksets_name
# ----------------------------------------
categories_2 = Categories("Grids")
all_elements_of_category_2 = ElementsOfCategory(categories_2)
forceChildrensEval_7 = ForceChildrensEval(all_elements_of_category_2)
n111 = Python(IN[0]=forceChildrensEval_7)  # "111"
# ---------- n111.python (53 lines) ----------
import clr
clr.AddReference('RevitAPI')
import Autodesk
from Autodesk.Revit.DB import *

# Import ToDSType(bool) extension method
clr.AddReference("RevitNodes")
import Revit
clr.ImportExtensions(Revit.Elements)

clr.ImportExtensions(Revit.GeometryConversion)

clr.AddReference('RevitServices')
import RevitServices
from RevitServices.Persistence import DocumentManager
from RevitServices.Transactions import TransactionManager

clr.AddReference('RevitAPIUI')
from  Autodesk.Revit.UI import *

import System
clr.AddReference('System')
from System.Collections.Generic import List

doc = DocumentManager.Instance.CurrentDBDocument

def tolist(obj1):
    if hasattr(obj1,'__iter__'): return obj1
    else: return [obj1]

grids=UnwrapElement(IN[0])
Ref=[]
test = []
test1 = List[Curve]()

opt=Options()
opt.ComputeReferences=True
opt.IncludeNonVisibleObjects=True
#opt.View=doc.ActiveView

for grid in grids:
	test.append(grid.Curve.ToProtoType())
	#test1.Add(grid.Curve)
	"""
	for obj in grid.get_Geometry(opt):
		if isinstance(obj, Line):
			gline = obj
			Ref.append(gline.Reference)

for t in test1:
	test.append(t.ToProtoType())
	"""	
OUT = test
# ----------------------------------------
geometry_3 = Element.Geometry()  # unwired: arg0
categories_3 = Categories("Rooms")
all_elements_of_category_3 = ElementsOfCategory(categories_3)
forceChildrensEval_8 = ForceChildrensEval(all_elements_of_category_3)
solids = Element.Solids(forceChildrensEval_8)
