# Dynamo graph П.Параметр запись из других.dyn (Dynamo 1.3.2.2480)

# note: Фильтрация по заданным параметрам

categories = Categories("Windows")
all_elements_of_category = ElementsOfCategory(categories)
parameters = Element.Parameters(all_elements_of_category)
id = Element.Id(all_elements_of_category)
sort = List.Sort(id)
eq = id == sort
uniqueItems = List.UniqueItems(eq)
code_block = CodeBlock { "Обозначение"; "2003"; }
getParameterValueByName = Element.GetParameterValueByName(element=all_elements_of_category, parameterName=code_block.out0)
contains = String.Contains(str=getParameterValueByName, searchFor=code_block.out1)
filterByBoolMask = List.FilterByBoolMask(list=all_elements_of_category, mask=contains)
# note: Собираем помещения, фильтр по помещениям, запись в параметр помещения
code_block_2 = CodeBlock { "Высота"; "Ширина"; }
getParameterValueByName_2 = Element.GetParameterValueByName(element=filterByBoolMask.in, parameterName=code_block_2.out0)
replace = String.Replace()  # unwired: str, searchFor, replaceWith
lastIndexOf = String.LastIndexOf(replace)  # unwired: arg1
string_from_object = FromObject(lastIndexOf)
replace_2 = String.Replace(str=string_from_object)  # unwired: searchFor, replaceWith
toNumber = String.ToNumber(replace_2)
getParameterValueByName_3 = Element.GetParameterValueByName(parameterName=code_block.out0)  # unwired: element
contains_2 = String.Contains(str=getParameterValueByName_3, searchFor=code_block.out1)
filterByBoolMask_2 = List.FilterByBoolMask(mask=contains_2)  # unwired: list
# note: Работа с значением параметра
code_block_3 = CodeBlock(x=lastIndexOf) { x+1; }
remove = String.Remove(str=replace, count=code_block_3)  # unwired: startIndex
toNumber_2 = String.ToNumber(remove)
setParameterByName = Element.SetParameterByName(value=toNumber_2)  # unwired: element, parameterName
code_block_4 = CodeBlock { "Описание"; "алкон"; }
getParameterValueByName_4 = Element.GetParameterValueByName(element=filterByBoolMask.in, parameterName=code_block_2.out1)
code_block_5 = CodeBlock(Ч=getParameterValueByName_4) { (Ч/100); }
floor = Math.Floor(code_block_5)
code_block_6 = CodeBlock(ч=floor) { ч*100; }
