# Dynamo graph Проверка нулевой точки.dyn (Dynamo 1.3.3.4111)

byCoordinates = Point.ByCoordinates()
code_block = CodeBlock { 2600; 4850; }
byCoordinates_2 = Point.ByCoordinates(x=code_block.out0, y=code_block.out1)
byStartPointEndPoint = Line.ByStartPointEndPoint(startPoint=byCoordinates, endPoint=byCoordinates_2)
