# Dynamo graph Убираем из топоповерхности точки больше заданной.dyn (Dynamo 1.3.0.875)

выбрать_элемент = DSModelElementSelection()  # 1 picked in the model
points = Topography.Points(выбрать_элемент)
Z = Point.Z(points)
высотная_отметка = DoubleInput(154.5)
le = Z <= высотная_отметка
filterByBoolMask = List.FilterByBoolMask(list=points, mask=le)
byPoints = Topography.ByPoints(filterByBoolMask.in)
code_block = CodeBlock { "Имя"; }
getParameterValueByName = Element.GetParameterValueByName(element=выбрать_элемент, parameterName=code_block)
прификс_для_имени_поверхности = StringInput("(fix)")
code_block_2 = CodeBlock(ч=getParameterValueByName, ашч=прификс_для_имени_поверхности) { ч+ашч; }
setParameterByName = Element.SetParameterByName(element=byPoints, parameterName=code_block, value=code_block_2)
code_block_3 = CodeBlock { 154.5; }
